# Grasshopper definition Parametric auger.gh (Grasshopper 0.9.76)

milling_preview_position = Slider(0.008, range=0..1)
enable_union_of_shapes = BooleanToggle(False)
outer_diameter = Panel(Slider(20, range=0..100))
number_of_sample_points = Panel("24")
pitch_ratio = Panel(Slider(1.5, range=0..10))
helix_length = Panel(Slider(150, range=0..1000))
helix_thickness_ratio = Panel(Slider(0.2, range=0..1))
feed_section_diameter_ratio = Panel(Slider(0.4, range=0..1))
metering_section_diameter_ratio = Panel(Slider(0.6, range=0..1))
feed_section_length_ratio = Panel(Slider(0.651, range=0..1))
metering_section_length_ratio = Panel(Slider(0.683, range=0..1))
multiplication = Multiplication(A=outer_diameter, B="0.5")
multiplication_2 = Multiplication(A=helix_length, B=feed_section_length_ratio)
multiplication_3 = Multiplication(A=helix_length, B=metering_section_length_ratio)
multiplication_4 = Multiplication(A=multiplication, B=metering_section_diameter_ratio)
multiplication_5 = Multiplication(A=multiplication, B=feed_section_diameter_ratio)
neg = Negative(Value=multiplication_2)
pt = ConstructPoint(XCoordinate=multiplication_4, YCoordinate=0, ZCoordinate=0)
multiplication_6 = Multiplication(A=multiplication, B=pitch_ratio)
pt_2 = ConstructPoint(XCoordinate=multiplication_5, YCoordinate=0, ZCoordinate=helix_length)
xy = XYPlane(Origin=Point(0, 0, 0))
Z = UnitZ(Factor=neg)
Z_2 = UnitZ(Factor=multiplication_3)
division = Division(A=multiplication_6, B=number_of_sample_points)
cir = Circle(Plane=xy, Radius=multiplication)
division_2 = Division(A=helix_length, B=multiplication_6)
round = Round(Number=division_2)  # -> Nearest, Floor, Ceiling
series = Series(Start=0, Step=division, Count=number_of_sample_points)
bzspan = BezierSpan(StartPoint=pt, StartTangent=Z_2, EndPoint=pt_2, EndTangent=Z)  # -> Curve, Length, Domain
pt_3 = ConstructPoint(XCoordinate=0, YCoordinate=0, ZCoordinate=0)
pt_4 = ConstructPoint(XCoordinate=0, YCoordinate=0, ZCoordinate="0.5")
divide = DivideCurve(Curve=cir, Count=number_of_sample_points, Kinks=False)  # -> Points, Tangents, Parameters
Z_3 = UnitZ(Factor=series)
ln = Line(StartPoint=pt_3, EndPoint=pt_4)
revsrf = Revolution(Curve=bzspan.Curve, Axis=ln, Domain=Domain(0, 6.283185307))
move = Move(Geometry=divide.Points, Motion=Z_3)  # -> Geometry, Transform
series_2 = Series(Start=0, Step=multiplication_6, Count=round.Ceiling)
Z_4 = UnitZ(Factor=series_2)
number_slider = Slider(4, range=0..10)
move_2 = Move(Geometry=graft(move.Geometry), Motion=Z_4)  # -> Geometry, Transform
multiplication_7 = Multiplication(A=multiplication, B=helix_thickness_ratio)
flip = FlipMatrix(Data=move_2.Geometry)
subtraction = Subtraction(A=helix_length, B=multiplication_7)
flatten = FlattenTree(Tree=flip, Path="{0}")
pt_5 = ConstructPoint(XCoordinate=0, YCoordinate=0, ZCoordinate=subtraction)
intcrv = Interpolate(Vertices=flatten, Degree=3, Periodic=False, KnotStyle=1)  # -> Curve, Length, Domain
xy_2 = XYPlane(Origin=pt_5)
pcx = CurvePlane(Curve=intcrv.Curve, Plane=xy_2)  # -> Points, ParamsC, ParamsP
shatter = Shatter(Curve=intcrv.Curve, Parameters=pcx.ParamsC)
Z_5 = UnitZ(Factor=multiplication_7)
item = ListItem(List=shatter, Index=0, Wrap=True)
move_3 = Move(Geometry=item, Motion=Z_5)  # -> Geometry, Transform
lng = ListLength(List=flatten)
crv = Curve(item)
crv_2 = Curve(move_3.Geometry)
srf = Surface(revsrf)
divide_2 = DivideCurve(Curve=crv_2, Count=lng, Kinks=False)  # -> Points, Tangents, Parameters
divide_3 = DivideCurve(Curve=crv, Count=lng, Kinks=False)  # -> Points, Tangents, Parameters
srf_cp = SurfaceClosestPoint(Point=divide_2.Points, Surface=srf)  # -> Point, UVPoint, Distance
srf_cp_2 = SurfaceClosestPoint(Point=divide_3.Points, Surface=srf)  # -> Point, UVPoint, Distance
intcrv_2 = Interpolate(Vertices=srf_cp.Point, Degree=3, Periodic=False, KnotStyle=1)  # -> Curve, Length, Domain
ln_2 = Line(StartPoint=divide_2.Points, EndPoint=srf_cp.Point)
intcrv_3 = Interpolate(Vertices=srf_cp_2.Point, Degree=3, Periodic=False, KnotStyle=1)  # -> Curve, Length, Domain
ln_3 = Line(StartPoint=divide_3.Points, EndPoint=srf_cp_2.Point)
pull = PullCurve(Curve=intcrv_2.Curve, Surface=srf)
crv_3 = Curve(pull)
pull_2 = PullCurve(Curve=intcrv_3.Curve, Surface=srf)
crv_4 = Curve(pull_2)
end = EndPoints(Curve=crv_3)  # -> Start, End
end_2 = EndPoints(Curve=crv_4)  # -> Start, End
swp2 = Sweep2(Rail1=pull, Rail2=crv_2, Sections=ln_2, SameHeight=True)
swp2_2 = Sweep2(Rail1=pull_2, Rail2=crv, Sections=ln_3, SameHeight=True)
xz = XZPlane(Origin=end.Start)
xz_2 = XZPlane(Origin=end_2.End)
loft = Loft(Curves=[swp2_2, swp2], Options={Adjust=False, Closed=False, LoftEnds=0, LoftSimp=0, LoftType=0, Rebuild=10, Refit=0.01})
pcx_2 = CurvePlane(Curve=crv_4, Plane=xz)  # -> Points, ParamsC, ParamsP
milling_bit_diamter = Panel("6")
pcx_3 = CurvePlane(Curve=crv_3, Plane=xz_2)  # -> Points, ParamsC, ParamsP
brep = Brep(srf)
brep_2 = Brep([loft, swp2_2, swp2])
stepover = Panel(Slider(0.372, range=0..1))
offset = Offset(Surface=srf, Distance=Slider(0.01, range=0..0.01), Retrim=True)
rev = ReverseList(List=pcx_3.ParamsC)
cap = CapHoles(Brep=offset)
item_2 = ListItem(List=pcx_2.ParamsC, Index="2", Wrap=True)
multiplication_8 = Multiplication(A=milling_bit_diamter, B="0.5")
multiplication_9 = Multiplication(A=milling_bit_diamter, B=stepover)
item_3 = ListItem(List=rev, Index="2", Wrap=True)
shatter_2 = Shatter(Curve=crv_4, Parameters=item_2)
milling_bit_radius = Panel(multiplication_8)
shatter_3 = Shatter(Curve=crv_3, Parameters=item_3)
filter = StreamFilter(Gate=enable_union_of_shapes, Stream1=brep_2)
filter_2 = StreamFilter(Gate=enable_union_of_shapes, Stream1=cap)
preview = CustomPreview(Geometry=[brep_2, brep, cap], Shader=ColourSwatch(SwatchColor=RGB(112, 112, 112)))
item_4 = ListItem(List=shatter_2, Index="1", Wrap=True)
item_5 = ListItem(List=shatter_3, Index="0", Wrap=True)
join = BrepJoin(Breps=flatten(filter))  # -> Breps, Closed
neg_2 = Negative(Value=milling_bit_radius)
Z_6 = UnitZ(Factor=milling_bit_radius)
sunion = SolidUnion(Breps=[join.Breps, filter_2])
Z_7 = UnitZ(Factor=neg_2)
auger_polysurface = Brep(sunion)
auger_polysurface_2 = Brep(auger_polysurface)
move_4 = Move(Geometry=item_5, Motion=Z_6)  # -> Geometry, Transform
move_5 = Move(Geometry=item_4, Motion=Z_7)  # -> Geometry, Transform
loft_2 = Loft(
    Curves=[move_4.Geometry, move_5.Geometry],
    Options={Adjust=False, Closed=False, LoftEnds=0, LoftSimp=0, LoftType=0, Rebuild=10, Refit=0.01})
debrep = DeconstructBrep(Brep=loft_2)  # -> Faces, Edges, Vertices
item_6 = ListItem(List=debrep.Edges, Index=0, Wrap=True)
stepover_distance = Panel(multiplication_9)
len = Length(Curve=item_6)
division_3 = Division(A=len, B=stepover_distance)
round_2 = Round(Number=division_3)  # -> Nearest, Floor, Ceiling
addition = Addition(A="1", B=round_2.Nearest)
division_4 = Division(A="1", B=round_2.Nearest)
series_3 = Series(Start=0, Step=division_4, Count=addition)
tweencrv = TweenCurve(CurveA=move_4.Geometry, CurveB=move_5.Geometry, Factor=series_3, BlendType=0)
dispatch = Dispatch(List=tweencrv, DispatchPattern=[True, False])  # -> ListA, ListB
flip_2 = FlipCurve(Curve=dispatch.ListB)  # -> Curve, Flag
weave = Weave(Pattern=[0, 1], Stream0=dispatch.ListA, Stream1=flip_2.Curve, NullGaps=False)
divide_curve_even_lenght = DivideCurveEvenLenght(crv=weave, B=stepover_distance)
preview_2 = CustomPreview(Geometry=weave, Shader=ColourSwatch(SwatchColor=RGB(112, 238, 255)))
srf_2 = Surface(loft_2)
srf_cp_3 = SurfaceClosestPoint(Point=flatten(divide_curve_even_lenght), Surface=srf_2)  # -> Point, UVPoint, Distance
evalsrf = EvaluateSurface(Surface=srf_2, Point=srf_cp_3.UVPoint)  # -> Point, Normal, Frame
Z_8 = UnitZ(Factor=1)
align = AlignPlane(Plane=evalsrf.Frame, Direction=Z_8)  # -> Plane, Angle
multiplication_10 = Multiplication(A=milling_bit_radius, B="10")
xy_3 = XYPlane(Origin=Point(0, 0, 0))
lng_2 = ListLength(List=align.Plane)
neg_3 = Negative(Value=multiplication_10)
multiplication_11 = Multiplication(A=lng_2, B=milling_preview_position)
cyl = Cylinder(Base=xy_3, Radius=milling_bit_radius, Length=neg_3)
item_7 = ListItem(List=align.Plane, Index=multiplication_11, Wrap=True)
cap_2 = CapHoles(Brep=cyl)
orient = Orient(Geometry=cap_2, Source=xy_3, Target=item_7)  # -> Geometry, Transform

# ==== cluster DivideCurveEvenLenght: Calculates approximate curve length for even division
crv = ClusterInput()
crv_2 = Curve(crv)
B = ClusterInput()
len = Length(Curve=crv_2)
division = Division(A=len, B=B)
int = Integer(division)
divide = DivideCurve(Curve=crv_2, Count=int, Kinks=False)  # -> Points, Tangents, Parameters
P = ClusterOutput(divide.Points)
