# Grasshopper definition trochoidal auger milling.gh (Grasshopper 0.9.76)

front_helix = Curve(<curve referenced from the Rhino model>)
rear_helix = Curve(<curve referenced from the Rhino model>)
reference_auger_brep_for_preview = Brep(<brep referenced from the Rhino model>)
ramp_entry_feedrate = Number(25)
milling_bit_diameter = Number(6)
# First point of helix needs to face upward!
lead_in_length = Panel("20")
arc_diameter_factor = Number(3)
straight_arc_extensions = Boolean(True)
make_helical_entry = Boolean(True)
use_climb_milling = Boolean(True)
ramp_angle = Number(4)
stepover = Number(0.1)
feedrate = Number(50)
jograte = Number(60)
end = EndPoints(Curve=rear_helix)  # -> Start, End
end_2 = EndPoints(Curve=front_helix)  # -> Start, End
make_straight_arc_extensions = Panel(straight_arc_extensions)
arc_diameter_factor_2 = Panel(arc_diameter_factor)
jograte_2 = Panel(jograte)
make_helical_entry_ramp = Panel(make_helical_entry)
ramp_angle_2 = Panel(ramp_angle)
use_climb_milling_2 = Panel(use_climb_milling)
milling_bit_diameter_2 = Panel(milling_bit_diameter)
stepover_2 = Panel("0.1")
feedrate_2 = Panel(feedrate)
ramp_feedrate = Panel(ramp_entry_feedrate)
dist = Distance(PointA=end_2.Start, PointB=end.Start)
dist_2 = Distance(PointA=end_2.End, PointB=end.End)
merge = Merge(Data1=dist, Data2=dist_2)
straight = Panel("0")
smooth = Panel("2")
avr = Average(Input=merge)
filter = StreamFilter(Gate=make_straight_arc_extensions, Stream0=smooth, Stream1=straight)
arc_extension_type = Panel(filter)
multiplication = Multiplication(A=milling_bit_diameter_2, B=stepover_2)
subtraction = Subtraction(A=avr, B=milling_bit_diameter_2)
stepover_distance = Panel(multiplication)
arc_diameter = Panel(subtraction)

# ---- group: Make sample planes along helix
front_helix_2 = Curve(front_helix)
rear_helix_2 = Curve(rear_helix)
len = Length(Curve=front_helix_2)
division = Division(A=len, B=stepover_distance)
int = Integer(division)
divide = DivideCurve(Curve=front_helix_2, Count=int, Kinks=False)  # -> Points, Tangents, Parameters
divide_2 = DivideCurve(Curve=rear_helix_2, Count=int, Kinks=False)  # -> Points, Tangents, Parameters
cull_i = CullIndex(List=divide_2.Points, Indices="0", Wrap=True)
cull_i_2 = CullIndex(List=divide.Points, Indices="0", Wrap=True)
front_points = Point(divide.Points)
rear_points = Point(divide_2.Points)
vec2pt = Vector2Pt(PointA=front_points, PointB=rear_points, Unitize=False)  # -> Vector, Length
ln = Line(StartPoint=front_points, EndPoint=rear_points)
eval = EvaluateLength(Curve=ln, Length="0.5", Normalized=True)  # -> Point, Tangent, Parameter
pdecon = Deconstruct(Point=eval.Point)  # -> XComponent, YComponent, ZComponent
pt = ConstructPoint(XCoordinate=0, YCoordinate=0, ZCoordinate=0)
pt_2 = ConstructPoint(XCoordinate=0, YCoordinate=pdecon.YComponent, ZCoordinate=pdecon.ZComponent)
vec2pt_2 = Vector2Pt(PointA=pt, PointB=pt_2, Unitize=False)  # -> Vector, Length
pl = ConstructPlane(Origin=eval.Point, XAxis=vec2pt.Vector, YAxis=vec2pt_2.Vector)
deplane = DeconstructPlane(Plane=pl)  # -> Origin, XAxis, YAxis, ZAxis
pl_2 = ConstructPlane(Origin=eval.Point, XAxis=deplane.ZAxis, YAxis=deplane.XAxis)
toolpath_planes = Plane(pl_2)

# ---- group: Make toolpath arcs
arc_diameter_2 = Panel(arc_diameter)
use_climb_milling_3 = Panel(use_climb_milling_2)
arc_extension_type_2 = Panel(arc_extension_type)
stepover_distance_2 = Panel(stepover_distance)
pi = Pi(Factor=1)
pi_2 = Pi(Factor=1)
multiplication_2 = Multiplication(A=arc_diameter_2, B="0.5")
multiplication_3 = Multiplication(A=pi, B="0.5")
multiplication_4 = Multiplication(A=pi_2, B="-0.5")
xy = XYPlane(Origin=Point(0, 0, 0))
dom = ConstructDomain(DomainStart=multiplication_4, DomainEnd=multiplication_3)
arc = Arc(Plane=xy, Radius=multiplication_2, Angle=dom)  # -> Arc, Length
ext = ExtendCurve(Curve=arc.Arc, Type=arc_extension_type_2, Start=stepover_distance_2, End=stepover_distance_2)
gate = StreamGate(Stream=ext, Gate=use_climb_milling_3)  # -> Target0, Target1
flip = FlipCurve(Curve=gate.Target0)  # -> Curve, Flag
filter_2 = StreamFilter(Gate=use_climb_milling_3, Stream0=flip.Curve, Stream1=gate.Target1)
orient = Orient(Geometry=filter_2, Source=xy, Target=toolpath_planes)  # -> Geometry, Transform
toolpath_arcs = Curve(orient.Geometry)

# ---- group: Make lead in path
lead_in_length_2 = Panel(lead_in_length)
toolpath_planes_2 = Plane(toolpath_planes)
item = ListItem(List=toolpath_planes_2, Index="1", Wrap=True)
item_2 = ListItem(List=toolpath_planes_2, Index=0, Wrap=True)
deplane_2 = DeconstructPlane(Plane=item_2)  # -> Origin, XAxis, YAxis, ZAxis
deplane_3 = DeconstructPlane(Plane=item)  # -> Origin, XAxis, YAxis, ZAxis
pdecon_2 = Deconstruct(Point=deplane_2.Origin)  # -> XComponent, YComponent, ZComponent
pdecon_3 = Deconstruct(Point=deplane_3.Origin)  # -> XComponent, YComponent, ZComponent
pt_3 = ConstructPoint(XCoordinate=pdecon_3.XComponent, YCoordinate=pdecon_3.YComponent, ZCoordinate=0)
pt_4 = ConstructPoint(XCoordinate=pdecon_2.XComponent, YCoordinate=pdecon_2.YComponent, ZCoordinate=0)
vec2pt_3 = Vector2Pt(PointA=pt_3, PointB=pt_4, Unitize=False)  # -> Vector, Length
amp = Amplitude(Vector=vec2pt_3.Vector, Amplitude=lead_in_length_2)
move = Move(Geometry=deplane_2.Origin, Motion=amp)  # -> Geometry, Transform
ln_2 = Line(StartPoint=move.Geometry, EndPoint=deplane_2.Origin)
lead_in_path = Curve(ln_2)

# ---- group: Make sample planes for lead in
lead_in_path_2 = Curve(lead_in_path)
len_2 = Length(Curve=lead_in_path_2)
division_2 = Division(A=len_2, B=stepover_distance)
int_2 = Integer(division_2)
divide_3 = DivideCurve(Curve=lead_in_path_2, Count=int_2, Kinks=False)  # -> Points, Tangents, Parameters
Y = UnitY(Factor=1)
X = UnitX(Factor=1)
rev = Reverse(Vector=X)
pl_3 = ConstructPlane(Origin=divide_3.Points, XAxis=Y, YAxis=rev)
lead_in_toolpath_planes = Plane(pl_3)

# ---- group: Make toolpath arcs
arc_diameter_3 = Panel(arc_diameter)
use_climb_milling_4 = Panel(use_climb_milling_2)
arc_extension_type_3 = Panel(arc_extension_type)
stepover_distance_3 = Panel(stepover_distance)
toolpath_planes_3 = Plane(lead_in_toolpath_planes)
pi_3 = Pi(Factor=1)
pi_4 = Pi(Factor=1)
multiplication_5 = Multiplication(A=arc_diameter_3, B="0.5")
multiplication_6 = Multiplication(A=pi_3, B="0.5")
multiplication_7 = Multiplication(A=pi_4, B="-0.5")
xy_2 = XYPlane(Origin=Point(0, 0, 0))
dom_2 = ConstructDomain(DomainStart=multiplication_7, DomainEnd=multiplication_6)
arc_2 = Arc(Plane=xy_2, Radius=multiplication_5, Angle=dom_2)  # -> Arc, Length
ext_2 = ExtendCurve(Curve=arc_2.Arc, Type=arc_extension_type_3, Start=stepover_distance_3, End=stepover_distance_3)
gate_2 = StreamGate(Stream=ext_2, Gate=use_climb_milling_4)  # -> Target0, Target1
flip_2 = FlipCurve(Curve=gate_2.Target0)  # -> Curve, Flag
filter_3 = StreamFilter(Gate=use_climb_milling_4, Stream0=flip_2.Curve, Stream1=gate_2.Target1)
orient_2 = Orient(Geometry=filter_3, Source=xy_2, Target=toolpath_planes_3)  # -> Geometry, Transform
toolpath_arcs_2 = Curve(orient_2.Geometry)

# ----
z_lift_distance = Panel("0")

# ---- group: Make jog arcs, transtion between each semicircular cut
z_lift_distance_2 = Panel(z_lift_distance)
toolpath_arcs_3 = Curve(toolpath_arcs)
number_slider = Slider(0.5, range=0..1)
shift = ShiftList(List=toolpath_arcs_3, Shift=1, Wrap=False)
shift_2 = ShiftList(List=toolpath_arcs_3, Shift=-1, Wrap=False)
blendc = BlendCurve(CurveA=shift_2, CurveB=shift, BulgeA=number_slider, BulgeB=number_slider, Continuity=1)
blended_transitions = Curve(blendc)
reb = RebuildCurve(Curve=blended_transitions, Count="5", Tangents=False)
multiplication_8 = Multiplication(A="5", B="0.5")
cp = ControlPoints(Curve=reb)  # -> Points, Weights, Knots
int_3 = Integer(multiplication_8)
Z = UnitZ(Factor=z_lift_distance_2)
item_3 = ListItem(List=cp.Points, Index=int_3, Wrap=True)
move_2 = Move(Geometry=item_3, Motion=Z)  # -> Geometry, Transform
replace = ReplaceItems(List=cp.Points, Item=move_2.Geometry, Indices=int_3, Wrap=False)
nurbs = NurbsCurve(Vertices=replace, Degree=3, Periodic=False)  # -> Curve, Length, Domain
jog_arcs = Curve(flatten(nurbs.Curve))

z_lift_distance_3 = Panel(z_lift_distance)
toolpath_arcs_4 = Curve(toolpath_arcs_2)
number_slider_2 = Slider(0.5, range=0..1)
shift_3 = ShiftList(List=toolpath_arcs_4, Shift=1, Wrap=False)
shift_4 = ShiftList(List=toolpath_arcs_4, Shift=-1, Wrap=False)
blendc_2 = BlendCurve(CurveA=shift_4, CurveB=shift_3, BulgeA=number_slider_2, BulgeB=number_slider_2, Continuity=1)
blended_transitions_2 = Curve(blendc_2)
reb_2 = RebuildCurve(Curve=blended_transitions_2, Count="5", Tangents=False)
multiplication_9 = Multiplication(A="5", B="0.5")
cp_2 = ControlPoints(Curve=reb_2)  # -> Points, Weights, Knots
int_4 = Integer(multiplication_9)
Z_2 = UnitZ(Factor=z_lift_distance_3)
item_4 = ListItem(List=cp_2.Points, Index=int_4, Wrap=True)
move_3 = Move(Geometry=item_4, Motion=Z_2)  # -> Geometry, Transform
replace_2 = ReplaceItems(List=cp_2.Points, Item=move_3.Geometry, Indices=int_4, Wrap=False)
nurbs_2 = NurbsCurve(Vertices=replace_2, Degree=3, Periodic=False)  # -> Curve, Length, Domain
jog_arcs_2 = Curve(flatten(nurbs_2.Curve))

# ---- group: Weave cuts and jogs
toolpath_arcs_5 = Curve(toolpath_arcs_2)
jog_arcs_3 = Curve(jog_arcs_2)
rev_2 = ReverseList(List=toolpath_arcs_5)
cull_i_3 = CullIndex(List=rev_2, Indices="0", Wrap=True)
rev_3 = ReverseList(List=cull_i_3)
simplify = SimplifyTree(Tree=jog_arcs_3, Front=False)
simplify_2 = SimplifyTree(Tree=rev_3, Front=False)
match = MatchTree(Tree=simplify, Guide=simplify_2)
weave = Weave(Pattern=[0, 1], Stream0=simplify_2, Stream1=match, NullGaps=False)
shift_paths_if_possible = ShiftPathsIfPossible(data_paths_to_shifts=weave)
toolpaths = Curve(shift_paths_if_possible)

toolpath_arcs_6 = Curve(toolpath_arcs)
jog_arcs_4 = Curve(jog_arcs)
simplify_3 = SimplifyTree(Tree=jog_arcs_4, Front=False)
simplify_4 = SimplifyTree(Tree=toolpath_arcs_6, Front=False)
match_2 = MatchTree(Tree=simplify_3, Guide=simplify_4)
weave_2 = Weave(Pattern=[0, 1], Stream0=simplify_4, Stream1=match_2, NullGaps=False)
shift_paths_if_possible_2 = ShiftPathsIfPossible(data_paths_to_shifts=weave_2)
toolpaths_2 = Curve(shift_paths_if_possible_2)

# ----
join = JoinCurves(Curves=toolpaths, Preserve=False)
tolerance = Panel("0.01")
item_5 = ListItem(List=join, Index=0, Wrap=True)
join_2 = JoinCurves(Curves=toolpaths_2, Preserve=False)
lead_in_milling_toolpath = Curve(item_5)
item_6 = ListItem(List=join_2, Index=0, Wrap=True)
len_3 = Length(Curve=item_6)
auger_milling_toolpath = Curve(item_6)
division_3 = Division(A=len_3, B="50")
panel = Panel(division_3)
tolerance_2 = Panel(tolerance)
lead_in_milling_toolpath_2 = Curve(lead_in_milling_toolpath)
tolerance_3 = Panel(tolerance)
auger_milling_toolpath_2 = Curve(auger_milling_toolpath)
topoly = CurveToPolyline(Curve=lead_in_milling_toolpath_2, ToleranceDistance=tolerance_2, ToleranceAngle=0)  # -> Polyline, Segments
cp_3 = ControlPoints(Curve=topoly.Polyline)  # -> Points, Weights, Knots
flatten = FlattenTree(Tree=cp_3.Points, Path="{0}")
topoly_2 = CurveToPolyline(Curve=auger_milling_toolpath_2, ToleranceDistance=tolerance_3, ToleranceAngle=0)  # -> Polyline, Segments
xy_3 = XYPlane(Origin=flatten)
cp_4 = ControlPoints(Curve=topoly_2.Polyline)  # -> Points, Weights, Knots
lead_in_planes = Plane(xy_3)
rev_4 = ReverseList(List=cp_4.Points)
panel_2 = Panel("""0
1""")
panel_3 = Panel("""0
1""")
cull_i_4 = CullIndex(List=cp_4.Points, Indices="0", Wrap=True)
cull_i_5 = CullIndex(List=cp_4.Points, Indices=panel_2, Wrap=True)
cull_i_6 = CullIndex(List=rev_4, Indices=panel_3, Wrap=True)
rev_5 = ReverseList(List=cull_i_4)
rev_6 = ReverseList(List=cull_i_6)
cull_i_7 = CullIndex(List=rev_5, Indices="0", Wrap=True)
rev_7 = ReverseList(List=cull_i_7)
center_points = Point(rev_7)
front_points_2 = Point(cull_i_5)
rear_points_2 = Point(rev_6)
pl_3pt = Plane3Pt(PointA=center_points, PointB=front_points_2, PointC=rear_points_2)
lead_in_planes_2 = Plane(flatten(lead_in_planes))
auger_planes = Plane(flatten(pl_3pt))
merge_2 = Merge(Data1=lead_in_planes_2, Data2=auger_planes)
deplane_4 = DeconstructPlane(Plane=merge_2)  # -> Origin, XAxis, YAxis, ZAxis
rev_8 = Reverse(Vector=deplane_4.ZAxis)
X_2 = UnitX(Factor=1)
pl_4 = ConstructPlane(Origin=deplane_4.Origin, XAxis=X_2, YAxis=rev_8)
deplane_5 = DeconstructPlane(Plane=pl_4)  # -> Origin, XAxis, YAxis, ZAxis
pl_5 = ConstructPlane(Origin=deplane_5.Origin, XAxis=deplane_5.XAxis, YAxis=deplane_5.ZAxis)
toolpath_4th_axis_normals = Vector(flatten(deplane_4.ZAxis))
toolpath_planes_4 = Plane(flatten(pl_5))

# ---- group: Find 360 degree positions
toolpath_4th_axis_normals_2 = Vector(flatten(toolpath_4th_axis_normals))
item_7 = ListItem(List=toolpath_4th_axis_normals_2, Index=0, Wrap=True)
pt_5 = ConstructPoint(XCoordinate=0, YCoordinate=0, ZCoordinate=0)
amp_2 = Amplitude(Vector=toolpath_4th_axis_normals_2, Amplitude=".5")
Y_2 = UnitY(Factor=1)
move_4 = Move(Geometry=pt_5, Motion=amp_2)  # -> Geometry, Transform
pl_6 = ConstructPlane(Origin=pt_5, XAxis=item_7, YAxis=Y_2)
cir = Circle(Plane=pl_6, Radius=".5")
crv_cp = CurveClosestPoint(Point=move_4.Geometry, Curve=cir)  # -> Point, Parameter, Distance
len_4 = Length(Curve=cir)
division_4 = Division(A=crv_cp.Parameter, B=len_4)
multiplication_10 = Multiplication(A=division_4, B="360")

# ---- group: Find rotational increments
reldif = RelativeDifferences(Values=multiplication_10)

# ----
panel_4 = Panel(multiplication_10)

# ---- group: Clean 360 transitions positive
larger = LargerThan(FirstNumber=reldif, SecondNumber="180")  # -> LargerThan, OrEqualTo
dispatch = Dispatch(List=reldif, DispatchPattern=larger.LargerThan)  # -> ListA, ListB
subtraction_2 = Subtraction(A=dispatch.ListA, B="360")
weave_3 = Weave(Pattern=larger.LargerThan, Stream0=dispatch.ListB, Stream1=subtraction_2, NullGaps=False)

# ----
panel_5 = Panel(reldif)

# ---- group: Clean 360 transitions negative
smaller = SmallerThan(FirstNumber=weave_3, SecondNumber="-180")  # -> SmallerThan, OrEqualTo
dispatch_2 = Dispatch(List=weave_3, DispatchPattern=smaller.SmallerThan)  # -> ListA, ListB
addition = Addition(A=dispatch_2.ListA, B="360")
weave_4 = Weave(Pattern=smaller.SmallerThan, Stream0=dispatch_2.ListB, Stream1=addition, NullGaps=False)

# ----
panel_7 = Panel(weave_4)

# ---- group: Find rotational positions
ma = MassAddition(Input=weave_4)  # -> Result, PartialResults
_4th_axis_rotational_positions = Panel(ma.PartialResults)

# ---- group: Find X, Y and Z axis coordinates
_4th_axis_rotational_positions_2 = Panel(_4th_axis_rotational_positions)
toolpath_planes_5 = Plane(toolpath_planes_4)
yz = YZPlane(Origin=Point(0, 0, 0))
rotate = Rotate(Geometry=toolpath_planes_5, Angle=degrees(_4th_axis_rotational_positions_2), Plane=yz)  # -> Geometry, Transform
deplane_6 = DeconstructPlane(Plane=rotate.Geometry)  # -> Origin, XAxis, YAxis, ZAxis
Y_3 = UnitY(Factor=1)
X_3 = UnitX(Factor=1)
pl_7 = ConstructPlane(Origin=deplane_6.Origin, XAxis=X_3, YAxis=Y_3)
pdecon_4 = Deconstruct(Point=deplane_6.Origin)  # -> XComponent, YComponent, ZComponent
preview_planes = Plane(pl_7)

# ----
preview_toolpath = Slider(0.061202, range=0..1)
preview_planes_2 = Plane(preview_planes)
_4th_axis_rotational_positions_3 = Panel(_4th_axis_rotational_positions)
lead_in_milling_toolpath_3 = Curve(topoly.Polyline)
auger_milling_toolpath_3 = Curve(topoly_2.Polyline)
reference_auger_brep_for_preview_2 = Brep(reference_auger_brep_for_preview)
milling_bit_diameter_3 = Panel(milling_bit_diameter_2)
lng = ListLength(List=preview_planes_2)
z_axis_positions = Panel(pdecon_4.ZComponent)
x_axis_positions = Panel(pdecon_4.XComponent)
y_axis_positions = Panel(pdecon_4.YComponent)
_4th_axis_rotational_positions_4 = Panel(_4th_axis_rotational_positions)
multiplication_11 = Multiplication(A=lng, B=preview_toolpath)
join_3 = JoinCurves(Curves=flatten([auger_milling_toolpath_3, lead_in_milling_toolpath_3]), Preserve=False)
multiplication_12 = Multiplication(A=milling_bit_diameter_3, B="0.5")
mesh = MeshBrep(
    Brep=reference_auger_brep_for_preview_2,
    Settings={GridMaxCount=0, GridMinCount=16, JaggedSeams=False, MaxEdgeLength=0, MinEdgeLength=0.0001, MinTolerance=0, Refine=True, RefineAngle=0, RelativeTolerance=0.65, SimplePlanes=True, Tolerance=0})
xy_4 = XYPlane(Origin=Point(0, 0, 0))
item_8 = ListItem(List=preview_planes_2, Index=multiplication_11, Wrap=True)
yz_2 = YZPlane(Origin=Point(0, 0, 0))
item_9 = ListItem(List=_4th_axis_rotational_positions_3, Index=multiplication_11, Wrap=True)
cyl = Cylinder(Base=xy_4, Radius=multiplication_12, Length=Slider(20, range=0..100))
rotate_2 = Rotate(Geometry=mesh, Angle=degrees(item_9), Plane=yz_2)  # -> Geometry, Transform
rotate_3 = Rotate(Geometry=join_3, Angle=degrees(item_9), Plane=yz_2)  # -> Geometry, Transform
cap = CapHoles(Brep=cyl)
smooth_2 = SettingsQuality()
mesh_2 = MeshBrep(Brep=cap, Settings=smooth_2)
orient_3 = Orient(Geometry=mesh_2, Source=xy_4, Target=item_8)  # -> Geometry, Transform
preview = CustomPreview(Geometry=rotate_3.Geometry, Shader=ColourSwatch(SwatchColor=RGB(0, 242, 255)))
preview_2 = CustomPreview(Geometry=rotate_2.Geometry, Shader=ColourSwatch(SwatchColor=RGB(143, 141, 117)))
preview_3 = CustomPreview(Geometry=orient_3.Geometry, Shader=ColourSwatch(SwatchColor=RGB(94, 93, 93)))

# ==== cluster ShiftPathsIfPossible
data_paths_to_shifts = ClusterInput()
pshift = ShiftPaths(Data=data_paths_to_shifts, Offset=-1)
flatten = FlattenTree(Tree=data_paths_to_shifts, Path="{0}")
flatten_2 = FlattenTree(Tree=pshift, Path="{0}")
clean = CleanTree(RemoveNulls=True, RemoveInvalid=True, RemoveEmpty=False, Tree=flatten_2)
item = ListItem(List=clean, Index=0, Wrap=True)
null = NullItem(Item=item)  # -> NullFlags, InvalidFlags, Description
filter = StreamFilter(Gate=null.NullFlags, Stream0=pshift, Stream1=flatten)
safely_shifted_paths = ClusterOutput(filter)  # Safely shifted paths
