# Grasshopper definition V carved rack and pinion test mill.gh (Grasshopper 0.9.76)

number_slider = Slider(24, range=0..100)
crv = Curve(<curve referenced from the Rhino model>)
crv_2 = Curve([<curve referenced from the Rhino model> x4])
crv_3 = Curve([<curve referenced from the Rhino model> x48])
crv_4 = Curve(crv)
rev = ReverseList(List=crv_3)
division = Division(A="360", B=number_slider)
crv_5 = Curve(crv_4)
xy = XYPlane(Origin=Point(0, 0, 0))
series = Series(Start=0, Step=division, Count=number_slider)
flip = FlipCurve(Curve=crv_5)  # -> Curve, Flag
flip_2 = FlipCurve(Curve=rev)  # -> Curve, Flag
panel = Panel("""6
11
14
15.6""")
panel_2 = Panel("""6
12
17""")
panel_3 = Panel("""6
11
14
15.6""")
rotate = Rotate(Geometry=flip.Curve, Angle=degrees(series), Plane=xy)  # -> Geometry, Transform
crv_6 = Curve(crv_2)
crv_7 = Curve(flip_2.Curve)
neg = Negative(Value=panel_2)
neg_2 = Negative(Value="16.1")
crv_8 = Curve(rotate.Geometry)
group = Group(Objects=crv_6)
group_2 = Group(Objects=crv_7)
neg_3 = Negative(Value=panel_3)
group_3 = Group(Objects=crv_8)
Z = UnitZ(Factor=neg)
Z_2 = UnitZ(Factor=neg_2)
crv_9 = Curve([<curve referenced from the Rhino model> x4])
crv_10 = Curve(<curve referenced from the Rhino model>)
Z_3 = UnitZ(Factor=neg_3)
move = Move(Geometry=group, Motion=Z)  # -> Geometry, Transform
move_2 = Move(Geometry=group_2, Motion=Z_2)  # -> Geometry, Transform
move_3 = Move(Geometry=group_3, Motion=Z_3)  # -> Geometry, Transform
ungroup = Ungroup(Group=move.Geometry)
ungroup_2 = Ungroup(Group=move_2.Geometry)
ungroup_3 = Ungroup(Group=move_3.Geometry)
toolpaths = Curve(flatten(ungroup_3))

resample_tolerance = Slider(0.02, range=0.02..0.1)
custom_jog_home_x = Slider(500, range=0..1000)
custom_jog_home_y = Slider(0, range=0..1000)
spindle_speed = Slider(12000, range=0..100000)
plunge_rate = Slider(20, range=0..100)
feed_rate = Slider(20, range=0..100)
use_custom_jog_home = BooleanToggle(True)
safe_z = Slider(6, range=0..20)
use_spindle = BooleanToggle(True)
use_inches = BooleanToggle(False)
toolpaths_2 = Curve(toolpaths)
use_inches_boolean = Panel(use_inches)
plunge_rate_2 = Number(plunge_rate)
sample_tolerance_in_mm = Number(resample_tolerance)
spindle_use_bollean = Number(use_spindle)
temp_home_y = Number(custom_jog_home_y)
feed_rate_2 = Number(feed_rate)
safe_z_height = Number(safe_z)
spindle_speed_2 = Number(spindle_speed)
use_custom_jog_home_2 = Integer(use_custom_jog_home)
temp_home_x = Number(custom_jog_home_x)
filter = StreamFilter(Gate=use_inches_boolean, Stream0="1", Stream1="25.4")
division_2 = Division(A=temp_home_x, B=filter)
division_3 = Division(A=temp_home_y, B=filter)
division_4 = Division(A=feed_rate_2, B=filter)
division_5 = Division(A=plunge_rate_2, B=filter)
division_6 = Division(A=safe_z_height, B=filter)

toolpaths_3 = Curve(toolpaths_2)
topoly = CurveToPolyline(Curve=toolpaths_3, ToleranceDistance=sample_tolerance_in_mm, ToleranceAngle=0)  # -> Polyline, Segments
cp = ControlPoints(Curve=topoly.Polyline)  # -> Points, Weights, Knots
rev_2 = ReverseList(List=cp.Points)
safe_z_height_2 = Number(division_6)
item = ListItem(List=cp.Points, Index=0, Wrap=True)
item_2 = ListItem(List=rev_2, Index=0, Wrap=True)
pdecon = Deconstruct(Point=item)  # -> XComponent, YComponent, ZComponent
pdecon_2 = Deconstruct(Point=item_2)  # -> XComponent, YComponent, ZComponent
pt = ConstructPoint(XCoordinate=pdecon.XComponent, YCoordinate=pdecon.YComponent, ZCoordinate=safe_z_height_2)
pt_2 = ConstructPoint(XCoordinate=pdecon_2.XComponent, YCoordinate=pdecon_2.YComponent, ZCoordinate=safe_z_height_2)
safe_z_end_point = Point(pt_2)
safe_z_start_point = Point(pt)

toolpath_points = Point(flatten(cp.Points))  # disabled
lng = ListLength(List=toolpath_points)
route_previvew_position = Number(Slider(0.523, range=0..1))
number_slider_2 = Slider(3, range=0..10)
multiplication = Multiplication(A=lng, B=route_previvew_position)
item_3 = ListItem(List=toolpath_points, Index=multiplication, Wrap=True)
sph = Sphere(Base=item_3, Radius=Slider(1.5, range=0..10))

# ---- group: Name
panel_4 = Panel("'vrnp")

# ---- group: Set spindle speed
spindle_speed_3 = Number(spindle_speed_2)
int = Integer(spindle_speed_3)
join = TextJoin(Text=["TR,", int, ",1"])

# ---- group: Turn off spindle
filter_2 = StreamFilter(Gate=spindle_use_bollean, Stream1="SO,1,0")

# ---- group: Start spindle
filter_3 = StreamFilter(Gate=spindle_use_bollean, Stream1="SO,1,1")
filter_4 = StreamFilter(Gate=spindle_use_bollean, Stream1="PAUSE 1")

# ---- group: Set Feed rate (X Y speed) and plunge rate (Z speed)
feed_rate_3 = Number(division_4)
plunge_rate_3 = Number(division_5)
plunge_rate_4 = Number(plunge_rate_3)
feed_rate_4 = Number(feed_rate_3)
text = Text("MS,")
text_2 = Text(",")
join_2 = TextJoin(Text=[text, feed_rate_4, text_2, plunge_rate_4])

# ----
rev_3 = ReverseList(List=flatten(safe_z_end_point))
cull_i = CullIndex(List=flatten(safe_z_start_point), Indices=0, Wrap=True)
cull_i_2 = CullIndex(List=rev_3, Indices=0, Wrap=True)
rev_4 = ReverseList(List=flatten(cull_i_2))
ln = Line(StartPoint=safe_z_start_point, EndPoint=item)
ln_2 = Line(StartPoint=rev_4, EndPoint=cull_i)
ln_3 = Line(StartPoint=item_2, EndPoint=safe_z_end_point)
toolpath_preview_line = Curve(topoly.Polyline)
cut_transition_preview_line = Curve(ln_2)
cut_entry_preview_line = Curve(ln)
cut_exit_preview_line = Curve(ln_3)
material = CreateMaterial(
    Diffuse=ColourSwatch(SwatchColor=RGB(184, 251, 255)),
    Specular=RGB(255, 255, 255),
    Emission=RGB(0, 0, 0),
    Transparency=0,
    Shine=0)
material_2 = CreateMaterial(
    Diffuse=ColourSwatch(SwatchColor=RGB(99, 74, 16)),
    Specular=RGB(255, 255, 255),
    Emission=RGB(0, 0, 0),
    Transparency=0,
    Shine=0)
material_3 = CreateMaterial(
    Diffuse=ColourSwatch(SwatchColor=RGB(174, 234, 235)),
    Specular=RGB(255, 255, 255),
    Emission=RGB(0, 0, 0),
    Transparency=0,
    Shine=0)
material_4 = CreateMaterial(
    Diffuse=ColourSwatch(SwatchColor=RGB(77, 114, 115)),
    Specular=RGB(255, 255, 255),
    Emission=RGB(0, 0, 0),
    Transparency=0,
    Shine=0)
preview = CustomPreview(Geometry=toolpath_preview_line, Shader=material)
preview_2 = CustomPreview(Geometry=cut_transition_preview_line, Shader=material_2)
preview_3 = CustomPreview(Geometry=cut_entry_preview_line, Shader=material_3)
preview_4 = CustomPreview(Geometry=cut_exit_preview_line, Shader=material_4)

use_inches_boolean_2 = Panel(use_inches)
toolpath_points_2 = Point(cp.Points)
filter_5 = StreamFilter(Gate=use_inches_boolean_2, Stream0="1", Stream1="25.4")
pdecon_3 = Deconstruct(Point=toolpath_points_2)  # -> XComponent, YComponent, ZComponent
lng_2 = ListLength(List=toolpath_points_2)
division_7 = Division(A=pdecon_3.XComponent, B=filter_5)
division_8 = Division(A=pdecon_3.YComponent, B=filter_5)
division_9 = Division(A=pdecon_3.ZComponent, B=filter_5)
flatten = FlattenTree(Tree=lng_2, Path="{0}")
panel_5 = Panel(division_7)
panel_6 = Panel(division_8)
panel_7 = Panel(division_9)
merge = Merge(Data1=Slider(0, range=0..100), Data2=flatten)
filter_6 = StreamFilter(Gate=spindle_use_bollean, Stream1=join)
text_3 = Text("J2,")
text_4 = Text(",")
join_3 = TextJoin(Text=[text_3, division_2, text_4, division_3])

# ---- group: Jog to safe Z
safe_z_height_3 = Number(flatten(safe_z_height_2))
text_5 = Text("JZ,")
graft = GraftTree(Tree=safe_z_height_3, IncludeEmptyLists=True, IncludeNullItems=True)
graft_2 = GraftTree(Tree=text_5, IncludeEmptyLists=True, IncludeNullItems=True)
lng_3 = ListLength(List=flatten(merge))
join_4 = TextJoin(Text=[graft_2, graft])
dup = DuplicateData(Data=join_4, Number=lng_3, Order=True)

# ---- group: Toolpath coordinates
text_6 = Text("M3,")
text_7 = Text(",")
text_8 = Text(",")
dup_2 = DuplicateData(Data=text_8, Number=lng_2, Order=True)
dup_3 = DuplicateData(Data=text_7, Number=lng_2, Order=True)
dup_4 = DuplicateData(Data=text_6, Number=lng_2, Order=True)
simplify = SimplifyTree(Tree=flatten(dup_4), Front=False)
simplify_2 = SimplifyTree(Tree=flatten(panel_5), Front=False)
simplify_3 = SimplifyTree(Tree=flatten(dup_3), Front=False)
simplify_4 = SimplifyTree(Tree=flatten(panel_6), Front=False)
simplify_5 = SimplifyTree(Tree=flatten(dup_2), Front=False)
simplify_6 = SimplifyTree(Tree=flatten(panel_7), Front=False)
graft_3 = GraftTree(Tree=simplify, IncludeEmptyLists=True, IncludeNullItems=True)
graft_4 = GraftTree(Tree=simplify_2, IncludeEmptyLists=True, IncludeNullItems=True)
graft_5 = GraftTree(Tree=simplify_3, IncludeEmptyLists=True, IncludeNullItems=True)
graft_6 = GraftTree(Tree=simplify_4, IncludeEmptyLists=True, IncludeNullItems=True)
graft_7 = GraftTree(Tree=simplify_5, IncludeEmptyLists=True, IncludeNullItems=True)
graft_8 = GraftTree(Tree=simplify_6, IncludeEmptyLists=True, IncludeNullItems=True)
join_5 = TextJoin(Text=[graft_3, graft_4, graft_5, graft_6, graft_7, graft_8])
flatten_2 = FlattenTree(Tree=join_5, Path="{0}")

# ---- group: Insert JZ commands
ma = MassAddition(Input=merge)  # -> Result, PartialResults
ins = InsertItems(List=flatten_2, Item=dup, Indices=ma.PartialResults, Wrap=True)

# ---- group: Jog to startpoints
item_4 = ListItem(List=division_7, Index=0, Wrap=True)
item_5 = ListItem(List=division_8, Index=0, Wrap=True)
lng_4 = ListLength(List=flatten(item_4))
text_9 = Text(",")
text_10 = Text("J2,")
dup_5 = DuplicateData(Data=text_10, Number=lng_4, Order=True)
dup_6 = DuplicateData(Data=text_9, Number=lng_4, Order=True)
simplify_7 = SimplifyTree(Tree=flatten(dup_5), Front=False)
simplify_8 = SimplifyTree(Tree=flatten(item_4), Front=False)
simplify_9 = SimplifyTree(Tree=flatten(dup_6), Front=False)
simplify_10 = SimplifyTree(Tree=flatten(item_5), Front=False)
graft_9 = GraftTree(Tree=simplify_7, IncludeEmptyLists=True, IncludeNullItems=True)
graft_10 = GraftTree(Tree=simplify_8, IncludeEmptyLists=True, IncludeNullItems=True)
graft_11 = GraftTree(Tree=simplify_9, IncludeEmptyLists=True, IncludeNullItems=True)
graft_12 = GraftTree(Tree=simplify_10, IncludeEmptyLists=True, IncludeNullItems=True)
join_6 = TextJoin(Text=[graft_9, graft_10, graft_11, graft_12])
jh = Text("JH")
flatten_3 = FlattenTree(Tree=join_6, Path="{0}")

# ----
filter_7 = StreamFilter(Gate=use_custom_jog_home_2, Stream0=jh, Stream1=flatten(join_3))

# ---- group: Jog to startpoints (continued)
merge_2 = Merge(Data1=flatten_3, Data2=filter_7)

# ---- group: Insert J2 commands
lng_5 = ListLength(List=merge_2)
dup_7 = DuplicateData(Data=Slider(1, range=0..1), Number=lng_5, Order=True)
addition = Addition(A=dup_7, B=merge)
ma_2 = MassAddition(Input=addition)  # -> Result, PartialResults
ins_2 = InsertItems(List=ins, Item=merge_2, Indices=ma_2.PartialResults, Wrap=True)

# ----
flatten_4 = FlattenTree(Tree=ins_2, Path="{0}")
merge_3 = Merge(Data1=panel_4, Data3=filter_6, Data4=filter_3, Data5=filter_4, Data6=join_2, Data7=flatten_4, Data8=filter_2)
panel_8 = Panel(merge_3)
lng_6 = ListLength(List=panel_8)
panel_9 = Panel(lng_6)

number_of_code_preview_lines = Slider(39, range=0..100)
code_preview_font_size = Slider(6, range=0..100)
code_preview_angle = Slider(0, range=0..100)
line_spacing_factor = Slider(1.84, range=1..2.5)
pt_3 = ConstructPoint(XCoordinate=Slider(0, range=0..1000), YCoordinate=Slider(-106, range=-1000..1000), ZCoordinate=0)
multiplication_2 = Multiplication(A=code_preview_font_size, B=line_spacing_factor)
Y = UnitY(Factor=1)
Z_4 = UnitZ(Factor=1)
series_2 = Series(Start=0, Step=multiplication_2, Count=number_of_code_preview_lines)
rev_5 = Reverse(Vector=Y)
neg_4 = Negative(Value=series_2)
pl = ConstructPlane(Origin=pt_3, XAxis=rev_5, YAxis=Z_4)
xy_2 = XYPlane(Origin=pt_3)
series_3 = Series(Start=0, Step=Slider(1, range=0..1), Count=number_of_code_preview_lines)
split = SplitList(List=panel_8, Index=number_of_code_preview_lines)  # -> ListA, ListB
dup_8 = DuplicateData(Data=code_preview_font_size, Number=number_of_code_preview_lines, Order=True)
int_2 = Integer(Toggle(True))
division_10 = Division(A=series_3, B=number_of_code_preview_lines)
yz = YZPlane(Origin=pt_3)
xz = XZPlane(Origin=pt_3)
neg_5 = Negative(Value=code_preview_angle)
rev_6 = ReverseList(List=division_10)
rotate_2 = Rotate(Geometry=xy_2, Angle=degrees(neg_5), Plane=yz)  # -> Geometry, Transform
argb = SplitARGB(Colour=ColourSwatch(SwatchColor=RGB(173, 240, 255)), IntegerChannels=True)  # -> Alpha, Red, Green, Blue
num = Number(rev_6)
deplane = DeconstructPlane(Plane=rotate_2.Geometry)  # -> Origin, XAxis, YAxis, ZAxis
replace = ReplaceItems(List=num, Item=Slider(1, range=0..1), Indices=Slider(4, range=0..10), Wrap=False)
replace_2 = ReplaceItems(List=num, Item=Slider(1, range=0..1), Indices=Slider(5, range=0..10), Wrap=False)
amp = Amplitude(Vector=deplane.YAxis, Amplitude=neg_4)
filter_8 = StreamFilter(Gate=int_2, Stream0=replace_2, Stream1=replace)
multiplication_3 = Multiplication(A=code_preview_font_size, B=Slider(0.6, range=0..1))
move_4 = Move(Geometry=rotate_2.Geometry, Motion=amp)  # -> Geometry, Transform
replace_3 = ReplaceItems(List=dup_8, Item=multiplication_3, Indices=Slider(1, range=0..1), Wrap=False)
multiplication_4 = Multiplication(A=argb.Red, B=filter_8)
multiplication_5 = Multiplication(A=argb.Blue, B=num)
multiplication_6 = Multiplication(A=argb.Green, B=filter_8)
rgb = ColourRGB(Alpha=255, Red=multiplication_4, Green=multiplication_6, Blue=multiplication_5)
tag = TextTag3D(Location=move_4.Geometry, Text=split.ListA, Size=replace_3, Colour=rgb, Justification=1)
