# Grasshopper definition speed calculator for oscilations.gh (Grasshopper 0.9.76)
# Copyright: Creative Commons BY-SA
# Copyright: none

arc_diameter = Panel("2")
number_of_flutes = Panel("3")
stepover = Panel("0.07")
spindle_rpm = Panel("30000")
milling_bit_diameter = Panel("5")
chip_load = Panel("0.03")
feedrate_calculator_for_arcs = FeedrateCalculatorForArcs(
    spindle_rpm=spindle_rpm,
    milling_bit_diameter=milling_bit_diameter,
    arc_diameter_factor=arc_diameter,
    number_of_flutes=number_of_flutes,
    chip_load=chip_load,
    max_stepover=stepover,
    ramp_feed_reduction_factor=0.5)  # -> arc_compensated_feedrate_3, ramp_feedrate_2, feedback_3
feedrate_calculator = FeedrateCalculator(
    spindle_rpm=spindle_rpm,
    milling_bit_diameter=milling_bit_diameter,
    number_of_flutes=number_of_flutes,
    chip_load=chip_load,
    max_stepover=stepover,
    ramp_feed_reduction_factor=0.5)  # -> feedrate_4, ramp_feedrate_2, feedback_3
multiplication = Multiplication(A=milling_bit_diameter, B=arc_diameter)
subtraction = Subtraction(A=multiplication, B=milling_bit_diameter)
trochoid_dimater = Panel(subtraction)
feedrate_at_center_of_milling_bit = Panel(feedrate_calculator_for_arcs.arc_compensated_feedrate_3)
feedrate_at_edge_of_milling_bit = Panel(feedrate_calculator.feedrate_4)
pi = Pi(Factor=1)
multiplication_2 = Multiplication(A=trochoid_dimater, B=pi)
feedrate_at_center_of_milling_bit_2 = Panel(feedrate_at_center_of_milling_bit)
trochoid_length = Panel(multiplication_2)
multiplication_3 = Multiplication(A=milling_bit_diameter, B=stepover)
division = Division(A=feedrate_at_center_of_milling_bit_2, B=trochoid_length)
distance_traveled_per_full_trochoid_revo = Panel(multiplication_3)  # "Distance traveled per full trochoid revolution"
oscilation_rps = Panel(division)
oscilation_rps_2 = Panel(oscilation_rps)
multiplication_4 = Multiplication(A=oscilation_rps, B="60")
multiplication_5 = Multiplication(A=oscilation_rps_2, B=distance_traveled_per_full_trochoid_revo)
x_y_feedrate_per_second = Panel(multiplication_5)
int = Integer(multiplication_4)
oscilation_rpm = Panel(int)

# ==== cluster FeedrateCalculatorForArcs: Compensates for the speed difference between the center of a bit and its outer edge when cutting in circular paths. Calculates a feedrate matching chipload and rpm. This speed difference is similar to how the wheels on a car spin at different speeds during a turn. Can take chip thining into account. Input the maxium stepover the tool will encounter. Normal pockets and profiles will have a full stepover of 1, while the Arc Based High speed milling givve constant low stepovers as speciified.
ramp_feed_reduction_factor = ClusterInput()
ramp_feed_reduction_factor_2 = Number(ramp_feed_reduction_factor)
arc_diameter_factor = ClusterInput()
milling_bit_diameter = ClusterInput()
number_of_flutes = ClusterInput()
max_stepover = ClusterInput()
spindle_rpm = ClusterInput()
chip_load = ClusterInput()
number_of_flutes_2 = Number(number_of_flutes)
milling_bit_diameter_2 = Number(milling_bit_diameter)
spindle_rpm_2 = Number(spindle_rpm)
max_stepover_2 = Number(max_stepover)
chip_load_2 = Number(chip_load)
arc_diameter_factor_2 = Number(arc_diameter_factor)
number_of_flutes_3 = Panel(number_of_flutes_2)
chip_load_3 = Panel(chip_load_2)
max_stepover_3 = Panel(max_stepover_2)
ramp_feedrate_reduction_factor = Panel(ramp_feed_reduction_factor_2)
arc_diameter_factor_3 = Panel(arc_diameter_factor_2)
spindle_rpm_3 = Panel(spindle_rpm_2)
milling_bit_diameter_3 = Panel(milling_bit_diameter_2)

multiplication = Multiplication(A=milling_bit_diameter_3, B=arc_diameter_factor_3)
subtraction = Subtraction(A=multiplication, B=milling_bit_diameter_3)
arc_diameter_at_bit_edge = Panel(multiplication)
arc_diameter_at_bit_center = Panel(subtraction)
division = Division(A=arc_diameter_at_bit_center, B=arc_diameter_at_bit_edge)
arc_feedrate_reduction_factor = Panel(division)

# ---- group: Calulate chip thining
larger = LargerThan(FirstNumber=max_stepover_3, SecondNumber="0.5")  # -> LargerThan, OrEqualTo
filter = StreamFilter(Gate=larger.LargerThan, Stream0=max_stepover_3, Stream1="0.5")
multiplication_2 = Multiplication(A=milling_bit_diameter_3, B=filter)
multiplication_3 = Multiplication(A="0.5", B=milling_bit_diameter_3)
subtraction_2 = Subtraction(A=multiplication_3, B=multiplication_2)
neg = Negative(Value=subtraction_2)
pt = ConstructPoint(XCoordinate=milling_bit_diameter_3, YCoordinate=neg, ZCoordinate=0)
pt_2 = ConstructPoint(XCoordinate=0, YCoordinate=neg, ZCoordinate=0)
xy = XYPlane(Origin=Point(0, 0, 0))
ln = Line(StartPoint=pt_2, EndPoint=pt)
cir = Circle(Plane=xy, Radius=multiplication_3)
ccx = CurveCurve(CurveA=cir, CurveB=ln)  # -> Points, ParamsA, ParamsB
pt_3 = ConstructPoint(XCoordinate=0, YCoordinate=0, ZCoordinate=0)
chip_load_4 = Panel(chip_load_3)
vec2pt = Vector2Pt(PointA=pt_3, PointB=ccx.Points, Unitize=False)  # -> Vector, Length
amp = Amplitude(Vector=vec2pt.Vector, Amplitude=chip_load_4)
move = Move(Geometry=ccx.Points, Motion=amp)  # -> Geometry, Transform
pdecon = Deconstruct(Point=move.Geometry)  # -> XComponent, YComponent, ZComponent
pt_4 = ConstructPoint(XCoordinate=0, YCoordinate=pdecon.YComponent, ZCoordinate=pdecon.ZComponent)
ln_2 = Line(StartPoint=move.Geometry, EndPoint=pt_4)
ccx_2 = CurveCurve(CurveA=cir, CurveB=ln_2)  # -> Points, ParamsA, ParamsB
dist = Distance(PointA=flatten(ccx_2.Points), PointB=flatten(move.Geometry))
move_distance_needed_for_chipload = Panel(dist)
chip_load_5 = Panel(chip_load_3)
division_2 = Division(A=move_distance_needed_for_chipload, B=chip_load_5)

# ---- group: Calculate feedrate
multiplication_4 = Multiplication(A=spindle_rpm_3, B=number_of_flutes_3)
multiplication_5 = Multiplication(A=multiplication_4, B=chip_load_3)
division_3 = Division(A=multiplication_5, B="60")
feedrate = Panel(division_3)

# ----
multiplication_6 = Multiplication(A=feedrate, B=arc_feedrate_reduction_factor)
arc_compensated_feedrate = Panel(multiplication_6)

# ---- group: Safatey in case of too extreme values
backup_feedrate_multiplaication_factor = Panel("2")
feedrate_multiplaication_factor = Panel(division_2)
null = NullItem(Item=ccx_2.Points)  # -> NullFlags, InvalidFlags, Description
filter_2 = StreamFilter(Gate=null.NullFlags, Stream0=feedrate_multiplaication_factor, Stream1=backup_feedrate_multiplaication_factor)

# ---- group: Visualize chip size
X = UnitX(Factor=dist)
ln_3 = Line(StartPoint=ccx.Points, EndPoint=pt)
ln_4 = Line(StartPoint=ccx.Points, EndPoint=move.Geometry)
move_2 = Move(Geometry=cir, Motion=X)  # -> Geometry, Transform
chip_load_cross_section = Curve(ln_4)
new_bit_position = Curve(move_2.Geometry)
old_bit_position = Curve(cir)
material_edge = Curve(ln_3)

# ----
panel = Panel("Stepover to small or chipload to high. Unable to compute optimal feedrate multiplication factor.")
filter_3 = StreamFilter(Gate=null.NullFlags, Stream0="All good", Stream1=panel)
ramp_feedrate_reduction_factor_2 = Panel(ramp_feedrate_reduction_factor)
feedrate_multiplication_factor = Panel(filter_2)
feedrate_2 = Panel(arc_compensated_feedrate)
feedback = Panel(filter_3)
multiplication_7 = Multiplication(A=feedrate_2, B=feedrate_multiplication_factor)
multiplication_8 = Multiplication(A=multiplication_7, B=ramp_feedrate_reduction_factor_2)
feedback_2 = Text(feedback)
int = Integer(multiplication_7)
int_2 = Integer(multiplication_8)
feedback_3 = ClusterOutput(feedback_2)
arc_compensated_feedrate_2 = Number(int)
ramp_feedrate = Number(int_2)
ramp_feedrate_2 = ClusterOutput(ramp_feedrate)
arc_compensated_feedrate_3 = ClusterOutput(arc_compensated_feedrate_2)

# ==== cluster FeedrateCalculator: Calculates a feedrate matching chipload and rpm. Can take chip thining into account. Input the maxium stepover the tool will encounter. Normal pockets and profiles will have a full stepover of 1, while the Arc Based High speed milling givve constant low stepovers as speciified.
ramp_feed_reduction_factor = ClusterInput()
milling_bit_diameter = ClusterInput()
number_of_flutes = ClusterInput()
spindle_rpm = ClusterInput()
max_stepover = ClusterInput()
chip_load = ClusterInput()
ramp_feed_reduction_factor_2 = Number(ramp_feed_reduction_factor)
milling_bit_diameter_2 = Number(milling_bit_diameter)
number_of_flutes_2 = Number(number_of_flutes)
spindle_rpm_2 = Number(spindle_rpm)
max_stepover_2 = Number(max_stepover)
chip_load_2 = Number(chip_load)
spindle_rpm_3 = Panel(spindle_rpm_2)
milling_bit_diameter_3 = Panel(milling_bit_diameter_2)
number_of_flutes_3 = Panel(number_of_flutes_2)
chip_load_3 = Panel(chip_load_2)
max_stepover_3 = Panel(max_stepover_2)
ramp_feedrate_reduction_factor = Panel(ramp_feed_reduction_factor_2)

# ---- group: Calulate chip thining
larger = LargerThan(FirstNumber=max_stepover_3, SecondNumber="0.5")  # -> LargerThan, OrEqualTo
filter = StreamFilter(Gate=larger.LargerThan, Stream0=max_stepover_3, Stream1="0.5")
multiplication = Multiplication(A=milling_bit_diameter_3, B=filter)
multiplication_2 = Multiplication(A="0.5", B=milling_bit_diameter_3)
subtraction = Subtraction(A=multiplication_2, B=multiplication)
neg = Negative(Value=subtraction)
pt = ConstructPoint(XCoordinate=milling_bit_diameter_3, YCoordinate=neg, ZCoordinate=0)
pt_2 = ConstructPoint(XCoordinate=0, YCoordinate=neg, ZCoordinate=0)
xy = XYPlane(Origin=Point(0, 0, 0))
ln = Line(StartPoint=pt_2, EndPoint=pt)
cir = Circle(Plane=xy, Radius=multiplication_2)
ccx = CurveCurve(CurveA=cir, CurveB=ln)  # -> Points, ParamsA, ParamsB
pt_3 = ConstructPoint(XCoordinate=0, YCoordinate=0, ZCoordinate=0)
chip_load_4 = Panel(chip_load_3)
vec2pt = Vector2Pt(PointA=pt_3, PointB=ccx.Points, Unitize=False)  # -> Vector, Length
amp = Amplitude(Vector=vec2pt.Vector, Amplitude=chip_load_4)
move = Move(Geometry=ccx.Points, Motion=amp)  # -> Geometry, Transform
pdecon = Deconstruct(Point=move.Geometry)  # -> XComponent, YComponent, ZComponent
pt_4 = ConstructPoint(XCoordinate=0, YCoordinate=pdecon.YComponent, ZCoordinate=pdecon.ZComponent)
ln_2 = Line(StartPoint=move.Geometry, EndPoint=pt_4)
ccx_2 = CurveCurve(CurveA=cir, CurveB=ln_2)  # -> Points, ParamsA, ParamsB
dist = Distance(PointA=flatten(ccx_2.Points), PointB=flatten(move.Geometry))
move_distance_needed_for_chipload = Panel(dist)
chip_load_5 = Panel(chip_load_3)
division = Division(A=move_distance_needed_for_chipload, B=chip_load_5)

# ---- group: Calculate feedrate
multiplication_3 = Multiplication(A=spindle_rpm_3, B=number_of_flutes_3)
multiplication_4 = Multiplication(A=multiplication_3, B=chip_load_3)
division_2 = Division(A=multiplication_4, B="60")
feedrate = Panel(division_2)

# ---- group: Safatey in case of too extreme values
backup_feedrate_multiplaication_factor = Panel("2")
feedrate_multiplaication_factor = Panel(division)
null = NullItem(Item=ccx_2.Points)  # -> NullFlags, InvalidFlags, Description
filter_2 = StreamFilter(Gate=null.NullFlags, Stream0=feedrate_multiplaication_factor, Stream1=backup_feedrate_multiplaication_factor)

# ---- group: Visualize chip size
X = UnitX(Factor=dist)
ln_3 = Line(StartPoint=ccx.Points, EndPoint=pt)
ln_4 = Line(StartPoint=ccx.Points, EndPoint=move.Geometry)
move_2 = Move(Geometry=cir, Motion=X)  # -> Geometry, Transform
chip_load_cross_section = Curve(ln_4)
new_bit_position = Curve(move_2.Geometry)
old_bit_position = Curve(cir)
material_edge = Curve(ln_3)

# ----
panel = Panel("Stepover to small or chipload to high. Unable to compute optimal feedrate multiplication factor.")
filter_3 = StreamFilter(Gate=null.NullFlags, Stream0="All good", Stream1=panel)
ramp_feedrate_reduction_factor_2 = Panel(ramp_feedrate_reduction_factor)
feedrate_multiplication_factor = Panel(filter_2)
feedrate_2 = Panel(feedrate)
feedback = Panel(filter_3)
multiplication_5 = Multiplication(A=feedrate_2, B=feedrate_multiplication_factor)
multiplication_6 = Multiplication(A=multiplication_5, B=ramp_feedrate_reduction_factor_2)
feedback_2 = Text(feedback)
int = Integer(multiplication_5)
int_2 = Integer(multiplication_6)
feedback_3 = ClusterOutput(feedback_2)
feedrate_3 = Number(int)
ramp_feedrate = Number(int_2)
feedrate_4 = ClusterOutput(feedrate_3)
ramp_feedrate_2 = ClusterOutput(ramp_feedrate)
