# Grasshopper definition cnc-friendly-gear-generator.gh (Grasshopper 0.9.76)
# Copyright: Creative commons attribution share-a-like

# ---- group: Gear settings
rack_and_pinion_geometry_type = ValueList({"Nema17, high torque": 0, "Nema23, high resolution and torque": 1, "Nema23, stronger teeth": 2}, selected="Nema23, high resolution and torque")
output_geometry_type = ValueList({"2D curves": 0, "3D brep": 1}, selected="3D brep")
gear_ratio = Slider(5, range=1..20)
gear_type = ValueList({"Outside": 0, "Inside": 1, "Rack": 2}, selected="Inside")

# ----
slide_to_preview = Slider(0, range=0..1)

# ---- group: Settings for Nema23, max resolution geometry
pinion_circumference = Slider(40, range=1..200)
motor_shaft_diameter = Slider(8, range=0..10)
tooth_fillet_ratio = Slider(0.12, range=0..1)
pinion_tooth_width = Panel("3.3")

# ----
pinion_circumference_2 = Slider(35, range=1..200)

# ---- group: Settings for Nema23, stronger teeth geometry
pinion_circumference_3 = Slider(60, range=1..200)
motor_shaft_diameter_2 = Slider(8, range=0..10)
tooth_fillet_ratio_2 = Slider(0.1, range=0..1)
pinion_tooth_width_2 = Panel("6.3")

# ----
number_of_pinion_teeth = Slider(8, range=0..10)
number_of_pinion_teeth_2 = Slider(6, range=0..10)
number_of_pinion_teeth_3 = Slider(6, range=0..10)

# ---- group: Settings for Nema17, max resolution geometry
motor_shaft_diameter_3 = Slider(5, range=0..10)
tooth_fillet_ratio_3 = Slider(0.22, range=0..1)
pinion_tooth_width_3 = Panel("3.2")

# ----
filter = StreamFilter(
    Gate=rack_and_pinion_geometry_type,
    Stream0=pinion_tooth_width_3,
    Stream1=pinion_tooth_width,
    Stream2=pinion_tooth_width_2)
filter_2 = StreamFilter(
    Gate=rack_and_pinion_geometry_type,
    Stream0=tooth_fillet_ratio_3,
    Stream1=tooth_fillet_ratio,
    Stream2=tooth_fillet_ratio_2)
filter_3 = StreamFilter(
    Gate=rack_and_pinion_geometry_type,
    Stream0=pinion_circumference_2,
    Stream1=pinion_circumference,
    Stream2=pinion_circumference_3)
filter_4 = StreamFilter(
    Gate=rack_and_pinion_geometry_type,
    Stream0=number_of_pinion_teeth_2,
    Stream1=number_of_pinion_teeth,
    Stream2=number_of_pinion_teeth_3)
filter_5 = StreamFilter(
    Gate=rack_and_pinion_geometry_type,
    Stream0=motor_shaft_diameter_3,
    Stream1=motor_shaft_diameter,
    Stream2=motor_shaft_diameter_2)

# ---- group: Make rack and pinion geometry
roller_rack_and_pinion_maker = RollerRackAndPinionMaker(
    pinion_tooth_width=filter,
    pinion_circumference=filter_3,
    number_of_pinion_teeth=filter_4,
    tooth_fillet_ratio=filter_2,
    motor_shaft_diameter=filter_5)  # -> rack_teeth_4, pinion_teeth_4, pinion_center_hole_3, pinion_edge_3, steps_per_mm_2, maxium_pinion_milling_bit_diamter_4, pinion_movement_preview_3

# ----
gear_type_2 = Panel(gear_type)
gate = StreamGate(Stream=roller_rack_and_pinion_maker.pinion_teeth_4, Gate=gear_type_2)  # -> Target0, Target1, Target2
gate_2 = StreamGate(
    Stream=[roller_rack_and_pinion_maker.pinion_teeth_4, roller_rack_and_pinion_maker.rack_teeth_4, roller_rack_and_pinion_maker.pinion_center_hole_3],
    Gate=gear_type_2)  # -> Target0, Target1, Target2

# ---- group: Make outside gear
gear_ratio_rotary_axis = Panel(gear_ratio)
multiplication = Multiplication(A=filter_4, B=gear_ratio_rotary_axis)
gear_for_pinion_maker = GearForPinionMaker(
    number_of_gear_teeth=multiplication,
    number_of_input_pinion_teeth=filter_4,
    pinion_teeth=gate.Target0,
    pinion_center_hole=roller_rack_and_pinion_maker.pinion_center_hole_3,
    milling_bit_diameter=filter,
    preview_position_0_1=slide_to_preview)  # -> gear_teeth_3, gear_center_hole_3, gear_movement_preview_3, pinion_movement_preview_3
gear_preview = Curve([gear_for_pinion_maker.pinion_movement_preview_3, gear_for_pinion_maker.gear_movement_preview_3, gear_for_pinion_maker.gear_center_hole_3])
crv = Curve([gear_for_pinion_maker.gear_teeth_3, gear_for_pinion_maker.gear_center_hole_3])

# ---- group: Make inside gear
gear_ratio_rotary_axis_2 = Panel(gear_ratio)
multiplication_2 = Multiplication(A=filter_4, B=gear_ratio_rotary_axis_2)
inside_gear_for_pinion_maker = InsideGearForPinionMaker(
    number_of_gear_teeth=multiplication_2,
    milling_bit_diameter=filter,
    number_of_input_pinion_teeth=filter_4,
    pinion_teeth_curve=gate.Target1,
    pinion_center_hole_curve=roller_rack_and_pinion_maker.pinion_center_hole_3,
    tooth_fillet_ratio=Slider(0.15, range=0..1),
    preview_position_0_1=slide_to_preview)  # -> gear_teeth_4, gear_center_hole_3, gear_movement_preview_3, pinion_movement_preview_3
pinion_teeth = Curve(roller_rack_and_pinion_maker.pinion_teeth_4)
gear_preview_2 = Curve([inside_gear_for_pinion_maker.gear_movement_preview_3, inside_gear_for_pinion_maker.pinion_movement_preview_3, inside_gear_for_pinion_maker.gear_center_hole_3])
crv_2 = Curve([inside_gear_for_pinion_maker.gear_teeth_4, inside_gear_for_pinion_maker.gear_center_hole_3, pinion_teeth])

# ----
pinion_center_hole = Curve(roller_rack_and_pinion_maker.pinion_center_hole_3)
rack_and_pinion = Curve(gate_2.Target2)
gear_geometry = Curve([crv_2, crv, gate.Target0, roller_rack_and_pinion_maker.pinion_center_hole_3, rack_and_pinion])

# ---- group: Create gear ratio tag
steps_per_mm = Panel(roller_rack_and_pinion_maker.steps_per_mm_2)
bbox = BoundingBox(Content=flatten(gear_geometry), Plane=PlaneXY(0, 0, 0), UnionBox=True)  # -> Box, Box_2
text_size = Panel("5")
text_distance = Panel("6")
int = Integer(gear_ratio)
gear_type_3 = Panel(gear_type)
merge = Merge(Data1="1:", Data2=int)
edges = BrepEdges(Brep=bbox.Box)  # -> Naked, Interior, NonManifold
merge_2 = Merge(Data1=steps_per_mm, Data2=" steps per mm with a 200 step motor")
item = ListItem(List=edges.Naked, Index=0, Wrap=True)
neg = Negative(Value=text_distance)
eval = EvaluateLength(Curve=item, Length=0.5, Normalized=True)  # -> Point, Tangent, Parameter
Y = UnitY(Factor=neg)
join = TextJoin(Text=merge_2)
join_2 = TextJoin(Text=merge)
move = Move(Geometry=eval.Point, Motion=Y)  # -> Geometry, Transform
xy = XYPlane(Origin=move.Geometry)

# ----
filter_6 = StreamFilter(Gate=gear_type_3, Stream0=join_2, Stream1=join_2, Stream2=join)

# ---- group: Right click and choose "Bake" to save to Rhino
gear_geometry_2 = Geometry(gear_geometry)
ratio_tag = TextTag3D(Location=xy, Text=filter_6, Size=text_size, Justification=2)

# ==== cluster RollerRackAndPinionMaker: Makes rack and pinion gemetry suitable for 3 axis CNC milling. Has low backlash, but is vulnerable to contamination. More options inside component.
number_of_pinion_teeth = ClusterInput()
pinion_tooth_width = ClusterInput()
pinion_circumference = ClusterInput()
motor_shaft_diameter = ClusterInput()
tooth_fillet_ratio = ClusterInput()
rack_length = ClusterInput()

# ---- group: Smaller amount of teeth gives higher resolution and more torque
number_of_pinion_teeth_2 = Panel("9")
number_of_pinion_teeth_3 = Number(number_of_pinion_teeth)
null = NullItem(Item=number_of_pinion_teeth_3)  # -> NullFlags, InvalidFlags, Description
filter = StreamFilter(Gate=null.NullFlags, Stream0=number_of_pinion_teeth_3, Stream1=number_of_pinion_teeth_2)
number_of_pinion_teeth_4 = Panel(filter)

# ---- group: Detrimees the distance between the pinion teeth. Smaller circumfrence gives higher resolution and more torque
pinion_circumference_2 = Panel("40")
pinion_circumference_3 = Number(pinion_circumference)
null_2 = NullItem(Item=pinion_circumference_3)  # -> NullFlags, InvalidFlags, Description
filter_2 = StreamFilter(Gate=null_2.NullFlags, Stream0=pinion_circumference_3, Stream1=pinion_circumference_2)
pinion_circumference_4 = Panel(filter_2)

# ---- group: The shaft diameter of the motor driving the pinion
motor_shaft_diameter_2 = Panel("8")
motor_shaft_diameter_3 = Number(motor_shaft_diameter)
null_3 = NullItem(Item=motor_shaft_diameter_3)  # -> NullFlags, InvalidFlags, Description
filter_3 = StreamFilter(Gate=null_3.NullFlags, Stream0=motor_shaft_diameter_3, Stream1=motor_shaft_diameter_2)
motor_shaft_diameter_4 = Panel(filter_3)

# ---- group: Determines the tooth width. Should be a little larger than the bit you plan to mill the rack with
milling_bit_diameter = Panel("2.8")
pinion_tooth_width_2 = Number(pinion_tooth_width)
null_4 = NullItem(Item=pinion_tooth_width_2)  # -> NullFlags, InvalidFlags, Description
filter_4 = StreamFilter(Gate=null_4.NullFlags, Stream0=pinion_tooth_width_2, Stream1=milling_bit_diameter)
milling_bit_diameter_2 = Panel(filter_4)

# ---- group: Determines the travel distance of pinion
rack_length_2 = Panel("200")
rack_length_3 = Number(rack_length)
null_5 = NullItem(Item=rack_length_3)  # -> NullFlags, InvalidFlags, Description
filter_5 = StreamFilter(Gate=null_5.NullFlags, Stream0=rack_length_3, Stream1=rack_length_2)
rack_length_4 = Panel(filter_5)

# ---- group: Low fillet ratio gives smoother motion, but makes a less robust pinion
tooth_fillet_ratio_2 = Panel("0.2")
tooth_fillet_ratio_3 = Number(tooth_fillet_ratio)
null_6 = NullItem(Item=tooth_fillet_ratio_3)  # -> NullFlags, InvalidFlags, Description
filter_6 = StreamFilter(Gate=null_6.NullFlags, Stream0=tooth_fillet_ratio_3, Stream1=tooth_fillet_ratio_2)
tooth_fillet_ratio_4 = Panel(filter_6)

# ----
preview_position_0_1 = ClusterInput()
preview_position = Slider(0.306, range=0..1)

# ---- group: Controlls pinion tooth blending
rounding_factor_pinion_outside = Slider(20, range=0..100)
rounding_factor_pinion_inside = Slider(70, range=0..100)

# ---- group: Start numbers to help calculte pinion tooth path through rack
number_of_curve_sample_points = Slider(12, range=0..1000)
sample_tooth_position = Panel("0.26")

# ---- group: Lower number gives more clearene between rack tooth and pinion valley
pinion_corner_tolerance_factor = Panel("20")

# ---- group: Fill in for correct step statistics
number_of_stepper_motor_steps = Panel("200")
microstep_level = Panel("16")

# ----
preview_position_0_1_2 = Number(preview_position_0_1)

# ---- group: Prepare properties
multiplication = Multiplication(A=number_of_pinion_teeth_4, B=sample_tooth_position)
division = Division(A=milling_bit_diameter_2, B=pinion_corner_tolerance_factor)
multiplication_2 = Multiplication(A=milling_bit_diameter_2, B="0.5")
multiplication_3 = Multiplication(A=motor_shaft_diameter_4, B="0.5")
round = Round(Number=multiplication)  # -> Nearest, Floor, Ceiling
multiplication_4 = Multiplication(A=number_of_pinion_teeth_4, B="2")
neg = Negative(Value=division)
multiplication_5 = Multiplication(A=milling_bit_diameter_2, B=tooth_fillet_ratio_4)
milling_bit_radius = Panel(multiplication_2)
xy = XYPlane(Origin=Point(0, 0, 0))
sample_tooth_number = Panel(round.Ceiling)
multiplication_6 = Multiplication(B=multiplication_4)
tooth_fillet_radius = Panel(multiplication_5)
pinion_circumference_5 = Panel(pinion_circumference_4)
cir = Circle(Plane=xy, Radius=milling_bit_radius)
pi = Pi(Factor=1)
division_2 = Division(A=pinion_circumference_5, B=pi)
number_of_pinion_teeth_5 = Panel(number_of_pinion_teeth_4)
pinion_diameter = Panel(division_2)
sample_tooth_number_2 = Panel(sample_tooth_number)
number_of_curve_sample_points_2 = Panel(number_of_curve_sample_points)
multiplication_7 = Multiplication(A=pinion_diameter, B="0.5")
division_3 = Division(A=sample_tooth_number_2, B=number_of_pinion_teeth_5)
pinion_radius = Panel(multiplication_7)
pinion_circumference_6 = Panel(pinion_circumference_5)
multiplication_8 = Multiplication(A="360", B=division_3)
Y = UnitY(Factor=pinion_radius)
division_4 = Division(A="360", B=number_of_pinion_teeth_5)
division_5 = Division(A=multiplication_8, B=number_of_curve_sample_points_2)
multiplication_9 = Multiplication(A=pinion_circumference_6, B=division_3)
division_6 = Division(A=pinion_circumference_5, B=number_of_pinion_teeth_4)
move = Move(Geometry=xy, Motion=Y)  # -> Geometry, Transform
series = Series(Start=0, Step=division_4, Count=number_of_pinion_teeth_5)
division_7 = Division(A=multiplication_9, B=number_of_curve_sample_points_2)
series_2 = Series(Start=0, Step=division_5, Count=number_of_curve_sample_points_2)
tooth_spacing = Panel(division_6)
rad = Radians(Degrees=series)
circle = Circle(cir)
series_3 = Series(Start=0, Step=division_7, Count=number_of_curve_sample_points_2)
neg_2 = Negative(Value=series_2)
rad_2 = Radians(Degrees=neg_2)
rotate = Rotate(Geometry=circle, Angle=rad, Plane=move.Geometry)  # -> Geometry, Transform

# ---- group: Make step resolution statisitics
number_of_stepper_motor_steps_2 = Panel(number_of_stepper_motor_steps)
microstep_level_2 = Panel(microstep_level)
division_8 = Division(A=pinion_circumference_5, B=number_of_stepper_motor_steps_2)
distance_covered_per_step = Panel(division_8)
division_9 = Division(A=distance_covered_per_step, B=microstep_level_2)
distance_covered_per_micro_step = Panel(division_9)

# ---- group: Step statsistics
distance_covered_per_step_2 = Panel(distance_covered_per_step)
distance_covered_per_micro_step_2 = Panel(distance_covered_per_micro_step)

# ---- group: Create rack tooth geometry
sample_tooth_number_3 = Panel(sample_tooth_number_2)
tooth_spacing_2 = Panel(tooth_spacing)
item = ListItem(List=rotate.Geometry, Index=sample_tooth_number_3, Wrap=True)
rotate_2 = Rotate(Geometry=graft(item), Angle=rad_2, Plane=move.Geometry)  # -> Geometry, Transform
tooth_spacing_3 = Panel(tooth_spacing)
X = UnitX(Factor=series_3)
sample_tooth_number_4 = Panel(sample_tooth_number_3)
milling_it_radius = Panel(multiplication_2)
subtraction = Subtraction(A=sample_tooth_number_3, B="0.5")
move_2 = Move(Geometry=rotate_2.Geometry, Motion=X)  # -> Geometry, Transform
multiplication_10 = Multiplication(A=sample_tooth_number_4, B=tooth_spacing_3)
area = Area(Geometry=move_2.Geometry)  # -> Area, Centroid
pt = ConstructPoint(XCoordinate=multiplication_10, YCoordinate=0, ZCoordinate=0)
multiplication_11 = Multiplication(A=subtraction, B=tooth_spacing_2)
multiplication_12 = Multiplication(A=sample_tooth_number_3, B=tooth_spacing_2)
deplane = DeconstructPlane(Plane=xy)  # -> Origin, XAxis, YAxis, ZAxis
merge = Merge(Data1=flatten(area.Centroid), Data2=flatten(pt))
amp = Amplitude(Vector=deplane.YAxis, Amplitude=milling_it_radius)
amp_2 = Amplitude(Vector=deplane.XAxis, Amplitude=multiplication_11)
amp_3 = Amplitude(Vector=deplane.XAxis, Amplitude=multiplication_12)
intcrv = Interpolate(Vertices=merge, Degree=3, Periodic=False, KnotStyle=1)  # -> Curve, Length, Domain
rev = Reverse(Vector=amp)
move_3 = Move(Geometry=deplane.Origin, Motion=amp_2)  # -> Geometry, Transform
move_4 = Move(Geometry=deplane.Origin, Motion=amp_3)  # -> Geometry, Transform
move_5 = Move(Geometry=move_3.Geometry, Motion=rev)  # -> Geometry, Transform
yz = YZPlane(Origin=move_5.Geometry)
crv = Curve(intcrv.Curve)
mirror = Mirror(Geometry=crv, Plane=yz)  # -> Geometry, Transform
ccx = CurveCurve(CurveA=crv, CurveB=mirror.Geometry)  # -> Points, ParamsA, ParamsB
shatter = Shatter(Curve=crv, Parameters=ccx.ParamsA)
rev_2 = ReverseList(List=shatter)
milling_it_radius_2 = Panel(milling_it_radius)
tooth_fillet_radius_2 = Panel(tooth_fillet_radius)
item_2 = ListItem(List=rev_2, Index=0, Wrap=True)
mirror_2 = Mirror(Geometry=item_2, Plane=yz)  # -> Geometry, Transform
pt_2 = Point(move_4.Geometry)
pt_3 = Point(deplane.Origin)
addition = Addition(A=tooth_fillet_radius_2, B=milling_it_radius_2)
join = JoinCurves(Curves=[item_2, mirror_2.Geometry], Preserve=False)
vec2pt = Vector2Pt(PointA=pt_2, PointB=pt_3, Unitize=False)  # -> Vector, Length
fillet = Fillet(Curve=join, Radius=addition)
move_6 = Move(Geometry=fillet, Motion=vec2pt.Vector)  # -> Geometry, Transform

# ---- group: Offset tooth profile to prepare for copying
tooth_spacing_4 = Panel(tooth_spacing)
milling_it_radius_3 = Panel(milling_it_radius)
tooth_profile_for_offset = Curve(move_6.Geometry)
xy_2 = XYPlane(Origin=Point(0, 0, 0))
neg_3 = Negative(Value=tooth_spacing_4)
X_2 = UnitX(Factor=tooth_spacing_4)
X_3 = UnitX(Factor=neg_3)
move_7 = Move(Geometry=tooth_profile_for_offset, Motion=X_2)  # -> Geometry, Transform
move_8 = Move(Geometry=tooth_profile_for_offset, Motion=X_3)  # -> Geometry, Transform
end = EndPoints(Curve=tooth_profile_for_offset)  # -> Start, End
join_2 = JoinCurves(Curves=flatten([move_8.Geometry, tooth_profile_for_offset, move_7.Geometry]), Preserve=False)
yz_2 = YZPlane(Origin=[end.Start, end.End])
offset = Offset(Curve=join_2, Distance=milling_it_radius_3, Plane=xy_2, Corners=2)
pcx = CurvePlane(Curve=offset, Plane=yz_2)  # -> Points, ParamsC, ParamsP
shatter_2 = Shatter(Curve=offset, Parameters=flatten(pcx.ParamsC))
item_3 = ListItem(List=shatter_2, Index="1", Wrap=True)
offset_tooth_for_copy_and_join = Curve(item_3)

# ----
distance_covered_per_step_3 = Panel(distance_covered_per_step)
division_10 = Division(A="1", B=distance_covered_per_step_3)
steps_per_mm = Number(division_10)
steps_per_mm_2 = ClusterOutput(steps_per_mm)

# ---- group: Create and blend pinion teeth
eval = EvaluateLength(Curve=fillet, Length="0.5", Normalized=True)  # -> Point, Tangent, Parameter
pdecon = Deconstruct(Point=eval.Point)  # -> XComponent, YComponent, ZComponent
milling_it_radius_4 = Panel(milling_bit_radius)
pinion_corner_tolerance = Panel(neg)
subtraction_2 = Subtraction(A=pdecon.YComponent, B=milling_it_radius_4)
subtraction_3 = Subtraction(A=subtraction_2, B=milling_it_radius_4)
subtraction_4 = Subtraction(A=subtraction_3, B=pinion_corner_tolerance)
pt_4 = ConstructPoint(XCoordinate=0, YCoordinate=subtraction_4, ZCoordinate=0)
rounding_factor_pinion_outside_2 = Panel(rounding_factor_pinion_outside)
xy_3 = XYPlane(Origin=pt_4)
division_11 = Division(A="360", B=multiplication_4)
rounding_factor_pinion_inside_2 = Panel(rounding_factor_pinion_inside)
subtraction_5 = Subtraction(A="0", B=rounding_factor_pinion_outside_2)
addition_2 = Addition(A="180", B=rounding_factor_pinion_outside_2)
rad_3 = Radians(Degrees=addition_2)
rad_4 = Radians(Degrees=subtraction_5)
subtraction_6 = Subtraction(A="180", B=rounding_factor_pinion_inside_2)
addition_3 = Addition(A="0", B=rounding_factor_pinion_inside_2)
milling_it_radius_5 = Panel(milling_it_radius_4)
dom = ConstructDomain(DomainStart=rad_4, DomainEnd=rad_3)
xy_4 = XYPlane(Origin=Point(0, 0, 0))
rad_5 = Radians(Degrees=subtraction_6)
rad_6 = Radians(Degrees=addition_3)
dom_2 = ConstructDomain(DomainStart=rad_6, DomainEnd=rad_5)
pi_2 = Pi(Factor=1)
arc = Arc(Plane=xy_4, Radius=milling_it_radius_5, Angle=dom)  # -> Arc, Length
arc_2 = Arc(Plane=xy_3, Radius=milling_it_radius_5, Angle=dom_2)  # -> Arc, Length
rad_7 = Radians(Degrees=division_11)
rotate_3 = Rotate(Geometry=arc.Arc, Angle=pi_2, Plane=xy_4)  # -> Geometry, Transform
addition_4 = Addition(A=rad, B=rad_7)
number_slider = Slider(0.5, range=0..1)
rotate_4 = Rotate(Geometry=rotate_3.Geometry, Angle=rad, Plane=move.Geometry)  # -> Geometry, Transform
rotate_5 = Rotate(Geometry=arc_2.Arc, Angle=addition_4, Plane=move.Geometry)  # -> Geometry, Transform
flip = FlipCurve(Curve=rotate_4.Geometry)  # -> Curve, Flag
flip_2 = FlipCurve(Curve=rotate_5.Geometry)  # -> Curve, Flag
pinion_radius_2 = Panel(pinion_radius)
shift = ShiftList(List=flip.Curve, Shift=1, Wrap=True)
blendc = BlendCurve(CurveA=rotate_4.Geometry, CurveB=flip_2.Curve, BulgeA=number_slider, BulgeB=number_slider, Continuity=2)
blendc_2 = BlendCurve(CurveA=shift, CurveB=rotate_5.Geometry, BulgeA=number_slider, BulgeB=number_slider, Continuity=2)
neg_4 = Negative(Value=pinion_radius_2)
Y_2 = UnitY(Factor=neg_4)
cir_2 = Circle(Plane=move.Geometry, Radius=multiplication_3)
join_3 = JoinCurves(Curves=flatten([rotate_4.Geometry, rotate_5.Geometry, blendc, blendc_2]), Preserve=False)
move_9 = Move(Geometry=join_3, Motion=Y_2)  # -> Geometry, Transform
pinion_teeth = Curve(move_9.Geometry)

# ----
move_10 = Move(Geometry=cir_2, Motion=Y_2)  # -> Geometry, Transform

# ---- group: Create and blend pinion teeth (continued)
pinion_center_hole = Curve(move_10.Geometry)

# ---- group: Create pinion movement preview
preview_position_0_1_3 = Number(preview_position_0_1_2)
pinion_radius_3 = Panel(pinion_radius)
pinion_circumference_7 = Panel(pinion_circumference_5)
multiplication_13 = Multiplication(A="360", B=preview_position_0_1_3)
multiplication_14 = Multiplication(A=pinion_circumference_7, B=preview_position_0_1_3)
neg_5 = Negative(Value=multiplication_13)
X_4 = UnitX(Factor=multiplication_14)
rad_8 = Radians(Degrees=neg_5)
rotate_6 = Rotate(Geometry=flatten([join_3, cir_2]), Angle=rad_8, Plane=move.Geometry)  # -> Geometry, Transform
move_11 = Move(Geometry=rotate_6.Geometry, Motion=X_4)  # -> Geometry, Transform
neg_6 = Negative(Value=pinion_radius_3)
Y_3 = UnitY(Factor=neg_6)
move_12 = Move(Geometry=move_11.Geometry, Motion=Y_3)  # -> Geometry, Transform
pinion_movement_preview = Curve(move_12.Geometry)

# ---- group: Make pinion bit statisitics
pinion_radius_4 = Panel(pinion_radius)
rotate_7 = Rotate(Geometry=move.Geometry, Angle=4.71238898, Plane=move.Geometry)  # -> Geometry, Transform
pinion_teeth_2 = Curve(join_3)
cir_3 = Circle(Plane=rotate_7.Geometry, Radius=pinion_radius_4)
trim = TrimWithRegion(Curve=cir_3, Region=pinion_teeth_2)  # -> Inside, Outside
item_4 = ListItem(List=trim.Outside, Index=0, Wrap=True)
len = Length(Curve=flatten(item_4))
maxium_pinion_milling_bit_diamter = Panel(len)

# ----
maxium_pinion_milling_bit_diamter_2 = Panel(maxium_pinion_milling_bit_diamter)
maxium_pinion_milling_bit_diamter_3 = Number(maxium_pinion_milling_bit_diamter_2)
pinion_movement_preview_2 = Curve(pinion_movement_preview)
pinion_center_hole_2 = Curve(pinion_center_hole)
pinion_teeth_3 = Curve(pinion_teeth)
pinion_teeth_4 = ClusterOutput(pinion_teeth_3)
pinion_center_hole_3 = ClusterOutput(pinion_center_hole_2)
maxium_pinion_milling_bit_diamter_4 = ClusterOutput(maxium_pinion_milling_bit_diamter_3)
pinion_movement_preview_3 = ClusterOutput(pinion_movement_preview_2)

# ---- group: Create rack by copying and offsetting rack tooth
tooth_spacing_5 = Panel(tooth_spacing)
rack_length_5 = Panel(rack_length_4)
milling_bit_radius_2 = Panel(multiplication_2)
tooth_profile_for_copy_and_join = Curve(offset_tooth_for_copy_and_join)
pinion_radius_5 = Panel(pinion_radius)
addition_5 = Addition(A=pinion_radius_5, B=milling_bit_radius_2)
multiplication_15 = Multiplication(A=addition_5, B="2")
addition_6 = Addition(A=rack_length_5, B=multiplication_15)
division_12 = Division(A=addition_5, B=tooth_spacing_5)
actual_rack_length = Panel(addition_6)
round_2 = Round(Number=division_12)  # -> Nearest, Floor, Ceiling
multiplication_16 = Multiplication(A=round_2.Ceiling, B=tooth_spacing_5)
division_13 = Division(A=actual_rack_length, B=tooth_spacing_5)
neg_7 = Negative(Value=addition_5)
neg_8 = Negative(Value=multiplication_16)
round_3 = Round(Number=division_13)  # -> Nearest, Floor, Ceiling
rack_start_distance = Panel(neg_8)
rack_cut_start_distance = Panel(neg_7)
addition_7 = Addition(A=round_3.Ceiling, B="1")
series_4 = Series(Start=0, Step=tooth_spacing_5, Count=addition_7)
X_5 = UnitX(Factor=rack_start_distance)
move_13 = Move(Geometry=tooth_profile_for_copy_and_join, Motion=X_5)  # -> Geometry, Transform
X_6 = UnitX(Factor=series_4)
move_14 = Move(Geometry=move_13.Geometry, Motion=X_6)  # -> Geometry, Transform
pinion_radius_6 = Panel(pinion_radius)
join_4 = JoinCurves(Curves=move_14.Geometry, Preserve=False)
neg_9 = Negative(Value=pinion_radius_6)
Y_4 = UnitY(Factor=neg_9)
move_15 = Move(Geometry=join_4, Motion=Y_4)  # -> Geometry, Transform; disabled
rack_teeth = Curve(move_15.Geometry)

# ----
end_2 = EndPoints(Curve=move_13.Geometry)  # -> Start, End
dist = Distance(PointA=end_2.Start, PointB=end_2.End)
move_16 = Move(Geometry=move_14.Geometry, Motion=Y_4)  # -> Geometry, Transform

# ---- group: Create rack by copying and offsetting rack tooth (continued)
rack_teeth_unjoined = Curve(move_16.Geometry)

# ---- group: Trim rack to specified length
rack_cut_start_distance_2 = Panel(rack_cut_start_distance)
actual_rack_length_2 = Panel(actual_rack_length)
pinion_diameter_2 = Panel(pinion_diameter)
rack_teeth_2 = Curve(rack_teeth)
pt_5 = ConstructPoint(XCoordinate=rack_cut_start_distance_2, YCoordinate=0, ZCoordinate=0)
xy_5 = XYPlane(Origin=pt_5)
neg_10 = Negative(Value=pinion_diameter_2)
rectangle = Rectangle(Plane=xy_5, XSize=actual_rack_length_2, YSize=neg_10, Radius=0)  # -> Rectangle, Length
trim_2 = TrimWithRegion(Curve=rack_teeth_2, Region=rectangle.Rectangle)  # -> Inside, Outside
bbox = BoundingBox(Content=trim_2.Inside, Plane=PlaneXY(0, 0, 0))  # -> Box, Box_2
edges = BrepEdges(Brep=bbox.Box)  # -> Naked, Interior, NonManifold
item_5 = ListItem(List=edges.Naked, Index="2", Wrap=True)
flip_3 = FlipCurve(Curve=item_5)  # -> Curve, Flag
rack_tooth_edge = Curve(flip_3.Curve)
trimmed_rack_teeth = Curve(trim_2.Inside)

# ----
rack_teeth_trimmed_and_joined = Curve(trimmed_rack_teeth)
rack_teeth_3 = Curve(rack_teeth_unjoined)
rack_teeth_4 = ClusterOutput(rack_teeth_3)

pinion_radius_7 = Panel(pinion_radius)
milling_bit_radius_3 = Panel(multiplication_2)
addition_8 = Addition(A=pinion_radius_7, B=milling_bit_radius_3)
cir_4 = Circle(Plane=move.Geometry, Radius=addition_8)

move_17 = Move(Geometry=cir_4, Motion=Y_2)  # -> Geometry, Transform

pinion_edge = Curve(move_17.Geometry)

pinion_edge_2 = Curve(pinion_edge)
pinion_edge_3 = ClusterOutput(pinion_edge_2)

# ==== cluster InsideGearForPinionMaker: Creates a gear matching a pinion from "Roller rack and pinion maker". Great for making geared rack and pinion drive systems. Connect pinion geometery from a "Roller rack and pinion maker" component.
number_of_input_pinion_teeth = ClusterInput()  # Input same pinion tooth count as used in "Roller rack and pinion maker"
preview_position_0_1 = ClusterInput()  # Connect a slider to preview gear movement
tooth_fillet_ratio = ClusterInput()  # Adjust to make sure pinion can roll soothly past to tips
pinion_center_hole_curve = ClusterInput()  # Connect pinion center hole geometry from "Roller rack and pinion maker"
number_of_gear_teeth = ClusterInput()  # Specify the number of teeth
milling_bit_diameter = ClusterInput()  # Input same diameter value as used in "Roller rack and pinion maker"
pinion_teeth_curve = ClusterInput()  # Connect pinion curve geometry from "Roller rack and pinion maker"

# ---- group: Low fillet ratio gives smoother motion, but makes a less robust pinion
tooth_fillet_ratio_2 = Number(tooth_fillet_ratio)
tooth_fillet_ratio_3 = Panel(tooth_fillet_ratio_2)

# ----
preview_position_0_1_2 = Number(preview_position_0_1)

# ---- group: Start numbers to help calculte pinion tooth path through rack
number_of_curve_sample_points = Slider(20, range=0..1000)
sample_tooth_position = Panel("0.26")

# ----
number_of_gear_teeth_2 = Number(number_of_gear_teeth)
milling_bit_diameter_2 = Number(milling_bit_diameter)
number_of_input_pinion_teeth_2 = Number(number_of_input_pinion_teeth)
pinion_teeth_curve_2 = Curve(pinion_teeth_curve)
pinion_center_hole_curve_2 = Curve(pinion_center_hole_curve)
number_of_gear_teeth_3 = Panel(number_of_gear_teeth_2)
milling_bit_diameter_3 = Panel(milling_bit_diameter_2)
number_of_pinion_teeth = Panel(number_of_input_pinion_teeth_2)
division = Division(A=number_of_gear_teeth_3, B=number_of_pinion_teeth)
explode = Explode(Curve=pinion_teeth_curve_2, Recursive=True)  # -> Segments, Vertices
smaller = SmallerThan(FirstNumber=division, SecondNumber="2")  # -> SmallerThan, OrEqualTo
item = ListItem(List=explode.Segments, Index=0, Wrap=True)
multiplication = Multiplication(A=number_of_pinion_teeth, B=sample_tooth_position)
input_pinion_has_at_least_half_the_tooth = Panel(smaller.SmallerThan)  # "Input pinion has at least half the tooth count"
darc = DeconstructArc(Arc=item)  # -> BasePlane, Radius, Angle
round = Round(Number=multiplication)  # -> Nearest, Floor, Ceiling
area = Area(Geometry=pinion_center_hole_curve_2)  # -> Area, Centroid
pinion_tooth_center_point = Point(darc.BasePlane)
sample_tooth_number = Panel(round.Ceiling)
xy = XYPlane(Origin=area.Centroid)
pinion_center_plane = Plane(xy)
dist = Distance(PointA=flatten(pinion_tooth_center_point), PointB=flatten(area.Centroid))
pinion_radius = Panel(dist)
multiplication_2 = Multiplication(A=pinion_radius, B="2")
pi = Pi(Factor=1)
multiplication_3 = Multiplication(A=multiplication_2, B=pi)
number_of_pinion_teeth_2 = Panel(number_of_pinion_teeth)
number_of_gear_teeth_4 = Panel(number_of_gear_teeth_3)
pinion_cirumference = Panel(multiplication_3)

number_of_curve_sample_points_2 = Panel(number_of_curve_sample_points)
number_of_pinion_teeth_3 = Panel(number_of_pinion_teeth)
sample_tooth_number_2 = Panel(sample_tooth_number)
input_pinion_has_at_least_half_the_tooth_2 = Panel(input_pinion_has_at_least_half_the_tooth)  # "Input pinion has at least half the tooth count"
pinion_circumference = Panel(pinion_cirumference)
pinion_circumference_2 = Panel(pinion_circumference)
division_2 = Division(A=pinion_circumference, B=number_of_pinion_teeth)
division_3 = Division(A=sample_tooth_number_2, B=number_of_pinion_teeth_3)
tooth_spacing = Panel(division_2)
multiplication_4 = Multiplication(A="360", B=division_3)
division_4 = Division(A=multiplication_4, B=number_of_curve_sample_points_2)
multiplication_5 = Multiplication(A=pinion_circumference_2, B=division_3)
division_5 = Division(A=number_of_pinion_teeth, B=number_of_gear_teeth_3)
series = Series(Start=0, Step=division_4, Count=number_of_curve_sample_points_2)
division_6 = Division(A=multiplication_5, B=number_of_curve_sample_points_2)
tooth_count_ratio = Panel(division_5)
neg = Negative(Value=series)
series_2 = Series(Start=0, Step=division_6, Count=number_of_curve_sample_points_2)
rad = Radians(Degrees=neg)
multiplication_6 = Multiplication(A=rad, B=tooth_count_ratio)
neg_2 = Negative(Value=rad)
neg_3 = Negative(Value=multiplication_6)
filter = StreamFilter(Gate=input_pinion_has_at_least_half_the_tooth_2, Stream0=rad, Stream1=neg_2)
filter_2 = StreamFilter(Gate=input_pinion_has_at_least_half_the_tooth_2, Stream0=neg_3, Stream1=multiplication_6)
tooth_spacing_2 = Panel(tooth_spacing)
gear_sample_positions = Panel(filter)
gear_sample_positions_2 = Panel(filter_2)

milling_bit_diameter_4 = Panel(milling_bit_diameter_3)
multiplication_7 = Multiplication(A=milling_bit_diameter_3, B=tooth_fillet_ratio_3)
multiplication_8 = Multiplication(A=milling_bit_diameter_4, B="0.5")
tooth_fillet_radius = Panel(multiplication_7)
milling_it_radius = Panel(multiplication_8)

division_7 = Division(A=pinion_cirumference, B=number_of_pinion_teeth_2)
tooth_spacing_3 = Panel(division_7)
multiplication_9 = Multiplication(A=tooth_spacing_3, B=number_of_gear_teeth_4)
gear_circumference = Panel(multiplication_9)
pi_2 = Pi(Factor=1)
division_8 = Division(A=gear_circumference, B=pi_2)
gear_diameter = Panel(division_8)
division_9 = Division(A=gear_diameter, B="2")
gear_radius = Panel(division_9)
pinion_tooth_center_point_2 = Point(pinion_tooth_center_point)
neg_4 = Negative(Value=gear_radius)
Y = UnitY(Factor=gear_radius)
move = Move(Geometry=pinion_tooth_center_point_2, Motion=Y)  # -> Geometry, Transform
gear_center_point = Point(move.Geometry)
xy_2 = XYPlane(Origin=gear_center_point)
gear_center_plane = Plane(xy_2)

gear_sample_positions_3 = Panel(gear_sample_positions_2)
gear_center_plane_2 = Plane(gear_center_plane)
rotate = Rotate(Geometry=graft(item), Angle=gear_sample_positions, Plane=pinion_center_plane)  # -> Geometry, Transform
gear_center_plane_3 = Plane(gear_center_plane)
number_of_gear_teeth_5 = Panel(number_of_gear_teeth_3)
X = UnitX(Factor=series_2)
move_2 = Move(Geometry=rotate.Geometry, Motion=X)  # -> Geometry, Transform
rotate_2 = Rotate(Geometry=rotate.Geometry, Angle=gear_sample_positions_3, Plane=gear_center_plane_2)  # -> Geometry, Transform
yz = YZPlane(Origin=gear_center_plane_3)
division_10 = Division(A="180", B=number_of_gear_teeth_5)
darc_2 = DeconstructArc(Arc=rotate_2.Geometry)  # -> BasePlane, Radius, Angle
rotate_3 = Rotate(Geometry=yz, Angle=degrees(division_10), Plane=gear_center_plane_3)  # -> Geometry, Transform
pt = Point(darc_2.BasePlane)
intcrv = Interpolate(Vertices=pt, Degree=3, Periodic=False, KnotStyle=1)  # -> Curve, Length, Domain
tooth_mid_plane = Plane(rotate_3.Geometry)
master_profile_curve = Curve(intcrv.Curve)

pinion_center_hole = Curve(pinion_center_hole_curve_2)
pinion_center_plane_2 = Plane(pinion_center_plane)
gear_center_plane_4 = Plane(gear_center_plane)
orient = Orient(Geometry=pinion_center_hole, Source=pinion_center_plane_2, Target=gear_center_plane_4)  # -> Geometry, Transform
gear_center_hole = Curve(orient.Geometry)

# ---- group: Create pinion movement preview
pinion_center_plane_3 = Plane(pinion_center_plane)
pinion_teeth = Curve(pinion_teeth_curve_2)
preview_position_0_1_3 = Number(preview_position_0_1_2)
multiplication_10 = Multiplication(A="360", B=preview_position_0_1_3)
neg_5 = Negative(Value=multiplication_10)
rad_2 = Radians(Degrees=neg_5)
rotate_4 = Rotate(Geometry=flatten(pinion_teeth), Angle=rad_2, Plane=pinion_center_plane_3)  # -> Geometry, Transform
pinion_movement_preview = Curve(rotate_4.Geometry)

# ----
gear_center_hole_2 = Curve(gear_center_hole)
pinion_movement_preview_2 = Curve(pinion_movement_preview)
gear_center_hole_3 = ClusterOutput(gear_center_hole_2)
pinion_movement_preview_3 = ClusterOutput(pinion_movement_preview_2)

milling_it_radius_2 = Panel(milling_it_radius)
master_profile_curve_2 = Curve(master_profile_curve)
gear_radius_2 = Panel(gear_radius)
valley_arc_from_pinion = Curve(item)
tooth_mid_plane_2 = Plane(tooth_mid_plane)
gear_center_plane_5 = Plane(gear_center_plane)
cir = Circle(Plane=gear_center_plane_5, Radius=gear_radius_2)
xy_3 = XYPlane(Origin=Point(0, 0, 0))
offset = Offset(Curve=master_profile_curve_2, Distance=milling_it_radius_2, Plane=xy_3, Corners=1)
ccx = CurveCurve(CurveA=offset, CurveB=cir)  # -> Points, ParamsA, ParamsB
shatter = Shatter(Curve=offset, Parameters=ccx.ParamsA)
rev = ReverseList(List=shatter)
milling_bit_diameter_5 = Panel(milling_bit_diameter_3)
item_2 = ListItem(List=rev, Index=0, Wrap=True)
valley_arc_from_pinion_2 = Curve(valley_arc_from_pinion)
yz_2 = YZPlane(Origin=Point(0, 0, 0))
tooth_fillet_radius_2 = Panel(tooth_fillet_radius)

eval = EvaluateLength(Curve=shatter, Length=0.5, Normalized=True)  # -> Point, Tangent, Parameter
dist_2 = Distance(PointA=eval.Point, PointB=gear_center_plane_5)
sort = SortList(Keys=dist_2, ValuesA=shatter)  # -> Keys, ValuesA
item_3 = ListItem(List=sort.ValuesA, Index=0, Wrap=True)

ext = ExtendCurve(Curve=item_3, Type=0, Start=milling_bit_diameter_5, End=milling_bit_diameter_5)
extended_profile = Curve(ext)
ccx_2 = CurveCurve(CurveA=extended_profile, CurveB=valley_arc_from_pinion_2)  # -> Points, ParamsA, ParamsB
rev_2 = ReverseList(List=ccx_2.Points)
rev_3 = ReverseList(List=ccx_2.ParamsA)
item_4 = ListItem(List=rev_3, Index=0, Wrap=True)
item_5 = ListItem(List=rev_2, Index=0, Wrap=True)
shatter_2 = Shatter(Curve=extended_profile, Parameters=item_4)
mirror = Mirror(Geometry=item_5, Plane=yz_2)  # -> Geometry, Transform
rev_4 = ReverseList(List=shatter_2)
crv_cp = CurveClosestPoint(Point=[item_5, mirror.Geometry], Curve=valley_arc_from_pinion_2)  # -> Point, Parameter, Distance
shatter_3 = Shatter(Curve=valley_arc_from_pinion_2, Parameters=crv_cp.Parameter)
item_6 = ListItem(List=shatter_3, Index="1", Wrap=True)
trimmed_valley = Curve(item_6)
trimmed_valley_2 = Curve(trimmed_valley)

eval_2 = EvaluateLength(Curve=shatter_2, Length=0.5, Normalized=True)  # -> Point, Tangent, Parameter
dist_3 = Distance(PointA=eval_2.Point, PointB=gear_center_plane_5)
sort_2 = SortList(Keys=dist_3, ValuesA=shatter_2)  # -> Keys, ValuesA

item_7 = ListItem(List=sort_2.ValuesA, Index=0, Wrap=True)
trimmed_profile = Curve(item_7)
curve_for_mirror = Curve(trimmed_profile)

mirror_2 = Mirror(Geometry=curve_for_mirror, Plane=tooth_mid_plane_2)  # -> Geometry, Transform

ccx_3 = CurveCurve(CurveA=curve_for_mirror, CurveB=mirror_2.Geometry)  # -> Points, ParamsA, ParamsB
shatter_4 = Shatter(Curve=curve_for_mirror, Parameters=ccx_3.ParamsA)

eval_3 = EvaluateLength(Curve=shatter_4, Length=0.5, Normalized=True)  # -> Point, Tangent, Parameter
dist_4 = Distance(PointA=eval_3.Point, PointB=gear_center_plane_5)
sort_3 = SortList(Keys=dist_4, ValuesA=shatter_4)  # -> Keys, ValuesA
rev_5 = ReverseList(List=sort_3.ValuesA)

item_8 = ListItem(List=rev_5, Index=0, Wrap=True)
mirror_3 = Mirror(Geometry=item_8, Plane=tooth_mid_plane_2)  # -> Geometry, Transform
join = JoinCurves(Curves=[item_8, mirror_3.Geometry], Preserve=False)
fillet = Fillet(Curve=join, Radius=tooth_fillet_radius_2)
gear_profile = Curve(fillet)

number_of_gear_teeth_6 = Panel(number_of_gear_teeth_3)
gear_center_plane_6 = Plane(gear_center_plane)
tooth_valley = Curve(trimmed_valley_2)
tooth_profile = Curve(gear_profile)
division_11 = Division(A="360", B=number_of_gear_teeth_6)
series_3 = Series(Start=0, Step=division_11, Count=number_of_gear_teeth_6)
rotate_5 = Rotate(Geometry=[tooth_profile, tooth_valley], Angle=degrees(series_3), Plane=gear_center_plane_6)  # -> Geometry, Transform
join_2 = JoinCurves(Curves=flatten(rotate_5.Geometry), Preserve=False)
gear_teeth = Curve(join_2)

# ---- group: Create pinion movement preview
preview_position_0_1_4 = Number(preview_position_0_1_2)
gear_center_plane_7 = Plane(gear_center_plane)
number_of_gear_teeth_7 = Panel(number_of_gear_teeth_3)
number_of_pinion_teeth_4 = Panel(number_of_pinion_teeth)
gear_teeth_2 = Curve(gear_teeth)
division_12 = Division(A=number_of_pinion_teeth_4, B=number_of_gear_teeth_7)
multiplication_11 = Multiplication(A="360", B=preview_position_0_1_4)
neg_6 = Negative(Value=multiplication_11)
rad_3 = Radians(Degrees=neg_6)
multiplication_12 = Multiplication(A=rad_3, B=division_12)
rotate_6 = Rotate(Geometry=flatten(gear_teeth_2), Angle=multiplication_12, Plane=gear_center_plane_7)  # -> Geometry, Transform
gear_movement_preview = Curve(rotate_6.Geometry)

# ----
gear_movement_preview_2 = Curve(gear_movement_preview)
gear_teeth_3 = Curve(gear_teeth)
gear_teeth_4 = ClusterOutput(gear_teeth_3)
gear_movement_preview_3 = ClusterOutput(gear_movement_preview_2)

# ==== cluster GearForPinionMaker: Creates a gear matching a pinion from "Roller rack and pinion maker". Great for making geared rack and pinion drive systems.
number_of_gear_teeth = ClusterInput()
number_of_input_pinion_teeth = ClusterInput()
pinion_center_hole = ClusterInput()
pinion_teeth = ClusterInput()
milling_bit_diameter = ClusterInput()
number_of_gear_teeth_2 = Number(number_of_gear_teeth)
number_of_input_pinion_teeth_2 = Number(number_of_input_pinion_teeth)
pinion_center_hole_2 = Curve(pinion_center_hole)
pinion_teeth_2 = Curve(pinion_teeth)
milling_bit_diameter_2 = Number(milling_bit_diameter)
preview_position_0_1 = ClusterInput()

# ---- group: Low fillet ratio gives smoother motion, but makes a less robust pinion
tooth_fillet_ratio = Slider(0.15, range=0..1)
tooth_fillet_ratio_2 = Panel(tooth_fillet_ratio)

# ---- group: Start numbers to help calculte pinion tooth path through rack
number_of_curve_sample_points = Slider(20, range=0..1000)
sample_tooth_position = Panel("0.26")

# ----
preview_position_0_1_2 = Number(preview_position_0_1)
milling_bit_diameter_3 = Panel(milling_bit_diameter_2)
number_of_pinion_teeth = Panel(number_of_input_pinion_teeth_2)
number_of_gear_teeth_3 = Panel(number_of_gear_teeth_2)
explode = Explode(Curve=pinion_teeth_2, Recursive=True)  # -> Segments, Vertices
item = ListItem(List=explode.Segments, Index=0, Wrap=True)
multiplication = Multiplication(A=number_of_pinion_teeth, B=sample_tooth_position)
darc = DeconstructArc(Arc=item)  # -> BasePlane, Radius, Angle
round = Round(Number=multiplication)  # -> Nearest, Floor, Ceiling
area = Area(Geometry=pinion_center_hole_2)  # -> Area, Centroid
pinion_tooth_center_point = Point(darc.BasePlane)
sample_tooth_number = Panel(round.Ceiling)
xy = XYPlane(Origin=area.Centroid)
pinion_center_plane = Plane(xy)
dist = Distance(PointA=flatten(pinion_tooth_center_point), PointB=flatten(area.Centroid))
pinion_radius = Panel(dist)
multiplication_2 = Multiplication(A=pinion_radius, B="2")
pi = Pi(Factor=1)
multiplication_3 = Multiplication(A=multiplication_2, B=pi)
number_of_pinion_teeth_2 = Panel(number_of_pinion_teeth)
number_of_gear_teeth_4 = Panel(number_of_gear_teeth_3)
pinion_cirumference = Panel(multiplication_3)

number_of_curve_sample_points_2 = Panel(number_of_curve_sample_points)
number_of_pinion_teeth_3 = Panel(number_of_pinion_teeth)
sample_tooth_number_2 = Panel(sample_tooth_number)
pinion_circumference = Panel(pinion_cirumference)
pinion_circumference_2 = Panel(pinion_circumference)
division = Division(A=pinion_circumference, B=number_of_pinion_teeth)
division_2 = Division(A=sample_tooth_number_2, B=number_of_pinion_teeth_3)
tooth_spacing = Panel(division)
multiplication_4 = Multiplication(A="360", B=division_2)
division_3 = Division(A=multiplication_4, B=number_of_curve_sample_points_2)
multiplication_5 = Multiplication(A=pinion_circumference_2, B=division_2)
division_4 = Division(A=number_of_pinion_teeth, B=number_of_gear_teeth_3)
series = Series(Start=0, Step=division_3, Count=number_of_curve_sample_points_2)
division_5 = Division(A=multiplication_5, B=number_of_curve_sample_points_2)
tooth_count_ratio = Panel(division_4)
neg = Negative(Value=series)
series_2 = Series(Start=0, Step=division_5, Count=number_of_curve_sample_points_2)
rad = Radians(Degrees=neg)
multiplication_6 = Multiplication(A=rad, B=tooth_count_ratio)
tooth_spacing_2 = Panel(tooth_spacing)
gear_sample_positions = Panel(multiplication_6)

milling_bit_diameter_4 = Panel(milling_bit_diameter_3)
multiplication_7 = Multiplication(A=milling_bit_diameter_3, B=tooth_fillet_ratio_2)
multiplication_8 = Multiplication(A=milling_bit_diameter_4, B="0.5")
tooth_fillet_radius = Panel(multiplication_7)
milling_it_radius = Panel(multiplication_8)

division_6 = Division(A=pinion_cirumference, B=number_of_pinion_teeth_2)
tooth_spacing_3 = Panel(division_6)
multiplication_9 = Multiplication(A=tooth_spacing_3, B=number_of_gear_teeth_4)
gear_circumference = Panel(multiplication_9)
pi_2 = Pi(Factor=1)
division_7 = Division(A=gear_circumference, B=pi_2)
gear_diameter = Panel(division_7)
division_8 = Division(A=gear_diameter, B="2")
pinion_tooth_center_point_2 = Point(pinion_tooth_center_point)
gear_radius = Panel(division_8)
neg_2 = Negative(Value=gear_radius)
Y = UnitY(Factor=neg_2)
move = Move(Geometry=pinion_tooth_center_point_2, Motion=Y)  # -> Geometry, Transform
gear_center_point = Point(move.Geometry)
xy_2 = XYPlane(Origin=gear_center_point)
gear_center_plane = Plane(xy_2)

gear_sample_positions_2 = Panel(gear_sample_positions)
gear_center_plane_2 = Plane(gear_center_plane)
rotate = Rotate(Geometry=graft(item), Angle=rad, Plane=pinion_center_plane)  # -> Geometry, Transform
gear_center_plane_3 = Plane(gear_center_plane)
number_of_gear_teeth_5 = Panel(number_of_gear_teeth_3)
X = UnitX(Factor=series_2)
move_2 = Move(Geometry=rotate.Geometry, Motion=X)  # -> Geometry, Transform
rotate_2 = Rotate(Geometry=rotate.Geometry, Angle=gear_sample_positions_2, Plane=gear_center_plane_2)  # -> Geometry, Transform
yz = YZPlane(Origin=gear_center_plane_3)
division_9 = Division(A="-180", B=number_of_gear_teeth_5)
darc_2 = DeconstructArc(Arc=rotate_2.Geometry)  # -> BasePlane, Radius, Angle
rotate_3 = Rotate(Geometry=yz, Angle=degrees(division_9), Plane=gear_center_plane_3)  # -> Geometry, Transform
pt = Point(darc_2.BasePlane)
intcrv = Interpolate(Vertices=pt, Degree=3, Periodic=False, KnotStyle=1)  # -> Curve, Length, Domain
tooth_mid_plane = Plane(rotate_3.Geometry)
master_profile_curve = Curve(intcrv.Curve)

milling_it_radius_2 = Panel(milling_it_radius)
master_profile_curve_2 = Curve(master_profile_curve)
gear_radius_2 = Panel(gear_radius)
valley_arc_from_pinion = Curve(item)
tooth_mid_plane_2 = Plane(tooth_mid_plane)
gear_center_plane_4 = Plane(gear_center_plane)
cir = Circle(Plane=gear_center_plane_4, Radius=gear_radius_2)
xy_3 = XYPlane(Origin=Point(0, 0, 0))
offset = Offset(Curve=master_profile_curve_2, Distance=milling_it_radius_2, Plane=xy_3, Corners=1)
ccx = CurveCurve(CurveA=offset, CurveB=cir)  # -> Points, ParamsA, ParamsB
shatter = Shatter(Curve=offset, Parameters=ccx.ParamsA)
rev = ReverseList(List=shatter)
milling_bit_diameter_5 = Panel(milling_bit_diameter_3)
item_2 = ListItem(List=rev, Index=0, Wrap=True)
ext = ExtendCurve(Curve=item_2, Type=0, Start=milling_bit_diameter_5, End=milling_bit_diameter_5)
valley_arc_from_pinion_2 = Curve(valley_arc_from_pinion)
extended_profile = Curve(ext)
ccx_2 = CurveCurve(CurveA=extended_profile, CurveB=valley_arc_from_pinion_2)  # -> Points, ParamsA, ParamsB
rev_2 = ReverseList(List=ccx_2.Points)
rev_3 = ReverseList(List=ccx_2.ParamsA)
item_3 = ListItem(List=rev_3, Index=0, Wrap=True)
yz_2 = YZPlane(Origin=Point(0, 0, 0))
item_4 = ListItem(List=rev_2, Index=0, Wrap=True)
shatter_2 = Shatter(Curve=extended_profile, Parameters=item_3)
mirror = Mirror(Geometry=item_4, Plane=yz_2)  # -> Geometry, Transform
rev_4 = ReverseList(List=shatter_2)
crv_cp = CurveClosestPoint(Point=[item_4, mirror.Geometry], Curve=valley_arc_from_pinion_2)  # -> Point, Parameter, Distance
item_5 = ListItem(List=rev_4, Index=0, Wrap=True)
shatter_3 = Shatter(Curve=valley_arc_from_pinion_2, Parameters=crv_cp.Parameter)
item_6 = ListItem(List=shatter_3, Index="1", Wrap=True)
trimmed_valley = Curve(item_6)
trimmed_profile = Curve(item_5)
curve_for_mirror = Curve(trimmed_profile)
mirror_2 = Mirror(Geometry=curve_for_mirror, Plane=tooth_mid_plane_2)  # -> Geometry, Transform
ccx_3 = CurveCurve(CurveA=curve_for_mirror, CurveB=mirror_2.Geometry)  # -> Points, ParamsA, ParamsB
shatter_4 = Shatter(Curve=curve_for_mirror, Parameters=ccx_3.ParamsA)
tooth_fillet_radius_2 = Panel(tooth_fillet_radius)
item_7 = ListItem(List=shatter_4, Index=0, Wrap=True)
mirror_3 = Mirror(Geometry=item_7, Plane=tooth_mid_plane_2)  # -> Geometry, Transform
join = JoinCurves(Curves=[item_7, mirror_3.Geometry], Preserve=False)
fillet = Fillet(Curve=join, Radius=tooth_fillet_radius_2)
trimmed_valley_2 = Curve(trimmed_valley)
gear_profile = Curve(fillet)

number_of_gear_teeth_6 = Panel(number_of_gear_teeth_3)
gear_center_plane_5 = Plane(gear_center_plane)
tooth_valley = Curve(trimmed_valley_2)
tooth_profile = Curve(gear_profile)
division_10 = Division(A="360", B=number_of_gear_teeth_6)
series_3 = Series(Start=0, Step=division_10, Count=number_of_gear_teeth_6)
rotate_4 = Rotate(Geometry=[tooth_profile, tooth_valley], Angle=degrees(series_3), Plane=gear_center_plane_5)  # -> Geometry, Transform
join_2 = JoinCurves(Curves=flatten(rotate_4.Geometry), Preserve=False)
gear_teeth = Curve(join_2)

pinion_center_hole_3 = Curve(pinion_center_hole_2)
pinion_center_plane_2 = Plane(pinion_center_plane)
gear_center_plane_6 = Plane(gear_center_plane)
orient = Orient(Geometry=pinion_center_hole_3, Source=pinion_center_plane_2, Target=gear_center_plane_6)  # -> Geometry, Transform
gear_center_hole = Curve(orient.Geometry)

# ---- group: Create pinion movement preview
pinion_center_plane_3 = Plane(pinion_center_plane)
pinion_teeth_3 = Curve(pinion_teeth_2)
preview_position_0_1_3 = Number(preview_position_0_1_2)
multiplication_10 = Multiplication(A="360", B=preview_position_0_1_3)
neg_3 = Negative(Value=multiplication_10)
rad_2 = Radians(Degrees=neg_3)
rotate_5 = Rotate(Geometry=flatten(pinion_teeth_3), Angle=rad_2, Plane=pinion_center_plane_3)  # -> Geometry, Transform
pinion_movement_preview = Curve(rotate_5.Geometry)

# ----
gear_center_hole_2 = Curve(gear_center_hole)
pinion_movement_preview_2 = Curve(pinion_movement_preview)
gear_teeth_2 = Curve(gear_teeth)
gear_teeth_3 = ClusterOutput(gear_teeth_2)
gear_center_hole_3 = ClusterOutput(gear_center_hole_2)
pinion_movement_preview_3 = ClusterOutput(pinion_movement_preview_2)

# ---- group: Create pinion movement preview
preview_position_0_1_4 = Number(preview_position_0_1_2)
gear_center_plane_7 = Plane(gear_center_plane)
number_of_gear_teeth_7 = Panel(number_of_gear_teeth_3)
number_of_pinion_teeth_4 = Panel(number_of_pinion_teeth)
gear_teeth_4 = Curve(gear_teeth)
division_11 = Division(A=number_of_pinion_teeth_4, B=number_of_gear_teeth_7)
multiplication_11 = Multiplication(A="360", B=preview_position_0_1_4)
neg_4 = Negative(Value=multiplication_11)
rad_3 = Radians(Degrees=neg_4)
multiplication_12 = Multiplication(A=rad_3, B=division_11)

# ----
neg_5 = Negative(Value=multiplication_12)

# ---- group: Create pinion movement preview (continued)
rotate_6 = Rotate(Geometry=flatten(gear_teeth_4), Angle=neg_5, Plane=gear_center_plane_7)  # -> Geometry, Transform
gear_movement_preview = Curve(rotate_6.Geometry)

# ----
gear_movement_preview_2 = Curve(gear_movement_preview)
gear_movement_preview_3 = ClusterOutput(gear_movement_preview_2)
