# Grasshopper definition fab_axis_new-hulti_config_example.gh (Grasshopper 1.0.7)

# ---- group: X
glideblockposition = Slider(200, range=0..1000)
materialthickness = Slider(8, range=8..20)
glideblocklength = Slider(200, range=100..200)
length = Slider(500, range=200..2000)
width = Slider(100, range=80..140)
list = ValueList({"Nema17": 1, "Nema23": 2}, selected="Nema17")
list_2 = ValueList({"1:2": 0, "1:4": 1, "1:8": 2, "1:16": 3}, selected="1:4")

# ---- group: Z
glideblockposition_2 = Slider(150, range=0..1000)
length_2 = Slider(400, range=200..2000)

# ---- group: Y
glideblockposition_3 = Slider(100, range=0..1000)
length_3 = Slider(500, range=200..2000)

# ----
fabricatable_axis = FabricatableAxis(
    length=length,
    width=width,
    materialthickness=materialthickness,
    gblength=glideblocklength,
    gbposition=glideblockposition,
    motor=list,
    gearing=list_2)  # -> fabricatable_axis, axis_plane_3
orient_axis_plane = OrientAxisPlane(
    axis_plane=fabricatable_axis.axis_plane_3,
    offset_x=Slider(100, range=0..100),
    offset_y=0,
    offset_z=0,
    rotation_x=Slider(-90, range=-90..90),
    rotation_y=0,
    rotation_z=0)
fabricatable_axis_2 = FabricatableAxis(
    length=length_2,
    width=width,
    materialthickness=materialthickness,
    axis_plane=orient_axis_plane,
    gblength=glideblocklength,
    gbposition=glideblockposition_2,
    motor=list,
    gearing=list_2)  # -> fabricatable_axis, axis_plane_3
addition = Addition(A=width, B=glideblockposition_3)
orient_axis_plane_2 = OrientAxisPlane(
    axis_plane=fabricatable_axis_2.axis_plane_3,
    offset_x=Slider(180, range=0..1000),
    offset_y=addition,
    offset_z=Slider(18, range=0..100),
    rotation_x=Slider(180, range=0..1000),
    rotation_y=0,
    rotation_z=Slider(90, range=-90..90))
fabricatable_axis_3 = FabricatableAxis(
    length=length_3,
    width=width,
    materialthickness=materialthickness,
    axis_plane=orient_axis_plane_2,
    gblength=glideblocklength,
    gbposition=glideblockposition_3,
    motor=list,
    gearing=list_2)  # -> fabricatable_axis, axis_plane_3

# ==== cluster FabricatableAxis
materialthickness = ClusterInput()
axis_plane = ClusterInput()
gblength = ClusterInput()
gbposition = ClusterInput()
gearing = ClusterInput()
motor = ClusterInput()
length = ClusterInput()
width = ClusterInput()

# ---- group: Use origo xy plane if no plane is given
axis_plane_2 = Plane(axis_plane)
item = ListItem(List=flatten(axis_plane_2), Index=0, Wrap=True)
xy = XYPlane(Origin=Point(0, 0, 0))
null = NullItem(Item=item)  # -> NullFlags, InvalidFlags, Description
filter = StreamFilter(Gate=null.NullFlags, Stream0=axis_plane_2, Stream1=xy)

# ----
rail = Axis(lenght=length, material=materialthickness, width=width)
glideblock = GlideBlock(material=materialthickness, width=width, gb_length=gblength, position="0", motor=motor, gearing=gearing)

# ---- group: Create a plane on glideblock
bbox = BoundingBox(Content=glideblock, Plane=PlaneXY(0, 0, 0), UnionBox=True)  # -> Box, Box_2
debrep = DeconstructBrep(Brep=bbox.Box)  # -> Faces, Edges, Vertices
item_2 = ListItem(List=debrep.Vertices, Index="4", Wrap=True)
xy_2 = XYPlane(Origin=item_2)

# ---- group: Move Glideblock after creating geomtry to speed up preview framerate (fail, seems to not work, geomtery still gets recomputed with open slider input)
X = UnitX(Factor=gbposition)
move = Move(Geometry=glideblock, Motion=X)  # -> Geometry, Transform

# ---- group: Move glideblock plane
X_2 = UnitX(Factor=gbposition)
move_2 = Move(Geometry=xy_2, Motion=X_2)  # -> Geometry, Transform

# ----
merge = Merge(Data1=rail, Data2=move.Geometry)

# ---- group: Move axis geometry from origo to axis plane
xy_3 = XYPlane(Origin=Point(0, 0, 0))
orient = Orient(Geometry=merge, Source=xy_3, Target=filter)  # -> Geometry, Transform

# ---- group: Orient plane to axis plane
xy_4 = XYPlane(Origin=Point(0, 0, 0))
orient_2 = Orient(Geometry=move_2.Geometry, Source=xy_4, Target=filter)  # -> Geometry, Transform

# ----
fabricatable_axis = ClusterOutput(orient.Geometry)
axis_plane_3 = ClusterOutput(orient_2.Geometry)  # Axis plane

# ==== cluster OrientAxisPlane
rotation_x = ClusterInput()
rotation_y = ClusterInput()
rotation_z = ClusterInput()
axis_plane = ClusterInput()
offset_x = ClusterInput()
offset_z = ClusterInput()
offset_y = ClusterInput()
rotation_z_2 = Number(rotation_z)
axis_plane_2 = Plane(axis_plane)
rotation_x_2 = Number(rotation_x)
rotation_y_2 = Number(rotation_y)
offset_x_2 = Number(offset_x)
offset_y_2 = Number(offset_y)
offset_z_2 = Number(offset_z)
deplane = DeconstructPlane(Plane=axis_plane_2)  # -> Origin, XAxis, YAxis, ZAxis

# ---- group: Rotate axis plane around X, Y, and Z
rot3d = Rotate3D(Geometry=axis_plane_2, Angle=degrees(rotation_y_2), Center=deplane.Origin, Axis=deplane.XAxis)  # -> Geometry, Transform
rot3d_2 = Rotate3D(Geometry=rot3d.Geometry, Angle=degrees(rotation_x_2), Center=deplane.Origin, Axis=deplane.YAxis)  # -> Geometry, Transform
rot3d_3 = Rotate3D(Geometry=rot3d_2.Geometry, Angle=degrees(rotation_z_2), Center=deplane.Origin, Axis=deplane.ZAxis)  # -> Geometry, Transform

# ---- group: Move axis plane along X, Y and Z
amp = Amplitude(Vector=deplane.XAxis, Amplitude=offset_x_2)
amp_2 = Amplitude(Vector=deplane.YAxis, Amplitude=offset_y_2)
amp_3 = Amplitude(Vector=deplane.ZAxis, Amplitude=offset_z_2)
move = Move(Geometry=rot3d_3.Geometry, Motion=amp)  # -> Geometry, Transform
move_2 = Move(Geometry=move.Geometry, Motion=amp_2)  # -> Geometry, Transform
move_3 = Move(Geometry=move_2.Geometry, Motion=amp_3)  # -> Geometry, Transform

# ----
oriented_axis_plane = Plane(move_3.Geometry)
oriented_axis_plane_2 = ClusterOutput(oriented_axis_plane)

# ==== cluster Axis
lenght = ClusterInput()
material = ClusterInput()
width = ClusterInput()
pt = ConstructPoint(XCoordinate=lenght, YCoordinate=width, ZCoordinate=material)
pt_2 = ConstructPoint(XCoordinate=0, YCoordinate=0, ZCoordinate=0)
c_script = CSharpScript(width=width, length=lenght, material=material, groove=Slider(20, range=0..30))  # -> out, A; inputs width: Int32, length: Int32, material: Int32, groove: Int32
# ---------- c_script: C# ----------
Point3d p0 = new Point3d(0,width/2-groove/2,3);
Point3d p1 = new Point3d(length,width/2+groove/2,material);

BoundingBox b = new BoundingBox(p0,p1);

A = b;
# ---------- end c_script ----------
box = Box2Pt(PointA=pt_2, PointB=pt, Plane=PlaneXY(0, 0, 0))
sdiff = SolidDifference(BrepsA=box, BrepsB=c_script.A)
rail = ClusterOutput(sdiff)

# ==== cluster GlideBlock
number_slider = Slider(2, range=0..10)
number_slider_2 = Slider(2, range=0..10)
gb_length = ClusterInput()
material = ClusterInput()
width = ClusterInput()
position = ClusterInput()
motor = ClusterInput()
gearing = ClusterInput()
cluster = Cluster_7(motor=motor, material=material, gearing=gearing)
cluster_2 = Cluster_12(material=material, gb_length=gb_length, bearing_offset=number_slider, position=position, width=width)
side_plate = Object(material=material, gb_length=gb_length, bearing_offset=number_slider, position=position, plate_offset=number_slider_2)
axis_plate = Axis_plate(
    position=position,
    plate_offset=number_slider_2,
    material=material,
    width=width,
    gb_length=gb_length,
    bearing_offset=number_slider)
merge = Merge(Data1=axis_plate, Data2=side_plate, Data3=cluster_2, Data4=cluster)  # -> flatten(Result)
group = Group(Objects=merge)
glideblock = ClusterOutput(group)

# ==== cluster Axis_plate
bearing_offset = ClusterInput()
plate_offset = ClusterInput()
gb_length = ClusterInput()
position = ClusterInput()
width = ClusterInput()
material = ClusterInput()
cluster = Cluster(material=material, width=width, gb_length=gb_length, plate_offset=plate_offset)
top_bearings = CSharpScript(width=width, material=material, offset=plate_offset, gbLength=gb_length)  # -> holes; inputs width: Int32, material: Int32, offset: Int32, gbLength: Int32
# ---------- top_bearings: C# ----------
int distX = 6;
int distY = 8;
int rad = 3;
Point3d[] points = new Point3d[4];

points[0] = new Point3d(distX,-offset-material+distY,material);
points[1] = new Point3d(distX,width + material - distY,material);
points[2] = new Point3d(gbLength-distX,-offset-material+distY,material);
points[3] = new Point3d(gbLength-distX,width + material - distY,material);

Cylinder[] c = new Cylinder[4];
c[0] = new Cylinder(new Circle(points[0],rad),-material);
c[1] = new Cylinder(new Circle(points[1],rad),-material);
c[2] = new Cylinder(new Circle(points[2],rad),-material);
c[3] = new Cylinder(new Circle(points[3],rad),-material);

holes = c;
# ---------- end top_bearings ----------
top_bearings_2 = CSharpScript(width=width, material=material, offset=plate_offset, gbLength=gb_length)  # -> cuts; inputs width: Int32, material: Int32, offset: Int32, gbLength: Int32
# ---------- top_bearings_2: C# ----------
int test = 15;
int b = 16; //bearing width
int d = 15; //bearing depth;


BoundingBox[] boxes = new BoundingBox[4];

Point3d boxPointA  = new Point3d(gbLength/2-10-b,-material-offset, 0);
Point3d boxPointB  = new Point3d(gbLength/2-10,-material-offset+d,material);

//define box0
boxes[0] = new BoundingBox(boxPointA, boxPointB);

//copy and mirror box0
boxes[1] = boxes[0];
Plane p1 = new Plane(new Point3d(gbLength/2,0,0),new Vector3d(1,0,0));
boxes[1].Transform(new Transform(Transform.Mirror(p1)));

//copy and mirror box0 & box1
Plane p2 = new Plane(new Point3d(0,width/2,0),new Vector3d(0,1,0));

boxes[2] = boxes[0];
boxes[3] = boxes[1];
boxes[2].Transform(new Transform(Transform.Mirror(p2)));
boxes[3].Transform(new Transform(Transform.Mirror(p2)));

cuts = boxes;
# ---------- end top_bearings_2 ----------
top_bearings_3 = CSharpScript(width=width, material=material, offset=plate_offset, gbLength=gb_length)  # -> holes; inputs width: Int32, material: Int32, offset: Int32, gbLength: Int32
# ---------- top_bearings_3: C# ----------
int distX = 6;
int distY = 8;
int rad = 3;
Point3d[] points = new Point3d[4];

points[0] = new Point3d(40,width/2,material);
points[1] = new Point3d(distX,width + material - distY,material);
points[2] = new Point3d(gbLength-distX,-offset-material+distY,material);
points[3] = new Point3d(gbLength-distX,width + material - distY,material);

Cylinder[] c = new Cylinder[4];
c[0] = new Cylinder(new Circle(points[0],22),-material);
//c[1] = new Cylinder(new Circle(points[1],rad),-material);
//c[2] = new Cylinder(new Circle(points[2],rad),-material);
//c[3] = new Cylinder(new Circle(points[3],rad),-material);

holes = c;
# ---------- end top_bearings_3 ----------
top_bearings_4 = CSharpScript(width=width, material=material, offset=plate_offset, gbLength=gb_length)  # -> cuts; inputs width: Int32, material: Int32, offset: Int32, gbLength: Int32
# ---------- top_bearings_4: C# ----------
int test = 15;
int b = 16; //bearing width
int d = 15; //bearing depth;


BoundingBox[] boxes = new BoundingBox[4];
Plane p1 = new Plane(new Point3d(gbLength/2,0,0),new Vector3d(1,0,0));

Point3d boxPointA  = new Point3d(0,4,0);
Point3d boxPointB  = new Point3d(20,7,material);

Point3d boxPointC  = new Point3d(12,-6,0);
Point3d boxPointD  = new Point3d(20,2,material);

//define box0
boxes[0] = new BoundingBox(boxPointA, boxPointB);
boxes[1] = new BoundingBox(boxPointC, boxPointD);

//copy and mirror box0
boxes[2] = boxes[0];
boxes[2].Transform(new Transform(Transform.Mirror(p1)));
boxes[3] = boxes[1];
boxes[3].Transform(new Transform(Transform.Mirror(p1)));

cuts = boxes;
# ---------- end top_bearings_4 ----------
addition = Addition(A=plate_offset, B=material)
merge = Merge(Data1=top_bearings, Data2=top_bearings_2, Data3=top_bearings_4, Data4=top_bearings_3)
sdiff = SolidDifference(BrepsA=cluster, BrepsB=merge)
vec = VectorXYZ(XComponent=position, YComponent=0, ZComponent=addition)  # -> Vector, Length
move = Move(Geometry=sdiff, Motion=vec.Vector)  # -> Geometry, Transform
edges = BrepEdges(Brep=cluster)  # -> Naked, Interior, NonManifold
axis_plate = ClusterOutput(move.Geometry)

# ==== cluster Object
bearing_offset = ClusterInput()
material = ClusterInput()
gb_length = ClusterInput()
width = ClusterInput()
number_slider = Slider(3, range=0..10)
cluster = Cluster_2(material=material, gb_length=gb_length)
cluster_2 = Cluster_3(gb_length=gb_length, material=material, bearings_offset=bearing_offset)
cluster_3 = Cluster_4(gb_length=gb_length, bearing_offset=bearing_offset, bearing_rad=number_slider, material=material)
cluster_4 = Cluster_5(gb_length=gb_length, bearing_offset=bearing_offset, bearing_rad=number_slider, material=material)
cluster_5 = Cluster_6(material=material, gb_length=gb_length)
merge = Merge(Data1=cluster_3, Data2=cluster_4, Data3=cluster_5)
sunion = SolidUnion(Breps=[cluster_2, cluster])
plate_offset = ClusterInput()
sdiff = SolidDifference(BrepsA=sunion, BrepsB=merge)
position = ClusterInput()
neg = Negative(Value=plate_offset)
addition = Addition(A=neg)
pt = ConstructPoint(XCoordinate=position, YCoordinate=addition, ZCoordinate=0)
move = Move(Geometry=sdiff, Motion=pt)  # -> Geometry, Transform
side_plate = ClusterOutput(move.Geometry)

# ==== cluster Cluster_7
material = ClusterInput()
motor = ClusterInput()
gearing = ClusterInput()
pt = ConstructPoint(XCoordinate=0, YCoordinate=0, ZCoordinate=0)
pt_2 = ConstructPoint(XCoordinate=0, YCoordinate=0, ZCoordinate=0)
box = Box2Pt(PointA=pt, PointB=pt_2, Plane=PlaneXY(0, 0, 0))
motorassembly = ClusterOutput(box)

# ==== cluster Cluster_12
bearing_offset = ClusterInput()
material = ClusterInput()
gb_length = ClusterInput()
width = ClusterInput()
number_slider = Slider(3, range=0..10)
cluster = Cluster_2(material=material, gb_length=gb_length)
cluster_2 = Cluster_8(gb_length=gb_length, material=material, bearings_offset=bearing_offset)
cluster_3 = Cluster_9(gb_length=gb_length, bearing_offset=bearing_offset, bearing_rad=number_slider, material=material)
cluster_4 = Cluster_10(gb_length=gb_length, bearing_offset=bearing_offset, bearing_rad=number_slider, material=material)
cluster_5 = Cluster_11(material=material, gb_length=gb_length)
merge = Merge(Data1=cluster_3, Data2=cluster_4, Data3=cluster_5)
sunion = SolidUnion(Breps=[cluster_2, cluster])
sdiff = SolidDifference(BrepsA=sunion, BrepsB=merge)
position = ClusterInput()
addition = Addition(A=material, B=width)
pt = ConstructPoint(XCoordinate=position, YCoordinate=addition, ZCoordinate=0)
move = Move(Geometry=sdiff, Motion=pt)  # -> Geometry, Transform
side_plate = ClusterOutput(move.Geometry)

# ==== cluster Cluster
plate_offset = ClusterInput()
gb_length = ClusterInput()
material = ClusterInput()
width = ClusterInput()
addition = Addition(A=width, B=plate_offset)
neg = Negative(Value=plate_offset)
vec = VectorXYZ(XComponent=gb_length, YComponent=addition, ZComponent=material)  # -> Vector, Length
pt = ConstructPoint(XCoordinate=0, YCoordinate=neg, ZCoordinate=0)
addition_2 = Addition(A=pt, B=vec.Vector)
Y = UnitY(Factor=material)
addition_3 = Addition(A=Y, B=addition_2)
neg_2 = Negative(Value=Y)
panel = Panel("""8
9
10
11""")
addition_4 = Addition(A=neg_2, B=pt)
box = Box2Pt(PointA=addition_3, PointB=addition_4, Plane=PlaneXY(0, 0, 0))
filedge = FilletEdge(Shape=box, Blend=0, Metric=0, Edges=panel, Radii=Slider(2, range=0..10))
plate = ClusterOutput(filedge)

# ==== cluster Cluster_2
number_slider = Slider(10, range=0..100)
material = ClusterInput()
gb_length = ClusterInput()
neg = Negative(Value=number_slider)
neg_2 = Negative(Value=material)
subtraction = Subtraction(A=gb_length, B=number_slider)
neg_3 = Negative(Value=Slider(13, range=0..15))
pt = ConstructPoint(XCoordinate=number_slider, YCoordinate=0, ZCoordinate=neg_3)
pt_2 = ConstructPoint(XCoordinate=subtraction, YCoordinate=neg_2, ZCoordinate=material)
box = Box2Pt(PointA=pt, PointB=pt_2, Plane=PlaneXY(0, 0, 0))
side_plate = ClusterOutput(box)

# ==== cluster Cluster_3
width = Slider(20, range=0..100)
gb_length = ClusterInput()
bearings_offset = ClusterInput()
material = ClusterInput()
neg = Negative(Value=width)
division = Division(A=gb_length, B=2)
subtraction = Subtraction(A=division, B=bearings_offset)
neg_2 = Negative(Value=material)
subtraction_2 = Subtraction(A=subtraction, B=Slider(10, range=0..10))
vec = VectorXYZ(XComponent=neg, YComponent=neg_2, ZComponent=material)  # -> Vector, Length
pt = ConstructPoint(XCoordinate=subtraction_2, YCoordinate=0, ZCoordinate=material)
pt_2 = ConstructPoint(XCoordinate=division, YCoordinate=0, ZCoordinate=0)
addition = Addition(A=pt, B=vec.Vector)
xy = XYPlane(Origin=pt)
yz = YZPlane(Origin=pt_2)
box = Box2Pt(PointA=pt, PointB=addition, Plane=PlaneXY(0, 0, 0))
mirror = Mirror(Geometry=box, Plane=yz)  # -> Geometry, Transform
merge = Merge(Data1=mirror.Geometry, Data2=box)
solids = ClusterOutput(merge)

# ==== cluster Cluster_4
bearing_offset = ClusterInput()
gb_length = ClusterInput()
bearing_rad = ClusterInput()
material = ClusterInput()
addition = Addition(A=material, B=Slider(8, range=0..10))
division = Division(A=gb_length, B=2)
pt = ConstructPoint(XCoordinate=0, YCoordinate=0, ZCoordinate=addition)
subtraction = Subtraction(A=division, B=bearing_offset)
subtraction_2 = Subtraction(A=subtraction, B=Slider(20, range=0..20))
pt_2 = ConstructPoint(XCoordinate=subtraction_2, YCoordinate=0, ZCoordinate=0)
addition_2 = Addition(A=pt_2, B=pt)
xz = XZPlane(Origin=addition_2)
cyl = Cylinder(Base=xz, Radius=bearing_rad, Length=material)
division_2 = Division(A=gb_length, B=2)
pt_3 = ConstructPoint(XCoordinate=division_2, YCoordinate=0, ZCoordinate=0)
yz = YZPlane(Origin=pt_3)
mirror = Mirror(Geometry=cyl, Plane=yz)  # -> Geometry, Transform
merge = Merge(Data1=cyl, Data2=mirror.Geometry)
solid = ClusterOutput(merge)

# ==== cluster Cluster_5
bearing_offset = ClusterInput()
gb_length = ClusterInput()
bearing_rad = ClusterInput()
material = ClusterInput()
neg = Negative(Value=material)
neg_2 = Negative(Value=Slider(8, range=0..10))
division = Division(A=gb_length, B=2)
pt = ConstructPoint(XCoordinate=0, YCoordinate=0, ZCoordinate=neg_2)
subtraction = Subtraction(A=division, B=bearing_offset)
subtraction_2 = Subtraction(A=subtraction, B=Slider(45, range=0..50))
pt_2 = ConstructPoint(XCoordinate=subtraction_2, YCoordinate=0, ZCoordinate=0)
addition = Addition(A=pt_2, B=pt)
xz = XZPlane(Origin=addition)
cyl = Cylinder(Base=xz, Radius=bearing_rad, Length=material)
division_2 = Division(A=gb_length, B=2)
pt_3 = ConstructPoint(XCoordinate=division_2, YCoordinate=0, ZCoordinate=0)
yz = YZPlane(Origin=pt_3)
mirror = Mirror(Geometry=cyl, Plane=yz)  # -> Geometry, Transform
merge = Merge(Data1=cyl, Data2=mirror.Geometry)
solid = ClusterOutput(merge)

# ==== cluster Cluster_6
material = ClusterInput()
gb_length = ClusterInput()
neg = Negative(Value=Slider(7, range=0..10))
neg_2 = Negative(Value=Slider(2, range=0..10))
neg_3 = Negative(Value=Slider(0, range=0..10))
neg_4 = Negative(Value=material)
Z = UnitZ(Factor=Slider(4, range=0..10))
vec = VectorXYZ(XComponent=neg, YComponent=material, ZComponent=neg)  # -> Vector, Length
pt = ConstructPoint(XCoordinate=Slider(18, range=0..20), YCoordinate=neg_4, ZCoordinate=neg_3)
panel = Panel("""1
3
5
7""")
pt_2 = ConstructPoint(XCoordinate=0, YCoordinate=0, ZCoordinate=neg_2)
subtraction = Subtraction(A=pt, B=Z)
addition = Addition(A=subtraction, B=vec.Vector)
panel_2 = Panel("""1
5""")
box = Box2Pt(PointA=pt, PointB=pt_2, Plane=PlaneXY(0, 0, 0))
division = Division(A=gb_length, B=2)
box_2 = Box2Pt(PointA=subtraction, PointB=addition, Plane=PlaneXY(0, 0, 0))
X = UnitX(Factor=Slider(10, range=0..10))
X_2 = UnitX(Factor=division)
move = Move(Geometry=box_2, Motion=X)  # -> Geometry, Transform
filedge = FilletEdge(Shape=box, Blend=0, Metric=0, Edges=panel_2, Radii=Slider(1, range=0..1))
filedge_2 = FilletEdge(Shape=move.Geometry, Blend=0, Metric=0, Edges=panel, Radii=Slider(1, range=0..1))
merge = Merge(Data1=filedge, Data2=filedge_2)
yz = YZPlane(Origin=X_2)
mirror = Mirror(Geometry=merge, Plane=yz)  # -> Geometry, Transform
merge_2 = Merge(Data1=mirror.Geometry, Data2=merge)
solid = ClusterOutput(merge_2)

# ==== cluster Cluster_8
width = Slider(20, range=0..100)
gb_length = ClusterInput()
bearings_offset = ClusterInput()
material = ClusterInput()
neg = Negative(Value=width)
division = Division(A=gb_length, B=2)
neg_2 = Negative(Value=material)
subtraction = Subtraction(A=division, B=bearings_offset)
vec = VectorXYZ(XComponent=neg, YComponent=neg_2, ZComponent=material)  # -> Vector, Length
pt = ConstructPoint(XCoordinate=subtraction, YCoordinate=0, ZCoordinate=material)
pt_2 = ConstructPoint(XCoordinate=division, YCoordinate=0, ZCoordinate=0)
addition = Addition(A=pt, B=vec.Vector)
xy = XYPlane(Origin=pt)
yz = YZPlane(Origin=pt_2)
box = Box2Pt(PointA=pt, PointB=addition, Plane=PlaneXY(0, 0, 0))
mirror = Mirror(Geometry=box, Plane=yz)  # -> Geometry, Transform
merge = Merge(Data1=mirror.Geometry, Data2=box)
solids = ClusterOutput(merge)

# ==== cluster Cluster_9
bearing_offset = ClusterInput()
gb_length = ClusterInput()
bearing_rad = ClusterInput()
material = ClusterInput()
addition = Addition(A=material, B=Slider(8, range=0..10))
division = Division(A=gb_length, B=2)
pt = ConstructPoint(XCoordinate=0, YCoordinate=0, ZCoordinate=addition)
subtraction = Subtraction(A=division, B=bearing_offset)
subtraction_2 = Subtraction(A=subtraction, B=Slider(10, range=0..10))
pt_2 = ConstructPoint(XCoordinate=subtraction_2, YCoordinate=0, ZCoordinate=0)
addition_2 = Addition(A=pt_2, B=pt)
xz = XZPlane(Origin=addition_2)
cyl = Cylinder(Base=xz, Radius=bearing_rad, Length=material)
division_2 = Division(A=gb_length, B=2)
pt_3 = ConstructPoint(XCoordinate=division_2, YCoordinate=0, ZCoordinate=0)
yz = YZPlane(Origin=pt_3)
mirror = Mirror(Geometry=cyl, Plane=yz)  # -> Geometry, Transform
merge = Merge(Data1=cyl, Data2=mirror.Geometry)
solid = ClusterOutput(merge)

# ==== cluster Cluster_10
bearing_offset = ClusterInput()
gb_length = ClusterInput()
bearing_rad = ClusterInput()
material = ClusterInput()
neg = Negative(Value=material)
neg_2 = Negative(Value=Slider(8, range=0..10))
division = Division(A=gb_length, B=2)
pt = ConstructPoint(XCoordinate=0, YCoordinate=0, ZCoordinate=neg_2)
subtraction = Subtraction(A=division, B=bearing_offset)
subtraction_2 = Subtraction(A=subtraction, B=Slider(30, range=0..50))
pt_2 = ConstructPoint(XCoordinate=subtraction_2, YCoordinate=0, ZCoordinate=0)
addition = Addition(A=pt_2, B=pt)
xz = XZPlane(Origin=addition)
cyl = Cylinder(Base=xz, Radius=bearing_rad, Length=material)
division_2 = Division(A=gb_length, B=2)
pt_3 = ConstructPoint(XCoordinate=division_2, YCoordinate=0, ZCoordinate=0)
yz = YZPlane(Origin=pt_3)
mirror = Mirror(Geometry=cyl, Plane=yz)  # -> Geometry, Transform
merge = Merge(Data1=cyl, Data2=mirror.Geometry)
solid = ClusterOutput(merge)

# ==== cluster Cluster_11
material = ClusterInput()
gb_length = ClusterInput()
neg = Negative(Value=Slider(7, range=0..10))
neg_2 = Negative(Value=Slider(2, range=0..10))
neg_3 = Negative(Value=Slider(0, range=0..10))
neg_4 = Negative(Value=material)
Z = UnitZ(Factor=Slider(4, range=0..10))
vec = VectorXYZ(XComponent=neg, YComponent=material, ZComponent=neg)  # -> Vector, Length
pt = ConstructPoint(XCoordinate=Slider(18, range=0..20), YCoordinate=neg_4, ZCoordinate=neg_3)
panel = Panel("""1
3
5
7""")
pt_2 = ConstructPoint(XCoordinate=0, YCoordinate=0, ZCoordinate=neg_2)
subtraction = Subtraction(A=pt, B=Z)
addition = Addition(A=subtraction, B=vec.Vector)
panel_2 = Panel("""1
5""")
box = Box2Pt(PointA=pt, PointB=pt_2, Plane=PlaneXY(0, 0, 0))
division = Division(A=gb_length, B=2)
box_2 = Box2Pt(PointA=subtraction, PointB=addition, Plane=PlaneXY(0, 0, 0))
X = UnitX(Factor=division)
filedge = FilletEdge(Shape=box, Blend=0, Metric=0, Edges=panel_2, Radii=Slider(1, range=0..1))
filedge_2 = FilletEdge(Shape=box_2, Blend=0, Metric=0, Edges=panel, Radii=Slider(1, range=0..1))
merge = Merge(Data1=filedge, Data2=filedge_2)
yz = YZPlane(Origin=X)
mirror = Mirror(Geometry=merge, Plane=yz)  # -> Geometry, Transform
merge_2 = Merge(Data1=mirror.Geometry, Data2=merge)
solid = ClusterOutput(merge_2)
