# Grasshopper definition holes-instead-of-planes-clusters-for-bracket-autogen.gh (Grasshopper 1.0.7)

screw_spacing_x = Panel("50")
screw_spacing_y = Panel("40")
hole_diameter = Panel("5")
xy = XYPlane(Origin=Point(0, 0, 0))
make_attachment_holes = MakeAttachmentHoles(axis_plane=xy, num_2=screw_spacing_x, num_3=screw_spacing_y, num=hole_diameter)
cluster = Cluster(attachment_holes=make_attachment_holes)  # -> axis_plane_2, hole_planes_2, hole_diameter_2

# ==== cluster MakeAttachmentHoles
num = ClusterInput()
num_2 = ClusterInput()
num_3 = ClusterInput()
axis_plane = ClusterInput()
num_4 = Number(num)
num_5 = Number(num_2)
num_6 = Number(num_3)
axis_plane_2 = Plane(axis_plane)
screw_spacing_x = Panel(num_5)
screw_spacing_y = Panel(num_6)
hole_diameter = Panel(num_4)
deplane = DeconstructPlane(Plane=axis_plane_2)  # -> Origin, XAxis, YAxis, ZAxis
division = Division(A=hole_diameter, B="2")
amp = Amplitude(Vector=deplane.YAxis, Amplitude=screw_spacing_y)
amp_2 = Amplitude(Vector=deplane.XAxis, Amplitude=screw_spacing_x)
move = Move(Geometry=axis_plane_2, Motion=amp)  # -> Geometry, Transform
move_2 = Move(Geometry=axis_plane_2, Motion=amp_2)  # -> Geometry, Transform
move_3 = Move(Geometry=move_2.Geometry, Motion=amp)  # -> Geometry, Transform
pln = Plane(axis_plane_2)
merge = Merge(Data1=pln, Data2=move.Geometry, Data3=move_3.Geometry, Data4=move_2.Geometry)
cir = Circle(Plane=merge, Radius=division)
attachment_holes = Curve(cir)
attachment_holes_2 = ClusterOutput(attachment_holes)

# ==== cluster Cluster
attachment_holes = ClusterInput()
attachment_holes_2 = Curve(attachment_holes)
item = ListItem(List=attachment_holes_2, Index=0, Wrap=True)
pi = Pi(Factor=1)
area = Area(Geometry=attachment_holes_2)  # -> Area, Centroid
len = Length(Curve=item)
division = Division(A=len, B=pi)
item_2 = ListItem(List=area.Centroid, Index="0", Wrap=True)
item_3 = ListItem(List=area.Centroid, Index="1", Wrap=True)
item_4 = ListItem(List=area.Centroid, Index="3", Wrap=True)
vec2pt = Vector2Pt(PointA=item_2, PointB=item_3, Unitize=False)  # -> Vector, Length
vec2pt_2 = Vector2Pt(PointA=item_2, PointB=item_4, Unitize=False)  # -> Vector, Length
pl = ConstructPlane(Origin=item_2, XAxis=vec2pt_2.Vector, YAxis=vec2pt.Vector)
pl_2 = ConstructPlane(Origin=area.Centroid, XAxis=vec2pt_2.Vector, YAxis=vec2pt.Vector)
hole_planes = Plane(pl_2)
hole_diameter = Number(division)
axis_plane = Plane(pl)
axis_plane_2 = ClusterOutput(axis_plane)
hole_diameter_2 = ClusterOutput(hole_diameter)
hole_planes_2 = ClusterOutput(hole_planes)
