# Grasshopper definition Award plotter g-code generator.gh (Grasshopper 0.9.76)
# plug-ins: Python Interpreter, Firefly.X

part4 = Curve([<curve referenced from the Rhino model> x118])
part5 = Curve([<curve referenced from the Rhino model> x704])
part2 = Curve([<curve referenced from the Rhino model> x29])
part3 = Curve([<curve referenced from the Rhino model> x34])
part1 = Curve([<curve referenced from the Rhino model> x11])
merge = Merge(Data1=part1, Data2=part2, Data3=part3, Data4=part4, Data5=part5)
right_click_and_choose_set_multiple_curv = Curve([<curve referenced from the Rhino model> x4])  # "Right click and choose \"Set Multiple Curves\""
feed_rate = Panel("20")
jog_rate = Panel("50")
home_x = Panel("0")
home_y = Panel("-100")
serov_angle_pen_down = Panel("-80")
serov_angle_pen_up = Panel("90")
servo_command = Panel("M280")
servo_index = Panel("0")
servo_move_speed = Panel("3000")
input_geometry = GeometryPipeline(
    GroupByLayer=False,
    GroupByType=False,
    IncludeHidden=True,
    IncludeLocked=True,
    LayerFilter="Award plot",
    NameFilter="*",
    TypeFilter=4)
crv = Curve(input_geometry)
multiplication = Multiplication(A=feed_rate, B="60")
multiplication_2 = Multiplication(A=jog_rate, B="60")
home_x_2 = Number(home_x)
home_y_2 = Number(home_y)
toolpaths = Curve(merge)
feed_rate_2 = Number(multiplication)
jog_rate_2 = Number(multiplication_2)
# POST /api/files/local/whistle_v2.gcode HTTP/1.1
# Host: example.com
# Content-Type: application/json
# X-Api-Key: abcdef...
# 
# {
#   "command": "select",
#   "print": true
# }
# POST /api/files/local/vbird.gcode HTTP/1.1
# Host: vbird.local
# Content-Type: application/json
# X-Api-Key: abcdef...
# 
# {
#   "command": "select",
#   "print": true
# }
panel = Panel(" R")
merge_2 = Merge(
    Data1=servo_command,
    Data2=" S",
    Data3=serov_angle_pen_up,
    Data4=" P",
    Data5=servo_index,
    Data6=" F",
    Data7=servo_move_speed,
    Data8=panel)
merge_3 = Merge(
    Data1=servo_command,
    Data2=" S",
    Data3=serov_angle_pen_down,
    Data4=" P",
    Data5=servo_index,
    Data6=" F",
    Data7=servo_move_speed,
    Data8=" R")
sample_tolerance_in_mm = Number(Slider(0.05, range=0.01..0.1))
join = TextJoin(Text=merge_2)
join_2 = TextJoin(Text=merge_3)
topoly = CurveToPolyline(Curve=toolpaths, ToleranceDistance=sample_tolerance_in_mm, ToleranceAngle=0)  # -> Polyline, Segments
pen_down = Panel(join_2)
pen_up = Panel(join)
crv_2 = Curve(topoly.Polyline)
cp = ControlPoints(Curve=topoly.Polyline)  # -> Points, Weights, Knots

toolpath_points = Point(cp.Points)
flatten = FlattenTree(Tree=toolpath_points, Path="{0}")
lng = ListLength(List=flatten)
feed_rate_3 = Number(feed_rate_2)
dup = DuplicateData(Data=graft(feed_rate_3), Number=graft(lng), Order=True)
lng_2 = ListLength(List=toolpath_points)
dup_2 = DuplicateData(Data=flatten("F"), Number=flatten(lng), Order=True)
dup_3 = DuplicateData(Data=flatten(" X"), Number=flatten(lng), Order=True)
flatten_2 = FlattenTree(Tree=dup_2, Path="{0}")
flatten_3 = FlattenTree(Tree=dup_3, Path="{0}")
flatten_4 = FlattenTree(Tree=dup, Path="{0}")
pdecon = Deconstruct(Point=toolpath_points)  # -> XComponent, YComponent, ZComponent
graft = GraftTree(Tree=flatten_2, IncludeEmptyLists=True, IncludeNullItems=True)
graft_2 = GraftTree(Tree=flatten_4, IncludeEmptyLists=True, IncludeNullItems=True)
graft_3 = GraftTree(Tree=flatten_3, IncludeEmptyLists=True, IncludeNullItems=True)
panel_2 = Panel(pdecon.XComponent)
panel_3 = Panel(pdecon.YComponent)
panel_4 = Panel(pdecon.ZComponent)
join_3 = TextJoin(Text=[graft, graft_2, graft_3])
dup_4 = DuplicateData(Data=" Z", Number=lng_2, Order=True)
dup_5 = DuplicateData(Data=" Y", Number=lng_2, Order=True)
dup_6 = DuplicateData(Data="G1 ", Number=lng_2, Order=True)
simplify = SimplifyTree(Tree=flatten(join_3), Front=False)
simplify_2 = SimplifyTree(Tree=flatten(dup_6), Front=False)
simplify_3 = SimplifyTree(Tree=flatten(panel_2), Front=False)
simplify_4 = SimplifyTree(Tree=flatten(dup_5), Front=False)
simplify_5 = SimplifyTree(Tree=flatten(panel_3), Front=False)
simplify_6 = SimplifyTree(Tree=flatten(dup_4), Front=False)
simplify_7 = SimplifyTree(Tree=flatten(panel_4), Front=False)
graft_4 = GraftTree(Tree=simplify_2, IncludeEmptyLists=True, IncludeNullItems=True)
graft_5 = GraftTree(Tree=simplify_3, IncludeEmptyLists=True, IncludeNullItems=True)
graft_6 = GraftTree(Tree=simplify_4, IncludeEmptyLists=True, IncludeNullItems=True)
graft_7 = GraftTree(Tree=simplify_5, IncludeEmptyLists=True, IncludeNullItems=True)
graft_8 = GraftTree(Tree=simplify_6, IncludeEmptyLists=True, IncludeNullItems=True)  # disabled
graft_9 = GraftTree(Tree=simplify_7, IncludeEmptyLists=True, IncludeNullItems=True)  # disabled
graft_10 = GraftTree(Tree=simplify, IncludeEmptyLists=True, IncludeNullItems=True)
join_4 = TextJoin(Text=[graft_4, graft_10, graft_5, graft_6, graft_7, graft_8, graft_9])
flatten_5 = FlattenTree(Tree=join_4, Path="{0}")
panel_5 = Panel(flatten_5)

# ---- group: Esimate job time
len = Length()
jog_rate_3 = Panel("150")
ma = MassAddition(Input=len)  # -> Result, PartialResults
panel_6 = Panel(ma.Result)
division = Division(A=panel_6, B=jog_rate_3)
division_2 = Division(A=division, B="60")
estimated_time = Panel(division_2)

len_2 = Length()
feed_rate_4 = Panel()
ma_2 = MassAddition(Input=len_2)  # -> Result, PartialResults
panel_7 = Panel(ma_2.Result)
division_3 = Division(A=panel_7, B=feed_rate_4)
division_4 = Division(A=division_3, B="60")
estimated_time_2 = Panel(division_4)

# ----
number_of_cut_operations = Panel(lng_2)
wait_for_clear_buffer = Panel(";G4 P0")
wait_for_clear_buffer_2 = Panel("G4 P0")
pen_up_2 = Panel(pen_down)
wait_for_clear_buffer_3 = Panel(";M400")
pen_down_2 = Panel(pen_up)
panel_8 = Panel("""0
1""")
startcode = Panel(""";congrats kahoot, hope you make some new g-codes for this machine
G28
G90""")
pen_up_3 = Panel(pen_up)
start_job = Button()
bang = Bang(BooleanInput=start_job)  # -> TrueState, FalseState
panel_9 = Panel(bang.TrueState)
send_and_start_gcode = PythonScript()  # -> out, sending; inputs start: Boolean, gcode: list
# ---------- send_and_start_gcode: Python ----------
#-*- coding: utf-8 -*-
#
####
# 2006/02 Will Holcomb <wholcomb@gmail.com>
# 
# This library is free software; you can redistribute it and/or
# modify it under the terms of the GNU Lesser General Public
# License as published by the Free Software Foundation; either
# version 2.1 of the License, or (at your option) any later version.
# 
# This library is distributed in the hope that it will be useful,
# but WITHOUT ANY WARRANTY; without even the implied warranty of
# MERCHANTABILITY or FITNESS FOR A PARTICULAR PURPOSE.  See the GNU
# Lesser General Public License for more details.
#
# 2007/07/26 Slightly modified by Brian Schneider  
#
# in order to support unicode files ( multipart_encode function )
# From http://peerit.blogspot.com/2007/07/multipartposthandler-doesnt-work-for.html
#
# 2013/07 Ken Olum <kdo@cosmos.phy.tufts.edu>
#
# Removed one of \r\n and send Content-Length
#
# 2014/05 Applied Fedora rpm patch
#
# https://bugzilla.redhat.com/show_bug.cgi?id=920778
# http://pkgs.fedoraproject.org/cgit/python-MultipartPostHandler2.git/diff/python-MultipartPostHandler2-cut-out-main.patch?id=c1638bb3e45596232b4d02f1e69901db0c28cfdb
#
# 2014/05/09 Sérgio Basto <sergio@serjux.com>
#
# Better deal with None values, don't throw an exception and just send an empty string.
# Simplified text example
#
"""
Usage:
  Enables the use of multipart/form-data for posting forms

Inspirations:
  Upload files in python:
    http://aspn.activestate.com/ASPN/Cookbook/Python/Recipe/146306
  urllib2_file:
    Fabien Seisen: <fabien@seisen.org>

Example:
  import MultipartPostHandler, urllib2

  opener = urllib2.build_opener(MultipartPostHandler.MultipartPostHandler)
  params = { "username" : "bob", "password" : "riviera",
             "file" : open("filename", "rb") }
  opener.open("http://wwww.bobsite.com/upload/", params)
"""

import urllib
import urllib2
import mimetools, mimetypes
import os, stat
from StringIO import StringIO

class Callable:
    def __init__(self, anycallable):
        self.__call__ = anycallable

# Controls how sequences are uncoded. If true, elements may be given multiple values by
#  assigning a sequence.
doseq = 1

class MultipartPostHandler(urllib2.BaseHandler):
    handler_order = urllib2.HTTPHandler.handler_order - 10 # needs to run first

    def http_request(self, request):
        print "using ustom Multipart Post handler"
        data = request.get_data()
        if data is not None and type(data) != str:
            v_files = []
            v_vars = []
            try:
                 for(key, value) in data.items():
                     print "checking key", key, value
                     if key == 'file':
                         v_files.append((key, value))
                     else:
                         v_vars.append((key, value))
            except TypeError:
                systype, value, traceback = sys.exc_info()
                raise TypeError, "not a valid non-string sequence or mapping object", traceback

            if len(v_files) == 0:
                data = urllib.urlencode(v_vars, doseq)
            else:
                boundary, data = self.multipart_encode(v_vars, v_files)
                contenttype = 'multipart/form-data; boundary=%s' % boundary
                if(request.has_header('Content-Type')
                   and request.get_header('Content-Type').find('multipart/form-data') != 0):
                    print "Replacing %s with %s" % (request.get_header('content-type'), 'multipart/form-data')
                request.add_unredirected_header('Content-Type', contenttype)

            request.add_data(data)
        return request

    def multipart_encode(vars, files, boundary = None, buffer = None):
        if boundary is None:
            boundary = mimetools.choose_boundary()
        if buffer is None:
            buffer = StringIO()
        for(key, value) in vars:
            buffer.write('--%s\r\n' % boundary)
            buffer.write('Content-Disposition: form-data; name="%s"' % key)
            if value is None:
                value = ""
            # if type(value) is not str, we need str(value) to not error with cannot concatenate 'str'
            # and 'dict' or 'tuple' or somethingelse objects
            buffer.write('\r\n\r\n' + str(value) + '\r\n')
        for(key, fd) in files:
            contents = fd.read()
            file_size = len(contents)
            filename = os.path.basename(fd.name)
            contenttype = mimetypes.guess_type(filename)[0] or 'application/octet-stream'            
            buffer.write('--%s\r\n' % boundary)
            buffer.write('Content-Disposition: form-data; name="%s"; filename="%s"\r\n' % (key, filename))
            buffer.write('Content-Type: %s\r\n' % contenttype)
            buffer.write('Content-Length: %s\r\n' % file_size)
            fd.seek(0)
            buffer.write('\r\n' + contents + '\r\n')
        buffer.write('--' + boundary + '--\r\n')
        buffer = buffer.getvalue()
        return boundary, buffer
    multipart_encode = Callable(multipart_encode)

    https_request = http_request

if start:
    #file = open(r"C:\Users\Jens\Desktop\vbird.gcode", "rb")
    gcode = "\n".join(gcode)
    print gcode
    file = StringIO(gcode)
    file.name = "barkbeetle.gcode"
    
    req = urllib2.Request("http://vbird.local/api/files/local", headers={'X-Api-Key': 'CBDF7EF815E845C4AE01B0001D238A9F'})
    opener = urllib2.build_opener(MultipartPostHandler)
    #opener.addheaders = [('X-Api-Key','CBDF7EF815E845C4AE01B0001D238A9F')]
    params = {
         "file" : file,
         "print": "true",
    }
    
    print opener
    try:
        opener.open(req, params)
    except Exception, e:
        print 'swf'
        print e
        print e.read()
        
    print "success!"
else:
    sending = False
# ---------- end send_and_start_gcode ----------

# ---- group: Esimate job time
crv_3 = Curve(topoly.Polyline)

len_3 = Length(Curve=crv_3)
feed_rate_5 = Panel(feed_rate)
ma_3 = MassAddition(Input=len_3)  # -> Result, PartialResults
panel_10 = Panel(ma_3.Result)
division_5 = Division(A=panel_10, B=feed_rate_5)
division_6 = Division(A=division_5, B="60")
estimated_time_3 = Panel(division_6)

ma_4 = MassAddition(Input=[estimated_time_3, estimated_time, estimated_time_2])  # -> Result, PartialResults
estimated_job_minutes = Integer(ma_4.Result)

# ----
jog_rate_4 = Number(jog_rate_2)
item = ListItem(List=pdecon.XComponent, Index=0, Wrap=True)
item_2 = ListItem(List=pdecon.YComponent, Index=0, Wrap=True)
int = Integer(jog_rate_4)
lng_3 = ListLength(List=flatten(item))
safe_z_height = Number()
lng_4 = ListLength(List=flatten(item))
join_5 = TextJoin(Text=["F", int, " X"])
dup_7 = DuplicateData(Data="G1 ", Number=lng_3, Order=True)
dup_8 = DuplicateData(Data=" Y", Number=lng_3, Order=True)
dup_9 = DuplicateData(Data=" Z", Number=lng_3, Order=True)
dup_10 = DuplicateData(Data=safe_z_height, Number=lng_3, Order=True)
dup_11 = DuplicateData(Data=join_5, Number=lng_4, Order=True)
simplify_8 = SimplifyTree(Tree=flatten(dup_7), Front=False)
simplify_9 = SimplifyTree(Tree=flatten(dup_8), Front=False)
simplify_10 = SimplifyTree(Tree=flatten(dup_9), Front=False)
simplify_11 = SimplifyTree(Tree=flatten(dup_10), Front=False)
simplify_12 = SimplifyTree(Tree=flatten(dup_11), Front=False)
# 2015/05/09 Kenji
# I found minor trouble just before end code. The line reads “G0 F112 G0X X 0.0 Y 0.0 Z10.0”. “G0X” made trouble so that I disconnected the Panel named “G0 X” from Join.
graft_11 = GraftTree(Tree=simplify_8, IncludeEmptyLists=True, IncludeNullItems=True)
graft_12 = GraftTree(Tree=simplify_12, IncludeEmptyLists=True, IncludeNullItems=True)
graft_13 = GraftTree(Tree=simplify_9, IncludeEmptyLists=True, IncludeNullItems=True)
graft_14 = GraftTree(Tree=simplify_10, IncludeEmptyLists=True, IncludeNullItems=True)  # disabled
graft_15 = GraftTree(Tree=simplify_11, IncludeEmptyLists=True, IncludeNullItems=True)  # disabled
safe_z_height_2 = Number()  # disabled
panel_11 = Panel("G0 X")
home_x_3 = Number(home_x_2)
home_y_3 = Number(home_y_2)

nullrep = ReplaceNulls(Items=item_2, Replacements="0")  # -> Items, Count
nullrep_2 = ReplaceNulls(Items=item, Replacements="0")  # -> Items, Count
txt = Text(" Z")  # disabled

simplify_13 = SimplifyTree(Tree=flatten(nullrep_2.Items), Front=False)
simplify_14 = SimplifyTree(Tree=flatten(nullrep.Items), Front=False)
graft_16 = GraftTree(Tree=simplify_13, IncludeEmptyLists=True, IncludeNullItems=True)
graft_17 = GraftTree(Tree=simplify_14, IncludeEmptyLists=True, IncludeNullItems=True)
join_6 = TextJoin(Text=[graft_11, graft_12, graft_16, graft_13, graft_17, graft_14, graft_15])
flatten_6 = FlattenTree(Tree=join_6, Path="{0}")
join_7 = TextJoin(Text=["G1 ", join_5, home_x_3, " Y", home_y_3, txt, safe_z_height_2])
merge_4 = Merge(Data1=flatten(flatten_6), Data2=flatten(join_7))
panel_12 = Panel(merge_4)

number_of_cutting_operations = Panel(lng_3)

ma_5 = MassAddition(Input=flatten(number_of_cut_operations))  # -> Result, PartialResults
addition = Addition(A=number_of_cutting_operations, B="1")
merge_5 = Merge(Data1=Slider(0, range=0..100), Data2=ma_5.PartialResults)
dup_12 = DuplicateData(Data=wait_for_clear_buffer_2, Number=addition, Order=True)
ins = InsertItems(List=panel_5, Item=dup_12, Indices=merge_5, Wrap=True)

jog_operations = Panel(panel_12)
dup_13 = DuplicateData(Data=pen_up_2, Number=addition, Order=True)
dup_14 = DuplicateData(Data=wait_for_clear_buffer_2, Number=addition, Order=True)
dup_15 = DuplicateData(Data=pen_down_2, Number=addition, Order=True)

series = Series(Start="1", Step=1, Count=addition)
addition_2 = Addition(A=merge_5, B=series)
ins_2 = InsertItems(List=ins, Item=dup_15, Indices=addition_2, Wrap=True)

addition_3 = Addition(A=addition_2, B=series)
ins_3 = InsertItems(List=ins_2, Item=jog_operations, Indices=addition_3, Wrap=True)

addition_4 = Addition(A=addition_3, B=series)
addition_5 = Addition(A=addition_4, B=series)
ins_4 = InsertItems(List=ins_3, Item=dup_14, Indices=addition_4, Wrap=True)
ins_5 = InsertItems(List=ins_4, Item=dup_13, Indices=addition_5, Wrap=True)
cull_i = CullIndex(List=ins_5, Indices=panel_8, Wrap=True)
rev = ReverseList(List=cull_i)
cull_i_2 = CullIndex(List=rev, Indices=panel_8, Wrap=True)
rev_2 = ReverseList(List=cull_i_2)
flatten_7 = FlattenTree(Tree=rev_2, Path="{0}")
merge_6 = Merge(Data1=flatten(pen_up_3), Data2=flatten(startcode), Data3=flatten(flatten_7))
# Rigth click and choose "Stream destination"
# 
# Give a file name ending with .gcode
# 
# Your toolpath will automatically be updated!
panel_13 = Panel(merge_6)
send_and_start_gcode_2 = PythonScript(start=start_job, gcode=panel_13)  # -> out, sending; inputs start: Boolean, gcode: list
# ---------- send_and_start_gcode_2: Python ----------
#-*- coding: utf-8 -*-
#
####
# 2006/02 Will Holcomb <wholcomb@gmail.com>
# 
# This library is free software; you can redistribute it and/or
# modify it under the terms of the GNU Lesser General Public
# License as published by the Free Software Foundation; either
# version 2.1 of the License, or (at your option) any later version.
# 
# This library is distributed in the hope that it will be useful,
# but WITHOUT ANY WARRANTY; without even the implied warranty of
# MERCHANTABILITY or FITNESS FOR A PARTICULAR PURPOSE.  See the GNU
# Lesser General Public License for more details.
#
# 2007/07/26 Slightly modified by Brian Schneider  
#
# in order to support unicode files ( multipart_encode function )
# From http://peerit.blogspot.com/2007/07/multipartposthandler-doesnt-work-for.html
#
# 2013/07 Ken Olum <kdo@cosmos.phy.tufts.edu>
#
# Removed one of \r\n and send Content-Length
#
# 2014/05 Applied Fedora rpm patch
#
# https://bugzilla.redhat.com/show_bug.cgi?id=920778
# http://pkgs.fedoraproject.org/cgit/python-MultipartPostHandler2.git/diff/python-MultipartPostHandler2-cut-out-main.patch?id=c1638bb3e45596232b4d02f1e69901db0c28cfdb
#
# 2014/05/09 Sérgio Basto <sergio@serjux.com>
#
# Better deal with None values, don't throw an exception and just send an empty string.
# Simplified text example
#
"""
Usage:
  Enables the use of multipart/form-data for posting forms

Inspirations:
  Upload files in python:
    http://aspn.activestate.com/ASPN/Cookbook/Python/Recipe/146306
  urllib2_file:
    Fabien Seisen: <fabien@seisen.org>

Example:
  import MultipartPostHandler, urllib2

  opener = urllib2.build_opener(MultipartPostHandler.MultipartPostHandler)
  params = { "username" : "bob", "password" : "riviera",
             "file" : open("filename", "rb") }
  opener.open("http://wwww.bobsite.com/upload/", params)
"""

import urllib
import urllib2
import mimetools, mimetypes
import os, stat
from StringIO import StringIO

class Callable:
    def __init__(self, anycallable):
        self.__call__ = anycallable

# Controls how sequences are uncoded. If true, elements may be given multiple values by
#  assigning a sequence.
doseq = 1

class MultipartPostHandler(urllib2.BaseHandler):
    handler_order = urllib2.HTTPHandler.handler_order - 10 # needs to run first

    def http_request(self, request):
        print "using ustom Multipart Post handler"
        data = request.get_data()
        if data is not None and type(data) != str:
            v_files = []
            v_vars = []
            try:
                 for(key, value) in data.items():
                     print "checking key", key, value
                     if key == 'file':
                         v_files.append((key, value))
                     else:
                         v_vars.append((key, value))
            except TypeError:
                systype, value, traceback = sys.exc_info()
                raise TypeError, "not a valid non-string sequence or mapping object", traceback

            if len(v_files) == 0:
                data = urllib.urlencode(v_vars, doseq)
            else:
                boundary, data = self.multipart_encode(v_vars, v_files)
                contenttype = 'multipart/form-data; boundary=%s' % boundary
                if(request.has_header('Content-Type')
                   and request.get_header('Content-Type').find('multipart/form-data') != 0):
                    print "Replacing %s with %s" % (request.get_header('content-type'), 'multipart/form-data')
                request.add_unredirected_header('Content-Type', contenttype)

            request.add_data(data)
        return request

    def multipart_encode(vars, files, boundary = None, buffer = None):
        if boundary is None:
            boundary = mimetools.choose_boundary()
        if buffer is None:
            buffer = StringIO()
        for(key, value) in vars:
            buffer.write('--%s\r\n' % boundary)
            buffer.write('Content-Disposition: form-data; name="%s"' % key)
            if value is None:
                value = ""
            # if type(value) is not str, we need str(value) to not error with cannot concatenate 'str'
            # and 'dict' or 'tuple' or somethingelse objects
            buffer.write('\r\n\r\n' + str(value) + '\r\n')
        for(key, fd) in files:
            contents = fd.read()
            file_size = len(contents)
            filename = os.path.basename(fd.name)
            contenttype = mimetypes.guess_type(filename)[0] or 'application/octet-stream'            
            buffer.write('--%s\r\n' % boundary)
            buffer.write('Content-Disposition: form-data; name="%s"; filename="%s"\r\n' % (key, filename))
            buffer.write('Content-Type: %s\r\n' % contenttype)
            buffer.write('Content-Length: %s\r\n' % file_size)
            fd.seek(0)
            buffer.write('\r\n' + contents + '\r\n')
        buffer.write('--' + boundary + '--\r\n')
        buffer = buffer.getvalue()
        return boundary, buffer
    multipart_encode = Callable(multipart_encode)

    https_request = http_request

if start:
    #file = open(r"C:\Users\Jens\Desktop\vbird.gcode", "rb")
    gcode = "\n".join(gcode)
    print gcode
    file = StringIO(gcode)
    file.name = "barkbeetle.gcode"
    
    req = urllib2.Request("192.168.0.196", headers={'X-Api-Key': '0058D2C139C148A8A5F8E99261FA7F95'})
    opener = urllib2.build_opener(MultipartPostHandler)
    #opener.addheaders = [('X-Api-Key','0058D2C139C148A8A5F8E99261FA7F95')]
    params = {
         "file" : file,
         "print": "true",
    }
    
    print opener
    try:
        opener.open(req, params)
    except Exception, e:
        print 'swf'
        print e
        print e.read()
        
    print "success!"
else:
    sending = False
# ---------- end send_and_start_gcode_2 ----------
rec = DataRecorder(send_and_start_gcode_2.out, DataLimit=-1, RecordData=True)
panel_14 = Panel(rec)
panel_15 = Panel(send_and_start_gcode_2.sending)
