# Grasshopper definition chamfer-rail-generator.gh (Grasshopper 0.9.76)
# Copyright: Creative commons attribution share-a-like

# ---- group: Geometry type
rack_and_pinion_geometry_type = ValueList({"Nema17, max torque": 0, "Nema23, max torque": 1, "Nema23, stronger teeth": 2}, selected="Nema23, stronger teeth")
chamfer_geometry_for_2d = ValueList({"Open curve for v-bit": 0, "Surface for ballnose 3D mill": 1}, selected="Surface for ballnose 3D mill")
output_geometry_type = ValueList({"2D curves": 0, "3D brep": 1}, selected="3D brep")
axis_type = ValueList({"Linear": False, "Rotary": True}, selected="Linear")

# ---- group: Attachment holes
make_hole_pattern_along_center = ValueList({"No": 0, "Yes": 1}, selected="No")
# to do: make mid layer option
# make top layer option
# make 2D outout for rotary axis
# solve motor plate and glide block collision in rotary. make threepoint motorplate?
# make dirt relief option
# make bake with metadata system
# make option for round corners on 3D axis?
# make option for ?
make_hole_pattern_along_edges = ValueList({"No": 0, "Yes": 1}, selected="Yes")
hole_grid_distance = Panel("70")
hole_diameter = Panel("5.2")
screw_pocket_diameter = Panel("12.5")
center_screw_pocket_depth = Panel("8")
edge_screw_pocket_depth = Panel("6")

# ---- group: Glideblock geometry
use_custom_hole_pattern = ValueList({"No": False, "Yes": True}, selected="No")
clearnace_from_axis_to_axis_plate = Panel("2")
distance_from_flat_pad_o_edge = Panel("1.5")
flat_pad_clerance = Panel("0.5")
milling_bit_diamter_for_clearing_flat_pa = Panel("6")  # "Milling bit diamter for clearing flat pad slot"
hole_diamter_for_tapping = Panel("4.5")
glide_block_length = Panel("200")
clamp_area_width = Panel("14")
hole_spacing = Panel("90")
first_hole_distance_from_edge = Panel("10")
hole_diamter_for_slip_fit = Panel("5.15")
custom_hole_pattern = Panel("""8
53
78""")
glide_block_fillet_radius = Panel("2")

# ---- group: Pinion geometry
pinion_material_thickness = Panel("12.7")
extra_tooth_height_compared_to_rack_toot = Panel("0.2")  # "Extra tooth height compared to rack tooth heigth"
milling_bit_diameter_for_hole_marking = Panel("3")
number_off_set_screws = Panel("3")
hole_diamter_for_set_screws = Panel("3")
default_pinion_outer_edge_diamter_to_sha = Panel("3")  # "Default pinion outer edge diamter to shaft diameter factor"
minimum_pinion_pipe_wall_thickness = Panel("5")
minimum_clearlance_from_tooth_to_outer_e = Panel("0.6")  # "Minimum clearlance from tooth to outer edge"
add_flat = Panel("False")

# ---- group: Axis and motor plate geometry
motorplate_mount_spacing_x_across = Panel("46")
motor_type = ValueList({"Nema17": 31, "Nema23": 47.14, "Oriental 60mm": 50}, selected="Nema23")
flange_hole_diameter = Panel("39")
adjustment_range_glideblock = Panel("6")
extra_offset_adjustable_holes = Panel("0.1")
pinon_distance_from_axis_edge = Panel("50")
motorplate_mount_spacing_y_along = Panel("40")
motorplate_mount_spacing_y_across = Panel("77")
motor_plate_attachment_type = ValueList({"Threaded holes": 0, "Trapped nut": 1}, selected="Trapped nut")
motorplate_mount_spacing_x_along = Panel("77")
motorplate_edge_thickness_from_holes = Panel("6")
hex_nut_width_inc_margin = Panel("7.95")
hex_nut_pocket_depth = Panel("4")
motor_plate_type = ValueList({"Along axis": 0, "Across axis": 1}, selected="Across axis")

# ---- group: Axis dimensions
pinion_clearance_margin = Panel("3")
rack_tooth_height = Panel("4")
axis_length = Panel("300")
axis_width = Panel("127")
material_thickness = Panel("8")
# Standard dimensions: Axis width: 127mm
# Material thickness: 8mm
# Chamfer distance: 4mm
# Hole grid distance: 70mm
# 
# Pinion clearance margin: 2mm
# Rack tooth height: 4mm
chamfer_distance = Panel("4")
corner_fillet_radius = Panel("5")

# ---- group: Edge chamfer
chamfer_line_overshoot = Panel("0.6")

# ---- group: Rotary axis geometry
gear_ratio_rotary_axis = Panel("6")
rack_to_chamfer_distance = Panel("2")
glideblock_width_angle_deg = Panel("60")

# ---- group: Settings for Nema23, stronger teeth geometry
pinion_tooth_spacing_factor = Slider(-0.20635, range=-1..1)
motor_shaft_diameter = Slider(8, range=0..10)
tooth_fillet_ratio = Slider(0.1, range=0..1)
milling_bit_diameter = Panel("6.3")

# ---- group: Settings for Nema23, max resolution geometry
pinion_tooth_spacing_factor_2 = Slider(-0.107142, range=-1..1)
motor_shaft_diameter_2 = Slider(8, range=0..10)
tooth_fillet_ratio_2 = Slider(0.29, range=0..1)
milling_bit_diameter_2 = Panel("4.2")

# ---- group: Settings for Nema17, max resolution geometry
pinion_tooth_spacing_factor_3 = Slider(-0.131945, range=-1..1)
motor_shaft_diameter_3 = Slider(5, range=0..10)
tooth_fillet_ratio_3 = Slider(0.22, range=0..1)
milling_bit_diameter_3 = Panel("3.2")

# ----
number_of_pinion_teeth = Panel("6")
filter = StreamFilter(
    Gate=rack_and_pinion_geometry_type,
    Stream0=milling_bit_diameter_3,
    Stream1=milling_bit_diameter_2,
    Stream2=milling_bit_diameter)
filter_2 = StreamFilter(
    Gate=rack_and_pinion_geometry_type,
    Stream0=pinion_tooth_spacing_factor_3,
    Stream1=pinion_tooth_spacing_factor_2,
    Stream2=pinion_tooth_spacing_factor)
filter_3 = StreamFilter(
    Gate=rack_and_pinion_geometry_type,
    Stream0=tooth_fillet_ratio_3,
    Stream1=tooth_fillet_ratio_2,
    Stream2=tooth_fillet_ratio)
filter_4 = StreamFilter(
    Gate=rack_and_pinion_geometry_type,
    Stream0=motor_shaft_diameter_3,
    Stream1=motor_shaft_diameter_2,
    Stream2=motor_shaft_diameter)

# ---- group: Make rack and pinion geometry
roller_rack_and_pinion_maker = RollerRackAndPinionMaker(
    number_of_pinion_teeth=number_of_pinion_teeth,
    milling_bit_diameter=filter,
    tooth_fillet_ratio=filter_3,
    pinion_tooth_spacing_factor=filter_2,
    motor_shaft_diameter=filter_4)  # -> rack_teeth_4, pinion_teeth_4, pinion_center_hole_3, pinion_edge_3, steps_per_mm_2, maxium_pinion_milling_bit_diamter_4, pinion_movement_preview_3

# ---- group: Use this value in your motion controll
steps_per_mm_with_200_step_motor = Panel(roller_rack_and_pinion_maker.steps_per_mm_2)

# ---- group: Find rack tooth height and clearance margin needed
rack_teeth = Curve(roller_rack_and_pinion_maker.rack_teeth_4)
item = ListItem(List=flatten(rack_teeth), Index=0, Wrap=True)
bbox = BoundingBox(Content=item, Plane=PlaneXY(0, 0, 0))  # -> Box, Box_2
dim = Dimensions(Surface=bbox.Box)  # -> UDimension, VDimension
rack_tooth_height_2 = Panel(dim.VDimension)
addition = Addition(A=rack_tooth_height_2, B=pinion_clearance_margin)

# ---- group: Make sure the adjustment holes of the mter plate is far enough away from the motor to allow the pinion to come clear off the rack
pinion_clearance_margin_2 = Panel(addition)
motorplate_mount_spacing_y_across_2 = Panel(motorplate_mount_spacing_y_across)
multiplication = Multiplication(A=pinion_clearance_margin_2, B="2")
addition_2 = Addition(A=multiplication, B=motorplate_mount_spacing_y_across_2)

# ---- group: Select motor plate type and override in case of rotary axis
axist_type_is_rotary = Panel(axis_type)
filter_5 = StreamFilter(Gate=axist_type_is_rotary, Stream0=motor_plate_type, Stream1=Toggle(False))
filter_6 = StreamFilter(Gate=filter_5, Stream0=motorplate_mount_spacing_x_along, Stream1=motorplate_mount_spacing_x_across)
filter_7 = StreamFilter(Gate=filter_5, Stream0=motorplate_mount_spacing_y_along, Stream1=addition_2)

# ---- group: Make grid spacing half for narrow rails
smaller = SmallerThan(FirstNumber=axis_width, SecondNumber=hole_grid_distance)  # -> SmallerThan, OrEqualTo
division = Division(A=hole_grid_distance, B="2")
filter_8 = StreamFilter(Gate=smaller.SmallerThan, Stream0=hole_grid_distance, Stream1=division)
hole_grid_distance_x = Panel(hole_grid_distance)
hole_grid_distance_y = Panel(filter_8)

# ---- group: Make inside gear for rotary axis
slide_to_preview = Slider(0, range=0..1)
gear_ratio_rotary_axis_2 = Panel(gear_ratio_rotary_axis)
axist_type_is_rotary_2 = Panel(axis_type)
multiplication_2 = Multiplication(A=number_of_pinion_teeth, B=gear_ratio_rotary_axis_2)
filter_9 = StreamFilter(Gate=axist_type_is_rotary_2, Stream1=roller_rack_and_pinion_maker.pinion_teeth_4)
inside_gear_for_pinion_maker = InsideGearForPinionMaker(
    number_of_gear_teeth=multiplication_2,
    milling_bit_diameter=filter,
    number_of_input_pinion_teeth=number_of_pinion_teeth,
    pinion_teeth_curve=filter_9,
    pinion_center_hole_curve=roller_rack_and_pinion_maker.pinion_center_hole_3,
    tooth_fillet_ratio=Slider(0.125, range=0..1),
    preview_position_0_1=slide_to_preview)  # -> gear_teeth_4, gear_center_hole_3, gear_movement_preview_3, pinion_movement_preview_3
crv = Curve(inside_gear_for_pinion_maker.pinion_movement_preview_3)
crv_2 = Curve([inside_gear_for_pinion_maker.gear_movement_preview_3, inside_gear_for_pinion_maker.gear_center_hole_3])

# ---- group: Find number of teeth needed for axis length
rack_teeth_2 = Curve(roller_rack_and_pinion_maker.rack_teeth_4)
item_2 = ListItem(List=flatten(rack_teeth_2), Index=0, Wrap=True)
end = EndPoints(Curve=item_2)  # -> Start, End
dist = Distance(PointA=end.Start, PointB=end.End)
axis_length_2 = Panel(axis_length)
tooth_spacing = Panel(dist)
division_2 = Division(A=axis_length_2, B=tooth_spacing)
round = Round(Number=division_2)  # -> Nearest, Floor, Ceiling
number_of_teeth_in_axis = Panel(round.Nearest)

# ---- group: Make points for axis profile
material_thickness_2 = Panel(material_thickness)
chamfer_distance_2 = Panel(chamfer_distance)
axis_width_2 = Panel(axis_width)
multiplication_3 = Multiplication(A=axis_width_2, B="0.5")
subtraction = Subtraction(A=multiplication_3, B=chamfer_distance_2)
neg = Negative(Value=multiplication_3)
neg_2 = Negative(Value=chamfer_distance_2)
neg_3 = Negative(Value=multiplication_3)
neg_4 = Negative(Value=material_thickness_2)
neg_5 = Negative(Value=subtraction)
pt = ConstructPoint(XCoordinate=0, YCoordinate=subtraction, ZCoordinate=0)
pt_2 = ConstructPoint(XCoordinate=0, YCoordinate=neg_5, ZCoordinate=0)
pt_3 = ConstructPoint(XCoordinate=0, YCoordinate=multiplication_3, ZCoordinate=neg_4)
pt_4 = ConstructPoint(XCoordinate=0, YCoordinate=neg_3, ZCoordinate=neg_4)
pt_5 = ConstructPoint(XCoordinate=0, YCoordinate=multiplication_3, ZCoordinate=neg_2)
pt_6 = ConstructPoint(XCoordinate=0, YCoordinate=neg, ZCoordinate=neg_2)
merge = Merge(Data1=pt, Data2=pt_2, Data3=pt_6, Data4=pt_4, Data5=pt_3, Data6=pt_5)
pline = PolyLine(Vertices=merge, Closed=True)
axis_profile = Curve(pline)

# ---- group: Move first tooth to axis edge
pdecon = Deconstruct(Point=end.Start)  # -> XComponent, YComponent, ZComponent
pt_7 = ConstructPoint(XCoordinate=0, YCoordinate=pdecon.YComponent, ZCoordinate=pdecon.ZComponent)
vec2pt = Vector2Pt(PointA=end.Start, PointB=pt_7, Unitize=False)  # -> Vector, Length
move = Move(Geometry=item_2, Motion=vec2pt.Vector)  # -> Geometry, Transform

# ---- group: Make outline and pocket
rack_tooth_height_3 = Panel(rack_tooth_height)
pinion_clearance_margin_3 = Panel(pinion_clearance_margin)
material_thickness_3 = Panel(material_thickness)
chamfer_distance_3 = Panel(chamfer_distance)
tooth_to_chamfer_distance = Panel(rack_to_chamfer_distance)
gear_center_hole = Curve(inside_gear_for_pinion_maker.gear_center_hole_3)
gear_teeth = Curve(inside_gear_for_pinion_maker.gear_teeth_4)
pinion_teeth = Curve(roller_rack_and_pinion_maker.pinion_teeth_4)
project = Project(Geometry=gear_teeth, Plane=PlaneXY(0, 0, 0))  # -> Geometry, Transform
Z = UnitZ(Factor=1)
area = Area(Geometry=gear_center_hole)  # -> Area, Centroid
bbox_2 = BoundingBox(Content=gear_teeth, Plane=PlaneXY(0, 0, 0))  # -> Box, Box_2
move_2 = Move(Geometry=area.Centroid, Motion=Z)  # -> Geometry, Transform
xy = XYPlane(Origin=area.Centroid)
dim_2 = Dimensions(Surface=bbox_2.Box)  # -> UDimension, VDimension
ln = Line(StartPoint=area.Centroid, EndPoint=move_2.Geometry)
sort = SortList(Keys=[dim_2.UDimension, dim_2.VDimension])  # -> Keys, ValuesA
gear_center_plane = Plane(xy)
axis_lne = Line(ln)
item_3 = ListItem(List=sort.Keys, Index=1, Wrap=True)
crv_cp = CurveClosestPoint(Point=area.Centroid, Curve=gear_teeth)  # -> Point, Parameter, Distance
crv_cp_2 = CurveClosestPoint(Point=area.Centroid, Curve=pinion_teeth)  # -> Point, Parameter, Distance
multiplication_4 = Multiplication(A=item_3, B=".5")
subtraction_2 = Subtraction(A=multiplication_4, B=crv_cp.Distance)
addition_3 = Addition(A=tooth_to_chamfer_distance, B=multiplication_4)
subtraction_3 = Subtraction(A=crv_cp_2.Distance, B=subtraction_2)
cir = Circle(Plane=gear_center_plane, Radius=addition_3)
subtraction_4 = Subtraction(A=subtraction_3, B=pinion_clearance_margin_3)
neg_6 = Negative(Value=chamfer_distance_3)
neg_7 = Negative(Value=material_thickness_3)
smaller_2 = SmallerThan(FirstNumber=subtraction_4, SecondNumber="3")  # -> SmallerThan, OrEqualTo
Z_2 = UnitZ(Factor=neg_6)
Z_3 = UnitZ(Factor=neg_7)
offset = Offset(Curve=cir, Distance=chamfer_distance_3, Plane=PlaneXY(0, 0, 0), Corners=1)
filter_10 = StreamFilter(Gate=smaller_2.SmallerThan, Stream0=subtraction_4)
move_3 = Move(Geometry=offset, Motion=Z_2)  # -> Geometry, Transform
move_4 = Move(Geometry=offset, Motion=Z_3)  # -> Geometry, Transform
cir_2 = Circle(Plane=gear_center_plane, Radius=filter_10)

# ---- group: Prep pinion position
move_5 = Move(Geometry=roller_rack_and_pinion_maker.pinion_center_hole_3, Motion=vec2pt.Vector)  # -> Geometry, Transform
move_6 = Move(Geometry=roller_rack_and_pinion_maker.pinion_teeth_4, Motion=vec2pt.Vector)  # -> Geometry, Transform
pinion = Curve(flatten([move_6.Geometry, move_5.Geometry]))

# ---- group: Copy and join teeth for axis
series = Series(Start=0, Step=tooth_spacing, Count=number_of_teeth_in_axis)
X = UnitX(Factor=series)
move_7 = Move(Geometry=move.Geometry, Motion=X)  # -> Geometry, Transform
join = JoinCurves(Curves=move_7.Geometry, Preserve=False)
rack_teeth_3 = Curve(join)

# ---- group: Extrude axis
axis_length_3 = Panel(axis_length)
axis_profile_2 = Curve(axis_profile)
X_2 = UnitX(Factor=axis_length_3)
extr = Extrude(Base=axis_profile_2, Direction=X_2)
cap = CapHoles(Brep=extr)
axis_stock = Brep(cap)

# ---- group: Make rack pocket outline
pinion_clearance_margin_4 = Panel(addition)
rack_teeth_4 = Curve(rack_teeth_3)
pinion_2 = Curve(pinion)
bbox_3 = BoundingBox(Content=flatten([pinion_2, rack_teeth_4]), Plane=PlaneXY(0, 0, 0), UnionBox=True)  # -> Box, Box_2
edges = BrepEdges(Brep=bbox_3.Box)  # -> Naked, Interior, NonManifold
Y = UnitY(Factor=pinion_clearance_margin_4)
item_4 = ListItem(List=edges.Naked, Index="2", Wrap=True)
move_8 = Move(Geometry=item_4, Motion=Y)  # -> Geometry, Transform
end_2 = EndPoints(Curve=move_8.Geometry)  # -> Start, End
end_3 = EndPoints(Curve=rack_teeth_4)  # -> Start, End
merge_2 = Merge(Data1=flatten(end_3.Start), Data2=flatten(end_2.End), Data3=flatten(end_2.Start), Data4=flatten(end_3.End))
multiplication_5 = Multiplication(A=pinion_clearance_margin_4, B="0.5")
pline_2 = PolyLine(Vertices=merge_2, Closed=False)
neg_8 = Negative(Value=multiplication_5)
join_2 = JoinCurves(Curves=flatten([rack_teeth_4, pline_2]), Preserve=False)
Y_2 = UnitY(Factor=neg_8)
move_9 = Move(Geometry=pinion_2, Motion=Y_2)  # -> Geometry, Transform
move_10 = Move(Geometry=join_2, Motion=Y_2)  # -> Geometry, Transform
rack_pocket_outline = Curve(move_10.Geometry)
pinion_on_rack = Curve(move_9.Geometry)

# ---- group: Make rotary axis 3D prevew
geometry_output_type = Panel(output_geometry_type)
filter_11 = StreamFilter(Gate=geometry_output_type, Stream1=flatten([gear_teeth, cir_2]))
filter_12 = StreamFilter(Gate=geometry_output_type, Stream1=cir)
filter_13 = StreamFilter(Gate=geometry_output_type, Stream1=move_3.Geometry)
filter_14 = StreamFilter(Gate=geometry_output_type, Stream1=move_4.Geometry)
neg_9 = Negative(Value=rack_tooth_height_3)
merge_3 = Merge(Data1=flatten(filter_12), Data2=flatten(filter_13), Data3=flatten(filter_14))
Z_4 = UnitZ(Factor=neg_9)
loft = Loft(Curves=merge_3, Options={Adjust=False, Closed=False, LoftEnds=0, LoftSimp=0, LoftType=3, Rebuild=10, Refit=0.01})
boundary = BoundarySurfaces(Edges=filter_11)
cap_2 = CapHoles(Brep=loft)
extr_2 = Extrude(Base=boundary, Direction=Z_4)
sdiff = SolidDifference(BrepsA=cap_2, BrepsB=extr_2)
rotary_axis_preview_brep = Brep(sdiff)

# ---- group: Make chamfer geometry
chamfer_line_overshoot_2 = Panel(chamfer_line_overshoot)
rotary_axis_outline = Curve(offset)
end_4 = EndPoints(Curve=cir)  # -> Start, End
end_5 = EndPoints(Curve=move_3.Geometry)  # -> Start, End
axis_lne_2 = Line(axis_lne)
xz = XZPlane(Origin=end_4.Start)
ln_2 = Line(StartPoint=end_5.Start, EndPoint=end_4.Start)
ext = ExtendCurve(Curve=ln_2, Type=0, Start=chamfer_line_overshoot_2, End=chamfer_line_overshoot_2)
offset_2 = Offset(Curve=rotary_axis_outline, Distance=chamfer_line_overshoot_2, Plane=PlaneXY(0, 0, 0), Corners=1)
revsrf = Revolution(Curve=ext, Axis=axis_lne_2, Domain=Domain(0, 6.283185307))
flip = FlipCurve(Curve=offset_2)  # -> Curve, Flag
mirror = Mirror(Geometry=revsrf, Plane=xz)  # -> Geometry, Transform
chamfer_2d_engrave_curve = Curve(flip.Curve)
chamfer_3d_surface_rotary = Surface(mirror.Geometry)
rack_pocket = Curve(flatten([gear_teeth, cir_2]))
rotary_axis_outline_2 = Curve(offset)

# ---- group: Make glideblock points and profiles
lower_point = Point(pt_4)
clearnace_from_axis_to_axis_plate_2 = Panel(clearnace_from_axis_to_axis_plate)
mid_point = Point(pt_6)
chamfer_distance_4 = Panel(chamfer_distance)
top_point = Point(pt_2)
flat_pad_clerance_2 = Panel(flat_pad_clerance)
milling_bit_diamter_for_clearing_flat_pa_2 = Panel(milling_bit_diamter_for_clearing_flat_pa)  # "Milling bit diamter for clearing flat pad slot"
distance_from_flat_pad_o_edge_2 = Panel(distance_from_flat_pad_o_edge)
clamp_area_width_2 = Panel(clamp_area_width)
material_thickness_4 = Panel(material_thickness)
multiplication_6 = Multiplication(A=clamp_area_width_2, B=".5")
ln_3 = Line(StartPoint=top_point, EndPoint=mid_point)
multiplication_7 = Multiplication(A=chamfer_distance_4, B=".5")
Y_3 = UnitY(Factor=distance_from_flat_pad_o_edge_2)
neg_10 = Negative(Value=multiplication_6)
len = Length(Curve=ln_3)
Y_4 = UnitY(Factor=multiplication_7)
neg_11 = Negative(Value=flat_pad_clerance_2)
addition_4 = Addition(A=milling_bit_diamter_for_clearing_flat_pa_2, B="0.1")
multiplication_8 = Multiplication(A=addition_4, B=".5")
neg_12 = Negative(Value=multiplication_8)
Y_5 = UnitY(Factor=neg_12)
Y_6 = UnitY(Factor=neg_10)
division_3 = Division(A=chamfer_distance_4, B=len)
move_11 = Move(Geometry=lower_point, Motion=Y_3)  # -> Geometry, Transform
Y_7 = UnitY(Factor=chamfer_distance_4)
move_12 = Move(Geometry=move_11.Geometry, Motion=Y_4)  # -> Geometry, Transform
Z_5 = UnitZ(Factor=neg_11)
eval = EvaluateLength(Curve=ln_3, Length=".5", Normalized=True)  # -> Point, Tangent, Parameter
neg_13 = Negative(Value=addition_4)
move_13 = Move(Geometry=move_11.Geometry, Motion=Y_7)  # -> Geometry, Transform
addition_5 = Addition(A=clearnace_from_axis_to_axis_plate_2, B=flat_pad_clerance_2)
trimline_point1 = Point(move_12.Geometry)
Y_8 = UnitY(Factor=neg_13)
move_14 = Move(Geometry=move_11.Geometry, Motion=Z_5)  # -> Geometry, Transform
move_15 = Move(Geometry=move_14.Geometry, Motion=Y_5)  # -> Geometry, Transform
trimline_point2 = Point(move_15.Geometry)
scale = Scale(Geometry=mid_point, Center=eval.Point, Factor=division_3)  # -> Geometry, Transform
scale_2 = Scale(Geometry=top_point, Center=eval.Point, Factor=division_3)  # -> Geometry, Transform
subtraction_5 = Subtraction(A=material_thickness_4, B=clearnace_from_axis_to_axis_plate_2)
move_16 = Move(Geometry=move_14.Geometry, Motion=Y_8)  # -> Geometry, Transform
Z_6 = UnitZ(Factor=addition_5)
neg_14 = Negative(Value=subtraction_5)
neg_15 = Negative(Value=clamp_area_width_2)
move_17 = Move(Geometry=move_16.Geometry, Motion=Z_6)  # -> Geometry, Transform
move_18 = Move(Geometry=move_17.Geometry, Motion=Y_6)  # -> Geometry, Transform
hole_midline_point = Point(move_18.Geometry)
neg_16 = Negative(Value=material_thickness_4)
Y_9 = UnitY(Factor=neg_15)
Z_7 = UnitZ(Factor=neg_14)
pdecon_2 = Deconstruct(Point=scale_2.Geometry)  # -> XComponent, YComponent, ZComponent
pdecon_3 = Deconstruct(Point=move_17.Geometry)  # -> XComponent, YComponent, ZComponent
pdecon_4 = Deconstruct(Point=scale.Geometry)  # -> XComponent, YComponent, ZComponent
Z_8 = UnitZ(Factor=neg_16)
move_19 = Move(Geometry=move_17.Geometry, Motion=Y_9)  # -> Geometry, Transform
pdecon_5 = Deconstruct(Point=move_19.Geometry)  # -> XComponent, YComponent, ZComponent
move_20 = Move(Geometry=move_13.Geometry, Motion=Z_7)  # -> Geometry, Transform
pt_8 = ConstructPoint(XCoordinate=pdecon_5.XComponent, YCoordinate=pdecon_5.YComponent, ZCoordinate=clearnace_from_axis_to_axis_plate_2)
pt_9 = ConstructPoint(XCoordinate=pdecon_2.XComponent, YCoordinate=pdecon_2.YComponent, ZCoordinate=clearnace_from_axis_to_axis_plate_2)
pt_10 = ConstructPoint(XCoordinate=pdecon_3.XComponent, YCoordinate=pdecon_3.YComponent, ZCoordinate=pdecon_4.ZComponent)
move_21 = Move(Geometry=move_19.Geometry, Motion=Z_8)  # -> Geometry, Transform
pt_11 = Point(move_19.Geometry)
pt_12 = Point(pt_8)
pt_13 = Point(pt_9)
pt_14 = Point(scale_2.Geometry)
pt_15 = Point(pt_10)
pt_16 = Point(move_17.Geometry)
pt_17 = Point(move_19.Geometry)
pt_18 = Point(scale.Geometry)
pt_19 = Point(move_20.Geometry)
pt_20 = Point(move_13.Geometry)
pt_21 = Point(move_14.Geometry)
pt_22 = Point(move_16.Geometry)
pt_23 = Point(move_17.Geometry)
pt_24 = Point(move_19.Geometry)
pt_25 = Point(move_21.Geometry)
pt_26 = Point(move_11.Geometry)
xz_2 = XZPlane(Origin=pt_11)
xy_2 = XYPlane(Origin=pt_11)
mirror_2 = Mirror(Geometry=xy_2, Plane=xz_2)  # -> Geometry, Transform
lower_glideblock_plane = Plane(mirror_2.Geometry)
upper_glideblock_plane = Plane(mirror_2.Geometry)
merge_4 = Merge(Data1=pt_19, Data2=pt_20, Data3=pt_26, Data4=pt_21, Data5=pt_22, Data6=pt_23, Data7=pt_24, Data8=pt_25)
merge_5 = Merge(Data1=pt_12, Data2=pt_13, Data3=pt_14, Data4=pt_18, Data5=pt_15, Data6=pt_16, Data7=pt_17)
pline_3 = PolyLine(Vertices=merge_4, Closed=True)
pline_4 = PolyLine(Vertices=merge_5, Closed=True)
chamfer_glideblock_profile = Curve(pline_4)
flat_pad_glideblock_profile = Curve(pline_3)

# ----
axist_type_is_rotary_3 = Panel(axis_type)
filter_15 = StreamFilter(Gate=axist_type_is_rotary_3, Stream0=rack_pocket_outline)

# ---- group: Create holes
pinion_clearance_margin_5 = Panel(addition)
hole_diameter_2 = Panel(hole_diameter)
screw_pocket_diameter_2 = Panel(screw_pocket_diameter)
hole_grid_distance_x_2 = Panel(hole_grid_distance_x)
hole_grid_distance_y_2 = Panel(hole_grid_distance_y)
axis_length_4 = Panel(axis_length)
rack_pocket_outline_2 = Curve(filter_15)
rack_teeth_5 = Curve(rack_teeth_3)
multiplication_9 = Multiplication(A=pinion_clearance_margin_5, B="0.5")
bbox_4 = BoundingBox(Content=flatten(rack_pocket_outline_2), Plane=PlaneXY(0, 0, 0), UnionBox=True)  # -> Box, Box_2
neg_17 = Negative(Value=multiplication_9)
division_4 = Division(A=axis_length_4, B=hole_grid_distance_x_2)
bbox_5 = BoundingBox(Content=flatten(rack_teeth_5), Plane=PlaneXY(0, 0, 0), UnionBox=True)  # -> Box, Box_2
multiplication_10 = Multiplication(A=hole_diameter_2, B="0.5")
multiplication_11 = Multiplication(A=screw_pocket_diameter_2, B="0.5")
Y_10 = UnitY(Factor=neg_17)
round_2 = Round(Number=division_4)  # -> Nearest, Floor, Ceiling
addition_6 = Addition(A=round_2.Floor, B="1")
move_22 = Move(Geometry=bbox_5.Box, Motion=Y_10)  # -> Geometry, Transform
multiplication_12 = Multiplication(A=round_2.Floor, B=hole_grid_distance_x_2)
edges_2 = BrepEdges(Brep=bbox_4.Box)  # -> Naked, Interior, NonManifold
edges_3 = BrepEdges(Brep=move_22.Geometry)  # -> Naked, Interior, NonManifold
subtraction_6 = Subtraction(A=axis_length_4, B=multiplication_12)
item_5 = ListItem(List=edges_2.Naked, Index=2, Wrap=True)
item_6 = ListItem(List=edges_3.Naked, Index=2, Wrap=True)
multiplication_13 = Multiplication(A=subtraction_6, B="0.5")
multiplication_14 = Multiplication(A=hole_grid_distance_y_2, B="0.5")
bbox_6 = BoundingBox(Content=flatten([item_5, item_6]), Plane=PlaneXY(0, 0, 0), UnionBox=True)  # -> Box, Box_2
neg_18 = Negative(Value=multiplication_14)
area_2 = Area(Geometry=bbox_6.Box)  # -> Area, Centroid
pt_27 = ConstructPoint(XCoordinate=multiplication_13, YCoordinate=neg_18, ZCoordinate=0)
xy_3 = XYPlane(Origin=pt_27)
pdecon_6 = Deconstruct(Point=area_2.Centroid)  # -> XComponent, YComponent, ZComponent
recgrid = Rectangular(Plane=xy_3, SizeX=hole_grid_distance_x_2, SizeY=hole_grid_distance_y_2, ExtentX=round_2.Floor, ExtentY="1")  # -> Cells, Points
addition_7 = Addition(A=multiplication_14, B=pdecon_6.YComponent)
xy_4 = XYPlane(Origin=recgrid.Points)
Y_11 = UnitY(Factor=addition_7)
cir_3 = Circle(Plane=xy_4, Radius=multiplication_11)
cir_4 = Circle(Plane=xy_4, Radius=multiplication_10)
item_7 = ListItem(List=cir_4, Index=0, Wrap=True)
item_8 = ListItem(List=cir_3, Index=0, Wrap=True)
move_23 = Move(Geometry=item_8, Motion=Y_11)  # -> Geometry, Transform
move_24 = Move(Geometry=item_7, Motion=Y_11)  # -> Geometry, Transform
screw_pockets_edges = Curve(cir_3)
screw_pockets_center = Curve(move_23.Geometry)
screw_holes_center = Curve(move_24.Geometry)
screw_holes_edges = Curve(cir_4)
hole_pattern_along_edges = Panel(make_hole_pattern_along_edges)
hole_pattern_along_center = Panel(make_hole_pattern_along_center)
filter_16 = StreamFilter(Gate=hole_pattern_along_center, Stream1=screw_holes_center)
filter_17 = StreamFilter(Gate=hole_pattern_along_center, Stream1=screw_pockets_center)
filter_18 = StreamFilter(Gate=hole_pattern_along_edges, Stream1=screw_holes_edges)
filter_19 = StreamFilter(Gate=hole_pattern_along_edges, Stream1=screw_pockets_edges)

# ---- group: Filter geometry
gemotry_output_type = Panel(output_geometry_type)
gate = StreamGate(Stream=filter_17, Gate=gemotry_output_type)  # -> Target0, Target1
gate_2 = StreamGate(Stream=filter_15, Gate=gemotry_output_type)  # -> Target0, Target1
gate_3 = StreamGate(Stream=filter_18, Gate=gemotry_output_type)  # -> Target0, Target1
gate_4 = StreamGate(Stream=filter_19, Gate=gemotry_output_type)  # -> Target0, Target1
gate_5 = StreamGate(Stream=filter_16, Gate=gemotry_output_type)  # -> Target0, Target1

# ----
glide_block_length_2 = Panel(glide_block_length)
hole_spacing_2 = Panel(hole_spacing)
first_hole_distance_from_edge_2 = Panel(first_hole_distance_from_edge)
hole_diamter_upper_glideblock = Panel(hole_diamter_for_tapping)
hole_diamter_lower_glideblock = Panel(hole_diamter_for_slip_fit)
use_custom_hole_pattern_2 = Panel(use_custom_hole_pattern)
custom_hole_pattern_2 = Panel(custom_hole_pattern)
hole_midline_point_2 = Point(hole_midline_point)
subtraction_7 = Subtraction(A=glide_block_length_2, B=first_hole_distance_from_edge_2)
pdecon_7 = Deconstruct(Point=hole_midline_point_2)  # -> XComponent, YComponent, ZComponent
multiplication_15 = Multiplication(A=hole_diamter_lower_glideblock, B=".5")
multiplication_16 = Multiplication(A=hole_diamter_upper_glideblock, B=".5")
subtraction_8 = Subtraction(A=subtraction_7, B=first_hole_distance_from_edge_2)
division_5 = Division(A=subtraction_8, B=hole_spacing_2)
round_3 = Round(Number=division_5)  # -> Nearest, Floor, Ceiling
division_6 = Division(A=subtraction_8, B=round_3.Ceiling)
addition_8 = Addition(A=round_3.Ceiling, B="1")
series_2 = Series(Start=first_hole_distance_from_edge_2, Step=division_6, Count=addition_8)
filter_20 = StreamFilter(Gate=use_custom_hole_pattern_2, Stream0=series_2, Stream1=custom_hole_pattern_2)
pt_28 = ConstructPoint(XCoordinate=filter_20, YCoordinate=pdecon_7.YComponent, ZCoordinate=pdecon_7.ZComponent)
xy_5 = XYPlane(Origin=pt_28)
planes_for_holes = Plane(xy_5)
cir_5 = Circle(Plane=planes_for_holes, Radius=multiplication_16)
cir_6 = Circle(Plane=planes_for_holes, Radius=multiplication_15)

# ---- group: Subtract pocket from axis extrusion
material_thickness_5 = Panel(material_thickness)
rack_pocket_outline_3 = Curve(gate_2.Target1)
rack_tooth_height_4 = Panel(rack_tooth_height)
axis_stock_2 = Brep(axis_stock)
screw_holes_edges_2 = Curve(gate_3.Target1)
screw_pockets_edges_2 = Curve(gate_4.Target1)
screw_holes_center_2 = Curve(gate_5.Target1)
screw_pockets_center_2 = Curve(gate.Target1)
edge_screw_pocket_depth_2 = Panel(edge_screw_pocket_depth)
center_screw_pocket_depth_2 = Panel(center_screw_pocket_depth)
neg_19 = Negative(Value=material_thickness_5)
neg_20 = Negative(Value=rack_tooth_height_4)
neg_21 = Negative(Value=edge_screw_pocket_depth_2)
neg_22 = Negative(Value=center_screw_pocket_depth_2)
Z_9 = UnitZ(Factor=neg_19)
Z_10 = UnitZ(Factor=neg_20)
Z_11 = UnitZ(Factor=neg_21)
Z_12 = UnitZ(Factor=neg_22)
extr_3 = Extrude(Base=[screw_holes_edges_2, screw_holes_center_2], Direction=Z_9)
extr_4 = Extrude(Base=rack_pocket_outline_3, Direction=Z_10)
extr_5 = Extrude(Base=screw_pockets_edges_2, Direction=Z_11)
extr_6 = Extrude(Base=screw_pockets_center_2, Direction=Z_12)
cap_3 = CapHoles(Brep=extr_4)
cap_4 = CapHoles(Brep=extr_3)
cap_5 = CapHoles(Brep=[extr_5, extr_6])
rack_pocket_2 = Brep(cap_3)
sdiff_2 = SolidDifference(BrepsA=axis_stock_2, BrepsB=rack_pocket_2)
sdiff_3 = SolidDifference(BrepsA=sdiff_2, BrepsB=flatten(cap_4))
sdiff_4 = SolidDifference(BrepsA=sdiff_3, BrepsB=flatten(cap_5))
item_9 = ListItem(List=flatten(sdiff_4), Index=0, Wrap=True)
null = NullItem(Item=item_9)  # -> NullFlags, InvalidFlags, Description
filter_21 = StreamFilter(Gate=null.NullFlags, Stream0=sdiff_4, Stream1=sdiff_2)
axis_brep = Brep(filter_21)

# ---- group: Extend rack pocket
tooth_spacing_2 = Panel(tooth_spacing)
rack_pocket_outline_4 = Curve(gate_2.Target0)
bbox_7 = BoundingBox(Content=rack_pocket_outline_4, Plane=PlaneXY(0, 0, 0))  # -> Box, Box_2
neg_23 = Negative(Value=tooth_spacing_2)
debrep = DeconstructBrep(Brep=bbox_7.Box)  # -> Faces, Edges, Vertices
X_3 = UnitX(Factor=neg_23)
item_10 = ListItem(List=debrep.Edges, Index=3, Wrap=True)
end_6 = EndPoints(Curve=item_10)  # -> Start, End
area_3 = Area(Geometry=bbox_7.Box)  # -> Area, Centroid
move_25 = Move(Geometry=end_6.Start, Motion=X_3)  # -> Geometry, Transform
move_26 = Move(Geometry=end_6.End, Motion=X_3)  # -> Geometry, Transform
yz = YZPlane(Origin=area_3.Centroid)
merge_6 = Merge(Data2=end_6.End, Data3=move_26.Geometry, Data4=move_25.Geometry, Data5=end_6.Start)
pline_5 = PolyLine(Vertices=merge_6, Closed=False)
mirror_3 = Mirror(Geometry=pline_5, Plane=yz)  # -> Geometry, Transform
rack_pocket_outline_5 = Curve(rack_pocket_outline_4)
end_7 = EndPoints(Curve=flatten([mirror_3.Geometry, pline_5]))  # -> Start, End
runion = RegionUnion(Curves=flatten([mirror_3.Geometry, pline_5, rack_pocket_outline_4]))  # disabled
crv_cp_3 = CurveClosestPoint(Point=flatten([end_7.Start, end_7.End]), Curve=flatten(rack_pocket_outline_5))  # -> Point, Parameter, Distance
shatter = Shatter(Curve=rack_pocket_outline_5, Parameters=crv_cp_3.Parameter)
dispatch = Dispatch(List=shatter, DispatchPattern=[True, False])  # -> ListA, ListB
join_3 = JoinCurves(Curves=flatten([dispatch.ListB, pline_5, mirror_3.Geometry]), Preserve=False)
item_11 = ListItem(List=dispatch.ListB, Index=1, Wrap=True)
rack_engrave_curve = Curve(item_11)
rack_pocket_extended = Curve(join_3)

# ----
glide_block_fillet_radius_2 = Panel(glide_block_fillet_radius)

# ---- group: Make clerance pocket
glide_block_length_3 = Panel(glide_block_length)
pocket_side_overshoot = Panel("0.5")
lower_glideblock_plane_2 = Plane(lower_glideblock_plane)
milling_bit_diamter_with_clearance = Panel(addition_4)
pt_29 = Point(pt_10)
pt_30 = Point(scale.Geometry)
dist_2 = Distance(PointA=pt_30, PointB=pt_29)
multiplication_17 = Multiplication(A=milling_bit_diamter_with_clearance, B="0.5")
addition_9 = Addition(A=dist_2, B=pocket_side_overshoot)
addition_10 = Addition(A=multiplication_17, B=pocket_side_overshoot)
project_2 = Project(Geometry=pt_29, Plane=lower_glideblock_plane_2)  # -> Geometry, Transform
smaller_3 = SmallerThan(FirstNumber=addition_9, SecondNumber=milling_bit_diamter_with_clearance)  # -> SmallerThan, OrEqualTo
X_4 = UnitX(Factor=addition_10)
dist_3 = Distance(PointA=pt_29, PointB=project_2.Geometry)
addition_11 = Addition(A=addition_10, B=glide_block_length_3, C=addition_10)
filter_22 = StreamFilter(Gate=smaller_3.SmallerThan, Stream0=addition_9, Stream1=milling_bit_diamter_with_clearance)
neg_24 = Negative(Value=X_4)
X_5 = UnitX(Factor=addition_11)
Y_12 = UnitY(Factor=filter_22)
move_27 = Move(Geometry=project_2.Geometry, Motion=neg_24)  # -> Geometry, Transform
move_28 = Move(Geometry=move_27.Geometry, Motion=Y_12)  # -> Geometry, Transform
move_29 = Move(Geometry=move_28.Geometry, Motion=X_5)  # -> Geometry, Transform
move_30 = Move(Geometry=move_27.Geometry, Motion=X_5)  # -> Geometry, Transform
pline_6 = PolyLine(Vertices=[move_27.Geometry, move_30.Geometry, move_29.Geometry, move_28.Geometry], Closed=True)
pocket_depth = Panel(dist_3)
clearance_pocket = Curve(pline_6)

# ---- group: Make lower glieblock outline
pt_31 = Point(pt_9)
glide_block_length_4 = Panel(glide_block_length)
glide_block_fillet_radius_3 = Panel(glide_block_fillet_radius)
material_thickness_6 = Panel(material_thickness_4)
pt_32 = Point(pt_8)
X_6 = UnitX(Factor=glide_block_length_4)
move_31 = Move(Geometry=pt_31, Motion=X_6)  # -> Geometry, Transform
move_32 = Move(Geometry=pt_32, Motion=X_6)  # -> Geometry, Transform
pline_7 = PolyLine(Vertices=[pt_32, move_32.Geometry, move_31.Geometry, pt_31], Closed=True)
neg_25 = Negative(Value=material_thickness_6)
Z_13 = UnitZ(Factor=neg_25)
fillet = Fillet(Curve=pline_7, Radius=glide_block_fillet_radius_3)
move_33 = Move(Geometry=fillet, Motion=Z_13)  # -> Geometry, Transform
outline_lower_glideblock = Curve(move_33.Geometry)

# ----
chamfer_line_overshoot_3 = Panel(chamfer_line_overshoot)
pt_33 = Point(scale_2.Geometry)
pt_34 = Point(scale.Geometry)
lower_glideblock_plane_3 = Plane(lower_glideblock_plane)
ln_4 = Line(StartPoint=pt_33, EndPoint=pt_34)
addition_12 = Addition(A=chamfer_line_overshoot_3, B=glide_block_length_4, C=chamfer_line_overshoot_3)
addition_13 = Addition(A=chamfer_line_overshoot_3, B=glide_block_length_4)
ext_2 = ExtendCurve(Curve=ln_4, Type=0, Start=chamfer_line_overshoot_3, End=chamfer_line_overshoot_3)
neg_26 = Negative(Value=addition_12)
X_7 = UnitX(Factor=addition_13)
X_8 = UnitX(Factor=neg_26)
move_34 = Move(Geometry=ext_2, Motion=X_7)  # -> Geometry, Transform
extr_7 = Extrude(Base=move_34.Geometry, Direction=X_8)
end_8 = EndPoints(Curve=move_34.Geometry)  # -> Start, End
project_3 = Project(Geometry=end_8.Start, Plane=lower_glideblock_plane_3)  # -> Geometry, Transform
move_35 = Move(Geometry=project_3.Geometry, Motion=X_8)  # -> Geometry, Transform
dist_4 = Distance(PointA=project_3.Geometry, PointB=end_8.Start)
pt_35 = Point(project_3.Geometry)
ln_5 = Line(StartPoint=pt_35, EndPoint=move_35.Geometry)
chamfer_engrave_depth = Panel(dist_4)
glideblock_chamfer_surface = Surface(extr_7)
chamfer_line = Curve(ln_5)

# ---- group: Make upper glideblock outline
glide_block_length_5 = Panel(glide_block_length)
glide_block_fillet_radius_4 = Panel(glide_block_fillet_radius)
material_thickness_7 = Panel(material_thickness_4)
pt_36 = Point(move_21.Geometry)
pt_37 = Point(move_20.Geometry)
X_9 = UnitX(Factor=glide_block_length_5)
move_36 = Move(Geometry=pt_36, Motion=X_9)  # -> Geometry, Transform
move_37 = Move(Geometry=pt_37, Motion=X_9)  # -> Geometry, Transform
pline_8 = PolyLine(Vertices=[pt_37, move_37.Geometry, move_36.Geometry, pt_36], Closed=True)
Z_14 = UnitZ(Factor=material_thickness_7)
fillet_2 = Fillet(Curve=pline_8, Radius=glide_block_fillet_radius_4)
move_38 = Move(Geometry=fillet_2, Motion=Z_14)  # -> Geometry, Transform
outline_upper_glideblock = Curve(move_38.Geometry)

# ---- group: Make 3D glide block geometry
glide_block_length_6 = Panel(glide_block_length)
material_thickness_8 = Panel(material_thickness_4)
gemotry_output_type_2 = Panel(output_geometry_type)
X_10 = UnitX(Factor=glide_block_length_6)
Z_15 = UnitZ(Factor=material_thickness_8)
filter_23 = StreamFilter(Gate=gemotry_output_type_2, Stream1=cir_5)
filter_24 = StreamFilter(Gate=gemotry_output_type_2, Stream1=cir_6)
filter_25 = StreamFilter(Gate=gemotry_output_type_2, Stream1=flat_pad_glideblock_profile)
filter_26 = StreamFilter(Gate=gemotry_output_type_2, Stream1=chamfer_glideblock_profile)
neg_27 = Negative(Value=Z_15)
extr_8 = Extrude(Base=filter_25, Direction=X_10)
extr_9 = Extrude(Base=filter_23, Direction=neg_27)
extr_10 = Extrude(Base=filter_26, Direction=X_10)
extr_11 = Extrude(Base=filter_24, Direction=Z_15)
cap_6 = CapHoles(Brep=extr_8)
cap_7 = CapHoles(Brep=extr_9)
cap_8 = CapHoles(Brep=extr_10)
cap_9 = CapHoles(Brep=extr_11)
xz_3 = XZPlane(Origin=Point(0, 0, 0))
sdiff_5 = SolidDifference(BrepsA=cap_8, BrepsB=cap_9)
sdiff_6 = SolidDifference(BrepsA=cap_6, BrepsB=cap_7)
mirror_4 = Mirror(Geometry=[sdiff_5, sdiff_6], Plane=xz_3)  # -> Geometry, Transform
glideblock_breps = Brep([mirror_4.Geometry, sdiff_5, sdiff_6])

# ---- group: Make chamfer pad pocket
milling_bit_diamter_with_clearance_2 = Panel(addition_4)
pocket_side_overshoot_2 = Panel("0.5")
glide_block_length_7 = Panel(glide_block_length)
upper_glideblock_plane_2 = Plane(upper_glideblock_plane)
pt_38 = Point(move_11.Geometry)
pt_39 = Point(move_13.Geometry)
dist_5 = Distance(PointA=pt_39, PointB=pt_38)
addition_14 = Addition(A=pocket_side_overshoot_2, B=dist_5, C=pocket_side_overshoot_2)
subtraction_9 = Subtraction(A=milling_bit_diamter_with_clearance_2, B=dist_5)
smaller_4 = SmallerThan(FirstNumber=addition_14, SecondNumber=milling_bit_diamter_with_clearance_2)  # -> SmallerThan, OrEqualTo
multiplication_18 = Multiplication(A=subtraction_9, B="0.5")
filter_27 = StreamFilter(Gate=smaller_4.SmallerThan, Stream0=pocket_side_overshoot_2, Stream1=multiplication_18)
neg_28 = Negative(Value=filter_27)
Y_13 = UnitY(Factor=filter_27)
Y_14 = UnitY(Factor=neg_28)
move_39 = Move(Geometry=pt_39, Motion=Y_13)  # -> Geometry, Transform
move_40 = Move(Geometry=pt_38, Motion=Y_14)  # -> Geometry, Transform
multiplication_19 = Multiplication(A=milling_bit_diamter_with_clearance_2, B="0.5")
project_4 = Project(Geometry=move_40.Geometry, Plane=upper_glideblock_plane_2)  # -> Geometry, Transform
project_5 = Project(Geometry=move_39.Geometry, Plane=upper_glideblock_plane_2)  # -> Geometry, Transform
addition_15 = Addition(A=multiplication_19, B=pocket_side_overshoot_2)
X_11 = UnitX(Factor=addition_15)
dist_6 = Distance(PointA=move_39.Geometry, PointB=project_5.Geometry)
addition_16 = Addition(A=addition_15, B=glide_block_length_7, C=addition_15)
neg_29 = Negative(Value=X_11)
neg_30 = Negative(Value=X_11)
X_12 = UnitX(Factor=addition_16)
move_41 = Move(Geometry=project_5.Geometry, Motion=neg_29)  # -> Geometry, Transform
move_42 = Move(Geometry=project_4.Geometry, Motion=neg_30)  # -> Geometry, Transform
move_43 = Move(Geometry=move_42.Geometry, Motion=X_12)  # -> Geometry, Transform
move_44 = Move(Geometry=move_41.Geometry, Motion=X_12)  # -> Geometry, Transform
pline_9 = PolyLine(Vertices=[move_41.Geometry, move_44.Geometry, move_43.Geometry, move_42.Geometry], Closed=True)
chamfer_pad_pocket = Curve(pline_9)
pocket_depth_2 = Panel(dist_6)

# ---- group: Make dogbone pad pocket
pocket_side_overshoot_3 = Panel("0.5")
glide_block_length_8 = Panel(glide_block_length)
upper_glideblock_plane_3 = Plane(upper_glideblock_plane)
milling_bit_diamter_with_clearance_3 = Panel(addition_4)
pt_40 = Point(move_14.Geometry)
pt_41 = Point(move_16.Geometry)
multiplication_20 = Multiplication(A=milling_bit_diamter_with_clearance_3, B="0.5")
project_6 = Project(Geometry=pt_41, Plane=upper_glideblock_plane_3)  # -> Geometry, Transform
project_7 = Project(Geometry=pt_40, Plane=upper_glideblock_plane_3)  # -> Geometry, Transform
addition_17 = Addition(A=multiplication_20, B=pocket_side_overshoot_3)
X_13 = UnitX(Factor=addition_17)
dist_7 = Distance(PointA=pt_40, PointB=project_7.Geometry)
addition_18 = Addition(A=addition_17, B=glide_block_length_8, C=addition_17)
neg_31 = Negative(Value=X_13)
neg_32 = Negative(Value=X_13)
X_14 = UnitX(Factor=addition_18)
move_45 = Move(Geometry=project_7.Geometry, Motion=neg_31)  # -> Geometry, Transform
move_46 = Move(Geometry=project_6.Geometry, Motion=neg_32)  # -> Geometry, Transform
move_47 = Move(Geometry=move_46.Geometry, Motion=X_14)  # -> Geometry, Transform
move_48 = Move(Geometry=move_45.Geometry, Motion=X_14)  # -> Geometry, Transform
pline_10 = PolyLine(Vertices=[move_45.Geometry, move_48.Geometry, move_47.Geometry, move_46.Geometry], Closed=True)
pocket_depth_3 = Panel(dist_7)
dogbone_pocket = Curve(pline_10)

# ----
pinion_clearance_margin_6 = Panel(addition)
extra_pinion_hole_clearance_margin = Panel("1")
gemotry_output_type_3 = Panel(output_geometry_type)
neg_33 = Negative(Value=pinion_clearance_margin_6)
neg_34 = Negative(Value=extra_pinion_hole_clearance_margin)
Y_15 = UnitY(Factor=neg_33)
Y_16 = UnitY(Factor=neg_34)
Y_17 = UnitY(Factor=pinion_clearance_margin_6)
X_15 = UnitX(Factor=1)
Y_18 = UnitY(Factor=1)
X_16 = UnitX(Factor=1)
Y_19 = UnitY(Factor=1)
rev = Reverse(Vector=X_16)
xy_6 = XYPlane(Origin=Point(0, 0, 0))

# ---- group: Prep nesting planes
axis_width_3 = Panel(axis_width)
extra_clearance = Panel("0.5")
glide_block_length_9 = Panel(glide_block_length)
milling_bit_diamter_for_clearing_flat_pa_3 = Panel(milling_bit_diamter_for_clearing_flat_pa)  # "Milling bit diamter for clearing flat pad slot"
addition_19 = Addition(A=milling_bit_diamter_for_clearing_flat_pa_3, B=extra_clearance)
multiplication_21 = Multiplication(A=axis_width_3, B="0.5")
addition_20 = Addition(A=addition_19, B=glide_block_length_9)
X_17 = UnitX(Factor=addition_20)
addition_21 = Addition(A=multiplication_21, B=addition_19)
neg_35 = Negative(Value=addition_21)
pt_42 = ConstructPoint(XCoordinate=0, YCoordinate=neg_35, ZCoordinate=0)
xy_7 = XYPlane(Origin=pt_42)
move_49 = Move(Geometry=xy_7, Motion=X_17)  # -> Geometry, Transform
first_nesting_plane = Plane(xy_7)
second_nesting_plane = Plane(move_49.Geometry)

# ---- group: Create pinion position plane
pinon_distance_from_axis_edge_2 = Panel(pinon_distance_from_axis_edge)
pinion_positioned_in_rack = Curve(flatten(pinion_on_rack))
axist_type_is_rotary_4 = Panel(axis_type)
item_12 = ListItem(List=pinion_positioned_in_rack, Index=0, Wrap=True)
area_4 = Area(Geometry=item_12)  # -> Area, Centroid
pdecon_8 = Deconstruct(Point=area_4.Centroid)  # -> XComponent, YComponent, ZComponent
filter_28 = StreamFilter(Gate=axist_type_is_rotary_4, Stream0=pinon_distance_from_axis_edge_2, Stream1="0")
filter_29 = StreamFilter(Gate=axist_type_is_rotary_4, Stream0=pdecon_8.YComponent, Stream1="0")
pt_43 = ConstructPoint(XCoordinate=filter_28, YCoordinate=filter_29, ZCoordinate=0)
xy_8 = XYPlane(Origin=pt_43)

# ----
pinion_material_thickness_2 = Panel(pinion_material_thickness)
pinion_center_hole = Curve(roller_rack_and_pinion_maker.pinion_center_hole_3)
pinion_clearance_to_pocket_floor = Panel("0.5")
rack_tooth_height_5 = Panel(rack_tooth_height)
subtraction_10 = Subtraction(A=rack_tooth_height_5, B=pinion_clearance_to_pocket_floor)
xz_4 = XZPlane(Origin=Point(0, 0, 0))
pt_44 = ConstructPoint(XCoordinate=0, YCoordinate=0, ZCoordinate=subtraction_10)
xy_9 = XYPlane(Origin=Point(0, 0, 0))
xy_10 = XYPlane(Origin=pt_44)
rotate = Rotate(Geometry=xy_10, Angle=3.141592654, Plane=xz_4)  # -> Geometry, Transform
gemotry_output_type_4 = Panel(output_geometry_type)
gemotry_output_type_5 = Panel(output_geometry_type)
axist_type_is_rotary_5 = Panel(axis_type)

# ---- group: Prep set screw markings
addition_22 = Addition(A=rack_tooth_height, B=extra_tooth_height_compared_to_rack_toot)
multiplication_22 = Multiplication(A=milling_bit_diameter_for_hole_marking, B="0.5")
subtraction_11 = Subtraction(A=minimum_clearlance_from_tooth_to_outer_e, B="0.1")
pinion_tooth_heigth = Panel(addition_22)
subtraction_12 = Subtraction(A=multiplication_22, B=subtraction_11)
subtraction_13 = Subtraction(A=pinion_material_thickness, B=pinion_tooth_heigth)
pinion_wall_height = Panel(subtraction_13)
multiplication_23 = Multiplication(A=hole_diamter_for_set_screws, B="0.5")
multiplication_24 = Multiplication(A=pinion_wall_height, B="0.5")
xy_11 = XYPlane(Origin=Point(0, 0, 0))
addition_23 = Addition(A=multiplication_24, B=multiplication_23)
addition_24 = Addition(A=pinion_tooth_heigth, B=addition_23)
pinion_tooth_heigth_2 = Panel(pinion_tooth_heigth)
drill_depths = Panel(addition_24)

# ----
pinion_tooth_heigth_3 = Panel(pinion_tooth_heigth_2)
drill_depths_2 = Panel(drill_depths)

# ---- group: Make outer pinion circle
motor_shaft_diameter_4 = Panel(filter_4)
pinion_teeth_2 = Curve(flatten(roller_rack_and_pinion_maker.pinion_teeth_4))
explode = Explode(Curve=pinion_teeth_2, Recursive=True)  # -> Segments, Vertices
multiplication_25 = Multiplication(A=motor_shaft_diameter_4, B=default_pinion_outer_edge_diamter_to_sha)
addition_25 = Addition(A=motor_shaft_diameter_4, B=minimum_pinion_pipe_wall_thickness, C=minimum_pinion_pipe_wall_thickness)
item_13 = ListItem(List=explode.Segments, Index=0, Wrap=True)
eval_2 = EvaluateLength(Curve=item_13, Length="0.5", Normalized=True)  # -> Point, Tangent, Parameter
pdecon_9 = Deconstruct(Point=eval_2.Point)  # -> XComponent, YComponent, ZComponent
abs = Absolute(Value=pdecon_9.YComponent)
addition_26 = Addition(A=abs, B=minimum_clearlance_from_tooth_to_outer_e)
multiplication_26 = Multiplication(A=addition_26, B="2")
xy_12 = XYPlane(Origin=Point(0, 0, 0))

# ---- group: Make outer pinion circle / Check if pinion wall is thick enough to hold a set screw
smaller_5 = SmallerThan(FirstNumber=multiplication_25, SecondNumber=addition_25)  # -> SmallerThan, OrEqualTo
filter_30 = StreamFilter(Gate=smaller_5.SmallerThan, Stream0=multiplication_25, Stream1=addition_25)

# ---- group: Make outer pinion circle / Check if there is enough clearing between tooth geometry and outer edge
smaller_6 = SmallerThan(FirstNumber=filter_30, SecondNumber=multiplication_26)  # -> SmallerThan, OrEqualTo
filter_31 = StreamFilter(Gate=smaller_6.SmallerThan, Stream0=filter_30, Stream1=multiplication_26)

# ---- group: Make outer pinion circle (continued)
round_4 = Round(Number=filter_31)  # -> Nearest, Floor, Ceiling
motor_shaft_diameter_5 = Panel(round_4.Ceiling)
multiplication_27 = Multiplication(A=motor_shaft_diameter_5, B="0.5")
cir_7 = Circle(Plane=xy_12, Radius=multiplication_27)
pinion_edge = Curve(cir_7)

# ---- group: Prep set screw markings (continued)
addition_27 = Addition(A=multiplication_27, B=subtraction_12)
pt_45 = ConstructPoint(XCoordinate=addition_27, YCoordinate=0, ZCoordinate=0)
xy_13 = XYPlane(Origin=pt_45)
cir_8 = Circle(Plane=xy_13, Radius=multiplication_22)
arrpolar = PolarArray(Geometry=cir_8, Plane=xy_11, Count=number_off_set_screws, Angle=6.283185307)  # -> Geometry, Transform
holes_for_marking_set_screws = Curve(arrpolar.Geometry)

# ---- group: Make 3D pinion
pinion_material_thickness_3 = Panel(pinion_material_thickness)
drill_depths_3 = Panel(drill_depths)
pinion_edge_2 = Curve(pinion_edge)
holes_for_marking_set_screws_2 = Curve(holes_for_marking_set_screws)
pinion_tooth_heigth_4 = Panel(pinion_tooth_heigth_2)
pinion_teeth_3 = Curve(pinion_teeth_2)
pinion_center_hole_2 = Curve(roller_rack_and_pinion_maker.pinion_center_hole_3)
offset_3 = Offset(Curve=pinion_edge_2, Distance=1, Plane=PlaneXY(0, 0, 0), Corners=1)
neg_36 = Negative(Value=drill_depths_3)
neg_37 = Negative(Value=pinion_material_thickness_3)
neg_38 = Negative(Value=pinion_tooth_heigth_4)
boundary_2 = BoundarySurfaces(Edges=flatten(holes_for_marking_set_screws_2))
boundary_3 = BoundarySurfaces(Edges=flatten([pinion_center_hole_2, pinion_edge_2]))
Z_16 = UnitZ(Factor=neg_36)
Z_17 = UnitZ(Factor=neg_37)
boundary_4 = BoundarySurfaces(Edges=flatten([offset_3, pinion_teeth_3]))
Z_18 = UnitZ(Factor=neg_38)
extr_12 = Extrude(Base=boundary_2, Direction=Z_16)
extr_13 = Extrude(Base=boundary_3, Direction=Z_17)
extr_14 = Extrude(Base=boundary_4, Direction=Z_18)
sdiff_7 = SolidDifference(BrepsA=extr_13, BrepsB=extr_14)
sdiff_8 = SolidDifference(BrepsA=sdiff_7, BrepsB=extr_12)
_3d_pinion = Brep(sdiff_8)

# ----
pinion_edge_3 = Curve(pinion_edge)
holes_for_marking_set_screws_3 = Curve(holes_for_marking_set_screws)
pinion_teeth_4 = Curve(pinion_teeth_2)
_3d_pinion_2 = Brep(_3d_pinion)
orient = Orient(
    Geometry=flatten([pinion_teeth_4, pinion_center_hole, pinion_edge_3, holes_for_marking_set_screws_3]),
    Source=xy_9,
    Target=xy_8)  # -> Geometry, Transform
orient_2 = Orient(Geometry=flatten(_3d_pinion_2), Source=rotate.Geometry, Target=xy_8)  # -> Geometry, Transform
filter_32 = StreamFilter(Gate=gemotry_output_type_5, Stream1=orient_2.Geometry)
filter_33 = StreamFilter(Gate=gemotry_output_type_5, Stream0=orient.Geometry)

# ---- group: 3D pinion
pinion_brep = Brep(filter_32)

# ----
X_18 = UnitX(Factor=1)
first_hole_distance_from_edge_3 = Panel(first_hole_distance_from_edge)
hole_diamter_upper_glideblock_2 = Panel(hole_diamter_for_tapping)
hole_diamter_lower_glideblock_2 = Panel(hole_diamter_for_slip_fit)
glideblock_angle_deg = Panel(glideblock_width_angle_deg)
axis_lne_3 = Line(axis_lne)
gear_center_plane_2 = Plane(gear_center_plane)
chamfer_glideblock_profile_2 = Curve(chamfer_glideblock_profile)
flat_pad_glideblock_profile_2 = Curve(flat_pad_glideblock_profile)
top_point_2 = Point(pt_2)
Z_19 = UnitZ(Factor=1)
end_9 = EndPoints(Curve=cir)  # -> Start, End
rev_2 = Reverse(Vector=X_18)
yz_2 = YZPlane(Origin=top_point_2)
pl = ConstructPlane(Origin=end_9.Start, XAxis=rev_2, YAxis=Z_19)
rad = Radians(Degrees=glideblock_angle_deg)
orient_3 = Orient(Geometry=chamfer_glideblock_profile_2, Source=yz_2, Target=pl)  # -> Geometry, Transform
orient_4 = Orient(Geometry=flat_pad_glideblock_profile_2, Source=yz_2, Target=pl)  # -> Geometry, Transform
multiplication_28 = Multiplication(A=hole_diamter_lower_glideblock_2, B=".5")
multiplication_29 = Multiplication(A=hole_diamter_upper_glideblock_2, B=".5")
pi = Pi(Factor=1)
multiplication_30 = Multiplication(A=pi, B="0.5")
multiplication_31 = Multiplication(A=rad, B="0.5")
addition_28 = Addition(A=multiplication_31, B=multiplication_30)
neg_39 = Negative(Value=addition_28)
rotate_2 = Rotate(Geometry=orient_4.Geometry, Angle=neg_39, Plane=gear_center_plane_2)  # -> Geometry, Transform
rotate_3 = Rotate(Geometry=orient_3.Geometry, Angle=neg_39, Plane=gear_center_plane_2)  # -> Geometry, Transform
revsrf_2 = Revolution(Curve=rotate_3.Geometry, Axis=axis_lne_3, Domain=rad)
revsrf_3 = Revolution(Curve=rotate_2.Geometry, Axis=axis_lne_3, Domain=rad)
explode_2 = Explode(Curve=rotate_3.Geometry, Recursive=True)  # -> Segments, Vertices
gear_center_plane_3 = Plane(gear_center_plane_2)
cap_10 = CapHoles(Brep=revsrf_2)
cap_11 = CapHoles(Brep=revsrf_3)
item_14 = ListItem(List=explode_2.Segments, Index=5, Wrap=True)
eval_3 = EvaluateLength(Curve=item_14, Length="0.5", Normalized=True)  # -> Point, Tangent, Parameter
rotary_chamfered_pad_glideblock = Brep(cap_10)
rotary_flat_pad_glideblock = Brep(cap_11)
project_8 = Project(Geometry=eval_3.Point, Plane=gear_center_plane_3)  # -> Geometry, Transform
dist_8 = Distance(PointA=project_8.Geometry, PointB=gear_center_plane_3)
pi_2 = Pi(Factor=1)
multiplication_32 = Multiplication(A=dist_8, B="2")
multiplication_33 = Multiplication(A=multiplication_32, B=pi_2)
first_hole_distance_from_edge_4 = Panel(first_hole_distance_from_edge_3)
division_7 = Division(A="360", B=multiplication_33)
multiplication_34 = Multiplication(A=division_7, B=first_hole_distance_from_edge_4)
rotate_4 = Rotate(Geometry=eval_3.Point, Angle=degrees(multiplication_34), Plane=gear_center_plane_3)  # -> Geometry, Transform
yz_3 = YZPlane(Origin=Point(0, 0, 0))
mirror_5 = Mirror(Geometry=rotate_4.Geometry, Plane=yz_3)  # -> Geometry, Transform
xy_14 = XYPlane(Origin=[mirror_5.Geometry, rotate_4.Geometry])
panel = Panel("""120
240""")
cir_9 = Circle(Plane=xy_14, Radius=multiplication_28)
cir_10 = Circle(Plane=xy_14, Radius=multiplication_29)
holes_chamfer_glideblock = Curve(cir_9)
holes_flat_glideblock = Curve(cir_10)
gear_center_plane_4 = Plane(gear_center_plane_3)

item_15 = ListItem(List=explode_2.Vertices, Index=0, Wrap=True)
project_9 = Project(Geometry=item_15, Plane=gear_center_plane_3)  # -> Geometry, Transform
dist_9 = Distance(PointA=project_9.Geometry, PointB=gear_center_plane_3)

glide_block_fillet_radius_5 = Panel(glide_block_fillet_radius)
rotary_flat_pad_glideblock_2 = Brep(rotary_flat_pad_glideblock)
material_thickness_9 = Panel(material_thickness)
rotary_chamfered_pad_glideblock_2 = Brep(rotary_chamfered_pad_glideblock)
debrep_2 = DeconstructBrep(Brep=rotary_flat_pad_glideblock_2)  # -> Faces, Edges, Vertices
debrep_3 = DeconstructBrep(Brep=rotary_chamfered_pad_glideblock_2)  # -> Faces, Edges, Vertices
neg_40 = Negative(Value=material_thickness_9)
Z_20 = UnitZ(Factor=neg_40)
Z_21 = UnitZ(Factor=material_thickness_9)
item_16 = ListItem(List=debrep_2.Faces, Index=Slider(2, range=0..10), Wrap=True)
item_17 = ListItem(List=debrep_3.Faces, Index=Slider(3, range=0..10), Wrap=True)
wires = BrepWireframe(Brep=item_17, Density=-1)
wires_2 = BrepWireframe(Brep=item_16, Density=-1)
join_4 = JoinCurves(Curves=wires, Preserve=False)
join_5 = JoinCurves(Curves=wires_2, Preserve=False)
fillet_3 = Fillet(Curve=join_4, Radius=glide_block_fillet_radius_5)
fillet_4 = Fillet(Curve=join_5, Radius=glide_block_fillet_radius_5)
move_50 = Move(Geometry=fillet_4, Motion=Z_21)  # -> Geometry, Transform
move_51 = Move(Geometry=fillet_3, Motion=Z_20)  # -> Geometry, Transform
flat_pad_outline = Curve(move_50.Geometry)
chamfer_pad_outline = Curve(move_51.Geometry)

# ---- group: Make rotary glideblock 3D preview
geometry_output_type_2 = Panel(output_geometry_type)
rotary_chamfered_pad_glideblock_3 = Brep(rotary_chamfered_pad_glideblock)
rotary_flat_pad_glideblock_3 = Brep(rotary_flat_pad_glideblock)
holes_upper_glideblock = Curve(holes_flat_glideblock)
holes_lower_glideblock = Curve(holes_chamfer_glideblock)
material_thickness_10 = Panel(material_thickness)
neg_41 = Negative(Value=material_thickness_10)
Z_22 = UnitZ(Factor=material_thickness_10)
Z_23 = UnitZ(Factor=neg_41)
extr_15 = Extrude(Base=holes_lower_glideblock, Direction=Z_22)
extr_16 = Extrude(Base=holes_upper_glideblock, Direction=Z_23)
filter_34 = StreamFilter(Gate=geometry_output_type_2, Stream1=rotary_chamfered_pad_glideblock_3)
filter_35 = StreamFilter(Gate=geometry_output_type_2, Stream1=rotary_flat_pad_glideblock_3)
cap_12 = CapHoles(Brep=extr_16)
cap_13 = CapHoles(Brep=extr_15)
sdiff_9 = SolidDifference(BrepsA=filter_35, BrepsB=cap_12)
sdiff_10 = SolidDifference(BrepsA=filter_34, BrepsB=cap_13)
arrpolar_2 = PolarArray(Geometry=[sdiff_10, sdiff_9], Plane=gear_center_plane_2, Count="3", Angle=6.283185307)  # -> Geometry, Transform
rotary_glideblock_breps = Brep(flatten(arrpolar_2.Geometry))

# ----
holes_chamfer_glideblock_2 = Curve(holes_chamfer_glideblock)
holes_flat_glideblock_2 = Curve(holes_flat_glideblock)
chamfer_pad_outline_2 = Curve(chamfer_pad_outline)
flat_pad_outline_2 = Curve(flat_pad_outline)

chamfer_line_overshoot_4 = Panel(chamfer_line_overshoot)
neg_42 = Negative(Value=chamfer_line_overshoot_4)
Y_20 = UnitY(Factor=neg_42)
xz_5 = XZPlane(Origin=Point(0, 0, 0))

corner_fillet_radius_2 = Panel(corner_fillet_radius)
axis_stock_3 = Brep(axis_stock)
bbox_8 = BoundingBox(Content=axis_stock_3, Plane=PlaneXY(0, 0, 0))  # -> Box, Box_2
debrep_4 = DeconstructBrep(Brep=bbox_8.Box)  # -> Faces, Edges, Vertices
item_18 = ListItem(List=debrep_4.Faces, Index=5, Wrap=True)
edges_4 = BrepEdges(Brep=item_18)  # -> Naked, Interior, NonManifold
join_6 = JoinCurves(Curves=edges_4.Naked, Preserve=False)

item_19 = ListItem(List=debrep_4.Edges, Index=4, Wrap=True)
ext_3 = ExtendCurve(Curve=item_19, Type=0, Start=chamfer_line_overshoot_4, End=chamfer_line_overshoot_4)
addition_29 = Addition(A=chamfer_line_overshoot_4, B=corner_fillet_radius_2)
move_52 = Move(Geometry=ext_3, Motion=Y_20)  # -> Geometry, Transform
neg_43 = Negative(Value=addition_29)
end_10 = EndPoints(Curve=move_52.Geometry)  # -> Start, End
X_19 = UnitX(Factor=neg_43)
X_20 = UnitX(Factor=addition_29)
move_53 = Move(Geometry=end_10.Start, Motion=X_19)  # -> Geometry, Transform
move_54 = Move(Geometry=end_10.End, Motion=X_20)  # -> Geometry, Transform
xy_15 = XYPlane(Origin=move_54.Geometry)
xy_16 = XYPlane(Origin=move_53.Geometry)
arc = Arc(Plane=xy_16, Radius=addition_29, Angle=Domain(6.283185307, 4.71238898))  # -> Arc, Length
arc_2 = Arc(Plane=xy_15, Radius=addition_29, Angle=Domain(4.71238898, 3.141592654))  # -> Arc, Length
end_11 = EndPoints(Curve=arc.Arc)  # -> Start, End
end_12 = EndPoints(Curve=arc_2.Arc)  # -> Start, End
ln_6 = Line(StartPoint=end_11.End, EndPoint=end_12.Start)
join_7 = JoinCurves(Curves=[arc.Arc, ln_6, arc_2.Arc], Preserve=True)
Y_21 = UnitY(Factor=addition_29)
move_55 = Move(Geometry=join_7, Motion=Y_21)  # -> Geometry, Transform
mirror_6 = Mirror(Geometry=move_55.Geometry, Plane=xz_5)  # -> Geometry, Transform
flip_2 = FlipCurve(Curve=mirror_6.Geometry)  # -> Curve, Flag
axis_chamfer_engrave_line = Curve([move_55.Geometry, flip_2.Curve])

fillet_5 = Fillet(Curve=join_6, Radius=corner_fillet_radius_2)

axis_outline = Curve(fillet_5)

gate_6 = StreamGate(Stream=axis_outline, Gate=gemotry_output_type_3)  # -> Target0, Target1
gate_7 = StreamGate(Stream=axis_chamfer_engrave_line, Gate=gemotry_output_type_3)  # -> Target0, Target1

# ---- group: Make 3D chamfer surfaces (very handy for high speed ball nose 3D milling with Bark Beetle)
axis_chamfer_engrave_line_2 = Curve(reparameterize(move_55.Geometry))
axis_length_5 = Panel(axis_length)
chamfer_distance_5 = Panel(chamfer_distance)
chamfer_line_overshoot_5 = Panel(chamfer_line_overshoot_4)
neg_44 = Negative(Value=chamfer_distance_5)
neg_45 = Negative(Value=chamfer_line_overshoot_5)
Z_24 = UnitZ(Factor=chamfer_line_overshoot_5)
addition_30 = Addition(A=neg_45, B=neg_44)
multiplication_35 = Multiplication(A=axis_length_5, B="0.5")
move_56 = Move(Geometry=axis_chamfer_engrave_line_2, Motion=Z_24)  # -> Geometry, Transform
addition_31 = Addition(A=chamfer_line_overshoot_5, B=chamfer_distance_5, C=chamfer_line_overshoot_5)
pt_46 = ConstructPoint(XCoordinate=multiplication_35, YCoordinate=0, ZCoordinate=0)
Z_25 = UnitZ(Factor=addition_30)
Y_22 = UnitY(Factor=addition_31)
xy_17 = XYPlane(Origin=pt_46)
move_57 = Move(Geometry=axis_chamfer_engrave_line_2, Motion=Z_25)  # -> Geometry, Transform
move_58 = Move(Geometry=move_56.Geometry, Motion=Y_22)  # -> Geometry, Transform
merge_7 = Merge(Data1=move_57.Geometry, Data2=move_58.Geometry)
loft_2 = Loft(Curves=merge_7, Options={Adjust=False, Closed=False, LoftEnds=0, LoftSimp=0, LoftType=0, Rebuild=10, Refit=0.01})
rotate_5 = Rotate(Geometry=loft_2, Angle=3.141592654, Plane=xy_17)  # -> Geometry, Transform
merge_8 = Merge(Data1=loft_2, Data2=rotate_5.Geometry)
chamfer_3d_surfaces = Surface(merge_8)

# ----
gate_8 = StreamGate(Stream=chamfer_3d_surfaces, Gate=gemotry_output_type_3)  # -> Target0, Target1

# ---- group: Select chamfer type
axis_chamfer_engrave_line_3 = Curve(flatten(gate_7.Target0))
chamfer_geometry_for_2d_2 = Panel(chamfer_geometry_for_2d)
chamfer_3d_surfaces_2 = Surface(flatten(gate_8.Target0))
filter_36 = StreamFilter(Gate=chamfer_geometry_for_2d_2, Stream0=axis_chamfer_engrave_line_3, Stream1=chamfer_3d_surfaces_2)

# ----
axis_plate_radius = Panel(dist_9)

# ---- group: Make axis plate and motor plate
motorplate_edge_thickness_from_holes_2 = Panel(motorplate_edge_thickness_from_holes)
clearnace_from_axis_to_axis_plate_3 = Panel(clearnace_from_axis_to_axis_plate)
material_thickness_11 = Panel(material_thickness)
hex_nut_pocket_depth_2 = Panel(hex_nut_pocket_depth)
gear_center_plane_5 = Plane(gear_center_plane_4)
axis_plate_radius_2 = Panel(axis_plate_radius)
geometry_output_type_3 = Panel(output_geometry_type)
axist_type_is_rotary_6 = Panel(axis_type)
motor_plate_hole_side_offset = Panel("20")
Y_23 = UnitY(Factor=motor_plate_hole_side_offset)
addition_32 = Addition(A=clearnace_from_axis_to_axis_plate_3, B=material_thickness_11)
Z_26 = UnitZ(Factor=material_thickness_11)
pt_47 = ConstructPoint(XCoordinate=0, YCoordinate=0, ZCoordinate=clearnace_from_axis_to_axis_plate_3)
pt_48 = ConstructPoint(XCoordinate=0, YCoordinate=0, ZCoordinate=addition_32)
xy_18 = XYPlane(Origin=pt_47)
xy_19 = XYPlane(Origin=pt_48)
Z_27 = UnitZ(Factor=clearnace_from_axis_to_axis_plate_3)
move_59 = Move(Geometry=gear_center_plane_5, Motion=Z_27)  # -> Geometry, Transform
cir_11 = Circle(Plane=move_59.Geometry, Radius=axis_plate_radius_2)
Z_28 = UnitZ(Factor=material_thickness_11)
Z_29 = UnitZ(Factor=material_thickness_11)
Z_30 = UnitZ(Factor=hex_nut_pocket_depth_2)

# ---- group: Make axis plate and motor plate curves
outline_upper_glideblock_2 = Curve(outline_upper_glideblock)
planes_for_holes_2 = Plane(planes_for_holes)
hole_diamter_lower_glideblock_3 = Panel(hole_diamter_for_slip_fit)
material_thickness_12 = Panel(material_thickness_4)
motor_mount_hole_spacing = Panel(motor_type)
flange_hole_diameter_2 = Panel(flange_hole_diameter)
adjustment_range_glideblocks = Panel(adjustment_range_glideblock)
extra_offset_adjustable_holes_2 = Panel(extra_offset_adjustable_holes)
clearnace_from_axis_to_axis_plate_4 = Panel(clearnace_from_axis_to_axis_plate)
pinion_positioned_in_rack_2 = Curve(flatten(pinion_on_rack))
pinon_distance_from_axis_edge_3 = Panel(pinon_distance_from_axis_edge)
motorplate_mount_spacing_x = Panel(filter_6)
motorplate_mount_spacing_y = Panel(filter_7)
motorplate_edge_thickness_from_holes_3 = Panel(motorplate_edge_thickness_from_holes)
motorplate_edge_fillet_radius = Panel("2")
motor_plate_attachment_type_2 = Panel(motor_plate_attachment_type)
hole_diamter_for_tapping_2 = Panel(hole_diamter_for_tapping)
hole_diamter_for_slip_fit_2 = Panel(hole_diamter_for_slip_fit)
hex_nut_width_inc_margin_2 = Panel(hex_nut_width_inc_margin)
hex_nut_pocket_depth_3 = Panel(hex_nut_pocket_depth)
item_20 = ListItem(List=pinion_positioned_in_rack_2, Index=0, Wrap=True)
Z_31 = UnitZ(Factor=material_thickness_12)
area_5 = Area(Geometry=item_20)  # -> Area, Centroid
filter_37 = StreamFilter(Gate=motor_plate_attachment_type_2, Stream0=hole_diamter_for_tapping_2, Stream1=hole_diamter_for_slip_fit_2)
filter_38 = StreamFilter(Gate=motor_plate_attachment_type_2, Stream1=hex_nut_width_inc_margin_2)
multiplication_36 = Multiplication(A=adjustment_range_glideblocks, B=".5")
panel_2 = Panel("""4
5
6""")
multiplication_37 = Multiplication(A=flange_hole_diameter_2, B=".5")
pdecon_10 = Deconstruct(Point=area_5.Centroid)  # -> XComponent, YComponent, ZComponent
multiplication_38 = Multiplication(A=hole_diamter_lower_glideblock_3, B=".5")
move_60 = Move(Geometry=planes_for_holes_2, Motion=Z_31)  # -> Geometry, Transform
explode_3 = Explode(Curve=outline_upper_glideblock_2, Recursive=True)  # -> Segments, Vertices
multiplication_39 = Multiplication(A=filter_37, B=".5")
neg_46 = Negative(Value=multiplication_36)
deplane = DeconstructPlane(Plane=planes_for_holes_2)  # -> Origin, XAxis, YAxis, ZAxis
pt_49 = ConstructPoint(
    XCoordinate=pinon_distance_from_axis_edge_3,
    YCoordinate=pdecon_10.YComponent,
    ZCoordinate=clearnace_from_axis_to_axis_plate_4)
xz_6 = XZPlane(Origin=deplane.Origin)
item_21 = ListItem(List=explode_3.Segments, Index=panel_2, Wrap=True)
Y_24 = UnitY(Factor=neg_46)
Y_25 = UnitY(Factor=multiplication_36)
xy_20 = XYPlane(Origin=pt_49)
cir_12 = Circle(Plane=move_60.Geometry, Radius=multiplication_38)
join_8 = JoinCurves(Curves=item_21, Preserve=False)
pinion_center_plane = Plane(xy_20)
multiplication_40 = Multiplication(A=motorplate_mount_spacing_y, B=".5")
pcx = CurvePlane(Curve=cir_12, Plane=xz_6)  # -> Points, ParamsC, ParamsP
multiplication_41 = Multiplication(A=motorplate_mount_spacing_x, B=".5")
pinion_center_plane_2 = Plane(pinion_center_plane)
move_61 = Move(Geometry=join_8, Motion=Z_31)  # -> Geometry, Transform
multiplication_42 = Multiplication(A=motor_mount_hole_spacing, B=".5")
xz_7 = XZPlane(Origin=Point(0, 0, 0))
neg_47 = Negative(Value=multiplication_40)
neg_48 = Negative(Value=multiplication_41)
neg_49 = Negative(Value=multiplication_42)
shatter_2 = Shatter(Curve=graft(cir_12), Parameters=pcx.ParamsC)
mirror_7 = Mirror(Geometry=move_61.Geometry, Plane=xz_7)  # -> Geometry, Transform
deplane_2 = DeconstructPlane(Plane=pinion_center_plane_2)  # -> Origin, XAxis, YAxis, ZAxis
pt_50 = ConstructPoint(XCoordinate=multiplication_42, YCoordinate=multiplication_42, ZCoordinate=0)
pt_51 = ConstructPoint(XCoordinate=multiplication_42, YCoordinate=neg_49, ZCoordinate=0)
pt_52 = ConstructPoint(XCoordinate=neg_49, YCoordinate=multiplication_42, ZCoordinate=0)
pt_53 = ConstructPoint(XCoordinate=neg_49, YCoordinate=neg_49, ZCoordinate=0)
pt_54 = ConstructPoint(XCoordinate=multiplication_41, YCoordinate=neg_47, ZCoordinate=0)
xy_21 = XYPlane(Origin=Point(0, 0, 0))
pt_55 = ConstructPoint(XCoordinate=multiplication_41, YCoordinate=multiplication_40, ZCoordinate=0)
pt_56 = ConstructPoint(XCoordinate=neg_48, YCoordinate=multiplication_40, ZCoordinate=0)
pt_57 = ConstructPoint(XCoordinate=neg_48, YCoordinate=neg_47, ZCoordinate=0)
cir_13 = Circle(Plane=pinion_center_plane_2, Radius=multiplication_37)
xz_8 = XZPlane(Origin=deplane_2.Origin)
end_13 = EndPoints(Curve=move_61.Geometry)  # -> Start, End
end_14 = EndPoints(Curve=mirror_7.Geometry)  # -> Start, End
item_22 = ListItem(List=shatter_2, Index=0, Wrap=True)
item_23 = ListItem(List=shatter_2, Index=1, Wrap=True)
pcx_2 = CurvePlane(Curve=cir_13, Plane=xz_8)  # -> Points, ParamsC, ParamsP
move_62 = Move(Geometry=item_22, Motion=Y_25)  # -> Geometry, Transform
move_63 = Move(Geometry=item_23, Motion=Y_24)  # -> Geometry, Transform
pl_2 = ConstructPlane(Origin=[pt_50, pt_51, pt_52, pt_53], XAxis=Vector(1, 0, 0), YAxis=Vector(0, 1, 0))
ln_7 = Line(StartPoint=end_13.Start, EndPoint=end_14.Start)
ln_8 = Line(StartPoint=end_13.End, EndPoint=end_14.End)
end_15 = EndPoints(Curve=move_62.Geometry)  # -> Start, End
end_16 = EndPoints(Curve=move_63.Geometry)  # -> Start, End
shatter_3 = Shatter(Curve=cir_13, Parameters=pcx_2.ParamsC)
orient_5 = Orient(Geometry=pl_2, Source=xy_21, Target=pinion_center_plane)  # -> Geometry, Transform
join_9 = JoinCurves(Curves=flatten([move_61.Geometry, mirror_7.Geometry, ln_7, ln_8]), Preserve=False)
ln_9 = Line(StartPoint=end_15.End, EndPoint=end_16.Start)
ln_10 = Line(StartPoint=end_15.Start, EndPoint=end_16.End)
item_24 = ListItem(List=shatter_3, Index=0, Wrap=True)
item_25 = ListItem(List=shatter_3, Index=1, Wrap=True)
xy_22 = XYPlane(Origin=Point(0, 0, 0))
join_10 = JoinCurves(Curves=flatten([ln_10, ln_9, move_62.Geometry, move_63.Geometry]), Preserve=False)
move_64 = Move(Geometry=item_24, Motion=Y_17)  # -> Geometry, Transform
move_65 = Move(Geometry=item_25, Motion=Y_16)  # -> Geometry, Transform
bbox_9 = BoundingBox(Content=join_9, Plane=PlaneXY(0, 0, 0))  # -> Box, Box_2
offset_4 = Offset(Curve=join_10, Distance=extra_offset_adjustable_holes_2, Plane=PlaneXY(0, 0, 0), Corners=1)
end_17 = EndPoints(Curve=move_64.Geometry)  # -> Start, End
end_18 = EndPoints(Curve=move_65.Geometry)  # -> Start, End
xz_9 = XZPlane(Origin=Point(0, 0, 0))
debrep_5 = DeconstructBrep(Brep=bbox_9.Box)  # -> Faces, Edges, Vertices
item_26 = ListItem(List=cir_12, Index=0, Wrap=True)
item_27 = ListItem(List=move_60.Geometry, Index=0, Wrap=True)
ln_11 = Line(StartPoint=end_17.End, EndPoint=end_18.Start)
ln_12 = Line(StartPoint=end_17.Start, EndPoint=end_18.End)
item_28 = ListItem(List=debrep_5.Vertices, Index=3, Wrap=True)
mirror_8 = Mirror(Geometry=flatten(offset_4), Plane=xz_9)  # -> Geometry, Transform
xy_23 = XYPlane(Origin=item_28)
join_11 = JoinCurves(Curves=flatten([ln_12, ln_11, move_64.Geometry, move_65.Geometry]), Preserve=False)
fixed_hole = Curve(item_26)
plane = Plane(item_27)
piion_hole = Curve(join_11)
orient_6 = Orient(Geometry=fixed_hole, Source=plane, Target=orient_5.Geometry)  # -> Geometry, Transform
motorplate_edge_fillet_radius_2 = Panel(motorplate_edge_fillet_radius)
motorplate_edge_thickness_from_holes_4 = Panel(motorplate_edge_thickness_from_holes_3)
motor_mount_holes = Curve(orient_6.Geometry)
flange_hole = Curve(cir_13)
material_thickness_13 = Panel(material_thickness_12)
addition_33 = Addition(A=material_thickness_13, B="0.5")
adjustable_glideblock_holes = Curve(mirror_8.Geometry)
fixed_glideblock_holes = Curve(cir_12)
nesting_orientation_plane = Plane(xy_23)
glideblock_holes = Curve(flatten([fixed_glideblock_holes, adjustable_glideblock_holes]))
motor_mount_holes_2 = Curve(motor_mount_holes)
flange_hole_pocket = Curve(flange_hole)
pinion_hole_pocket = Curve(piion_hole)
axis_plate_outline = Curve(join_9)

# ----
item_29 = ListItem(List=shatter_2, Index=0, Wrap=True)
item_30 = ListItem(List=shatter_2, Index=1, Wrap=True)
move_66 = Move(Geometry=item_29, Motion=Y_17)  # -> Geometry, Transform
move_67 = Move(Geometry=item_30, Motion=Y_15)  # -> Geometry, Transform
end_19 = EndPoints(Curve=move_66.Geometry)  # -> Start, End
end_20 = EndPoints(Curve=move_67.Geometry)  # -> Start, End
pl_3 = ConstructPlane(Origin=[pt_55, pt_54], XAxis=X_15, YAxis=Y_18)
pl_4 = ConstructPlane(Origin=[pt_56, pt_57], XAxis=rev, YAxis=Y_19)
ln_13 = Line(StartPoint=end_19.End, EndPoint=end_20.Start)
ln_14 = Line(StartPoint=end_19.Start, EndPoint=end_20.End)
join_12 = JoinCurves(Curves=flatten([ln_14, ln_13, move_66.Geometry, move_67.Geometry]), Preserve=False)
offset_5 = Offset(Curve=join_12, Distance=extra_offset_adjustable_holes_2, Plane=PlaneXY(0, 0, 0), Corners=1)

# ---- group: Make axis plate and motor plate curves (continued)
orient_7 = Orient(Geometry=[pl_3, pl_4], Source=xy_22, Target=pinion_center_plane)  # -> Geometry, Transform
item_31 = ListItem(List=flatten(offset_5), Index=0, Wrap=True)
cir_14 = Circle(Plane=orient_7.Geometry, Radius=multiplication_39)
polygon = Polygon(Plane=orient_7.Geometry, Radius=filter_38, Segments=3, FilletRadius=0)  # -> Polygon, Length
adjustable_hole = Curve(item_31)
orient_8 = Orient(Geometry=adjustable_hole, Source=plane, Target=orient_7.Geometry)  # -> Geometry, Transform
adjustable_mounting_holes = Curve(orient_8.Geometry)
bbox_10 = BoundingBox(Content=adjustable_mounting_holes, Plane=PlaneXY(0, 0, 0), UnionBox=True)  # -> Box, Box_2
debrep_6 = DeconstructBrep(Brep=bbox_10.Box)  # -> Faces, Edges, Vertices
item_32 = ListItem(List=debrep_6.Faces, Index="4", Wrap=True)
edges_5 = BrepEdges(Brep=item_32)  # -> Naked, Interior, NonManifold
join_13 = JoinCurves(Curves=edges_5.Naked, Preserve=False)
offset_6 = Offset(Curve=join_13, Distance=motorplate_edge_thickness_from_holes_4, Plane=PlaneXY(0, 0, 0), Corners=4)
fillet_6 = Fillet(Curve=offset_6, Radius=motorplate_edge_fillet_radius_2)
adjustable_motor_mount_holes = Curve(adjustable_mounting_holes)
motorplate_outline = Curve(fillet_6)
attachment_holes = Curve(cir_14)
hex_nut_pockets = Curve(polygon.Polygon)

# ----
plane_2 = Plane(plane)
fixed_hole_2 = Curve(fixed_hole)
adjustable_hole_2 = Curve(adjustable_hole)
orient_9 = Orient(Geometry=fixed_hole_2, Source=plane_2, Target=xy_14)  # -> Geometry, Transform
orient_10 = Orient(Geometry=adjustable_hole_2, Source=plane_2, Target=xy_14)  # -> Geometry, Transform
rotate_6 = Rotate(Geometry=graft(orient_10.Geometry), Angle=degrees(panel), Plane=gear_center_plane_3)  # -> Geometry, Transform
non_adjustable_holes_axis_plate = Curve(orient_9.Geometry)
adjustable_holes_axis_plate = Curve(flatten(rotate_6.Geometry))

# ---- group: Make axis plate and motor plate curves / Add pocket?
offset_7 = Offset(Curve=motor_mount_holes, Distance=1, Plane=PlaneXY(0, 0, 0), Corners=1)  # disabled

# ----
bbox_11 = BoundingBox(Content=fillet_6, Plane=PlaneXY(0, 0, 0))  # -> Box, Box_2
debrep_7 = DeconstructBrep(Brep=bbox_11.Box)  # -> Faces, Edges, Vertices
item_33 = ListItem(List=debrep_7.Vertices, Index=3, Wrap=True)
xy_24 = XYPlane(Origin=item_33)
nesting_orientation_plane_2 = Plane(xy_24)

# ---- group: Make preview brep fot motor plate
gemotry_output_type_6 = Panel(output_geometry_type)
axis_plate_curves = Curve(flatten([attachment_holes, pinion_hole_pocket, axis_plate_outline, glideblock_holes]))
hex_nut_pockets_2 = Curve(hex_nut_pockets)
material_thickness_14 = Panel(material_thickness_4)
motor_plate_attachment_type_3 = Panel(motor_plate_attachment_type)
Z_32 = UnitZ(Factor=hex_nut_pocket_depth_3)
filter_39 = StreamFilter(Gate=gemotry_output_type_6, Stream1=axis_plate_curves)
Z_33 = UnitZ(Factor=material_thickness_14)
boundary_5 = BoundarySurfaces(Edges=filter_39)
boundary_6 = BoundarySurfaces(Edges=hex_nut_pockets_2)
extr_17 = Extrude(Base=boundary_5, Direction=Z_33)
extr_18 = Extrude(Base=boundary_6, Direction=Z_32)
sdiff_11 = SolidDifference(BrepsA=extr_17, BrepsB=extr_18)
filter_40 = StreamFilter(Gate=motor_plate_attachment_type_3, Stream0=extr_17, Stream1=sdiff_11)
axis_plate_brep = Brep(filter_40)

# ---- group: Nest axis plate
orient_11 = Orient(Geometry=glideblock_holes, Source=nesting_orientation_plane, Target=first_nesting_plane)  # -> Geometry, Transform
orient_12 = Orient(Geometry=hex_nut_pockets, Source=nesting_orientation_plane, Target=first_nesting_plane)  # -> Geometry, Transform
orient_13 = Orient(Geometry=pinion_hole_pocket, Source=nesting_orientation_plane, Target=first_nesting_plane)  # -> Geometry, Transform
orient_14 = Orient(Geometry=attachment_holes, Source=nesting_orientation_plane, Target=first_nesting_plane)  # -> Geometry, Transform
orient_15 = Orient(Geometry=axis_plate_outline, Source=nesting_orientation_plane, Target=first_nesting_plane)  # -> Geometry, Transform
hex_nut_pocket_depth_4 = Panel(hex_nut_pocket_depth_3)
bb_metadata_value = Panel("First")
pinion_pocket_depth = Panel(addition_33)
bb_metadata_key = Panel("Order")
glideblock_holes_2 = Curve(flatten(orient_11.Geometry))
pinion_hole_pocket_2 = Curve(orient_13.Geometry)
attachment_holes_2 = Curve(orient_14.Geometry)
axis_plate_outline_2 = Curve(orient_15.Geometry)
hex_nut_pockets_3 = Curve(orient_12.Geometry)

# ---- group: Nest motor plate
orient_16 = Orient(Geometry=adjustable_motor_mount_holes, Source=nesting_orientation_plane_2, Target=second_nesting_plane)  # -> Geometry, Transform
orient_17 = Orient(Geometry=flange_hole_pocket, Source=nesting_orientation_plane_2, Target=second_nesting_plane)  # -> Geometry, Transform
orient_18 = Orient(Geometry=motor_mount_holes_2, Source=nesting_orientation_plane_2, Target=second_nesting_plane)  # -> Geometry, Transform
orient_19 = Orient(Geometry=motorplate_outline, Source=nesting_orientation_plane_2, Target=second_nesting_plane)  # -> Geometry, Transform
adjustable_motor_mount_holes_2 = Curve(orient_16.Geometry)
motor_mount_holes_3 = Curve(orient_18.Geometry)
flange_hole_pocket_2 = Curve(orient_17.Geometry)
motorplate_outline_2 = Curve(orient_19.Geometry)

# ----
axis_and_motor_plate_curves = Curve([glideblock_holes_2, hex_nut_pockets_3, pinion_hole_pocket_2, attachment_holes_2, axis_plate_outline_2, adjustable_motor_mount_holes_2, flange_hole_pocket_2, motor_mount_holes_3, motorplate_outline_2])
filter_41 = StreamFilter(Gate=gemotry_output_type_4, Stream0=flatten(axis_and_motor_plate_curves))

# ---- group: Make axis plate and motor plate (continued)
non_adjustable_holes_axis_plate_2 = Curve(non_adjustable_holes_axis_plate)
adjustable_holes_axis_plate_2 = Curve(flatten(adjustable_holes_axis_plate))
adjustable_motor_mount_holes_3 = Curve(adjustable_motor_mount_holes)
motor_mount_holes_4 = Curve(motor_mount_holes_2)
motorplate_outline_3 = Curve(motorplate_outline)
hex_nut_pockets_4 = Curve(hex_nut_pockets)
pinion_hole_pocket_3 = Curve(pinion_hole_pocket)
attachment_holes_3 = Curve(attachment_holes)
flange_hole_pocket_3 = Curve(flange_hole_pocket)
area_6 = Area(Geometry=flange_hole_pocket_3)  # -> Area, Centroid
xy_25 = XYPlane(Origin=area_6.Centroid)
orient_20 = Orient(Geometry=adjustable_motor_mount_holes_3, Source=xy_25, Target=xy_18)  # -> Geometry, Transform
orient_21 = Orient(Geometry=motor_mount_holes_4, Source=xy_25, Target=xy_18)  # -> Geometry, Transform
orient_22 = Orient(Geometry=flange_hole_pocket_3, Source=xy_25, Target=xy_18)  # -> Geometry, Transform
move_68 = Move(Geometry=non_adjustable_holes_axis_plate_2, Motion=Z_26)  # -> Geometry, Transform
move_69 = Move(Geometry=adjustable_holes_axis_plate_2, Motion=Z_26)  # -> Geometry, Transform
orient_23 = Orient(Geometry=hex_nut_pockets_4, Source=xy_25, Target=xy_18)  # -> Geometry, Transform
move_70 = Move(Geometry=orient_20.Geometry, Motion=Y_23)  # -> Geometry, Transform
orient_24 = Orient(Geometry=pinion_hole_pocket_3, Source=xy_25, Target=xy_18)  # -> Geometry, Transform
orient_25 = Orient(Geometry=attachment_holes_3, Source=xy_25, Target=xy_18)  # -> Geometry, Transform
cp = ControlPoints(Curve=move_70.Geometry)  # -> Points, Weights, Knots
cp_2 = ControlPoints(Curve=[orient_22.Geometry, orient_21.Geometry])  # -> Points, Weights, Knots
hull = ConvexHull(Points=flatten(cp.Points), Plane=PlaneXY(0, 0, 0))  # -> Hull, HullZ, Indices
hull_2 = ConvexHull(Points=flatten(cp_2.Points), Plane=PlaneXY(0, 0, 0))  # -> Hull, HullZ, Indices
offset_8 = Offset(Curve=hull_2.HullZ, Distance=motorplate_edge_thickness_from_holes_2, Plane=PlaneXY(0, 0, 0), Corners=4)
offset_9 = Offset(Curve=hull.HullZ, Distance=motorplate_edge_thickness_from_holes_2, Plane=PlaneXY(0, 0, 0), Corners=4)
runion_2 = RegionUnion(Curves=[offset_8, offset_9])
fillet_7 = Fillet(Curve=runion_2, Radius=glide_block_fillet_radius_2)
boundary_7 = BoundarySurfaces(Edges=flatten([fillet_7, orient_21.Geometry, orient_22.Geometry, move_70.Geometry]))
extr_19 = Extrude(Base=boundary_7, Direction=Z_29)
move_71 = Move(Geometry=extr_19, Motion=Z_29)  # -> Geometry, Transform
filter_42 = StreamFilter(Gate=axist_type_is_rotary_6, Stream1=move_71.Geometry)
rotary_motor_plate_brep = Brep(filter_42)

# ----
move_72 = Move(Geometry=orient_25.Geometry, Motion=Y_23)  # -> Geometry, Transform
move_73 = Move(Geometry=orient_23.Geometry, Motion=Y_23)  # -> Geometry, Transform

# ---- group: Make axis plate and motor plate (continued)
filter_43 = StreamFilter(
    Gate=geometry_output_type_3,
    Stream1=flatten([cir_11, orient_24.Geometry, move_68.Geometry, move_69.Geometry, move_72.Geometry]))
boundary_8 = BoundarySurfaces(Edges=filter_43)
boundary_9 = BoundarySurfaces(Edges=move_73.Geometry)
extr_20 = Extrude(Base=boundary_8, Direction=Z_28)
extr_21 = Extrude(Base=boundary_9, Direction=Z_30)
item_34 = ListItem(List=flatten(extr_21), Index=0, Wrap=True)
sdiff_12 = SolidDifference(BrepsA=extr_20, BrepsB=extr_21)
null_2 = NullItem(Item=item_34)  # -> NullFlags, InvalidFlags, Description
filter_44 = StreamFilter(Gate=null_2.NullFlags, Stream0=sdiff_12, Stream1=extr_20)
filter_45 = StreamFilter(Gate=axist_type_is_rotary_6, Stream1=filter_44)
rotary_axis_plate_brep = Brep(filter_45)

# ---- group: 3D rotary axis
rotary_axis_preview_brep_2 = Brep(rotary_axis_preview_brep)
rotary_glideblock_breps_2 = Brep(rotary_glideblock_breps)
rotary_motor_plate_brep_2 = Brep(rotary_motor_plate_brep)
rotary_axis_plate_brep_2 = Brep(rotary_axis_plate_brep)

# ---- group: Nest 2D parts
dogbone_pocket_2 = Curve(dogbone_pocket)
upper_glideblock_plane_4 = Plane(upper_glideblock_plane)
holes_upper_glideblock_2 = Curve(cir_5)
chamfer_pad_pocket_2 = Curve(chamfer_pad_pocket)
outline_upper_glideblock_3 = Curve(outline_upper_glideblock)
lower_glideblock_plane_4 = Plane(lower_glideblock_plane)
holes_lower_glide_block = Circle(cir_6)
clearance_pocket_2 = Curve(clearance_pocket)
chamfer_line_2 = Curve(chamfer_line)
glideblock_chamfer_surface_2 = Surface(glideblock_chamfer_surface)
outline_lower_glideblock_2 = Curve(outline_lower_glideblock)
xy_26 = XYPlane(Origin=Point(0, 0, 0))
project_10 = Project(Geometry=outline_upper_glideblock_3, Plane=xy_26)  # -> Geometry, Transform
bbox_12 = BoundingBox(Content=project_10.Geometry, Plane=xy_26, UnionBox=False)  # -> Box, Box_2
dim_3 = Dimensions(Surface=bbox_12.Box)  # -> UDimension, VDimension
clearence_pocket_depth = Panel(pocket_depth)
chamfer_engrave_depth_2 = Panel(chamfer_engrave_depth)
dogbone_pocket_depths = Panel(pocket_depth_3)
chamfer_pad_pocket_depths = Panel(pocket_depth_2)

# ----
project_11 = Project(Geometry=outline_lower_glideblock_2, Plane=xy_6)  # -> Geometry, Transform

# ---- group: Prep nesting planes
nesting_margin_axis_and_glideblocks = Panel("30")
axis_length_6 = Panel(axis_length)
extra_clearance_2 = Panel("0.5")
axis_width_4 = Panel(axis_width)
milling_bit_diamter_for_clearing_flat_pa_4 = Panel(milling_bit_diamter_for_clearing_flat_pa)  # "Milling bit diamter for clearing flat pad slot"
addition_34 = Addition(A=milling_bit_diamter_for_clearing_flat_pa_4, B=extra_clearance_2)
addition_35 = Addition(A=axis_length_6, B=nesting_margin_axis_and_glideblocks)
multiplication_43 = Multiplication(A=axis_width_4, B="0.5")
multiplication_44 = Multiplication(A=addition_34, B="0.5")
addition_36 = Addition(A=multiplication_43, B=addition_34)  # disabled
addition_37 = Addition(A=multiplication_44, B=dim_3.VDimension)
neg_50 = Negative(Value=addition_36)  # disabled
neg_51 = Negative(Value=addition_37)
pt_58 = ConstructPoint(XCoordinate=addition_35, YCoordinate=multiplication_43, ZCoordinate=0)
Y_26 = UnitY(Factor=neg_51)
xy_27 = XYPlane(Origin=pt_58)
first_nesting_plane_2 = Plane(xy_27)

# ---- group: Nest 2D parts (continued)
bbox_13 = BoundingBox(Content=project_11.Geometry, Plane=PlaneXY(0, 0, 0))  # -> Box, Box_2
dim_4 = Dimensions(Surface=bbox_13.Box)  # -> UDimension, VDimension
first_nesting_plane_3 = Plane(first_nesting_plane_2)
orient_26 = Orient(Geometry=holes_lower_glide_block, Source=lower_glideblock_plane_4, Target=first_nesting_plane_3)  # -> Geometry, Transform
orient_27 = Orient(Geometry=clearance_pocket_2, Source=lower_glideblock_plane_4, Target=first_nesting_plane_3)  # -> Geometry, Transform
orient_28 = Orient(Geometry=chamfer_line_2, Source=lower_glideblock_plane_4, Target=first_nesting_plane_3)  # -> Geometry, Transform
orient_29 = Orient(Geometry=glideblock_chamfer_surface_2, Source=lower_glideblock_plane_4, Target=first_nesting_plane_3)  # -> Geometry, Transform
orient_30 = Orient(Geometry=outline_lower_glideblock_2, Source=lower_glideblock_plane_4, Target=first_nesting_plane_3)  # -> Geometry, Transform
eval_4 = EvaluateLength(Curve=orient_28.Geometry, Length="0.5", Normalized=True)  # -> Point, Tangent, Parameter
yz_4 = YZPlane(Origin=eval_4.Point)
mirror_9 = Mirror(Geometry=orient_28.Geometry, Plane=yz_4)  # -> Geometry, Transform
mirror_10 = Mirror(Geometry=orient_29.Geometry, Plane=yz_4)  # -> Geometry, Transform

# ---- group: Prep nesting planes (continued)
addition_38 = Addition(A=multiplication_44, B=dim_4.VDimension)
multiplication_45 = Multiplication(A=addition_38, B="2")
neg_52 = Negative(Value=addition_38)
addition_39 = Addition(A=multiplication_45, B=addition_34)
Y_27 = UnitY(Factor=neg_52)
neg_53 = Negative(Value=addition_39)
move_74 = Move(Geometry=pt_58, Motion=Y_27)  # -> Geometry, Transform
Y_28 = UnitY(Factor=neg_53)
xz_10 = XZPlane(Origin=move_74.Geometry)
move_75 = Move(Geometry=pt_58, Motion=Y_28)  # -> Geometry, Transform
move_76 = Move(Geometry=move_75.Geometry, Motion=Y_26)  # -> Geometry, Transform
xz_11 = XZPlane(Origin=move_76.Geometry)
first_mirror_plane = Plane(xz_10)
second_nesting_plane_2 = Plane(move_75.Geometry)
seond_mirror_plane = Plane(xz_11)

# ---- group: Nest 2D parts (continued)
second_nesting_plane_3 = Plane(second_nesting_plane_2)
orient_31 = Orient(Geometry=holes_upper_glideblock_2, Source=upper_glideblock_plane_4, Target=second_nesting_plane_3)  # -> Geometry, Transform
orient_32 = Orient(Geometry=dogbone_pocket_2, Source=upper_glideblock_plane_4, Target=second_nesting_plane_3)  # -> Geometry, Transform
orient_33 = Orient(Geometry=chamfer_pad_pocket_2, Source=upper_glideblock_plane_4, Target=second_nesting_plane_3)  # -> Geometry, Transform
orient_34 = Orient(Geometry=outline_upper_glideblock_3, Source=upper_glideblock_plane_4, Target=second_nesting_plane_3)  # -> Geometry, Transform
mirror_11 = Mirror(Geometry=orient_32.Geometry, Plane=seond_mirror_plane)  # -> Geometry, Transform
mirror_12 = Mirror(Geometry=orient_31.Geometry, Plane=seond_mirror_plane)  # -> Geometry, Transform
mirror_13 = Mirror(Geometry=orient_33.Geometry, Plane=seond_mirror_plane)  # -> Geometry, Transform
mirror_14 = Mirror(Geometry=orient_34.Geometry, Plane=seond_mirror_plane)  # -> Geometry, Transform
mirror_15 = Mirror(Geometry=orient_26.Geometry, Plane=first_mirror_plane)  # -> Geometry, Transform
mirror_16 = Mirror(Geometry=orient_30.Geometry, Plane=first_mirror_plane)  # -> Geometry, Transform
mirror_17 = Mirror(Geometry=orient_27.Geometry, Plane=first_mirror_plane)  # -> Geometry, Transform
mirror_18 = Mirror(Geometry=mirror_10.Geometry, Plane=first_mirror_plane)  # -> Geometry, Transform
mirror_19 = Mirror(Geometry=mirror_9.Geometry, Plane=first_mirror_plane)  # -> Geometry, Transform
merge_9 = Merge(Data1=orient_30.Geometry, Data2=mirror_16.Geometry, Data3=orient_34.Geometry, Data4=mirror_14.Geometry)
merge_10 = Merge(Data1=orient_26.Geometry, Data2=mirror_15.Geometry, Data3=orient_31.Geometry, Data4=mirror_12.Geometry)
glideblock_holes_3 = Curve(merge_10)
clearance_pockets = Curve(flatten([orient_27.Geometry, mirror_17.Geometry]))
chamfer_lines = Curve(flatten([orient_28.Geometry, mirror_19.Geometry]))
glideblock_chamfer_surfaces = Surface(flatten([orient_29.Geometry, mirror_18.Geometry]))
dogbone_pockets = Curve([orient_32.Geometry, mirror_11.Geometry])
chamfer_pad_pockets = Curve([orient_33.Geometry, mirror_13.Geometry])
glideblock_outlines = Curve(flatten(merge_9))

# ----
glideblock_chamfer_surface_3 = Surface(glideblock_chamfer_surfaces)
chamfer_lines_2 = Curve(chamfer_lines)

# ---- group: Select chamfer type
chamfer_geometry_for_2d_3 = Panel(chamfer_geometry_for_2d)
filter_46 = StreamFilter(Gate=chamfer_geometry_for_2d_3, Stream0=chamfer_lines_2, Stream1=glideblock_chamfer_surface_3)

# ----
glideblock_holes_4 = Curve(glideblock_holes_3)
chamfer_pad_pockets_2 = Curve(chamfer_pad_pockets)
clearance_pockets_2 = Curve(clearance_pockets)
dogbone_pockets_2 = Curve(dogbone_pockets)
glideblock_outlines_2 = Curve(glideblock_outlines)
merge_11 = Merge(
    Data1=glideblock_holes_4,
    Data2=clearance_pockets_2,
    Data3=filter_46,
    Data4=dogbone_pockets_2,
    Data5=chamfer_pad_pockets_2,
    Data6=glideblock_outlines_2)
filter_47 = StreamFilter(Gate=gemotry_output_type_4, Stream0=flatten(merge_11))

# ---- group: 2D
rack_pocket_extended_2 = Curve(flatten(rack_pocket_extended))
screw_holes_center_3 = Curve(flatten(gate_5.Target0))
screw_pockets_center_3 = Curve(flatten(gate.Target0))
pinion_3 = Curve(flatten(filter_33))
chamfer_geometry = Geometry(flatten(filter_36))
axis_outline_2 = Curve(flatten(gate_6.Target0))
screw_holes_edges_3 = Curve(flatten(gate_3.Target0))
screw_pockets_edges_3 = Curve(flatten(gate_4.Target0))
glideblock_geometry = Geometry(filter_47)
axis_and_motor_plate_geometry = Geometry(filter_41)

# ---- group: Make preview brep fot motor plate
gemotry_output_type_7 = Panel(output_geometry_type)
motor_plate_curves = Curve(flatten([motorplate_outline, adjustable_motor_mount_holes, motor_mount_holes_2, flange_hole_pocket]))
material_thickness_15 = Panel(material_thickness_4)
filter_48 = StreamFilter(Gate=gemotry_output_type_7, Stream1=motor_plate_curves)
Z_34 = UnitZ(Factor=material_thickness_15)
move_77 = Move(Geometry=filter_48, Motion=Z_34)  # -> Geometry, Transform

# ----
boundary_10 = BoundarySurfaces(Edges=move_77.Geometry)

# ---- group: Make preview brep fot motor plate (continued)
extr_22 = Extrude(Base=boundary_10, Direction=Z_34)
motor_plate_brep = Brep(extr_22)

# ---- group: Make axis plate and motor plate (continued)
motor_plate_brep_2 = Brep(motor_plate_brep)
orient_35 = Orient(Geometry=motor_plate_brep_2, Source=xy_25, Target=xy_18)  # -> Geometry, Transform

# ---- group: 3D linear axis
motor_plate_brep_3 = Brep(motor_plate_brep)
axis_plate_brep_2 = Brep(axis_plate_brep)
glideblock_breps_2 = Brep(glideblock_breps)
axis_brep_2 = Brep(axis_brep)

# ----
filter_49 = StreamFilter(Gate=axist_type_is_rotary_5, Stream0=[glideblock_breps_2, axis_plate_brep_2, motor_plate_brep_3])
axis_geometry_for_baking = Geometry([pinion_3, rack_pocket_extended_2, axis_outline_2, screw_holes_edges_3, screw_pockets_edges_3, screw_holes_center_3, screw_pockets_center_3, axis_brep_2, chamfer_geometry, pinion_brep, filter_49, glideblock_geometry, axis_and_motor_plate_geometry, rotary_axis_plate_brep_2, rotary_motor_plate_brep_2, rotary_glideblock_breps_2, rotary_axis_preview_brep_2])

# ---- group: Right click and choose "Bake" to save to Rhino
axis_geometry = Geometry(axis_geometry_for_baking)

# ---- group: Make nice looking preview
material = CreateMaterial(
    Diffuse=ColourSwatch(SwatchColor=RGB(82, 82, 82)),
    Specular=RGB(255, 255, 255),
    Emission=RGB(0, 0, 0),
    Transparency=Slider(0.2, range=0..1),
    Shine=0)
wires_3 = BrepWireframe(Brep=axis_geometry_for_baking, Density=-1)
preview = CustomPreview(Geometry=wires_3, Shader=ColourSwatch(SwatchColor=RGB(0, 0, 0)))
preview_2 = CustomPreview(Geometry=axis_geometry_for_baking, Shader=material)

# ==== cluster RollerRackAndPinionMaker: Makes rack and pinion gemetry suitable for 3 axis CNC milling. Has low backlash, but is vulnerable to contamination. More options inside component.
pinion_tooth_spacing_factor = ClusterInput()
number_of_pinion_teeth = ClusterInput()
motor_shaft_diameter = ClusterInput()
milling_bit_diameter = ClusterInput()
rack_length = ClusterInput()
tooth_fillet_ratio = ClusterInput()

# ---- group: Determines the travel distance of pinion
rack_length_2 = Panel("200")
rack_length_3 = Number(rack_length)
null = NullItem(Item=rack_length_3)  # -> NullFlags, InvalidFlags, Description
filter = StreamFilter(Gate=null.NullFlags, Stream0=rack_length_3, Stream1=rack_length_2)
rack_length_4 = Panel(filter)

# ---- group: Smaller amount of teeth gives higher resolution and more torque
number_of_pinion_teeth_2 = Panel("9")
number_of_pinion_teeth_3 = Number(number_of_pinion_teeth)
# default config for nema 23 and nema 17 stepper motors - january 2017: bit diamter: 2.8
# pinion tooth spacing factor: -0.1071428
# (gives optimal pinion size and 5mm rack tooth spacing)
# number of pinion teeth: 9
# fillet ratio: 0.2
# earlier config for 2mm pinion milling and 3mm rack milling - august 2016: bit diamter: 3.1
# pinion tooth spacing factor: -0.14
# number of pinion teeth: 10
# fillet ratio: 0.15
null_2 = NullItem(Item=number_of_pinion_teeth_3)  # -> NullFlags, InvalidFlags, Description
filter_2 = StreamFilter(Gate=null_2.NullFlags, Stream0=number_of_pinion_teeth_3, Stream1=number_of_pinion_teeth_2)
number_of_pinion_teeth_4 = Panel(filter_2)

# ---- group: Determines the tooth spacing, some margin recommended
milling_bit_diameter_2 = Panel("2.8")
milling_bit_diameter_3 = Number(milling_bit_diameter)
null_3 = NullItem(Item=milling_bit_diameter_3)  # -> NullFlags, InvalidFlags, Description
filter_3 = StreamFilter(Gate=null_3.NullFlags, Stream0=milling_bit_diameter_3, Stream1=milling_bit_diameter_2)
milling_bit_diameter_4 = Panel(filter_3)

# ---- group: Can be used to reduce or increase the pinion tooth spacing
pinion_tooth_spacing_factor_2 = Panel("-0.1071428")
pinion_tooth_spacing_factor_3 = Number(pinion_tooth_spacing_factor)
null_4 = NullItem(Item=pinion_tooth_spacing_factor_3)  # -> NullFlags, InvalidFlags, Description
filter_4 = StreamFilter(Gate=null_4.NullFlags, Stream0=pinion_tooth_spacing_factor_3, Stream1=pinion_tooth_spacing_factor_2)
pinion_tooth_spacing_factor_4 = Panel(filter_4)

# ---- group: The shaft diameter of the motor driving the pinion
motor_shaft_diameter_2 = Panel("8")
motor_shaft_diameter_3 = Number(motor_shaft_diameter)
null_5 = NullItem(Item=motor_shaft_diameter_3)  # -> NullFlags, InvalidFlags, Description
filter_5 = StreamFilter(Gate=null_5.NullFlags, Stream0=motor_shaft_diameter_3, Stream1=motor_shaft_diameter_2)
motor_shaft_diameter_4 = Panel(filter_5)

# ---- group: Low fillet ratio gives smoother motion, but makes a less robust pinion
tooth_fillet_ratio_2 = Panel("0.2")
tooth_fillet_ratio_3 = Number(tooth_fillet_ratio)
null_6 = NullItem(Item=tooth_fillet_ratio_3)  # -> NullFlags, InvalidFlags, Description
filter_6 = StreamFilter(Gate=null_6.NullFlags, Stream0=tooth_fillet_ratio_3, Stream1=tooth_fillet_ratio_2)
tooth_fillet_ratio_4 = Panel(filter_6)

# ----
preview_position_0_1 = ClusterInput()
preview_position = Slider(0.25, range=0..1)

# ---- group: Controlls pinion tooth blending
rounding_factor_pinion_outside = Slider(20, range=0..100)
rounding_factor_pinion_inside = Slider(70, range=0..100)

# ---- group: Start numbers to help calculte pinion tooth path through rack
number_of_curve_sample_points = Slider(12, range=0..1000)
sample_tooth_position = Panel("0.26")

# ---- group: Lower number gives more clearene between rack tooth and pinion valley
pinion_corner_tolerance_factor = Panel("15")

# ---- group: Fill in for correct step statistics
number_of_stepper_motor_steps = Panel("200")
microstep_level = Panel("4")

# ----
preview_position_0_1_2 = Number(preview_position_0_1)

# ---- group: Prepare properties
multiplication = Multiplication(A=milling_bit_diameter_4, B=pinion_tooth_spacing_factor_4)
multiplication_2 = Multiplication(A=number_of_pinion_teeth_4, B=sample_tooth_position)
division = Division(A=milling_bit_diameter_4, B=pinion_corner_tolerance_factor)
addition = Addition(A=milling_bit_diameter_4, B=multiplication)
multiplication_3 = Multiplication(A=milling_bit_diameter_4, B="0.5")
multiplication_4 = Multiplication(A=motor_shaft_diameter_4, B="0.5")
round = Round(Number=multiplication_2)  # -> Nearest, Floor, Ceiling
multiplication_5 = Multiplication(A=number_of_pinion_teeth_4, B="2")
neg = Negative(Value=division)
multiplication_6 = Multiplication(A=milling_bit_diameter_4, B=tooth_fillet_ratio_4)
milling_bit_radius = Panel(multiplication_3)
xy = XYPlane(Origin=Point(0, 0, 0))
sample_tooth_number = Panel(round.Ceiling)
multiplication_7 = Multiplication(A=addition, B=multiplication_5)
tooth_fillet_radius = Panel(multiplication_6)
pinion_circumference = Panel(multiplication_7)
cir = Circle(Plane=xy, Radius=milling_bit_radius)
pi = Pi(Factor=1)
division_2 = Division(A=pinion_circumference, B=pi)
number_of_pinion_teeth_5 = Panel(number_of_pinion_teeth_4)
pinion_diameter = Panel(division_2)
sample_tooth_number_2 = Panel(sample_tooth_number)
number_of_curve_sample_points_2 = Panel(number_of_curve_sample_points)
multiplication_8 = Multiplication(A=pinion_diameter, B="0.5")
division_3 = Division(A=sample_tooth_number_2, B=number_of_pinion_teeth_5)
pinion_radius = Panel(multiplication_8)
pinion_circumference_2 = Panel(pinion_circumference)
multiplication_9 = Multiplication(A="360", B=division_3)
Y = UnitY(Factor=pinion_radius)
division_4 = Division(A="360", B=number_of_pinion_teeth_5)
division_5 = Division(A=multiplication_9, B=number_of_curve_sample_points_2)
multiplication_10 = Multiplication(A=pinion_circumference_2, B=division_3)
division_6 = Division(A=pinion_circumference, B=number_of_pinion_teeth_4)
move = Move(Geometry=xy, Motion=Y)  # -> Geometry, Transform
series = Series(Start=0, Step=division_4, Count=number_of_pinion_teeth_5)
division_7 = Division(A=multiplication_10, B=number_of_curve_sample_points_2)
series_2 = Series(Start=0, Step=division_5, Count=number_of_curve_sample_points_2)
tooth_spacing = Panel(division_6)
rad = Radians(Degrees=series)
circle = Circle(cir)
series_3 = Series(Start=0, Step=division_7, Count=number_of_curve_sample_points_2)
neg_2 = Negative(Value=series_2)
rad_2 = Radians(Degrees=neg_2)
rotate = Rotate(Geometry=circle, Angle=rad, Plane=move.Geometry)  # -> Geometry, Transform

# ---- group: Make step resolution statisitics
number_of_stepper_motor_steps_2 = Panel(number_of_stepper_motor_steps)
microstep_level_2 = Panel(microstep_level)
division_8 = Division(A=pinion_circumference, B=number_of_stepper_motor_steps_2)
distance_covered_per_step = Panel(division_8)
division_9 = Division(A=distance_covered_per_step, B=microstep_level_2)
distance_covered_per_micro_step = Panel(division_9)

# ---- group: Step statsistics
distance_covered_per_step_2 = Panel(distance_covered_per_step)
distance_covered_per_micro_step_2 = Panel(distance_covered_per_micro_step)

# ---- group: Create rack tooth geometry
sample_tooth_number_3 = Panel(sample_tooth_number_2)
tooth_spacing_2 = Panel(tooth_spacing)
item = ListItem(List=rotate.Geometry, Index=sample_tooth_number_3, Wrap=True)
rotate_2 = Rotate(Geometry=graft(item), Angle=rad_2, Plane=move.Geometry)  # -> Geometry, Transform
tooth_spacing_3 = Panel(tooth_spacing)
X = UnitX(Factor=series_3)
sample_tooth_number_4 = Panel(sample_tooth_number_3)
milling_it_radius = Panel(multiplication_3)
subtraction = Subtraction(A=sample_tooth_number_3, B="0.5")
move_2 = Move(Geometry=rotate_2.Geometry, Motion=X)  # -> Geometry, Transform
multiplication_11 = Multiplication(A=sample_tooth_number_4, B=tooth_spacing_3)
area = Area(Geometry=move_2.Geometry)  # -> Area, Centroid
pt = ConstructPoint(XCoordinate=multiplication_11, YCoordinate=0, ZCoordinate=0)
multiplication_12 = Multiplication(A=subtraction, B=tooth_spacing_2)
multiplication_13 = Multiplication(A=sample_tooth_number_3, B=tooth_spacing_2)
deplane = DeconstructPlane(Plane=xy)  # -> Origin, XAxis, YAxis, ZAxis
merge = Merge(Data1=flatten(area.Centroid), Data2=flatten(pt))
amp = Amplitude(Vector=deplane.YAxis, Amplitude=milling_it_radius)
amp_2 = Amplitude(Vector=deplane.XAxis, Amplitude=multiplication_12)
amp_3 = Amplitude(Vector=deplane.XAxis, Amplitude=multiplication_13)
intcrv = Interpolate(Vertices=merge, Degree=3, Periodic=False, KnotStyle=1)  # -> Curve, Length, Domain
rev = Reverse(Vector=amp)
move_3 = Move(Geometry=deplane.Origin, Motion=amp_2)  # -> Geometry, Transform
move_4 = Move(Geometry=deplane.Origin, Motion=amp_3)  # -> Geometry, Transform
move_5 = Move(Geometry=move_3.Geometry, Motion=rev)  # -> Geometry, Transform
yz = YZPlane(Origin=move_5.Geometry)
crv = Curve(intcrv.Curve)
mirror = Mirror(Geometry=crv, Plane=yz)  # -> Geometry, Transform
ccx = CurveCurve(CurveA=crv, CurveB=mirror.Geometry)  # -> Points, ParamsA, ParamsB
shatter = Shatter(Curve=crv, Parameters=ccx.ParamsA)
rev_2 = ReverseList(List=shatter)
milling_it_radius_2 = Panel(milling_it_radius)
tooth_fillet_radius_2 = Panel(tooth_fillet_radius)
item_2 = ListItem(List=rev_2, Index=0, Wrap=True)
mirror_2 = Mirror(Geometry=item_2, Plane=yz)  # -> Geometry, Transform
pt_2 = Point(move_4.Geometry)
pt_3 = Point(deplane.Origin)
addition_2 = Addition(A=tooth_fillet_radius_2, B=milling_it_radius_2)
join = JoinCurves(Curves=[item_2, mirror_2.Geometry], Preserve=False)
vec2pt = Vector2Pt(PointA=pt_2, PointB=pt_3, Unitize=False)  # -> Vector, Length
fillet = Fillet(Curve=join, Radius=addition_2)
move_6 = Move(Geometry=fillet, Motion=vec2pt.Vector)  # -> Geometry, Transform

# ---- group: Offset tooth profile to prepare for copying
tooth_spacing_4 = Panel(tooth_spacing)
milling_it_radius_3 = Panel(milling_it_radius)
tooth_profile_for_offset = Curve(move_6.Geometry)
xy_2 = XYPlane(Origin=Point(0, 0, 0))
neg_3 = Negative(Value=tooth_spacing_4)
X_2 = UnitX(Factor=tooth_spacing_4)
X_3 = UnitX(Factor=neg_3)
move_7 = Move(Geometry=tooth_profile_for_offset, Motion=X_2)  # -> Geometry, Transform
move_8 = Move(Geometry=tooth_profile_for_offset, Motion=X_3)  # -> Geometry, Transform
end = EndPoints(Curve=tooth_profile_for_offset)  # -> Start, End
join_2 = JoinCurves(Curves=flatten([move_8.Geometry, tooth_profile_for_offset, move_7.Geometry]), Preserve=False)
yz_2 = YZPlane(Origin=[end.Start, end.End])
offset = Offset(Curve=join_2, Distance=milling_it_radius_3, Plane=xy_2, Corners=2)
pcx = CurvePlane(Curve=offset, Plane=yz_2)  # -> Points, ParamsC, ParamsP
shatter_2 = Shatter(Curve=offset, Parameters=flatten(pcx.ParamsC))
item_3 = ListItem(List=shatter_2, Index="1", Wrap=True)
offset_tooth_for_copy_and_join = Curve(item_3)

# ----
distance_covered_per_step_3 = Panel(distance_covered_per_step)
division_10 = Division(A="1", B=distance_covered_per_step_3)
steps_per_mm = Number(division_10)
steps_per_mm_2 = ClusterOutput(steps_per_mm)

# ---- group: Create and blend pinion teeth
eval = EvaluateLength(Curve=fillet, Length="0.5", Normalized=True)  # -> Point, Tangent, Parameter
pdecon = Deconstruct(Point=eval.Point)  # -> XComponent, YComponent, ZComponent
milling_it_radius_4 = Panel(milling_bit_radius)
pinion_corner_tolerance = Panel(neg)
subtraction_2 = Subtraction(A=pdecon.YComponent, B=milling_it_radius_4)
subtraction_3 = Subtraction(A=subtraction_2, B=milling_it_radius_4)
subtraction_4 = Subtraction(A=subtraction_3, B=pinion_corner_tolerance)
pt_4 = ConstructPoint(XCoordinate=0, YCoordinate=subtraction_4, ZCoordinate=0)
rounding_factor_pinion_outside_2 = Panel(rounding_factor_pinion_outside)
xy_3 = XYPlane(Origin=pt_4)
division_11 = Division(A="360", B=multiplication_5)
rounding_factor_pinion_inside_2 = Panel(rounding_factor_pinion_inside)
subtraction_5 = Subtraction(A="0", B=rounding_factor_pinion_outside_2)
addition_3 = Addition(A="180", B=rounding_factor_pinion_outside_2)
rad_3 = Radians(Degrees=addition_3)
rad_4 = Radians(Degrees=subtraction_5)
subtraction_6 = Subtraction(A="180", B=rounding_factor_pinion_inside_2)
addition_4 = Addition(A="0", B=rounding_factor_pinion_inside_2)
milling_it_radius_5 = Panel(milling_it_radius_4)
dom = ConstructDomain(DomainStart=rad_4, DomainEnd=rad_3)
xy_4 = XYPlane(Origin=Point(0, 0, 0))
rad_5 = Radians(Degrees=subtraction_6)
rad_6 = Radians(Degrees=addition_4)
dom_2 = ConstructDomain(DomainStart=rad_6, DomainEnd=rad_5)
pi_2 = Pi(Factor=1)
arc = Arc(Plane=xy_4, Radius=milling_it_radius_5, Angle=dom)  # -> Arc, Length
arc_2 = Arc(Plane=xy_3, Radius=milling_it_radius_5, Angle=dom_2)  # -> Arc, Length
rad_7 = Radians(Degrees=division_11)
rotate_3 = Rotate(Geometry=arc.Arc, Angle=pi_2, Plane=xy_4)  # -> Geometry, Transform
addition_5 = Addition(A=rad, B=rad_7)
number_slider = Slider(0.5, range=0..1)
rotate_4 = Rotate(Geometry=rotate_3.Geometry, Angle=rad, Plane=move.Geometry)  # -> Geometry, Transform
rotate_5 = Rotate(Geometry=arc_2.Arc, Angle=addition_5, Plane=move.Geometry)  # -> Geometry, Transform
flip = FlipCurve(Curve=rotate_4.Geometry)  # -> Curve, Flag
flip_2 = FlipCurve(Curve=rotate_5.Geometry)  # -> Curve, Flag
pinion_radius_2 = Panel(pinion_radius)
shift = ShiftList(List=flip.Curve, Shift=1, Wrap=True)
blendc = BlendCurve(CurveA=rotate_4.Geometry, CurveB=flip_2.Curve, BulgeA=number_slider, BulgeB=number_slider, Continuity=2)
blendc_2 = BlendCurve(CurveA=shift, CurveB=rotate_5.Geometry, BulgeA=number_slider, BulgeB=number_slider, Continuity=2)
neg_4 = Negative(Value=pinion_radius_2)
Y_2 = UnitY(Factor=neg_4)
cir_2 = Circle(Plane=move.Geometry, Radius=multiplication_4)
join_3 = JoinCurves(Curves=flatten([rotate_4.Geometry, rotate_5.Geometry, blendc, blendc_2]), Preserve=False)
move_9 = Move(Geometry=join_3, Motion=Y_2)  # -> Geometry, Transform
pinion_teeth = Curve(move_9.Geometry)

# ----
move_10 = Move(Geometry=cir_2, Motion=Y_2)  # -> Geometry, Transform

# ---- group: Create and blend pinion teeth (continued)
pinion_center_hole = Curve(move_10.Geometry)

# ---- group: Create pinion movement preview
preview_position_0_1_3 = Number(preview_position_0_1_2)
pinion_radius_3 = Panel(pinion_radius)
pinion_circumference_3 = Panel(pinion_circumference)
multiplication_14 = Multiplication(A="360", B=preview_position_0_1_3)
multiplication_15 = Multiplication(A=pinion_circumference_3, B=preview_position_0_1_3)
neg_5 = Negative(Value=multiplication_14)
X_4 = UnitX(Factor=multiplication_15)
rad_8 = Radians(Degrees=neg_5)
rotate_6 = Rotate(Geometry=flatten([join_3, cir_2]), Angle=rad_8, Plane=move.Geometry)  # -> Geometry, Transform
move_11 = Move(Geometry=rotate_6.Geometry, Motion=X_4)  # -> Geometry, Transform
neg_6 = Negative(Value=pinion_radius_3)
Y_3 = UnitY(Factor=neg_6)
move_12 = Move(Geometry=move_11.Geometry, Motion=Y_3)  # -> Geometry, Transform
pinion_movement_preview = Curve(move_12.Geometry)

# ---- group: Make pinion bit statisitics
pinion_radius_4 = Panel(pinion_radius)
rotate_7 = Rotate(Geometry=move.Geometry, Angle=4.71238898, Plane=move.Geometry)  # -> Geometry, Transform
pinion_teeth_2 = Curve(join_3)
cir_3 = Circle(Plane=rotate_7.Geometry, Radius=pinion_radius_4)
trim = TrimWithRegion(Curve=cir_3, Region=pinion_teeth_2)  # -> Inside, Outside
item_4 = ListItem(List=trim.Outside, Index=0, Wrap=True)
len = Length(Curve=flatten(item_4))
maxium_pinion_milling_bit_diamter = Panel(len)

# ----
maxium_pinion_milling_bit_diamter_2 = Panel(maxium_pinion_milling_bit_diamter)
maxium_pinion_milling_bit_diamter_3 = Number(maxium_pinion_milling_bit_diamter_2)
pinion_movement_preview_2 = Curve(pinion_movement_preview)
pinion_center_hole_2 = Curve(pinion_center_hole)
pinion_teeth_3 = Curve(pinion_teeth)
pinion_teeth_4 = ClusterOutput(pinion_teeth_3)
pinion_center_hole_3 = ClusterOutput(pinion_center_hole_2)
maxium_pinion_milling_bit_diamter_4 = ClusterOutput(maxium_pinion_milling_bit_diamter_3)
pinion_movement_preview_3 = ClusterOutput(pinion_movement_preview_2)

# ---- group: Create rack by copying and offsetting rack tooth
tooth_spacing_5 = Panel(tooth_spacing)
rack_length_5 = Panel(rack_length_4)
milling_bit_radius_2 = Panel(multiplication_3)
tooth_profile_for_copy_and_join = Curve(offset_tooth_for_copy_and_join)
pinion_radius_5 = Panel(pinion_radius)
addition_6 = Addition(A=pinion_radius_5, B=milling_bit_radius_2)
multiplication_16 = Multiplication(A=addition_6, B="2")
addition_7 = Addition(A=rack_length_5, B=multiplication_16)
division_12 = Division(A=addition_6, B=tooth_spacing_5)
actual_rack_length = Panel(addition_7)
round_2 = Round(Number=division_12)  # -> Nearest, Floor, Ceiling
multiplication_17 = Multiplication(A=round_2.Ceiling, B=tooth_spacing_5)
division_13 = Division(A=actual_rack_length, B=tooth_spacing_5)
neg_7 = Negative(Value=addition_6)
neg_8 = Negative(Value=multiplication_17)
round_3 = Round(Number=division_13)  # -> Nearest, Floor, Ceiling
rack_start_distance = Panel(neg_8)
rack_cut_start_distance = Panel(neg_7)
addition_8 = Addition(A=round_3.Ceiling, B="1")
series_4 = Series(Start=0, Step=tooth_spacing_5, Count=addition_8)
X_5 = UnitX(Factor=rack_start_distance)
move_13 = Move(Geometry=tooth_profile_for_copy_and_join, Motion=X_5)  # -> Geometry, Transform
X_6 = UnitX(Factor=series_4)
move_14 = Move(Geometry=move_13.Geometry, Motion=X_6)  # -> Geometry, Transform
pinion_radius_6 = Panel(pinion_radius)
join_4 = JoinCurves(Curves=move_14.Geometry, Preserve=False)
neg_9 = Negative(Value=pinion_radius_6)
Y_4 = UnitY(Factor=neg_9)
move_15 = Move(Geometry=join_4, Motion=Y_4)  # -> Geometry, Transform; disabled
rack_teeth = Curve(move_15.Geometry)

# ----
end_2 = EndPoints(Curve=move_13.Geometry)  # -> Start, End
dist = Distance(PointA=end_2.Start, PointB=end_2.End)
panel = Panel(dist)
move_16 = Move(Geometry=move_14.Geometry, Motion=Y_4)  # -> Geometry, Transform

# ---- group: Create rack by copying and offsetting rack tooth (continued)
rack_teeth_unjoined = Curve(move_16.Geometry)

# ---- group: Trim rack to specified length
rack_cut_start_distance_2 = Panel(rack_cut_start_distance)
actual_rack_length_2 = Panel(actual_rack_length)
pinion_diameter_2 = Panel(pinion_diameter)
rack_teeth_2 = Curve(rack_teeth)
pt_5 = ConstructPoint(XCoordinate=rack_cut_start_distance_2, YCoordinate=0, ZCoordinate=0)
xy_5 = XYPlane(Origin=pt_5)
neg_10 = Negative(Value=pinion_diameter_2)
rectangle = Rectangle(Plane=xy_5, XSize=actual_rack_length_2, YSize=neg_10, Radius=0)  # -> Rectangle, Length
trim_2 = TrimWithRegion(Curve=rack_teeth_2, Region=rectangle.Rectangle)  # -> Inside, Outside
bbox = BoundingBox(Content=trim_2.Inside, Plane=PlaneXY(0, 0, 0))  # -> Box, Box_2
edges = BrepEdges(Brep=bbox.Box)  # -> Naked, Interior, NonManifold
item_5 = ListItem(List=edges.Naked, Index="2", Wrap=True)
flip_3 = FlipCurve(Curve=item_5)  # -> Curve, Flag
rack_tooth_edge = Curve(flip_3.Curve)
trimmed_rack_teeth = Curve(trim_2.Inside)

# ----
rack_teeth_trimmed_and_joined = Curve(trimmed_rack_teeth)
rack_teeth_3 = Curve(rack_teeth_unjoined)
rack_teeth_4 = ClusterOutput(rack_teeth_3)

pinion_radius_7 = Panel(pinion_radius)
milling_bit_radius_3 = Panel(multiplication_3)
addition_9 = Addition(A=pinion_radius_7, B=milling_bit_radius_3)
cir_4 = Circle(Plane=move.Geometry, Radius=addition_9)

move_17 = Move(Geometry=cir_4, Motion=Y_2)  # -> Geometry, Transform

pinion_edge = Curve(move_17.Geometry)

pinion_edge_2 = Curve(pinion_edge)
pinion_edge_3 = ClusterOutput(pinion_edge_2)

# ==== cluster InsideGearForPinionMaker: Creates a gear matching a pinion from "Roller rack and pinion maker". Great for making geared rack and pinion drive systems. Connect pinion geometery from a "Roller rack and pinion maker" component.
number_of_input_pinion_teeth = ClusterInput()  # Input same pinion tooth count as used in "Roller rack and pinion maker"
preview_position_0_1 = ClusterInput()  # Connect a slider to preview gear movement
tooth_fillet_ratio = ClusterInput()  # Adjust to make sure pinion can roll soothly past to tips
pinion_center_hole_curve = ClusterInput()  # Connect pinion center hole geometry from "Roller rack and pinion maker"
number_of_gear_teeth = ClusterInput()  # Specify the number of teeth
milling_bit_diameter = ClusterInput()  # Input same diameter value as used in "Roller rack and pinion maker"
pinion_teeth_curve = ClusterInput()  # Connect pinion curve geometry from "Roller rack and pinion maker"

# ---- group: Low fillet ratio gives smoother motion, but makes a less robust pinion
tooth_fillet_ratio_2 = Number(tooth_fillet_ratio)
tooth_fillet_ratio_3 = Panel(tooth_fillet_ratio_2)

# ----
preview_position_0_1_2 = Number(preview_position_0_1)

# ---- group: Start numbers to help calculte pinion tooth path through rack
number_of_curve_sample_points = Slider(20, range=0..1000)
sample_tooth_position = Panel("0.26")

# ----
number_of_gear_teeth_2 = Number(number_of_gear_teeth)
milling_bit_diameter_2 = Number(milling_bit_diameter)
number_of_input_pinion_teeth_2 = Number(number_of_input_pinion_teeth)
pinion_teeth_curve_2 = Curve(pinion_teeth_curve)
pinion_center_hole_curve_2 = Curve(pinion_center_hole_curve)
number_of_gear_teeth_3 = Panel(number_of_gear_teeth_2)
milling_bit_diameter_3 = Panel(milling_bit_diameter_2)
number_of_pinion_teeth = Panel(number_of_input_pinion_teeth_2)
division = Division(A=number_of_gear_teeth_3, B=number_of_pinion_teeth)
explode = Explode(Curve=pinion_teeth_curve_2, Recursive=True)  # -> Segments, Vertices
smaller = SmallerThan(FirstNumber=division, SecondNumber="2")  # -> SmallerThan, OrEqualTo
item = ListItem(List=explode.Segments, Index=0, Wrap=True)
multiplication = Multiplication(A=number_of_pinion_teeth, B=sample_tooth_position)
input_pinion_has_at_least_half_the_tooth = Panel(smaller.SmallerThan)  # "Input pinion has at least half the tooth count"
darc = DeconstructArc(Arc=item)  # -> BasePlane, Radius, Angle
round = Round(Number=multiplication)  # -> Nearest, Floor, Ceiling
area = Area(Geometry=pinion_center_hole_curve_2)  # -> Area, Centroid
pinion_tooth_center_point = Point(darc.BasePlane)
sample_tooth_number = Panel(round.Ceiling)
xy = XYPlane(Origin=area.Centroid)
pinion_center_plane = Plane(xy)
dist = Distance(PointA=flatten(pinion_tooth_center_point), PointB=flatten(area.Centroid))
pinion_radius = Panel(dist)
multiplication_2 = Multiplication(A=pinion_radius, B="2")
pi = Pi(Factor=1)
multiplication_3 = Multiplication(A=multiplication_2, B=pi)
number_of_pinion_teeth_2 = Panel(number_of_pinion_teeth)
number_of_gear_teeth_4 = Panel(number_of_gear_teeth_3)
pinion_cirumference = Panel(multiplication_3)

number_of_curve_sample_points_2 = Panel(number_of_curve_sample_points)
number_of_pinion_teeth_3 = Panel(number_of_pinion_teeth)
sample_tooth_number_2 = Panel(sample_tooth_number)
input_pinion_has_at_least_half_the_tooth_2 = Panel(input_pinion_has_at_least_half_the_tooth)  # "Input pinion has at least half the tooth count"
pinion_circumference = Panel(pinion_cirumference)
pinion_circumference_2 = Panel(pinion_circumference)
division_2 = Division(A=pinion_circumference, B=number_of_pinion_teeth)
division_3 = Division(A=sample_tooth_number_2, B=number_of_pinion_teeth_3)
tooth_spacing = Panel(division_2)
multiplication_4 = Multiplication(A="360", B=division_3)
division_4 = Division(A=multiplication_4, B=number_of_curve_sample_points_2)
multiplication_5 = Multiplication(A=pinion_circumference_2, B=division_3)
division_5 = Division(A=number_of_pinion_teeth, B=number_of_gear_teeth_3)
series = Series(Start=0, Step=division_4, Count=number_of_curve_sample_points_2)
division_6 = Division(A=multiplication_5, B=number_of_curve_sample_points_2)
tooth_count_ratio = Panel(division_5)
neg = Negative(Value=series)
series_2 = Series(Start=0, Step=division_6, Count=number_of_curve_sample_points_2)
rad = Radians(Degrees=neg)
multiplication_6 = Multiplication(A=rad, B=tooth_count_ratio)
neg_2 = Negative(Value=rad)
neg_3 = Negative(Value=multiplication_6)
filter = StreamFilter(Gate=input_pinion_has_at_least_half_the_tooth_2, Stream0=rad, Stream1=neg_2)
filter_2 = StreamFilter(Gate=input_pinion_has_at_least_half_the_tooth_2, Stream0=neg_3, Stream1=multiplication_6)
tooth_spacing_2 = Panel(tooth_spacing)
gear_sample_positions = Panel(filter)
gear_sample_positions_2 = Panel(filter_2)

milling_bit_diameter_4 = Panel(milling_bit_diameter_3)
multiplication_7 = Multiplication(A=milling_bit_diameter_3, B=tooth_fillet_ratio_3)
multiplication_8 = Multiplication(A=milling_bit_diameter_4, B="0.5")
tooth_fillet_radius = Panel(multiplication_7)
milling_it_radius = Panel(multiplication_8)

division_7 = Division(A=pinion_cirumference, B=number_of_pinion_teeth_2)
tooth_spacing_3 = Panel(division_7)
multiplication_9 = Multiplication(A=tooth_spacing_3, B=number_of_gear_teeth_4)
gear_circumference = Panel(multiplication_9)
pi_2 = Pi(Factor=1)
division_8 = Division(A=gear_circumference, B=pi_2)
gear_diameter = Panel(division_8)
division_9 = Division(A=gear_diameter, B="2")
gear_radius = Panel(division_9)
pinion_tooth_center_point_2 = Point(pinion_tooth_center_point)
neg_4 = Negative(Value=gear_radius)
Y = UnitY(Factor=gear_radius)
move = Move(Geometry=pinion_tooth_center_point_2, Motion=Y)  # -> Geometry, Transform
gear_center_point = Point(move.Geometry)
xy_2 = XYPlane(Origin=gear_center_point)
gear_center_plane = Plane(xy_2)

gear_sample_positions_3 = Panel(gear_sample_positions_2)
gear_center_plane_2 = Plane(gear_center_plane)
rotate = Rotate(Geometry=graft(item), Angle=gear_sample_positions, Plane=pinion_center_plane)  # -> Geometry, Transform
gear_center_plane_3 = Plane(gear_center_plane)
number_of_gear_teeth_5 = Panel(number_of_gear_teeth_3)
X = UnitX(Factor=series_2)
move_2 = Move(Geometry=rotate.Geometry, Motion=X)  # -> Geometry, Transform
rotate_2 = Rotate(Geometry=rotate.Geometry, Angle=gear_sample_positions_3, Plane=gear_center_plane_2)  # -> Geometry, Transform
yz = YZPlane(Origin=gear_center_plane_3)
division_10 = Division(A="180", B=number_of_gear_teeth_5)
darc_2 = DeconstructArc(Arc=rotate_2.Geometry)  # -> BasePlane, Radius, Angle
rotate_3 = Rotate(Geometry=yz, Angle=degrees(division_10), Plane=gear_center_plane_3)  # -> Geometry, Transform
pt = Point(darc_2.BasePlane)
intcrv = Interpolate(Vertices=pt, Degree=3, Periodic=False, KnotStyle=1)  # -> Curve, Length, Domain
tooth_mid_plane = Plane(rotate_3.Geometry)
master_profile_curve = Curve(intcrv.Curve)

pinion_center_hole = Curve(pinion_center_hole_curve_2)
pinion_center_plane_2 = Plane(pinion_center_plane)
gear_center_plane_4 = Plane(gear_center_plane)
orient = Orient(Geometry=pinion_center_hole, Source=pinion_center_plane_2, Target=gear_center_plane_4)  # -> Geometry, Transform
gear_center_hole = Curve(orient.Geometry)

# ---- group: Create pinion movement preview
pinion_center_plane_3 = Plane(pinion_center_plane)
pinion_teeth = Curve(pinion_teeth_curve_2)
preview_position_0_1_3 = Number(preview_position_0_1_2)
multiplication_10 = Multiplication(A="360", B=preview_position_0_1_3)
neg_5 = Negative(Value=multiplication_10)
rad_2 = Radians(Degrees=neg_5)
rotate_4 = Rotate(Geometry=flatten(pinion_teeth), Angle=rad_2, Plane=pinion_center_plane_3)  # -> Geometry, Transform
pinion_movement_preview = Curve(rotate_4.Geometry)

# ----
gear_center_hole_2 = Curve(gear_center_hole)
pinion_movement_preview_2 = Curve(pinion_movement_preview)
gear_center_hole_3 = ClusterOutput(gear_center_hole_2)
pinion_movement_preview_3 = ClusterOutput(pinion_movement_preview_2)

milling_it_radius_2 = Panel(milling_it_radius)
master_profile_curve_2 = Curve(master_profile_curve)
gear_radius_2 = Panel(gear_radius)
valley_arc_from_pinion = Curve(item)
tooth_mid_plane_2 = Plane(tooth_mid_plane)
gear_center_plane_5 = Plane(gear_center_plane)
cir = Circle(Plane=gear_center_plane_5, Radius=gear_radius_2)
xy_3 = XYPlane(Origin=Point(0, 0, 0))
offset = Offset(Curve=master_profile_curve_2, Distance=milling_it_radius_2, Plane=xy_3, Corners=1)
ccx = CurveCurve(CurveA=offset, CurveB=cir)  # -> Points, ParamsA, ParamsB
shatter = Shatter(Curve=offset, Parameters=ccx.ParamsA)
rev = ReverseList(List=shatter)
milling_bit_diameter_5 = Panel(milling_bit_diameter_3)
item_2 = ListItem(List=rev, Index=0, Wrap=True)
ext = ExtendCurve(Curve=item_2, Type=0, Start=milling_bit_diameter_5, End=milling_bit_diameter_5)
valley_arc_from_pinion_2 = Curve(valley_arc_from_pinion)
extended_profile = Curve(ext)
ccx_2 = CurveCurve(CurveA=extended_profile, CurveB=valley_arc_from_pinion_2)  # -> Points, ParamsA, ParamsB
rev_2 = ReverseList(List=ccx_2.Points)
rev_3 = ReverseList(List=ccx_2.ParamsA)
item_3 = ListItem(List=rev_3, Index=0, Wrap=True)
yz_2 = YZPlane(Origin=Point(0, 0, 0))
item_4 = ListItem(List=rev_2, Index=0, Wrap=True)
shatter_2 = Shatter(Curve=extended_profile, Parameters=item_3)
mirror = Mirror(Geometry=item_4, Plane=yz_2)  # -> Geometry, Transform
rev_4 = ReverseList(List=shatter_2)
crv_cp = CurveClosestPoint(Point=[item_4, mirror.Geometry], Curve=valley_arc_from_pinion_2)  # -> Point, Parameter, Distance
item_5 = ListItem(List=rev_4, Index=0, Wrap=True)
shatter_3 = Shatter(Curve=valley_arc_from_pinion_2, Parameters=crv_cp.Parameter)
item_6 = ListItem(List=shatter_3, Index="1", Wrap=True)
trimmed_profile = Curve(item_5)
trimmed_valley = Curve(item_6)
curve_for_mirror = Curve(trimmed_profile)
mirror_2 = Mirror(Geometry=curve_for_mirror, Plane=tooth_mid_plane_2)  # -> Geometry, Transform
tooth_fillet_radius_2 = Panel(tooth_fillet_radius)
trimmed_valley_2 = Curve(trimmed_valley)

mirror_3 = Mirror(Geometry=curve_for_mirror, Plane=tooth_mid_plane_2)  # -> Geometry, Transform

ccx_3 = CurveCurve(CurveA=curve_for_mirror, CurveB=mirror_3.Geometry)  # -> Points, ParamsA, ParamsB
shatter_4 = Shatter(Curve=curve_for_mirror, Parameters=ccx_3.ParamsA)
item_7 = ListItem(List=shatter_4, Index=0, Wrap=True)
mirror_4 = Mirror(Geometry=item_7, Plane=tooth_mid_plane_2)  # -> Geometry, Transform
join = JoinCurves(Curves=[item_7, mirror_4.Geometry], Preserve=False)
fillet = Fillet(Curve=join, Radius=tooth_fillet_radius_2)
gear_profile = Curve(fillet)

number_of_gear_teeth_6 = Panel(number_of_gear_teeth_3)
gear_center_plane_6 = Plane(gear_center_plane)
tooth_valley = Curve(trimmed_valley_2)
tooth_profile = Curve(gear_profile)
division_11 = Division(A="360", B=number_of_gear_teeth_6)
series_3 = Series(Start=0, Step=division_11, Count=number_of_gear_teeth_6)
rotate_5 = Rotate(Geometry=[tooth_profile, tooth_valley], Angle=degrees(series_3), Plane=gear_center_plane_6)  # -> Geometry, Transform
join_2 = JoinCurves(Curves=flatten(rotate_5.Geometry), Preserve=False)
gear_teeth = Curve(join_2)

# ---- group: Create pinion movement preview
preview_position_0_1_4 = Number(preview_position_0_1_2)
gear_center_plane_7 = Plane(gear_center_plane)
number_of_gear_teeth_7 = Panel(number_of_gear_teeth_3)
number_of_pinion_teeth_4 = Panel(number_of_pinion_teeth)
gear_teeth_2 = Curve(gear_teeth)
division_12 = Division(A=number_of_pinion_teeth_4, B=number_of_gear_teeth_7)
multiplication_11 = Multiplication(A="360", B=preview_position_0_1_4)
neg_6 = Negative(Value=multiplication_11)
rad_3 = Radians(Degrees=neg_6)
multiplication_12 = Multiplication(A=rad_3, B=division_12)
rotate_6 = Rotate(Geometry=flatten(gear_teeth_2), Angle=multiplication_12, Plane=gear_center_plane_7)  # -> Geometry, Transform
gear_movement_preview = Curve(rotate_6.Geometry)

# ----
gear_movement_preview_2 = Curve(gear_movement_preview)
gear_teeth_3 = Curve(gear_teeth)
gear_teeth_4 = ClusterOutput(gear_teeth_3)
gear_movement_preview_3 = ClusterOutput(gear_movement_preview_2)
