# Grasshopper definition double-cycloid-two-layer-rack-and-pinion.gh (Grasshopper 0.9.76)
# Copyright: Creative commons attribution share-a-like

# ---- group: Settings for Nema23, stronger teeth geometry
pinion_tooth_spacing_factor = Slider(-0.20635, range=-1..1)
tooth_fillet_ratio = Slider(0.1, range=0..1)
number_of_curve_sample_points = Panel("22")
milling_bit_diameter = Panel("6.3")
number_of_pinion_teeth = Panel("6")

# ----
contacting_pinion_valley = BooleanToggle(True)
tooth_fillet_ratio_2 = Slider(0.18, range=0..1)
number_slider = Slider(0.72, range=0..1)
teeth_per_rack_distance = Slider(16, range=0..20)
arch_deg_chop = Panel("16")
number_of_sample_points = Panel("24")
circle_saple_ratio = Panel("0.07")
rack_valley_diameter = Panel("3.4")
preview = Slider(0.716097, range=0..1)
motor_shaft_diamter = Panel("8")
rack_distance = Slider(100, range=0..100)
number_of_pinon_teeth = Panel("7")
number_of_rack_teeth = Panel("60")
rack_tooth_diamter = Panel(rack_valley_diameter)
number_of_pinon_teeth_2 = Panel(number_of_pinon_teeth)
division = Division(A=rack_distance, B=teeth_per_rack_distance)
multiplication = Multiplication(A=number_of_pinon_teeth_2, B=rack_tooth_diamter)
number_of_sample_points_2 = Panel("24")
circle_saple_ratio_2 = Panel("1")
subtraction = Subtraction(A=number_of_sample_points, B="1")
tooth_spacing = Panel(division)
multiplication_2 = Multiplication(A=motor_shaft_diamter, B="0.5")
xy = XYPlane(Origin=Point(0, 0, 0))
pi = Pi(Factor=1)
multiplication_3 = Multiplication(A="360", B=circle_saple_ratio)
cir = Circle(Plane=xy, Radius=multiplication_2)
division_2 = Division(A=multiplication_3, B=subtraction)
multiplication_4 = Multiplication(A=number_of_pinon_teeth_2, B=tooth_spacing)
subtraction_2 = Subtraction(A=number_of_sample_points_2, B="1")
clearance = Panel("0.7")
series = Series(Start=0, Step=division_2, Count=number_of_sample_points)
circumference = Panel(multiplication_4)
pinon_circumference = Panel(circumference)
pinon_circumference_2 = Panel(pinon_circumference)
roller_rack_and_pinion_maker = RollerRackAndPinionMaker(
    number_of_pinion_teeth=number_of_pinon_teeth,
    milling_bit_diameter=rack_valley_diameter,
    tooth_fillet_ratio=tooth_fillet_ratio_2,
    pinion_circumference=pinon_circumference,
    contacting_pinion_valley=contacting_pinion_valley)  # -> rack_teeth_4, pinion_teeth_5, pinion_center_hole_3, pinion_edge_3, steps_per_mm_2, maxium_pinion_milling_bit_diamter_4, pinion_movement_preview_3
division_3 = Division(A=pinon_circumference, B=number_of_pinon_teeth)
division_4 = Division(A=pinon_circumference, B="200")
division_5 = Division(A="200", B=pinon_circumference)
rack_tooth_spacing = Panel(division_3)
steps_per_mm = Panel(division_5)
distance_per_step = Panel(division_4)
multiplication_5 = Multiplication(A=pinon_circumference, B=circle_saple_ratio)
subtraction_3 = Subtraction(A=pinon_circumference_2, B=multiplication)
division_6 = Division(A=pinon_circumference, B=pi)
division_7 = Division(A=multiplication_5, B=subtraction)
series_2 = Series(Start=0, Step=rack_tooth_spacing, Count=number_of_rack_teeth)
division_8 = Division(A=subtraction_3, B=number_of_pinon_teeth_2)
multiplication_6 = Multiplication(A=division_6, B="0.5")
series_3 = Series(Start=0, Step=division_7, Count=number_of_sample_points)
pinion_valley_width = Panel(division_8)
division_9 = Division(A="1", B=roller_rack_and_pinion_maker.steps_per_mm_2)
multiplication_7 = Multiplication(A=rack_tooth_spacing, B="0.5")
neg = Negative(Value=multiplication_6)
multiplication_8 = Multiplication(A="360", B=circle_saple_ratio_2)
multiplication_9 = Multiplication(A=pinon_circumference, B=circle_saple_ratio_2)
cir_2 = Circle(Plane=PlaneXY(0, 0, 0), Radius=Slider(4, range=0..10))
X = UnitX(Factor=multiplication_7)
panel = Panel(division_9)
pt = ConstructPoint(XCoordinate=0, YCoordinate=neg, ZCoordinate=0)
pt_2 = ConstructPoint(XCoordinate=series_3, YCoordinate=0, ZCoordinate=0)
neg_2 = Negative(Value=series)
X_2 = UnitX(Factor=series_2)
division_10 = Division(A=multiplication_9, B=subtraction_2)
subtraction_4 = Subtraction(A=pinion_valley_width, B=clearance)
rack_tooth_diamter_2 = Panel(subtraction_4)
division_11 = Division(A=multiplication_8, B=subtraction_2)
rdiff = RegionDifference(CurvesA=roller_rack_and_pinion_maker.pinion_teeth_5, CurvesB=cir_2)
move = Move(Geometry=roller_rack_and_pinion_maker.rack_teeth_4, Motion=X)  # -> Geometry, Transform
xy_2 = XYPlane(Origin=pt_2)
xy_3 = XYPlane(Origin=pt)
series_4 = Series(Start=0, Step=division_10, Count=number_of_sample_points_2)
series_5 = Series(Start=0, Step=division_11, Count=number_of_sample_points_2)
fillet = Fillet(Curve=rdiff, Radius="0.16")
subtraction_5 = Subtraction(A="180", B=arch_deg_chop)
move_2 = Move(Geometry=xy_3, Motion=X_2)  # -> Geometry, Transform
multiplication_10 = Multiplication(A=rack_tooth_diamter_2, B="0.5")
rotate = Rotate(Geometry=xy_2, Angle=degrees(neg_2), Plane=xy_2)  # -> Geometry, Transform
multiplication_11 = Multiplication(A=rack_tooth_spacing, B="0.5")
pt_3 = ConstructPoint(XCoordinate=series_4, YCoordinate=0, ZCoordinate=0)
neg_3 = Negative(Value=series_5)
rad = Radians(Degrees=arch_deg_chop)
rad_2 = Radians(Degrees=subtraction_5)
neg_4 = Negative(Value=multiplication_11)
cir_3 = Circle(Plane=move_2.Geometry, Radius=multiplication_10)  # disabled
xy_4 = XYPlane(Origin=pt_3)
pt_4 = ConstructPoint(XCoordinate=multiplication_11, YCoordinate=neg, ZCoordinate=0)
division_12 = Division(A="360", B=number_of_pinon_teeth)
multiplication_12 = Multiplication(A=division_12, B="0.5")
rotate_2 = Rotate(Geometry=fillet, Angle=degrees(multiplication_12), Plane=PlaneXY(0, 0, 0))  # -> Geometry, Transform
xy_5 = XYPlane(Origin=Point(0, 0, 0))
dom = ConstructDomain(DomainStart=rad, DomainEnd=rad_2)
multiplication_13 = Multiplication(A=rack_tooth_diamter_2, B="0.5")
series_6 = Series(Start=0, Step=division_12, Count=number_of_pinon_teeth)
orient = Orient(Geometry=pt_4, Source=rotate.Geometry, Target=xy_5)  # -> Geometry, Transform
rotate_3 = Rotate(Geometry=xy_4, Angle=degrees(neg_3), Plane=xy_4)  # -> Geometry, Transform
xy_6 = XYPlane(Origin=Point(0, 0, 0))
arc = Arc(Plane=xy_3, Radius=multiplication_13, Angle=dom)  # -> Arc, Length
deplane = DeconstructPlane(Plane=rotate_3.Geometry)  # -> Origin, XAxis, YAxis, ZAxis
amp = Amplitude(Vector=deplane.YAxis, Amplitude=neg)
multiplication_14 = Multiplication(A=rack_tooth_spacing, B="0.5")
multiplication_15 = Multiplication(A=rack_tooth_diamter_2, B="0.5")
intcrv = Interpolate(Vertices=orient.Geometry, Degree=3, Periodic=False, KnotStyle=1)  # -> Curve, Length, Domain
move_3 = Move(Geometry=deplane.Origin, Motion=amp)  # -> Geometry, Transform
rack_tooth_spacing_2 = Panel(rack_tooth_spacing)
subtraction_6 = Subtraction(A=multiplication_14, B=multiplication_15)
multiplication_16 = Multiplication(A=division_12, B="0.5")
xy_7 = XYPlane(Origin=Point(0, 0, 0))
neg_5 = Negative(Value=multiplication_16)
neg_6 = Negative(Value=multiplication_15)
yz = YZPlane(Origin=Point(0, 0, 0))
xy_8 = XYPlane(Origin=Point(0, 0, 0))
multiplication_17 = Multiplication(A=rack_tooth_spacing_2, B="0.5")
intcrv_2 = Interpolate(Vertices=move_3.Geometry, Degree=3, Periodic=False, KnotStyle=1)  # -> Curve, Length, Domain; disabled
rotate_4 = Rotate(Geometry=yz, Angle=degrees(multiplication_16), Plane=xy_7)  # -> Geometry, Transform
offset = Offset(Curve=intcrv.Curve, Distance=subtraction_6, Plane=xy_8, Corners=1)
X_3 = UnitX(Factor=multiplication_17)
mirror = Mirror(Geometry=intcrv_2.Curve, Plane=PlaneYZ(0, 0, 0))  # -> Geometry, Transform; disabled
number_slider_2 = Slider(0.711, range=0..1)
mirror_2 = Mirror(Geometry=offset, Plane=rotate_4.Geometry)  # -> Geometry, Transform
move_4 = Move(Geometry=[intcrv_2.Curve, mirror.Geometry], Motion=X_3)  # -> Geometry, Transform; disabled
flip = FlipCurve(Curve=mirror_2.Geometry)  # -> Curve, Flag
flip_2 = FlipCurve(Curve=arc.Arc)  # -> Curve, Flag
blendc = BlendCurve(CurveA=flip_2.Curve, CurveB=flip.Curve, BulgeA="0.5", BulgeB="0.5", Continuity=2)
blendc_2 = BlendCurve(CurveA=flip.Curve, CurveB=offset, BulgeA=number_slider, BulgeB=number_slider, Continuity=1)
crvgraph = CurvatureGraph(Curve=blendc_2, Density=5, Scale=105)  # disabled
mirror_3 = Mirror(Geometry=blendc, Plane=rotate_4.Geometry)  # -> Geometry, Transform
rotate_5 = Rotate(Geometry=arc.Arc, Angle=degrees(series_6), Plane=xy_6)  # -> Geometry, Transform
rotate_6 = Rotate(Geometry=graft([offset, mirror_2.Geometry]), Angle=degrees(series_6), Plane=xy_6)  # -> Geometry, Transform
rotate_7 = Rotate(Geometry=graft(blendc_2), Angle=degrees(series_6), Plane=xy_6)  # -> Geometry, Transform
rotate_8 = Rotate(Geometry=graft([mirror_3.Geometry, blendc]), Angle=degrees(series_6), Plane=xy_6)  # -> Geometry, Transform
classic_pinion = Curve(rotate_2.Geometry)
xy_9 = XYPlane(Origin=Point(0, 0, 0))
group = Group(Objects=flatten([rotate_5.Geometry, cir, rotate_6.Geometry, rotate_7.Geometry, rotate_8.Geometry]))
orient_2 = Orient(Geometry=blendc_2, Source=xy_9, Target=rotate.Geometry)  # -> Geometry, Transform
join = JoinCurves(Curves=flatten([rotate_5.Geometry, cir, rotate_6.Geometry, rotate_7.Geometry, rotate_8.Geometry]), Preserve=False)
flatten = FlattenTree(Tree=orient_2.Geometry, Path="{0}")
multiplication_18 = Multiplication(A="360", B=preview)
end = EndPoints(Curve=orient_2.Geometry)  # -> Start, End
group_2 = Group(Objects=flatten(join))
lng = ListLength(List=flatten)
pinon_circumference_3 = Panel(pinon_circumference)
item = ListItem(List=rotate.Geometry, Index=Slider(0, range=0..20), Wrap=False)
neg_7 = Negative(Value=multiplication_18)
ln = Line(StartPoint=end.Start, EndPoint=end.End)
panel_2 = Panel(lng)
xy_10 = XYPlane(Origin=Point(0, 0, 0))
xy_11 = XYPlane(Origin=Point(0, 0, 0))
xy_12 = XYPlane(Origin=Point(0, 0, 0))
join_2 = JoinCurves(Curves=[orient_2.Geometry, ln], Preserve=False)
orient_3 = Orient(Geometry=group, Source=xy_10, Target=item)  # -> Geometry, Transform; disabled
subtraction_7 = Subtraction(A=panel_2, B="2")
subtraction_8 = Subtraction(A=panel_2, B="1")
rotate_9 = Rotate(Geometry=classic_pinion, Angle=degrees(neg_7), Plane=xy_11)  # -> Geometry, Transform
multiplication_19 = Multiplication(A=pinon_circumference_3, B=preview)
rotate_10 = Rotate(Geometry=group_2, Angle=degrees(neg_7), Plane=xy_12)  # -> Geometry, Transform
X_4 = UnitX(Factor=multiplication_19)
flatten_2 = FlattenTree(Tree=join_2, Path="{0}")  # disabled
cull_i = CullIndex(List=flatten, Indices=["0", "1"], Wrap=False)
cull_i_2 = CullIndex(List=flatten, Indices=[subtraction_7, subtraction_8], Wrap=False)
cull_i_3 = CullIndex(List=flatten, Indices=["0", subtraction_8], Wrap=False)
move_5 = Move(Geometry=rotate_9.Geometry, Motion=X_4)  # -> Geometry, Transform
move_6 = Move(Geometry=rotate_10.Geometry, Motion=X_4)  # -> Geometry, Transform
ungroup = Ungroup(Group=move_6.Geometry)
ccx = CurveCurve(CurveA=cull_i_3, CurveB=cull_i_2)  # -> Points, ParamsA, ParamsB
item_2 = ListItem(List=ungroup, Index=1, Wrap=True)
geo = Geometry([move_5.Geometry, move.Geometry])
shatter = Shatter(Curve=graft(cull_i_3), Parameters=ccx.ParamsA)
preview_2 = CustomPreview(Geometry=[move_5.Geometry, move.Geometry], Shader=ColourSwatch(SwatchColor=RGB(0, 14, 171)))
explode = Explode(Curve=item_2, Recursive=True)  # -> Segments, Vertices
item_3 = ListItem(List=shatter, Index=0, Wrap=True)
item_4 = ListItem(List=explode.Segments, Index=0, Wrap=True)
item_5 = ListItem(List=move_5.Geometry, Index=Slider(5, range=0..20), Wrap=True)
explode_2 = Explode(Curve=item_5, Recursive=True)  # -> Segments, Vertices
flatten_3 = FlattenTree(Tree=item_3, Path="{0}")
darc = DeconstructArc(Arc=item_4)  # -> BasePlane, Radius, Angle
item_6 = ListItem(List=explode_2.Segments, Index=Slider(5, range=0..20), Wrap=True)
ccx_2 = CurveCurve(CurveA=flatten_3, CurveB=cull_i)  # -> Points, ParamsA, ParamsB
darc_2 = DeconstructArc(Arc=item_6)  # -> BasePlane, Radius, Angle
shatter_2 = Shatter(Curve=graft(flatten_3), Parameters=ccx_2.ParamsA)
rev = ReverseList(List=shatter_2)
pt_5 = Point(darc.BasePlane)  # disabled
pt_6 = Point(darc_2.BasePlane)  # disabled
rack_tooth_spacing_3 = Panel(rack_tooth_spacing)
item_7 = ListItem(List=rev, Index=0, Wrap=True)
flatten_4 = FlattenTree(Tree=item_7, Path="{0}")
arc_2 = CircularArc(arc.Arc)
X_5 = UnitX(Factor=rack_tooth_spacing_3)
end_2 = EndPoints(Curve=arc_2)  # -> Start, End
eval = EvaluateLength(Curve=flatten_4, Length="0.5", Normalized=True)  # -> Point, Tangent, Parameter
move_7 = Move(Geometry=end_2.End, Motion=X_5)  # -> Geometry, Transform
yz_2 = YZPlane(Origin=pt_4)
multiplication_20 = Multiplication(A=rack_tooth_diamter_2, B="0.5")
xy_13 = XYPlane(Origin=pt)
flatten_5 = FlattenTree(Tree=move_7.Geometry, Path="{0}")
arc_3 = Arc(Plane=xy_13, Radius=multiplication_20, Angle=Domain(0, 3.141592654))  # -> Arc, Length
merge = Merge(Data1=flatten_5, Data2=eval.Point)
intcrv_3 = Interpolate(Vertices=merge, Degree=3, Periodic=False, KnotStyle=1)  # -> Curve, Length, Domain
mirror_4 = Mirror(Geometry=intcrv_3.Curve, Plane=yz_2)  # -> Geometry, Transform
flip_3 = FlipCurve(Curve=mirror_4.Geometry)  # -> Curve, Flag
blendc_3 = BlendCurve(CurveA=intcrv_3.Curve, CurveB=flip_3.Curve, BulgeA="0.5", BulgeB="0.5", Continuity=2)
eval_2 = EvaluateLength(Curve=blendc_3, Length="0.5", Normalized=True)  # -> Point, Tangent, Parameter
shatter_3 = Shatter(Curve=blendc_3, Parameters=eval_2.Parameter)
rev_2 = ReverseList(List=shatter_3)
item_8 = ListItem(List=rev_2, Index=0, Wrap=True)
merge_2 = Merge(Data1=mirror_4.Geometry, Data2=item_8)
yz_3 = YZPlane(Origin=Point(0, 0, 0))
mirror_5 = Mirror(Geometry=merge_2, Plane=yz_3)  # -> Geometry, Transform
join_3 = JoinCurves(Curves=flatten([mirror_5.Geometry, merge_2, arc_2]), Preserve=False)
fillet_2 = Fillet(Curve=join_3, Radius="0.6")
move_8 = Move(Geometry=fillet_2, Motion=X_2)  # -> Geometry, Transform
geo_2 = Geometry(move_8.Geometry)
geo_3 = Geometry([move_6.Geometry, geo_2])
preview_3 = CustomPreview(Geometry=[move_6.Geometry, geo_2], Shader=ColourSwatch(SwatchColor=RGB(255, 0, 0)))

# ==== cluster RollerRackAndPinionMaker: Makes rack and pinion gemetry suitable for 3 axis CNC milling. Has low backlash, but is vulnerable to contamination. More options inside component.
pinion_circumference = ClusterInput()
number_of_pinion_teeth = ClusterInput()
motor_shaft_diameter = ClusterInput()
milling_bit_diameter = ClusterInput()
rack_length = ClusterInput()
tooth_fillet_ratio = ClusterInput()

# ---- group: Determines the travel distance of pinion
rack_length_2 = Panel("200")
rack_length_3 = Number(rack_length)
null = NullItem(Item=rack_length_3)  # -> NullFlags, InvalidFlags, Description
filter = StreamFilter(Gate=null.NullFlags, Stream0=rack_length_3, Stream1=rack_length_2)
rack_length_4 = Panel(filter)

# ---- group: Smaller amount of teeth gives higher resolution and more torque
number_of_pinion_teeth_2 = Panel("9")
number_of_pinion_teeth_3 = Number(number_of_pinion_teeth)
# default config for nema 23 and nema 17 stepper motors - january 2017: bit diamter: 2.8
# pinion tooth spacing factor: -0.1071428
# (gives optimal pinion size and 5mm rack tooth spacing)
# number of pinion teeth: 9
# fillet ratio: 0.2
# earlier config for 2mm pinion milling and 3mm rack milling - august 2016: bit diamter: 3.1
# pinion tooth spacing factor: -0.14
# number of pinion teeth: 10
# fillet ratio: 0.15
null_2 = NullItem(Item=number_of_pinion_teeth_3)  # -> NullFlags, InvalidFlags, Description
filter_2 = StreamFilter(Gate=null_2.NullFlags, Stream0=number_of_pinion_teeth_3, Stream1=number_of_pinion_teeth_2)
number_of_pinion_teeth_4 = Panel(filter_2)

# ---- group: Determines the tooth spacing, some margin recommended
milling_bit_diameter_2 = Panel("2.8")
milling_bit_diameter_3 = Number(milling_bit_diameter)
null_3 = NullItem(Item=milling_bit_diameter_3)  # -> NullFlags, InvalidFlags, Description
filter_3 = StreamFilter(Gate=null_3.NullFlags, Stream0=milling_bit_diameter_3, Stream1=milling_bit_diameter_2)
milling_bit_diameter_4 = Panel(filter_3)

# ---- group: Can be used to reduce or increase the pinion tooth spacing
pinion_circumference_2 = Panel("40")
pinion_circumference_3 = Number(pinion_circumference)
null_4 = NullItem(Item=pinion_circumference_3)  # -> NullFlags, InvalidFlags, Description
filter_4 = StreamFilter(Gate=null_4.NullFlags, Stream0=pinion_circumference_3, Stream1=pinion_circumference_2)
pinion_circumference_4 = Panel(filter_4)

# ---- group: The shaft diameter of the motor driving the pinion
motor_shaft_diameter_2 = Panel("8")
motor_shaft_diameter_3 = Number(motor_shaft_diameter)
null_5 = NullItem(Item=motor_shaft_diameter_3)  # -> NullFlags, InvalidFlags, Description
filter_5 = StreamFilter(Gate=null_5.NullFlags, Stream0=motor_shaft_diameter_3, Stream1=motor_shaft_diameter_2)
motor_shaft_diameter_4 = Panel(filter_5)

# ---- group: Low fillet ratio gives smoother motion, but makes a less robust pinion
tooth_fillet_ratio_2 = Panel("0.2")
tooth_fillet_ratio_3 = Number(tooth_fillet_ratio)
null_6 = NullItem(Item=tooth_fillet_ratio_3)  # -> NullFlags, InvalidFlags, Description
filter_6 = StreamFilter(Gate=null_6.NullFlags, Stream0=tooth_fillet_ratio_3, Stream1=tooth_fillet_ratio_2)
tooth_fillet_ratio_4 = Panel(filter_6)

# ----
preview_position_0_1 = ClusterInput()
contacting_pinion_valley = ClusterInput()
preview_position = Slider(0.25, range=0..1)

# ---- group: Controlls pinion tooth blending
rounding_factor_pinion_outside = Slider(20, range=0..100)
rounding_factor_pinion_inside = Slider(70, range=0..100)

# ---- group: Start numbers to help calculte pinion tooth path through rack
number_of_curve_sample_points = Slider(22, range=0..100)
sample_tooth_position = Panel("0.5")

# ---- group: Lower number gives more clearene between rack tooth and pinion valley
pinion_corner_tolerance_factor = Panel("15")

# ---- group: Fill in for correct step statistics
number_of_stepper_motor_steps = Panel("200")
microstep_level = Panel("16")

# ----
contacting_pinion_valley_2 = Boolean(contacting_pinion_valley)
preview_position_0_1_2 = Number(preview_position_0_1)
sample_tooth_position_2 = Panel("0.26")

# ---- group: Prepare properties
multiplication = Multiplication(A=number_of_pinion_teeth_4, B=sample_tooth_position)
pinion_circumference_5 = Panel(pinion_circumference_4)
division = Division(A=milling_bit_diameter_4, B=pinion_corner_tolerance_factor)
multiplication_2 = Multiplication(A=milling_bit_diameter_4, B="0.5")
multiplication_3 = Multiplication(A=motor_shaft_diameter_4, B="0.5")
round = Round(Number=multiplication)  # -> Nearest, Floor, Ceiling
multiplication_4 = Multiplication(A=number_of_pinion_teeth_4, B="2")
neg = Negative(Value=division)
multiplication_5 = Multiplication(A=milling_bit_diameter_4, B=tooth_fillet_ratio_4)
milling_bit_radius = Panel(multiplication_2)
xy = XYPlane(Origin=Point(0, 0, 0))
sample_tooth_number = Panel(round.Ceiling)
tooth_fillet_radius = Panel(multiplication_5)
cir = Circle(Plane=xy, Radius=milling_bit_radius)
pi = Pi(Factor=1)
division_2 = Division(A=pinion_circumference_5, B=pi)
number_of_pinion_teeth_5 = Panel(number_of_pinion_teeth_4)
pinion_diameter = Panel(division_2)
sample_tooth_number_2 = Panel(sample_tooth_number)
number_of_curve_sample_points_2 = Panel(number_of_curve_sample_points)
multiplication_6 = Multiplication(A=pinion_diameter, B="0.5")
division_3 = Division(A=sample_tooth_number_2, B=number_of_pinion_teeth_5)
pinion_radius = Panel(multiplication_6)
pinion_circumference_6 = Panel(pinion_circumference_5)
multiplication_7 = Multiplication(A="360", B=division_3)
Y = UnitY(Factor=pinion_radius)
division_4 = Division(A="360", B=number_of_pinion_teeth_5)
division_5 = Division(A=multiplication_7, B=number_of_curve_sample_points_2)
multiplication_8 = Multiplication(A=pinion_circumference_6, B=division_3)
division_6 = Division(A=pinion_circumference_5, B=number_of_pinion_teeth_4)
move = Move(Geometry=xy, Motion=Y)  # -> Geometry, Transform
series = Series(Start=0, Step=division_4, Count=number_of_pinion_teeth_5)
division_7 = Division(A=multiplication_8, B=number_of_curve_sample_points_2)
series_2 = Series(Start=0, Step=division_5, Count=number_of_curve_sample_points_2)
tooth_spacing = Panel(division_6)
circle = Circle(cir)
rad = Radians(Degrees=series)
series_3 = Series(Start=0, Step=division_7, Count=number_of_curve_sample_points_2)
neg_2 = Negative(Value=series_2)
rad_2 = Radians(Degrees=neg_2)
rotate = Rotate(Geometry=circle, Angle=rad, Plane=move.Geometry)  # -> Geometry, Transform

# ---- group: Make step resolution statisitics
number_of_stepper_motor_steps_2 = Panel(number_of_stepper_motor_steps)
microstep_level_2 = Panel(microstep_level)
division_8 = Division(A=pinion_circumference_5, B=number_of_stepper_motor_steps_2)
distance_covered_per_step = Panel(division_8)
division_9 = Division(A=distance_covered_per_step, B=microstep_level_2)
distance_covered_per_micro_step = Panel(division_9)

# ---- group: Step statsistics
distance_covered_per_micro_step_2 = Panel(distance_covered_per_micro_step)
distance_covered_per_step_2 = Panel(distance_covered_per_step)

# ---- group: Create rack tooth geometry
sample_tooth_number_3 = Panel(sample_tooth_number_2)
tooth_spacing_2 = Panel(tooth_spacing)
item = ListItem(List=rotate.Geometry, Index=sample_tooth_number_3, Wrap=True)
rotate_2 = Rotate(Geometry=graft(item), Angle=rad_2, Plane=move.Geometry)  # -> Geometry, Transform
tooth_spacing_3 = Panel(tooth_spacing)
X = UnitX(Factor=series_3)
sample_tooth_number_4 = Panel(sample_tooth_number_3)
milling_it_radius = Panel(multiplication_2)
subtraction = Subtraction(A=sample_tooth_number_3, B="0.5")
move_2 = Move(Geometry=rotate_2.Geometry, Motion=X)  # -> Geometry, Transform
multiplication_9 = Multiplication(A=sample_tooth_number_4, B=tooth_spacing_3)
area = Area(Geometry=move_2.Geometry)  # -> Area, Centroid
pt = ConstructPoint(XCoordinate=multiplication_9, YCoordinate=0, ZCoordinate=0)
multiplication_10 = Multiplication(A=subtraction, B=tooth_spacing_2)
multiplication_11 = Multiplication(A=sample_tooth_number_3, B=tooth_spacing_2)
deplane = DeconstructPlane(Plane=xy)  # -> Origin, XAxis, YAxis, ZAxis
merge = Merge(Data1=flatten(area.Centroid), Data2=flatten(pt))
amp = Amplitude(Vector=deplane.YAxis, Amplitude=milling_it_radius)
amp_2 = Amplitude(Vector=deplane.XAxis, Amplitude=multiplication_10)
amp_3 = Amplitude(Vector=deplane.XAxis, Amplitude=multiplication_11)
intcrv = Interpolate(Vertices=merge, Degree=3, Periodic=False, KnotStyle=1)  # -> Curve, Length, Domain
rev = Reverse(Vector=amp)
move_3 = Move(Geometry=deplane.Origin, Motion=amp_2)  # -> Geometry, Transform
move_4 = Move(Geometry=deplane.Origin, Motion=amp_3)  # -> Geometry, Transform
move_5 = Move(Geometry=move_3.Geometry, Motion=rev)  # -> Geometry, Transform
yz = YZPlane(Origin=move_5.Geometry)
crv = Curve(intcrv.Curve)
mirror = Mirror(Geometry=crv, Plane=yz)  # -> Geometry, Transform
ccx = CurveCurve(CurveA=crv, CurveB=mirror.Geometry)  # -> Points, ParamsA, ParamsB
shatter = Shatter(Curve=crv, Parameters=ccx.ParamsA)
rev_2 = ReverseList(List=shatter)
milling_it_radius_2 = Panel(milling_it_radius)
tooth_fillet_radius_2 = Panel(tooth_fillet_radius)
item_2 = ListItem(List=rev_2, Index=0, Wrap=True)
mirror_2 = Mirror(Geometry=item_2, Plane=yz)  # -> Geometry, Transform
pt_2 = Point(move_4.Geometry)
pt_3 = Point(deplane.Origin)
addition = Addition(A=tooth_fillet_radius_2, B=milling_it_radius_2)
join = JoinCurves(Curves=[item_2, mirror_2.Geometry], Preserve=False)
vec2pt = Vector2Pt(PointA=pt_2, PointB=pt_3, Unitize=False)  # -> Vector, Length
fillet = Fillet(Curve=join, Radius=addition)
move_6 = Move(Geometry=fillet, Motion=vec2pt.Vector)  # -> Geometry, Transform

# ---- group: Offset tooth profile to prepare for copying
tooth_spacing_4 = Panel(tooth_spacing)
milling_it_radius_3 = Panel(milling_it_radius)
tooth_profile_for_offset = Curve(move_6.Geometry)
xy_2 = XYPlane(Origin=Point(0, 0, 0))
neg_3 = Negative(Value=tooth_spacing_4)
X_2 = UnitX(Factor=tooth_spacing_4)
X_3 = UnitX(Factor=neg_3)
move_7 = Move(Geometry=tooth_profile_for_offset, Motion=X_2)  # -> Geometry, Transform
move_8 = Move(Geometry=tooth_profile_for_offset, Motion=X_3)  # -> Geometry, Transform
end = EndPoints(Curve=tooth_profile_for_offset)  # -> Start, End
join_2 = JoinCurves(Curves=flatten([move_8.Geometry, tooth_profile_for_offset, move_7.Geometry]), Preserve=False)
yz_2 = YZPlane(Origin=[end.Start, end.End])
offset = Offset(Curve=join_2, Distance=milling_it_radius_3, Plane=xy_2, Corners=2)
pcx = CurvePlane(Curve=offset, Plane=yz_2)  # -> Points, ParamsC, ParamsP
shatter_2 = Shatter(Curve=offset, Parameters=flatten(pcx.ParamsC))
item_3 = ListItem(List=shatter_2, Index="1", Wrap=True)
offset_tooth_for_copy_and_join = Curve(item_3)

# ---- group: Find filleted top segment of rack tooth
offset_tooth_for_copy_and_join_2 = Curve(offset_tooth_for_copy_and_join)
rev_3 = Reverse(Vector=vec2pt.Vector)
move_9 = Move(Geometry=offset_tooth_for_copy_and_join_2, Motion=rev_3)  # -> Geometry, Transform
explode = Explode(Curve=move_9.Geometry, Recursive=True)  # -> Segments, Vertices
lng = ListLength(List=explode.Segments)
division_10 = Division(A=lng, B="2")
round_2 = Round(Number=division_10)  # -> Nearest, Floor, Ceiling
item_4 = ListItem(List=explode.Segments, Index=round_2.Floor, Wrap=True)

# ---- group: Create series of orientation planes the same way the rack tooth profile was created
pinion_tooth_circle = Curve(item)
area_2 = Area(Geometry=pinion_tooth_circle)  # -> Area, Centroid
xy_3 = XYPlane(Origin=area_2.Centroid)
rotate_3 = Rotate(Geometry=graft(xy_3), Angle=rad_2, Plane=move.Geometry)  # -> Geometry, Transform
move_10 = Move(Geometry=rotate_3.Geometry, Motion=X)  # -> Geometry, Transform

# ---- group: Find center of tooth fillet
eval = EvaluateLength(Curve=item_4, Length="0", Normalized=True)  # -> Point, Tangent, Parameter
eval_2 = EvaluateLength(Curve=item_4, Length="0.5", Normalized=True)  # -> Point, Tangent, Parameter
eval_3 = EvaluateLength(Curve=item_4, Length="1", Normalized=True)  # -> Point, Tangent, Parameter
circle_2 = Circle3Pt(PointA=eval.Point, PointB=eval_2.Point, PointC=eval_3.Point)  # -> Circle, Plane, Radius
deplane_2 = DeconstructPlane(Plane=circle_2.Plane)  # -> Origin, XAxis, YAxis, ZAxis

# ---- group: Check for deviation
tooth_fillet_radius_3 = Panel(circle_2.Radius)
tooth_fillet_radius_4 = Panel(tooth_fillet_radius)

# ---- group: Map fillet center point into the pinion valley
orient = Orient(Geometry=deplane_2.Origin, Source=move_10.Geometry, Target=xy_3)  # -> Geometry, Transform

# ---- group: Interpolate a profile curve and offset with the radius of the rack tooth fillet
intcrv_2 = Interpolate(Vertices=orient.Geometry, Degree=3, Periodic=False, KnotStyle=1)  # -> Curve, Length, Domain
offset_2 = Offset(Curve=intcrv_2.Curve, Distance=circle_2.Radius, Plane=PlaneXY(0, 0, 0), Corners=1)

# ----
spline_for_pinion_inside_profile = Curve(offset_2)
angle_between_pinion_teeth = Panel(division_4)
pinion_center_plane = Plane(move.Geometry)
pinion_tooth_circle_2 = Curve(item)
area_3 = Area(Geometry=pinion_tooth_circle_2)  # -> Area, Centroid
flip = FlipCurve(Curve=spline_for_pinion_inside_profile)  # -> Curve, Flag
ln = Line(StartPoint=pinion_center_plane, EndPoint=area_3.Centroid)
multiplication_12 = Multiplication(A=angle_between_pinion_teeth, B="-0.5")
rotate_4 = Rotate(Geometry=ln, Angle=degrees(multiplication_12), Plane=pinion_center_plane)  # -> Geometry, Transform
Z = UnitZ(Factor=1)
pl = ConstructPlane(Origin=pinion_center_plane, XAxis=ln, YAxis=Z)
pl_2 = ConstructPlane(Origin=pinion_center_plane, XAxis=rotate_4.Geometry, YAxis=Z)
pcx_2 = CurvePlane(Curve=flip.Curve, Plane=pl_2)  # -> Points, ParamsC, ParamsP
item_5 = ListItem(List=pcx_2.ParamsC, Index=0, Wrap=True)
shatter_3 = Shatter(Curve=flip.Curve, Parameters=item_5)
item_6 = ListItem(List=shatter_3, Index="1", Wrap=True)

# ---- group: Postion valley profile at correct position next to pinion tooth
multiplication_13 = Multiplication(A=angle_between_pinion_teeth, B="-0.5")
rotate_5 = Rotate(Geometry=item_6, Angle=degrees(multiplication_13), Plane=pinion_center_plane)  # -> Geometry, Transform

# ---- group: Find the meeting point off pinion tooth circle and the valley profile
crv_cp = CurveClosestPoint(Point=area_3.Centroid, Curve=item_6)  # -> Point, Parameter, Distance

# ----
panel = Panel(Slider(45, range=0..100))

# ---- group: Trim and mirror valley profile
shatter_4 = Shatter(Curve=item_6, Parameters=crv_cp.Parameter)
item_7 = ListItem(List=shatter_4, Index=0, Wrap=True)
mirror_3 = Mirror(Geometry=item_7, Plane=pl)  # -> Geometry, Transform

# ----
panel_2 = Panel(Slider(30, range=0..100))
multiplication_14 = Multiplication(A=Slider(2.4, range=0..10), B="0.5")
pt_4 = Point(area_3.Centroid)
xy_4 = XYPlane(Origin=area_3.Centroid)
xy_5 = XYPlane(Origin=area_3.Centroid)
neg_4 = Negative(Value=panel)
neg_5 = Negative(Value=panel_2)
distance_covered_per_step_3 = Panel(distance_covered_per_step)
division_11 = Division(A="1", B=distance_covered_per_step_3)
steps_per_mm = Number(division_11)
steps_per_mm_2 = ClusterOutput(steps_per_mm)

# ---- group: Create and blend pinion teeth
eval_4 = EvaluateLength(Curve=fillet, Length="0.5", Normalized=True)  # -> Point, Tangent, Parameter
pdecon = Deconstruct(Point=eval_4.Point)  # -> XComponent, YComponent, ZComponent
milling_it_radius_4 = Panel(milling_bit_radius)
pinion_corner_tolerance = Panel(neg)
subtraction_2 = Subtraction(A=pdecon.YComponent, B=milling_it_radius_4)
subtraction_3 = Subtraction(A=subtraction_2, B=milling_it_radius_4)
subtraction_4 = Subtraction(A=subtraction_3, B=pinion_corner_tolerance)
pt_5 = ConstructPoint(XCoordinate=0, YCoordinate=subtraction_4, ZCoordinate=0)
rounding_factor_pinion_outside_2 = Panel(rounding_factor_pinion_outside)
division_12 = Division(A="360", B=multiplication_4)
xy_6 = XYPlane(Origin=pt_5)
rounding_factor_pinion_inside_2 = Panel(rounding_factor_pinion_inside)
subtraction_5 = Subtraction(A="0", B=rounding_factor_pinion_outside_2)
addition_2 = Addition(A="180", B=rounding_factor_pinion_outside_2)
rad_3 = Radians(Degrees=addition_2)
rad_4 = Radians(Degrees=subtraction_5)
subtraction_6 = Subtraction(A="180", B=rounding_factor_pinion_inside_2)
addition_3 = Addition(A="0", B=rounding_factor_pinion_inside_2)
milling_it_radius_5 = Panel(milling_it_radius_4)
dom = ConstructDomain(DomainStart=rad_4, DomainEnd=rad_3)
xy_7 = XYPlane(Origin=Point(0, 0, 0))
rad_5 = Radians(Degrees=subtraction_6)
rad_6 = Radians(Degrees=addition_3)
dom_2 = ConstructDomain(DomainStart=rad_6, DomainEnd=rad_5)
arc = Arc(Plane=xy_7, Radius=milling_it_radius_5, Angle=dom)  # -> Arc, Length
pi_2 = Pi(Factor=1)
arc_2 = Arc(Plane=xy_6, Radius=milling_it_radius_5, Angle=dom_2)  # -> Arc, Length
rad_7 = Radians(Degrees=division_12)
rotate_6 = Rotate(Geometry=arc.Arc, Angle=pi_2, Plane=xy_7)  # -> Geometry, Transform
addition_4 = Addition(A=rad, B=rad_7)
number_slider = Slider(0.5, range=0..1)
rotate_7 = Rotate(Geometry=rotate_6.Geometry, Angle=rad, Plane=move.Geometry)  # -> Geometry, Transform
rotate_8 = Rotate(Geometry=arc_2.Arc, Angle=addition_4, Plane=move.Geometry)  # -> Geometry, Transform
flip_2 = FlipCurve(Curve=rotate_7.Geometry)  # -> Curve, Flag
flip_3 = FlipCurve(Curve=rotate_8.Geometry)  # -> Curve, Flag
pinion_radius_2 = Panel(pinion_radius)
shift = ShiftList(List=flip_2.Curve, Shift=1, Wrap=True)
blendc = BlendCurve(CurveA=rotate_7.Geometry, CurveB=flip_3.Curve, BulgeA=number_slider, BulgeB=number_slider, Continuity=2)
blendc_2 = BlendCurve(CurveA=shift, CurveB=rotate_8.Geometry, BulgeA=number_slider, BulgeB=number_slider, Continuity=2)
cir_2 = Circle(Plane=move.Geometry, Radius=multiplication_3)
neg_6 = Negative(Value=pinion_radius_2)
Y_2 = UnitY(Factor=neg_6)
join_3 = JoinCurves(Curves=flatten([rotate_7.Geometry, rotate_8.Geometry, blendc, blendc_2]), Preserve=False)
pinion_with_non_contacting_valley = Curve(join_3)

# ----
milling_it_radius_6 = Panel(milling_it_radius_4)
amp_4 = Amplitude(Vector=ln, Amplitude=milling_it_radius_6)
move_11 = Move(Geometry=area_3.Centroid, Motion=amp_4)  # -> Geometry, Transform
xy_8 = XYPlane(Origin=move_11.Geometry)

# ---- group: Create pinion tooth
mirror_4 = Mirror(Geometry=crv_cp.Point, Plane=pl)  # -> Geometry, Transform
arc_3 = Arc3Pt(PointA=crv_cp.Point, PointB=move_11.Geometry, PointC=mirror_4.Geometry)  # -> Arc, Plane, Radius

# ----
pt_6 = Point(move_11.Geometry)
cir_3 = Circle(Plane=xy_8, Radius=multiplication_14)
rotate_9 = Rotate(Geometry=pt_6, Angle=degrees(neg_4), Plane=xy_4)  # -> Geometry, Transform
rotate_10 = Rotate(Geometry=pt_6, Angle=degrees(panel), Plane=xy_4)  # -> Geometry, Transform
rotate_11 = Rotate(Geometry=cir_3, Angle=degrees(neg_5), Plane=xy_5)  # -> Geometry, Transform
rotate_12 = Rotate(Geometry=cir_3, Angle=degrees(panel_2), Plane=xy_5)  # -> Geometry, Transform

# ---- group: Check for serious deviation from precision, could be used for warining or self correction
panel_3 = Panel(crv_cp.Distance)
milling_it_radius_7 = Panel(milling_it_radius_6)
division_13 = Division(A=milling_it_radius_7, B=panel_3)
panel_4 = Panel(division_13)

# ----
move_12 = Move(Geometry=cir_2, Motion=Y_2)  # -> Geometry, Transform
merge_2 = Merge(Data1=rotate_10.Geometry, Data2=pt_4, Data3=rotate_9.Geometry)
ccx_2 = CurveCurve(CurveA=rotate_11.Geometry, CurveB=arc_3.Arc)  # -> Points, ParamsA, ParamsB
ccx_3 = CurveCurve(CurveA=rotate_12.Geometry, CurveB=arc_3.Arc)  # -> Points, ParamsA, ParamsB

# ---- group: Create and blend pinion teeth (continued)
pinion_center_hole = Curve(move_12.Geometry)

# ----
nurbs = NurbsCurve(Vertices=merge_2, Degree=3, Periodic=False)  # -> Curve, Length, Domain
shatter_5 = Shatter(Curve=rotate_11.Geometry, Parameters=ccx_2.ParamsA)
shatter_6 = Shatter(Curve=rotate_12.Geometry, Parameters=ccx_3.ParamsA)
trim = TrimWithRegions(Curve=arc_3.Arc, Regions=[rotate_11.Geometry, rotate_12.Geometry])  # -> Inside, Outside
item_8 = ListItem(List=shatter_5, Index=1, Wrap=True)
ccx_4 = CurveCurve(CurveA=arc_3.Arc, CurveB=nurbs.Curve)  # -> Points, ParamsA, ParamsB
crv_2 = Curve(trim.Outside)
item_9 = ListItem(List=shatter_6, Index=1, Wrap=True)
shatter_7 = Shatter(Curve=arc_3.Arc, Parameters=ccx_4.ParamsA)
double_bite_pinion = Curve([item_9, crv_2, item_8])
item_10 = ListItem(List=shatter_7, Index=[0, 2], Wrap=True)
merge_3 = Merge(Data1=item_10, Data2=nurbs.Curve)
crv_3 = Curve(merge_3)
filter_7 = StreamFilter(Gate=Toggle(False), Stream0=arc_3.Arc, Stream1=crv_3)

# ---- group: Join into a complete tooth
join_4 = JoinCurves(Curves=flatten([item_7, mirror_3.Geometry, filter_7]), Preserve=False)

# ---- group: Create a complete pinion
rotate_13 = Rotate(Geometry=join_4, Angle=rad, Plane=pinion_center_plane)  # -> Geometry, Transform
join_5 = JoinCurves(Curves=rotate_13.Geometry, Preserve=False)
pinion_with_contacting_valley = Curve(join_5)

# ---- group: Select pinion type
contacting_pinion_valley_3 = Panel(contacting_pinion_valley_2)
pinion_with_non_contacting_valley_2 = Curve(pinion_with_non_contacting_valley)
pinion_with_contacting_valley_2 = Curve(pinion_with_contacting_valley)
filter_8 = StreamFilter(Gate=contacting_pinion_valley_3, Stream0=pinion_with_non_contacting_valley_2, Stream1=pinion_with_contacting_valley_2)
pinion_teeth = Curve(filter_8)

# ---- group: Create pinion movement preview
preview_position_0_1_3 = Number(preview_position_0_1_2)
pinion_radius_3 = Panel(pinion_radius)
pinion_circumference_7 = Panel(pinion_circumference_5)
multiplication_15 = Multiplication(A="360", B=preview_position_0_1_3)
multiplication_16 = Multiplication(A=pinion_circumference_7, B=preview_position_0_1_3)
neg_7 = Negative(Value=multiplication_15)
X_4 = UnitX(Factor=multiplication_16)
rad_8 = Radians(Degrees=neg_7)
rotate_14 = Rotate(Geometry=flatten([pinion_teeth, cir_2]), Angle=rad_8, Plane=move.Geometry)  # -> Geometry, Transform
move_13 = Move(Geometry=rotate_14.Geometry, Motion=X_4)  # -> Geometry, Transform
neg_8 = Negative(Value=pinion_radius_3)
Y_3 = UnitY(Factor=neg_8)
move_14 = Move(Geometry=move_13.Geometry, Motion=Y_3)  # -> Geometry, Transform
pinion_movement_preview = Curve(move_14.Geometry)

# ---- group: Make pinion bit statisitics
pinion_radius_4 = Panel(pinion_radius)
rotate_15 = Rotate(Geometry=move.Geometry, Angle=4.71238898, Plane=move.Geometry)  # -> Geometry, Transform
pinion_teeth_2 = Curve(pinion_teeth)
cir_4 = Circle(Plane=rotate_15.Geometry, Radius=pinion_radius_4)
trim_2 = TrimWithRegion(Curve=cir_4, Region=pinion_teeth_2)  # -> Inside, Outside
item_11 = ListItem(List=trim_2.Outside, Index=0, Wrap=True)
len = Length(Curve=flatten(item_11))
maxium_pinion_milling_bit_diamter = Panel(len)

# ---- group: Position so that the center of the pinion is at origo
move_15 = Move(Geometry=pinion_teeth, Motion=Y_2)  # -> Geometry, Transform
pinion_teeth_3 = Curve(move_15.Geometry)

# ----
maxium_pinion_milling_bit_diamter_2 = Panel(maxium_pinion_milling_bit_diamter)
maxium_pinion_milling_bit_diamter_3 = Number(maxium_pinion_milling_bit_diamter_2)
pinion_movement_preview_2 = Curve(pinion_movement_preview)
pinion_center_hole_2 = Curve(pinion_center_hole)
pinion_teeth_4 = Curve(pinion_teeth_3)
pinion_teeth_5 = ClusterOutput(pinion_teeth_4)
pinion_center_hole_3 = ClusterOutput(pinion_center_hole_2)
maxium_pinion_milling_bit_diamter_4 = ClusterOutput(maxium_pinion_milling_bit_diamter_3)
pinion_movement_preview_3 = ClusterOutput(pinion_movement_preview_2)

# ---- group: Create rack by copying and offsetting rack tooth
tooth_spacing_5 = Panel(tooth_spacing)
rack_length_5 = Panel(rack_length_4)
milling_bit_radius_2 = Panel(multiplication_2)
tooth_profile_for_copy_and_join = Curve(offset_tooth_for_copy_and_join)
pinion_radius_5 = Panel(pinion_radius)
addition_5 = Addition(A=pinion_radius_5, B=milling_bit_radius_2)
multiplication_17 = Multiplication(A=addition_5, B="2")
addition_6 = Addition(A=rack_length_5, B=multiplication_17)
division_14 = Division(A=addition_5, B=tooth_spacing_5)
actual_rack_length = Panel(addition_6)
round_3 = Round(Number=division_14)  # -> Nearest, Floor, Ceiling
multiplication_18 = Multiplication(A=round_3.Ceiling, B=tooth_spacing_5)
division_15 = Division(A=actual_rack_length, B=tooth_spacing_5)
neg_9 = Negative(Value=addition_5)
neg_10 = Negative(Value=multiplication_18)
round_4 = Round(Number=division_15)  # -> Nearest, Floor, Ceiling
rack_start_distance = Panel(neg_10)
rack_cut_start_distance = Panel(neg_9)
addition_7 = Addition(A=round_4.Ceiling, B="1")
series_4 = Series(Start=0, Step=tooth_spacing_5, Count=addition_7)
X_5 = UnitX(Factor=rack_start_distance)
move_16 = Move(Geometry=tooth_profile_for_copy_and_join, Motion=X_5)  # -> Geometry, Transform
X_6 = UnitX(Factor=series_4)
move_17 = Move(Geometry=move_16.Geometry, Motion=X_6)  # -> Geometry, Transform
pinion_radius_6 = Panel(pinion_radius)
join_6 = JoinCurves(Curves=move_17.Geometry, Preserve=False)
neg_11 = Negative(Value=pinion_radius_6)
Y_4 = UnitY(Factor=neg_11)
move_18 = Move(Geometry=join_6, Motion=Y_4)  # -> Geometry, Transform; disabled
rack_teeth = Curve(move_18.Geometry)

# ----
end_2 = EndPoints(Curve=move_16.Geometry)  # -> Start, End
dist = Distance(PointA=end_2.Start, PointB=end_2.End)
panel_5 = Panel(dist)
move_19 = Move(Geometry=move_17.Geometry, Motion=Y_4)  # -> Geometry, Transform

# ---- group: Create rack by copying and offsetting rack tooth (continued)
rack_teeth_unjoined = Curve(move_19.Geometry)

# ---- group: Trim rack to specified length
rack_cut_start_distance_2 = Panel(rack_cut_start_distance)
actual_rack_length_2 = Panel(actual_rack_length)
pinion_diameter_2 = Panel(pinion_diameter)
rack_teeth_2 = Curve(rack_teeth)
pt_7 = ConstructPoint(XCoordinate=rack_cut_start_distance_2, YCoordinate=0, ZCoordinate=0)
xy_9 = XYPlane(Origin=pt_7)
neg_12 = Negative(Value=pinion_diameter_2)
rectangle = Rectangle(Plane=xy_9, XSize=actual_rack_length_2, YSize=neg_12, Radius=0)  # -> Rectangle, Length
trim_3 = TrimWithRegion(Curve=rack_teeth_2, Region=rectangle.Rectangle)  # -> Inside, Outside
bbox = BoundingBox(Content=trim_3.Inside, Plane=PlaneXY(0, 0, 0))  # -> Box, Box_2
edges = BrepEdges(Brep=bbox.Box)  # -> Naked, Interior, NonManifold
item_12 = ListItem(List=edges.Naked, Index="2", Wrap=True)
flip_4 = FlipCurve(Curve=item_12)  # -> Curve, Flag
rack_tooth_edge = Curve(flip_4.Curve)
trimmed_rack_teeth = Curve(trim_3.Inside)

# ----
rack_teeth_trimmed_and_joined = Curve(trimmed_rack_teeth)
rack_teeth_3 = Curve(rack_teeth_unjoined)
rack_teeth_4 = ClusterOutput(rack_teeth_3)

pinion_radius_7 = Panel(pinion_radius)
milling_bit_radius_3 = Panel(multiplication_2)
addition_8 = Addition(A=pinion_radius_7, B=milling_bit_radius_3)
cir_5 = Circle(Plane=move.Geometry, Radius=addition_8)

move_20 = Move(Geometry=cir_5, Motion=Y_2)  # -> Geometry, Transform

pinion_edge = Curve(move_20.Geometry)

pinion_edge_2 = Curve(pinion_edge)
pinion_edge_3 = ClusterOutput(pinion_edge_2)
