# Grasshopper definition chamfer-rail-generator-for-humphito-axes.gh (Grasshopper 0.9.76)
# Copyright: Creative commons attribution share-a-like
# Copyright: Creative commons BY-SA
# Copyright: none
# Copyright: Creative Commons BY-SA

# ----
# not yet functional
# Standard dimensions: Axis width: 58mm or 127mm
# Material thickness: 10mm
# Chamfer distance: 4mm
# Hole grid distance: 70mm
# 
# Pinion clearance margin: 2mm
# Rack tooth height: 4mm
make_hole_pattern_along_center = ValueList({"No": 0, "Yes": 1}, selected="No")
make_hole_pattern_along_edges = ValueList({"No": 0, "Yes": 1}, selected="Yes")
output_geometry_type = ValueList({"2D curves": 0, "3D brep": 1}, selected="2D curves")
make_cnc_toolpaths = ValueList({"No": 0, "Yes": 1}, selected="No")

passdepth_factor = Panel("2.6")
finish_pass_width_rack = Panel("0.1")
stepover_rack = Panel("0.12")
ramp_angle = Panel("0.8")
chipload_rack_milling = Panel("0.06")
finish_pass_width_pocket_and_cut = Panel("0.1")
passdepth_factor_2 = Panel("3.2")
rpm = Panel("18000")
number_of_flutes = Panel("1")
arc_diamter_factor_cutout = Panel("2.3")
stepover_pocket_and_cut = Panel("0.14")
rack_milling_bit_diamter = Panel("2")
chipload_pocket_and_cut = Panel("0.06")
rpm_pocekt_and_cut = Panel("18000")
pocket_and_cutout_bit_diameter = Panel("3")
number_of_flutes_2 = Panel("2")
chamfer_line_overshoot = Panel("0.6")
hole_grid_distance = Panel("70")
hole_diameter = Panel("5.2")
screw_pocket_diameter = Panel("12.5")
center_screw_pocket_depth = Panel("8")
rack_tooth_height = Panel("4")
pinion_clearance_margin = Panel("4.5")
edge_screw_pocket_depth = Panel("6")

motor_type = ValueList({"Nema17": 0, "Nema23": 1}, selected="Nema23")
axis_length = Panel("300")
axis_width = Panel("127")
material_thickness = Panel("8")
chamfer_distance = Panel("4")
corner_fillet_radius = Panel("5")

multiplication = Multiplication(A=rack_milling_bit_diamter, B=passdepth_factor)
feedrate_calculator = FeedrateCalculator(
    spindle_rpm=rpm,
    milling_bit_diameter=rack_milling_bit_diamter,
    number_of_flutes=number_of_flutes,
    chip_load=chipload_rack_milling,
    max_stepover=stepover_rack,
    ramp_feed_reduction_factor=0.5)  # -> feedrate_4, ramp_feedrate_2, feedback_3
feedrate_calculator_for_arcs = FeedrateCalculatorForArcs(
    spindle_rpm=rpm_pocekt_and_cut,
    milling_bit_diameter=pocket_and_cutout_bit_diameter,
    arc_diameter_factor=arc_diamter_factor_cutout,
    number_of_flutes=number_of_flutes_2,
    chip_load=chipload_pocket_and_cut,
    max_stepover=stepover_pocket_and_cut,
    ramp_feed_reduction_factor=0.5)  # -> arc_compensated_feedrate_3, ramp_feedrate_2, feedback_3
pinion_tooth_spacing_factor = Slider(-0.131945, range=-1..1)
pinion_tooth_spacing_factor_2 = Slider(-0.107142, range=-1..1)
multiplication_2 = Multiplication(A=pocket_and_cutout_bit_diameter, B=passdepth_factor_2)
feedrate_calculator_2 = FeedrateCalculator(
    spindle_rpm=rpm_pocekt_and_cut,
    milling_bit_diameter=pocket_and_cutout_bit_diameter,
    number_of_flutes=number_of_flutes_2,
    chip_load=chipload_pocket_and_cut,
    max_stepover=stepover_pocket_and_cut,
    ramp_feed_reduction_factor=0.5)  # -> feedrate_4, ramp_feedrate_2, feedback_3
motor_shaft_diameter = Slider(5, range=0..10)
motor_shaft_diameter_2 = Slider(8, range=0..10)
tooth_fillet_ratio = Slider(0.22, range=0..1)
tooth_fillet_ratio_2 = Slider(0.29, range=0..1)
passdepth_rack_milling = Panel(multiplication)
passdepth_pocket_and_cut_milling = Panel(multiplication_2)
milling_bit_diameter = Panel("3.2")
number_of_pinion_teeth = Panel("6")
gear_ratio_rotary_axis = Panel("8")
milling_bit_diameter_2 = Panel("4.2")
feedrate_for_rack_milling = Panel(feedrate_calculator.feedrate_4)
feedrate_for_pocket_and_cut_milling = Panel(feedrate_calculator_2.feedrate_4)
feedrate_for_pocket_and_cut_milling_2 = Panel(feedrate_calculator_for_arcs.arc_compensated_feedrate_3)
filter = StreamFilter(Gate=motor_type, Stream0=motor_shaft_diameter, Stream1=motor_shaft_diameter_2)
filter_2 = StreamFilter(Gate=motor_type, Stream0=tooth_fillet_ratio, Stream1=tooth_fillet_ratio_2)
filter_3 = StreamFilter(Gate=motor_type, Stream0=milling_bit_diameter, Stream1=milling_bit_diameter_2)
filter_4 = StreamFilter(Gate=motor_type, Stream0=pinion_tooth_spacing_factor, Stream1=pinion_tooth_spacing_factor_2)
division = Division(A="6", B="4.444")

# ---- group: Make rack and pinion geometry
roller_rack_and_pinion_maker = RollerRackAndPinionMaker(
    number_of_pinion_teeth=number_of_pinion_teeth,
    milling_bit_diameter=filter_3,
    tooth_fillet_ratio=filter_2,
    pinion_tooth_spacing_factor=filter_4,
    motor_shaft_diameter=filter)  # -> rack_teeth_4, pinion_teeth_4, pinion_center_hole_3, pinion_edge_3, steps_per_mm_2, maxium_pinion_milling_bit_diamter_4, pinion_movement_preview_3

# ----
panel = Panel(division)

# ---- group: Make grid spacing half for narrow rails
smaller = SmallerThan(FirstNumber=axis_width, SecondNumber=hole_grid_distance)  # -> SmallerThan, OrEqualTo
division_2 = Division(A=hole_grid_distance, B="2")
filter_5 = StreamFilter(Gate=smaller.SmallerThan, Stream0=hole_grid_distance, Stream1=division_2)
hole_grid_distance_x = Panel(hole_grid_distance)
hole_grid_distance_y = Panel(filter_5)

# ---- group: Make inside gear for rotary axis
multiplication_3 = Multiplication(A=number_of_pinion_teeth, B=gear_ratio_rotary_axis)
inside_gear_for_pinion_maker = InsideGearForPinionMaker(
    number_of_gear_teeth=multiplication_3,
    milling_bit_diameter=filter_3,
    number_of_input_pinion_teeth=number_of_pinion_teeth,
    pinion_teeth_curve=roller_rack_and_pinion_maker.pinion_teeth_4,
    pinion_center_hole_curve=roller_rack_and_pinion_maker.pinion_center_hole_3,
    tooth_fillet_ratio=".24",
    preview_position_0_1=Slider(0, range=0..1))  # -> gear_teeth_4, gear_center_hole_3, gear_movement_preview_3, pinion_movement_preview_3
crv = Curve(inside_gear_for_pinion_maker.pinion_movement_preview_3)
crv_2 = Curve([inside_gear_for_pinion_maker.gear_center_hole_3, inside_gear_for_pinion_maker.gear_teeth_4])

# ---- group: Make points for axis profile
material_thickness_2 = Panel(material_thickness)
chamfer_distance_2 = Panel(chamfer_distance)
axis_width_2 = Panel(axis_width)
multiplication_4 = Multiplication(A=axis_width_2, B="0.5")
subtraction = Subtraction(A=multiplication_4, B=chamfer_distance_2)
neg = Negative(Value=multiplication_4)
neg_2 = Negative(Value=chamfer_distance_2)
neg_3 = Negative(Value=multiplication_4)
neg_4 = Negative(Value=material_thickness_2)
neg_5 = Negative(Value=subtraction)
pt = ConstructPoint(XCoordinate=0, YCoordinate=subtraction, ZCoordinate=0)
pt_2 = ConstructPoint(XCoordinate=0, YCoordinate=neg_5, ZCoordinate=0)
pt_3 = ConstructPoint(XCoordinate=0, YCoordinate=multiplication_4, ZCoordinate=neg_4)
pt_4 = ConstructPoint(XCoordinate=0, YCoordinate=neg_3, ZCoordinate=neg_4)
pt_5 = ConstructPoint(XCoordinate=0, YCoordinate=multiplication_4, ZCoordinate=neg_2)
pt_6 = ConstructPoint(XCoordinate=0, YCoordinate=neg, ZCoordinate=neg_2)
merge = Merge(Data1=pt, Data2=pt_2, Data3=pt_6, Data4=pt_4, Data5=pt_3, Data6=pt_5)
pline = PolyLine(Vertices=merge, Closed=True)
axis_profile = Curve(pline)

# ----
rack_teeth = Curve(roller_rack_and_pinion_maker.rack_teeth_4)
item = ListItem(List=flatten(rack_teeth), Index=0, Wrap=True)

# ---- group: Find number of teeth needed for axis length
end = EndPoints(Curve=item)  # -> Start, End
dist = Distance(PointA=end.Start, PointB=end.End)
axis_length_2 = Panel(axis_length)
tooth_spacing = Panel(dist)
division_3 = Division(A=axis_length_2, B=tooth_spacing)
round = Round(Number=division_3)  # -> Nearest, Floor, Ceiling
number_of_teeth_in_axis = Panel(round.Ceiling)

# ---- group: Move first tooth to axis edge
pdecon = Deconstruct(Point=end.Start)  # -> XComponent, YComponent, ZComponent
pt_7 = ConstructPoint(XCoordinate=0, YCoordinate=pdecon.YComponent, ZCoordinate=pdecon.ZComponent)
vec2pt = Vector2Pt(PointA=end.Start, PointB=pt_7, Unitize=False)  # -> Vector, Length
move = Move(Geometry=item, Motion=vec2pt.Vector)  # -> Geometry, Transform

# ---- group: Prep pinion position
move_2 = Move(Geometry=roller_rack_and_pinion_maker.pinion_center_hole_3, Motion=vec2pt.Vector)  # -> Geometry, Transform
move_3 = Move(Geometry=roller_rack_and_pinion_maker.pinion_teeth_4, Motion=vec2pt.Vector)  # -> Geometry, Transform
pinion = Curve(flatten([move_3.Geometry, move_2.Geometry]))

# ---- group: Copy and join teeth for axis
series = Series(Start=0, Step=tooth_spacing, Count=number_of_teeth_in_axis)
X = UnitX(Factor=series)
move_4 = Move(Geometry=move.Geometry, Motion=X)  # -> Geometry, Transform
join = JoinCurves(Curves=move_4.Geometry, Preserve=False)
rack_teeth_2 = Curve(join)

# ---- group: Extrude axis
axis_length_3 = Panel(axis_length)
axis_profile_2 = Curve(axis_profile)
X_2 = UnitX(Factor=axis_length_3)
extr = Extrude(Base=axis_profile_2, Direction=X_2)
cap = CapHoles(Brep=extr)
axis_stock = Brep(cap)

# ---- group: Make rack pocket outline
pinion_clearance_margin_2 = Panel(pinion_clearance_margin)
rack_teeth_3 = Curve(rack_teeth_2)
pinion_2 = Curve(pinion)
bbox = BoundingBox(Content=flatten([pinion_2, rack_teeth_3]), Plane=PlaneXY(0, 0, 0), UnionBox=True)  # -> Box, Box_2
edges = BrepEdges(Brep=bbox.Box)  # -> Naked, Interior, NonManifold
Y = UnitY(Factor=pinion_clearance_margin_2)
item_2 = ListItem(List=edges.Naked, Index="2", Wrap=True)
move_5 = Move(Geometry=item_2, Motion=Y)  # -> Geometry, Transform
end_2 = EndPoints(Curve=move_5.Geometry)  # -> Start, End
end_3 = EndPoints(Curve=rack_teeth_3)  # -> Start, End
merge_2 = Merge(Data1=flatten(end_3.Start), Data2=flatten(end_2.End), Data3=flatten(end_2.Start), Data4=flatten(end_3.End))
multiplication_5 = Multiplication(A=pinion_clearance_margin_2, B="0.5")
pline_2 = PolyLine(Vertices=merge_2, Closed=False)
neg_6 = Negative(Value=multiplication_5)
join_2 = JoinCurves(Curves=flatten([rack_teeth_3, pline_2]), Preserve=False)
Y_2 = UnitY(Factor=neg_6)
move_6 = Move(Geometry=join_2, Motion=Y_2)  # -> Geometry, Transform
rack_pocket_outline = Curve(move_6.Geometry)

# ---- group: Create holes
pinion_clearance_margin_3 = Panel(pinion_clearance_margin)
hole_diameter_2 = Panel(hole_diameter)
screw_pocket_diameter_2 = Panel(screw_pocket_diameter)
hole_grid_distance_x_2 = Panel(hole_grid_distance_x)
hole_grid_distance_y_2 = Panel(hole_grid_distance_y)
axis_length_4 = Panel(axis_length)
rack_pocket_outline_2 = Curve(rack_pocket_outline)
rack_teeth_4 = Curve(rack_teeth_2)
multiplication_6 = Multiplication(A=pinion_clearance_margin_3, B="0.5")
bbox_2 = BoundingBox(Content=flatten(rack_pocket_outline_2), Plane=PlaneXY(0, 0, 0), UnionBox=True)  # -> Box, Box_2
neg_7 = Negative(Value=multiplication_6)
division_4 = Division(A=axis_length_4, B=hole_grid_distance_x_2)
bbox_3 = BoundingBox(Content=flatten(rack_teeth_4), Plane=PlaneXY(0, 0, 0), UnionBox=True)  # -> Box, Box_2
multiplication_7 = Multiplication(A=hole_diameter_2, B="0.5")
multiplication_8 = Multiplication(A=screw_pocket_diameter_2, B="0.5")
Y_3 = UnitY(Factor=neg_7)
round_2 = Round(Number=division_4)  # -> Nearest, Floor, Ceiling
addition = Addition(A=round_2.Floor, B="1")
move_7 = Move(Geometry=bbox_3.Box, Motion=Y_3)  # -> Geometry, Transform
multiplication_9 = Multiplication(A=round_2.Floor, B=hole_grid_distance_x_2)
edges_2 = BrepEdges(Brep=bbox_2.Box)  # -> Naked, Interior, NonManifold
edges_3 = BrepEdges(Brep=move_7.Geometry)  # -> Naked, Interior, NonManifold
subtraction_2 = Subtraction(A=axis_length_4, B=multiplication_9)
item_3 = ListItem(List=edges_2.Naked, Index=2, Wrap=True)
item_4 = ListItem(List=edges_3.Naked, Index=2, Wrap=True)
multiplication_10 = Multiplication(A=subtraction_2, B="0.5")
multiplication_11 = Multiplication(A=hole_grid_distance_y_2, B="0.5")
bbox_4 = BoundingBox(Content=flatten([item_3, item_4]), Plane=PlaneXY(0, 0, 0), UnionBox=True)  # -> Box, Box_2
neg_8 = Negative(Value=multiplication_11)
area = Area(Geometry=bbox_4.Box)  # -> Area, Centroid
pt_8 = ConstructPoint(XCoordinate=multiplication_10, YCoordinate=neg_8, ZCoordinate=0)
xy = XYPlane(Origin=pt_8)
pdecon_2 = Deconstruct(Point=area.Centroid)  # -> XComponent, YComponent, ZComponent
recgrid = Rectangular(Plane=xy, SizeX=hole_grid_distance_x_2, SizeY=hole_grid_distance_y_2, ExtentX=round_2.Floor, ExtentY="1")  # -> Cells, Points
addition_2 = Addition(A=multiplication_11, B=pdecon_2.YComponent)
xy_2 = XYPlane(Origin=recgrid.Points)
Y_4 = UnitY(Factor=addition_2)
cir = Circle(Plane=xy_2, Radius=multiplication_8)
cir_2 = Circle(Plane=xy_2, Radius=multiplication_7)
item_5 = ListItem(List=cir_2, Index=0, Wrap=True)
item_6 = ListItem(List=cir, Index=0, Wrap=True)
move_8 = Move(Geometry=item_6, Motion=Y_4)  # -> Geometry, Transform
move_9 = Move(Geometry=item_5, Motion=Y_4)  # -> Geometry, Transform
screw_pockets_edges = Curve(cir)
screw_pockets_center = Curve(move_8.Geometry)
screw_holes_center = Curve(move_9.Geometry)
screw_holes_edges = Curve(cir_2)
hole_pattern_along_edges = Panel(make_hole_pattern_along_edges)
hole_pattern_along_center = Panel(make_hole_pattern_along_center)
filter_6 = StreamFilter(Gate=hole_pattern_along_center, Stream1=screw_holes_center)
filter_7 = StreamFilter(Gate=hole_pattern_along_center, Stream1=screw_pockets_center)
filter_8 = StreamFilter(Gate=hole_pattern_along_edges, Stream1=screw_holes_edges)
filter_9 = StreamFilter(Gate=hole_pattern_along_edges, Stream1=screw_pockets_edges)

# ---- group: Prep geometry and settings for pocket milling
edges_4 = BrepEdges(Brep=bbox_4.Box)  # -> Naked, Interior, NonManifold
finish_pass_width_pocket_and_cut_2 = Panel(finish_pass_width_pocket_and_cut)
pocket_and_cutout_bit_diameter_2 = Panel(pocket_and_cutout_bit_diameter)
pocket_line_overshoot = Panel("1")
item_7 = ListItem(List=edges_4.Naked, Index=3, Wrap=True)
item_8 = ListItem(List=edges_4.Naked, Index=1, Wrap=True)
item_9 = ListItem(List=edges_4.Naked, Index=3, Wrap=True)
len = Length(Curve=item_9)
multiplication_12 = Multiplication(A=finish_pass_width_pocket_and_cut_2, B="2")
eval = EvaluateLength(Curve=item_8, Length="0.5", Normalized=True)  # -> Point, Tangent, Parameter
eval_2 = EvaluateLength(Curve=item_7, Length="0.5", Normalized=True)  # -> Point, Tangent, Parameter
ln = Line(StartPoint=eval_2.Point, EndPoint=eval.Point)
subtraction_3 = Subtraction(A=flatten(len), B=flatten(multiplication_12))
ext = ExtendCurve(Curve=ln, Type=0, Start=pocket_line_overshoot, End=pocket_line_overshoot)
pocket_slot_width = Panel(subtraction_3)
division_5 = Division(A=pocket_slot_width, B=pocket_and_cutout_bit_diameter_2)
arc_diameter_factor_pocket = Panel(division_5)
feedrate_calculator_for_arcs_2 = FeedrateCalculatorForArcs(
    spindle_rpm=rpm_pocekt_and_cut,
    milling_bit_diameter=pocket_and_cutout_bit_diameter,
    arc_diameter_factor=arc_diameter_factor_pocket,
    number_of_flutes=number_of_flutes_2,
    chip_load=chipload_pocket_and_cut,
    max_stepover=stepover_pocket_and_cut,
    ramp_feed_reduction_factor=0.5)  # -> arc_compensated_feedrate_3, ramp_feedrate_2, feedback_3
feedrate_for_pocket_and_cut_milling_3 = Panel(feedrate_calculator_for_arcs_2.arc_compensated_feedrate_3)
pocket_clearing_center_line = Curve(ext)
arc_diameter_factor_pocket_2 = Panel(division_5)

# ----
stepover_rack_2 = Panel(stepover_rack)
rack_milling_bit_diamter_2 = Panel(rack_milling_bit_diamter)
finish_pass_width_rack_2 = Panel(finish_pass_width_rack)
make_cnc_toolpaths_2 = Panel(make_cnc_toolpaths)
filter_10 = StreamFilter(Gate=make_cnc_toolpaths_2, Stream1=roller_rack_and_pinion_maker.rack_teeth_4)
high_speed_rack_milling_toolpaths = HighSpeedRackMillingToolpaths(
    rack_teeth=filter_10,
    milling_bit_diameter=rack_milling_bit_diamter_2,
    stepover=stepover_rack_2,
    final_pass_width=finish_pass_width_rack_2)
item_10 = ListItem(List=flatten(high_speed_rack_milling_toolpaths), Index=0, Wrap=True)

# ---- group: Filter geometry
gemotry_output_type = Panel(output_geometry_type)
gate = StreamGate(Stream=filter_7, Gate=gemotry_output_type)  # -> Target0, Target1
gate_2 = StreamGate(Stream=rack_pocket_outline, Gate=gemotry_output_type)  # -> Target0, Target1
gate_3 = StreamGate(Stream=filter_8, Gate=gemotry_output_type)  # -> Target0, Target1
gate_4 = StreamGate(Stream=filter_9, Gate=gemotry_output_type)  # -> Target0, Target1
gate_5 = StreamGate(Stream=filter_6, Gate=gemotry_output_type)  # -> Target0, Target1

# ---- group: Subtract pocket from axis extrusion
rack_pocket_outline_3 = Curve(gate_2.Target1)
axis_stock_2 = Brep(axis_stock)
material_thickness_3 = Panel(material_thickness)
center_screw_pocket_depth_2 = Panel(center_screw_pocket_depth)
rack_tooth_height_2 = Panel(rack_tooth_height)
screw_holes_edges_2 = Curve(gate_3.Target1)
screw_pockets_edges_2 = Curve(gate_4.Target1)
screw_holes_center_2 = Curve(gate_5.Target1)
screw_pockets_center_2 = Curve(gate.Target1)
edge_screw_pocket_depth_2 = Panel(edge_screw_pocket_depth)
neg_9 = Negative(Value=material_thickness_3)
neg_10 = Negative(Value=rack_tooth_height_2)
neg_11 = Negative(Value=edge_screw_pocket_depth_2)
neg_12 = Negative(Value=center_screw_pocket_depth_2)
Z = UnitZ(Factor=neg_9)
Z_2 = UnitZ(Factor=neg_10)
Z_3 = UnitZ(Factor=neg_11)
Z_4 = UnitZ(Factor=neg_12)
extr_2 = Extrude(Base=[screw_holes_edges_2, screw_holes_center_2], Direction=Z)
extr_3 = Extrude(Base=rack_pocket_outline_3, Direction=Z_2)
extr_4 = Extrude(Base=screw_pockets_edges_2, Direction=Z_3)
extr_5 = Extrude(Base=screw_pockets_center_2, Direction=Z_4)
cap_2 = CapHoles(Brep=extr_3)
cap_3 = CapHoles(Brep=extr_2)
cap_4 = CapHoles(Brep=[extr_4, extr_5])
rack_pocket = Brep(cap_2)
sdiff = SolidDifference(BrepsA=axis_stock_2, BrepsB=rack_pocket)
sdiff_2 = SolidDifference(BrepsA=sdiff, BrepsB=flatten(cap_3))
sdiff_3 = SolidDifference(BrepsA=sdiff_2, BrepsB=flatten(cap_4))
item_11 = ListItem(List=flatten(sdiff_3), Index=0, Wrap=True)
null = NullItem(Item=item_11)  # -> NullFlags, InvalidFlags, Description
filter_11 = StreamFilter(Gate=null.NullFlags, Stream0=sdiff_3, Stream1=sdiff)
axis_brep = Brep(filter_11)

# ---- group: Extend rack pocket
tooth_spacing_2 = Panel(tooth_spacing)
rack_pocket_outline_4 = Curve(gate_2.Target0)
bbox_5 = BoundingBox(Content=rack_pocket_outline_4, Plane=PlaneXY(0, 0, 0))  # -> Box, Box_2
neg_13 = Negative(Value=tooth_spacing_2)
debrep = DeconstructBrep(Brep=bbox_5.Box)  # -> Faces, Edges, Vertices
X_3 = UnitX(Factor=neg_13)
item_12 = ListItem(List=debrep.Edges, Index=3, Wrap=True)
end_4 = EndPoints(Curve=item_12)  # -> Start, End
area_2 = Area(Geometry=bbox_5.Box)  # -> Area, Centroid
move_10 = Move(Geometry=end_4.Start, Motion=X_3)  # -> Geometry, Transform
move_11 = Move(Geometry=end_4.End, Motion=X_3)  # -> Geometry, Transform
yz = YZPlane(Origin=area_2.Centroid)
merge_3 = Merge(Data2=end_4.End, Data3=move_11.Geometry, Data4=move_10.Geometry, Data5=end_4.Start)
pline_3 = PolyLine(Vertices=merge_3, Closed=False)
mirror = Mirror(Geometry=pline_3, Plane=yz)  # -> Geometry, Transform
rack_pocket_outline_5 = Curve(rack_pocket_outline_4)
end_5 = EndPoints(Curve=flatten([mirror.Geometry, pline_3]))  # -> Start, End
runion = RegionUnion(Curves=flatten([mirror.Geometry, pline_3, rack_pocket_outline_4]))  # disabled
crv_cp = CurveClosestPoint(Point=flatten([end_5.Start, end_5.End]), Curve=flatten(rack_pocket_outline_5))  # -> Point, Parameter, Distance
shatter = Shatter(Curve=rack_pocket_outline_5, Parameters=crv_cp.Parameter)
dispatch = Dispatch(List=shatter, DispatchPattern=[True, False])  # -> ListA, ListB
join_3 = JoinCurves(Curves=flatten([dispatch.ListB, pline_3, mirror.Geometry]), Preserve=False)
item_13 = ListItem(List=dispatch.ListB, Index=1, Wrap=True)
rack_engrave_curve = Curve(item_13)
rack_pocket_extended = Curve(join_3)

# ----
pocket_and_cutout_bit_diameter_3 = Panel(pocket_and_cutout_bit_diameter)
ramp_angle_2 = Panel(ramp_angle)
stepover_pocket_and_cut_2 = Panel(stepover_pocket_and_cut)
edge_screw_pocket_depth_3 = Panel(edge_screw_pocket_depth)
center_screw_pocket_depth_3 = Panel(center_screw_pocket_depth)
material_thickness_4 = Panel(material_thickness)
additional_cut_depth = Panel("0.6")
screw_pockets_center_3 = Curve(filter_7)
screw_pockets_edges_3 = Curve(filter_9)
screw_holes_center_3 = Curve(filter_6)
screw_holes_edges_3 = Curve(filter_8)
addition_3 = Addition(A=material_thickness_4, B=additional_cut_depth)
neg_14 = Negative(Value=edge_screw_pocket_depth_3)
neg_15 = Negative(Value=center_screw_pocket_depth_3)
Z_5 = UnitZ(Factor=neg_14)
Z_6 = UnitZ(Factor=neg_15)
subtraction_4 = Subtraction(A=addition_3, B=edge_screw_pocket_depth_3)
move_12 = Move(Geometry=screw_holes_edges_3, Motion=Z_5)  # -> Geometry, Transform
move_13 = Move(Geometry=screw_holes_center_3, Motion=Z_6)  # -> Geometry, Transform
subtraction_5 = Subtraction(A=addition_3, B=center_screw_pocket_depth_3)
variable_helix_pocket = VariableHelixPocket(
    circles_for_variable_helix_pocket=screw_pockets_edges_3,
    milling_bit_diameter=pocket_and_cutout_bit_diameter_3,
    pocket_depth=edge_screw_pocket_depth_3,
    stepover=stepover_pocket_and_cut_2,
    ramp_angle=ramp_angle_2)  # disabled
variable_helix_pocket_2 = VariableHelixPocket(
    circles_for_variable_helix_pocket=screw_pockets_center_3,
    milling_bit_diameter=pocket_and_cutout_bit_diameter_3,
    pocket_depth=center_screw_pocket_depth_3,
    stepover=stepover_pocket_and_cut_2,
    ramp_angle=ramp_angle_2)  # disabled
variable_helix_pocket_3 = VariableHelixPocket(
    circles_for_variable_helix_pocket=move_12.Geometry,
    milling_bit_diameter=pocket_and_cutout_bit_diameter_3,
    pocket_depth=subtraction_4,
    stepover=stepover_pocket_and_cut_2,
    ramp_angle=ramp_angle_2)  # disabled
# fix climb conventional
variable_helix_pocket_4 = VariableHelixPocket(
    circles_for_variable_helix_pocket=move_13.Geometry,
    milling_bit_diameter=pocket_and_cutout_bit_diameter_3,
    pocket_depth=subtraction_5,
    stepover=stepover_pocket_and_cut_2,
    ramp_angle=ramp_angle_2)  # disabled
merge_4 = Merge(Data1=variable_helix_pocket, Data2=variable_helix_pocket_2, Data3=variable_helix_pocket_3, Data4=variable_helix_pocket_4)
hole_toolpaths = Curve(merge_4)

pocket_and_cutout_bit_diameter_4 = Panel(pocket_and_cutout_bit_diameter)
passdepth_pocket_and_cut_milling_2 = Panel(passdepth_pocket_and_cut_milling)
stepover_pocket_and_cut_3 = Panel(stepover_pocket_and_cut)
ramp_angle_3 = Panel(ramp_angle)
rack_tooth_height_3 = Panel(rack_tooth_height)
engrave = Engrave(engrave_curves=pocket_clearing_center_line, cut_depth=rack_tooth_height_3, pass_depth=passdepth_pocket_and_cut_milling_2)
trochoidal_high_speed_milling = TrochoidalHighSpeedMilling(
    toolpath_curves=engrave,
    milling_bit_diameter=pocket_and_cutout_bit_diameter_4,
    arc_diameter_factor=arc_diameter_factor_pocket_2,
    stepover=stepover_pocket_and_cut_3,
    feedrate=50,
    jograte=60,
    ramp_entry_feedrate=25,
    make_helical_entry=True,
    ramp_angle=ramp_angle_3,
    jog_z_lift_factor=0.1,
    use_climb_milling=True,
    straight_arc_extensions=True)  # -> toolpaths_3, feedrates_3, feedback_3; disabled
pocket_roughing_toolpath = Curve(trochoidal_high_speed_milling.toolpaths_3)

rack_engrave_curve_2 = Curve(rack_engrave_curve)
offset = Offset(Curve=rack_engrave_curve_2, Distance=1, Plane=PlaneXY(0, 0, 0), Corners=1)  # disabled
len_2 = Length(Curve=rack_engrave_curve_2)
feedrate_for_pocket_and_cut_milling_4 = Panel(feedrate_for_pocket_and_cut_milling_3)
division_6 = Division(A=len_2, B="8")
feedrate_for_rack_milling_2 = Panel(feedrate_for_rack_milling)
len_3 = Length(Curve=pocket_roughing_toolpath)
len_4 = Length(Curve=hole_toolpaths)
feedrate_for_pocket_and_cut_milling_5 = Panel(feedrate_for_pocket_and_cut_milling_2)
ma = MassAddition(Input=len_3)  # -> Result, PartialResults
ma_2 = MassAddition(Input=len_4)  # -> Result, PartialResults
feedrate_for_hole_milling = Panel(feedrate_for_pocket_and_cut_milling_2)
pocket_and_cutout_bit_diameter_5 = Panel(pocket_and_cutout_bit_diameter)
rpm_pocekt_and_cut_2 = Panel(rpm_pocekt_and_cut)
division_7 = Division(A=ma.Result, B=feedrate_for_pocket_and_cut_milling_4)
division_8 = Division(A=ma_2.Result, B=feedrate_for_hole_milling)
gemotry_output_type_2 = Panel(output_geometry_type)
multiplication_13 = Multiplication(A=feedrate_for_hole_milling, B="0.5")
cnc_milling_postprocessor = CNCMillingPostProcessor(
    toolpath_curves=hole_toolpaths,
    feed_rate=feedrate_for_hole_milling,
    plunge_rate=multiplication_13,
    safe_z_height=6,
    use_spindle=1,
    spindle_speed=rpm_pocekt_and_cut_2,
    ramp_plunges=0,
    ramp_angle=25,
    use_custom_jog_home=0,
    custom_home_x=612,
    custom_home_y=612,
    deviation_tolerance="0.01",
    milling_bit_diameter=pocket_and_cutout_bit_diameter_5,
    job_name="Bark beetle toolpath")  # -> toolpath_preview_curves_3, tab_cleanup_preview_curves_3, cut_transition_preview_lines_3, cut_entry_preview_lines_3, cut_exit_preview_lines_3, shopbot_code_connect_panel_stream_and_sa, tab_cleanup_code_connect_panel_stream_an; disabled
crv_3 = Curve([cnc_milling_postprocessor.toolpath_preview_curves_3, cnc_milling_postprocessor.cut_entry_preview_lines_3, cnc_milling_postprocessor.cut_exit_preview_lines_3, cnc_milling_postprocessor.cut_transition_preview_lines_3])
panel_2 = Panel(cnc_milling_postprocessor.shopbot_code_connect_panel_stream_and_sa)
preview = CustomPreview(Geometry=crv_3, Shader=ColourSwatch(SwatchColor=RGB(230, 0, 255)))

# ---- group: 3D
axis_brep_2 = Brep(axis_brep)

# ---- group: Copy and join teeth toolpaths
neg_16 = Negative(Value=tooth_spacing)
addition_4 = Addition(A=number_of_teeth_in_axis, B="1")
X_4 = UnitX(Factor=neg_16)
series_2 = Series(Start=0, Step=tooth_spacing, Count=addition_4)
move_14 = Move(Geometry=item_10, Motion=vec2pt.Vector)  # -> Geometry, Transform
X_5 = UnitX(Factor=series_2)

# ----
move_15 = Move(Geometry=move_14.Geometry, Motion=X_4)  # -> Geometry, Transform

# ---- group: Copy and join teeth toolpaths (continued)
move_16 = Move(Geometry=move_15.Geometry, Motion=X_5)  # -> Geometry, Transform
join_4 = JoinCurves(Curves=move_16.Geometry, Preserve=False)

# ----
move_17 = Move(Geometry=join_4, Motion=Y_2)  # -> Geometry, Transform

# ---- group: Copy and join teeth toolpaths (continued)
rack_roughing_toolpaths = Curve(move_17.Geometry)

# ---- group: Make pass depth for rack roughing
passdepth_rack_milling_2 = Panel(passdepth_rack_milling)
rack_tooth_height_4 = Panel(rack_tooth_height)
floor_margin = Panel("0.1")
rack_roughing_toolpaths_2 = Curve(rack_roughing_toolpaths)
subtraction_6 = Subtraction(A=rack_tooth_height_4, B=floor_margin)
engrave_2 = Engrave(engrave_curves=rack_roughing_toolpaths_2, cut_depth=subtraction_6, pass_depth=passdepth_rack_milling_2)

# ----
len_5 = Length(Curve=engrave_2)
division_9 = Division(A=len_5, B=feedrate_for_rack_milling_2)

chamfer_line_overshoot_2 = Panel(chamfer_line_overshoot)
neg_17 = Negative(Value=chamfer_line_overshoot_2)
Y_5 = UnitY(Factor=neg_17)
xz = XZPlane(Origin=Point(0, 0, 0))

corner_fillet_radius_2 = Panel(corner_fillet_radius)
axis_stock_3 = Brep(axis_stock)
bbox_6 = BoundingBox(Content=axis_stock_3, Plane=PlaneXY(0, 0, 0))  # -> Box, Box_2
debrep_2 = DeconstructBrep(Brep=bbox_6.Box)  # -> Faces, Edges, Vertices
item_14 = ListItem(List=debrep_2.Faces, Index=5, Wrap=True)
edges_5 = BrepEdges(Brep=item_14)  # -> Naked, Interior, NonManifold
join_5 = JoinCurves(Curves=edges_5.Naked, Preserve=False)

item_15 = ListItem(List=debrep_2.Edges, Index=4, Wrap=True)
ext_2 = ExtendCurve(Curve=item_15, Type=0, Start=chamfer_line_overshoot_2, End=chamfer_line_overshoot_2)
addition_5 = Addition(A=chamfer_line_overshoot_2, B=corner_fillet_radius_2)
move_18 = Move(Geometry=ext_2, Motion=Y_5)  # -> Geometry, Transform
neg_18 = Negative(Value=addition_5)
end_6 = EndPoints(Curve=move_18.Geometry)  # -> Start, End
X_6 = UnitX(Factor=neg_18)
X_7 = UnitX(Factor=addition_5)
move_19 = Move(Geometry=end_6.Start, Motion=X_6)  # -> Geometry, Transform
move_20 = Move(Geometry=end_6.End, Motion=X_7)  # -> Geometry, Transform
xy_3 = XYPlane(Origin=move_20.Geometry)
xy_4 = XYPlane(Origin=move_19.Geometry)
arc = Arc(Plane=xy_4, Radius=addition_5, Angle=Domain(6.283185307, 4.71238898))  # -> Arc, Length
arc_2 = Arc(Plane=xy_3, Radius=addition_5, Angle=Domain(4.71238898, 3.141592654))  # -> Arc, Length
end_7 = EndPoints(Curve=arc.Arc)  # -> Start, End
end_8 = EndPoints(Curve=arc_2.Arc)  # -> Start, End
ln_2 = Line(StartPoint=end_7.End, EndPoint=end_8.Start)
join_6 = JoinCurves(Curves=[arc.Arc, ln_2, arc_2.Arc], Preserve=True)
Y_6 = UnitY(Factor=addition_5)
move_21 = Move(Geometry=join_6, Motion=Y_6)  # -> Geometry, Transform
mirror_2 = Mirror(Geometry=move_21.Geometry, Plane=xz)  # -> Geometry, Transform
flip = FlipCurve(Curve=mirror_2.Geometry)  # -> Curve, Flag
axis_chamfer_engrave_line = Curve([move_21.Geometry, flip.Curve])

axis_chamfer_engrave_line_2 = Curve(axis_chamfer_engrave_line)
fillet = Fillet(Curve=join_5, Radius=corner_fillet_radius_2)

axis_outline = Curve(fillet)

axis_outline_2 = Curve(axis_outline)
passdepth_pocket_and_cut_milling_3 = Panel(passdepth_pocket_and_cut_milling)
pocket_and_cutout_bit_diameter_6 = Panel(pocket_and_cutout_bit_diameter)
arc_diamter_factor_cutout_2 = Panel(arc_diamter_factor_cutout)
stepover_pocket_and_cut_4 = Panel(stepover_pocket_and_cut)
ramp_angle_4 = Panel(ramp_angle)
multiplication_14 = Multiplication(A=pocket_and_cutout_bit_diameter_6, B=arc_diamter_factor_cutout_2)
cutout = CutoutOrProfile(
    curves_for_cutout=axis_outline_2,
    cut_depth=addition_3,
    pass_depth=passdepth_pocket_and_cut_milling_3,
    tool_diameter=multiplication_14,
    cutout_tolerance="0",
    use_climb_direction=Toggle(False),
    use_inside_cutting=Toggle(False))
trochoidal_high_speed_milling_2 = TrochoidalHighSpeedMilling(
    toolpath_curves=cutout,
    milling_bit_diameter=pocket_and_cutout_bit_diameter_6,
    arc_diameter_factor=arc_diamter_factor_cutout_2,
    stepover=stepover_pocket_and_cut_4,
    feedrate=50,
    jograte=60,
    ramp_entry_feedrate=25,
    make_helical_entry=True,
    ramp_angle=ramp_angle_4,
    jog_z_lift_factor=0.1,
    use_climb_milling=True,
    straight_arc_extensions=True)  # -> toolpaths_3, feedrates_3, feedback_3; disabled
cutout_toolpaths = Curve(trochoidal_high_speed_milling_2.toolpaths_3)

len_6 = Length(Curve=cutout_toolpaths)
ma_3 = MassAddition(Input=len_6)  # -> Result, PartialResults
division_10 = Division(A=ma_3.Result, B=feedrate_for_pocket_and_cut_milling_5)
gate_6 = StreamGate(Stream=axis_outline, Gate=gemotry_output_type_2)  # -> Target0, Target1
gate_7 = StreamGate(Stream=axis_chamfer_engrave_line, Gate=gemotry_output_type_2)  # -> Target0, Target1

# ---- group: Make 3D chamfer surfaces (very handy for high speed ball nose 3D milling with Bark Beetle)
axis_chamfer_engrave_line_3 = Curve(reparameterize(move_21.Geometry))
axis_length_5 = Panel(axis_length)
chamfer_distance_3 = Panel(chamfer_distance)
chamfer_line_overshoot_3 = Panel(chamfer_line_overshoot_2)
neg_19 = Negative(Value=chamfer_distance_3)
neg_20 = Negative(Value=chamfer_line_overshoot_3)
Z_7 = UnitZ(Factor=chamfer_line_overshoot_3)
addition_6 = Addition(A=neg_20, B=neg_19)
multiplication_15 = Multiplication(A=axis_length_5, B="0.5")
move_22 = Move(Geometry=axis_chamfer_engrave_line_3, Motion=Z_7)  # -> Geometry, Transform
addition_7 = Addition(A=chamfer_line_overshoot_3, B=chamfer_distance_3, C=chamfer_line_overshoot_3)
pt_9 = ConstructPoint(XCoordinate=multiplication_15, YCoordinate=0, ZCoordinate=0)
Z_8 = UnitZ(Factor=addition_6)
Y_7 = UnitY(Factor=addition_7)
xy_5 = XYPlane(Origin=pt_9)
move_23 = Move(Geometry=axis_chamfer_engrave_line_3, Motion=Z_8)  # -> Geometry, Transform
move_24 = Move(Geometry=move_22.Geometry, Motion=Y_7)  # -> Geometry, Transform
merge_5 = Merge(Data1=move_23.Geometry, Data2=move_24.Geometry)
loft = Loft(Curves=merge_5, Options={Adjust=False, Closed=False, LoftEnds=0, LoftSimp=0, LoftType=0, Rebuild=10, Refit=0.01})
rotate = Rotate(Geometry=loft, Angle=3.141592654, Plane=xy_5)  # -> Geometry, Transform
merge_6 = Merge(Data1=loft, Data2=rotate.Geometry)
chamfer_3d_surfaces = Surface(merge_6)

# ----
merge_7 = Merge(Data1=flatten(division_8), Data2=flatten(division_10), Data3=flatten(division_7), Data4=flatten(division_9))
panel_3 = Panel(merge_7)
ma_4 = MassAddition(Input=panel_3)  # -> Result, PartialResults
division_11 = Division(A=ma_4.Result, B="60")
minutes_to_mill = Panel(division_11)

# ---- group: 2D
rack_pocket_extended_2 = Curve(rack_pocket_extended)
axis_chamfer_engrave_line_4 = Curve(gate_7.Target0)
axis_outline_3 = Curve(gate_6.Target0)
screw_holes_edges_4 = Curve(gate_3.Target0)
screw_pockets_edges_4 = Curve(gate_4.Target0)
pinion_3 = Curve(flatten(pinion))
screw_holes_center_4 = Curve(gate_5.Target0)
screw_pockets_center_4 = Curve(gate.Target0)

# ----
chamfer_3d_surfaces_2 = Surface(chamfer_3d_surfaces)
# Bake this geometry
# to export
axis_geometry = Geometry([pinion_3, rack_pocket_extended_2, axis_chamfer_engrave_line_4, axis_outline_3, screw_holes_edges_4, screw_pockets_edges_4, chamfer_3d_surfaces_2, screw_holes_center_4, axis_brep_2])

# ---- group: Right click and choose "Bake" to save to Rhino
axis_geometry_2 = Geometry(axis_geometry)

# ==== cluster RollerRackAndPinionMaker: Makes rack and pinion gemetry suitable for 3 axis CNC milling. Has low backlash, but is vulnerable to contamination. More options inside component.
pinion_tooth_spacing_factor = ClusterInput()
number_of_pinion_teeth = ClusterInput()
motor_shaft_diameter = ClusterInput()
milling_bit_diameter = ClusterInput()
rack_length = ClusterInput()
tooth_fillet_ratio = ClusterInput()

# ---- group: Determines the travel distance of pinion
rack_length_2 = Panel("200")
rack_length_3 = Number(rack_length)
null = NullItem(Item=rack_length_3)  # -> NullFlags, InvalidFlags, Description
filter = StreamFilter(Gate=null.NullFlags, Stream0=rack_length_3, Stream1=rack_length_2)
rack_length_4 = Panel(filter)

# ---- group: Smaller amount of teeth gives higher resolution and more torque
number_of_pinion_teeth_2 = Panel("9")
number_of_pinion_teeth_3 = Number(number_of_pinion_teeth)
# default config for nema 23 and nema 17 stepper motors - january 2017: bit diamter: 2.8
# pinion tooth spacing factor: -0.1071428
# (gives optimal pinion size and 5mm rack tooth spacing)
# number of pinion teeth: 9
# fillet ratio: 0.2
# earlier config for 2mm pinion milling and 3mm rack milling - august 2016: bit diamter: 3.1
# pinion tooth spacing factor: -0.14
# number of pinion teeth: 10
# fillet ratio: 0.15
null_2 = NullItem(Item=number_of_pinion_teeth_3)  # -> NullFlags, InvalidFlags, Description
filter_2 = StreamFilter(Gate=null_2.NullFlags, Stream0=number_of_pinion_teeth_3, Stream1=number_of_pinion_teeth_2)
number_of_pinion_teeth_4 = Panel(filter_2)

# ---- group: Determines the tooth spacing, some margin recommended
milling_bit_diameter_2 = Panel("2.8")
milling_bit_diameter_3 = Number(milling_bit_diameter)
null_3 = NullItem(Item=milling_bit_diameter_3)  # -> NullFlags, InvalidFlags, Description
filter_3 = StreamFilter(Gate=null_3.NullFlags, Stream0=milling_bit_diameter_3, Stream1=milling_bit_diameter_2)
milling_bit_diameter_4 = Panel(filter_3)

# ---- group: Can be used to reduce or increase the pinion tooth spacing
pinion_tooth_spacing_factor_2 = Panel("-0.1071428")
pinion_tooth_spacing_factor_3 = Number(pinion_tooth_spacing_factor)
null_4 = NullItem(Item=pinion_tooth_spacing_factor_3)  # -> NullFlags, InvalidFlags, Description
filter_4 = StreamFilter(Gate=null_4.NullFlags, Stream0=pinion_tooth_spacing_factor_3, Stream1=pinion_tooth_spacing_factor_2)
pinion_tooth_spacing_factor_4 = Panel(filter_4)

# ---- group: The shaft diameter of the motor driving the pinion
motor_shaft_diameter_2 = Panel("8")
motor_shaft_diameter_3 = Number(motor_shaft_diameter)
null_5 = NullItem(Item=motor_shaft_diameter_3)  # -> NullFlags, InvalidFlags, Description
filter_5 = StreamFilter(Gate=null_5.NullFlags, Stream0=motor_shaft_diameter_3, Stream1=motor_shaft_diameter_2)
motor_shaft_diameter_4 = Panel(filter_5)

# ---- group: Low fillet ratio gives smoother motion, but makes a less robust pinion
tooth_fillet_ratio_2 = Panel("0.2")
tooth_fillet_ratio_3 = Number(tooth_fillet_ratio)
null_6 = NullItem(Item=tooth_fillet_ratio_3)  # -> NullFlags, InvalidFlags, Description
filter_6 = StreamFilter(Gate=null_6.NullFlags, Stream0=tooth_fillet_ratio_3, Stream1=tooth_fillet_ratio_2)
tooth_fillet_ratio_4 = Panel(filter_6)

# ----
preview_position_0_1 = ClusterInput()
preview_position = Slider(0.25, range=0..1)

# ---- group: Controlls pinion tooth blending
rounding_factor_pinion_outside = Slider(20, range=0..100)
rounding_factor_pinion_inside = Slider(70, range=0..100)

# ---- group: Start numbers to help calculte pinion tooth path through rack
number_of_curve_sample_points = Slider(20, range=0..1000)
sample_tooth_position = Panel("0.26")

# ---- group: Lower number gives more clearene between rack tooth and pinion valley
pinion_corner_tolerance_factor = Panel("15")

# ---- group: Fill in for correct step statistics
number_of_stepper_motor_steps = Panel("200")
microstep_level = Panel("4")

# ----
preview_position_0_1_2 = Number(preview_position_0_1)

# ---- group: Prepare properties
multiplication = Multiplication(A=milling_bit_diameter_4, B=pinion_tooth_spacing_factor_4)
multiplication_2 = Multiplication(A=number_of_pinion_teeth_4, B=sample_tooth_position)
division = Division(A=milling_bit_diameter_4, B=pinion_corner_tolerance_factor)
addition = Addition(A=milling_bit_diameter_4, B=multiplication)
multiplication_3 = Multiplication(A=milling_bit_diameter_4, B="0.5")
multiplication_4 = Multiplication(A=motor_shaft_diameter_4, B="0.5")
round = Round(Number=multiplication_2)  # -> Nearest, Floor, Ceiling
multiplication_5 = Multiplication(A=number_of_pinion_teeth_4, B="2")
neg = Negative(Value=division)
multiplication_6 = Multiplication(A=milling_bit_diameter_4, B=tooth_fillet_ratio_4)
milling_bit_radius = Panel(multiplication_3)
xy = XYPlane(Origin=Point(0, 0, 0))
sample_tooth_number = Panel(round.Ceiling)
multiplication_7 = Multiplication(A=addition, B=multiplication_5)
tooth_fillet_radius = Panel(multiplication_6)
pinion_circumference = Panel(multiplication_7)
cir = Circle(Plane=xy, Radius=milling_bit_radius)
pi = Pi(Factor=1)
division_2 = Division(A=pinion_circumference, B=pi)
number_of_pinion_teeth_5 = Panel(number_of_pinion_teeth_4)
pinion_diameter = Panel(division_2)
sample_tooth_number_2 = Panel(sample_tooth_number)
number_of_curve_sample_points_2 = Panel(number_of_curve_sample_points)
multiplication_8 = Multiplication(A=pinion_diameter, B="0.5")
division_3 = Division(A=sample_tooth_number_2, B=number_of_pinion_teeth_5)
pinion_radius = Panel(multiplication_8)
pinion_circumference_2 = Panel(pinion_circumference)
multiplication_9 = Multiplication(A="360", B=division_3)
Y = UnitY(Factor=pinion_radius)
division_4 = Division(A="360", B=number_of_pinion_teeth_5)
division_5 = Division(A=multiplication_9, B=number_of_curve_sample_points_2)
multiplication_10 = Multiplication(A=pinion_circumference_2, B=division_3)
division_6 = Division(A=pinion_circumference, B=number_of_pinion_teeth_4)
move = Move(Geometry=xy, Motion=Y)  # -> Geometry, Transform
series = Series(Start=0, Step=division_4, Count=number_of_pinion_teeth_5)
division_7 = Division(A=multiplication_10, B=number_of_curve_sample_points_2)
series_2 = Series(Start=0, Step=division_5, Count=number_of_curve_sample_points_2)
tooth_spacing = Panel(division_6)
rad = Radians(Degrees=series)
circle = Circle(cir)
series_3 = Series(Start=0, Step=division_7, Count=number_of_curve_sample_points_2)
neg_2 = Negative(Value=series_2)
rad_2 = Radians(Degrees=neg_2)
rotate = Rotate(Geometry=circle, Angle=rad, Plane=move.Geometry)  # -> Geometry, Transform

# ---- group: Make step resolution statisitics
number_of_stepper_motor_steps_2 = Panel(number_of_stepper_motor_steps)
microstep_level_2 = Panel(microstep_level)
division_8 = Division(A=pinion_circumference, B=number_of_stepper_motor_steps_2)
distance_covered_per_step = Panel(division_8)
division_9 = Division(A=distance_covered_per_step, B=microstep_level_2)
distance_covered_per_micro_step = Panel(division_9)

# ---- group: Step statsistics
distance_covered_per_step_2 = Panel(distance_covered_per_step)
distance_covered_per_micro_step_2 = Panel(distance_covered_per_micro_step)

# ---- group: Create rack tooth geometry
sample_tooth_number_3 = Panel(sample_tooth_number_2)
tooth_spacing_2 = Panel(tooth_spacing)
item = ListItem(List=rotate.Geometry, Index=sample_tooth_number_3, Wrap=True)
rotate_2 = Rotate(Geometry=graft(item), Angle=rad_2, Plane=move.Geometry)  # -> Geometry, Transform
tooth_spacing_3 = Panel(tooth_spacing)
X = UnitX(Factor=series_3)
sample_tooth_number_4 = Panel(sample_tooth_number_3)
milling_it_radius = Panel(multiplication_3)
subtraction = Subtraction(A=sample_tooth_number_3, B="0.5")
move_2 = Move(Geometry=rotate_2.Geometry, Motion=X)  # -> Geometry, Transform
multiplication_11 = Multiplication(A=sample_tooth_number_4, B=tooth_spacing_3)
area = Area(Geometry=move_2.Geometry)  # -> Area, Centroid
pt = ConstructPoint(XCoordinate=multiplication_11, YCoordinate=0, ZCoordinate=0)
multiplication_12 = Multiplication(A=subtraction, B=tooth_spacing_2)
multiplication_13 = Multiplication(A=sample_tooth_number_3, B=tooth_spacing_2)
deplane = DeconstructPlane(Plane=xy)  # -> Origin, XAxis, YAxis, ZAxis
merge = Merge(Data1=flatten(area.Centroid), Data2=flatten(pt))
amp = Amplitude(Vector=deplane.YAxis, Amplitude=milling_it_radius)
amp_2 = Amplitude(Vector=deplane.XAxis, Amplitude=multiplication_12)
amp_3 = Amplitude(Vector=deplane.XAxis, Amplitude=multiplication_13)
intcrv = Interpolate(Vertices=merge, Degree=3, Periodic=False, KnotStyle=1)  # -> Curve, Length, Domain
rev = Reverse(Vector=amp)
move_3 = Move(Geometry=deplane.Origin, Motion=amp_2)  # -> Geometry, Transform
move_4 = Move(Geometry=deplane.Origin, Motion=amp_3)  # -> Geometry, Transform
move_5 = Move(Geometry=move_3.Geometry, Motion=rev)  # -> Geometry, Transform
yz = YZPlane(Origin=move_5.Geometry)
crv = Curve(intcrv.Curve)
mirror = Mirror(Geometry=crv, Plane=yz)  # -> Geometry, Transform
ccx = CurveCurve(CurveA=crv, CurveB=mirror.Geometry)  # -> Points, ParamsA, ParamsB
shatter = Shatter(Curve=crv, Parameters=ccx.ParamsA)
rev_2 = ReverseList(List=shatter)
milling_it_radius_2 = Panel(milling_it_radius)
tooth_fillet_radius_2 = Panel(tooth_fillet_radius)
item_2 = ListItem(List=rev_2, Index=0, Wrap=True)
mirror_2 = Mirror(Geometry=item_2, Plane=yz)  # -> Geometry, Transform
pt_2 = Point(move_4.Geometry)
pt_3 = Point(deplane.Origin)
addition_2 = Addition(A=tooth_fillet_radius_2, B=milling_it_radius_2)
join = JoinCurves(Curves=[item_2, mirror_2.Geometry], Preserve=False)
vec2pt = Vector2Pt(PointA=pt_2, PointB=pt_3, Unitize=False)  # -> Vector, Length
fillet = Fillet(Curve=join, Radius=addition_2)
move_6 = Move(Geometry=fillet, Motion=vec2pt.Vector)  # -> Geometry, Transform

# ---- group: Offset tooth profile to prepare for copying
tooth_spacing_4 = Panel(tooth_spacing)
milling_it_radius_3 = Panel(milling_it_radius)
tooth_profile_for_offset = Curve(move_6.Geometry)
xy_2 = XYPlane(Origin=Point(0, 0, 0))
neg_3 = Negative(Value=tooth_spacing_4)
X_2 = UnitX(Factor=tooth_spacing_4)
X_3 = UnitX(Factor=neg_3)
move_7 = Move(Geometry=tooth_profile_for_offset, Motion=X_2)  # -> Geometry, Transform
move_8 = Move(Geometry=tooth_profile_for_offset, Motion=X_3)  # -> Geometry, Transform
end = EndPoints(Curve=tooth_profile_for_offset)  # -> Start, End
join_2 = JoinCurves(Curves=flatten([move_8.Geometry, tooth_profile_for_offset, move_7.Geometry]), Preserve=False)
yz_2 = YZPlane(Origin=[end.Start, end.End])
offset = Offset(Curve=join_2, Distance=milling_it_radius_3, Plane=xy_2, Corners=2)
pcx = CurvePlane(Curve=offset, Plane=yz_2)  # -> Points, ParamsC, ParamsP
shatter_2 = Shatter(Curve=offset, Parameters=flatten(pcx.ParamsC))
item_3 = ListItem(List=shatter_2, Index="1", Wrap=True)
offset_tooth_for_copy_and_join = Curve(item_3)

# ----
distance_covered_per_step_3 = Panel(distance_covered_per_step)
division_10 = Division(A="1", B=distance_covered_per_step_3)
steps_per_mm = Number(division_10)
steps_per_mm_2 = ClusterOutput(steps_per_mm)

# ---- group: Create and blend pinion teeth
eval = EvaluateLength(Curve=fillet, Length="0.5", Normalized=True)  # -> Point, Tangent, Parameter
pdecon = Deconstruct(Point=eval.Point)  # -> XComponent, YComponent, ZComponent
milling_it_radius_4 = Panel(milling_bit_radius)
pinion_corner_tolerance = Panel(neg)
subtraction_2 = Subtraction(A=pdecon.YComponent, B=milling_it_radius_4)
subtraction_3 = Subtraction(A=subtraction_2, B=milling_it_radius_4)
subtraction_4 = Subtraction(A=subtraction_3, B=pinion_corner_tolerance)
pt_4 = ConstructPoint(XCoordinate=0, YCoordinate=subtraction_4, ZCoordinate=0)
rounding_factor_pinion_outside_2 = Panel(rounding_factor_pinion_outside)
xy_3 = XYPlane(Origin=pt_4)
division_11 = Division(A="360", B=multiplication_5)
rounding_factor_pinion_inside_2 = Panel(rounding_factor_pinion_inside)
subtraction_5 = Subtraction(A="0", B=rounding_factor_pinion_outside_2)
addition_3 = Addition(A="180", B=rounding_factor_pinion_outside_2)
rad_3 = Radians(Degrees=addition_3)
rad_4 = Radians(Degrees=subtraction_5)
subtraction_6 = Subtraction(A="180", B=rounding_factor_pinion_inside_2)
addition_4 = Addition(A="0", B=rounding_factor_pinion_inside_2)
milling_it_radius_5 = Panel(milling_it_radius_4)
dom = ConstructDomain(DomainStart=rad_4, DomainEnd=rad_3)
xy_4 = XYPlane(Origin=Point(0, 0, 0))
rad_5 = Radians(Degrees=subtraction_6)
rad_6 = Radians(Degrees=addition_4)
dom_2 = ConstructDomain(DomainStart=rad_6, DomainEnd=rad_5)
pi_2 = Pi(Factor=1)
arc = Arc(Plane=xy_4, Radius=milling_it_radius_5, Angle=dom)  # -> Arc, Length
arc_2 = Arc(Plane=xy_3, Radius=milling_it_radius_5, Angle=dom_2)  # -> Arc, Length
rad_7 = Radians(Degrees=division_11)
rotate_3 = Rotate(Geometry=arc.Arc, Angle=pi_2, Plane=xy_4)  # -> Geometry, Transform
addition_5 = Addition(A=rad, B=rad_7)
number_slider = Slider(0.5, range=0..1)
rotate_4 = Rotate(Geometry=rotate_3.Geometry, Angle=rad, Plane=move.Geometry)  # -> Geometry, Transform
rotate_5 = Rotate(Geometry=arc_2.Arc, Angle=addition_5, Plane=move.Geometry)  # -> Geometry, Transform
flip = FlipCurve(Curve=rotate_4.Geometry)  # -> Curve, Flag
flip_2 = FlipCurve(Curve=rotate_5.Geometry)  # -> Curve, Flag
pinion_radius_2 = Panel(pinion_radius)
shift = ShiftList(List=flip.Curve, Shift=1, Wrap=True)
blendc = BlendCurve(CurveA=rotate_4.Geometry, CurveB=flip_2.Curve, BulgeA=number_slider, BulgeB=number_slider, Continuity=2)
blendc_2 = BlendCurve(CurveA=shift, CurveB=rotate_5.Geometry, BulgeA=number_slider, BulgeB=number_slider, Continuity=2)
neg_4 = Negative(Value=pinion_radius_2)
Y_2 = UnitY(Factor=neg_4)
cir_2 = Circle(Plane=move.Geometry, Radius=multiplication_4)
join_3 = JoinCurves(Curves=flatten([rotate_4.Geometry, rotate_5.Geometry, blendc, blendc_2]), Preserve=False)
move_9 = Move(Geometry=join_3, Motion=Y_2)  # -> Geometry, Transform
pinion_teeth = Curve(move_9.Geometry)

# ----
move_10 = Move(Geometry=cir_2, Motion=Y_2)  # -> Geometry, Transform

# ---- group: Create and blend pinion teeth (continued)
pinion_center_hole = Curve(move_10.Geometry)

# ---- group: Create pinion movement preview
preview_position_0_1_3 = Number(preview_position_0_1_2)
pinion_radius_3 = Panel(pinion_radius)
pinion_circumference_3 = Panel(pinion_circumference)
multiplication_14 = Multiplication(A="360", B=preview_position_0_1_3)
multiplication_15 = Multiplication(A=pinion_circumference_3, B=preview_position_0_1_3)
neg_5 = Negative(Value=multiplication_14)
X_4 = UnitX(Factor=multiplication_15)
rad_8 = Radians(Degrees=neg_5)
rotate_6 = Rotate(Geometry=flatten([join_3, cir_2]), Angle=rad_8, Plane=move.Geometry)  # -> Geometry, Transform
move_11 = Move(Geometry=rotate_6.Geometry, Motion=X_4)  # -> Geometry, Transform
neg_6 = Negative(Value=pinion_radius_3)
Y_3 = UnitY(Factor=neg_6)
move_12 = Move(Geometry=move_11.Geometry, Motion=Y_3)  # -> Geometry, Transform
pinion_movement_preview = Curve(move_12.Geometry)

# ---- group: Make pinion bit statisitics
pinion_radius_4 = Panel(pinion_radius)
rotate_7 = Rotate(Geometry=move.Geometry, Angle=4.71238898, Plane=move.Geometry)  # -> Geometry, Transform
pinion_teeth_2 = Curve(join_3)
cir_3 = Circle(Plane=rotate_7.Geometry, Radius=pinion_radius_4)
trim = TrimWithRegion(Curve=cir_3, Region=pinion_teeth_2)  # -> Inside, Outside
item_4 = ListItem(List=trim.Outside, Index=0, Wrap=True)
len = Length(Curve=flatten(item_4))
maxium_pinion_milling_bit_diamter = Panel(len)

# ----
maxium_pinion_milling_bit_diamter_2 = Panel(maxium_pinion_milling_bit_diamter)
maxium_pinion_milling_bit_diamter_3 = Number(maxium_pinion_milling_bit_diamter_2)
pinion_movement_preview_2 = Curve(pinion_movement_preview)
pinion_center_hole_2 = Curve(pinion_center_hole)
pinion_teeth_3 = Curve(pinion_teeth)
pinion_teeth_4 = ClusterOutput(pinion_teeth_3)
pinion_center_hole_3 = ClusterOutput(pinion_center_hole_2)
maxium_pinion_milling_bit_diamter_4 = ClusterOutput(maxium_pinion_milling_bit_diamter_3)
pinion_movement_preview_3 = ClusterOutput(pinion_movement_preview_2)

# ---- group: Create rack by copying and offsetting rack tooth
tooth_spacing_5 = Panel(tooth_spacing)
rack_length_5 = Panel(rack_length_4)
milling_bit_radius_2 = Panel(multiplication_3)
tooth_profile_for_copy_and_join = Curve(offset_tooth_for_copy_and_join)
pinion_radius_5 = Panel(pinion_radius)
addition_6 = Addition(A=pinion_radius_5, B=milling_bit_radius_2)
multiplication_16 = Multiplication(A=addition_6, B="2")
addition_7 = Addition(A=rack_length_5, B=multiplication_16)
division_12 = Division(A=addition_6, B=tooth_spacing_5)
actual_rack_length = Panel(addition_7)
round_2 = Round(Number=division_12)  # -> Nearest, Floor, Ceiling
multiplication_17 = Multiplication(A=round_2.Ceiling, B=tooth_spacing_5)
division_13 = Division(A=actual_rack_length, B=tooth_spacing_5)
neg_7 = Negative(Value=addition_6)
neg_8 = Negative(Value=multiplication_17)
round_3 = Round(Number=division_13)  # -> Nearest, Floor, Ceiling
rack_start_distance = Panel(neg_8)
rack_cut_start_distance = Panel(neg_7)
addition_8 = Addition(A=round_3.Ceiling, B="1")
series_4 = Series(Start=0, Step=tooth_spacing_5, Count=addition_8)
X_5 = UnitX(Factor=rack_start_distance)
move_13 = Move(Geometry=tooth_profile_for_copy_and_join, Motion=X_5)  # -> Geometry, Transform
X_6 = UnitX(Factor=series_4)
move_14 = Move(Geometry=move_13.Geometry, Motion=X_6)  # -> Geometry, Transform
pinion_radius_6 = Panel(pinion_radius)
join_4 = JoinCurves(Curves=move_14.Geometry, Preserve=False)
neg_9 = Negative(Value=pinion_radius_6)
Y_4 = UnitY(Factor=neg_9)
move_15 = Move(Geometry=join_4, Motion=Y_4)  # -> Geometry, Transform; disabled
rack_teeth = Curve(move_15.Geometry)

# ----
end_2 = EndPoints(Curve=move_13.Geometry)  # -> Start, End
dist = Distance(PointA=end_2.Start, PointB=end_2.End)
panel = Panel(dist)
move_16 = Move(Geometry=move_14.Geometry, Motion=Y_4)  # -> Geometry, Transform

# ---- group: Create rack by copying and offsetting rack tooth (continued)
rack_teeth_unjoined = Curve(move_16.Geometry)

# ---- group: Trim rack to specified length
rack_cut_start_distance_2 = Panel(rack_cut_start_distance)
actual_rack_length_2 = Panel(actual_rack_length)
pinion_diameter_2 = Panel(pinion_diameter)
rack_teeth_2 = Curve(rack_teeth)
pt_5 = ConstructPoint(XCoordinate=rack_cut_start_distance_2, YCoordinate=0, ZCoordinate=0)
xy_5 = XYPlane(Origin=pt_5)
neg_10 = Negative(Value=pinion_diameter_2)
rectangle = Rectangle(Plane=xy_5, XSize=actual_rack_length_2, YSize=neg_10, Radius=0)  # -> Rectangle, Length
trim_2 = TrimWithRegion(Curve=rack_teeth_2, Region=rectangle.Rectangle)  # -> Inside, Outside
bbox = BoundingBox(Content=trim_2.Inside, Plane=PlaneXY(0, 0, 0))  # -> Box, Box_2
edges = BrepEdges(Brep=bbox.Box)  # -> Naked, Interior, NonManifold
item_5 = ListItem(List=edges.Naked, Index="2", Wrap=True)
flip_3 = FlipCurve(Curve=item_5)  # -> Curve, Flag
rack_tooth_edge = Curve(flip_3.Curve)
trimmed_rack_teeth = Curve(trim_2.Inside)

# ----
rack_teeth_trimmed_and_joined = Curve(trimmed_rack_teeth)
rack_teeth_3 = Curve(rack_teeth_unjoined)
rack_teeth_4 = ClusterOutput(rack_teeth_3)

pinion_radius_7 = Panel(pinion_radius)
milling_bit_radius_3 = Panel(multiplication_3)
addition_9 = Addition(A=pinion_radius_7, B=milling_bit_radius_3)
cir_4 = Circle(Plane=move.Geometry, Radius=addition_9)

move_17 = Move(Geometry=cir_4, Motion=Y_2)  # -> Geometry, Transform

pinion_edge = Curve(move_17.Geometry)

pinion_edge_2 = Curve(pinion_edge)
pinion_edge_3 = ClusterOutput(pinion_edge_2)

# ==== cluster HighSpeedRackMillingToolpaths: For roughing rack geometry in metals. This kind of toolapth is for deep cutting with a small stepover, in very high speed. Input "rack teeth" from "Roller rack and pinion maker" component. Connect output curves to "Engrave" component.
milling_bit_diameter = ClusterInput()  # The diameter of the milling bit.
rack_teeth = ClusterInput()  # Input rack teeth output from "Roller rack and pinion maker"
final_pass_width = ClusterInput()  # How much material will be left for the finish pass to clean up
stepover = ClusterInput()  # (0-1.0) The depth of each pass in relation to the milling bit diameter.
rack_teeth_2 = Curve(rack_teeth)
milling_bit_diamter = Number(milling_bit_diameter)
finish_pass_width = Number(final_pass_width)
stepover_2 = Number(stepover)
lng = ListLength(List=flatten(rack_teeth_2))
item = ListItem(List=rack_teeth_2, Index=0, Wrap=True)
stepover_3 = Panel(stepover_2)
finish_pass_width_2 = Panel(finish_pass_width)
number_of_tooth_valleys = Panel(lng)
milling_bit_diamter_2 = Panel(milling_bit_diamter)
rack_tooth = Curve(item)
eval = EvaluateLength(Curve=rack_tooth, Length="0.5", Normalized=True)  # -> Point, Tangent, Parameter
end = EndPoints(Curve=rack_tooth)  # -> Start, End
dist = Distance(PointA=flatten(end.Start), PointB=flatten(end.End))
multiplication = Multiplication(A=milling_bit_diamter_2, B=stepover_3)
yz = YZPlane(Origin=end.End)
shatter = Shatter(Curve=rack_tooth, Parameters=eval.Parameter)
multiplication_2 = Multiplication(A=milling_bit_diamter_2, B="0.5")
tooth_spacing = Panel(dist)
stepover_distance = Panel(multiplication)
milling_bit_radius = Panel(multiplication_2)
item_2 = ListItem(List=shatter, Index="1", Wrap=True)
mirror = Mirror(Geometry=item_2, Plane=yz)  # -> Geometry, Transform
addition = Addition(A=milling_bit_radius, B=finish_pass_width_2)
join = JoinCurves(Curves=[item_2, mirror.Geometry], Preserve=False)
neg = Negative(Value=addition)
offset = Offset(Curve=join, Distance=neg, Plane=PlaneXY(0, 0, 0), Corners=1)
master_root = Curve(offset)
end_2 = EndPoints(Curve=master_root)  # -> Start, End
ln = Line(StartPoint=end_2.Start, EndPoint=end_2.End)
feedrate_calculator = FeedrateCalculator(
    spindle_rpm=18000,
    milling_bit_diameter=milling_bit_diamter_2,
    number_of_flutes=Slider(3, range=0..10),
    chip_load=Slider(0.05, range=0..0.1),
    max_stepover=stepover_3,
    ramp_feed_reduction_factor=0.5)  # -> feedrate_4, ramp_feedrate_2, feedback_3
eval_2 = EvaluateLength(Curve=ln, Length="0.5", Normalized=True)  # -> Point, Tangent, Parameter
eval_3 = EvaluateLength(Curve=master_root, Length="0.5", Normalized=True)  # -> Point, Tangent, Parameter
tooth_spacing_2 = Panel(tooth_spacing)
dist_2 = Distance(PointA=flatten(eval_2.Point), PointB=flatten(eval_3.Point))
number_slider = Slider(6, range=0..10)
stepover_distance_2 = Panel(stepover_distance)
disatnce_to_mill = Panel(dist_2)
division = Division(A=Slider(7750, range=0..10000), B=tooth_spacing_2)
division_2 = Division(A=disatnce_to_mill, B=stepover_distance_2)
int = Integer(division_2)
division_3 = Division(A=disatnce_to_mill, B=int)
actual_stepover_distance = Panel(division_3)
subtraction = Subtraction(A=int, B="1")
series = Series(Start=actual_stepover_distance, Step=actual_stepover_distance, Count=subtraction)
neg_2 = Negative(Value=series)
Y = UnitY(Factor=neg_2)
master_root_2 = Curve(master_root)
move = Move(Geometry=ln, Motion=Y)  # -> Geometry, Transform
ccx = CurveCurve(CurveA=move.Geometry, CurveB=master_root_2)  # -> Points, ParamsA, ParamsB
shatter_2 = Shatter(Curve=graft(move.Geometry), Parameters=ccx.ParamsA)
item_3 = ListItem(List=shatter_2, Index="1", Wrap=True)
pass_lines = Curve(item_3)
rev = ReverseList(List=flatten(pass_lines))
master_root_3 = Curve(master_root)
item_4 = ListItem(List=rev, Index=0, Wrap=True)
ccx_2 = CurveCurve(CurveA=master_root_3, CurveB=item_4)  # -> Points, ParamsA, ParamsB
shatter_3 = Shatter(Curve=master_root_3, Parameters=ccx_2.ParamsA)
item_5 = ListItem(List=shatter_3, Index="1", Wrap=True)
eval_4 = EvaluateLength(Curve=master_root_3, Length="0.5", Normalized=True)  # -> Point, Tangent, Parameter
eval_5 = EvaluateLength(Curve=pass_lines, Length="0.5", Normalized=True)  # -> Point, Tangent, Parameter
shatter_4 = Shatter(Curve=master_root_3, Parameters=eval_4.Parameter)
shatter_5 = Shatter(Curve=pass_lines, Parameters=eval_5.Parameter)
end_pass = Curve(item_5)
item_6 = ListItem(List=shatter_4, Index="0", Wrap=True)
item_7 = ListItem(List=shatter_5, Index="0", Wrap=True)
ccx_3 = CurveCurve(CurveA=flatten(item_6), CurveB=flatten(item_7))  # -> Points, ParamsA, ParamsB
shatter_6 = Shatter(Curve=flatten(item_6), Parameters=flatten(ccx_3.ParamsA))
simplify = SimplifyTree(Tree=shatter_6, Front=False)
rev_2 = ReverseList(List=simplify)
cull_i = CullIndex(List=rev_2, Indices="0", Wrap=True)
rev_3 = ReverseList(List=cull_i)
side_curves = Curve(flatten(rev_3))
flat_curves = Curve(flatten(item_7))
panel = Panel("4")
graft = GraftTree(Tree=flat_curves, IncludeEmptyLists=True, IncludeNullItems=True)
actual_stepover_distance_2 = Panel(division_3)
graft_2 = GraftTree(Tree=side_curves, IncludeEmptyLists=True, IncludeNullItems=True)
len = Length(Curve=graft_2)
division_4 = Division(A=len, B=actual_stepover_distance_2)
int_2 = Integer(division_4)
addition_2 = Addition(A="1", B=int_2)
divide = DivideCurve(Curve=graft, Count="1", Kinks=False)  # -> Points, Tangents, Parameters
join_2 = JoinCurves(Curves=[graft_2, graft], Preserve=False)
divide_2 = DivideCurve(Curve=graft_2, Count=addition_2, Kinks=False)  # -> Points, Tangents, Parameters
multiplication_3 = Multiplication(A=actual_stepover_distance_2, B=Slider(0.867, range=0..1))
simplify_2 = SimplifyCurve(Curve=join_2)  # -> Curve, Simplified
merge = Merge(Data1=divide_2.Points, Data2=divide.Points)
cullpt = CullDuplicates(Points=merge, Tolerance=0.1, CullMode=3)  # -> Points, Indices, Valence
nurbs = NurbsCurve(Vertices=cullpt.Points, Degree=4, Periodic=False)  # -> Curve, Length, Domain
actual_stepover_distance_3 = Panel(division_3)
crv = Curve(flatten(nurbs.Curve))
yz_2 = YZPlane(Origin=end.End)
multiplication_4 = Multiplication(A=actual_stepover_distance_3, B="0.1")
mirror_2 = Mirror(Geometry=crv, Plane=yz_2)  # -> Geometry, Transform
neg_3 = Negative(Value=multiplication_4)
flip = FlipCurve(Curve=flatten(mirror_2.Geometry))  # -> Curve, Flag
start_pass = Curve(ln)
X = UnitX(Factor=neg_3)
join_3 = JoinCurves(Curves=[crv, flip.Curve], Preserve=True)
move_2 = Move(Geometry=start_pass, Motion=X)  # -> Geometry, Transform
end_3 = EndPoints(Curve=join_3)  # -> Start, End
eval_6 = EvaluateLength(Curve=move_2.Geometry, Length="0.99", Normalized=True)  # -> Point, Tangent, Parameter
sort_pt = SortPoints(Points=end_3.Start)  # -> Points, Indices
shatter_7 = Shatter(Curve=move_2.Geometry, Parameters=eval_6.Parameter)
include_first_pass = BooleanToggle(False)
item_8 = ListItem(List=join_3, Index=sort_pt.Indices, Wrap=True)
item_9 = ListItem(List=shatter_7, Index=0, Wrap=True)
start_pass_2 = Curve(item_9)
mid_passes = Curve(item_8)
end_pass_2 = Curve(end_pass)
include_first_pass_2 = Panel(include_first_pass)
actual_stepover_distance_4 = Panel(division_3)
item_10 = ListItem(List=mid_passes, Index=0, Wrap=True)
tooth_spacing_3 = Panel(tooth_spacing)
multiplication_5 = Multiplication(A=actual_stepover_distance_4, B=Slider(3, range=0..10))
start_pass_3 = Curve(start_pass_2)
merge_2 = Merge(Data2=flatten(mid_passes), Data3=flatten(end_pass_2))
Y_2 = UnitY(Factor=multiplication_5)
move_3 = Move(Geometry=start_pass_2, Motion=Y_2)  # -> Geometry, Transform
X_2 = UnitX(Factor=tooth_spacing_3)
number_slider_2 = Slider(0.8, range=0..1)
number_slider_3 = Slider(0.8, range=0..1)
flip_2 = FlipCurve(Curve=move_3.Geometry)  # -> Curve, Flag
move_4 = Move(Geometry=item_10, Motion=X_2)  # -> Geometry, Transform
move_5 = Move(Geometry=start_pass_3, Motion=X_2)  # -> Geometry, Transform
shift = ShiftList(List=merge_2, Shift="1", Wrap=False)
shift_2 = ShiftList(List=merge_2, Shift="-1", Wrap=False)
filter = StreamFilter(Gate=include_first_pass_2, Stream0=move_4.Geometry, Stream1=move_5.Geometry)
blendc = BlendCurve(CurveA=start_pass_2, CurveB=flip_2.Curve, BulgeA=number_slider_3, BulgeB=number_slider_3, Continuity=1)
blendc_2 = BlendCurve(CurveA=flip_2.Curve, CurveB=item_10, BulgeA=number_slider_2, BulgeB=number_slider_2, Continuity=1)
blendc_3 = BlendCurve(CurveA=shift_2, CurveB=shift, BulgeA=Slider(0.9, range=0..1), BulgeB=1, Continuity=1)
filter_2 = StreamFilter(Gate=include_first_pass_2, Stream1=blendc)
filter_3 = StreamFilter(Gate=include_first_pass_2, Stream1=blendc_2)
filter_4 = StreamFilter(Gate=include_first_pass_2, Stream1=start_pass_2)
filter_5 = StreamFilter(Gate=include_first_pass_2, Stream1=flip_2.Curve)
blendc_4 = BlendCurve(CurveA=end_pass_2, CurveB=filter, BulgeA=Slider(0.32, range=0..1), BulgeB=Slider(0.675, range=0..1), Continuity=1)
merge_3 = Merge(Data1=flatten(filter_2), Data2=flatten(filter_3), Data3=flatten(blendc_3), Data4=flatten(blendc_4))
merge_4 = Merge(Data1=flatten(filter_4), Data2=flatten(filter_5), Data3=flatten(merge_2))
weave = Weave(Pattern=[0, 1], Stream0=merge_4, Stream1=merge_3, NullGaps=False)
join_4 = JoinCurves(Curves=weave, Preserve=True)
number_of_tooth_valleys_2 = Panel(number_of_tooth_valleys)
tooth_spacing_4 = Panel(tooth_spacing)
masterpath = Curve(join_4)
len_2 = Length(Curve=masterpath)
division_5 = Division(A=len_2, B=feedrate_calculator.feedrate_4)
time_per_tooth = Panel(division_5)
multiplication_6 = Multiplication(A=time_per_tooth, B=division)
division_6 = Division(A=multiplication_6, B=Slider(60, range=0..100))
time_to_rough_all_teeth = Panel(division_6)
series_2 = Series(Start=0, Step=tooth_spacing_4, Count=number_of_tooth_valleys_2)
X_3 = UnitX(Factor=series_2)
move_6 = Move(Geometry=masterpath, Motion=X_3)  # -> Geometry, Transform
high_speed_toolpaths = Curve(move_6.Geometry)
high_speed_toolpaths_2 = ClusterOutput(high_speed_toolpaths)  # Connect to "Engrave" component to set cut depth. Connect "Engrave" output to "PostProcessor" to make g-code

# ==== cluster FeedrateCalculatorForArcs: Compensates for the speed difference between the center of a bit and its outer edge when cutting in circular paths. Calculates a feedrate matching chipload and rpm. This speed difference is similar to how the wheels on a car spin at different speeds during a turn. Can take chip thining into account. Input the maxium stepover the tool will encounter. Normal pockets and profiles will have a full stepover of 1, while the Arc Based High speed milling givve constant low stepovers as speciified.
ramp_feed_reduction_factor = ClusterInput()
ramp_feed_reduction_factor_2 = Number(ramp_feed_reduction_factor)
arc_diameter_factor = ClusterInput()
milling_bit_diameter = ClusterInput()
number_of_flutes = ClusterInput()
max_stepover = ClusterInput()
spindle_rpm = ClusterInput()
chip_load = ClusterInput()
number_of_flutes_2 = Number(number_of_flutes)
milling_bit_diameter_2 = Number(milling_bit_diameter)
spindle_rpm_2 = Number(spindle_rpm)
max_stepover_2 = Number(max_stepover)
chip_load_2 = Number(chip_load)
arc_diameter_factor_2 = Number(arc_diameter_factor)
number_of_flutes_3 = Panel(number_of_flutes_2)
chip_load_3 = Panel(chip_load_2)
max_stepover_3 = Panel(max_stepover_2)
ramp_feedrate_reduction_factor = Panel(ramp_feed_reduction_factor_2)
arc_diameter_factor_3 = Panel(arc_diameter_factor_2)
spindle_rpm_3 = Panel(spindle_rpm_2)
milling_bit_diameter_3 = Panel(milling_bit_diameter_2)

multiplication = Multiplication(A=milling_bit_diameter_3, B=arc_diameter_factor_3)
subtraction = Subtraction(A=multiplication, B=milling_bit_diameter_3)
arc_diameter_at_bit_edge = Panel(multiplication)
arc_diameter_at_bit_center = Panel(subtraction)
division = Division(A=arc_diameter_at_bit_center, B=arc_diameter_at_bit_edge)
arc_feedrate_reduction_factor = Panel(division)

# ---- group: Calulate chip thining
larger = LargerThan(FirstNumber=max_stepover_3, SecondNumber="0.5")  # -> LargerThan, OrEqualTo
filter = StreamFilter(Gate=larger.LargerThan, Stream0=max_stepover_3, Stream1="0.5")
multiplication_2 = Multiplication(A=milling_bit_diameter_3, B=filter)
multiplication_3 = Multiplication(A="0.5", B=milling_bit_diameter_3)
subtraction_2 = Subtraction(A=multiplication_3, B=multiplication_2)
neg = Negative(Value=subtraction_2)
pt = ConstructPoint(XCoordinate=milling_bit_diameter_3, YCoordinate=neg, ZCoordinate=0)
pt_2 = ConstructPoint(XCoordinate=0, YCoordinate=neg, ZCoordinate=0)
xy = XYPlane(Origin=Point(0, 0, 0))
ln = Line(StartPoint=pt_2, EndPoint=pt)
cir = Circle(Plane=xy, Radius=multiplication_3)
ccx = CurveCurve(CurveA=cir, CurveB=ln)  # -> Points, ParamsA, ParamsB
pt_3 = ConstructPoint(XCoordinate=0, YCoordinate=0, ZCoordinate=0)
chip_load_4 = Panel(chip_load_3)
vec2pt = Vector2Pt(PointA=pt_3, PointB=ccx.Points, Unitize=False)  # -> Vector, Length
amp = Amplitude(Vector=vec2pt.Vector, Amplitude=chip_load_4)
move = Move(Geometry=ccx.Points, Motion=amp)  # -> Geometry, Transform
pdecon = Deconstruct(Point=move.Geometry)  # -> XComponent, YComponent, ZComponent
pt_4 = ConstructPoint(XCoordinate=0, YCoordinate=pdecon.YComponent, ZCoordinate=pdecon.ZComponent)
ln_2 = Line(StartPoint=move.Geometry, EndPoint=pt_4)
ccx_2 = CurveCurve(CurveA=cir, CurveB=ln_2)  # -> Points, ParamsA, ParamsB
dist = Distance(PointA=flatten(ccx_2.Points), PointB=flatten(move.Geometry))
move_distance_needed_for_chipload = Panel(dist)
chip_load_5 = Panel(chip_load_3)
division_2 = Division(A=move_distance_needed_for_chipload, B=chip_load_5)

# ---- group: Calculate feedrate
multiplication_4 = Multiplication(A=spindle_rpm_3, B=number_of_flutes_3)
multiplication_5 = Multiplication(A=multiplication_4, B=chip_load_3)
division_3 = Division(A=multiplication_5, B="60")
feedrate = Panel(division_3)

# ----
multiplication_6 = Multiplication(A=feedrate, B=arc_feedrate_reduction_factor)
arc_compensated_feedrate = Panel(multiplication_6)

# ---- group: Safatey in case of too extreme values
backup_feedrate_multiplaication_factor = Panel("2")
feedrate_multiplaication_factor = Panel(division_2)
null = NullItem(Item=ccx_2.Points)  # -> NullFlags, InvalidFlags, Description
filter_2 = StreamFilter(Gate=null.NullFlags, Stream0=feedrate_multiplaication_factor, Stream1=backup_feedrate_multiplaication_factor)

# ---- group: Visualize chip size
X = UnitX(Factor=dist)
ln_3 = Line(StartPoint=ccx.Points, EndPoint=pt)
ln_4 = Line(StartPoint=ccx.Points, EndPoint=move.Geometry)
move_2 = Move(Geometry=cir, Motion=X)  # -> Geometry, Transform
chip_load_cross_section = Curve(ln_4)
new_bit_position = Curve(move_2.Geometry)
old_bit_position = Curve(cir)
material_edge = Curve(ln_3)

# ----
panel = Panel("Stepover to small or chipload to high. Unable to compute optimal feedrate multiplication factor.")
filter_3 = StreamFilter(Gate=null.NullFlags, Stream0="All good", Stream1=panel)
ramp_feedrate_reduction_factor_2 = Panel(ramp_feedrate_reduction_factor)
feedrate_multiplication_factor = Panel(filter_2)
feedrate_2 = Panel(arc_compensated_feedrate)
feedback = Panel(filter_3)
multiplication_7 = Multiplication(A=feedrate_2, B=feedrate_multiplication_factor)
multiplication_8 = Multiplication(A=multiplication_7, B=ramp_feedrate_reduction_factor_2)
feedback_2 = Text(feedback)
int = Integer(multiplication_7)
int_2 = Integer(multiplication_8)
feedback_3 = ClusterOutput(feedback_2)
arc_compensated_feedrate_2 = Number(int)
ramp_feedrate = Number(int_2)
ramp_feedrate_2 = ClusterOutput(ramp_feedrate)
arc_compensated_feedrate_3 = ClusterOutput(arc_compensated_feedrate_2)

# ==== cluster Engrave: Creates toolpaths with pass depths from 2D and 3D curves. Handy for making your own freestyle toolpaths. Be careful about start depths of your curves. Pass depth and cut depth assumes your input curve starts at surface level (Z0).
engrave_curves = ClusterInput()
pass_depth = ClusterInput()
cut_depth = ClusterInput()
engrave_curves_2 = Curve(engrave_curves)
pass_depth_2 = Number(pass_depth)
cut_depth_2 = Number(cut_depth)
pass_depth_3 = Panel(pass_depth_2)
cut_depth_line_engrave = Panel(cut_depth_2)
division = Division(A=cut_depth_line_engrave, B=pass_depth_3)
round = Round(Number=division)  # -> Nearest, Floor, Ceiling
division_2 = Division(A=cut_depth_line_engrave, B=round.Ceiling)
actual_pass_depth = Panel(division_2)
series = Series(Start=actual_pass_depth, Step=actual_pass_depth, Count=round.Ceiling)
neg = Negative(Value=series)
null = NullItem(Item=division_2)  # -> NullFlags, InvalidFlags, Description
filter = StreamFilter(Gate=null.NullFlags, Stream0=neg, Stream1="0")
Z = UnitZ(Factor=filter)
move = Move(Geometry=graft(engrave_curves_2), Motion=Z)  # -> Geometry, Transform
flatten = FlattenTree(Tree=move.Geometry, Path="{0}")
clean = CleanTree(RemoveNulls=True, RemoveInvalid=True, RemoveEmpty=False, Tree=flatten)
engrave_toolpaths = Curve(clean)
engrave_toolpaths_2 = ClusterOutput(engrave_toolpaths)

# ==== cluster TrochoidalHighSpeedMilling: Makes highspeed toolpaths for deep and fast cutting in metal. Input toolpath curves for the arcs to follow. Be careful about feedrates and stepovers. Prioritize deep passes and small stepovers (0.05 to 0.2). This technique is known as high speed feed machining.
straight_arc_extensions = ClusterInput()
ramp_entry_feedrate = ClusterInput()
milling_bit_diameter = ClusterInput()
arc_diameter_factor = ClusterInput()
make_helical_entry = ClusterInput()
toolpath_curves = ClusterInput()
use_climb_milling = ClusterInput()
jog_z_lift_factor = ClusterInput()
ramp_angle = ClusterInput()
stepover = ClusterInput()
feedrate = ClusterInput()
jograte = ClusterInput()
ramp_entry_feedrate_2 = Number(ramp_entry_feedrate)
milling_bit_diameter_2 = Number(milling_bit_diameter)
arc_diameter_factor_2 = Number(arc_diameter_factor)
straight_arc_extensions_2 = Boolean(straight_arc_extensions)
make_helical_entry_2 = Boolean(make_helical_entry)
toolpath_curves_2 = Curve(toolpath_curves)
use_climb_milling_2 = Boolean(use_climb_milling)
jog_z_lift_factor_2 = Number(jog_z_lift_factor)
ramp_angle_2 = Number(ramp_angle)
stepover_2 = Number(stepover)
feedrate_2 = Number(feedrate)
jograte_2 = Number(jograte)
make_straight_arc_extensions = Panel(straight_arc_extensions_2)
milling_bit_diameter_3 = Panel(milling_bit_diameter_2)
arc_diameter_factor_3 = Panel(arc_diameter_factor_2)
stepover_3 = Panel(stepover_2)
feedrate_3 = Panel(feedrate_2)
jograte_3 = Panel(jograte_2)
ramp_feedrate = Panel(ramp_entry_feedrate_2)
make_helical_entry_ramp = Panel(make_helical_entry_2)
ramp_angle_3 = Panel(ramp_angle_2)
jog_z_lift_factor_3 = Panel(jog_z_lift_factor_2)
use_climb_milling_3 = Panel(use_climb_milling_2)

# ---- group: Shetter curves at corners and shatter closed curves
disc = Discontinuity(Curve=toolpath_curves_2, Level=1)  # -> Points, Parameters
lng = ListLength(List=disc.Parameters)
smaller = SmallerThan(FirstNumber=lng, SecondNumber="1")  # -> SmallerThan, OrEqualTo
weave = Weave(Pattern=smaller.SmallerThan, Stream0=disc.Parameters, Stream1="0", NullGaps=False)
shatter = Shatter(Curve=graft(toolpath_curves_2), Parameters=weave)

# ----
straight = Panel("0")
smooth = Panel("2")
filter = StreamFilter(Gate=make_straight_arc_extensions, Stream0=smooth, Stream1=straight)
multiplication = Multiplication(A=milling_bit_diameter_3, B=arc_diameter_factor_3)
multiplication_2 = Multiplication(A=milling_bit_diameter_3, B=jog_z_lift_factor_3)
multiplication_3 = Multiplication(A=milling_bit_diameter_3, B=stepover_3)
arc_extension_type = Panel(filter)
subtraction = Subtraction(A=multiplication, B=milling_bit_diameter_3)
stepover_distance = Panel(multiplication_3)
z_lift_distance = Panel(multiplication_2)
arc_diameter = Panel(subtraction)
shattered_toolpath_curves = Curve(shatter)

# ---- group: Check if all curves consist of singel line, can give errors in data weaving
lng_2 = ListLength(List=shattered_toolpath_curves)
sort = SortList(Keys=flatten(lng_2))  # -> Keys, ValuesA
rev = ReverseList(List=sort.Keys)
item = ListItem(List=rev, Index=0, Wrap=True)
smaller_2 = SmallerThan(FirstNumber=item, SecondNumber="2")  # -> SmallerThan, OrEqualTo
all_toolpaths_are_single_curve = Panel(smaller_2.SmallerThan)

# ---- group: Make oriented planes for toolpah arcs
len = Length(Curve=shattered_toolpath_curves)
division = Division(A=len, B=stepover_distance)
int = Integer(division)
divide = DivideCurve(Curve=shattered_toolpath_curves, Count=int, Kinks=False)  # -> Points, Tangents, Parameters
cull_i = CullIndex(List=divide.Tangents, Indices="0", Wrap=True)
cull_i_2 = CullIndex(List=divide.Points, Indices="0", Wrap=True)
xy = XYPlane(Origin=cull_i_2)
align = AlignPlane(Plane=xy, Direction=cull_i)  # -> Plane, Angle
simplify = SimplifyTree(Tree=align.Plane, Front=False)
toolpath_planes = Plane(simplify)

# ---- group: Make toolpath arcs
arc_diameter_2 = Panel(arc_diameter)
use_climb_milling_4 = Panel(use_climb_milling_3)
arc_extension_type_2 = Panel(arc_extension_type)
stepover_distance_2 = Panel(stepover_distance)
pi = Pi(Factor=1)
pi_2 = Pi(Factor=1)
multiplication_4 = Multiplication(A=arc_diameter_2, B="0.5")
multiplication_5 = Multiplication(A=pi, B="0.5")
multiplication_6 = Multiplication(A=pi_2, B="-0.5")
xy_2 = XYPlane(Origin=Point(0, 0, 0))
dom = ConstructDomain(DomainStart=multiplication_6, DomainEnd=multiplication_5)
arc = Arc(Plane=xy_2, Radius=multiplication_4, Angle=dom)  # -> Arc, Length
ext = ExtendCurve(Curve=arc.Arc, Type=arc_extension_type_2, Start=stepover_distance_2, End=stepover_distance_2)
gate = StreamGate(Stream=ext, Gate=use_climb_milling_4)  # -> Target0, Target1
flip = FlipCurve(Curve=gate.Target0)  # -> Curve, Flag
filter_2 = StreamFilter(Gate=use_climb_milling_4, Stream0=flip.Curve, Stream1=gate.Target1)
orient = Orient(Geometry=filter_2, Source=xy_2, Target=toolpath_planes)  # -> Geometry, Transform
toolpath_arcs = Curve(orient.Geometry)

# ---- group: Tests for 3D projection
brep = Brep(<brep referenced from the Rhino model>)
toolpath_arcs_2 = Curve()
smooth_2 = SettingsQuality()
topoly = CurveToPolyline(Curve=toolpath_arcs_2, ToleranceDistance="0.01", ToleranceAngle=0)  # -> Polyline, Segments
mesh = MeshBrep(
    Brep=brep,
    Settings={GridMaxCount=0, GridMinCount=16, JaggedSeams=False, MaxEdgeLength=0, MinEdgeLength=0.0001, MinTolerance=0, Refine=True, RefineAngle=0, RelativeTolerance=0.65, SimplePlanes=True, Tolerance=0})
cp = ControlPoints(Curve=topoly.Polyline)  # -> Points, Weights, Knots
Z = UnitZ(Factor=Slider(100, range=0..100))
meshcp = MeshClosestPoint(Point=cp.Points, Mesh=mesh)  # -> Point, Index, Parameter
Z_2 = UnitZ(Factor=1)
move = Move(Geometry=cp.Points, Motion=Z)  # -> Geometry, Transform
dist = Distance(PointA=meshcp.Point, PointB=cp.Points)
neg = Negative(Value=Z_2)
multiplication_7 = Multiplication(A=dist, B=Slider(0.9, range=0..1))
vec2pt = Vector2Pt(PointA=cp.Points, PointB=meshcp.Point, Unitize=False)  # -> Vector, Length
simplify_2 = SimplifyTree(Tree=move.Geometry, Front=False)
amp = Amplitude(Vector=vec2pt.Vector, Amplitude=multiplication_7)
meshray = MeshRay(Mesh=mesh, Point=simplify_2, Direction=neg)  # -> Point, Hit
Z_3 = UnitZ(Factor=Slider(100, range=0..100))
move_2 = Move(Geometry=cp.Points, Motion=amp)  # -> Geometry, Transform
Z_4 = UnitZ(Factor=1)
move_3 = Move(Geometry=toolpath_arcs_2, Motion=Z_3)  # -> Geometry, Transform
neg_2 = Negative(Value=Z_4)
intcrv = Interpolate(Vertices=move_2.Geometry, Degree=3, Periodic=False, KnotStyle=1)  # -> Curve, Length, Domain
pline = PolyLine(Vertices=meshray.Point, Closed=False)
pline_2 = PolyLine(Vertices=move_2.Geometry, Closed=False)
project = Project(Curve=move_3.Geometry, Brep=brep, Direction=neg_2)
smoothpline = SmoothPolyline(Polyline=pline, Strength=1, Times=1)
smoothpline_2 = SmoothPolyline(Polyline=pline_2, Strength=1, Times=1)
item_2 = ListItem(List=project, Index=0, Wrap=True)
smoothpline_3 = SmoothPolyline(Polyline=smoothpline, Strength=1, Times=1)
smoothpline_4 = SmoothPolyline(Polyline=smoothpline_2, Strength=1, Times=1)
simplify_3 = SimplifyTree(Tree=item_2, Front=False)
crv = Curve(smoothpline_4)
crv_2 = Curve(simplify_3)
pshift = ShiftPaths(Data=crv, Offset=-1)

# ----
all_toolpaths_are_single_curve_2 = Panel(all_toolpaths_are_single_curve)
all_toolpaths_are_single_curve_3 = Panel(all_toolpaths_are_single_curve)

# ---- group: Make transition jog arcs for corner transitions
z_lift_distance_2 = Panel(z_lift_distance)
toolpath_arcs_3 = Curve(toolpath_arcs)
rev_2 = ReverseList(List=toolpath_arcs_3)
number_slider = Slider(0.5, range=0..1)
item_3 = ListItem(List=rev_2, Index=0, Wrap=True)
item_4 = ListItem(List=toolpath_arcs_3, Index=0, Wrap=True)
flatten = FlattenTree(Tree=item_4, Path="{0}")
pshift_2 = ShiftPaths(Data=item_3, Offset=-1)
flatten_2 = FlattenTree(Tree=item_3, Path="{0}")
pshift_3 = ShiftPaths(Data=item_4, Offset=-1)
flatten_3 = FlattenTree(Tree=pshift_2, Path="{0}")
clean = CleanTree(RemoveNulls=True, RemoveInvalid=True, RemoveEmpty=False, Tree=flatten_3)
item_5 = ListItem(List=clean, Index=0, Wrap=True)
null = NullItem(Item=item_5)  # -> NullFlags, InvalidFlags, Description
filter_3 = StreamFilter(Gate=null.NullFlags, Stream0=pshift_2, Stream1=flatten_2)
filter_4 = StreamFilter(Gate=null.NullFlags, Stream0=pshift_3, Stream1=flatten)
shift = ShiftList(List=filter_4, Shift=1, Wrap=False)
shift_2 = ShiftList(List=filter_3, Shift=-1, Wrap=False)
blendc = BlendCurve(CurveA=shift_2, CurveB=shift, BulgeA=number_slider, BulgeB=number_slider, Continuity=1)
reb = RebuildCurve(Curve=blendc, Count="5", Tangents=False)
multiplication_8 = Multiplication(A="5", B="0.5")
cp_2 = ControlPoints(Curve=reb)  # -> Points, Weights, Knots
int_2 = Integer(multiplication_8)
Z_5 = UnitZ(Factor=z_lift_distance_2)
item_6 = ListItem(List=cp_2.Points, Index=int_2, Wrap=True)
move_4 = Move(Geometry=item_6, Motion=Z_5)  # -> Geometry, Transform
replace = ReplaceItems(List=cp_2.Points, Item=move_4.Geometry, Indices=int_2, Wrap=False)
nurbs = NurbsCurve(Vertices=replace, Degree=3, Periodic=False)  # -> Curve, Length, Domain
all_toolpaths_are_single_curve_4 = Panel(all_toolpaths_are_single_curve_3)
simplify_4 = SimplifyTree(Tree=nurbs.Curve, Front=False)
gate_2 = StreamGate(Stream=simplify_4, Gate=all_toolpaths_are_single_curve_4)  # -> Target0, Target1

# ---- group: Make fancy jog to surface ending
last_arcs_in_list = Curve(filter_3)
rev_3 = ReverseList(List=last_arcs_in_list)
item_7 = ListItem(List=rev_3, Index=0, Wrap=True)
end = EndPoints(Curve=item_7)  # -> Start, End
crv_cp = CurveClosestPoint(Point=end.End, Curve=item_7)  # -> Point, Parameter, Distance
ln = Line(StartPoint=end.Start, EndPoint=end.End)
dist_2 = Distance(PointA=end.Start, PointB=end.End)
eval = EvaluateLength(Curve=ln, Length="0.3", Normalized=True)  # -> Point, Tangent, Parameter
eval_2 = EvaluateCurve(Curve=item_7, Parameter=crv_cp.Parameter)  # -> Point, Tangent, Angle
multiplication_9 = Multiplication(A=dist_2, B="0.5")
end_point_tangent = Vector(eval_2.Tangent)
arc_center_point = Point(eval.Point)
arc_end_point = Point(end.End)
arc_radius = Panel(multiplication_9)
arc_2 = ArcSED(Start=arc_end_point, End=arc_center_point, Direction=end_point_tangent)  # -> Arc, Plane, Radius
reb_2 = RebuildCurve(Curve=arc_2.Arc, Count="5", Tangents=False)
multiplication_10 = Multiplication(A="5", B="0.5")
cp_3 = ControlPoints(Curve=reb_2)  # -> Points, Weights, Knots
multiplication_11 = Multiplication(A=arc_radius, B="0.1")
multiplication_12 = Multiplication(A=arc_radius, B="0.7")
multiplication_13 = Multiplication(A=arc_radius, B="0.3")
int_3 = Integer(multiplication_10)
addition = Addition(A=int_3, B="1")
Z_6 = UnitZ(Factor=multiplication_13)
Z_7 = UnitZ(Factor=multiplication_11)
item_8 = ListItem(List=cp_3.Points, Index=int_3, Wrap=True)
Z_8 = UnitZ(Factor=arc_radius)
Z_9 = UnitZ(Factor=multiplication_12)
move_5 = Move(Geometry=item_8, Motion=Z_7)  # -> Geometry, Transform
replace_2 = ReplaceItems(List=cp_3.Points, Item=move_5.Geometry, Indices=int_3, Wrap=False)
item_9 = ListItem(List=replace_2, Index=addition, Wrap=True)
move_6 = Move(Geometry=item_9, Motion=Z_6)  # -> Geometry, Transform
subtraction_2 = Subtraction(A="5", B="1")
replace_3 = ReplaceItems(List=replace_2, Item=move_6.Geometry, Indices=addition, Wrap=False)
item_10 = ListItem(List=replace_3, Index=subtraction_2, Wrap=True)
move_7 = Move(Geometry=item_10, Motion=Z_9)  # -> Geometry, Transform
move_8 = Move(Geometry=item_10, Motion=Z_8)  # -> Geometry, Transform
replace_4 = ReplaceItems(List=replace_3, Item=move_7.Geometry, Indices=subtraction_2, Wrap=False)
ins = InsertItems(List=replace_4, Item=move_8.Geometry, Indices="5", Wrap=True)
nurbs_2 = NurbsCurve(Vertices=ins, Degree=3, Periodic=False)  # -> Curve, Length, Domain
simplify_5 = SimplifyTree(Tree=nurbs_2.Curve, Front=False)
end_jog_arcs = Curve(simplify_5)

# ---- group: Make jog arcs, transtion between each semicircular cut
z_lift_distance_3 = Panel(z_lift_distance)
toolpath_arcs_4 = Curve(toolpath_arcs)
number_slider_2 = Slider(0.5, range=0..1)
shift_3 = ShiftList(List=toolpath_arcs_4, Shift=1, Wrap=False)
shift_4 = ShiftList(List=toolpath_arcs_4, Shift=-1, Wrap=False)
blendc_2 = BlendCurve(CurveA=shift_4, CurveB=shift_3, BulgeA=number_slider_2, BulgeB=number_slider_2, Continuity=1)
blended_transitions = Curve(blendc_2)
reb_3 = RebuildCurve(Curve=blended_transitions, Count="5", Tangents=False)
multiplication_14 = Multiplication(A="5", B="0.5")
cp_4 = ControlPoints(Curve=reb_3)  # -> Points, Weights, Knots
int_4 = Integer(multiplication_14)
Z_10 = UnitZ(Factor=z_lift_distance_3)
item_11 = ListItem(List=cp_4.Points, Index=int_4, Wrap=True)
move_9 = Move(Geometry=item_11, Motion=Z_10)  # -> Geometry, Transform
replace_5 = ReplaceItems(List=cp_4.Points, Item=move_9.Geometry, Indices=int_4, Wrap=False)
nurbs_3 = NurbsCurve(Vertices=replace_5, Degree=3, Periodic=False)  # -> Curve, Length, Domain
jog_arcs = Curve(nurbs_3.Curve)

# ---- group: Inser fancy end jog to surface
corner_jog_arcs = Curve(gate_2.Target0)
end_jog_arcs_2 = Curve(end_jog_arcs)
pshift_4 = ShiftPaths(Data=corner_jog_arcs, Offset=-1)
flatten_4 = FlattenTree(Tree=corner_jog_arcs, Path="{0}")
flatten_5 = FlattenTree(Tree=pshift_4, Path="{0}")
flatten_6 = FlattenTree(Tree=end_jog_arcs_2, Path="{0}")
clean_2 = CleanTree(RemoveNulls=True, RemoveInvalid=True, RemoveEmpty=False, Tree=flatten_5)
item_12 = ListItem(List=clean_2, Index=0, Wrap=True)
null_2 = NullItem(Item=item_12)  # -> NullFlags, InvalidFlags, Description
filter_5 = StreamFilter(Gate=null_2.NullFlags, Stream0=pshift_4, Stream1=flatten_4)
filter_6 = StreamFilter(Gate=null_2.NullFlags, Stream0=end_jog_arcs_2, Stream1=flatten_6)
merge = Merge(Data1=filter_5, Data2=filter_6)
graft = GraftTree(Tree=merge, IncludeEmptyLists=True, IncludeNullItems=True)
clean_3 = CleanTree(RemoveNulls=True, RemoveInvalid=True, RemoveEmpty=True, Tree=graft)
transition_jog_arcs = Curve(clean_3)

# ---- group: Insert jog corner transitions
corner_jog_arcs_2 = Curve(transition_jog_arcs)
jog_arcs_2 = Curve(jog_arcs)
simplify_6 = SimplifyTree(Tree=jog_arcs_2, Front=False)
pshift_5 = ShiftPaths(Data=simplify_6, Offset=-1)
flatten_7 = FlattenTree(Tree=simplify_6, Path="{0}")
flatten_8 = FlattenTree(Tree=pshift_5, Path="{0}")
clean_4 = CleanTree(RemoveNulls=True, RemoveInvalid=True, RemoveEmpty=False, Tree=flatten_8)
item_13 = ListItem(List=clean_4, Index=0, Wrap=True)
null_3 = NullItem(Item=item_13)  # -> NullFlags, InvalidFlags, Description
filter_7 = StreamFilter(Gate=null_3.NullFlags, Stream0=pshift_5, Stream1=flatten_7)
lng_3 = ListLength(List=filter_7)
ins_2 = InsertItems(List=filter_7, Item=corner_jog_arcs_2, Indices=lng_3, Wrap=False)
jog_arcs_3 = Curve(ins_2)

# ---- group: Weave cuts and jogs
toolpath_arcs_5 = Curve(toolpath_arcs)
jog_arcs_4 = Curve(jog_arcs_3)
jograte_4 = Panel(jograte_3)
feedrate_4 = Panel(feedrate_3)
lng_4 = ListLength(List=toolpath_arcs_5)
lng_5 = ListLength(List=jog_arcs_4)
dup = DuplicateData(Data=feedrate_4, Number=lng_4, Order=True)
dup_2 = DuplicateData(Data=jograte_4, Number=lng_5, Order=True)
simplify_7 = SimplifyTree(Tree=dup_2, Front=False)
simplify_8 = SimplifyTree(Tree=dup, Front=False)
simplify_9 = SimplifyTree(Tree=jog_arcs_4, Front=False)
simplify_10 = SimplifyTree(Tree=toolpath_arcs_5, Front=False)
match = MatchTree(Tree=simplify_7, Guide=simplify_8)
match_2 = MatchTree(Tree=simplify_9, Guide=simplify_10)
weave_2 = Weave(Pattern=[0, 1], Stream0=simplify_8, Stream1=match, NullGaps=False)
weave_3 = Weave(Pattern=[0, 1], Stream0=simplify_10, Stream1=match_2, NullGaps=False)
shift_paths_if_possible = ShiftPathsIfPossible(data_paths_to_shifts=weave_2)
shift_paths_if_possible_2 = ShiftPathsIfPossible(data_paths_to_shifts=weave_3)

# ----
all_toolpaths_are_single_curve_5 = Panel(all_toolpaths_are_single_curve)
feedback = Panel("All good")
feedback_2 = Text(feedback)
feedback_3 = ClusterOutput(feedback_2)

# ---- group: Make helical entry plunge
stepover_distance_3 = Panel(stepover_distance)
make_helical_entry_ramp_2 = Panel(make_helical_entry_ramp)
inner_diameter_overlap = Panel("0.05")
ramp_extra_start_height = Panel("1")
milling_bit_diameter_4 = Panel(milling_bit_diameter_3)
ramp_angle_4 = Panel(ramp_angle_3)
start_arcs = Curve(filter_4)
filter_8 = StreamFilter(Gate=make_helical_entry_ramp_2, Stream1=start_arcs)
rad = Radians(Degrees=ramp_angle_4)
subtraction_3 = Subtraction(A="1", B=inner_diameter_overlap)
rtrig = RightTrigonometry(Beta=rad, PLength=stepover_distance_3)  # -> Alpha, Beta, PLength, QLength, RLength
multiplication_15 = Multiplication(A=milling_bit_diameter_4, B=subtraction_3)
multiplication_16 = Multiplication(A=multiplication_15, B="0.5")
eleveation_per_stepover_distance = Panel(rtrig.QLength)
inner_circle_radius = Panel(multiplication_16)
stepover_distance_4 = Panel(stepover_distance_3)
division_2 = Division(A="1", B="12")
Z_11 = UnitZ(Factor=1)
eleveation_per_stepover_distance_2 = Panel(eleveation_per_stepover_distance)
stepover_distance_5 = Panel(stepover_distance_3)
Z_12 = UnitZ(Factor=1)
xy_3 = XYPlane(Origin=Point(0, 0, 0))
rad_2 = Radians(Degrees="5")
rad_3 = Radians(Degrees="360")
dom_2 = ConstructDomain(DomainStart=rad_2, DomainEnd=rad_3)

# ----
graft_2 = GraftTree(Tree=filter_8, IncludeEmptyLists=True, IncludeNullItems=True)
filter_9 = StreamFilter(Gate=all_toolpaths_are_single_curve_2, Stream0=filter_8, Stream1=graft_2)

# ---- group: Make helical entry plunge (continued)
item_14 = ListItem(List=filter_9, Index=0, Wrap=True)
end_2 = EndPoints(Curve=item_14)  # -> Start, End
dist_3 = Distance(PointA=end_2.Start, PointB=end_2.End)
ln_2 = Line(StartPoint=end_2.Start, EndPoint=end_2.End)
pdecon = Deconstruct(Point=end_2.Start)  # -> XComponent, YComponent, ZComponent
vec2pt_2 = Vector2Pt(PointA=end_2.Start, PointB=end_2.End, Unitize=False)  # -> Vector, Length
multiplication_17 = Multiplication(A=dist_3, B="0.5")
eval_3 = EvaluateLength(Curve=ln_2, Length="0.5", Normalized=True)  # -> Point, Tangent, Parameter
abs = Absolute(Value=pdecon.ZComponent)
start_point = Point(eval_3.Point)
addition_2 = Addition(A=abs, B=ramp_extra_start_height)
rev_4 = Reverse(Vector=vec2pt_2.Vector)
xy_4 = XYPlane(Origin=start_point)
cut_depths = Panel(addition_2)
arc_radius_2 = Panel(multiplication_17)
pl = ConstructPlane(Origin=start_point, XAxis=rev_4, YAxis=Vector(0, 1, 0))
align_2 = AlignPlane(Plane=xy_4, Direction=rev_4)  # -> Plane, Angle
cir = Circle(Plane=align_2.Plane, Radius=multiplication_17)
arc_radius_3 = Panel(arc_radius_2)
flip_2 = FlipCurve(Curve=cir)  # -> Curve, Flag
subtraction_4 = Subtraction(A=arc_radius_3, B=inner_circle_radius)
horizontal_spiral_distance = Panel(subtraction_4)
divide_2 = DivideCurve(Curve=flip_2.Curve, Count="12", Kinks=False)  # -> Points, Tangents, Parameters
division_3 = Division(A=horizontal_spiral_distance, B=stepover_distance_4)
multiplication_18 = Multiplication(A="12", B=division_3)
number_of_spiral_points = Panel(multiplication_18)
series = Series(Start=0, Step=1, Count=number_of_spiral_points)
series_2 = Series(Start=0, Step=division_2, Count=number_of_spiral_points)
item_15 = ListItem(List=divide_2.Points, Index=series, Wrap=True)
multiplication_19 = Multiplication(A=series_2, B=stepover_distance_4)
vec2pt_3 = Vector2Pt(PointA=item_15, PointB=start_point, Unitize=False)  # -> Vector, Length
amp_2 = Amplitude(Vector=vec2pt_3.Vector, Amplitude=multiplication_19)
move_10 = Move(Geometry=item_15, Motion=amp_2)  # -> Geometry, Transform
intcrv_2 = Interpolate(Vertices=move_10.Geometry, Degree=3, Periodic=False, KnotStyle=1)  # -> Curve, Length, Domain
flip_3 = FlipCurve(Curve=intcrv_2.Curve)  # -> Curve, Flag
bottom_flat_spiral = Curve(flip_3.Curve)
end_3 = EndPoints(Curve=bottom_flat_spiral)  # -> Start, End
start_point_2 = Point(start_point)
vec2pt_4 = Vector2Pt(PointA=start_point_2, PointB=end_3.Start, Unitize=False)  # -> Vector, Length
pl_2 = ConstructPlane(Origin=start_point_2, XAxis=vec2pt_4.Vector, YAxis=Z_11)
mirror = Mirror(Geometry=bottom_flat_spiral, Plane=pl_2)  # -> Geometry, Transform
divide_curve_even_lenght = DivideCurveEvenLenght(crv=mirror.Geometry, B=stepover_distance_5)
lng_6 = ListLength(List=divide_curve_even_lenght)
series_3 = Series(Start=0, Step=eleveation_per_stepover_distance_2, Count=lng_6)
Z_13 = UnitZ(Factor=series_3)
move_11 = Move(Geometry=divide_curve_even_lenght, Motion=Z_13)  # -> Geometry, Transform
intcrv_3 = Interpolate(Vertices=move_11.Geometry, Degree=3, Periodic=False, KnotStyle=1)  # -> Curve, Length, Domain
flip_4 = FlipCurve(Curve=intcrv_3.Curve)  # -> Curve, Flag
lower_plunge_helix = Curve(flip_4.Curve)
start_point_3 = Point(start_point)
end_4 = EndPoints(Curve=lower_plunge_helix)  # -> Start, End
vec2pt_5 = Vector2Pt(PointA=start_point_3, PointB=end_4.Start, Unitize=False)  # -> Vector, Length
pl_3 = ConstructPlane(Origin=end_4.Start, XAxis=vec2pt_5.Vector, YAxis=Z_12)
mirror_2 = Mirror(Geometry=lower_plunge_helix, Plane=pl_3)  # -> Geometry, Transform
flip_5 = FlipCurve(Curve=mirror_2.Geometry)  # -> Curve, Flag
xy_5 = XYPlane(Origin=end_4.Start)
mirror_3 = Mirror(Geometry=flip_5.Curve, Plane=xy_5)  # -> Geometry, Transform
upper_plunge_helix = Curve(mirror_3.Geometry)
lower_plunge_helix_2 = Curve(lower_plunge_helix)
merge_2 = Merge(Data1=upper_plunge_helix, Data2=lower_plunge_helix_2)
join = JoinCurves(Curves=merge_2, Preserve=False)
simplify_11 = SimplifyTree(Tree=join, Front=False)
plunge_helix = Curve(simplify_11)
end_5 = EndPoints(Curve=plunge_helix)  # -> Start, End
pdecon_2 = Deconstruct(Point=end_5.Start)  # -> XComponent, YComponent, ZComponent
pdecon_3 = Deconstruct(Point=end_5.End)  # -> XComponent, YComponent, ZComponent
pt = ConstructPoint(XCoordinate=0, YCoordinate=0, ZCoordinate=pdecon_2.ZComponent)
pt_2 = ConstructPoint(XCoordinate=0, YCoordinate=0, ZCoordinate=pdecon_3.ZComponent)
dist_4 = Distance(PointA=pt, PointB=pt_2)
cut_depths_2 = Panel(cut_depths)
plunge_helix_height = Panel(dist_4)
division_4 = Division(A=cut_depths_2, B=plunge_helix_height)
round = Round(Number=division_4)  # -> Nearest, Floor, Ceiling
addition_3 = Addition(A=division_4, B="0.5")
start_point_4 = Point(start_point)
end_6 = EndPoints(Curve=plunge_helix)  # -> Start, End
project_2 = Project(Geometry=end_6.Start, Plane=xy_3)  # -> Geometry, Transform
project_3 = Project(Geometry=start_point_4, Plane=xy_3)  # -> Geometry, Transform
project_4 = Project(Geometry=end_6.End, Plane=xy_3)  # -> Geometry, Transform
vec2pt_6 = Vector2Pt(PointA=project_3.Geometry, PointB=project_4.Geometry, Unitize=False)  # -> Vector, Length
vec2pt_7 = Vector2Pt(PointA=project_3.Geometry, PointB=project_2.Geometry, Unitize=False)  # -> Vector, Length
angle = Angle(VectorA=vec2pt_7.Vector, VectorB=vec2pt_6.Vector, Plane=xy_3)  # -> Angle, Reflex
series_4 = Series(Start=0, Step=plunge_helix_height, Count=round.Ceiling)
series_5 = Series(Start=0, Step=angle.Reflex, Count=round.Ceiling)
Z_14 = UnitZ(Factor=series_4)
move_12 = Move(Geometry=plunge_helix, Motion=Z_14)  # -> Geometry, Transform
xy_6 = XYPlane(Origin=start_point_4)
rotate = Rotate(Geometry=move_12.Geometry, Angle=series_5, Plane=xy_6)  # -> Geometry, Transform
cut_depths_3 = Panel(cut_depths)
join_2 = JoinCurves(Curves=rotate.Geometry, Preserve=False)
bottom_flat_spiral_2 = Curve(bottom_flat_spiral)
simplify_12 = SimplifyTree(Tree=join_2, Front=False)
Z_15 = UnitZ(Factor=cut_depths_3)
plunge_helix_tower = Curve(simplify_12)
move_13 = Move(Geometry=xy_6, Motion=Z_15)  # -> Geometry, Transform
flatten_9 = FlattenTree(Tree=bottom_flat_spiral_2, Path="{0}")
lng_7 = ListLength(List=flatten_9)
pcx = CurvePlane(Curve=plunge_helix_tower, Plane=move_13.Geometry)  # -> Points, ParamsC, ParamsP
arc_radius_4 = Panel(arc_radius_2)
smaller_3 = SmallerThan(FirstNumber=lng_7, SecondNumber="2")  # -> SmallerThan, OrEqualTo
shatter_2 = Shatter(Curve=plunge_helix_tower, Parameters=pcx.ParamsC)
start_point_plane = Plane(align_2.Plane)
rev_5 = ReverseList(List=shatter_2)
filter_10 = StreamFilter(Gate=smaller_3.SmallerThan, Stream0=bottom_flat_spiral_2, Stream1=flatten_9)
item_16 = ListItem(List=rev_5, Index=0, Wrap=True)
rotate_2 = Rotate(Geometry=filter_10, Angle=rad_2, Plane=start_point_plane)  # -> Geometry, Transform
arc_3 = Arc(Plane=start_point_plane, Radius=arc_radius_4, Angle=dom_2)  # -> Arc, Length
rev_6 = ReverseList(List=item_16)
simplify_13 = SimplifyTree(Tree=rotate_2.Geometry, Front=False)
simplify_14 = SimplifyTree(Tree=arc_3.Arc, Front=False)
rotate_3 = Rotate(Geometry=rev_6, Angle=rad_2, Plane=start_point_plane)  # -> Geometry, Transform
join_3 = JoinCurves(Curves=[simplify_13, simplify_14], Preserve=False)
simplify_15 = SimplifyTree(Tree=rotate_3.Geometry, Front=False)
simplify_16 = SimplifyTree(Tree=join_3, Front=False)
flatten_10 = FlattenTree(Tree=simplify_16, Path="{0}")
flatten_11 = FlattenTree(Tree=simplify_15, Path="{0}")
filter_11 = StreamFilter(Gate=smaller_3.SmallerThan, Stream0=simplify_16, Stream1=flatten_10)
filter_12 = StreamFilter(Gate=smaller_3.SmallerThan, Stream0=simplify_15, Stream1=flatten_11)
join_4 = JoinCurves(Curves=[filter_12, filter_11], Preserve=False)
cut_entry_plunges = Curve(join_4)

# ---- group: Prepare ramp for insert
make_helical_entry_ramp_3 = Panel(make_helical_entry_ramp)
ramp_feedrate_2 = Panel(ramp_feedrate)
cut_entry_plunges_2 = Curve(cut_entry_plunges)
lng_8 = ListLength(List=cut_entry_plunges_2)
dup_3 = DuplicateData(Data=ramp_feedrate_2, Number=lng_8, Order=True)
simplify_17 = SimplifyTree(Tree=cut_entry_plunges_2, Front=False)
simplify_18 = SimplifyTree(Tree=dup_3, Front=False)
flatten_12 = FlattenTree(Tree=simplify_18, Path="{0}")
flatten_13 = FlattenTree(Tree=simplify_17, Path="{0}")
filter_13 = StreamFilter(Gate=all_toolpaths_are_single_curve_5, Stream0=simplify_18, Stream1=flatten_12)
filter_14 = StreamFilter(Gate=all_toolpaths_are_single_curve_5, Stream0=simplify_17, Stream1=flatten_13)

# ---- group: Insert ramp feedrates
ins_3 = InsertItems(List=shift_paths_if_possible, Item=filter_13, Indices="0", Wrap=True)
simplify_19 = SimplifyTree(Tree=ins_3, Front=False)
filter_15 = StreamFilter(Gate=make_helical_entry_ramp_3, Stream0=shift_paths_if_possible, Stream1=simplify_19)

# ---- group: Insert ramp geometry
ins_4 = InsertItems(List=shift_paths_if_possible_2, Item=filter_14, Indices="0", Wrap=True)
simplify_20 = SimplifyTree(Tree=ins_4, Front=False)
filter_16 = StreamFilter(Gate=make_helical_entry_ramp_3, Stream0=shift_paths_if_possible_2, Stream1=simplify_20)

# ----
toolpaths = Curve(filter_16)
feedrates = Panel(filter_15)

# ---- group: Preview toolpaths
preview_toolpath = Slider(0, range=0..1)
shift_paths_if_possible_3 = ShiftPathsIfPossible(data_paths_to_shifts=toolpaths)  # disabled
join_5 = JoinCurves(Curves=shift_paths_if_possible_3, Preserve=False)
milling_bit_diameter_5 = Panel(milling_bit_diameter_3)
eval_4 = EvaluateLength(Curve=graft(join_5), Length=preview_toolpath, Normalized=True)  # -> Point, Tangent, Parameter
shatter_3 = Shatter(Curve=graft(join_5), Parameters=eval_4.Parameter)
multiplication_20 = Multiplication(A=milling_bit_diameter_5, B="0.5")
pt_3 = Point(eval_4.Point)
xy_7 = XYPlane(Origin=eval_4.Point)
xy_8 = XYPlane(Origin=Point(0, 0, 0))
item_17 = ListItem(List=shatter_3, Index=0, Wrap=True)
cyl = Cylinder(Base=xy_8, Radius=multiplication_20, Length=Slider(40, range=0..100))
orient_2 = Orient(Geometry=cyl, Source=xy_8, Target=xy_7)  # -> Geometry, Transform
preview = CustomPreview(Geometry=orient_2.Geometry, Shader=ColourSwatch(SwatchColor=RGB(79, 79, 79)))

# ----
feedrates_2 = Number(feedrates)
toolpaths_2 = Curve(toolpaths)
feedrates_3 = ClusterOutput(feedrates_2)
toolpaths_3 = ClusterOutput(toolpaths_2)

# ==== cluster VariableHelixPocket
circles_for_variable_helix_pocket = ClusterInput()
milling_bit_diameter = ClusterInput()
pocket_depth = ClusterInput()
stepover = ClusterInput()
ramp_angle = ClusterInput()
milling_bit_diameter_2 = Number(milling_bit_diameter)
pocket_depth_2 = Number(pocket_depth)
stepover_2 = Number(stepover)
ramp_angle_2 = Number(ramp_angle)
circles_for_variable_helix_pocket_2 = Circle(flatten(circles_for_variable_helix_pocket))
pocket_depth_3 = Panel(pocket_depth_2)
milling_bit_diameter_3 = Panel(milling_bit_diameter_2)
stepover_3 = Panel(stepover_2)
ramp_angle_3 = Panel(ramp_angle_2)
ramp_extra_start_height = Panel("0.5")
inner_diameter_overlap = Panel("0.05")
neg = Negative(Value=pocket_depth_3)
Z = UnitZ(Factor=neg)
multiplication = Multiplication(A=milling_bit_diameter_3, B=stepover_3)
move = Move(Geometry=circles_for_variable_helix_pocket_2, Motion=Z)  # -> Geometry, Transform
stepover_distance = Panel(multiplication)
len = Length(Curve=move.Geometry)
area = Area(Geometry=move.Geometry)  # -> Area, Centroid
pi = Pi(Factor=1)
rad = Radians(Degrees=ramp_angle_3)
start_point = Point(graft(area.Centroid))

# ---- group: Fix climb conventional detection
flip = FlipCurve(Curve=move.Geometry)  # -> Curve, Flag

# ----
division = Division(A=len, B=pi)
subtraction = Subtraction(A="1", B=inner_diameter_overlap)
rtrig = RightTrigonometry(Beta=rad, PLength=stepover_distance)  # -> Alpha, Beta, PLength, QLength, RLength
flip_2 = FlipCurve(Curve=flip.Curve)  # -> Curve, Flag
multiplication_2 = Multiplication(A=milling_bit_diameter_3, B=subtraction)
multiplication_3 = Multiplication(A=multiplication_2, B="0.5")
division_2 = Division(A=division, B="2")
eleveation_per_stepover_distance = Panel(rtrig.QLength)
addition = Addition(A=pocket_depth_3, B=ramp_extra_start_height)
circle_radius_radius = Panel(division_2)
cut_depths = Panel(addition)
arc_radius = Panel(circle_radius_radius)
inner_circle_radius = Panel(multiplication_3)
stepover_distance_2 = Panel(stepover_distance)
subtraction_2 = Subtraction(A=arc_radius, B=inner_circle_radius)
horizontal_spiral_distance = Panel(subtraction_2)
division_3 = Division(A="1", B="12")
divide = DivideCurve(Curve=flip.Curve, Count="12", Kinks=False)  # -> Points, Tangents, Parameters
division_4 = Division(A=horizontal_spiral_distance, B=stepover_distance_2)
multiplication_4 = Multiplication(A="12", B=division_4)
number_of_spiral_points = Panel(multiplication_4)
series = Series(Start=0, Step=1, Count=number_of_spiral_points)
series_2 = Series(Start=0, Step=division_3, Count=number_of_spiral_points)
item = ListItem(List=divide.Points, Index=series, Wrap=True)
multiplication_5 = Multiplication(A=series_2, B=stepover_distance_2)
vec2pt = Vector2Pt(PointA=item, PointB=start_point, Unitize=False)  # -> Vector, Length
amp = Amplitude(Vector=vec2pt.Vector, Amplitude=multiplication_5)
move_2 = Move(Geometry=item, Motion=amp)  # -> Geometry, Transform
intcrv = Interpolate(Vertices=move_2.Geometry, Degree=3, Periodic=False, KnotStyle=1)  # -> Curve, Length, Domain
flip_3 = FlipCurve(Curve=intcrv.Curve)  # -> Curve, Flag
bottom_flat_spiral = Curve(flip_3.Curve)
end = EndPoints(Curve=bottom_flat_spiral)  # -> Start, End
start_point_2 = Point(start_point)
vec2pt_2 = Vector2Pt(PointA=start_point_2, PointB=end.Start, Unitize=False)  # -> Vector, Length
Z_2 = UnitZ(Factor=1)
pl = ConstructPlane(Origin=start_point_2, XAxis=vec2pt_2.Vector, YAxis=Z_2)
mirror = Mirror(Geometry=bottom_flat_spiral, Plane=pl)  # -> Geometry, Transform
eleveation_per_stepover_distance_2 = Panel(eleveation_per_stepover_distance)
stepover_distance_3 = Panel(stepover_distance)
divide_curve_even_lenght = DivideCurveEvenLenght(crv=mirror.Geometry, B=stepover_distance_3)
lng = ListLength(List=divide_curve_even_lenght)
series_3 = Series(Start=0, Step=eleveation_per_stepover_distance_2, Count=lng)
Z_3 = UnitZ(Factor=series_3)
move_3 = Move(Geometry=divide_curve_even_lenght, Motion=Z_3)  # -> Geometry, Transform
intcrv_2 = Interpolate(Vertices=move_3.Geometry, Degree=3, Periodic=False, KnotStyle=1)  # -> Curve, Length, Domain
flip_4 = FlipCurve(Curve=intcrv_2.Curve)  # -> Curve, Flag
lower_plunge_helix = Curve(flip_4.Curve)
start_point_3 = Point(start_point)
end_2 = EndPoints(Curve=lower_plunge_helix)  # -> Start, End
vec2pt_3 = Vector2Pt(PointA=start_point_3, PointB=end_2.Start, Unitize=False)  # -> Vector, Length
Z_4 = UnitZ(Factor=1)
pl_2 = ConstructPlane(Origin=end_2.Start, XAxis=vec2pt_3.Vector, YAxis=Z_4)
mirror_2 = Mirror(Geometry=lower_plunge_helix, Plane=pl_2)  # -> Geometry, Transform
flip_5 = FlipCurve(Curve=mirror_2.Geometry)  # -> Curve, Flag
xy = XYPlane(Origin=end_2.Start)
mirror_3 = Mirror(Geometry=flip_5.Curve, Plane=xy)  # -> Geometry, Transform
upper_plunge_helix = Curve(mirror_3.Geometry)
lower_plunge_helix_2 = Curve(lower_plunge_helix)
merge = Merge(Data1=upper_plunge_helix, Data2=lower_plunge_helix_2)
join = JoinCurves(Curves=merge, Preserve=False)
simplify = SimplifyTree(Tree=join, Front=False)
plunge_helix = Curve(simplify)
end_3 = EndPoints(Curve=plunge_helix)  # -> Start, End
pdecon = Deconstruct(Point=end_3.Start)  # -> XComponent, YComponent, ZComponent
pdecon_2 = Deconstruct(Point=end_3.End)  # -> XComponent, YComponent, ZComponent
pt = ConstructPoint(XCoordinate=0, YCoordinate=0, ZCoordinate=pdecon.ZComponent)
pt_2 = ConstructPoint(XCoordinate=0, YCoordinate=0, ZCoordinate=pdecon_2.ZComponent)
dist = Distance(PointA=pt, PointB=pt_2)
cut_depths_2 = Panel(cut_depths)
plunge_helix_height = Panel(dist)
division_5 = Division(A=cut_depths_2, B=plunge_helix_height)
start_point_4 = Point(start_point)
round = Round(Number=division_5)  # -> Nearest, Floor, Ceiling
addition_2 = Addition(A=division_5, B="0.5")
end_4 = EndPoints(Curve=plunge_helix)  # -> Start, End
xy_2 = XYPlane(Origin=Point(0, 0, 0))
project = Project(Geometry=end_4.Start, Plane=xy_2)  # -> Geometry, Transform
project_2 = Project(Geometry=start_point_4, Plane=xy_2)  # -> Geometry, Transform
project_3 = Project(Geometry=end_4.End, Plane=xy_2)  # -> Geometry, Transform
vec2pt_4 = Vector2Pt(PointA=project_2.Geometry, PointB=project_3.Geometry, Unitize=False)  # -> Vector, Length
vec2pt_5 = Vector2Pt(PointA=project_2.Geometry, PointB=project.Geometry, Unitize=False)  # -> Vector, Length
angle = Angle(VectorA=vec2pt_5.Vector, VectorB=vec2pt_4.Vector, Plane=xy_2)  # -> Angle, Reflex
series_4 = Series(Start=0, Step=plunge_helix_height, Count=round.Ceiling)
series_5 = Series(Start=0, Step=angle.Reflex, Count=round.Ceiling)
Z_5 = UnitZ(Factor=series_4)
move_4 = Move(Geometry=plunge_helix, Motion=Z_5)  # -> Geometry, Transform
xy_3 = XYPlane(Origin=start_point_4)
rotate = Rotate(Geometry=move_4.Geometry, Angle=series_5, Plane=xy_3)  # -> Geometry, Transform
cut_depths_3 = Panel(cut_depths)
join_2 = JoinCurves(Curves=rotate.Geometry, Preserve=False)
simplify_2 = SimplifyTree(Tree=join_2, Front=False)
Z_6 = UnitZ(Factor=cut_depths_3)
plunge_helix_tower = Curve(simplify_2)
move_5 = Move(Geometry=xy_3, Motion=Z_6)  # -> Geometry, Transform
pcx = CurvePlane(Curve=plunge_helix_tower, Plane=move_5.Geometry)  # -> Points, ParamsC, ParamsP
shatter = Shatter(Curve=plunge_helix_tower, Parameters=pcx.ParamsC)
crv = Curve(flip_2.Curve)
panel = Panel("""0
0.98""")
rev = ReverseList(List=shatter)
item_2 = ListItem(List=rev, Index=0, Wrap=True)
bottom_flat_spiral_2 = Curve(bottom_flat_spiral)
eval = EvaluateLength(Curve=crv, Length=panel, Normalized=True)  # -> Point, Tangent, Parameter
rev_2 = ReverseList(List=item_2)
shatter_2 = Shatter(Curve=crv, Parameters=eval.Parameter)
join_3 = JoinCurves(Curves=flatten([bottom_flat_spiral_2, rev_2]), Preserve=False)
item_3 = ListItem(List=shatter_2, Index=0, Wrap=True)
join_4 = JoinCurves(Curves=flatten([item_3, join_3]), Preserve=True)
pocket_toolpaths = Curve(join_4)
pocket_toolpaths_2 = ClusterOutput(pocket_toolpaths)

# ==== cluster CutoutOrProfile: Creates cutout toolpaths from closed flat 2D curves. Compensates for the diameter of your milling bit. It will detect curves inside curves. Inside curves will be cut first and on the inside of the curve. Outside curves last and on the outside of the curve. Note: Only one level of curve inside curve is supported. Use multiple setups to achieve a cure inside a curve inside a curve. Supports climb and conventional. Supports inside cutting, but remember to switch of when your are done cutting a inside hole. Cutting your outer geometry on the inside is classic.
use_climb_direction = ClusterInput()
use_inside_cutting = ClusterInput()
curves_for_cutout = ClusterInput()
cutout_tolerance = ClusterInput()
tool_diameter = ClusterInput()
pass_depth = ClusterInput()
cut_depth = ClusterInput()
use_climb_direction_2 = Integer(use_climb_direction)
use_inside_cutting_2 = Integer(use_inside_cutting)
curves_for_cutout_2 = Curve(curves_for_cutout)
cutout_tolerance_2 = Number(cutout_tolerance)
tool_diameter_2 = Number(tool_diameter)
pass_depth_2 = Number(pass_depth)
cut_depth_2 = Number(cut_depth)
tool_diameter_3 = Panel(tool_diameter_2)
use_climb_direction_3 = Panel(use_climb_direction_2)
use_inside_cutting_3 = Panel(use_inside_cutting_2)

# ---- group: Filter out open curves
curves_for_cutout_3 = Curve(curves_for_cutout_2)
cls = Closed(Curve=curves_for_cutout_3)  # -> Closed, Periodic
dispatch = Dispatch(List=curves_for_cutout_3, DispatchPattern=cls.Closed)  # -> ListA, ListB

# ----
xy = XYPlane(Origin=Point(0, 0, 0))
operation_plane = Plane(xy)
multiplication = Multiplication(A=tool_diameter_3, B="0.5")
cutout_tolerance_3 = Panel(cutout_tolerance_2)
tool_radius = Panel(multiplication)

# ---- group: Re-join to assist in offsetting
explode = Explode(Curve=dispatch.ListA, Recursive=True)  # -> Segments, Vertices
join = JoinCurves(Curves=explode.Segments, Preserve=False)
cls_2 = Closed(Curve=join)  # -> Closed, Periodic
crv = Curve(graft(dispatch.ListA))
p_n_c = PickNChoose(Pattern=cls_2.Closed, Stream0=crv, Stream1=join)
flatten = FlattenTree(Tree=p_n_c, Path="{0}")

# ----
addition = Addition(A=tool_radius, B=cutout_tolerance_3)
compensated_tool_radius = Panel(addition)

# ---- group: Merge overlapping curves
curves_for_merging_overlap = Curve(flatten)
mcx = MultipleCurves(Curves=curves_for_merging_overlap)  # -> Points, IndexA, IndexB, ParamA, ParamB
dcon = DeleteConsecutive(Set=[mcx.IndexA, mcx.IndexB], Wrap=False)  # -> Set, Count
item = ListItem(List=curves_for_merging_overlap, Index=dcon.Set, Wrap=True)
cull_i = CullIndex(List=curves_for_merging_overlap, Indices=dcon.Set, Wrap=True)
runion = RegionUnion(Curves=item, Plane=operation_plane)
merged_overlapping_curves = Curve([runion, cull_i])

# ----
use_inside_cutting_4 = Panel(use_inside_cutting_3)
operation_plane_2 = Plane(operation_plane)
neg = Negative(Value=compensated_tool_radius)
pass_depth_3 = Number(pass_depth_2)
cut_depth_3 = Number(cut_depth_2)

# ---- group: Align curve directions
curves_for_aligned_direction = Curve(merged_overlapping_curves)
graft = GraftTree(Tree=curves_for_aligned_direction, IncludeEmptyLists=True, IncludeNullItems=True)
offset = Offset(Curve=graft, Distance="0.01", Plane=PlaneXY(0, 0, 0), Corners=2)
end = EndPoints(Curve=offset)  # -> Start, End
pshift = ShiftPaths(Data=end.Start, Offset=-1)
incurve = PointInCurve(Point=pshift, Curve=graft)  # -> Relationship, Point
multiplication_2 = Multiplication(A=incurve.Relationship, B="0.5")
round = Round(Number=multiplication_2)  # -> Nearest, Floor, Ceiling
crv_2 = Curve(graft)
int = Integer(round.Nearest)
flip = FlipCurve(Curve=crv_2)  # -> Curve, Flag
weave = Weave(Pattern=int, Stream0=flip.Curve, Stream1=crv_2, NullGaps=False)
pshift_2 = ShiftPaths(Data=weave, Offset=-1)

# ----
flip_2 = FlipCurve(Curve=pshift_2)  # -> Curve, Flag
filter = StreamFilter(Gate=use_inside_cutting_4, Stream0=pshift_2, Stream1=flip_2.Curve)

# ---- group: Align curve directions (continued)
aligned_curves = Curve(filter)

# ---- group: Detect curves inside curves
aligned_curves_2 = Curve(aligned_curves)
graft_2 = GraftTree(Tree=aligned_curves_2, IncludeEmptyLists=True, IncludeNullItems=True)
end_2 = EndPoints(Curve=aligned_curves_2)  # -> Start, End
incurve_2 = PointInCurve(Point=end_2.Start, Curve=graft_2)  # -> Relationship, Point
multiplication_3 = Multiplication(A=incurve_2.Relationship, B="0.5")
round_2 = Round(Number=multiplication_3)  # -> Nearest, Floor, Ceiling
int_2 = Integer(round_2.Floor)
flip_3 = FlipMatrix(Data=int_2)
ma = MassAddition(Input=flip_3)  # -> Result, PartialResults
pshift_3 = ShiftPaths(Data=ma.Result, Offset=-1)
dispatch_2 = Dispatch(List=aligned_curves_2, DispatchPattern=pshift_3)  # -> ListA, ListB
curves_outside = Curve(dispatch_2.ListB)
curves_inside = Curve(dispatch_2.ListA)

# ----
curves_for_offset_outwards = Curve(curves_outside)
curves_for_offset_inwards = Curve(curves_inside)
offset_2 = Offset(Curve=curves_for_offset_outwards, Distance=neg, Plane=operation_plane_2, Corners=2)
offset_3 = Offset(Curve=curves_for_offset_inwards, Distance=compensated_tool_radius, Plane=operation_plane_2, Corners=2)
pshift_4 = ShiftPaths(Data=offset_3, Offset=-1)
pshift_5 = ShiftPaths(Data=offset_2, Offset=-1)
flip_4 = FlipCurve(Curve=pshift_4)  # -> Curve, Flag
outside_cutout_curves = Curve(pshift_5)
inside_cutout_curves = Curve(flip_4.Curve)

outside_cutout_curves_2 = Curve(outside_cutout_curves)
inside_cutout_curves_2 = Curve(inside_cutout_curves)
inside_outline_curves = Curve(inside_cutout_curves_2)
flatten_2 = FlattenTree(Tree=outside_cutout_curves_2, Path="{0}")
end_3 = EndPoints(Curve=inside_outline_curves)  # -> Start, End
incurves = PointInCurves(Point=end_3.Start, Curves=flatten_2)  # -> Relationship, Index, Point
addition_2 = Addition(A=incurves.Index, B="1")
ins = InsertItems(List=flatten_2, Item=inside_outline_curves, Indices=incurves.Index, Wrap=True)

# ---- group: Flip curves for climb direction
sorted_inside_and_outside_curves = Curve(ins)
use_climb_direction_4 = Panel(use_climb_direction_3)
flip_5 = FlipCurve(Curve=sorted_inside_and_outside_curves)  # -> Curve, Flag
filter_2 = StreamFilter(Gate=use_climb_direction_4, Stream0=flip_5.Curve, Stream1=sorted_inside_and_outside_curves)
sorted_inside_and_outside_curves_2 = Curve(filter_2)

# ---- group: Move cutout toolpaths to cut depths
sorted_inside_and_outside_curves_3 = Curve(sorted_inside_and_outside_curves_2)
pass_depth_4 = Panel(pass_depth_3)
cut_depth_cutout = Panel(cut_depth_3)
division = Division(A=cut_depth_cutout, B=pass_depth_4)
graft_3 = GraftTree(Tree=sorted_inside_and_outside_curves_3, IncludeEmptyLists=True, IncludeNullItems=True)
round_3 = Round(Number=division)  # -> Nearest, Floor, Ceiling
division_2 = Division(A=cut_depth_cutout, B=round_3.Ceiling)
actual_pass_depth = Panel(division_2)
series = Series(Start=actual_pass_depth, Step=actual_pass_depth, Count=round_3.Ceiling)
neg_2 = Negative(Value=series)
Z = UnitZ(Factor=neg_2)
simplify = SimplifyTree(Tree=graft_3, Front=False)
simplify_2 = SimplifyTree(Tree=Z, Front=False)
move = Move(Geometry=simplify, Motion=simplify_2)  # -> Geometry, Transform
flatten_3 = FlattenTree(Tree=move.Geometry, Path="{0}")

# ----
cutout_toolpaths = Curve(flatten_3)
cutout_toolpaths_2 = ClusterOutput(cutout_toolpaths)

# ==== cluster CNCMillingPostProcessor: Converts toolpath curves into coordinates that a CNC machine can read. Use tab boxes for making safe cutouts, and ramps for smooth entry into hard materials.
use_custom_jog_home = ClusterInput()
milling_bit_diameter = ClusterInput()
deviation_tolerance = ClusterInput()
custom_home_x = ClusterInput()
toolpath_curves = ClusterInput()
custom_home_y = ClusterInput()
ramp_plunges = ClusterInput()
spindle_speed = ClusterInput()
safe_z_height = ClusterInput()
ramp_angle = ClusterInput()
use_spindle = ClusterInput()
plunge_rate = ClusterInput()
tab_breps = ClusterInput()
job_name = ClusterInput()
feed_rate = ClusterInput()

convert_to_inches = BooleanToggle(False)
toolpath_curves_2 = Curve(toolpath_curves)
tab_breps_2 = Brep(tab_breps)
feed_rate_2 = Number(feed_rate)
plunge_rate_2 = Number(plunge_rate)
safe_z_height_2 = Number(safe_z_height)
use_spindle_2 = Integer(use_spindle)
spindle_speed_2 = Number(spindle_speed)
ramp_plunges_2 = Integer(ramp_plunges)
ramp_angle_2 = Number(ramp_angle)
use_custom_jog_home_2 = Integer(use_custom_jog_home)
custom_home_x_2 = Number(custom_home_x)
custom_home_y_2 = Number(custom_home_y)
deviation_tolerance_2 = Number(deviation_tolerance)
milling_bit_diameter_2 = Number(milling_bit_diameter)
job_name_2 = Text(job_name)
use_inches_boolean = Panel(convert_to_inches)
flatten = FlattenTree(Tree=toolpath_curves_2, Path="{0}")
flatten_2 = FlattenTree(Tree=tab_breps_2, Path="{0}")
clean = CleanTree(RemoveNulls=True, RemoveInvalid=True, RemoveEmpty=False, Tree=flatten)
filter = StreamFilter(Gate=use_inches_boolean, Stream0="1", Stream1="25.4")
division = Division(A=custom_home_x_2, B=filter)
division_2 = Division(A=custom_home_y_2, B=filter)
join = TextJoin(Text=flatten(["'", job_name_2]))
topoly = CurveToPolyline(Curve=clean, ToleranceDistance=deviation_tolerance_2, ToleranceAngle=0)  # -> Polyline, Segments
division_3 = Division(A=feed_rate_2, B=filter)
division_4 = Division(A=plunge_rate_2, B=filter)
division_5 = Division(A=safe_z_height_2, B=filter)
polyline_toolpaths = Curve(topoly.Polyline)

jog_rate_z = Number(20)

safe_z_height_3 = Number(6)
convert_to_inches_2 = BooleanToggle(False)
plunge_rate_3 = Number(20)
feed_rate_3 = Number(20)
toolpath_curves_3 = Curve()
tab_breps_3 = Brep()
use_spindle_3 = Integer(1)
spindle_speed_3 = Number(18000)
ramp_plunges_3 = Integer(0)
ramp_angle_3 = Number(25)
use_custom_jog_home_3 = Integer(0)
custom_home_x_3 = Number(612)
custom_home_y_3 = Number(612)
deviation_tolerance_3 = Number(0.02)
milling_bit_diameter_3 = Number()
job_name_3 = Text("Bark beetle toolpath")
use_inches_boolean_2 = Panel(convert_to_inches_2)
flatten_3 = FlattenTree(Tree=toolpath_curves_3, Path="{0}")
flatten_4 = FlattenTree(Tree=tab_breps_3, Path="{0}")
clean_2 = CleanTree(RemoveNulls=True, RemoveInvalid=True, RemoveEmpty=False, Tree=flatten_3)
filter_2 = StreamFilter(Gate=use_inches_boolean_2, Stream0="1", Stream1="25.4")
division_6 = Division(A=custom_home_x_3, B=filter_2)
division_7 = Division(A=custom_home_y_3, B=filter_2)
join_2 = TextJoin(Text=flatten(["'", job_name_3]))
topoly_2 = CurveToPolyline(Curve=clean_2, ToleranceDistance=deviation_tolerance_3, ToleranceAngle=0)  # -> Polyline, Segments
division_8 = Division(A=feed_rate_3, B=filter_2)
division_9 = Division(A=plunge_rate_3, B=filter_2)
division_10 = Division(A=safe_z_height_3, B=filter_2)
polyline_toolpaths_2 = Curve(topoly_2.Polyline)

jog_rate = Number(20)
preview_position = Slider(0, range=0..1)
multiplication = Multiplication(A=jog_rate, B="60")
multiplication_2 = Multiplication(A=jog_rate_z, B="60")
multiplication_3 = Multiplication(A=feed_rate_3, B="60")
multiplication_4 = Multiplication()
jog_rate_z_2 = Number(multiplication_2)
jog_rate_x_y = Number(multiplication)
feed_rate_4 = Number(multiplication_3)
home_y = Number(Slider(0, range=0..1000))
home_x = Number(Slider(0, range=0..1000))

# ---- group: Eliminate unecessary jog Z
connect_overlapping_toolpaths = ConnectOverlappingToolpaths(polyline_toolpaths=polyline_toolpaths)

# ----
ramp_plunges_4 = Integer(ramp_plunges_2)
filter_3 = StreamFilter(Gate=ramp_plunges_4, Stream0=connect_overlapping_toolpaths, Stream1=polyline_toolpaths)

# ---- group: Eliminate unecessary jog Z
connect_overlapping_toolpaths_2 = ConnectOverlappingToolpaths(polyline_toolpaths=polyline_toolpaths_2)

# ---- group: Adds tabs to toolpaths
tab_toolpaths = TabToolpaths(polyline_toolpaths=filter_3, tab_breps=flatten_2, milling_bit_diamter=milling_bit_diameter_2)  # -> tabbed_toolpaths_3, tab_cleanup_toolpaths_4

# ----
ramp_plunges_5 = Integer(ramp_plunges_3)
tab_cleanup_toolpaths = Curve(tab_toolpaths.tab_cleanup_toolpaths_4)
filter_4 = StreamFilter(Gate=ramp_plunges_5, Stream0=connect_overlapping_toolpaths_2, Stream1=polyline_toolpaths_2)

# ---- group: Add ramps to toolpaths
ramp_toolpath_plunges = RampToolpathPlunges(toolpaths_to_ramp=tab_toolpaths.tabbed_toolpaths_3, ramp_angle=ramp_angle_2)
ramp_plunges_6 = Integer(ramp_plunges_2)
filter_5 = StreamFilter(Gate=flatten(ramp_plunges_6), Stream0=flatten(tab_toolpaths.tabbed_toolpaths_3), Stream1=flatten(ramp_toolpath_plunges))

# ---- group: Add ramps to cleanup toolpaths
ramp_toolpath_plunges_2 = RampToolpathPlunges(toolpaths_to_ramp=tab_cleanup_toolpaths, ramp_angle=ramp_angle_2)
ramp_plunges_7 = Integer(ramp_plunges_2)
filter_6 = StreamFilter(Gate=ramp_plunges_7, Stream0=tab_cleanup_toolpaths, Stream1=ramp_toolpath_plunges_2)

# ---- group: Adds tabs to toolpaths
tab_toolpaths_2 = TabToolpaths(polyline_toolpaths=filter_4, tab_breps=flatten_4, milling_bit_diamter=milling_bit_diameter_3)  # -> tabbed_toolpaths_3, tab_cleanup_toolpaths_4

# ----
tab_cleanup_toolpaths_2 = Curve(tab_toolpaths_2.tab_cleanup_toolpaths_4)

# ---- group: Add ramps to cleanup toolpaths
ramp_toolpath_plunges_3 = RampToolpathPlunges_2(toolpaths_to_ramp=tab_cleanup_toolpaths_2, ramp_angle=ramp_angle_3)
ramp_plunges_8 = Integer(ramp_plunges_3)
filter_7 = StreamFilter(Gate=ramp_plunges_8, Stream0=tab_cleanup_toolpaths_2, Stream1=ramp_toolpath_plunges_3)

# ----
connect_overlapping_toolpaths_3 = ConnectOverlappingToolpaths(polyline_toolpaths=filter_7)

safe_z_height_4 = Number(division_10)
cp = ControlPoints(Curve=connect_overlapping_toolpaths_3)  # -> Points, Weights, Knots

# ---- group: Add ramps to toolpaths
ramp_toolpath_plunges_4 = RampToolpathPlunges_2(toolpaths_to_ramp=tab_toolpaths_2.tabbed_toolpaths_3, ramp_angle=ramp_angle_3)
ramp_plunges_9 = Integer(ramp_plunges_3)
filter_8 = StreamFilter(
    Gate=flatten(ramp_plunges_9),
    Stream0=flatten(tab_toolpaths_2.tabbed_toolpaths_3),
    Stream1=flatten(ramp_toolpath_plunges_4))

# ----
connect_overlapping_toolpaths_4 = ConnectOverlappingToolpaths(polyline_toolpaths=filter_5)
connect_overlapping_toolpaths_5 = ConnectOverlappingToolpaths(polyline_toolpaths=filter_6)
connect_overlapping_toolpaths_6 = ConnectOverlappingToolpaths(polyline_toolpaths=filter_8)

# ---- group: Create safe Z transtions
cp_2 = ControlPoints(Curve=connect_overlapping_toolpaths_4)  # -> Points, Weights, Knots
rev = ReverseList(List=cp_2.Points)
safe_z_height_5 = Number(division_5)
item = ListItem(List=cp_2.Points, Index=0, Wrap=True)
item_2 = ListItem(List=rev, Index=0, Wrap=True)
pdecon = Deconstruct(Point=item)  # -> XComponent, YComponent, ZComponent
pdecon_2 = Deconstruct(Point=item_2)  # -> XComponent, YComponent, ZComponent
pt = ConstructPoint(XCoordinate=pdecon.XComponent, YCoordinate=pdecon.YComponent, ZCoordinate=safe_z_height_5)
pt_2 = ConstructPoint(XCoordinate=pdecon_2.XComponent, YCoordinate=pdecon_2.YComponent, ZCoordinate=safe_z_height_5)
safe_z_end_point = Point(pt_2)
safe_z_start_point = Point(pt)

# ----
flatten_5 = FlattenTree(Tree=cp_2.Points, Path="{0}")  # disabled

safe_z_height_6 = Number(division_5)
cp_3 = ControlPoints(Curve=connect_overlapping_toolpaths_5)  # -> Points, Weights, Knots

lng = ListLength(List=flatten_5)
multiplication_5 = Multiplication(A=lng, B=Slider(0.048775, range=0..1))
item_3 = ListItem(List=flatten_5, Index=multiplication_5, Wrap=True)

# ---- group: Create safe Z transtions
cp_4 = ControlPoints(Curve=connect_overlapping_toolpaths_6)  # -> Points, Weights, Knots
rev_2 = ReverseList(List=cp_4.Points)
safe_z_height_7 = Number(division_10)
item_4 = ListItem(List=cp_4.Points, Index=0, Wrap=True)
item_5 = ListItem(List=rev_2, Index=0, Wrap=True)
pdecon_3 = Deconstruct(Point=item_4)  # -> XComponent, YComponent, ZComponent
pdecon_4 = Deconstruct(Point=item_5)  # -> XComponent, YComponent, ZComponent
pt_3 = ConstructPoint(XCoordinate=pdecon_3.XComponent, YCoordinate=pdecon_3.YComponent, ZCoordinate=safe_z_height_7)
pt_4 = ConstructPoint(XCoordinate=pdecon_4.XComponent, YCoordinate=pdecon_4.YComponent, ZCoordinate=safe_z_height_7)
safe_z_end_point_2 = Point(pt_4)
safe_z_start_point_2 = Point(pt_3)

# ----
toolpath_points = Point(cp_4.Points)
rev_3 = ReverseList(List=toolpath_points)
safe_z_height_8 = Number(safe_z_height_3)
item_6 = ListItem(List=toolpath_points, Index=0, Wrap=True)
item_7 = ListItem(List=rev_3, Index=0, Wrap=True)
pdecon_5 = Deconstruct(Point=item_6)  # -> XComponent, YComponent, ZComponent
pdecon_6 = Deconstruct(Point=item_7)  # -> XComponent, YComponent, ZComponent
pt_5 = ConstructPoint(XCoordinate=pdecon_5.XComponent, YCoordinate=pdecon_5.YComponent, ZCoordinate=safe_z_height_8)
pt_6 = ConstructPoint(XCoordinate=pdecon_6.XComponent, YCoordinate=pdecon_6.YComponent, ZCoordinate=safe_z_height_8)

toolpath_points_2 = Point(cp.Points)

toolpath_points_3 = Point(toolpath_points)
flatten_6 = FlattenTree(Tree=toolpath_points_3, Path="{0}")
lng_2 = ListLength(List=flatten_6)
feed_rate_5 = Number(feed_rate_4)
dup = DuplicateData(Data=graft(feed_rate_5), Number=graft(lng_2), Order=True)
lng_3 = ListLength(List=toolpath_points_3)
dup_2 = DuplicateData(Data=flatten("F"), Number=flatten(lng_2), Order=True)
dup_3 = DuplicateData(Data=flatten(" X"), Number=flatten(lng_2), Order=True)
flatten_7 = FlattenTree(Tree=dup_2, Path="{0}")
flatten_8 = FlattenTree(Tree=dup_3, Path="{0}")
flatten_9 = FlattenTree(Tree=dup, Path="{0}")
pdecon_7 = Deconstruct(Point=toolpath_points_3)  # -> XComponent, YComponent, ZComponent
graft = GraftTree(Tree=flatten_7, IncludeEmptyLists=True, IncludeNullItems=True)
graft_2 = GraftTree(Tree=flatten_9, IncludeEmptyLists=True, IncludeNullItems=True)
graft_3 = GraftTree(Tree=flatten_8, IncludeEmptyLists=True, IncludeNullItems=True)
panel = Panel(pdecon_7.XComponent)
panel_2 = Panel(pdecon_7.YComponent)
panel_3 = Panel(pdecon_7.ZComponent)
join_3 = TextJoin(Text=[graft, graft_2, graft_3])
dup_4 = DuplicateData(Data=" Z", Number=lng_3, Order=True)
dup_5 = DuplicateData(Data=" Y", Number=lng_3, Order=True)
dup_6 = DuplicateData(Data="G1 ", Number=lng_3, Order=True)
simplify = SimplifyTree(Tree=flatten(join_3), Front=False)
simplify_2 = SimplifyTree(Tree=flatten(dup_6), Front=False)
simplify_3 = SimplifyTree(Tree=flatten(panel), Front=False)
simplify_4 = SimplifyTree(Tree=flatten(dup_5), Front=False)
simplify_5 = SimplifyTree(Tree=flatten(panel_2), Front=False)
simplify_6 = SimplifyTree(Tree=flatten(dup_4), Front=False)
simplify_7 = SimplifyTree(Tree=flatten(panel_3), Front=False)
graft_4 = GraftTree(Tree=simplify_2, IncludeEmptyLists=True, IncludeNullItems=True)
graft_5 = GraftTree(Tree=simplify_3, IncludeEmptyLists=True, IncludeNullItems=True)
graft_6 = GraftTree(Tree=simplify_4, IncludeEmptyLists=True, IncludeNullItems=True)
graft_7 = GraftTree(Tree=simplify_5, IncludeEmptyLists=True, IncludeNullItems=True)
graft_8 = GraftTree(Tree=simplify_6, IncludeEmptyLists=True, IncludeNullItems=True)
graft_9 = GraftTree(Tree=simplify_7, IncludeEmptyLists=True, IncludeNullItems=True)
graft_10 = GraftTree(Tree=simplify, IncludeEmptyLists=True, IncludeNullItems=True)
join_4 = TextJoin(Text=[graft_4, graft_10, graft_5, graft_6, graft_7, graft_8, graft_9])
flatten_10 = FlattenTree(Tree=join_4, Path="{0}")
panel_4 = Panel(flatten_10)

pdecon_8 = Deconstruct(Point=toolpath_points_2)  # -> XComponent, YComponent, ZComponent

# ---- group: Optional MM to inch conversion
convert_to_inches_boolean = Panel(convert_to_inches_2)
filter_9 = StreamFilter(Gate=convert_to_inches_boolean, Stream0="1", Stream1="25.4")
division_11 = Division(A=pdecon_8.XComponent, B=filter_9)
division_12 = Division(A=pdecon_8.YComponent, B=filter_9)
division_13 = Division(A=pdecon_8.ZComponent, B=filter_9)

# ----
lng_4 = ListLength(List=toolpath_points_2)
toolpath_points_4 = Point(cp_2.Points)
flatten_11 = FlattenTree(Tree=lng_4, Path="{0}")
toolpath_points_5 = Point(cp_3.Points)
panel_5 = Panel(panel_4)
merge = Merge(Data1=Slider(0, range=0..100), Data2=flatten_11)
panel_6 = Panel(division_11)
panel_7 = Panel(division_12)
panel_8 = Panel(division_13)
pdecon_9 = Deconstruct(Point=toolpath_points_4)  # -> XComponent, YComponent, ZComponent

# ---- group: Optional MM to inch conversion
convert_to_inches_boolean_2 = Panel(convert_to_inches)
filter_10 = StreamFilter(Gate=convert_to_inches_boolean_2, Stream0="1", Stream1="25.4")
division_14 = Division(A=pdecon_9.XComponent, B=filter_10)
division_15 = Division(A=pdecon_9.YComponent, B=filter_10)
division_16 = Division(A=pdecon_9.ZComponent, B=filter_10)

# ----
lng_5 = ListLength(List=toolpath_points_4)
pdecon_10 = Deconstruct(Point=toolpath_points_5)  # -> XComponent, YComponent, ZComponent

# ---- group: Optional MM to inch conversion
convert_to_inches_boolean_3 = Panel(convert_to_inches)
filter_11 = StreamFilter(Gate=convert_to_inches_boolean_3, Stream0="1", Stream1="25.4")
division_17 = Division(A=pdecon_10.XComponent, B=filter_11)
division_18 = Division(A=pdecon_10.YComponent, B=filter_11)
division_19 = Division(A=pdecon_10.ZComponent, B=filter_11)

# ----
lng_6 = ListLength(List=toolpath_points_5)

# ---- group: Jog to safe Z
safe_z_height_9 = Number(flatten(safe_z_height_4))
text = Text("JZ,")
graft_11 = GraftTree(Tree=safe_z_height_9, IncludeEmptyLists=True, IncludeNullItems=True)
graft_12 = GraftTree(Tree=text, IncludeEmptyLists=True, IncludeNullItems=True)
lng_7 = ListLength(List=flatten(merge))
join_5 = TextJoin(Text=[graft_12, graft_11])
dup_7 = DuplicateData(Data=join_5, Number=lng_7, Order=True)

# ---- group: Name
panel_9 = Panel(join_2)

# ---- group: Set spindle speed
spindle_speed_4 = Number(spindle_speed_3)
int = Integer(spindle_speed_4)
join_6 = TextJoin(Text=["TR,", int, ",1"])

# ---- group: Turn off spindle
filter_12 = StreamFilter(Gate=use_spindle_3, Stream1="SO,1,0")

# ---- group: Toolpath coordinates
text_2 = Text("M3,")
text_3 = Text(",")
text_4 = Text(",")
dup_8 = DuplicateData(Data=text_4, Number=lng_4, Order=True)
dup_9 = DuplicateData(Data=text_3, Number=lng_4, Order=True)
dup_10 = DuplicateData(Data=text_2, Number=lng_4, Order=True)
simplify_8 = SimplifyTree(Tree=flatten(dup_10), Front=False)
simplify_9 = SimplifyTree(Tree=flatten(panel_6), Front=False)
simplify_10 = SimplifyTree(Tree=flatten(dup_9), Front=False)
simplify_11 = SimplifyTree(Tree=flatten(panel_7), Front=False)
simplify_12 = SimplifyTree(Tree=flatten(dup_8), Front=False)
simplify_13 = SimplifyTree(Tree=flatten(panel_8), Front=False)
graft_13 = GraftTree(Tree=simplify_8, IncludeEmptyLists=True, IncludeNullItems=True)
graft_14 = GraftTree(Tree=simplify_9, IncludeEmptyLists=True, IncludeNullItems=True)
graft_15 = GraftTree(Tree=simplify_10, IncludeEmptyLists=True, IncludeNullItems=True)
graft_16 = GraftTree(Tree=simplify_11, IncludeEmptyLists=True, IncludeNullItems=True)
graft_17 = GraftTree(Tree=simplify_12, IncludeEmptyLists=True, IncludeNullItems=True)
graft_18 = GraftTree(Tree=simplify_13, IncludeEmptyLists=True, IncludeNullItems=True)
join_7 = TextJoin(Text=[graft_13, graft_14, graft_15, graft_16, graft_17, graft_18])
flatten_12 = FlattenTree(Tree=join_7, Path="{0}")

# ---- group: Start spindle
panel_10 = Panel("PAUSE 1")
filter_13 = StreamFilter(Gate=use_spindle_3, Stream1="SO,1,1")

# ---- group: Set Feed rate (X Y speed) and plunge rate (Z speed)
feed_rate_6 = Number(division_8)
plunge_rate_4 = Number(division_9)
plunge_rate_5 = Number(plunge_rate_4)
feed_rate_7 = Number(feed_rate_6)
text_5 = Text("MS,")
text_6 = Text(",")
join_8 = TextJoin(Text=flatten([text_5, feed_rate_7, text_6, plunge_rate_5]))

# ----
flatten_13 = FlattenTree(Tree=lng_5, Path="{0}")
flatten_14 = FlattenTree(Tree=lng_6, Path="{0}")
merge_2 = Merge(Data1=Slider(0, range=0..100), Data2=flatten_13)
panel_11 = Panel(division_14)
panel_12 = Panel(division_15)
panel_13 = Panel(division_16)
merge_3 = Merge(Data1=Slider(0, range=0..100), Data2=flatten_14)
panel_14 = Panel(division_17)
panel_15 = Panel(division_18)
panel_16 = Panel(division_19)
filter_14 = StreamFilter(Gate=use_spindle_3, Stream1=join_6)

jog_rate_x_y_2 = Number(jog_rate_x_y)
item_8 = ListItem(List=pdecon_7.XComponent, Index=0, Wrap=True)
item_9 = ListItem(List=pdecon_7.YComponent, Index=0, Wrap=True)
int_2 = Integer(jog_rate_x_y_2)
lng_8 = ListLength(List=flatten(item_8))
safe_z_height_10 = Number(safe_z_height_3)
lng_9 = ListLength(List=flatten(item_8))
join_9 = TextJoin(Text=["F", int_2, " X"])
dup_11 = DuplicateData(Data="G1 ", Number=lng_8, Order=True)
dup_12 = DuplicateData(Data=" Y", Number=lng_8, Order=True)
dup_13 = DuplicateData(Data=" Z", Number=lng_8, Order=True)
dup_14 = DuplicateData(Data=safe_z_height_10, Number=lng_8, Order=True)
dup_15 = DuplicateData(Data=join_9, Number=lng_9, Order=True)
simplify_14 = SimplifyTree(Tree=flatten(dup_11), Front=False)
simplify_15 = SimplifyTree(Tree=flatten(item_8), Front=False)
simplify_16 = SimplifyTree(Tree=flatten(dup_12), Front=False)
simplify_17 = SimplifyTree(Tree=flatten(item_9), Front=False)
simplify_18 = SimplifyTree(Tree=flatten(dup_13), Front=False)
simplify_19 = SimplifyTree(Tree=flatten(dup_14), Front=False)
simplify_20 = SimplifyTree(Tree=flatten(dup_15), Front=False)
graft_19 = GraftTree(Tree=simplify_14, IncludeEmptyLists=True, IncludeNullItems=True)
graft_20 = GraftTree(Tree=simplify_20, IncludeEmptyLists=True, IncludeNullItems=True)
graft_21 = GraftTree(Tree=simplify_15, IncludeEmptyLists=True, IncludeNullItems=True)
graft_22 = GraftTree(Tree=simplify_16, IncludeEmptyLists=True, IncludeNullItems=True)
graft_23 = GraftTree(Tree=simplify_17, IncludeEmptyLists=True, IncludeNullItems=True)
graft_24 = GraftTree(Tree=simplify_18, IncludeEmptyLists=True, IncludeNullItems=True)
graft_25 = GraftTree(Tree=simplify_19, IncludeEmptyLists=True, IncludeNullItems=True)
join_10 = TextJoin(Text=[graft_19, graft_20, graft_21, graft_22, graft_23])
jog_rate_x_y_3 = Integer(jog_rate_x_y_2)
flatten_15 = FlattenTree(Tree=join_10, Path="{0}")
join_11 = TextJoin(Text=["F", jog_rate_x_y_3])
home_x_2 = Number(home_x)
home_y_2 = Number(home_y)
join_12 = TextJoin(Text=["G0 ", join_11, " X", home_x_2, " Y", home_y_2])
merge_4 = Merge(Data1=flatten(flatten_15), Data2=flatten(join_12))
jog_x_y_positions = Panel(merge_4)

# ---- group: Jog to safe Z
safe_z_height_11 = Number(flatten(safe_z_height_5))
text_7 = Text("JZ,")
graft_26 = GraftTree(Tree=safe_z_height_11, IncludeEmptyLists=True, IncludeNullItems=True)
graft_27 = GraftTree(Tree=text_7, IncludeEmptyLists=True, IncludeNullItems=True)
lng_10 = ListLength(List=flatten(merge_2))
join_13 = TextJoin(Text=[graft_27, graft_26])
dup_16 = DuplicateData(Data=join_13, Number=lng_10, Order=True)

# ---- group: Name
panel_17 = Panel(join)

# ---- group: Set spindle speed
spindle_speed_5 = Number(spindle_speed_2)
int_3 = Integer(spindle_speed_5)
join_14 = TextJoin(Text=["TR,", int_3, ",1"])

# ---- group: Turn off spindle
filter_15 = StreamFilter(Gate=use_spindle_2, Stream1="SO,1,0")

# ---- group: Toolpath coordinates
text_8 = Text("M3,")
text_9 = Text(",")
text_10 = Text(",")
dup_17 = DuplicateData(Data=text_10, Number=lng_5, Order=True)
dup_18 = DuplicateData(Data=text_9, Number=lng_5, Order=True)
dup_19 = DuplicateData(Data=text_8, Number=lng_5, Order=True)
simplify_21 = SimplifyTree(Tree=flatten(dup_19), Front=False)
simplify_22 = SimplifyTree(Tree=flatten(panel_11), Front=False)
simplify_23 = SimplifyTree(Tree=flatten(dup_18), Front=False)
simplify_24 = SimplifyTree(Tree=flatten(panel_12), Front=False)
simplify_25 = SimplifyTree(Tree=flatten(dup_17), Front=False)
simplify_26 = SimplifyTree(Tree=flatten(panel_13), Front=False)
graft_28 = GraftTree(Tree=simplify_21, IncludeEmptyLists=True, IncludeNullItems=True)
graft_29 = GraftTree(Tree=simplify_22, IncludeEmptyLists=True, IncludeNullItems=True)
graft_30 = GraftTree(Tree=simplify_23, IncludeEmptyLists=True, IncludeNullItems=True)
graft_31 = GraftTree(Tree=simplify_24, IncludeEmptyLists=True, IncludeNullItems=True)
graft_32 = GraftTree(Tree=simplify_25, IncludeEmptyLists=True, IncludeNullItems=True)
graft_33 = GraftTree(Tree=simplify_26, IncludeEmptyLists=True, IncludeNullItems=True)
join_15 = TextJoin(Text=[graft_28, graft_29, graft_30, graft_31, graft_32, graft_33])
flatten_16 = FlattenTree(Tree=join_15, Path="{0}")

# ---- group: Start spindle
panel_18 = Panel("PAUSE 1")
filter_16 = StreamFilter(Gate=use_spindle_2, Stream1="SO,1,1")

# ---- group: Set Feed rate (X Y speed) and plunge rate (Z speed)
feed_rate_8 = Number(division_3)
plunge_rate_6 = Number(division_4)
plunge_rate_7 = Number(plunge_rate_6)
feed_rate_9 = Number(feed_rate_8)
text_11 = Text("MS,")
text_12 = Text(",")
join_16 = TextJoin(Text=flatten([text_11, feed_rate_9, text_12, plunge_rate_7]))

# ---- group: Jog to safe Z
safe_z_height_12 = Number(flatten(safe_z_height_6))
text_13 = Text("JZ,")
graft_34 = GraftTree(Tree=safe_z_height_12, IncludeEmptyLists=True, IncludeNullItems=True)
graft_35 = GraftTree(Tree=text_13, IncludeEmptyLists=True, IncludeNullItems=True)
lng_11 = ListLength(List=flatten(merge_3))
join_17 = TextJoin(Text=[graft_35, graft_34])
dup_20 = DuplicateData(Data=join_17, Number=lng_11, Order=True)

# ---- group: Name
panel_19 = Panel(join)

# ---- group: Set spindle speed
spindle_speed_6 = Number(spindle_speed_2)
int_4 = Integer(spindle_speed_6)
join_18 = TextJoin(Text=["TR,", int_4, ",1"])

# ---- group: Turn off spindle
filter_17 = StreamFilter(Gate=use_spindle_2, Stream1="SO,1,0")

# ---- group: Toolpath coordinates
text_14 = Text("M3,")
text_15 = Text(",")
text_16 = Text(",")
dup_21 = DuplicateData(Data=text_16, Number=lng_6, Order=True)
dup_22 = DuplicateData(Data=text_15, Number=lng_6, Order=True)
dup_23 = DuplicateData(Data=text_14, Number=lng_6, Order=True)
simplify_27 = SimplifyTree(Tree=flatten(dup_23), Front=False)
simplify_28 = SimplifyTree(Tree=flatten(panel_14), Front=False)
simplify_29 = SimplifyTree(Tree=flatten(dup_22), Front=False)
simplify_30 = SimplifyTree(Tree=flatten(panel_15), Front=False)
simplify_31 = SimplifyTree(Tree=flatten(dup_21), Front=False)
simplify_32 = SimplifyTree(Tree=flatten(panel_16), Front=False)
graft_36 = GraftTree(Tree=simplify_27, IncludeEmptyLists=True, IncludeNullItems=True)
graft_37 = GraftTree(Tree=simplify_28, IncludeEmptyLists=True, IncludeNullItems=True)
graft_38 = GraftTree(Tree=simplify_29, IncludeEmptyLists=True, IncludeNullItems=True)
graft_39 = GraftTree(Tree=simplify_30, IncludeEmptyLists=True, IncludeNullItems=True)
graft_40 = GraftTree(Tree=simplify_31, IncludeEmptyLists=True, IncludeNullItems=True)
graft_41 = GraftTree(Tree=simplify_32, IncludeEmptyLists=True, IncludeNullItems=True)
join_19 = TextJoin(Text=[graft_36, graft_37, graft_38, graft_39, graft_40, graft_41])
flatten_17 = FlattenTree(Tree=join_19, Path="{0}")

# ---- group: Start spindle
panel_20 = Panel("PAUSE 1")
filter_18 = StreamFilter(Gate=use_spindle_2, Stream1="SO,1,1")

# ---- group: Set Feed rate (X Y speed) and plunge rate (Z speed)
feed_rate_10 = Number(division_3)
plunge_rate_8 = Number(division_4)
plunge_rate_9 = Number(plunge_rate_8)
feed_rate_11 = Number(feed_rate_10)
text_17 = Text("MS,")
text_18 = Text(",")
join_20 = TextJoin(Text=flatten([text_17, feed_rate_11, text_18, plunge_rate_9]))

# ----
text_19 = Text("J2,")
text_20 = Text(",")
join_21 = TextJoin(Text=[text_19, division_6, text_20, division_7])
xy = XYPlane(Origin=Point(0, 0, 0))

# ---- group: Code preview in viewport
number_of_code_preview_lines = Slider(20, range=0..100)
code_preview_angle = Slider(90, range=0..100)
code_preview_font_size = Slider(3, range=0..100)
# Rigth click and choose "Stream destination"
# 
# Give a file name ending with .gcode
# 
# Your toolpath will automatically be updated!
number_slider = Slider(-8, range=-1000..1000)
line_spacing_factor = Slider(1.45, range=1..2.5)
pt_7 = ConstructPoint(XCoordinate=Slider(66, range=0..1000), YCoordinate=number_slider, ZCoordinate=0)
multiplication_6 = Multiplication(A=code_preview_font_size, B=line_spacing_factor)
Y = UnitY(Factor=1)
series = Series(Start=0, Step=multiplication_6, Count=number_of_code_preview_lines)
rev_4 = Reverse(Vector=Y)
Z = UnitZ(Factor=1)
split = SplitList(List=panel_5, Index=number_of_code_preview_lines)  # -> ListA, ListB
neg = Negative(Value=series)
pl = ConstructPlane(Origin=pt_7, XAxis=rev_4, YAxis=Z)
series_2 = Series(Start=0, Step=Slider(1, range=0..1), Count=number_of_code_preview_lines)
dup_24 = DuplicateData(Data=code_preview_font_size, Number=number_of_code_preview_lines, Order=True)
division_20 = Division(A=series_2, B=number_of_code_preview_lines)
neg_2 = Negative(Value=code_preview_angle)
xz = XZPlane(Origin=pt_7)
rev_5 = ReverseList(List=division_20)
rotate = Rotate(Geometry=pl, Angle=degrees(neg_2), Plane=xz)  # -> Geometry, Transform
num = Number(rev_5)
argb = SplitARGB(Colour=ColourSwatch(SwatchColor=RGB(130, 232, 255)), IntegerChannels=True)  # -> Alpha, Red, Green, Blue
deplane = DeconstructPlane(Plane=rotate.Geometry)  # -> Origin, XAxis, YAxis, ZAxis
amp = Amplitude(Vector=deplane.YAxis, Amplitude=neg)
move = Move(Geometry=rotate.Geometry, Motion=amp)  # -> Geometry, Transform
multiplication_7 = Multiplication(A=argb.Red, B=num)
multiplication_8 = Multiplication(A=argb.Blue, B=num)
multiplication_9 = Multiplication(A=argb.Green, B=num)
rgb = ColourRGB(Alpha=255, Red=multiplication_7, Green=multiplication_9, Blue=multiplication_8)
tag = TextTag3D(Location=xy, Text=split.ListA, Size=dup_24, Colour=rgb, Justification=1)

# ----
filter_19 = StreamFilter(Gate=use_spindle_2, Stream1=join_14)
filter_20 = StreamFilter(Gate=use_spindle_2, Stream1=join_18)

jog_rate_z_3 = Number(jog_rate_z_2)
int_5 = Integer(jog_rate_z_3)
safe_z_height_13 = Number(safe_z_height_3)
join_22 = TextJoin(Text=["F", int_5])
join_23 = TextJoin(Text=["G1 ", join_22, " Z", safe_z_height_13])
lng_12 = ListLength(List=merge_4)
dup_25 = DuplicateData(Data=join_23, Number=lng_12, Order=True)
flatten_18 = FlattenTree(Tree=dup_25, Path="{0}")
jog_z_positions = Panel(flatten_18)

# ---- group: Insert JZ commands
ma = MassAddition(Input=merge)  # -> Result, PartialResults
ins = InsertItems(List=flatten_12, Item=dup_7, Indices=ma.PartialResults, Wrap=True)

# ----
text_21 = Text("J2,")
text_22 = Text(",")
text_23 = Text("J2,")
text_24 = Text(",")
join_24 = TextJoin(Text=[text_21, division, text_22, division_2])
join_25 = TextJoin(Text=[text_23, division, text_24, division_2])

# ---- group: Insert JZ commands
ma_2 = MassAddition(Input=merge_2)  # -> Result, PartialResults
ins_2 = InsertItems(List=flatten_16, Item=dup_16, Indices=ma_2.PartialResults, Wrap=True)

ma_3 = MassAddition(Input=merge_3)  # -> Result, PartialResults
ins_3 = InsertItems(List=flatten_17, Item=dup_20, Indices=ma_3.PartialResults, Wrap=True)

# ---- group: Insert jog to safe Z
ma_4 = MassAddition(Input=flatten(lng_3))  # -> Result, PartialResults
merge_5 = Merge(Data1=Slider(0, range=0..100), Data2=ma_4.PartialResults)
ins_4 = InsertItems(List=flatten(panel_4), Item=flatten(jog_z_positions), Indices=flatten(merge_5), Wrap=True)

# ---- group: Create toolpath preview
rev_6 = ReverseList(List=flatten(safe_z_end_point))
cull_i = CullIndex(List=flatten(safe_z_start_point), Indices=0, Wrap=True)
cull_i_2 = CullIndex(List=rev_6, Indices=0, Wrap=True)
rev_7 = ReverseList(List=flatten(cull_i_2))
ln = Line(StartPoint=rev_7, EndPoint=cull_i)
ln_2 = Line(StartPoint=safe_z_start_point, EndPoint=item)
ln_3 = Line(StartPoint=item_2, EndPoint=safe_z_end_point)
tab_cleanup_preview_curves = Curve(connect_overlapping_toolpaths_5)
cut_transition_preview_lines = Curve(flatten(ln))
cut_entry_preview_lines = Curve(flatten(ln_2))
cut_exit_preview_lines = Curve(flatten(ln_3))
toolpath_preview_curves = Curve(connect_overlapping_toolpaths_4)

# ---- group: Insert jog X Y positions
lng_13 = ListLength(List=merge_5)
series_3 = Series(Start=1, Step=1, Count=lng_13)
addition = Addition(A=merge_5, B=series_3)
ins_5 = InsertItems(List=flatten(ins_4), Item=flatten(jog_x_y_positions), Indices=flatten(addition), Wrap=True)

# ----
# Startcode: ;enter suitable start code for your machine here
# Startcode - Ultimaker original , extruder upgrade + heatbed: M190 S70.000000
# M109 T0 S220.000000
# T0
# G21        ;metric values
# G90        ;absolute positioning
# M82        ;set extruder to absolute mode
# M107       ;start with the fan off
# G28 X0 Y0  ;move X/Y to min endstops
# G28 Z0     ;move Z to min endstops
# G1 Z15.0 F9000 ;move the platform down 15mm
# G92 E0                  ;zero the extruded length
# G1 F200 E17              ;extrude 17mm of feed stock
# G92 E0                  ;zero the extruded length again
# G1 F9000
# ;Put printing message on LCD screen
# M117 Bark beetle
# Startcode - Printrbot Simple: M190 S30.000000
# M109 S220.000000
# ;Sliced at: Mon 16-03-2015 21:37:50
# ;Basic settings: Layer height: 0.2 Walls: 0.8 Fill: 20
# ;Print time: 3 minutes
# ;Filament used: 0.151m 0.0g
# ;Filament cost: None
# ;M190 S30 ;Uncomment to add your own bed temperature line
# ;M109 S220 ;Uncomment to add your own temperature line
# G21        ;metric values
# G90        ;absolute positioning
# M82        ;set extruder to absolute mode
# M107       ;start with the fan off
# 
# G28 X0 Y0  ;move X/Y to min endstops
# G28 Z0     ;move Z to min endstops
# 
# G1 Z15.0 F9000 ;move the platform down 15mm
# 
# G92 E0                  ;zero the extruded length
# G1 F200 E6              ;extrude 6mm of feed stock
# G92 E0                  ;zero the extruded length again
# G1 F9000
# Startcode - FABtotum: G90        ;absolute positioning
# 
# ;G28	;Home all Axis
# 
# M3 S15000 ;SPINDLE ON - Clockwise , tries to maintain RPM constant min: 6500, max: 15000
# G4 S4; Dwell 4 seconds
# 
# G0 F600 Z-210; move to custom Z 0 position
# G92 Z0; set new zero position
startcode = Panel(""";vbird gcode for cnc mill
;G28
G90""")
# Endcode: ;enter suitable end code for your machine here
# Endcode - Ultimaker original , extruder upgrade + heatbed: ;End GCode
# M104 S0                     ;extruder heater off
# M140 S0                     ;heated bed heater off (if you have it)
# G91                                    ;relative positioning
# G1 E-1 F300                            ;retract the filament a bit before lifting the nozzle, to release some of the pressure
# G1 Z+0.5 E-5 X-20 Y-20 F9000 ;move Z up a bit and retract filament even more
# G28 X0 Y0                              ;move X/Y to min endstops, so the head is out of the way
# M84                         ;steppers off
# G90                         ;absolute positioning
# Endcode - Printrbot Simple: M104 S0                     ;extruder heater off
# M140 S0                     ;heated bed heater off (if you have it)
# 
# G91                                    ;relative positioning
# G1 E-1 F300                            ;retract the filament a bit before lifting the nozzle, to release some of the pressure
# G1 Z+0.5 E-5 X-20 Y-20 F9000 ;move Z up a bit and retract filament even more
# G28 X0 Y0                              ;move X/Y to min endstops, so the head is out of the way
# 
# M84                         ;steppers off
# G90                         ;absolute positioning
endcode_fabtotum = Panel("""G4 S2; Dwell
M5; SPINDLE OFF""")

# ---- group: Create toolpath preview
rev_8 = ReverseList(List=flatten(safe_z_end_point_2))
cull_i_3 = CullIndex(List=flatten(safe_z_start_point_2), Indices=0, Wrap=True)
cull_i_4 = CullIndex(List=rev_8, Indices=0, Wrap=True)
rev_9 = ReverseList(List=flatten(cull_i_4))
ln_4 = Line(StartPoint=rev_9, EndPoint=cull_i_3)
ln_5 = Line(StartPoint=safe_z_start_point_2, EndPoint=item_4)
ln_6 = Line(StartPoint=item_5, EndPoint=safe_z_end_point_2)
tab_cleanup_preview_curves_2 = Curve(connect_overlapping_toolpaths_3)
cut_transition_preview_lines_2 = Curve(flatten(ln_4))
cut_entry_preview_lines_2 = Curve(flatten(ln_5))
cut_exit_preview_lines_2 = Curve(flatten(ln_6))
toolpath_preview_curves_2 = Curve(connect_overlapping_toolpaths_6)

# ----
tab_cleanup_preview_curves_3 = ClusterOutput(tab_cleanup_preview_curves)
cut_transition_preview_lines_3 = ClusterOutput(cut_transition_preview_lines)
cut_exit_preview_lines_3 = ClusterOutput(cut_exit_preview_lines)
toolpath_preview_curves_3 = ClusterOutput(toolpath_preview_curves)
cut_entry_preview_lines_3 = ClusterOutput(cut_entry_preview_lines)
merge_6 = Merge(Data1=flatten(startcode), Data2=flatten(ins_5))
panel_21 = Panel(merge_6)
graft_42 = GraftTree(Tree=panel_21, IncludeEmptyLists=True, IncludeNullItems=True)
panel_22 = Panel(merge_6)

# ---- group: Jog to startpoints
item_10 = ListItem(List=division_11, Index=0, Wrap=True)
item_11 = ListItem(List=division_12, Index=0, Wrap=True)
lng_14 = ListLength(List=flatten(item_10))
text_25 = Text(",")
text_26 = Text("J2,")
dup_26 = DuplicateData(Data=text_26, Number=lng_14, Order=True)
dup_27 = DuplicateData(Data=text_25, Number=lng_14, Order=True)
simplify_33 = SimplifyTree(Tree=flatten(dup_26), Front=False)
simplify_34 = SimplifyTree(Tree=flatten(item_10), Front=False)
simplify_35 = SimplifyTree(Tree=flatten(dup_27), Front=False)
simplify_36 = SimplifyTree(Tree=flatten(item_11), Front=False)
graft_43 = GraftTree(Tree=simplify_33, IncludeEmptyLists=True, IncludeNullItems=True)
graft_44 = GraftTree(Tree=simplify_34, IncludeEmptyLists=True, IncludeNullItems=True)
graft_45 = GraftTree(Tree=simplify_35, IncludeEmptyLists=True, IncludeNullItems=True)
graft_46 = GraftTree(Tree=simplify_36, IncludeEmptyLists=True, IncludeNullItems=True)
join_26 = TextJoin(Text=[graft_43, graft_44, graft_45, graft_46])
jh = Text("JH")
flatten_19 = FlattenTree(Tree=join_26, Path="{0}")

# ----
filter_21 = StreamFilter(Gate=use_custom_jog_home_3, Stream0=jh, Stream1=flatten(join_21))

# ---- group: Jog to startpoints (continued)
merge_7 = Merge(Data1=flatten_19, Data2=filter_21)

# ---- group: Insert J2 commands
lng_15 = ListLength(List=merge_7)
dup_28 = DuplicateData(Data=Slider(1, range=0..1), Number=lng_15, Order=True)
addition_2 = Addition(A=dup_28, B=merge)
ma_5 = MassAddition(Input=addition_2)  # -> Result, PartialResults
ins_6 = InsertItems(List=ins, Item=merge_7, Indices=ma_5.PartialResults, Wrap=True)

# ----
flatten_20 = FlattenTree(Tree=ins_6, Path="{0}")
merge_8 = Merge(Data1=panel_9, Data3=filter_14, Data4=filter_13, Data5=panel_10, Data6=join_8, Data7=flatten_20, Data8=filter_12)  # disabled
stream_and_save_as_sbp_2 = Panel(merge_8)

# ---- group: Jog to startpoints
item_12 = ListItem(List=division_14, Index=0, Wrap=True)
item_13 = ListItem(List=division_15, Index=0, Wrap=True)
lng_16 = ListLength(List=flatten(item_12))
text_27 = Text(",")
text_28 = Text("J2,")
dup_29 = DuplicateData(Data=text_28, Number=lng_16, Order=True)
dup_30 = DuplicateData(Data=text_27, Number=lng_16, Order=True)
simplify_37 = SimplifyTree(Tree=flatten(dup_29), Front=False)
simplify_38 = SimplifyTree(Tree=flatten(item_12), Front=False)
simplify_39 = SimplifyTree(Tree=flatten(dup_30), Front=False)
simplify_40 = SimplifyTree(Tree=flatten(item_13), Front=False)
graft_47 = GraftTree(Tree=simplify_37, IncludeEmptyLists=True, IncludeNullItems=True)
graft_48 = GraftTree(Tree=simplify_38, IncludeEmptyLists=True, IncludeNullItems=True)
graft_49 = GraftTree(Tree=simplify_39, IncludeEmptyLists=True, IncludeNullItems=True)
graft_50 = GraftTree(Tree=simplify_40, IncludeEmptyLists=True, IncludeNullItems=True)
join_27 = TextJoin(Text=[graft_47, graft_48, graft_49, graft_50])
jh_2 = Text("JH")
flatten_21 = FlattenTree(Tree=join_27, Path="{0}")

# ----
filter_22 = StreamFilter(Gate=use_custom_jog_home_2, Stream0=jh_2, Stream1=flatten(join_24))

# ---- group: Jog to startpoints (continued)
merge_9 = Merge(Data1=flatten_21, Data2=filter_22)

# ---- group: Insert J2 commands
lng_17 = ListLength(List=merge_9)
dup_31 = DuplicateData(Data=Slider(1, range=0..1), Number=lng_17, Order=True)
addition_3 = Addition(A=dup_31, B=merge_2)
ma_6 = MassAddition(Input=addition_3)  # -> Result, PartialResults
ins_7 = InsertItems(List=ins_2, Item=merge_9, Indices=ma_6.PartialResults, Wrap=True)

# ----
flatten_22 = FlattenTree(Tree=ins_7, Path="{0}")
merge_10 = Merge(Data1=panel_17, Data3=filter_19, Data4=filter_16, Data5=panel_18, Data6=join_16, Data7=flatten_22, Data8=filter_15)
shopbot_code_connect_panel_stream_and_sa = ClusterOutput(merge_10)  # "ShopBot code - Connect panel, stream and save as .sbp"
stream_and_save_as_sbp_3 = Panel(merge_10)

# ---- group: Jog to startpoints
item_14 = ListItem(List=division_17, Index=0, Wrap=True)
item_15 = ListItem(List=division_18, Index=0, Wrap=True)
lng_18 = ListLength(List=flatten(item_14))
text_29 = Text(",")
text_30 = Text("J2,")
dup_32 = DuplicateData(Data=text_30, Number=lng_18, Order=True)
dup_33 = DuplicateData(Data=text_29, Number=lng_18, Order=True)
simplify_41 = SimplifyTree(Tree=flatten(dup_32), Front=False)
simplify_42 = SimplifyTree(Tree=flatten(item_14), Front=False)
simplify_43 = SimplifyTree(Tree=flatten(dup_33), Front=False)
simplify_44 = SimplifyTree(Tree=flatten(item_15), Front=False)
graft_51 = GraftTree(Tree=simplify_41, IncludeEmptyLists=True, IncludeNullItems=True)
graft_52 = GraftTree(Tree=simplify_42, IncludeEmptyLists=True, IncludeNullItems=True)
graft_53 = GraftTree(Tree=simplify_43, IncludeEmptyLists=True, IncludeNullItems=True)
graft_54 = GraftTree(Tree=simplify_44, IncludeEmptyLists=True, IncludeNullItems=True)
join_28 = TextJoin(Text=[graft_51, graft_52, graft_53, graft_54])
jh_3 = Text("JH")
flatten_23 = FlattenTree(Tree=join_28, Path="{0}")

# ----
filter_23 = StreamFilter(Gate=use_custom_jog_home_2, Stream0=jh_3, Stream1=flatten(join_25))

# ---- group: Jog to startpoints (continued)
merge_11 = Merge(Data1=flatten_23, Data2=filter_23)

# ---- group: Insert J2 commands
lng_19 = ListLength(List=merge_11)
dup_34 = DuplicateData(Data=Slider(1, range=0..1), Number=lng_19, Order=True)
addition_4 = Addition(A=dup_34, B=merge_3)
ma_7 = MassAddition(Input=addition_4)  # -> Result, PartialResults
ins_8 = InsertItems(List=ins_3, Item=merge_11, Indices=ma_7.PartialResults, Wrap=True)

# ----
flatten_24 = FlattenTree(Tree=ins_8, Path="{0}")
merge_12 = Merge(Data1=panel_19, Data3=filter_20, Data4=filter_18, Data5=panel_20, Data6=join_20, Data7=flatten_24, Data8=filter_17)
tab_cleanup_code_connect_panel_stream_an = ClusterOutput(merge_12)  # "Tab cleanup code - Connect panel, stream and save as .sbp"
stream_and_save_as_sbp_4 = Panel(merge_12)

# ==== cluster InsideGearForPinionMaker: Creates a gear matching a pinion from "Roller rack and pinion maker". Great for making geared rack and pinion drive systems. Connect pinion geometery from a "Roller rack and pinion maker" component.
number_of_input_pinion_teeth = ClusterInput()  # Input same pinion tooth count as used in "Roller rack and pinion maker"
preview_position_0_1 = ClusterInput()  # Connect a slider to preview gear movement
tooth_fillet_ratio = ClusterInput()  # Adjust to make sure pinion can roll soothly past to tips
pinion_center_hole_curve = ClusterInput()  # Connect pinion center hole geometry from "Roller rack and pinion maker"
number_of_gear_teeth = ClusterInput()  # Specify the number of teeth
milling_bit_diameter = ClusterInput()  # Input same diameter value as used in "Roller rack and pinion maker"
pinion_teeth_curve = ClusterInput()  # Connect pinion curve geometry from "Roller rack and pinion maker"

# ---- group: Low fillet ratio gives smoother motion, but makes a less robust pinion
tooth_fillet_ratio_2 = Number(tooth_fillet_ratio)
tooth_fillet_ratio_3 = Panel(tooth_fillet_ratio_2)

# ----
preview_position_0_1_2 = Number(preview_position_0_1)

# ---- group: Start numbers to help calculte pinion tooth path through rack
number_of_curve_sample_points = Slider(20, range=0..1000)
sample_tooth_position = Panel("0.26")

# ----
number_of_gear_teeth_2 = Number(number_of_gear_teeth)
milling_bit_diameter_2 = Number(milling_bit_diameter)
number_of_input_pinion_teeth_2 = Number(number_of_input_pinion_teeth)
pinion_teeth_curve_2 = Curve(pinion_teeth_curve)
pinion_center_hole_curve_2 = Curve(pinion_center_hole_curve)
number_of_gear_teeth_3 = Panel(number_of_gear_teeth_2)
milling_bit_diameter_3 = Panel(milling_bit_diameter_2)
number_of_pinion_teeth = Panel(number_of_input_pinion_teeth_2)
division = Division(A=number_of_gear_teeth_3, B=number_of_pinion_teeth)
explode = Explode(Curve=pinion_teeth_curve_2, Recursive=True)  # -> Segments, Vertices
smaller = SmallerThan(FirstNumber=division, SecondNumber="2")  # -> SmallerThan, OrEqualTo
item = ListItem(List=explode.Segments, Index=0, Wrap=True)
multiplication = Multiplication(A=number_of_pinion_teeth, B=sample_tooth_position)
input_pinion_has_at_least_half_the_tooth = Panel(smaller.SmallerThan)  # "Input pinion has at least half the tooth count"
darc = DeconstructArc(Arc=item)  # -> BasePlane, Radius, Angle
round = Round(Number=multiplication)  # -> Nearest, Floor, Ceiling
area = Area(Geometry=pinion_center_hole_curve_2)  # -> Area, Centroid
pinion_tooth_center_point = Point(darc.BasePlane)
sample_tooth_number = Panel(round.Ceiling)
xy = XYPlane(Origin=area.Centroid)
pinion_center_plane = Plane(xy)
dist = Distance(PointA=flatten(pinion_tooth_center_point), PointB=flatten(area.Centroid))
pinion_radius = Panel(dist)
multiplication_2 = Multiplication(A=pinion_radius, B="2")
pi = Pi(Factor=1)
multiplication_3 = Multiplication(A=multiplication_2, B=pi)
number_of_pinion_teeth_2 = Panel(number_of_pinion_teeth)
number_of_gear_teeth_4 = Panel(number_of_gear_teeth_3)
pinion_cirumference = Panel(multiplication_3)

number_of_curve_sample_points_2 = Panel(number_of_curve_sample_points)
number_of_pinion_teeth_3 = Panel(number_of_pinion_teeth)
sample_tooth_number_2 = Panel(sample_tooth_number)
input_pinion_has_at_least_half_the_tooth_2 = Panel(input_pinion_has_at_least_half_the_tooth)  # "Input pinion has at least half the tooth count"
pinion_circumference = Panel(pinion_cirumference)
pinion_circumference_2 = Panel(pinion_circumference)
division_2 = Division(A=pinion_circumference, B=number_of_pinion_teeth)
division_3 = Division(A=sample_tooth_number_2, B=number_of_pinion_teeth_3)
tooth_spacing = Panel(division_2)
multiplication_4 = Multiplication(A="360", B=division_3)
division_4 = Division(A=multiplication_4, B=number_of_curve_sample_points_2)
multiplication_5 = Multiplication(A=pinion_circumference_2, B=division_3)
division_5 = Division(A=number_of_pinion_teeth, B=number_of_gear_teeth_3)
series = Series(Start=0, Step=division_4, Count=number_of_curve_sample_points_2)
division_6 = Division(A=multiplication_5, B=number_of_curve_sample_points_2)
tooth_count_ratio = Panel(division_5)
neg = Negative(Value=series)
series_2 = Series(Start=0, Step=division_6, Count=number_of_curve_sample_points_2)
rad = Radians(Degrees=neg)
multiplication_6 = Multiplication(A=rad, B=tooth_count_ratio)
neg_2 = Negative(Value=rad)
neg_3 = Negative(Value=multiplication_6)
filter = StreamFilter(Gate=input_pinion_has_at_least_half_the_tooth_2, Stream0=rad, Stream1=neg_2)
filter_2 = StreamFilter(Gate=input_pinion_has_at_least_half_the_tooth_2, Stream0=neg_3, Stream1=multiplication_6)
tooth_spacing_2 = Panel(tooth_spacing)
gear_sample_positions = Panel(filter)
gear_sample_positions_2 = Panel(filter_2)

milling_bit_diameter_4 = Panel(milling_bit_diameter_3)
multiplication_7 = Multiplication(A=milling_bit_diameter_3, B=tooth_fillet_ratio_3)
multiplication_8 = Multiplication(A=milling_bit_diameter_4, B="0.5")
tooth_fillet_radius = Panel(multiplication_7)
milling_it_radius = Panel(multiplication_8)

division_7 = Division(A=pinion_cirumference, B=number_of_pinion_teeth_2)
tooth_spacing_3 = Panel(division_7)
multiplication_9 = Multiplication(A=tooth_spacing_3, B=number_of_gear_teeth_4)
gear_circumference = Panel(multiplication_9)
pi_2 = Pi(Factor=1)
division_8 = Division(A=gear_circumference, B=pi_2)
gear_diameter = Panel(division_8)
division_9 = Division(A=gear_diameter, B="2")
gear_radius = Panel(division_9)
pinion_tooth_center_point_2 = Point(pinion_tooth_center_point)
neg_4 = Negative(Value=gear_radius)
Y = UnitY(Factor=gear_radius)
move = Move(Geometry=pinion_tooth_center_point_2, Motion=Y)  # -> Geometry, Transform
gear_center_point = Point(move.Geometry)
xy_2 = XYPlane(Origin=gear_center_point)
gear_center_plane = Plane(xy_2)

gear_sample_positions_3 = Panel(gear_sample_positions_2)
gear_center_plane_2 = Plane(gear_center_plane)
rotate = Rotate(Geometry=graft(item), Angle=gear_sample_positions, Plane=pinion_center_plane)  # -> Geometry, Transform
gear_center_plane_3 = Plane(gear_center_plane)
number_of_gear_teeth_5 = Panel(number_of_gear_teeth_3)
X = UnitX(Factor=series_2)
move_2 = Move(Geometry=rotate.Geometry, Motion=X)  # -> Geometry, Transform
rotate_2 = Rotate(Geometry=rotate.Geometry, Angle=gear_sample_positions_3, Plane=gear_center_plane_2)  # -> Geometry, Transform
yz = YZPlane(Origin=gear_center_plane_3)
division_10 = Division(A="180", B=number_of_gear_teeth_5)
darc_2 = DeconstructArc(Arc=rotate_2.Geometry)  # -> BasePlane, Radius, Angle
rotate_3 = Rotate(Geometry=yz, Angle=degrees(division_10), Plane=gear_center_plane_3)  # -> Geometry, Transform
pt = Point(darc_2.BasePlane)
intcrv = Interpolate(Vertices=pt, Degree=3, Periodic=False, KnotStyle=1)  # -> Curve, Length, Domain
tooth_mid_plane = Plane(rotate_3.Geometry)
master_profile_curve = Curve(intcrv.Curve)

pinion_center_hole = Curve(pinion_center_hole_curve_2)
pinion_center_plane_2 = Plane(pinion_center_plane)
gear_center_plane_4 = Plane(gear_center_plane)
orient = Orient(Geometry=pinion_center_hole, Source=pinion_center_plane_2, Target=gear_center_plane_4)  # -> Geometry, Transform
gear_center_hole = Curve(orient.Geometry)

# ---- group: Create pinion movement preview
pinion_center_plane_3 = Plane(pinion_center_plane)
pinion_teeth = Curve(pinion_teeth_curve_2)
preview_position_0_1_3 = Number(preview_position_0_1_2)
multiplication_10 = Multiplication(A="360", B=preview_position_0_1_3)
neg_5 = Negative(Value=multiplication_10)
rad_2 = Radians(Degrees=neg_5)
rotate_4 = Rotate(Geometry=flatten(pinion_teeth), Angle=rad_2, Plane=pinion_center_plane_3)  # -> Geometry, Transform
pinion_movement_preview = Curve(rotate_4.Geometry)

# ----
gear_center_hole_2 = Curve(gear_center_hole)
pinion_movement_preview_2 = Curve(pinion_movement_preview)
gear_center_hole_3 = ClusterOutput(gear_center_hole_2)
pinion_movement_preview_3 = ClusterOutput(pinion_movement_preview_2)

milling_it_radius_2 = Panel(milling_it_radius)
master_profile_curve_2 = Curve(master_profile_curve)
gear_radius_2 = Panel(gear_radius)
valley_arc_from_pinion = Curve(item)
tooth_mid_plane_2 = Plane(tooth_mid_plane)
gear_center_plane_5 = Plane(gear_center_plane)
cir = Circle(Plane=gear_center_plane_5, Radius=gear_radius_2)
xy_3 = XYPlane(Origin=Point(0, 0, 0))
offset = Offset(Curve=master_profile_curve_2, Distance=milling_it_radius_2, Plane=xy_3, Corners=1)
ccx = CurveCurve(CurveA=offset, CurveB=cir)  # -> Points, ParamsA, ParamsB
shatter = Shatter(Curve=offset, Parameters=ccx.ParamsA)
rev = ReverseList(List=shatter)
milling_bit_diameter_5 = Panel(milling_bit_diameter_3)
item_2 = ListItem(List=rev, Index=0, Wrap=True)
ext = ExtendCurve(Curve=item_2, Type=0, Start=milling_bit_diameter_5, End=milling_bit_diameter_5)
valley_arc_from_pinion_2 = Curve(valley_arc_from_pinion)
extended_profile = Curve(ext)
ccx_2 = CurveCurve(CurveA=extended_profile, CurveB=valley_arc_from_pinion_2)  # -> Points, ParamsA, ParamsB
rev_2 = ReverseList(List=ccx_2.Points)
rev_3 = ReverseList(List=ccx_2.ParamsA)
item_3 = ListItem(List=rev_3, Index=0, Wrap=True)
yz_2 = YZPlane(Origin=Point(0, 0, 0))
item_4 = ListItem(List=rev_2, Index=0, Wrap=True)
shatter_2 = Shatter(Curve=extended_profile, Parameters=item_3)
mirror = Mirror(Geometry=item_4, Plane=yz_2)  # -> Geometry, Transform
rev_4 = ReverseList(List=shatter_2)
crv_cp = CurveClosestPoint(Point=[item_4, mirror.Geometry], Curve=valley_arc_from_pinion_2)  # -> Point, Parameter, Distance
item_5 = ListItem(List=rev_4, Index=0, Wrap=True)
shatter_3 = Shatter(Curve=valley_arc_from_pinion_2, Parameters=crv_cp.Parameter)
item_6 = ListItem(List=shatter_3, Index="1", Wrap=True)
trimmed_profile = Curve(item_5)
trimmed_valley = Curve(item_6)
curve_for_mirror = Curve(trimmed_profile)
mirror_2 = Mirror(Geometry=curve_for_mirror, Plane=tooth_mid_plane_2)  # -> Geometry, Transform
tooth_fillet_radius_2 = Panel(tooth_fillet_radius)
trimmed_valley_2 = Curve(trimmed_valley)

mirror_3 = Mirror(Geometry=curve_for_mirror, Plane=tooth_mid_plane_2)  # -> Geometry, Transform

ccx_3 = CurveCurve(CurveA=curve_for_mirror, CurveB=mirror_3.Geometry)  # -> Points, ParamsA, ParamsB
shatter_4 = Shatter(Curve=curve_for_mirror, Parameters=ccx_3.ParamsA)
item_7 = ListItem(List=shatter_4, Index=0, Wrap=True)
mirror_4 = Mirror(Geometry=item_7, Plane=tooth_mid_plane_2)  # -> Geometry, Transform
join = JoinCurves(Curves=[item_7, mirror_4.Geometry], Preserve=False)
fillet = Fillet(Curve=join, Radius=tooth_fillet_radius_2)
gear_profile = Curve(fillet)

number_of_gear_teeth_6 = Panel(number_of_gear_teeth_3)
gear_center_plane_6 = Plane(gear_center_plane)
tooth_valley = Curve(trimmed_valley_2)
tooth_profile = Curve(gear_profile)
division_11 = Division(A="360", B=number_of_gear_teeth_6)
series_3 = Series(Start=0, Step=division_11, Count=number_of_gear_teeth_6)
rotate_5 = Rotate(Geometry=[tooth_profile, tooth_valley], Angle=degrees(series_3), Plane=gear_center_plane_6)  # -> Geometry, Transform
join_2 = JoinCurves(Curves=flatten(rotate_5.Geometry), Preserve=False)
gear_teeth = Curve(join_2)

# ---- group: Create pinion movement preview
preview_position_0_1_4 = Number(preview_position_0_1_2)
gear_center_plane_7 = Plane(gear_center_plane)
number_of_gear_teeth_7 = Panel(number_of_gear_teeth_3)
number_of_pinion_teeth_4 = Panel(number_of_pinion_teeth)
gear_teeth_2 = Curve(gear_teeth)
division_12 = Division(A=number_of_pinion_teeth_4, B=number_of_gear_teeth_7)
multiplication_11 = Multiplication(A="360", B=preview_position_0_1_4)
neg_6 = Negative(Value=multiplication_11)
rad_3 = Radians(Degrees=neg_6)
multiplication_12 = Multiplication(A=rad_3, B=division_12)
rotate_6 = Rotate(Geometry=flatten(gear_teeth_2), Angle=multiplication_12, Plane=gear_center_plane_7)  # -> Geometry, Transform
gear_movement_preview = Curve(rotate_6.Geometry)

# ----
gear_movement_preview_2 = Curve(gear_movement_preview)
gear_teeth_3 = Curve(gear_teeth)
gear_teeth_4 = ClusterOutput(gear_teeth_3)
gear_movement_preview_3 = ClusterOutput(gear_movement_preview_2)

# ==== cluster FeedrateCalculator: Calculates a feedrate matching chipload and rpm. Can take chip thining into account. Input the maxium stepover the tool will encounter. Normal pockets and profiles will have a full stepover of 1, while the Arc Based High speed milling givve constant low stepovers as speciified.
ramp_feed_reduction_factor = ClusterInput()
milling_bit_diameter = ClusterInput()
number_of_flutes = ClusterInput()
spindle_rpm = ClusterInput()
max_stepover = ClusterInput()
chip_load = ClusterInput()
ramp_feed_reduction_factor_2 = Number(ramp_feed_reduction_factor)
milling_bit_diameter_2 = Number(milling_bit_diameter)
number_of_flutes_2 = Number(number_of_flutes)
spindle_rpm_2 = Number(spindle_rpm)
max_stepover_2 = Number(max_stepover)
chip_load_2 = Number(chip_load)
spindle_rpm_3 = Panel(spindle_rpm_2)
milling_bit_diameter_3 = Panel(milling_bit_diameter_2)
number_of_flutes_3 = Panel(number_of_flutes_2)
chip_load_3 = Panel(chip_load_2)
max_stepover_3 = Panel(max_stepover_2)
ramp_feedrate_reduction_factor = Panel(ramp_feed_reduction_factor_2)

# ---- group: Calulate chip thining
larger = LargerThan(FirstNumber=max_stepover_3, SecondNumber="0.5")  # -> LargerThan, OrEqualTo
filter = StreamFilter(Gate=larger.LargerThan, Stream0=max_stepover_3, Stream1="0.5")
multiplication = Multiplication(A=milling_bit_diameter_3, B=filter)
multiplication_2 = Multiplication(A="0.5", B=milling_bit_diameter_3)
subtraction = Subtraction(A=multiplication_2, B=multiplication)
neg = Negative(Value=subtraction)
pt = ConstructPoint(XCoordinate=milling_bit_diameter_3, YCoordinate=neg, ZCoordinate=0)
pt_2 = ConstructPoint(XCoordinate=0, YCoordinate=neg, ZCoordinate=0)
xy = XYPlane(Origin=Point(0, 0, 0))
ln = Line(StartPoint=pt_2, EndPoint=pt)
cir = Circle(Plane=xy, Radius=multiplication_2)
ccx = CurveCurve(CurveA=cir, CurveB=ln)  # -> Points, ParamsA, ParamsB
pt_3 = ConstructPoint(XCoordinate=0, YCoordinate=0, ZCoordinate=0)
chip_load_4 = Panel(chip_load_3)
vec2pt = Vector2Pt(PointA=pt_3, PointB=ccx.Points, Unitize=False)  # -> Vector, Length
amp = Amplitude(Vector=vec2pt.Vector, Amplitude=chip_load_4)
move = Move(Geometry=ccx.Points, Motion=amp)  # -> Geometry, Transform
pdecon = Deconstruct(Point=move.Geometry)  # -> XComponent, YComponent, ZComponent
pt_4 = ConstructPoint(XCoordinate=0, YCoordinate=pdecon.YComponent, ZCoordinate=pdecon.ZComponent)
ln_2 = Line(StartPoint=move.Geometry, EndPoint=pt_4)
ccx_2 = CurveCurve(CurveA=cir, CurveB=ln_2)  # -> Points, ParamsA, ParamsB
dist = Distance(PointA=flatten(ccx_2.Points), PointB=flatten(move.Geometry))
move_distance_needed_for_chipload = Panel(dist)
chip_load_5 = Panel(chip_load_3)
division = Division(A=move_distance_needed_for_chipload, B=chip_load_5)

# ---- group: Calculate feedrate
multiplication_3 = Multiplication(A=spindle_rpm_3, B=number_of_flutes_3)
multiplication_4 = Multiplication(A=multiplication_3, B=chip_load_3)
division_2 = Division(A=multiplication_4, B="60")
feedrate = Panel(division_2)

# ---- group: Safatey in case of too extreme values
backup_feedrate_multiplaication_factor = Panel("2")
feedrate_multiplaication_factor = Panel(division)
null = NullItem(Item=ccx_2.Points)  # -> NullFlags, InvalidFlags, Description
filter_2 = StreamFilter(Gate=null.NullFlags, Stream0=feedrate_multiplaication_factor, Stream1=backup_feedrate_multiplaication_factor)

# ---- group: Visualize chip size
X = UnitX(Factor=dist)
ln_3 = Line(StartPoint=ccx.Points, EndPoint=pt)
ln_4 = Line(StartPoint=ccx.Points, EndPoint=move.Geometry)
move_2 = Move(Geometry=cir, Motion=X)  # -> Geometry, Transform
chip_load_cross_section = Curve(ln_4)
new_bit_position = Curve(move_2.Geometry)
old_bit_position = Curve(cir)
material_edge = Curve(ln_3)

# ----
panel = Panel("Stepover to small or chipload to high. Unable to compute optimal feedrate multiplication factor.")
filter_3 = StreamFilter(Gate=null.NullFlags, Stream0="All good", Stream1=panel)
ramp_feedrate_reduction_factor_2 = Panel(ramp_feedrate_reduction_factor)
feedrate_multiplication_factor = Panel(filter_2)
feedrate_2 = Panel(feedrate)
feedback = Panel(filter_3)
multiplication_5 = Multiplication(A=feedrate_2, B=feedrate_multiplication_factor)
multiplication_6 = Multiplication(A=multiplication_5, B=ramp_feedrate_reduction_factor_2)
feedback_2 = Text(feedback)
int = Integer(multiplication_5)
int_2 = Integer(multiplication_6)
feedback_3 = ClusterOutput(feedback_2)
feedrate_3 = Number(int)
ramp_feedrate = Number(int_2)
feedrate_4 = ClusterOutput(feedrate_3)
ramp_feedrate_2 = ClusterOutput(ramp_feedrate)

# ==== cluster ShiftPathsIfPossible
data_paths_to_shifts = ClusterInput()
pshift = ShiftPaths(Data=data_paths_to_shifts, Offset=-1)
flatten = FlattenTree(Tree=data_paths_to_shifts, Path="{0}")
flatten_2 = FlattenTree(Tree=pshift, Path="{0}")
clean = CleanTree(RemoveNulls=True, RemoveInvalid=True, RemoveEmpty=False, Tree=flatten_2)
item = ListItem(List=clean, Index=0, Wrap=True)
null = NullItem(Item=item)  # -> NullFlags, InvalidFlags, Description
filter = StreamFilter(Gate=null.NullFlags, Stream0=pshift, Stream1=flatten)
safely_shifted_paths = ClusterOutput(filter)  # Safely shifted paths

# ==== cluster DivideCurveEvenLenght: Calculates approximate curve length for even division
crv = ClusterInput()
crv_2 = Curve(crv)
B = ClusterInput()
len = Length(Curve=crv_2)
division = Division(A=len, B=B)
int = Integer(division)
divide = DivideCurve(Curve=crv_2, Count=int, Kinks=False)  # -> Points, Tangents, Parameters
P = ClusterOutput(divide.Points)

# ==== cluster ConnectOverlappingToolpaths
polyline_toolpaths = ClusterInput()
polyline_toolpaths_2 = Curve(polyline_toolpaths)
clean = CleanTree(RemoveNulls=True, RemoveInvalid=True, RemoveEmpty=False, Tree=polyline_toolpaths_2)
crv = Curve(clean)
cp = ControlPoints(Curve=crv)  # -> Points, Weights, Knots
cp_2 = ControlPoints(Curve=crv)  # -> Points, Weights, Knots
end = EndPoints(Curve=crv)  # -> Start, End
lng = ListLength(List=cp.Points)
pshift = ShiftPaths(Data=cp_2.Points, Offset=-1)
shift = ShiftList(List=end.Start, Shift=1, Wrap=False)
shift_2 = ShiftList(List=end.End, Shift=-1, Wrap=False)
pshift_2 = ShiftPaths(Data=lng, Offset=-1)
pline = PolyLine(Vertices=pshift, Closed=False)
pdecon = Deconstruct(Point=shift)  # -> XComponent, YComponent, ZComponent
pdecon_2 = Deconstruct(Point=shift_2)  # -> XComponent, YComponent, ZComponent
ma = MassAddition(Input=pshift_2)  # -> Result, PartialResults
cp_3 = ControlPoints(Curve=pline)  # -> Points, Weights, Knots
pshift_3 = ShiftPaths(Data=cp_2.Points, Offset=-1)
flatten = FlattenTree(Tree=ma.PartialResults, Path="{0}")
multiplication = Multiplication(A=pdecon.YComponent, B="100")
multiplication_2 = Multiplication(A=pdecon.XComponent, B="100")
multiplication_3 = Multiplication(A=pdecon_2.XComponent, B="100")
multiplication_4 = Multiplication(A=pdecon_2.YComponent, B="100")
lng_2 = ListLength(List=pshift_3)
lng_3 = ListLength(List=cp_3.Points)
int = Integer(multiplication)
int_2 = Integer(multiplication_2)
int_3 = Integer(multiplication_3)
int_4 = Integer(multiplication_4)
smaller = SmallerThan(FirstNumber=lng_3, SecondNumber=lng_2)  # -> SmallerThan, OrEqualTo
division = Division(A=int, B="100")
division_2 = Division(A=int_2, B="100")
division_3 = Division(A=int_3, B="100")
division_4 = Division(A=int_4, B="100")
unreialiable_result_boolean = Panel(smaller.SmallerThan)
equals = Equality(FirstNumber=division_2, SecondNumber=division_3)  # -> Equality, Inequality
equals_2 = Equality(FirstNumber=division, SecondNumber=division_4)  # -> Equality, Inequality
and = GateAnd(A=equals.Equality, B=equals_2.Equality)

# ---- group: Line connection viz for troubleshooting
dispatch = Dispatch(List=shift_2, DispatchPattern=and)  # -> ListA, ListB
dispatch_2 = Dispatch(List=shift, DispatchPattern=and)  # -> ListA, ListB
ln = Line(StartPoint=dispatch_2.ListA, EndPoint=dispatch.ListA)  # disabled

# ----
rev = ReverseList(List=flatten)
rev_2 = ReverseList(List=flatten)
cull_i = CullIndex(List=rev, Indices="0", Wrap=True)
item = ListItem(List=rev, Index="0", Wrap=True)
cull_i_2 = CullIndex(List=rev_2, Indices="0", Wrap=True)
pshift_4 = ShiftPaths(Data=and, Offset=-1)
pshift_5 = ShiftPaths(Data=cull_i, Offset=-1)
pshift_6 = ShiftPaths(Data=cull_i_2, Offset=-1)
lng_4 = ListLength(List=pshift_4)
rev_3 = ReverseList(List=pshift_5)
rev_4 = ReverseList(List=pshift_6)
ins = InsertItems(List=pshift_4, Item=Toggle(False), Indices="0", Wrap=True)
ins_2 = InsertItems(List=pshift_4, Item=Toggle(False), Indices=lng_4, Wrap=True)
subtraction = Subtraction(A=rev_3, B="1")
cp_4 = ControlPoints(Curve=pline)  # -> Points, Weights, Knots
flatten_2 = FlattenTree(Tree=pshift, Path="{0}")
pshift_7 = ShiftPaths(Data=ins, Offset=-1)
merge = Merge(Data1=subtraction, Data2=item)
merge_2 = Merge(Data1="0", Data2=rev_4)
pshift_8 = ShiftPaths(Data=ins_2, Offset=-1)
dispatch_3 = Dispatch(List=merge_2, DispatchPattern=pshift_7)  # -> ListA, ListB
dispatch_4 = Dispatch(List=merge, DispatchPattern=pshift_8)  # -> ListA, ListB
dom = ConstructDomain(DomainStart=dispatch_3.ListB, DomainEnd=dispatch_4.ListB)
subset = SubList(List=flatten_2, Domain=dom, Wrap=False)  # -> List, Index
pline_2 = PolyLine(Vertices=subset.List, Closed=False)
unreialiable_result_boolean_2 = Panel(unreialiable_result_boolean)
flatten_3 = FlattenTree(Tree=pline_2, Path="{0}")
pshift_9 = ShiftPaths(Data=pline_2, Offset=-2)
filter = StreamFilter(Gate=unreialiable_result_boolean_2, Stream0=pshift_9)
item_2 = ListItem(List=flatten_3, Index=0, Wrap=True)
polyline_toolpaths_3 = Curve(polyline_toolpaths_2)
null = NullItem(Item=item_2)  # -> NullFlags, InvalidFlags, Description
filter_2 = StreamFilter(Gate=null.NullFlags, Stream0=flatten_3, Stream1=polyline_toolpaths_3)
z_connected_polyline_toolpaths = Curve(filter_2)
z_connected_polyline_toolpaths_2 = ClusterOutput(z_connected_polyline_toolpaths)

# ==== cluster TabToolpaths
polyline_toolpaths = ClusterInput()
milling_bit_diamter = ClusterInput()
tab_breps = ClusterInput()
tab_cleanup_overshoot_lenght = Panel("1")
tab_breps_2 = Brep(tab_breps)
polyline_toolpaths_2 = Curve(polyline_toolpaths)
milling_bit_diamter_2 = Number(milling_bit_diamter)
flatten = FlattenTree(Tree=tab_breps_2, Path="{0}")
clean = CleanTree(RemoveNulls=True, RemoveInvalid=True, RemoveEmpty=False, Tree=polyline_toolpaths_2)
bbox = BoundingBox(Content=clean, Plane=PlaneXY(0, 0, 0), UnionBox=True)  # -> Box, Box_2

# ---- group: Check if any tab volumes break material surface
bbox_2 = BoundingBox(Content=flatten, Plane=PlaneXY(0, 0, 0))  # -> Box, Box_2
debrep = DeconstructBrep(Brep=bbox_2.Box)  # -> Faces, Edges, Vertices
item = ListItem(List=debrep.Vertices, Index="4", Wrap=True)
pdecon = Deconstruct(Point=item)  # -> XComponent, YComponent, ZComponent
sort = SortList(Keys=flatten(pdecon.ZComponent))  # -> Keys, ValuesA
rev = ReverseList(List=sort.Keys)
item_2 = ListItem(List=rev, Index=0, Wrap=True)
larger = LargerThan(FirstNumber=item_2, SecondNumber="0")  # -> LargerThan, OrEqualTo
make_severed_toolapths = Panel(larger.LargerThan)

# ---- group: Check for input tab breps
item_3 = ListItem(List=flatten, Index=0, Wrap=True)
null = NullItem(Item=item_3)  # -> NullFlags, InvalidFlags, Description
no_tab_brep_input_boolean = Panel(null.NullFlags)

# ----
debrep_2 = DeconstructBrep(Brep=bbox.Box)  # -> Faces, Edges, Vertices
item_4 = ListItem(List=debrep_2.Vertices, Index="0", Wrap=True)
pdecon_2 = Deconstruct(Point=flatten(item_4))  # -> XComponent, YComponent, ZComponent
subtraction = Subtraction(A=pdecon_2.ZComponent, B="0.1")
lowes_toolpath_point = Panel(subtraction)
polyline_toolpaths_3 = Curve(clean)
tab_breps_3 = Brep(flatten)

# ---- group: Bit diameter compensate tab breps (for tab cleanup)
tab_cleanup_overshoot_lenght_2 = Panel(tab_cleanup_overshoot_lenght)
milling_bit_diamter_3 = Number(milling_bit_diamter_2)
tab_breps_4 = Brep(tab_breps_3)
multiplication = Multiplication(A=milling_bit_diamter_3, B="0.5")
debrep_3 = DeconstructBrep(Brep=tab_breps_4)  # -> Faces, Edges, Vertices
bbox_3 = BoundingBox(Content=tab_breps_4, Plane=PlaneXY(0, 0, 0))  # -> Box, Box_2
addition = Addition(A=multiplication, B=tab_cleanup_overshoot_lenght_2)
debrep_4 = DeconstructBrep(Brep=bbox_3.Box)  # -> Faces, Edges, Vertices
planar = IsPlanar(Surface=debrep_3.Faces, Interior=True)  # -> Planar, Plane
deplane = DeconstructPlane(Plane=planar.Plane)  # -> Origin, XAxis, YAxis, ZAxis
lowes_toolpath_point_2 = Panel(lowes_toolpath_point)
pdecon_3 = Deconstruct(Point=deplane.Origin)  # -> XComponent, YComponent, ZComponent
item_5 = ListItem(List=debrep_4.Vertices, Index=4, Wrap=True)
sort_2 = SortList(Keys=pdecon_3.ZComponent, ValuesA=debrep_3.Faces)  # -> Keys, ValuesA
pt = ConstructPoint(XCoordinate=0, YCoordinate=0, ZCoordinate=lowes_toolpath_point_2)
item_6 = ListItem(List=sort_2.ValuesA, Index=0, Wrap=True)
xy = XYPlane(Origin=pt)
edges = BrepEdges(Brep=item_6)  # -> Naked, Interior, NonManifold
cp = PlaneClosestPoint(Point=item_5, Plane=xy)  # -> Point, UVPoint, Distance
pshift = ShiftPaths(Data=edges.Naked, Offset=-1)
join = JoinCurves(Curves=pshift, Preserve=False)
Z = UnitZ(Factor=cp.Distance)
simplify = SimplifyTree(Tree=join, Front=False)
simplify_2 = SimplifyTree(Tree=Z, Front=False)
milling_bit_radius = Panel(addition)
project = Project(Geometry=simplify, Plane=xy)  # -> Geometry, Transform
neg = Negative(Value=milling_bit_radius)
offset = Offset(Curve=project.Geometry, Distance=milling_bit_radius, Plane=PlaneXY(0, 0, 0), Corners=1)
offset_2 = Offset(Curve=project.Geometry, Distance=neg, Plane=PlaneXY(0, 0, 0), Corners=1)
len = Length(Curve=offset)
len_2 = Length(Curve=offset_2)
smaller = SmallerThan(FirstNumber=len, SecondNumber=len_2)  # -> SmallerThan, OrEqualTo
weave = Weave(Pattern=smaller.SmallerThan, Stream0=offset, Stream1=offset_2, NullGaps=False)
extr = Extrude(Base=weave, Direction=simplify_2)
cap = CapHoles(Brep=extr)
bit_diameter_compensated_tab_breps = Brep(flatten(cap))

# ---- group: Bit diameter compensate tab breps
milling_bit_diamter_4 = Number(milling_bit_diamter_2)
tab_breps_5 = Brep(tab_breps_3)
multiplication_2 = Multiplication(A=milling_bit_diamter_4, B="0.5")
debrep_5 = DeconstructBrep(Brep=tab_breps_5)  # -> Faces, Edges, Vertices
bbox_4 = BoundingBox(Content=tab_breps_5, Plane=PlaneXY(0, 0, 0))  # -> Box, Box_2
milling_bit_radius_2 = Panel(multiplication_2)
debrep_6 = DeconstructBrep(Brep=bbox_4.Box)  # -> Faces, Edges, Vertices
planar_2 = IsPlanar(Surface=debrep_5.Faces, Interior=True)  # -> Planar, Plane
deplane_2 = DeconstructPlane(Plane=planar_2.Plane)  # -> Origin, XAxis, YAxis, ZAxis
lowes_toolpath_point_3 = Panel(lowes_toolpath_point)
item_7 = ListItem(List=debrep_6.Vertices, Index=4, Wrap=True)
pdecon_4 = Deconstruct(Point=deplane_2.Origin)  # -> XComponent, YComponent, ZComponent
sort_3 = SortList(Keys=pdecon_4.ZComponent, ValuesA=debrep_5.Faces)  # -> Keys, ValuesA
pt_2 = ConstructPoint(XCoordinate=0, YCoordinate=0, ZCoordinate=lowes_toolpath_point_3)
item_8 = ListItem(List=sort_3.ValuesA, Index=0, Wrap=True)
xy_2 = XYPlane(Origin=pt_2)
edges_2 = BrepEdges(Brep=item_8)  # -> Naked, Interior, NonManifold
cp_2 = PlaneClosestPoint(Point=item_7, Plane=xy_2)  # -> Point, UVPoint, Distance
pshift_2 = ShiftPaths(Data=edges_2.Naked, Offset=-1)
join_2 = JoinCurves(Curves=pshift_2, Preserve=False)
Z_2 = UnitZ(Factor=cp_2.Distance)
simplify_3 = SimplifyTree(Tree=join_2, Front=False)
# FIX BUG: Tabs equal to bit diamter makes offset and select error
simplify_4 = SimplifyTree(Tree=Z_2, Front=False)
milling_bit_radius_3 = Panel(milling_bit_radius_2)
project_2 = Project(Geometry=simplify_3, Plane=xy_2)  # -> Geometry, Transform
neg_2 = Negative(Value=milling_bit_radius_3)
offset_3 = Offset(Curve=project_2.Geometry, Distance=milling_bit_radius_3, Plane=PlaneXY(0, 0, 0), Corners=1)
offset_4 = Offset(Curve=project_2.Geometry, Distance=neg_2, Plane=PlaneXY(0, 0, 0), Corners=1)
len_3 = Length(Curve=offset_3)
len_4 = Length(Curve=offset_4)
smaller_2 = SmallerThan(FirstNumber=len_3, SecondNumber=len_4)  # -> SmallerThan, OrEqualTo
weave_2 = Weave(Pattern=smaller_2.SmallerThan, Stream0=offset_3, Stream1=offset_4, NullGaps=False)
extr_2 = Extrude(Base=weave_2, Direction=simplify_4)
cap_2 = CapHoles(Brep=extr_2)
bit_diameter_compensated_tab_breps_2 = Brep(flatten(cap_2))

# ---- group: Check for invalid boxes
flatten_2 = FlattenTree(Tree=bit_diameter_compensated_tab_breps_2, Path="{0}")
item_9 = ListItem(List=flatten_2, Index=0, Wrap=True)
null_2 = NullItem(Item=item_9)  # -> NullFlags, InvalidFlags, Description
filter = StreamFilter(Gate=null_2.NullFlags, Stream0=bit_diameter_compensated_tab_breps_2, Stream1=tab_breps_3)

flatten_3 = FlattenTree(Tree=bit_diameter_compensated_tab_breps, Path="{0}")
item_10 = ListItem(List=flatten_3, Index=0, Wrap=True)
null_3 = NullItem(Item=item_10)  # -> NullFlags, InvalidFlags, Description
filter_2 = StreamFilter(Gate=null_3.NullFlags, Stream0=bit_diameter_compensated_tab_breps, Stream1=tab_breps_3)

# ----
mesh = MeshBrep(
    Brep=filter_2,
    Settings={GridMaxCount=0, GridMinCount=16, JaggedSeams=False, MaxEdgeLength=0, MinEdgeLength=0.0001, MinTolerance=0, Refine=True, RefineAngle=0, RelativeTolerance=0.65, SimplePlanes=True, Tolerance=0})
mjoin = MeshJoin(Meshes=mesh)
tab_cleanup_volume_mesh = Mesh(mjoin)

make_severed_toolapths_2 = Panel(make_severed_toolapths)
no_tab_brep_input_boolean_2 = Panel(no_tab_brep_input_boolean)
polyline_toolpaths_4 = Curve(clean)

mesh_2 = MeshBrep(
    Brep=filter,
    Settings={GridMaxCount=0, GridMinCount=16, JaggedSeams=False, MaxEdgeLength=0, MinEdgeLength=0.0001, MinTolerance=0, Refine=True, RefineAngle=0, RelativeTolerance=0.65, SimplePlanes=True, Tolerance=0})
mjoin_2 = MeshJoin(Meshes=mesh_2)
tab_volume_mesh = Mesh(mjoin_2)
colom = CollisionOneMany(Collider=tab_volume_mesh, Obstacles=graft(polyline_toolpaths_3))  # -> Collision, Index
pshift_3 = ShiftPaths(Data=colom.Collision, Offset=-1)

tab_or_no_tab_booleans = Integer(pshift_3)

dispatch = Dispatch(List=polyline_toolpaths_3, DispatchPattern=tab_or_no_tab_booleans)  # -> ListA, ListB
toolpaths_without_tabs = Curve(dispatch.ListB)
toolpaths_for_tabbing = Curve(dispatch.ListA)

bbox_5 = BoundingBox(Content=mesh_2, Plane=PlaneXY(0, 0, 0))  # -> Box, Box_2
volume = Volume(Geometry=bbox_5.Box)  # -> Volume, Centroid
xy_3 = XYPlane(Origin=volume.Centroid)
scale_nu = ScaleNU(Geometry=bbox_5.Box, Plane=xy_3, ScaleX="1.01", ScaleY="1.01", ScaleZ=1)  # -> Geometry, Transform
mjoin_3 = MeshJoin(Meshes=scale_nu.Geometry)
tab_control_point_intersect_mesh = Mesh(mjoin_3)

# ---- group: Filter toolpaths entirely inside tabs
toolpaths_without_tabs_2 = Curve(dispatch.ListB)
tab_breps_6 = Brep(filter)
shapein = ShapeInBrep(Brep=tab_breps_6, Shape=toolpaths_without_tabs_2)
lng = ListLength(List=toolpaths_without_tabs_2)
bool = Boolean(shapein)
series = Series(Start=0, Step=1, Count=lng)
dispatch_2 = Dispatch(List=series, DispatchPattern=bool)  # -> ListA, ListB
replace = ReplaceItems(List=toolpaths_without_tabs_2, Indices=dispatch_2.ListB, Wrap=False)
toolpaths_without_tabs_3 = Curve(replace)

# ---- group: Test closing
cls = Closed(Curve=toolpaths_for_tabbing)  # -> Closed, Periodic
graft = GraftTree(Tree=cls.Closed, IncludeEmptyLists=True, IncludeNullItems=True)

# ----
tab_or_no_tab_booleans_2 = Integer(tab_or_no_tab_booleans)
toolpaths_without_tabs_4 = Curve(replace)

# ---- group: Cut toolpaths with extended tab volumes for tab cleanup
tab_cleanup_volume_mesh_2 = Mesh(tab_cleanup_volume_mesh)
mcx = MeshCurve(Mesh=tab_cleanup_volume_mesh_2, Curve=toolpaths_for_tabbing)  # -> Points, Faces

# ----
cullpt = CullDuplicates(Points=mcx.Points, Tolerance="0.01", CullMode=3)  # -> Points, Indices, Valence
pshift_4 = ShiftPaths(Data=cullpt.Points, Offset=-1)

# ---- group: Cut toolpaths with extended tab volumes for tab cleanup (continued)
crv_cp = CurveClosestPoint(Point=pshift_4, Curve=graft(toolpaths_for_tabbing))  # -> Point, Parameter, Distance
shatter = Shatter(Curve=graft(toolpaths_for_tabbing), Parameters=crv_cp.Parameter)
curvepoint = PointOnCurve(shatter, parameter=0.5)
minc = MeshInclusion(Mesh=tab_cleanup_volume_mesh_2, Point=curvepoint, Strict=False)
dispatch_3 = Dispatch(List=shatter, DispatchPattern=minc)  # -> ListA, ListB
tab_cleanup_toolpaths = Curve(dispatch_3.ListA)
toolpath_outside_tabs = Curve(dispatch_3.ListB)

# ----
tab_cleanup_toolpaths_2 = Curve(tab_cleanup_toolpaths)
flatten_4 = FlattenTree(Tree=tab_cleanup_toolpaths_2, Path="{0}")
tab_cleanup_toolpaths_3 = Curve(flatten_4)
tab_cleanup_toolpaths_4 = ClusterOutput(tab_cleanup_toolpaths_3)

# ---- group: Cut toolpaths with tab volumes
tab_volume_mesh_2 = Mesh(tab_volume_mesh)
mcx_2 = MeshCurve(Mesh=tab_volume_mesh_2, Curve=toolpaths_for_tabbing)  # -> Points, Faces

# ----
cullpt_2 = CullDuplicates(Points=mcx_2.Points, Tolerance="0.01", CullMode=3)  # -> Points, Indices, Valence
pshift_5 = ShiftPaths(Data=cullpt_2.Points, Offset=-1)

# ---- group: Cut toolpaths with tab volumes (continued)
crv_cp_2 = CurveClosestPoint(Point=pshift_5, Curve=graft(toolpaths_for_tabbing))  # -> Point, Parameter, Distance
shatter_2 = Shatter(Curve=graft(toolpaths_for_tabbing), Parameters=crv_cp_2.Parameter)
curvepoint_2 = PointOnCurve(shatter_2, parameter=0.5)
minc_2 = MeshInclusion(Mesh=tab_volume_mesh_2, Point=curvepoint_2, Strict=False)
dispatch_4 = Dispatch(List=shatter_2, DispatchPattern=minc_2)  # -> ListA, ListB
toolpath_outside_tabs_2 = Curve(dispatch_4.ListB)
toolpaths_inside_tabs = Curve(dispatch_4.ListA)

# ----
cp_3 = ControlPoints(Curve=toolpaths_inside_tabs)  # -> Points, Weights, Knots
Z_3 = UnitZ(Factor=1)
meshray = MeshRay(Mesh=tab_control_point_intersect_mesh, Point=cp_3.Points, Direction=Z_3)  # -> Point, Hit
pline = PolyLine(Vertices=meshray.Point, Closed=False)
pshift_6 = ShiftPaths(Data=pline, Offset=-1)

weave_3 = Weave(Pattern=minc_2, Stream0=toolpath_outside_tabs_2, Stream1=pshift_6, NullGaps=False)
cp_4 = ControlPoints(Curve=weave_3)  # -> Points, Weights, Knots
pshift_7 = ShiftPaths(Data=cp_4.Points, Offset=-1)
pline_2 = PolyLine(Vertices=pshift_7, Closed=graft)
pshift_8 = ShiftPaths(Data=pline_2, Offset="-2")
toolpath_outside_tabs_3 = Curve(toolpath_outside_tabs_2)
group = Group(Objects=toolpath_outside_tabs_3)

# ---- group: Check
flatten_5 = FlattenTree(Tree=pline_2, Path="{0}")
flatten_6 = FlattenTree(Tree=group, Path="{0}")

# ----
toolpaths_with_tabs = Curve(flatten_5)
pshift_9 = ShiftPaths(Data=group, Offset="-2")
filter_3 = StreamFilter(Gate=make_severed_toolapths_2, Stream0=toolpaths_with_tabs, Stream1=flatten_6)
tabbed_toolpaths = Geometry(filter_3)
weave_4 = Weave(Pattern=tab_or_no_tab_booleans_2, Stream0=toolpaths_without_tabs_4, Stream1=tabbed_toolpaths, NullGaps=False)
ungroup = Ungroup(Group=weave_4)
pshift_10 = ShiftPaths(Data=ungroup, Offset=-1)

polyline_toolpaths_5 = Curve(clean)
end = EndPoints(Curve=pshift_10)  # -> Start, End

end_2 = EndPoints(Curve=polyline_toolpaths_5)  # -> Start, End
crv_cp_3 = CurveClosestPoint(Point=end_2.End, Curve=pshift_10)  # -> Point, Parameter, Distance
pt_3 = Point(end_2.End)

dist = Distance(PointA=end.End, PointB=pt_3)
smaller_3 = SmallerThan(FirstNumber=dist, SecondNumber="0.01")  # -> SmallerThan, OrEqualTo
dispatch_5 = Dispatch(List=crv_cp_3.Parameter, DispatchPattern=smaller_3.SmallerThan)  # -> ListA, ListB
dispatch_6 = Dispatch(List=pshift_10, DispatchPattern=smaller_3.SmallerThan)  # -> ListA, ListB
seam = Seam(Curve=dispatch_6.ListB, Seam=dispatch_5.ListB)
weave_5 = Weave(Pattern=smaller_3.SmallerThan, Stream0=seam, Stream1=dispatch_6.ListA, NullGaps=False)

filter_4 = StreamFilter(Gate=no_tab_brep_input_boolean_2, Stream0=weave_5, Stream1=polyline_toolpaths_4)
clean_2 = CleanTree(RemoveNulls=True, RemoveInvalid=False, RemoveEmpty=False, Tree=filter_4)
flatten_7 = FlattenTree(Tree=clean_2, Path="{0}")
tabbed_toolpaths_2 = Curve(flatten_7)
tabbed_toolpaths_3 = ClusterOutput(tabbed_toolpaths_2)

# ==== cluster RampToolpathPlunges
toolpaths_to_ramp = ClusterInput()
ramp_angle = ClusterInput()
toolpaths_to_ramp_2 = Curve(toolpaths_to_ramp)
ramp_angle_2 = Number(ramp_angle)

# ---- group: Constrain angle input to sane values
ramp_angle_3 = Panel(ramp_angle_2)
minimum_angle = Panel("1")
maximum_angle = Panel("89")
smaller = SmallerThan(FirstNumber=ramp_angle_3, SecondNumber=minimum_angle)  # -> SmallerThan, OrEqualTo
filter = StreamFilter(Gate=smaller.SmallerThan, Stream0=ramp_angle_3, Stream1=minimum_angle)
larger = LargerThan(FirstNumber=filter, SecondNumber=maximum_angle)  # -> LargerThan, OrEqualTo
filter_2 = StreamFilter(Gate=larger.LargerThan, Stream0=filter, Stream1=maximum_angle)

# ----
end = EndPoints(Curve=toolpaths_to_ramp_2)  # -> Start, End
pdecon = Deconstruct(Point=end.Start)  # -> XComponent, YComponent, ZComponent
# Fix values that make angle to create correct angle in case P beeing longer than curve length
abs = Absolute(Value=pdecon.ZComponent)
rad = Radians(Degrees=filter_2)
len = Length(Curve=toolpaths_to_ramp_2)
rtrig = RightTrigonometry(Beta=rad, QLength=abs)  # -> Alpha, Beta, PLength, QLength, RLength
smaller_2 = SmallerThan(FirstNumber=len, SecondNumber=rtrig.PLength)  # -> SmallerThan, OrEqualTo
dispatch = Dispatch(List=len, DispatchPattern=smaller_2.OrEqualTo)  # -> ListA, ListB
dispatch_2 = Dispatch(List=rtrig.PLength, DispatchPattern=smaller_2.OrEqualTo)  # -> ListA, ListB
division = Division(A=dispatch_2.ListA, B=dispatch.ListA)
weave = Weave(Pattern=smaller_2.OrEqualTo, Stream0=dispatch_2.ListB, Stream1=dispatch.ListA, NullGaps=False)

cls = Closed(Curve=toolpaths_to_ramp_2)  # -> Closed, Periodic
dispatch_3 = Dispatch(List=toolpaths_to_ramp_2, DispatchPattern=cls.Closed)  # -> ListA, ListB
flip = FlipCurve(Curve=dispatch_3.ListA)  # -> Curve, Flag
weave_2 = Weave(Pattern=cls.Closed, Stream0=dispatch_3.ListB, Stream1=flip.Curve, NullGaps=False)

round = Round(Number=division)  # -> Nearest, Floor, Ceiling
use_ceiling_or_nearest = Panel(round.Ceiling)
division_2 = Division(A=weave, B="0.1")
dispatch_4 = Dispatch(List=abs, DispatchPattern=smaller_2.OrEqualTo)  # -> ListA, ListB
int = Integer(division_2)
division_3 = Division(A=dispatch_4.ListA, B=round.Nearest)
int_2 = Integer(division_2)
division_4 = Division(A=weave, B=int)
weave_3 = Weave(Pattern=smaller_2.OrEqualTo, Stream0=dispatch_4.ListB, Stream1=division_3, NullGaps=False)
addition = Addition(A=int, B="1")
division_5 = Division(A=weave_3, B=int_2)
series = Series(Start=0, Step=division_4, Count=addition)
series_2 = Series(Start=0, Step=division_5, Count=addition)
eval = EvaluateLength(Curve=graft(weave_2), Length=series, Normalized=False)  # -> Point, Tangent, Parameter
Z = UnitZ(Factor=series_2)
move = Move(Geometry=eval.Point, Motion=Z)  # -> Geometry, Transform

# ---- group: Make ram path points curve at specified angle or steeper
pt = Point(move.Geometry)
graft = GraftTree(Tree=division_5, IncludeEmptyLists=True, IncludeNullItems=True)
pdecon_2 = Deconstruct(Point=pt)  # -> XComponent, YComponent, ZComponent
shift = ShiftList(List=pdecon_2.ZComponent, Shift=1, Wrap=False)
shift_2 = ShiftList(List=pdecon_2.ZComponent, Shift="-1", Wrap=False)
panel = Panel(shift_2)
panel_2 = Panel(shift)
subtraction = Subtraction(A=shift, B=shift_2)
simplify = SimplifyTree(Tree=graft, Front=False)
simplify_2 = SimplifyTree(Tree=subtraction, Front=False)
subtraction_2 = Subtraction(A=simplify_2, B=simplify)
lng = ListLength(List=subtraction_2)
smaller_3 = SmallerThan(FirstNumber=subtraction_2, SecondNumber="0")  # -> SmallerThan, OrEqualTo
dup = DuplicateData(Data="0", Number=lng, Order=True)
simplify_3 = SimplifyTree(Tree=dup, Front=False)
p_n_c = PickNChoose(Pattern=smaller_3.SmallerThan, Stream0=simplify_3, Stream1=subtraction_2)
abs_2 = Absolute(Value=p_n_c)
ma = MassAddition(Input=abs_2)  # -> Result, PartialResults
Z_2 = UnitZ(Factor=ma.PartialResults)
move_2 = Move(Geometry=move.Geometry, Motion=Z_2)  # -> Geometry, Transform
pt_2 = Point(move_2.Geometry)

# ----
pline = PolyLine(Vertices=pt_2, Closed=False)
pshift = ShiftPaths(Data=pline, Offset=-1)
redpline = Reduce(Polyline=pshift, Tolerance="0.02")  # -> Polyline, Reduction
flip_2 = FlipCurve(Curve=redpline.Polyline)  # -> Curve, Flag
first_ramp_curve = Curve(flip_2.Curve)
end_2 = EndPoints(Curve=first_ramp_curve)  # -> Start, End
pdecon_3 = Deconstruct(Point=end_2.Start)  # -> XComponent, YComponent, ZComponent
smaller_4 = SmallerThan(FirstNumber=pdecon_3.ZComponent, SecondNumber="0")  # -> SmallerThan, OrEqualTo

dispatch_5 = Dispatch(List=first_ramp_curve, DispatchPattern=smaller_2.OrEqualTo)  # -> ListA, ListB
end_3 = EndPoints(Curve=dispatch_5.ListA)  # -> Start, End
pdecon_4 = Deconstruct(Point=end_3.End)  # -> XComponent, YComponent, ZComponent
pdecon_5 = Deconstruct(Point=end_3.Start)  # -> XComponent, YComponent, ZComponent
pt_3 = ConstructPoint(XCoordinate=0, YCoordinate=0, ZCoordinate=pdecon_4.ZComponent)
pt_4 = ConstructPoint(XCoordinate=0, YCoordinate=0, ZCoordinate=pdecon_5.ZComponent)
dist = Distance(PointA=pt_4, PointB=pt_3)
series_3 = Series(Start=0, Step=dist, Count=round.Nearest)
Z_3 = UnitZ(Factor=series_3)
move_3 = Move(Geometry=graft(dispatch_5.ListA), Motion=Z_3)  # -> Geometry, Transform

clean = CleanTree(RemoveNulls=True, RemoveInvalid=True, RemoveEmpty=False, Tree=move_3.Geometry)
join = JoinCurves(Curves=move_3.Geometry, Preserve=False)
flip_3 = FlipMatrix(Data=clean)
lng_2 = ListLength(List=join)
dispatch_6 = Dispatch(List=flip_3, DispatchPattern=cls.Closed)  # -> ListA, ListB
larger_2 = LargerThan(FirstNumber=lng_2, SecondNumber="1")  # -> LargerThan, OrEqualTo
flip_4 = FlipMatrix(Data=dispatch_6.ListB)
dispatch_7 = Dispatch(List=join, DispatchPattern=larger_2.LargerThan)  # -> ListA, ListB
simplify_4 = SimplifyTree(Tree=dispatch_7.ListA, Front=False)
dispatch_8 = Dispatch(List=flip_4, DispatchPattern=[True, False])  # -> ListA, ListB
flatten = FlattenTree(Tree=dispatch_7.ListB, Path="{0}")
dispatch_9 = Dispatch(List=simplify_4, DispatchPattern=[True, False])  # -> ListA, ListB
crv = Curve(dispatch_9.ListB)
bbox = BoundingBox(Content=dispatch_9.ListB, Plane=PlaneXY(0, 0, 0))  # -> Box, Box_2
xy = XYPlane(Origin=Point(0, 0, 0))
cp = ControlPoints(Curve=dispatch_8.ListB)  # -> Points, Weights, Knots
x_tremez = Extremes(Curve=crv, Plane=xy)  # -> Highest, Lowest
cp_2 = ControlPoints(Curve=dispatch_9.ListB)  # -> Points, Weights, Knots; disabled
pshift_2 = ShiftPaths(Data=bbox.Box, Offset=-1)
pdecon_6 = Deconstruct(Point=cp.Points)  # -> XComponent, YComponent, ZComponent
ln = Line(StartPoint=x_tremez.Highest, EndPoint=x_tremez.Lowest)
debrep = DeconstructBrep(Brep=pshift_2)  # -> Faces, Edges, Vertices
rev = ReverseList(List=pdecon_6.ZComponent)
pdecon_7 = Deconstruct(Point=cp_2.Points)  # -> XComponent, YComponent, ZComponent
pt_5 = ConstructPoint(XCoordinate=pdecon_6.XComponent, YCoordinate=pdecon_6.YComponent, ZCoordinate=rev)
item = ListItem(List=debrep.Edges, Index="8", Wrap=True)
rev_2 = ReverseList(List=pdecon_7.ZComponent)
eval_2 = EvaluateLength(Curve=ln, Length="0.5", Normalized=True)  # -> Point, Tangent, Parameter
pline_2 = PolyLine(Vertices=pt_5, Closed=False)
pt_6 = ConstructPoint(XCoordinate=pdecon_7.XComponent, YCoordinate=pdecon_7.YComponent, ZCoordinate=rev_2)
pshift_3 = ShiftPaths(Data=eval_2.Point, Offset=-1)  # disabled
pshift_4 = ShiftPaths(Data=pline_2, Offset=-1)
pline_3 = PolyLine(Vertices=pt_6, Closed=False)
xy_2 = XYPlane(Origin=eval_2.Point)
flip_5 = FlipCurve(Curve=pshift_4)  # -> Curve, Flag
pshift_5 = ShiftPaths(Data=pline_3, Offset=-1)
mirror = Mirror(Geometry=crv, Plane=xy_2)  # -> Geometry, Transform
weave_4 = Weave(Pattern=[0, 1], Stream0=dispatch_8.ListA, Stream1=flip_5.Curve, NullGaps=False)
flip_6 = FlipCurve(Curve=pshift_5)  # -> Curve, Flag
flip_7 = FlipMatrix(Data=weave_4)
flip_8 = FlipCurve(Curve=mirror.Geometry)  # -> Curve, Flag
weave_5 = Weave(Pattern=[0, 1], Stream0=dispatch_9.ListA, Stream1=flip_8.Curve, NullGaps=False)
weave_6 = Weave(Pattern=cls.Closed, Stream0=flip_7, Stream1=dispatch_6.ListA, NullGaps=False)
join_2 = JoinCurves(Curves=weave_5, Preserve=False)
flip_9 = FlipMatrix(Data=weave_6)
simplify_5 = SimplifyTree(Tree=join_2, Front=False)
join_3 = JoinCurves(Curves=flip_9, Preserve=False)
number_slider = Slider(4, range=0..10)
weave_7 = Weave(Pattern=flatten(larger_2.LargerThan), Stream0=flatten(flatten), Stream1=flatten(simplify_5), NullGaps=False)
pshift_6 = ShiftPaths(Data=join_3, Offset=-1)
pshift_7 = ShiftPaths(Data=pshift_6, Offset=-1)
weave_8 = Weave(Pattern=smaller_2.OrEqualTo, Stream0=dispatch_5.ListB, Stream1=weave_7, NullGaps=False)
item_2 = ListItem(List=toolpaths_to_ramp_2, Index=number_slider, Wrap=True)
item_3 = ListItem(List=weave_8, Index=number_slider, Wrap=True)
weave_9 = Weave(Pattern=[0, 1], Stream0=weave_8, Stream1=toolpaths_to_ramp_2, NullGaps=False)
join_4 = JoinCurves(Curves=weave_9, Preserve=Toggle(True))  # disabled
ramped_toolpaths = Curve(weave_9)

# ---- group: Trim ramps that go aboce zero plane
ramped_toolpaths_2 = Curve(reparameterize(ramped_toolpaths))
xy_3 = XYPlane(Origin=Point(0, 0, 0))
pcx = CurvePlane(Curve=ramped_toolpaths_2, Plane=xy_3)  # -> Points, ParamsC, ParamsP
lng_3 = ListLength(List=pcx.ParamsC)
larger_3 = LargerThan(FirstNumber=lng_3, SecondNumber="0")  # -> LargerThan, OrEqualTo
int_3 = Integer(larger_3.LargerThan)
p_n_c_2 = PickNChoose(Pattern=larger_3.LargerThan, Stream0=int_3, Stream1=pcx.ParamsC)
shatter = Shatter(Curve=graft(ramped_toolpaths_2), Parameters=p_n_c_2)
eval_3 = EvaluateLength(Curve=shatter, Length="0.5", Normalized=True)  # -> Point, Tangent, Parameter
pdecon_8 = Deconstruct(Point=eval_3.Point)  # -> XComponent, YComponent, ZComponent
larger_4 = LargerThan(FirstNumber=pdecon_8.ZComponent, SecondNumber="0")  # -> LargerThan, OrEqualTo
dispatch_10 = Dispatch(List=shatter, DispatchPattern=larger_4.LargerThan)  # -> ListA, ListB
pshift_8 = ShiftPaths(Data=dispatch_10.ListB, Offset=-1)
pshift_9 = ShiftPaths(Data=pshift_8, Offset=-1)
ramped_toolpaths_3 = Curve(pshift_9)

# ----
panel_3 = Panel(pcx.ParamsC)
ramped_toolpaths_4 = ClusterOutput(ramped_toolpaths_3)

# ==== cluster RampToolpathPlunges_2
toolpaths_to_ramp = ClusterInput()
ramp_angle = ClusterInput()
toolpaths_to_ramp_2 = Curve(toolpaths_to_ramp)
ramp_angle_2 = Number(ramp_angle)
end = EndPoints(Curve=toolpaths_to_ramp_2)  # -> Start, End
pdecon = Deconstruct(Point=end.Start)  # -> XComponent, YComponent, ZComponent
abs = Absolute(Value=pdecon.ZComponent)
dom = ConstructDomain(DomainStart="1", DomainEnd="89")
constrain = Constrain(Number=ramp_angle_2, Domain=dom)
rad = Radians(Degrees=constrain)
rtrig = RightTrigonometry(Beta=rad, QLength=abs)  # -> Alpha, Beta, PLength, QLength, RLength
len = Length(Curve=toolpaths_to_ramp_2)
smaller = SmallerThan(FirstNumber=len, SecondNumber=rtrig.PLength)  # -> SmallerThan, OrEqualTo
dispatch = Dispatch(List=len, DispatchPattern=smaller.OrEqualTo)  # -> ListA, ListB
dispatch_2 = Dispatch(List=rtrig.PLength, DispatchPattern=smaller.OrEqualTo)  # -> ListA, ListB
division = Division(A=dispatch_2.ListA, B=dispatch.ListA)
weave = Weave(Pattern=smaller.OrEqualTo, Stream0=dispatch_2.ListB, Stream1=dispatch.ListA, NullGaps=False)

cls = Closed(Curve=toolpaths_to_ramp_2)  # -> Closed, Periodic
dispatch_3 = Dispatch(List=toolpaths_to_ramp_2, DispatchPattern=cls.Closed)  # -> ListA, ListB
flip = FlipCurve(Curve=dispatch_3.ListA)  # -> Curve, Flag
weave_2 = Weave(Pattern=cls.Closed, Stream0=dispatch_3.ListB, Stream1=flip.Curve, NullGaps=False)

round = Round(Number=division)  # -> Nearest, Floor, Ceiling
division_2 = Division(A=weave, B="0.1")
dispatch_4 = Dispatch(List=abs, DispatchPattern=smaller.OrEqualTo)  # -> ListA, ListB
int = Integer(division_2)
division_3 = Division(A=dispatch_4.ListA, B=round.Ceiling)
int_2 = Integer(division_2)
division_4 = Division(A=weave, B=int)
weave_3 = Weave(Pattern=smaller.OrEqualTo, Stream0=dispatch_4.ListB, Stream1=division_3, NullGaps=False)
addition = Addition(A=int, B="1")
division_5 = Division(A=weave_3, B=int_2)
series = Series(Start=0, Step=division_4, Count=addition)
series_2 = Series(Start=0, Step=division_5, Count=addition)
eval = EvaluateLength(Curve=graft(weave_2), Length=series, Normalized=False)  # -> Point, Tangent, Parameter
Z = UnitZ(Factor=series_2)
move = Move(Geometry=eval.Point, Motion=Z)  # -> Geometry, Transform
pline = PolyLine(Vertices=move.Geometry, Closed=False)
pshift = ShiftPaths(Data=pline, Offset=-1)
redpline = Reduce(Polyline=pshift, Tolerance="0.02")  # -> Polyline, Reduction
flip_2 = FlipCurve(Curve=redpline.Polyline)  # -> Curve, Flag

dispatch_5 = Dispatch(List=flip_2.Curve, DispatchPattern=smaller.OrEqualTo)  # -> ListA, ListB
end_2 = EndPoints(Curve=dispatch_5.ListA)  # -> Start, End
pdecon_2 = Deconstruct(Point=end_2.End)  # -> XComponent, YComponent, ZComponent
pdecon_3 = Deconstruct(Point=end_2.Start)  # -> XComponent, YComponent, ZComponent
pt = ConstructPoint(XCoordinate=0, YCoordinate=0, ZCoordinate=pdecon_2.ZComponent)
pt_2 = ConstructPoint(XCoordinate=0, YCoordinate=0, ZCoordinate=pdecon_3.ZComponent)
dist = Distance(PointA=pt_2, PointB=pt)
series_3 = Series(Start=0, Step=dist, Count=round.Ceiling)
Z_2 = UnitZ(Factor=series_3)
move_2 = Move(Geometry=graft(dispatch_5.ListA), Motion=Z_2)  # -> Geometry, Transform

clean = CleanTree(RemoveNulls=True, RemoveInvalid=True, RemoveEmpty=False, Tree=move_2.Geometry)
join = JoinCurves(Curves=move_2.Geometry, Preserve=False)
flip_3 = FlipMatrix(Data=clean)
lng = ListLength(List=join)
dispatch_6 = Dispatch(List=flip_3, DispatchPattern=cls.Closed)  # -> ListA, ListB
larger = LargerThan(FirstNumber=lng, SecondNumber="1")  # -> LargerThan, OrEqualTo
flip_4 = FlipMatrix(Data=dispatch_6.ListB)
dispatch_7 = Dispatch(List=join, DispatchPattern=larger.LargerThan)  # -> ListA, ListB
simplify = SimplifyTree(Tree=dispatch_7.ListA, Front=False)
dispatch_8 = Dispatch(List=flip_4, DispatchPattern=[True, False])  # -> ListA, ListB
flatten = FlattenTree(Tree=dispatch_7.ListB, Path="{0}")
dispatch_9 = Dispatch(List=simplify, DispatchPattern=[True, False])  # -> ListA, ListB
crv = Curve(dispatch_9.ListB)
bbox = BoundingBox(Content=dispatch_9.ListB, Plane=PlaneXY(0, 0, 0))  # -> Box, Box_2
xy = XYPlane(Origin=Point(0, 0, 0))
cp = ControlPoints(Curve=dispatch_8.ListB)  # -> Points, Weights, Knots
x_tremez = Extremes(Curve=crv, Plane=xy)  # -> Highest, Lowest
cp_2 = ControlPoints(Curve=dispatch_9.ListB)  # -> Points, Weights, Knots; disabled
pshift_2 = ShiftPaths(Data=bbox.Box, Offset=-1)
pdecon_4 = Deconstruct(Point=cp.Points)  # -> XComponent, YComponent, ZComponent
ln = Line(StartPoint=x_tremez.Highest, EndPoint=x_tremez.Lowest)
debrep = DeconstructBrep(Brep=pshift_2)  # -> Faces, Edges, Vertices
rev = ReverseList(List=pdecon_4.ZComponent)
pdecon_5 = Deconstruct(Point=cp_2.Points)  # -> XComponent, YComponent, ZComponent
pt_3 = ConstructPoint(XCoordinate=pdecon_4.XComponent, YCoordinate=pdecon_4.YComponent, ZCoordinate=rev)
item = ListItem(List=debrep.Edges, Index="8", Wrap=True)
rev_2 = ReverseList(List=pdecon_5.ZComponent)
eval_2 = EvaluateLength(Curve=ln, Length="0.5", Normalized=True)  # -> Point, Tangent, Parameter
pline_2 = PolyLine(Vertices=pt_3, Closed=False)
pt_4 = ConstructPoint(XCoordinate=pdecon_5.XComponent, YCoordinate=pdecon_5.YComponent, ZCoordinate=rev_2)
pshift_3 = ShiftPaths(Data=eval_2.Point, Offset=-1)  # disabled
pshift_4 = ShiftPaths(Data=pline_2, Offset=-1)
pline_3 = PolyLine(Vertices=pt_4, Closed=False)
xy_2 = XYPlane(Origin=eval_2.Point)
flip_5 = FlipCurve(Curve=pshift_4)  # -> Curve, Flag
pshift_5 = ShiftPaths(Data=pline_3, Offset=-1)
mirror = Mirror(Geometry=crv, Plane=xy_2)  # -> Geometry, Transform
weave_4 = Weave(Pattern=[0, 1], Stream0=dispatch_8.ListA, Stream1=flip_5.Curve, NullGaps=False)
flip_6 = FlipCurve(Curve=pshift_5)  # -> Curve, Flag
flip_7 = FlipMatrix(Data=weave_4)
flip_8 = FlipCurve(Curve=mirror.Geometry)  # -> Curve, Flag
weave_5 = Weave(Pattern=[0, 1], Stream0=dispatch_9.ListA, Stream1=flip_8.Curve, NullGaps=False)
weave_6 = Weave(Pattern=cls.Closed, Stream0=flip_7, Stream1=dispatch_6.ListA, NullGaps=False)
join_2 = JoinCurves(Curves=weave_5, Preserve=False)
flip_9 = FlipMatrix(Data=weave_6)
simplify_2 = SimplifyTree(Tree=join_2, Front=False)
join_3 = JoinCurves(Curves=flip_9, Preserve=False)
number_slider = Slider(4, range=0..10)
weave_7 = Weave(Pattern=flatten(larger.LargerThan), Stream0=flatten(flatten), Stream1=flatten(simplify_2), NullGaps=False)
pshift_6 = ShiftPaths(Data=join_3, Offset=-1)
pshift_7 = ShiftPaths(Data=pshift_6, Offset=-1)
weave_8 = Weave(Pattern=smaller.OrEqualTo, Stream0=dispatch_5.ListB, Stream1=weave_7, NullGaps=False)
item_2 = ListItem(List=toolpaths_to_ramp_2, Index=number_slider, Wrap=True)
item_3 = ListItem(List=weave_8, Index=number_slider, Wrap=True)
weave_9 = Weave(Pattern=[0, 1], Stream0=weave_8, Stream1=toolpaths_to_ramp_2, NullGaps=False)
join_4 = JoinCurves(Curves=weave_9, Preserve=Toggle(True))  # disabled
ramped_toolpaths = Curve(weave_9)
ramped_toolpaths_2 = ClusterOutput(ramped_toolpaths)
