# Grasshopper definition machine builder.gh (Grasshopper 0.9.76)
# Copyright: Creative commons attribution share-a-like
# Copyright: Co-de-iT
# plug-ins: Firefly.Core

# ---- group: Gantry bed
make_electronics_section_outside_rack = BooleanToggle(False)
# ok lets verify this:
section_width = Slider(80, range=10..150)
vacuum_tube_diameter = Slider(48, range=5..60)
make_vacuum_bed = BooleanToggle(True)

# ----
# Welcome to the machine builder
# 
# A simple way of building custom machines
# with a large format CNC router.
# 
# 1; Specify your desired machine, materials and tools available
# 2: Simulate and verfify your machine
# 3: Generate g-code for cutting the various parts of the macine
# 4: Assemble, add end-effector, calibrate and use
# 1
# Design
# I want build this
# kind of machine:
# It should be able to
# make things this size:
list = ValueList({"Single axis": 0, "Simple gantry": 1, "Delta platform": 2}, selected="Single axis")

# ---- group: Single axis
axis_length = Slider(800, range=20..1000)

# ---- group: Simple gantry work area
work_area_x = Slider(640, range=20..2000)
work_area_y = Slider(320, range=20..1250)
work_area_z = Slider(22, range=2..200)

# ---- group: Z axis
make_z_axis_side1 = BooleanToggle(False)
make_z_axis_side2 = BooleanToggle(False)

# ---- group: Delta platform work area
work_area_diameter = Slider(200, range=20..1000)
work_area_z_2 = Slider(100, range=20..1000)

# ---- group: Joinery
# Bonus features:
join_rails_with_dowels_instead_of_bolts = BooleanToggle(False)

# ----
job_simulation_position = Slider(0, range=0..1)
list_2 = ValueList({"View machine in 3D": 0, "View machine in 2D - 1:1": 1, "View machine from end effector position": 2}, selected="View machine in 3D")

# ---- group: Job to simulate
# 2
# Simulate
right_click_and_choose_set_one_file_path = FilePath("C:\Users\Jens\Desktop\vbird.gcode")

# ---- group: BOM
# Machine stats:
panel = Panel("to be developed")

# Bill of materials:
panel_2 = Panel("to be developed")

# ----
list_3 = ValueList({"Low detail 3D": 0, "High detail 3D": 1}, selected="Low detail 3D")
# Make motor plate option
# 
# Make pinion cutting
# 
# Make Y and X slide lock on one side
# 
# Make separate rack material option
# 
# Make outside hold down
# 
# Fix lower layer tab situation?
# 
# Make upper and mid bed layer cutting
# 
# Organize cut order of parts for minimum jog
# 
# Make instructions
# 
# Make machine stats and bom
# 
# Make clusters to fix speed?
# 
# Make auto layout?
# 
# Fix motor pocket is not possible with hex nut pocket in lower gantry?
# 
# Link space between parts to
# hold down spacer and milling bit diameter?
# 
# make auto layout for bed, bridge and slide?
# 
# fix rack mill has pass depth on first pass?
# 3
# Fabricate
list_4 = ValueList({"View machine parts": 0, "Pre fabricate rails, pinion and bearings": 1, "Cut pinion axis hole": 2, "Cut pinion teeth": 3, "Pre fabricate main frame parts": 4, "Cut registration geometry for the assembly": 5, "Cut v-rail geometry": 6, "Cut rack geometry": 7, "Flatten gantry bed": 8, "Drill vacuum holes": 9, "Document this machine": 10}, selected="View machine parts")

part_position_shift_y = Slider(30, range=-50..1000)
space_between_parts = Slider(30, range=-50..200)
part_position_shift_x = Slider(30, range=-50..1000)

instructions = Panel("to be developed")
list_5 = ValueList({"Give me a cut sheet for all the parts": 0, "Give me job: 1": 1, "Give me job: 2": 2, "Give me job: 3": 3, "Give me job: 4": 4, "Give me job: 5": 5, "Give me job: 6": 6, "Give me job: 7": 7, "Give me job: 8": 8, "Give me job: 9": 9}, selected="Give me job: 1")
list_6 = ValueList({"Give me outside part hold down": 0, "Give me inside part hold down": 1, "Give me main cutting": 2}, selected="Give me main cutting")

# ---- group: Override auto settings
speed = ControlKnob(Decimals=0, Limit=True, Maximum=200, Minimum=10, Range=50, Value=100)

# ----
# My milling machine:
dust_skirt_diameter = Slider(160, range=-50..200)
milling_machine_bed_size_y = Panel("1220")
milling_machine_bed_size_x = Panel("2440")

# ----
# Advanced settings
# I want to use this
# motor standard:
list_7 = ValueList({"NEMA 17": 0, "NEMA 23": 1, "NEMA 34": 2}, selected="NEMA 17")
motor_shaft_diamameter = Slider(4, range=3..15)
motor_height = Slider(42, range=30..100)
make_motor_plates = BooleanToggle(True)
motor_plate_bolt_diamter = Slider(6.4, range=3..15)
# I want it to glide with:
motor_nut_width_flat_side_to_flat_side = Slider(9.7, range=3..15)

# ---- group: Birds mouth diamond bit
diameter = Slider(38.1, range=10..50)
upper_knife_length = Slider(12.2, range=10..40)
lower_knife_length = Slider(22.3, range=10..40)

# ---- group: Part registration in milling machine bed
x_corner_slide_jig = Panel("30")
y_corner_slide_jig = Panel("1150")
x_corner_bridge_assembly = Panel("100")
y_corner_bridge_assembly = Panel("600")
x_corner_bed = Panel("30")
y_corner_bed = Panel("30")

# ---- group: Main material + rail and pinion pre cut
# Note: Single flute end mills recomended
diameter_2 = Slider(6, range=3..6.35)

# ---- group: Pinion axis inside cut
diameter_3 = Slider(3, range=3..4)

# ---- group: Pinion teeth cut
diameter_4 = Slider(2, range=2..4)

# ---- group: Rack teeth cut
diameter_5 = Slider(3, range=2..6.35)

# ----
list_8 = ValueList({"Plain bearings, V-type": 0, "Skateboard bearing V-wheels": 1}, selected="Plain bearings, V-type")

# ---- group: Main construction material
# I want to use these materials:
list_9 = ValueList({"Valchromat / MDF": 1, "Plastic": 3, "Aluminum / Brass": 4}, selected="Valchromat / MDF")
thickness = Slider(15, range=5..30)

# ---- group: Rail, rack and pinion material
list_10 = ValueList({"Plastic": 3, "Aluminum / Brass": 4}, selected="Plastic")
# My milling bits:
thickness_2 = Slider(12, range=3..20)

# ---- group: Simple gantry bed surfacing bit
diameter_6 = Slider(10, range=10..20)

# ---- group: Vacuum bed hole drill
diameter_7 = Slider(3, range=1..6)

# ----
merge = Merge(Data1="MDF: ", Data2="1.5", Data3=" M2")
merge_2 = Merge(Data1="Plastic: ", Data2="0.6", Data3=" M2")
rectangle = Rectangle(Plane=PlaneXY(0, 0, 0), XSize=milling_machine_bed_size_x, YSize=milling_machine_bed_size_y, Radius=0)  # -> Rectangle, Length
join = TextJoin(Text=merge)
join_2 = TextJoin(Text=merge_2)
merge_3 = Merge(Data1=join, Data2=join_2, Data3="NEMA 17 motor: 4", Data4="Bolt M5: 24", Data5="Bolt M5: 24", Data6="Nut M5: 24")
preview = CustomPreview(Geometry=rectangle.Rectangle, Shader=ColourSwatch(SwatchColor=RGB(66, 66, 66)))

# ---- group: Motor library
motor_type = Panel(list_7)
motor_widths = Panel("""42.3
57.15
85.6""")
motor_type_2 = Panel(list_7)
shaft_opening_diameters = Panel("""24
32
48""")
motor_mount_hole_diameters = Panel("""3
5
6.5""")
motor_mount_hole_spacings = Panel("""31
47.14
69.6""")
hole_size_multiplier = Panel("1.1")
multiplication = Multiplication(A=motor_mount_hole_diameters, B=hole_size_multiplier)
item = ListItem(List=motor_widths, Index=motor_type, Wrap=True)
item_2 = ListItem(List=shaft_opening_diameters, Index=motor_type_2, Wrap=True)
item_3 = ListItem(List=multiplication, Index=motor_type_2, Wrap=True)
item_4 = ListItem(List=motor_mount_hole_spacings, Index=motor_type_2, Wrap=True)

# ----
main_material_thickness = Panel(thickness)
rail_rack_and_pinion_material_thickness = Panel(thickness_2)
arm_to_axis_angle = Slider(30, range=15..60)
center_plate_diameter = Slider(100, range=60..200)
motorize_z_axis_side1 = BooleanToggle(False)
motorize_z_axis_side2 = BooleanToggle(False)

# ---- group: Machine stiffness settings
number_of_layers_beneath_rack_and_rail_l = Panel("2")  # "Number of layers beneath rack and rail layer"
number_of_layers_in_gantry_bed = Panel("1")
# Pro settings
axis_width = Panel("120")
carriage_lenght = Panel("100")

# ---- group: Motor settings
motor_width = Panel(item)
motor_height_2 = Panel(motor_height)
motor_mount_hole_spacing = Panel(item_4)
motor_mount_hole_diameter = Panel(item_3)
make_motor_mount_holes_millable_with_mai = Panel(Toggle(True))  # "Make motor mount holes millable with main milling bit"
shaft_opening_diameter = Panel(item_2)
motor_mount_placement_margin = Panel("4")
thickness_underneath_motor_pocket_on_car = Panel("6")  # "Thickness underneath motor pocket on carriage"
thickness_underneath_motor_pocket_on_z_w = Panel("4")  # "Thickness underneath motor pocket on Z wall"

# ---- group: Rack and pinion settings
rack_mill_margin = Panel("0.1")
number_of_pinion_teeth = Panel("10")
pinion_to_pocket_wall_margin = Panel("2")
pinion_edge_screw_edge_margin = Panel("5")
rack_and_pinion_tooth_height = Panel("6")
rack_and_pinion_tooth_overlap_reduction = Panel("1")  # "Rack and pinion tooth overlap reduction distance"
material_leftover_beneath_rack_teeth = Panel("1.2")

# ---- group: Spare part settings
extra_amount_of_pinions_to_cut = Panel("0")
extra_amount_of_slides_to_cut = Panel("0")

# ---- group: Axis assembly settings
wedge_or_bolt_spacing = Panel("70")
additional_axis_margin = Panel("4")
nut_pocket_depth = Panel("10")
wedge_width_to_material_thickness_ratio = Panel("1.5")
mounting_hole_spacing = Panel("75")
attachment_bolt_diameter = Panel("6.4")
nut_width_flat_side_to_flat_side = Panel("9.7")
spacer_diameter_inc_margin = Panel("16")
spacer_pocket_depth = Panel("6")

# ---- group: Cutsheet layout and regisration
extra_cutout_depth = Panel("0.6")
extra_precut_with_offset_top_layer = Panel("0.6")
hold_down_minimum_spacing = Panel("120")
tab_width = Panel("12")
tab_height = Panel("8")
registration_hole_depth = Panel("8")
hold_down_and_registration_hole_diameter = Panel("6.2")

# ---- group: Rail margins
rail_to_carriage_safety_distance = Panel("2.5")
rail_flat_mid_section_heigth = Panel("1")
v_rail_to_attachment_bolt_margin = Panel("6")

# ----
g_code_previewer = GCodePreviewer(F=right_click_and_choose_set_one_file_path)
bearing_bolt_spacer_diameter = Panel("15")

# ---- group: Bearings
inner_v_rail_edge_to_bolt_center_distanc = Panel("10.5")  # "Inner v rail edge to bolt center distance"
bearing_bolt_placement_margin = Panel("4")
bearing_bolt_diameter = Panel("6.4")
bolt_head_height_inc_spacer_and_margin = Panel("6")
hole_size_multiplier_2 = Panel("1.05")

# ----
make_motor_plates_2 = Panel(make_motor_plates)
motor_plate_bolt_diamter_2 = Panel(motor_plate_bolt_diamter)
motor_nut_width_flat_side_to_flat_side_2 = Panel(motor_nut_width_flat_side_to_flat_side)

corner_radius = Panel("3")
preview_center_y = Panel("625")
preview_bottom_z = Panel("0")
motorize_z_axis_side1_2 = Panel(motorize_z_axis_side1)
motorize_z_axis_side1_3 = Panel(motorize_z_axis_side2)
preview_center_x = Panel("350")
make_z_axis_side2_2 = Panel(make_z_axis_side2)
single_axis_config_identifier = Panel("0")
single_axis_config_identifier_2 = Panel("2")
make_z_axis_side1_2 = Panel(make_z_axis_side1)
gantry_config_identifier = Panel("1")

# ---- group: Delta config settings
arm_to_axis_angle_2 = Panel(arm_to_axis_angle)
center_plate_diameter_2 = Panel(center_plate_diameter)
minium_arm_to_axis_angle = Panel("5")

# ----
hello_world_letters = Curve([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])
null = NullItem(Item=g_code_previewer)  # -> NullFlags, InvalidFlags, Description
or = GateOr(A=make_z_axis_side1_2, B=make_z_axis_side2_2)
multiplication_2 = Multiplication(A=bearing_bolt_diameter, B=hole_size_multiplier_2)

pt = ConstructPoint(XCoordinate=preview_center_x, YCoordinate=preview_center_y, ZCoordinate=preview_bottom_z)
xy = XYPlane(Origin=pt)
preview_center_plane = Plane(xy)

filter = StreamFilter(Gate=null.NullFlags, Stream0=g_code_previewer, Stream1=hello_world_letters)
bearing_bolt_hole_diameter = Panel(multiplication_2)
scale_toolpath_to_work_area = Panel(null.NullFlags)
toolpath_curves_for_preview = Curve(filter)

# ---- group: Make material stack
number_of_layers_beneath_rack_and_rail_l_2 = Panel(number_of_layers_beneath_rack_and_rail_l)  # "Number of layers beneath rack and rail layer"
minium_number_of_layers = Panel("1")
maxiumum_number_of_layers = Panel("2")
gantry_work_area_z = Panel(work_area_z)
main_material_thickness_2 = Panel(thickness)
rail_rack_and_pinion_material_thickness_2 = Panel(thickness_2)
number_of_layers_in_gantry_bed_2 = Panel(number_of_layers_in_gantry_bed)
minium_number_of_layers_2 = Panel("1")
maxiumum_number_of_layers_2 = Panel("3")
make_vacuum_bed_2 = Panel(make_vacuum_bed)
number_of_layers_in_vacuum_bed = Panel("3")
dom = ConstructDomain(DomainStart=minium_number_of_layers, DomainEnd=maxiumum_number_of_layers)
constrain = Constrain(Number=number_of_layers_beneath_rack_and_rail_l_2, Domain=dom)
subtraction = Subtraction(A=main_material_thickness_2, B=rail_rack_and_pinion_material_thickness_2)
dom_2 = ConstructDomain(DomainStart=minium_number_of_layers_2, DomainEnd=maxiumum_number_of_layers_2)
subtraction_2 = Subtraction(A=constrain, B="1")
multiplication_3 = Multiplication(A=subtraction_2, B=main_material_thickness_2)
constrain_2 = Constrain(Number=number_of_layers_in_gantry_bed_2, Domain=dom_2)
z_height_lost_to_rack_bridge = Panel(multiplication_3)
rack_layer_thickness_difference = Panel(subtraction)
z_height = Panel(gantry_work_area_z)
filter_2 = StreamFilter(Gate=make_vacuum_bed_2, Stream0=constrain_2, Stream1=number_of_layers_in_vacuum_bed)
addition = Addition(A=z_height_lost_to_rack_bridge, B=z_height)
addition_2 = Addition(A=addition, B=rack_layer_thickness_difference)
division = Division(A=addition_2, B=main_material_thickness_2)
round = Round(Number=division)  # -> Nearest, Floor, Ceiling
main_material_thickness_3 = Panel(main_material_thickness_2)
subtraction_3 = Subtraction(A=round.Ceiling, B="1")
equals = Equality(FirstNumber=z_height_lost_to_rack_bridge, SecondNumber="0.0")  # -> Equality, Inequality
multiplication_4 = Multiplication(A=subtraction_3, B=main_material_thickness_3)
subtraction_4 = Subtraction(A=multiplication_4, B=rack_layer_thickness_difference)
addition_3 = Addition(A=subtraction_4, B=rail_rack_and_pinion_material_thickness_2)
number_of_layers_beneath_lower_gantry_ra = Panel(subtraction_3)  # "Number of layers beneath lower gantry rack and rail layer"
filter_3 = StreamFilter(Gate=equals.Equality, Stream0=subtraction_4, Stream1=addition_3)
number_of_layers_beneath_rack_and_rail_l_3 = Panel(constrain)  # "Number of layers beneath rack and rail layer"
number_of_layers_in_gantry_bed_3 = Panel(filter_2)
actual_z_axis_lenght = Panel(filter_3)

# ----
bird_bit_lower_knife_lenght = Panel(lower_knife_length)
bird_bit_upper_knife_lenght = Panel(upper_knife_length)
bird_bit_diameter = Panel(diameter)
multiplication_5 = Multiplication(A=bird_bit_diameter, B="0.5")
pt_2 = ConstructPoint(XCoordinate=0, YCoordinate=multiplication_5, ZCoordinate=0)
pt_3 = ConstructPoint(XCoordinate=0, YCoordinate=multiplication_5, ZCoordinate=bird_bit_upper_knife_lenght)
pt_4 = ConstructPoint(XCoordinate=0, YCoordinate=multiplication_5, ZCoordinate=bird_bit_lower_knife_lenght)
yz = YZPlane(Origin=pt_2)
rotate = Rotate(Geometry=pt_3, Angle=degrees("45"), Plane=yz)  # -> Geometry, Transform
rotate_2 = Rotate(Geometry=pt_4, Angle=degrees("135"), Plane=yz)  # -> Geometry, Transform
pdecon = Deconstruct(Point=rotate_2.Geometry)  # -> XComponent, YComponent, ZComponent
Z = UnitZ(Factor="25")
Y = UnitY(Factor="-4")
pt_5 = ConstructPoint(XCoordinate=0, YCoordinate=0, ZCoordinate=0)
pt_6 = ConstructPoint(XCoordinate=0, YCoordinate=0, ZCoordinate=pdecon.ZComponent)
move = Move(Geometry=rotate.Geometry, Motion=Y)  # -> Geometry, Transform
move_2 = Move(Geometry=move.Geometry, Motion=Z)  # -> Geometry, Transform
ln = Line(StartPoint=pt_2, EndPoint=rotate_2.Geometry)
ln_2 = Line(StartPoint=pt_2, EndPoint=rotate.Geometry)
ln_3 = Line(StartPoint=pt_6, EndPoint=pt_5)
ln_4 = Line(StartPoint=rotate_2.Geometry, EndPoint=pt_6)
ln_5 = Line(StartPoint=move.Geometry, EndPoint=rotate.Geometry)
ln_6 = Line(StartPoint=move_2.Geometry, EndPoint=move.Geometry)
join_3 = JoinCurves(Curves=flatten([ln_6, ln_2, ln, ln_4, ln_5]), Preserve=False)
revsrf = Revolution(Curve=join_3, Axis=ln_3, Domain=Domain(0, 6.283185307))
bird_beak_model = Brep(revsrf)
center_point = Point(pt_6)
upper_line = Line(ln_2)
lower_line = Line(ln)

# ---- group: Make rack and pinion pocket depths
material_leftover_beneath_rack_teeth_2 = Panel(material_leftover_beneath_rack_teeth)
rack_and_pinion_tooth_height_2 = Panel(rack_and_pinion_tooth_height)
rail_rack_and_pinion_material_thickness_3 = Panel(thickness_2)
subtraction_5 = Subtraction(A=rail_rack_and_pinion_material_thickness_3, B=material_leftover_beneath_rack_teeth_2)
subtraction_6 = Subtraction(A=subtraction_5, B=rack_and_pinion_tooth_height_2)
rack_pocket_depth = Panel(subtraction_6)
pinion_pocket_depth = Panel(subtraction_5)

# ----
xy_2 = XYPlane(Origin=Point(0, 0, 0))
swatch = ColourSwatch(SwatchColor=RGB(255, 0, 102))
warning_plane = Plane(xy_2)

# ---- group: Check space between pinion and carriage
rack_and_pinion_tooth_overlap_reduction_2 = Panel(rack_and_pinion_tooth_overlap_reduction)  # "Rack and pinion tooth overlap reduction distance"
material_leftover_beneath_rack_teeth_3 = Panel(material_leftover_beneath_rack_teeth)
rail_to_carriage_safety_distance_2 = Panel(rail_to_carriage_safety_distance)
addition_4 = Addition(A=rack_and_pinion_tooth_overlap_reduction_2, B=material_leftover_beneath_rack_teeth_3)
larger = LargerThan(FirstNumber=addition_4, SecondNumber=rail_to_carriage_safety_distance_2)  # -> LargerThan, OrEqualTo
panel_3 = Panel("""WARNING:
Inssuficent space between pinion and carriage""")
filter_4 = StreamFilter(Gate=larger.LargerThan, Stream1=warning_plane)
tag = TextTag3D(Location=filter_4, Text=panel_3, Size="100", Colour=swatch, Justification=7)

# ----
main_material_bit = Panel(diameter_2)

# ---- group: Make rack preview
rack_pocket_depth_2 = Panel(rack_pocket_depth)
rack_teeth = Curve()
neg = Negative(Value=rack_pocket_depth_2)
Z_2 = UnitZ(Factor=neg)
move_3 = Move(Geometry=rack_teeth, Motion=Z_2)  # -> Geometry, Transform
rack_teeth_2 = Curve(move_3.Geometry)

# ----
gantry_work_area_x = Panel(work_area_x)
make_motor_plates_3 = Panel(make_motor_plates_2)
motor_nut_width_flat_side_to_flat_side_3 = Panel(motor_nut_width_flat_side_to_flat_side_2)
motor_plate_bolt_diamter_3 = Panel(motor_plate_bolt_diamter_2)

# ---- group: Make nut pocket
nut_pocket_depth_2 = Panel(nut_pocket_depth)
nut_width_flat_side_to_flat_side_2 = Panel(nut_width_flat_side_to_flat_side)
xy_3 = XYPlane(Origin=Point(0, 0, 0))
polygon = Polygon(Plane=xy_3, Radius=nut_width_flat_side_to_flat_side_2, Segments="3", FilletRadius=0)  # -> Polygon, Length
nut_pocket_depth_3 = Panel(nut_pocket_depth_2)
nut_pocket = Curve(polygon.Polygon)

# ---- group: Make tab boxes for main material cutting
tab_height_2 = Panel(tab_height)
main_material_bit_2 = Panel(diameter_2)
tab_width_2 = Panel(tab_width)
xy_4 = XYPlane(Origin=Point(0, 0, 0))
multiplication_6 = Multiplication(A=tab_width_2, B="0.5")
box = CenterBox(Base=xy_4, X=main_material_bit_2, Y=multiplication_6, Z=tab_height_2)
tab_box = Brep(box)

# ----
rotate_3 = Rotate(Geometry=nut_pocket, Angle=1.570796327, Plane=xy_3)  # -> Geometry, Transform
offset = Offset(Curve=rotate_3.Geometry, Distance="0.5", Plane=PlaneXY(0, 0, 0), Corners=1)
nut_pocket_for_mid_layer = Curve(rotate_3.Geometry)
nut_hole_for_top_layer = Curve(offset)

toolpath_curves_for_preview_2 = Curve(toolpath_curves_for_preview)
scale_toolpath_to_work_area_2 = Panel(scale_toolpath_to_work_area)
gate = StreamGate(Stream=toolpath_curves_for_preview_2, Gate=scale_toolpath_to_work_area_2)  # -> Target0, Target1
rotate_4 = Rotate(Geometry=gate.Target1, Angle=1.570796327, Plane=PlaneXY(0, 0, 0))  # -> Geometry, Transform
current_machine_to_make = Panel(list)
toolpath_curves_for_preview_3 = Curve(rotate_4.Geometry)
gate_2 = StreamGate(Stream=toolpath_curves_for_preview_3, Gate=current_machine_to_make)  # -> Target0, Target1, Target2

# ---- group: Scale hello world text delta work area
toolpath_curves_for_preview_4 = Curve(gate_2.Target2)
delta_work_area_diameter = Panel(work_area_diameter)
bbox = BoundingBox(Content=toolpath_curves_for_preview_4, Plane=PlaneXY(0, 0, 0), UnionBox=True)  # -> Box, Box_2
debrep = DeconstructBrep(Brep=bbox.Box)  # -> Faces, Edges, Vertices
item_5 = ListItem(List=debrep.Vertices, Index=0, Wrap=True)  # -> Item, Item1, Item2
circle = Circle3Pt(PointA=item_5.Item, PointB=item_5.Item1, PointC=item_5.Item2)  # -> Circle, Plane, Radius
xy_5 = XYPlane(Origin=circle.Plane)
multiplication_7 = Multiplication(A=delta_work_area_diameter, B="0.5")
cir = Circle(Plane=xy_5, Radius=multiplication_7)
len = Length(Curve=cir)
len_2 = Length(Curve=circle.Circle)
toolpath_curves_for_preview_5 = Curve(toolpath_curves_for_preview_4)
division_2 = Division(A=len, B=len_2)
scale = Scale(Geometry=toolpath_curves_for_preview_5, Center=circle.Plane, Factor=division_2)  # -> Geometry, Transform
toolpath_center_plane = Plane(xy_5)
scaled_toolpaths = Curve(scale.Geometry)

# ---- group: Scale hello world text to linnear axis lenght
toolpath_curves_for_preview_6 = Curve(gate_2.Target0)
single_axis_length = Panel(axis_length)
bbox_2 = BoundingBox(Content=toolpath_curves_for_preview_6, Plane=PlaneXY(0, 0, 0), UnionBox=True)  # -> Box, Box_2
dim = Dimensions(Surface=bbox_2.Box)  # -> UDimension, VDimension
area = Area(Geometry=bbox_2.Box)  # -> Area, Centroid
multiplication_8 = Multiplication(A=dim.UDimension, B="1")
division_3 = Division(A=single_axis_length, B=dim.VDimension)
neg_2 = Negative(Value=multiplication_8)
X = UnitX(Factor=neg_2)
move_4 = Move(Geometry=area.Centroid, Motion=X)  # -> Geometry, Transform
xy_6 = XYPlane(Origin=move_4.Geometry)
scale_2 = Scale(Geometry=toolpath_curves_for_preview_6, Center=move_4.Geometry, Factor=division_3)  # -> Geometry, Transform
toolpath_edge_plane = Plane(xy_6)
scaled_toolpaths_2 = Curve(scale_2.Geometry)

# ---- group: Scale hello world text to gantry bed
gantry_work_area_x_2 = Panel(work_area_x)
gantry_work_area_y = Panel(work_area_y)
toolpath_curves_for_preview_7 = Curve(gate_2.Target1)
bbox_3 = BoundingBox(Content=toolpath_curves_for_preview_7, Plane=PlaneXY(0, 0, 0), UnionBox=True)  # -> Box, Box_2
dim_2 = Dimensions(Surface=bbox_3.Box)  # -> UDimension, VDimension
area_2 = Area(Geometry=bbox_3.Box)  # -> Area, Centroid
division_4 = Division(A=gantry_work_area_x_2, B=dim_2.VDimension)
division_5 = Division(A=gantry_work_area_y, B=dim_2.UDimension)
sort = SortList(Keys=[division_4, division_5])  # -> Keys, ValuesA
item_6 = ListItem(List=sort.Keys, Index=0, Wrap=True)
xy_7 = XYPlane(Origin=area_2.Centroid)
scale_3 = Scale(Geometry=toolpath_curves_for_preview_7, Center=area_2.Centroid, Factor=item_6)  # -> Geometry, Transform
toolpath_center_plane_2 = Plane(xy_7)
scaled_toolpaths_3 = Curve(scale_3.Geometry)

# ----
current_part_number_to_make = Panel(list_5)
part_position_shift_y_2 = Panel(part_position_shift_y)
part_position_shift_x_2 = Panel(part_position_shift_x)
current_fabrication_step = Panel(list_4)
part_position_shift_x_3 = Panel(part_position_shift_x)
part_position_shift_y_3 = Panel(part_position_shift_y)
space_between_parts_2 = Panel(space_between_parts)
dust_skirt_diameter_2 = Panel(dust_skirt_diameter)
pt_7 = ConstructPoint(XCoordinate=part_position_shift_x_2, YCoordinate=part_position_shift_y_2, ZCoordinate=0)
current_machine_to_make_2 = Panel(list)
gantry_work_area_z_2 = Panel(work_area_z)
delta_work_area_z = Panel(work_area_z_2)
xy_8 = XYPlane(Origin=pt_7)
rotate_5 = Rotate(Geometry=xy_8, Angle=1.570796327, Plane=xy_8)  # -> Geometry, Transform
cut_position_plane = Plane(xy_8)
current_fabrication_step_2 = Panel(list_4)
pre_fabricate_main_parts_id = Panel("4")
precut_lower_layer_id = Panel("2")
current_part_number_to_make_2 = Panel(list_5)
current_fabrication_step_3 = Panel(list_4)
pre_fabricate_main_parts_id_2 = Panel("4")
precut_mid_layer_id = Panel("1")
current_part_number_to_make_3 = Panel(list_5)
current_fabrication_step_4 = Panel(list_4)
pre_fabricate_rails_pinion_and_bearings = Panel("1")  # "Pre fabricate rails, pinion and bearings ID"
current_part_number_to_make_4 = Panel(list_5)
precut_top_axis_layer_id = Panel("1")
filter_5 = StreamFilter(
    Gate=current_machine_to_make_2,
    Stream0=toolpath_edge_plane,
    Stream1=toolpath_center_plane_2,
    Stream2=toolpath_center_plane)
filter_6 = StreamFilter(Gate=current_machine_to_make_2, Stream0=scaled_toolpaths_2, Stream1=scaled_toolpaths_3, Stream2=scaled_toolpaths)
filter_7 = StreamFilter(Gate=current_machine_to_make_2, Stream0="0", Stream1=gantry_work_area_z_2, Stream2=delta_work_area_z)
current_fabrication_step_5 = Panel(list_4)
pre_fabricate_main_parts_id_3 = Panel("4")
precut_carriage_id = Panel("3")
current_part_number_to_make_5 = Panel(list_5)
current_fabrication_step_6 = Panel(list_4)
pre_fabricate_main_parts_id_4 = Panel("4")
precutlower_lower_bed_layer_id = Panel("9")
current_part_number_to_make_6 = Panel(list_5)
current_fabrication_step_7 = Panel(list_4)
pre_fabricate_main_parts_id_5 = Panel("4")
current_part_number_to_make_7 = Panel(list_5)
precut_z_wall_id = Panel("4")
current_fabrication_step_8 = Panel(list_4)
pre_fabricate_rails_pinion_and_bearings_2 = Panel("1")  # "Pre fabricate rails, pinion and bearings ID"
precut_lower_right_axis_rail_id = Panel("3")
current_part_number_to_make_8 = Panel(list_5)
current_fabrication_step_9 = Panel(list_4)
pre_fabricate_main_parts_id_6 = Panel("4")
current_part_number_to_make_9 = Panel(list_5)
precut_z_support_wall_id = Panel("5")
current_fabrication_step_10 = Panel(list_4)
pre_fabricate_rails_pinion_and_bearings_3 = Panel("1")  # "Pre fabricate rails, pinion and bearings ID"
precut_slides_id = Panel("4")
current_part_number_to_make_10 = Panel(list_5)
current_fabrication_step_11 = Panel(list_4)
pre_fabricate_rails_pinion_and_bearings_4 = Panel("1")  # "Pre fabricate rails, pinion and bearings ID"
current_part_number_to_make_11 = Panel(list_5)
precut_lower_left_axis_rail_id = Panel("2")
current_fabrication_step_12 = Panel(list_4)
pre_fabricate_main_parts_id_7 = Panel("4")
precutlower_gantry_rails_id = Panel("6")
current_part_number_to_make_12 = Panel(list_5)
toolpath_center_plane_3 = Plane(filter_5)
z_heigth = Panel(filter_7)
toolpaths = Curve(filter_6)
equals_2 = Equality(FirstNumber=current_fabrication_step_2, SecondNumber=pre_fabricate_main_parts_id)  # -> Equality, Inequality
equals_3 = Equality(FirstNumber=current_part_number_to_make_2, SecondNumber=precut_lower_layer_id)  # -> Equality, Inequality
equals_4 = Equality(FirstNumber=current_fabrication_step_3, SecondNumber=pre_fabricate_main_parts_id_2)  # -> Equality, Inequality
equals_5 = Equality(FirstNumber=current_part_number_to_make_3, SecondNumber=precut_mid_layer_id)  # -> Equality, Inequality
equals_6 = Equality(FirstNumber=current_fabrication_step_4, SecondNumber=pre_fabricate_rails_pinion_and_bearings)  # -> Equality, Inequality
equals_7 = Equality(FirstNumber=current_part_number_to_make_4, SecondNumber=precut_top_axis_layer_id)  # -> Equality, Inequality
equals_8 = Equality(FirstNumber=current_fabrication_step_5, SecondNumber=pre_fabricate_main_parts_id_3)  # -> Equality, Inequality
equals_9 = Equality(FirstNumber=current_part_number_to_make_5, SecondNumber=precut_carriage_id)  # -> Equality, Inequality
equals_10 = Equality(FirstNumber=current_fabrication_step_6, SecondNumber=pre_fabricate_main_parts_id_4)  # -> Equality, Inequality
equals_11 = Equality(FirstNumber=current_part_number_to_make_6, SecondNumber=precutlower_lower_bed_layer_id)  # -> Equality, Inequality
equals_12 = Equality(FirstNumber=current_fabrication_step_7, SecondNumber=pre_fabricate_main_parts_id_5)  # -> Equality, Inequality
equals_13 = Equality(FirstNumber=current_part_number_to_make_7, SecondNumber=precut_z_wall_id)  # -> Equality, Inequality
equals_14 = Equality(FirstNumber=current_fabrication_step_8, SecondNumber=pre_fabricate_rails_pinion_and_bearings_2)  # -> Equality, Inequality
equals_15 = Equality(FirstNumber=current_part_number_to_make_8, SecondNumber=precut_lower_right_axis_rail_id)  # -> Equality, Inequality
equals_16 = Equality(FirstNumber=current_fabrication_step_9, SecondNumber=pre_fabricate_main_parts_id_6)  # -> Equality, Inequality
equals_17 = Equality(FirstNumber=current_part_number_to_make_9, SecondNumber=precut_z_support_wall_id)  # -> Equality, Inequality
equals_18 = Equality(FirstNumber=current_fabrication_step_10, SecondNumber=pre_fabricate_rails_pinion_and_bearings_3)  # -> Equality, Inequality
equals_19 = Equality(FirstNumber=current_part_number_to_make_10, SecondNumber=precut_slides_id)  # -> Equality, Inequality
equals_20 = Equality(FirstNumber=current_fabrication_step_11, SecondNumber=pre_fabricate_rails_pinion_and_bearings_4)  # -> Equality, Inequality
equals_21 = Equality(FirstNumber=current_part_number_to_make_11, SecondNumber=precut_lower_left_axis_rail_id)  # -> Equality, Inequality
equals_22 = Equality(FirstNumber=current_fabrication_step_12, SecondNumber=pre_fabricate_main_parts_id_7)  # -> Equality, Inequality
equals_23 = Equality(FirstNumber=current_part_number_to_make_12, SecondNumber=precutlower_gantry_rails_id)  # -> Equality, Inequality
and = GateAnd(A=equals_2.Equality, B=equals_3.Equality)
and_2 = GateAnd(A=equals_4.Equality, B=equals_5.Equality)
current_fabrication_step_13 = Panel(list_4)
bird_beak_cutting_id = Panel("6")
current_part_number_to_make_13 = Panel(list_5)
cut_bed_assembly_v_rail_id = Panel("3")
cut_registraion_geometry_id = Panel("5")
and_3 = GateAnd(A=equals_6.Equality, B=equals_7.Equality)
cut_slide_jig_id = Panel("1")
current_part_number_to_make_14 = Panel(list_5)
cut_bridge_assembly_v_rail_id = Panel("2")
cut_slide_v_rail_id = Panel("1")
current_fabrication_step_14 = Panel(list_4)
bird_beak_cutting_id_2 = Panel("6")
current_part_number_to_make_15 = Panel(list_5)
current_fabrication_step_15 = Panel(list_4)
bird_beak_cutting_id_3 = Panel("6")
current_part_number_to_make_16 = Panel(list_5)
cut_registraion_geometry_id_2 = Panel("5")
current_fabrication_step_16 = Panel(list_4)
and_4 = GateAnd(A=equals_8.Equality, B=equals_9.Equality)
and_5 = GateAnd(A=equals_10.Equality, B=equals_11.Equality)
cut_registraion_geometry_id_3 = Panel("5")
and_6 = GateAnd(A=equals_12.Equality, B=equals_13.Equality)
cut_bed_registration_holes_id = Panel("3")
and_7 = GateAnd(A=equals_14.Equality, B=equals_15.Equality)
current_fabrication_step_17 = Panel(list_4)
current_part_number_to_make_17 = Panel(list_5)
and_8 = GateAnd(A=equals_16.Equality, B=equals_17.Equality)
cut_bridge_registration_holes_id = Panel("2")
and_9 = GateAnd(A=equals_18.Equality, B=equals_19.Equality)
current_fabrication_step_18 = Panel(list_4)
current_part_number_to_make_18 = Panel(list_5)
and_10 = GateAnd(A=equals_20.Equality, B=equals_21.Equality)
precut = Panel(and)
and_11 = GateAnd(A=equals_22.Equality, B=equals_23.Equality)
precut_2 = Panel(and_2)
precut_top_axis_layer = Panel(and_3)
precut_3 = Panel(and_4)
precut_4 = Panel(and_5)
precut_5 = Panel(and_6)
precut_lower_right_axis = Panel(and_7)
precut_6 = Panel(and_8)
precut_slides = Panel(and_9)
precut_lower_left_axis = Panel(and_10)
precut_7 = Panel(and_11)
cut_bed_rack_id = Panel("2")
current_fabrication_step_19 = Panel(list_4)
rack_geometey_cutting_id = Panel("7")
current_part_number_to_make_19 = Panel(list_5)
cut_bridge_rack_id = Panel("1")
current_fabrication_step_20 = Panel(list_4)
rack_geometey_cutting_id_2 = Panel("7")
current_part_number_to_make_20 = Panel(list_5)
equals_24 = Equality(FirstNumber=current_fabrication_step_13, SecondNumber=bird_beak_cutting_id)  # -> Equality, Inequality
equals_25 = Equality(FirstNumber=current_part_number_to_make_13, SecondNumber=cut_bed_assembly_v_rail_id)  # -> Equality, Inequality
equals_26 = Equality(FirstNumber=current_fabrication_step_14, SecondNumber=bird_beak_cutting_id_2)  # -> Equality, Inequality
equals_27 = Equality(FirstNumber=current_fabrication_step_15, SecondNumber=bird_beak_cutting_id_3)  # -> Equality, Inequality
equals_28 = Equality(FirstNumber=current_part_number_to_make_15, SecondNumber=cut_bridge_assembly_v_rail_id)  # -> Equality, Inequality
equals_29 = Equality(FirstNumber=current_part_number_to_make_16, SecondNumber=cut_slide_v_rail_id)  # -> Equality, Inequality
equals_30 = Equality(FirstNumber=current_part_number_to_make_14, SecondNumber=cut_slide_jig_id)  # -> Equality, Inequality
equals_31 = Equality(FirstNumber=current_fabrication_step_16, SecondNumber=cut_registraion_geometry_id)  # -> Equality, Inequality
equals_32 = Equality(FirstNumber=current_fabrication_step_17, SecondNumber=cut_registraion_geometry_id_2)  # -> Equality, Inequality
equals_33 = Equality(FirstNumber=current_part_number_to_make_17, SecondNumber=cut_bed_registration_holes_id)  # -> Equality, Inequality
equals_34 = Equality(FirstNumber=current_fabrication_step_18, SecondNumber=cut_registraion_geometry_id_3)  # -> Equality, Inequality
equals_35 = Equality(FirstNumber=current_part_number_to_make_18, SecondNumber=cut_bridge_registration_holes_id)  # -> Equality, Inequality

# ---- group: Make flea jump transition
flea_weave_heigth = Panel(z_heigth)
amplitude_factor = Slider(0.018, range=0..0.2)
toolpaths_for_flea_weave = Curve(toolpaths)
end = EndPoints(Curve=toolpaths_for_flea_weave)  # -> Start, End
shift = ShiftList(List=end.End, Shift=-1, Wrap=False)
shift_2 = ShiftList(List=end.Start, Shift=1, Wrap=False)
multiplication_9 = Multiplication(A=flea_weave_heigth, B=amplitude_factor)
ln_7 = Line(StartPoint=shift, EndPoint=shift_2)
Z_3 = UnitZ(Factor=flea_weave_heigth)
eval = EvaluateLength(Curve=ln_7, Length="1", Normalized=True)  # -> Point, Tangent, Parameter
eval_2 = EvaluateLength(Curve=ln_7, Length="0.5", Normalized=True)  # -> Point, Tangent, Parameter
eval_3 = EvaluateLength(Curve=ln_7, Length="0", Normalized=True)  # -> Point, Tangent, Parameter
move_5 = Move(Geometry=eval_2.Point, Motion=Z_3)  # -> Geometry, Transform
neg_3 = Negative(Value=multiplication_9)
Z_4 = UnitZ(Factor=multiplication_9)
merge_4 = Merge(Data1=graft(eval_3.Point), Data2=graft(move_5.Geometry), Data3=graft(eval.Point))
Z_5 = UnitZ(Factor=neg_3)
intcrv_t = InterpolateT(Vertices=merge_4, Degree=3, TangentStart=Z_4, TangentEnd=Z_5, KnotStyle=1)  # -> Curve, Length, Domain
pshift = ShiftPaths(Data=intcrv_t.Curve, Offset=-1)
toolpaths_for_flea_weave_2 = Curve(toolpaths_for_flea_weave)
flea_transitions = Curve(pshift)
weave = Weave(Pattern=[0, 1], Stream0=toolpaths_for_flea_weave_2, Stream1=flea_transitions, NullGaps=False)
toolpaths_with_flea_transitions = Curve(weave)

# ----
and_12 = GateAnd(A=equals_24.Equality, B=equals_25.Equality)
and_13 = GateAnd(A=equals_26.Equality, B=equals_28.Equality)
and_14 = GateAnd(A=equals_27.Equality, B=equals_29.Equality)
and_15 = GateAnd(A=equals_31.Equality, B=equals_30.Equality)
and_16 = GateAnd(A=equals_32.Equality, B=equals_33.Equality)
and_17 = GateAnd(A=equals_34.Equality, B=equals_35.Equality)
equals_36 = Equality(FirstNumber=current_fabrication_step_19, SecondNumber=rack_geometey_cutting_id)  # -> Equality, Inequality
equals_37 = Equality(FirstNumber=current_fabrication_step_20, SecondNumber=rack_geometey_cutting_id_2)  # -> Equality, Inequality
equals_38 = Equality(FirstNumber=current_part_number_to_make_19, SecondNumber=cut_bed_rack_id)  # -> Equality, Inequality
equals_39 = Equality(FirstNumber=current_part_number_to_make_20, SecondNumber=cut_bridge_rack_id)  # -> Equality, Inequality
cut = Panel(and_15)
cut_2 = Panel(and_12)
cut_3 = Panel(and_13)
cut_4 = Panel(and_14)
cut_5 = Panel(and_16)
cut_6 = Panel(and_17)
and_18 = GateAnd(A=equals_36.Equality, B=equals_38.Equality)
and_19 = GateAnd(A=equals_37.Equality, B=equals_39.Equality)
cut_7 = Panel(and_18)
cut_8 = Panel(and_19)
main_material_and_rack_diameter = Panel(diameter_2)
pocket_stepover = Panel("0.8")
nut_pocket_depth_4 = Panel(nut_pocket_depth_3)
drill = Drill()  # -> drill_toolpaths_3, drill_preview_geometry_3
xy_9 = XYPlane(Origin=Point(0, 0, 0))
filter_8 = StreamFilter(Gate=scale_toolpath_to_work_area_2, Stream0=toolpath_curves_for_preview_2, Stream1=toolpaths_with_flea_transitions)
filter_9 = StreamFilter(Gate=scale_toolpath_to_work_area_2, Stream0=xy_9, Stream1=toolpath_center_plane_3)

preview_center_plane_2 = Plane(preview_center_plane)
toolpath_center_plane_4 = Plane(filter_9)
toolpaths_2 = Curve(filter_8)
orient = Orient(Geometry=toolpaths_2, Source=toolpath_center_plane_4, Target=preview_center_plane_2)  # -> Geometry, Transform
oriented_toolpaths = Curve(orient.Geometry)

# ---- group: Make preview from toolapth curves
job_simulation_position_2 = Panel(job_simulation_position)
current_fabrication_step_21 = Panel(list_4)
toolpath_curves_for_preview_8 = Curve(oriented_toolpaths)
dom_3 = ConstructDomain(DomainStart="0", DomainEnd="1")
larger_2 = LargerThan(FirstNumber=current_fabrication_step_21, SecondNumber="0")  # -> LargerThan, OrEqualTo
flatten = FlattenTree(Tree=toolpath_curves_for_preview_8, Path="{0}")
constrain_3 = Constrain(Number=job_simulation_position_2, Domain=dom_3)
currently_fabricating_parts_disable_prev = Panel(larger_2.LargerThan)  # "Currently fabricating parts, disable preview"
len_3 = Length(Curve=flatten)
ma = MassAddition(Input=len_3)  # -> Result, PartialResults
job_simulation_position_3 = Panel(constrain_3)
total_toolpath_length = Panel(ma.Result)
multiplication_10 = Multiplication(A=total_toolpath_length, B=job_simulation_position_3)
current_length = Panel(multiplication_10)
partial_lenghts = Panel(ma.PartialResults)
larger_3 = LargerThan(FirstNumber=current_length, SecondNumber=partial_lenghts)  # -> LargerThan, OrEqualTo
ma_2 = MassAddition(Input=larger_3.LargerThan)  # -> Result, PartialResults
subtraction_7 = Subtraction(A=ma_2.Result, B="1")
current_curve_index = Panel(ma_2.Result)
toolpath_curves_for_preview_9 = Curve(flatten)
previous_curve_index = Panel(subtraction_7)
item_7 = ListItem(List=partial_lenghts, Index=previous_curve_index, Wrap=False)
nullrep = ReplaceNulls(Items=item_7, Replacements="0")  # -> Items, Count
cull_i = CullIndex(List=toolpath_curves_for_preview_9, Indices=current_curve_index, Wrap=True)
item_8 = ListItem(List=toolpath_curves_for_preview_9, Index=current_curve_index, Wrap=False)
current_length_2 = Panel(multiplication_10)
previously_covered_length = Panel(nullrep.Items)
current_curve = Curve(item_8)
split = SplitList(List=cull_i, Index=current_curve_index)  # -> ListA, ListB
subtraction_8 = Subtraction(A=current_length_2, B=previously_covered_length)
length_to_evaluate_current_curve = Panel(subtraction_8)
addition_5 = Addition(A=length_to_evaluate_current_curve, B="0.001")
eval_4 = EvaluateLength(Curve=current_curve, Length=addition_5, Normalized=Toggle(False))  # -> Point, Tangent, Parameter
merge_5 = Merge(Data1="0", Data2=eval_4.Parameter)
shatter = Shatter(Curve=current_curve, Parameters=merge_5)
item_9 = ListItem(List=shatter, Index=0, Wrap=True)  # -> Item, Item1
uncut_curves = Curve(split.ListB)
uncut_part = Curve(item_9.Item1)
cut_curves = Curve(split.ListA)
cut_part = Curve(item_9.Item)
currently_fabricating_parts_disable_prev_2 = Panel(currently_fabricating_parts_disable_prev)  # "Currently fabricating parts, disable preview"
merge_6 = Merge(Data1=flatten(cut_curves), Data2=flatten(cut_part))
merge_7 = Merge(Data1=flatten(uncut_part), Data2=flatten(uncut_curves))
current_position_point = Point(eval_4.Point)
uncut_curves_2 = Curve(merge_7)
cut_curves_2 = Curve(merge_6)
filter_10 = StreamFilter(Gate=currently_fabricating_parts_disable_prev_2, Stream0=cut_curves_2)
filter_11 = StreamFilter(Gate=currently_fabricating_parts_disable_prev_2, Stream0=uncut_curves_2)
filter_12 = StreamFilter(Gate=currently_fabricating_parts_disable_prev_2, Stream0=current_position_point)
current_position_point_2 = Point(eval_4.Point)
uncut_curves_3 = Curve(merge_7)
cut_curves_3 = Curve(merge_6)
preview_2 = CustomPreview(Geometry=filter_10, Shader=ColourSwatch(SwatchColor=RGB(89, 247, 255)))
preview_3 = CustomPreview(Geometry=filter_11, Shader=ColourSwatch(SwatchColor=RGB(109, 119, 120)))
dots = DotDisplay(Point=filter_12, Colour=ColourSwatch(SwatchColor=RGB(255, 0, 166)), Size=1)

# ----
bird_beak_hack_diameter = Panel("10")

# ---- group: Map bit diamter ID
# Bit diamter ID ref: 2mm  = 0
# 3mm  = 1
# 4mm  = 2
# 6mm  = 3
# 10mm = 4
pinion_teeth_cut_diamter = Panel(diameter_4)
main_material_and_rack_diamter = Panel(diameter_2)
pinion_axis_inside_diamter = Panel(diameter_3)
rack_cut_diameter = Panel(diameter_5)
gantry_bed_surfacing_diamter = Panel(diameter_6)
# Developed by Jens Dyvik / Fellesverkstedet
# 
# License: Creative Commons Attribution ShareAllike (cc-by-sa)
vacuum_bed_hole_drill = Panel(diameter_7)
current_fabrication_step_22 = Panel(list_4)
filter_13 = StreamFilter(
    Gate=current_fabrication_step_22,
    Stream1=main_material_and_rack_diamter,
    Stream2=pinion_axis_inside_diamter,
    Stream3=pinion_teeth_cut_diamter,
    Stream4=main_material_and_rack_diamter,
    Stream5=main_material_and_rack_diamter,
    Stream6=bird_beak_hack_diameter,
    Stream7=rack_cut_diameter,
    Stream8=gantry_bed_surfacing_diamter,
    Stream9=vacuum_bed_hole_drill)
current_bit_diamter = Panel(filter_13)
bit_diamter_options = Panel("""2
3
4
6
10""")
fsim = FindSimilarMember(Data=current_bit_diamter, Set=bit_diamter_options)  # -> Hit, Index
bit_diamter_id = Panel(fsim.Index)

# ---- group: Map material ID
# Current fabrication step ref: View machine parts                         = 0
# Pre fabricate rails, pinion and bearings   = 1
# Cut pinion axis hole                       = 2
# Cut pinion teeth                           = 3
# Pre fabricate main frame parts             = 4
# Cut registration geometry for the assembly = 5
# Cut v-rail geometry                        = 6
# Cut rack geometry                          = 7
# Flatten gantry bed                         = 8
# Drill vacuum holes                         = 9
# Document this machine                      = 10
# Material ID ref: Foam / wax        = 0
# Soft wood         = 1
# Hard wood         = 2
# Plastic           = 3
# Aluminium / brass = 4
current_main_construction_material = Panel(list_9)
current_rack_rail_and_pinion_material = Panel(list_10)
current_fabrication_step_23 = Panel(list_4)
main_or_rack_filter_id = Panel("""no milling
1
1
1
0
0
0
1
0
0
no milling""")
item_10 = ListItem(List=main_or_rack_filter_id, Index=current_fabrication_step_23, Wrap=True)
filter_14 = StreamFilter(Gate=item_10, Stream0=current_main_construction_material, Stream1=current_rack_rail_and_pinion_material)
current_material_id = Panel(filter_14)

# ---- group: Bit type
value_list = ValueList({"Up-cut": 0, "Down-cut": 1, "Ball nose": 2, "V-bit": 3}, selected="Up-cut")

# ----
feed_rate_calculator = FeedRateCalculator(material_id=current_material_id, bit_diameter_id=bit_diamter_id, bit_type_id=value_list)  # -> feed_rate_4, plunge_rate_4, pass_depth_4, ramp_plunges_4, ramp_angle_4
pass_depth_from_easy_interface = Panel(feed_rate_calculator.pass_depth_4)

# ---- group: Make sure there is no ramp when bird bit or rack milling
current_fabrication_step_24 = Panel(list_4)
bird_beak_cutting_id_4 = Panel("6")
current_fabrication_step_25 = Panel(list_4)
rack_geometey_cutting_id_3 = Panel("7")
ramp_plunges_from_auto_interface = Panel(feed_rate_calculator.ramp_plunges_4)
equals_40 = Equality(FirstNumber=current_fabrication_step_24, SecondNumber=bird_beak_cutting_id_4)  # -> Equality, Inequality
equals_41 = Equality(FirstNumber=current_fabrication_step_25, SecondNumber=rack_geometey_cutting_id_3)  # -> Equality, Inequality
or_2 = GateOr(A=equals_40.Equality, B=equals_41.Equality)
filter_15 = StreamFilter(Gate=or_2, Stream0=ramp_plunges_from_auto_interface, Stream1=Toggle(False))

# ----
ramp_angle_from_auto_interface = Panel(feed_rate_calculator.ramp_angle_4)

plunge_rate = Slider(15, range=6..80)
use_auto_settings = BooleanToggle(True)

feed_rate = Slider(15, range=6..150)
use_auto_settings_2 = BooleanToggle(True)

bit_diameter_from_interface_input = Panel(current_bit_diamter)

ramp_angle = Slider(60, range=0..100)
use_auto_settings_3 = BooleanToggle(True)

plunge_rate_from_easy_interface = Panel(feed_rate_calculator.plunge_rate_4)
feed_rate_from_easy_interface = Panel(feed_rate_calculator.feed_rate_4)

use_auto_settings_4 = BooleanToggle(True)
ramp_plunges = BooleanToggle(False)

deviation_tolerance = Slider(0.01, range=0.01..0.1)
custom_jog_home_x = Slider(1200, range=0..2440)
custom_jog_home_y = Slider(0, range=0..1000)
spindle_speed = Slider(18000, range=6000..18000)
spindle_speed_2 = Slider(12000, range=6000..18000)
use_custom_jog_home = BooleanToggle(True)
safe_z = Slider(10, range=0..20)
use_spindle = BooleanToggle(True)
filter_16 = StreamFilter(Gate=use_auto_settings_4, Stream0=ramp_plunges, Stream1=filter_15)
filter_17 = StreamFilter(Gate=use_auto_settings_2, Stream0=feed_rate, Stream1=feed_rate_from_easy_interface)
filter_18 = StreamFilter(Gate=use_auto_settings, Stream0=plunge_rate, Stream1=plunge_rate_from_easy_interface)
filter_19 = StreamFilter(Gate=use_auto_settings_3, Stream0=ramp_angle, Stream1=ramp_angle_from_auto_interface)

# ---- group: ShopBot PostProcessor settings
# PP
safe_z_height = Panel(safe_z)
job_name = Panel("Machine builder - Bark beetle stream")
use_spindle_2 = Panel(use_spindle)
spindle_speed_all_cutting = Panel(spindle_speed)
use_custom_jog_home_2 = Panel(use_custom_jog_home)
custom_jog_home_x_2 = Panel(custom_jog_home_x)
custom_jog_home_y_2 = Panel(custom_jog_home_y)
deviation_tolerance_2 = Panel(deviation_tolerance)
spindle_speed_bird_bit_cutting = Panel(spindle_speed_2)

# ---- group: Override auto settings
feed_rate_2 = Panel(filter_17)
plunge_rate_2 = Panel(filter_18)
milling_bit_diameter = Panel(bit_diameter_from_interface_input)
ramp_plunges_2 = Panel(filter_16)
ramp_angle_2 = Panel(filter_19)

# ----
hold_down_toolpaths = Curve()
current_cutting_to_do = Panel(list_6)

# ---- group: Make lower RPM when bird bit cutting
bird_beak_cutting_id_5 = Panel("6")
current_fabrication_step_26 = Panel(list_4)
equals_42 = Equality(FirstNumber=current_fabrication_step_26, SecondNumber=bird_beak_cutting_id_5)  # -> Equality, Inequality
filter_20 = StreamFilter(Gate=equals_42.Equality, Stream0=spindle_speed_all_cutting, Stream1=spindle_speed_bird_bit_cutting)

# ---- group: Make simulation axis movement values
current_position_point_3 = Point(current_position_point_2)
preview_center_plane_3 = Plane(preview_center_plane)
z_heigth_2 = Panel(z_heigth)
single_axis_length_2 = Panel(axis_length)
gantry_work_area_x_3 = Panel(work_area_x)
gantry_work_area_y_2 = Panel(work_area_y)
pdecon_2 = Deconstruct(Point=current_position_point_3)  # -> XComponent, YComponent, ZComponent
pdecon_3 = Deconstruct(Point=preview_center_plane_3)  # -> XComponent, YComponent, ZComponent
subtraction_9 = Subtraction(A=pdecon_2.XComponent, B=pdecon_3.XComponent)
subtraction_10 = Subtraction(A=pdecon_2.YComponent, B=pdecon_3.YComponent)
subtraction_11 = Subtraction(A=pdecon_2.ZComponent, B=pdecon_3.ZComponent)
multiplication_11 = Multiplication(A=single_axis_length_2, B="0.5")
multiplication_12 = Multiplication(A=gantry_work_area_x_3, B="0.5")
multiplication_13 = Multiplication(A=gantry_work_area_y_2, B="0.5")
subtraction_12 = Subtraction(A=subtraction_11, B=z_heigth_2)
X_2 = Panel(subtraction_9)
Y_2 = Panel(subtraction_10)
Z_6 = Panel(subtraction_12)
addition_6 = Addition(A=Y_2, B=multiplication_12)
addition_7 = Addition(A=X_2, B=multiplication_13)
addition_8 = Addition(A=Y_2, B=multiplication_11)
single_axis_simulation_x = Panel(addition_8)
gantry_simulation_x = Panel(addition_6)
gantry_simulation_y = Panel(addition_7)
gantry_simulation_z = Panel(Z_6)

# ----
cnc_drill_curves = Curve()
drill_2 = Drill(drill_curves=cnc_drill_curves)  # -> drill_toolpaths_3, drill_preview_geometry_3

subtraction_13 = Subtraction(A=gantry_work_area_x_3, B=addition_6)
subtraction_14 = Subtraction(A=gantry_work_area_y_2, B=addition_7)
surface_3d_roughing_toolpaths = Curve()
surface_3d_finishing_toolpaths = Curve()
measured_projected_size = Slider(263, range=0..1000)

# ---- group: Make preview materials
current_view_mode = Panel(list_2)
current_fabrication_step_27 = Panel(list_4)
wire_frame_identifier = Panel("1")
material = CreateMaterial(
    Diffuse=ColourSwatch(SwatchColor=RGB(0, 0, 0)),
    Specular=RGB(255, 255, 255),
    Emission=RGB(0, 0, 0),
    Transparency=0,
    Shine=0)
material_2 = CreateMaterial(
    Diffuse=ColourSwatch(SwatchColor=RGB(255, 255, 255)),
    Specular=RGB(255, 255, 255),
    Emission=RGB(0, 0, 0),
    Transparency=0,
    Shine=0)
larger_4 = LargerThan(FirstNumber=current_fabrication_step_27, SecondNumber="0")  # -> LargerThan, OrEqualTo
material_3 = CreateMaterial(
    Diffuse=ColourSwatch(SwatchColor=RGB(102, 102, 102)),
    Specular=RGB(255, 255, 255),
    Emission=RGB(0, 0, 0),
    Transparency=Slider(0.9, range=0..1),
    Shine=0)
equals_43 = Equality(FirstNumber=current_view_mode, SecondNumber=wire_frame_identifier)  # -> Equality, Inequality
material_4 = CreateMaterial(
    Diffuse=ColourSwatch(SwatchColor=RGB(58, 73, 74)),
    Specular=RGB(255, 255, 255),
    Emission=ColourSwatch(SwatchColor=RGB(92, 92, 92)),
    Transparency=0,
    Shine=Slider(6, range=0..100))
material_5 = CreateMaterial(
    Diffuse=ColourSwatch(SwatchColor=RGB(56, 68, 69)),
    Specular=RGB(255, 255, 255),
    Emission=ColourSwatch(SwatchColor=RGB(18, 18, 18)),
    Transparency=0,
    Shine=Slider(24, range=0..100))
material_6 = CreateMaterial(
    Diffuse=ColourSwatch(SwatchColor=RGB(194, 194, 194)),
    Specular=RGB(255, 255, 255),
    Emission=ColourSwatch(SwatchColor=RGB(15, 15, 15)),
    Transparency=0,
    Shine=Slider(25, range=0..100))
smooth = SettingsQuality()
jagged = SettingsSpeed()
currently_fabricating_parts_disable_prev_3 = Panel(larger_4.LargerThan)  # "Currently fabricating parts, disable preview"
part_ghost_material = Shader(material_3)
rack_and_rail_material = Shader(material_6)
_3d_wire_material = Shader(material)
_2d_wire_material = Shader(material_2)
main_material = Shader(material_5)
motor_material = Shader(material_4)
filter_21 = StreamFilter(Gate=equals_43.Equality, Stream0=_3d_wire_material, Stream1=_2d_wire_material)
wire_material = Shader(filter_21)
filter_22 = StreamFilter(Gate=currently_fabricating_parts_disable_prev_3, Stream0=main_material)
filter_23 = StreamFilter(Gate=currently_fabricating_parts_disable_prev_3, Stream0=rack_and_rail_material)
filter_24 = StreamFilter(Gate=currently_fabricating_parts_disable_prev_3, Stream0=motor_material)
filter_25 = StreamFilter(Gate=currently_fabricating_parts_disable_prev_3, Stream0=wire_material)

# ----
expected_projected_size = Slider(300, range=0..1000)
rotation_correction = Slider(-0.01, range=-0.1..0.1)
position_correction_x = Slider(14, range=0..100)
position_correction_y = Slider(3, range=-10..10)
drill_preview_geometry = Curve()
engrave_toolpaths = Curve()
_3d_mill_toolpaths = Curve(flatten([surface_3d_roughing_toolpaths, surface_3d_finishing_toolpaths]))
cutout_toolpaths = Curve()
pocket_toolpaths = Curve()
cutting_curves = Curve()
pocket_curves = Curve()
preview_graphic_for_1_1_projection_on_ma = PreviewGraphicFor11ProjectionOnMachine(
    toolpath_curves=[pocket_toolpaths, cutout_toolpaths, engrave_toolpaths, _3d_mill_toolpaths],
    cutting_curves=cutting_curves,
    pocket_curves=pocket_curves,
    drill_preview_curves=drill_preview_geometry,
    expected_projected_size=expected_projected_size,
    measured_projected_size=measured_projected_size,
    position_correction_x=position_correction_x,
    position_correction_y=position_correction_y,
    rotation_correction=rotation_correction,
    svg_px_width="719",
    svg_px_heigth="1279")  # "Preview graphic for 1:1 projection on machine"; disabled
stream_and_save_as_svg = Panel(preview_graphic_for_1_1_projection_on_ma)
tab_cleanup = ColourSwatch(SwatchColor=RGB(74, 74, 74))

# ---- group: Make work area and wrist point
single_axis_config_identifier_3 = Panel(single_axis_config_identifier_2)
current_machine_to_make_3 = Panel(list)
arm_to_axis_angle_3 = Panel(arm_to_axis_angle_2)
tooltip_distance_bellow_center_plate = Panel("10")
additional_axis_margin_2 = Panel(additional_axis_margin)
center_plate_diameter_3 = Panel(center_plate_diameter_2)
delta_work_area_diameter_2 = Panel(work_area_diameter)
equals_44 = Equality(FirstNumber=current_machine_to_make_3, SecondNumber=single_axis_config_identifier_3)  # -> Equality, Inequality
multiplication_14 = Multiplication(A=delta_work_area_diameter_2, B="0.5")
xy_10 = XYPlane(Origin=Point(0, 0, 0))
addition_9 = Addition(A=multiplication_14, B=additional_axis_margin_2)
rotate_6 = Rotate(Geometry=xy_10, Angle=1.570796327, Plane=xy_10)  # -> Geometry, Transform
actual_work_area_radius = Panel(addition_9)
filter_26 = StreamFilter(Gate=equals_44.Equality, Stream1=actual_work_area_radius)
cir_2 = Circle(Plane=rotate_6.Geometry, Radius=filter_26)
Z_7 = UnitZ(Factor=tooltip_distance_bellow_center_plate)
arm_to_axis_angle_4 = Panel(arm_to_axis_angle_3)
actual_work_area_radius_2 = Panel(filter_26)
work_area_outline = Curve(cir_2)

# ----
filter_27 = StreamFilter(Gate=equals_44.Equality, Stream1=center_plate_diameter_3)

# ---- group: Make work area and wrist point (continued)
multiplication_15 = Multiplication(A=filter_27, B="0.5")
cir_3 = Circle(Plane=rotate_6.Geometry, Radius=multiplication_15)
divide = DivideCurve(Curve=cir_3, Count="6", Kinks=False)  # -> Points, Tangents, Parameters
pline = PolyLine(Vertices=divide.Points, Closed=True)
item_11 = ListItem(List=flatten(divide.Points), Index="5", Wrap=True)
item_12 = ListItem(List=flatten(divide.Points), Index="4", Wrap=True)
arm_point_2 = Point(item_11)
arm_point1 = Point(item_12)
pdecon_4 = Deconstruct(Point=arm_point1)  # -> XComponent, YComponent, ZComponent
dist = Distance(PointA=arm_point_2, PointB=arm_point1)
move_6 = Move(Geometry=pline, Motion=Z_7)  # -> Geometry, Transform
move_7 = Move(Geometry=arm_point1, Motion=Z_7)  # -> Geometry, Transform
distance_from_wrist_joint_to_tooltip_cen = Panel(pdecon_4.XComponent)  # "Distance from wrist joint to tooltip center"
arm_spacing = Panel(dist)
center_plate_curve = Curve(move_6.Geometry)
wrist_point = Point(move_7.Geometry)

# ---- group: Make arm legth and shoulder point
wrist_point_2 = Point(wrist_point)
minium_arm_to_axis_angle_2 = Panel(minium_arm_to_axis_angle)
arm_to_axis_angle_5 = Panel(arm_to_axis_angle_4)
actual_work_area_radius_3 = Panel(actual_work_area_radius_2)
X_3 = UnitX(Factor=actual_work_area_radius_3)
move_8 = Move(Geometry=wrist_point_2, Motion=X_3)  # -> Geometry, Transform
corner_point = Point(move_8.Geometry)
Z_8 = UnitZ(Factor=1)
move_9 = Move(Geometry=wrist_point_2, Motion=Z_8)  # -> Geometry, Transform
move_10 = Move(Geometry=corner_point, Motion=Z_8)  # -> Geometry, Transform
xz = XZPlane(Origin=wrist_point_2)
ln_8 = Line(StartPoint=corner_point, EndPoint=move_10.Geometry)
xz_2 = XZPlane(Origin=corner_point)
ln_9 = Line(StartPoint=wrist_point_2, EndPoint=move_9.Geometry)
neg_4 = Negative(Value=minium_arm_to_axis_angle_2)
neg_5 = Negative(Value=arm_to_axis_angle_5)
rotate_7 = Rotate(Geometry=ln_8, Angle=degrees(neg_4), Plane=xz_2)  # -> Geometry, Transform
rotate_8 = Rotate(Geometry=ln_9, Angle=degrees(neg_5), Plane=xz)  # -> Geometry, Transform
llx = LineLine(Line1=rotate_8.Geometry, Line2=rotate_7.Geometry)  # -> ParamA, ParamB, PointA, PointB
shoulder_point = Point(llx.PointA)
wrist_point_3 = Point(wrist_point_2)
dist_2 = Distance(PointA=shoulder_point, PointB=wrist_point_3)
arm_lenght = Panel(dist_2)

# ----
shoulder_point_2 = Point(shoulder_point)
wrist_point_4 = Point(wrist_point_3)

# ---- group: Make axis length
arm_lenght_2 = Panel(arm_lenght)
delta_work_area_z_2 = Panel(work_area_z_2)
shoulder_point_3 = Point(shoulder_point_2)
actual_work_area_radius_4 = Panel(actual_work_area_radius_2)
wrist_point_5 = Point(wrist_point_4)
neg_6 = Negative(Value=actual_work_area_radius_4)
project = Project(Geometry=shoulder_point_3, Plane=PlaneXY(0, 0, 0))  # -> Geometry, Transform
X_4 = UnitX(Factor=actual_work_area_radius_4)
X_5 = UnitX(Factor=neg_6)
ln_10 = Line(StartPoint=project.Geometry, EndPoint=shoulder_point_3)
move_11 = Move(Geometry=wrist_point_5, Motion=X_5)  # -> Geometry, Transform
move_12 = Move(Geometry=wrist_point_5, Motion=X_4)  # -> Geometry, Transform
ext = ExtendCurve(Curve=ln_10, Type=0, Start="0", End=arm_lenght_2)
xz_3 = XZPlane(Origin=move_11.Geometry)
xz_4 = XZPlane(Origin=move_12.Geometry)
cir_4 = Circle(Plane=xz_4, Radius=arm_lenght_2)
cir_5 = Circle(Plane=xz_3, Radius=arm_lenght_2)
axis_line = Curve(ext)
delta_work_area_z_3 = Panel(delta_work_area_z_2)
ccx = CurveCurve(CurveA=axis_line, CurveB=cir_4)  # -> Points, ParamsA, ParamsB
ccx_2 = CurveCurve(CurveA=axis_line, CurveB=cir_5)  # -> Points, ParamsA, ParamsB
Z_9 = UnitZ(Factor=delta_work_area_z_3)
move_13 = Move(Geometry=ccx.Points, Motion=Z_9)  # -> Geometry, Transform
lowest_movement_point = Point(flatten(ccx_2.Points))
highest_movement_point = Point(flatten(move_13.Geometry))
dist_3 = Distance(PointA=lowest_movement_point, PointB=highest_movement_point)
delta_axis_length = Panel(dist_3)
highest_movement_point_2 = Point(highest_movement_point)
lowest_movement_point_2 = Point(lowest_movement_point)
bottom_point = Point(project.Geometry)

# ---- group: Find longest axis
delta_axis_length_2 = Panel(delta_axis_length)
# Include end effector distance from carriage in rack length
current_machine_to_make_4 = Panel(list)
gantry_work_area_x_4 = Panel(work_area_x)
single_axis_length_3 = Panel(axis_length)
gantry_work_area_y_3 = Panel(work_area_y)
merge_8 = Merge(Data1=gantry_work_area_x_4, Data2=gantry_work_area_y_3)
sort_2 = SortList(Keys=merge_8)  # -> Keys, ValuesA
rev = ReverseList(List=sort_2.Keys)
item_13 = ListItem(List=rev, Index=0, Wrap=True)
merge_9 = Merge(Data1=single_axis_length_3, Data2=item_13, Data3=delta_axis_length_2)
item_14 = ListItem(List=merge_9, Index=current_machine_to_make_4, Wrap=True)
longest_axis_length = Panel(item_14)

# ---- group: Make rack and pinion
longest_axis_length_2 = Panel(longest_axis_length)
additional_axis_margin_3 = Panel(additional_axis_margin)
rack_teeth_bit_diameter = Panel(diameter_5)
rack_mill_margin_2 = Panel(rack_mill_margin)
number_of_pinion_teeth_2 = Panel(number_of_pinion_teeth)
motor_shaft_diamameter_2 = Panel(motor_shaft_diamameter)
addition_10 = Addition(A=rack_teeth_bit_diameter, B=rack_mill_margin_2)
multiplication_16 = Multiplication(A=additional_axis_margin_3, B="2")
addition_11 = Addition(A=longest_axis_length_2, B=multiplication_16)
actual_axis_lenght = Panel(addition_11)
roller_rack_and_pinion_maker = RollerRackAndPinionMaker(
    rack_length=actual_axis_lenght,
    milling_bit_diameter=addition_10,
    number_of_pinion_teeth=number_of_pinion_teeth_2,
    motor_shaft_diameter=motor_shaft_diamameter_2)  # -> rack_teeth_4, rack_edge_2, pinion_teeth_4, pinion_center_hole_3, pinion_edge_3, pinion_movement_preview_3, distance_covered_per_step_5, maxium_pinion_milling_bit_diamter_4

# ----
step_resolution = Panel(roller_rack_and_pinion_maker.distance_covered_per_step_5)
pinion_center_hole = Curve(roller_rack_and_pinion_maker.pinion_center_hole_3)
pinion_teeth = Curve(roller_rack_and_pinion_maker.pinion_teeth_4)

# ---- group: Adjust rack lenght to axis
input_axis_lenght = Panel(actual_axis_lenght)
current_machine_to_make_5 = Panel(list)
single_axis_length_4 = Panel(axis_length)
gantry_work_area_y_4 = Panel(work_area_y)
temp_delta_axis_length = Panel(axis_length)
additional_axis_margin_4 = Panel(additional_axis_margin)
rack_teeth_3 = Curve(roller_rack_and_pinion_maker.rack_teeth_4)
bbox_4 = BoundingBox(Content=flatten(rack_teeth_3), Plane=PlaneXY(0, 0, 0), UnionBox=True)  # -> Box, Box_2
filter_28 = StreamFilter(
    Gate=current_machine_to_make_5,
    Stream0=single_axis_length_4,
    Stream1=gantry_work_area_y_4,
    Stream2=temp_delta_axis_length)
dim_3 = Dimensions(Surface=bbox_4.Box)  # -> UDimension, VDimension
multiplication_17 = Multiplication(A=additional_axis_margin_4, B="2")
subtraction_15 = Subtraction(A=dim_3.UDimension, B=input_axis_lenght)
addition_12 = Addition(A=filter_28, B=multiplication_17)
exstra_axis_lenght = Panel(subtraction_15)
desired_axis_lenght = Panel(addition_12)
input_axis_lenght_2 = Panel(input_axis_lenght)
edges = BrepEdges(Brep=bbox_4.Box)  # -> Naked, Interior, NonManifold
item_15 = ListItem(List=edges.Naked, Index="3", Wrap=True)
addition_13 = Addition(A=exstra_axis_lenght, B=desired_axis_lenght)
X_6 = UnitX(Factor=addition_13)
rack_teeth_4 = Curve(rack_teeth_3)
move_14 = Move(Geometry=item_15, Motion=X_6)  # -> Geometry, Transform
ccx_3 = CurveCurve(CurveA=rack_teeth_4, CurveB=move_14.Geometry)  # -> Points, ParamsA, ParamsB
shatter_2 = Shatter(Curve=rack_teeth_4, Parameters=ccx_3.ParamsA)
item_16 = ListItem(List=shatter_2, Index=0, Wrap=True)
smaller = SmallerThan(FirstNumber=desired_axis_lenght, SecondNumber=input_axis_lenght_2)  # -> SmallerThan, OrEqualTo
trimmed_rack_teeth = Curve(item_16)
rack_teeth_5 = Curve(rack_teeth_3)
actual_axis_lenght_first_axis = Panel(desired_axis_lenght)
filter_29 = StreamFilter(Gate=smaller.SmallerThan, Stream0=rack_teeth_5, Stream1=trimmed_rack_teeth)
rack_teeth_6 = Curve(filter_29)

# ---- group: Check pinion teeth milling bit
max_pinion_diamter = Panel(roller_rack_and_pinion_maker.maxium_pinion_milling_bit_diamter_4)
rack_mill_margin_3 = Panel(rack_mill_margin_2)
pinion_teeth_bit_diameter = Panel(diameter_4)
subtraction_16 = Subtraction(A=max_pinion_diamter, B=rack_mill_margin_3)
smaller_2 = SmallerThan(FirstNumber=subtraction_16, SecondNumber=pinion_teeth_bit_diameter)  # -> SmallerThan, OrEqualTo
panel_4 = Panel("""WARNING:
Pinion teeth milling bit
diameter to large""")
filter_30 = StreamFilter(Gate=smaller_2.OrEqualTo, Stream1=warning_plane)
tag_2 = TextTag3D(Location=filter_30, Text=panel_4, Size="100", Colour=swatch, Justification=7)

# ---- group: Make rack top pocket
pinion_edge_screw_edge_margin_2 = Panel(pinion_edge_screw_edge_margin)
additional_axis_margin_5 = Panel(additional_axis_margin)
rack_teeth_7 = Curve(rack_teeth_6)
bbox_5 = BoundingBox(Content=rack_teeth_7, Plane=PlaneXY(0, 0, 0), UnionBox=True)  # -> Box, Box_2
edges_2 = BrepEdges(Brep=bbox_5.Box)  # -> Naked, Interior, NonManifold
multiplication_18 = Multiplication(A=main_material_bit, B="0.6")
item_17 = ListItem(List=edges_2.Naked, Index="2", Wrap=True)
item_18 = ListItem(List=edges_2.Naked, Index=0, Wrap=True)
flip = FlipCurve(Curve=item_17)  # -> Curve, Flag
neg_7 = Negative(Value=pinion_edge_screw_edge_margin_2)
panel_5 = Panel(multiplication_18)
rack_tooth_edge = Curve(flip.Curve)
rack_outer_edge = Curve(item_18)
Y_3 = UnitY(Factor=neg_7)
Y_4 = UnitY(Factor=panel_5)
ext_2 = ExtendCurve(Curve=rack_tooth_edge, Type=0, Start=additional_axis_margin_5, End=additional_axis_margin_5)
ext_3 = ExtendCurve(Curve=rack_outer_edge, Type=0, Start=additional_axis_margin_5, End=additional_axis_margin_5)
move_15 = Move(Geometry=ext_2, Motion=Y_4)  # -> Geometry, Transform
move_16 = Move(Geometry=ext_3, Motion=Y_3)  # -> Geometry, Transform
xz_5 = XZPlane(Origin=Point(0, 0, 0))
mirror = Mirror(Geometry=move_16.Geometry, Plane=xz_5)  # -> Geometry, Transform
end_2 = EndPoints(Curve=move_16.Geometry)  # -> Start, End
end_3 = EndPoints(Curve=mirror.Geometry)  # -> Start, End
ln_11 = Line(StartPoint=end_3.Start, EndPoint=end_2.Start)
ln_12 = Line(StartPoint=end_3.End, EndPoint=end_2.End)
join_4 = JoinCurves(Curves=flatten([mirror.Geometry, ln_11, ln_12, move_16.Geometry]), Preserve=False)
rack_pocket_depth_3 = Panel(rack_pocket_depth)
rack_pocket = Curve(join_4)

# ---- group: Make pinion pocket
pinion_to_pocket_wall_margin_2 = Panel(pinion_to_pocket_wall_margin)
pinion_edge = Curve(roller_rack_and_pinion_maker.pinion_edge_3)
bbox_6 = BoundingBox(Content=pinion_edge, Plane=PlaneXY(0, 0, 0))  # -> Box, Box_2
dim_4 = Dimensions(Surface=flatten(bbox_6.Box))  # -> UDimension, VDimension
pinion_width = Panel(dim_4.UDimension)
rack_tooth_edge_2 = Curve(ext_2)
multiplication_19 = Multiplication(A=pinion_width, B="0.5")
addition_14 = Addition(A=multiplication_19, B=pinion_to_pocket_wall_margin_2)
end_4 = EndPoints(Curve=rack_tooth_edge_2)  # -> Start, End
pdecon_5 = Deconstruct(Point=end_4.Start)  # -> XComponent, YComponent, ZComponent
pdecon_6 = Deconstruct(Point=end_4.End)  # -> XComponent, YComponent, ZComponent
pt_8 = ConstructPoint(XCoordinate=pdecon_5.XComponent, YCoordinate=addition_14, ZCoordinate=0)
pt_9 = ConstructPoint(XCoordinate=pdecon_6.XComponent, YCoordinate=addition_14, ZCoordinate=0)
ln_13 = Line(StartPoint=pt_8, EndPoint=pt_9)
end_5 = EndPoints(Curve=ln_13)  # -> Start, End
end_6 = EndPoints(Curve=rack_tooth_edge_2)  # -> Start, End
ln_14 = Line(StartPoint=end_5.End, EndPoint=end_6.End)
ln_15 = Line(StartPoint=end_5.Start, EndPoint=end_6.Start)
join_5 = JoinCurves(Curves=flatten([ln_15, ln_14, rack_tooth_edge_2, ln_13]), Preserve=False)
pinion_pocket_depth_2 = Panel(pinion_pocket_depth)
# make pocket depths
pinion_pocket = Curve(join_5)

# ---- group: Adjust rack lenght to axis
input_axis_lenght_3 = Panel(actual_axis_lenght)
current_machine_to_make_6 = Panel(list)
gantry_config_identifier_2 = Panel(gantry_config_identifier)
additional_axis_margin_6 = Panel(additional_axis_margin)
rack_teeth_8 = Curve(roller_rack_and_pinion_maker.rack_teeth_4)
equals_45 = Equality(FirstNumber=current_machine_to_make_6, SecondNumber=gantry_config_identifier_2)  # -> Equality, Inequality
filter_31 = StreamFilter(Gate=equals_45.Equality, Stream1=rack_teeth_8)
rack_teeth_9 = Curve(filter_31)
bbox_7 = BoundingBox(Content=flatten(rack_teeth_9), Plane=PlaneXY(0, 0, 0), UnionBox=True)  # -> Box, Box_2
multiplication_20 = Multiplication(A=additional_axis_margin_6, B="2")
dim_5 = Dimensions(Surface=bbox_7.Box)  # -> UDimension, VDimension
subtraction_17 = Subtraction(A=dim_5.UDimension, B=input_axis_lenght_3)
addition_15 = Addition(A=gantry_work_area_x, B=multiplication_20)
exstra_axis_lenght_2 = Panel(subtraction_17)
desired_axis_lenght_2 = Panel(addition_15)
input_axis_lenght_4 = Panel(input_axis_lenght_3)
edges_3 = BrepEdges(Brep=bbox_7.Box)  # -> Naked, Interior, NonManifold
item_19 = ListItem(List=edges_3.Naked, Index="3", Wrap=True)
addition_16 = Addition(A=exstra_axis_lenght_2, B=desired_axis_lenght_2)
X_7 = UnitX(Factor=addition_16)
rack_teeth_10 = Curve(rack_teeth_9)
move_17 = Move(Geometry=item_19, Motion=X_7)  # -> Geometry, Transform
ccx_4 = CurveCurve(CurveA=rack_teeth_10, CurveB=move_17.Geometry)  # -> Points, ParamsA, ParamsB
shatter_3 = Shatter(Curve=rack_teeth_10, Parameters=ccx_4.ParamsA)
item_20 = ListItem(List=shatter_3, Index=0, Wrap=True)
smaller_3 = SmallerThan(FirstNumber=desired_axis_lenght_2, SecondNumber=input_axis_lenght_4)  # -> SmallerThan, OrEqualTo
trimmed_rack_teeth_2 = Curve(item_20)
filter_32 = StreamFilter(Gate=equals_45.Equality, Stream1=desired_axis_lenght_2)
rack_teeth_11 = Curve(rack_teeth_9)
filter_33 = StreamFilter(Gate=smaller_3.SmallerThan, Stream0=rack_teeth_11, Stream1=trimmed_rack_teeth_2)
actual_axis_lenght_lower_gantry_axis = Panel(filter_32)
rack_teeth_lower_gantry_axis = Curve(filter_33)

# ---- group: Make rack top pocket
additional_axis_margin_7 = Panel(additional_axis_margin)
main_material_bit_3 = Panel(diameter_2)
extra_precut_with_offset_top_layer_2 = Panel(extra_precut_with_offset_top_layer)
pinion_edge_screw_edge_margin_3 = Panel(pinion_edge_screw_edge_margin)
rack_teeth_12 = Curve(rack_teeth_lower_gantry_axis)
bbox_8 = BoundingBox(Content=rack_teeth_12, Plane=PlaneXY(0, 0, 0), UnionBox=True)  # -> Box, Box_2
edges_4 = BrepEdges(Brep=bbox_8.Box)  # -> Naked, Interior, NonManifold
multiplication_21 = Multiplication(A=main_material_bit_3, B="0.6")
addition_17 = Addition(A=multiplication_21, B=extra_precut_with_offset_top_layer_2)
item_21 = ListItem(List=edges_4.Naked, Index="2", Wrap=True)
item_22 = ListItem(List=edges_4.Naked, Index=0, Wrap=True)
flip_2 = FlipCurve(Curve=item_21)  # -> Curve, Flag
neg_8 = Negative(Value=pinion_edge_screw_edge_margin_3)
panel_6 = Panel(addition_17)
rack_tooth_edge_3 = Curve(flip_2.Curve)
rack_outer_edge_2 = Curve(item_22)
Y_5 = UnitY(Factor=neg_8)
Y_6 = UnitY(Factor=panel_6)
ext_4 = ExtendCurve(Curve=rack_tooth_edge_3, Type=0, Start=additional_axis_margin_7, End=additional_axis_margin_7)
ext_5 = ExtendCurve(Curve=rack_outer_edge_2, Type=0, Start=additional_axis_margin_7, End=additional_axis_margin_7)
move_18 = Move(Geometry=ext_5, Motion=Y_5)  # -> Geometry, Transform
move_19 = Move(Geometry=ext_4, Motion=Y_6)  # -> Geometry, Transform
end_7 = EndPoints(Curve=move_19.Geometry)  # -> Start, End
end_8 = EndPoints(Curve=move_18.Geometry)  # -> Start, End
ln_16 = Line(StartPoint=end_7.End, EndPoint=end_8.End)
ln_17 = Line(StartPoint=end_7.Start, EndPoint=end_8.Start)
join_6 = JoinCurves(Curves=flatten([move_19.Geometry, ln_17, ln_16, move_18.Geometry]), Preserve=False)
rack_pocket_depth_4 = Panel(rack_pocket_depth)
rack_tooth_edge_4 = Curve(ext_4)
rack_pocket_2 = Curve(join_6)

# ----
additional_axis_margin_8 = Panel(additional_axis_margin_3)
X_8 = UnitX(Factor=additional_axis_margin_8)

# ---- group: Make inside axis mounting holes
hold_down_hole_diameter = Panel(hold_down_and_registration_hole_diameter)
mounting_hole_spacing_2 = Panel(mounting_hole_spacing)
actual_axis_lenght_first_axis_2 = Panel(actual_axis_lenght_first_axis)
nut_width_flat_side_to_flat_side_3 = Panel(nut_width_flat_side_to_flat_side)
attachment_bolt_diameter_2 = Panel(attachment_bolt_diameter)
division_6 = Division(A=actual_axis_lenght_first_axis_2, B=mounting_hole_spacing_2)
multiplication_22 = Multiplication(A=nut_width_flat_side_to_flat_side_3, B="0.65")
xy_11 = XYPlane(Origin=Point(0, 0, 0))
multiplication_23 = Multiplication(A=hold_down_hole_diameter, B="0.5")
multiplication_24 = Multiplication(A=attachment_bolt_diameter_2, B="0.5")
round_2 = Round(Number=division_6)  # -> Nearest, Floor, Ceiling
cir_6 = Circle(Plane=xy_11, Radius=multiplication_23)
cir_7 = Circle(Plane=xy_11, Radius=multiplication_24)
multiplication_25 = Multiplication(A=round_2.Floor, B="0.5")
addition_18 = Addition(A=multiplication_25, B="0.1")
subtraction_18 = Subtraction(A=multiplication_25, B="0.1")
int = Integer(addition_18)
multiplication_26 = Multiplication(A=int, B="2")
panel_7 = Panel(multiplication_26)
subtraction_19 = Subtraction(A=panel_7, B="1")
addition_19 = Addition(A=panel_7, B="1")
multiplication_27 = Multiplication(A=mounting_hole_spacing_2, B=subtraction_19)
subtraction_20 = Subtraction(A=actual_axis_lenght_first_axis_2, B=multiplication_27)
multiplication_28 = Multiplication(A=subtraction_20, B="0.5")
series = Series(Start=multiplication_28, Step=mounting_hole_spacing_2, Count=panel_7)
X_9 = UnitX(Factor=series)
xy_12 = XYPlane(Origin=Point(0, 0, 0))
move_20 = Move(Geometry=xy_12, Motion=X_9)  # -> Geometry, Transform
orient_2 = Orient(Geometry=nut_hole_for_top_layer, Source=xy_12, Target=move_20.Geometry)  # -> Geometry, Transform
orient_3 = Orient(Geometry=nut_pocket_for_mid_layer, Source=xy_12, Target=move_20.Geometry)  # -> Geometry, Transform
orient_4 = Orient(Geometry=cir_7, Source=xy_12, Target=move_20.Geometry)  # -> Geometry, Transform
hold_down_hole_for_cutsheet_layout = Curve(cir_6)
nut_pockets_for_mid_layer = Curve(orient_3.Geometry)
nut_holes_for_top_layer = Curve(orient_2.Geometry)
bolt_holes_for_mounting = Curve(orient_4.Geometry)
hold_down_hole = Curve(cir_6)

# ----
nut_pockets_for_mid_layer_2 = Curve(nut_pockets_for_mid_layer)

rack_pocket_depth_5 = Panel(rack_pocket_depth)
rack_teeth_13 = Curve(rack_teeth_7)
cut_rack_geometry_identifer = Panel("7")
current_action = Panel(list_4)
rack_teeth_bit_diameter_2 = Panel(diameter_5)
rack_mill_margin_4 = Panel(rack_mill_margin)
first_premill_stepover = Panel("0.025")
rack_and_pinion_tooth_height_3 = Panel(rack_and_pinion_tooth_height_2)
neg_9 = Negative(Value=rack_pocket_depth_5)
equals_46 = Equality(FirstNumber=cut_rack_geometry_identifer, SecondNumber=current_action)  # -> Equality, Inequality
multiplication_29 = Multiplication(A=rack_mill_margin_4, B="0.5")
multiplication_30 = Multiplication(A=rack_teeth_bit_diameter_2, B="0.5")
multiplication_31 = Multiplication(A=rack_teeth_bit_diameter_2, B=first_premill_stepover)
Z_10 = UnitZ(Factor=neg_9)
filter_34 = StreamFilter(Gate=equals_46.Equality, Stream1=rack_teeth_13)
addition_20 = Addition(A=multiplication_30, B=multiplication_29)
flip_3 = FlipCurve(Curve=filter_34)  # -> Curve, Flag
addition_21 = Addition(A=addition_20, B=multiplication_31)
move_21 = Move(Geometry=flip_3.Curve, Motion=Z_10)  # -> Geometry, Transform
cut1 = Panel(addition_21)
cut2 = Panel(addition_20)
cut3 = Panel(multiplication_30)
rack_teeth_14 = Curve(move_21.Geometry)
offset_2 = Offset(Curve=rack_teeth_14, Distance=cut1, Plane=PlaneXY(0, 0, 0), Corners=1)
offset_3 = Offset(Curve=rack_teeth_14, Distance=cut2, Plane=PlaneXY(0, 0, 0), Corners=1)  # disabled
offset_4 = Offset(Curve=rack_teeth_14, Distance=cut3, Plane=PlaneXY(0, 0, 0), Corners=1)
flip_4 = FlipCurve(Curve=offset_2)  # -> Curve, Flag
flip_5 = FlipCurve(Curve=offset_3)  # -> Curve, Flag
multiplication_32 = Multiplication(A=rack_teeth_bit_diameter_2, B="2")
Y_7 = UnitY(Factor=multiplication_32)
end_9 = EndPoints(Curve=flip_4.Curve)  # -> Start, End
move_22 = Move(Geometry=end_9.Start, Motion=Y_7)  # -> Geometry, Transform
ln_18 = Line(StartPoint=move_22.Geometry, EndPoint=end_9.Start)
rack_cut_depth = Panel(rack_and_pinion_tooth_height_3)
join_7 = JoinCurves(Curves=[ln_18, flip_4.Curve], Preserve=False)
rack_finish_mill = Curve(offset_4)
rack_premill1 = Curve(join_7)
rack_premill2 = Curve(flip_5.Curve)

nut_pockets_for_mid_layer_3 = Curve(nut_pockets_for_mid_layer_2)
filter_35 = StreamFilter(Gate=precut_2, Stream1=nut_pockets_for_mid_layer_3)
filter_36 = StreamFilter(Gate=precut_lower_left_axis, Stream1=rack_pocket_2)
filter_37 = StreamFilter(Gate=precut_top_axis_layer, Stream1=pinion_pocket)
filter_38 = StreamFilter(Gate=precut_top_axis_layer, Stream1=rack_pocket)
filter_39 = StreamFilter(Gate=cut_8, Stream1=rack_finish_mill)
filter_40 = StreamFilter(Gate=cut_8, Stream1=rack_premill2)
filter_41 = StreamFilter(Gate=cut_8, Stream1=rack_premill1)

# ---- group: Link carriage length to axis width in case of gantry config
current_machine_to_make_7 = Panel(list)
gantry_identifier = Panel("1")
carriage_lenght_2 = Panel(carriage_lenght)
equals_47 = Equality(FirstNumber=current_machine_to_make_7, SecondNumber=gantry_identifier)  # -> Equality, Inequality

# ---- group: Find axis edges and width
axis_width_2 = Panel(axis_width)
pinion_edge_screw_edge_margin_4 = Panel(pinion_edge_screw_edge_margin_2)
actual_axis_lenght_first_axis_3 = Panel(actual_axis_lenght_first_axis)
wedge_width_to_material_thickness_ratio_2 = Panel(wedge_width_to_material_thickness_ratio)
v_rail_to_attachment_bolt_margin_2 = Panel(v_rail_to_attachment_bolt_margin)
spacer_diamter = Panel(spacer_diameter_inc_margin)
additional_axis_margin_9 = Panel(additional_axis_margin)
pinion_width_2 = Panel(dim_4.UDimension)
join_rails_with_dowels_instead_of_bolts_2 = Panel(join_rails_with_dowels_instead_of_bolts)
main_material_thickness_4 = Panel(thickness)
multiplication_33 = Multiplication(A=pinion_width_2, B="0.5")
multiplication_34 = Multiplication(A=wedge_width_to_material_thickness_ratio_2, B=main_material_thickness_4)
top_wedge_hole_width = Panel(multiplication_34)
addition_22 = Addition(A=multiplication_33, B=pinion_edge_screw_edge_margin_4)
minium_distance_to_start_bolt_placing = Panel(addition_22)
filter_42 = StreamFilter(Gate=join_rails_with_dowels_instead_of_bolts_2, Stream0=spacer_diamter, Stream1=top_wedge_hole_width)
top_hole_width = Panel(filter_42)
v_rail_to_attachment_bolt_margin_3 = Panel(v_rail_to_attachment_bolt_margin_2)
multiplication_35 = Multiplication(A=top_hole_width, B="0.5")
addition_23 = Addition(A=multiplication_35, B=v_rail_to_attachment_bolt_margin_3)
bolt_hole_pluss_margin_radus = Panel(addition_23)
addition_24 = Addition(A=minium_distance_to_start_bolt_placing, B=bolt_hole_pluss_margin_radus)
attachment_bolt_center_line_distance = Panel(addition_24)
bolt_hole_pluss_margin_radus_2 = Panel(addition_23)
desired_axis_width = Panel(axis_width_2)
multiplication_36 = Multiplication(A=desired_axis_width, B="0.5")
addition_25 = Addition(A=attachment_bolt_center_line_distance, B=addition_23, C=v_rail_to_attachment_bolt_margin_3)
multiplication_37 = Multiplication(A=addition_25, B="2")
subtraction_21 = Subtraction(A=multiplication_36, B=bolt_hole_pluss_margin_radus_2)
minimum_axis_width = Panel(multiplication_37)
desired_axis_width_2 = Panel(axis_width_2)
subtraction_22 = Subtraction(A=subtraction_21, B=v_rail_to_attachment_bolt_margin_3)
desired_attachment_bolt_center_line_dist = Panel(subtraction_22)  # "Desired attachment bolt center line distance"
smaller_4 = SmallerThan(FirstNumber=minimum_axis_width, SecondNumber=desired_axis_width_2)  # -> SmallerThan, OrEqualTo
filter_43 = StreamFilter(Gate=smaller_4.SmallerThan, Stream0=minimum_axis_width, Stream1=desired_axis_width_2)
actual_axis_width = Panel(filter_43)
filter_44 = StreamFilter(
    Gate=smaller_4.SmallerThan,
    Stream0=attachment_bolt_center_line_distance,
    Stream1=desired_attachment_bolt_center_line_dist)
attachment_bolt_center_line_distance_2 = Panel(filter_44)
actual_axis_lenght_2 = Panel(actual_axis_lenght_first_axis_3)
multiplication_38 = Multiplication(A=actual_axis_width, B="0.5")
additional_axis_margin_10 = Panel(additional_axis_margin_9)
pt_10 = ConstructPoint(XCoordinate=0, YCoordinate=attachment_bolt_center_line_distance_2, ZCoordinate=0)
pt_11 = ConstructPoint(XCoordinate=actual_axis_lenght_2, YCoordinate=attachment_bolt_center_line_distance_2, ZCoordinate=0)
pt_12 = ConstructPoint(XCoordinate=0, YCoordinate=multiplication_38, ZCoordinate=0)
pt_13 = ConstructPoint(XCoordinate=actual_axis_lenght_2, YCoordinate=multiplication_38, ZCoordinate=0)
ln_19 = Line(StartPoint=pt_10, EndPoint=pt_11)
ln_20 = Line(StartPoint=pt_12, EndPoint=pt_13)
actual_axis_width_2 = Panel(actual_axis_width)

# ---- group: Link carriage length to axis width in case of gantry config (continued)
actual_axis_width_3 = Panel(actual_axis_width_2)
filter_45 = StreamFilter(Gate=equals_47.Equality, Stream0=carriage_lenght_2, Stream1=actual_axis_width_3)
carriage_lenght_3 = Panel(filter_45)

# ---- group: Find axis edges and width (continued)
carriage_lenght_4 = Panel(carriage_lenght_3)
carriage_lenght_5 = Panel(carriage_lenght_4)
multiplication_39 = Multiplication(A=carriage_lenght_5, B="0.5")
addition_26 = Addition(A=multiplication_39, B=additional_axis_margin_10)
multiplication_40 = Multiplication(A=addition_26, B="2")
ext_6 = ExtendCurve(Curve=ln_19, Type=0, Start=addition_26, End=addition_26)
ext_7 = ExtendCurve(Curve=ln_20, Type=0, Start=addition_26, End=addition_26)
carriage_lenght_6 = Panel(carriage_lenght_4)
total_axis_extension = Panel(multiplication_40)
bolt_placement_axis = Curve(ext_6)
axis_edge = Curve(ext_7)

# ----
len_4 = Length(Curve=ext_7)

# ---- group: Find axis edges and width (continued)
actual_axis_length = Panel(len_4)

# ---- group: Make joinery hole planes
bolt_placement_axis_2 = Curve(bolt_placement_axis)
wedge_or_bolt_spacing_2 = Panel(wedge_or_bolt_spacing)
join_rails_with_dowels_instead_of_bolts_3 = Panel(join_rails_with_dowels_instead_of_bolts_2)
spacer_diamter_2 = Panel(spacer_diameter_inc_margin)
wedge_width_to_material_thickness_ratio_3 = Panel(wedge_width_to_material_thickness_ratio)
main_material_thickness_5 = Panel(thickness)
current_machine_to_make_8 = Panel(list)
gantry_config_identifier_3 = Panel(gantry_config_identifier)
equals_48 = Equality(FirstNumber=current_machine_to_make_8, SecondNumber=gantry_config_identifier_3)  # -> Equality, Inequality
multiplication_41 = Multiplication(A=wedge_width_to_material_thickness_ratio_3, B=main_material_thickness_5)
top_wedge_hole_width_2 = Panel(multiplication_41)
bolt_placement_axis_3 = Curve(bolt_placement_axis_2)
filter_46 = StreamFilter(Gate=join_rails_with_dowels_instead_of_bolts_3, Stream0=spacer_diamter_2, Stream1=top_wedge_hole_width_2)
hole_width = Panel(filter_46)
len_5 = Length(Curve=bolt_placement_axis_3)
subtraction_23 = Subtraction(A=len_5, B=hole_width)
merge_10 = Merge(Data1=hole_width, Data2=subtraction_23)
eval_5 = EvaluateLength(Curve=bolt_placement_axis_3, Length=merge_10, Normalized=Toggle(False))  # -> Point, Tangent, Parameter
shatter_4 = Shatter(Curve=bolt_placement_axis_3, Parameters=eval_5.Parameter)
wedge_or_bolt_spacing_3 = Panel(wedge_or_bolt_spacing_2)
item_23 = ListItem(List=shatter_4, Index="1", Wrap=True)
divide_curve_even_lenght = DivideCurveEvenLenght(crv=item_23, B=wedge_or_bolt_spacing_3)
cull_i_2 = CullIndex(List=divide_curve_even_lenght, Indices="0", Wrap=True)
hole_plans_are_for_gantry_bridge = Panel(equals_48.Equality)
rev_2 = ReverseList(List=cull_i_2)
cull_i_3 = CullIndex(List=rev_2, Indices="0", Wrap=True)
rev_3 = ReverseList(List=cull_i_3)
filter_47 = StreamFilter(Gate=hole_plans_are_for_gantry_bridge, Stream0=divide_curve_even_lenght, Stream1=rev_3)
xy_13 = XYPlane(Origin=filter_47)
xz_6 = XZPlane(Origin=Point(0, 0, 0))
mirror_2 = Mirror(Geometry=xy_13, Plane=xz_6)  # -> Geometry, Transform
hole_planes_top_layer = Plane([xy_13, mirror_2.Geometry])

# ---- group: Make v rail profiles
bird_bit_upper_line = Line(upper_line)
bird_bit_center_point = Point(center_point)
rail_rack_and_pinion_material_thickness_4 = Panel(thickness_2)
rail_to_carriage_safety_distance_3 = Panel(rail_to_carriage_safety_distance)
rail_flat_mid_section_heigth_2 = Panel(rail_flat_mid_section_heigth)
bird_bit_lower_line = Line(lower_line)
xz_7 = XZPlane(Origin=Point(0, 0, 0))
axis_edge_2 = Curve(axis_edge)
mirror_3 = Mirror(Geometry=axis_edge_2, Plane=xz_7)  # -> Geometry, Transform
end_10 = EndPoints(Curve=mirror_3.Geometry)  # -> Start, End
multiplication_42 = Multiplication(A=rail_to_carriage_safety_distance_3, B="0.5")
multiplication_43 = Multiplication(A=rail_flat_mid_section_heigth_2, B="0.5")
subtraction_24 = Subtraction(A=rail_rack_and_pinion_material_thickness_4, B=multiplication_42)
multiplication_44 = Multiplication(A=subtraction_24, B="0.5")
v_rail_center_depth = Panel(multiplication_44)
v_rail_height = Panel(subtraction_24)
rail_to_carriege_safety_distance_2 = Panel(multiplication_42)
addition_27 = Addition(A=v_rail_center_depth, B=multiplication_43)
subtraction_25 = Subtraction(A=v_rail_center_depth, B=multiplication_43)
neg_10 = Negative(Value=rail_to_carriege_safety_distance_2)
neg_11 = Negative(Value=rail_to_carriege_safety_distance_2)
neg_12 = Negative(Value=subtraction_25)
neg_13 = Negative(Value=v_rail_height)
neg_14 = Negative(Value=addition_27)
pt_14 = Point(end_10.Start)
Y_8 = UnitY(Factor=subtraction_25)
Z_11 = UnitZ(Factor=neg_10)
Y_9 = UnitY(Factor=subtraction_25)
Z_12 = UnitZ(Factor=neg_12)
Y_10 = UnitY(Factor=neg_11)
Z_13 = UnitZ(Factor=neg_13)
Z_14 = UnitZ(Factor=neg_14)
move_23 = Move(Geometry=pt_14, Motion=Y_8)  # -> Geometry, Transform
move_24 = Move(Geometry=pt_14, Motion=Z_12)  # -> Geometry, Transform
move_25 = Move(Geometry=pt_14, Motion=Y_9)  # -> Geometry, Transform
move_26 = Move(Geometry=pt_14, Motion=Z_14)  # -> Geometry, Transform
move_27 = Move(Geometry=move_23.Geometry, Motion=Z_13)  # -> Geometry, Transform
rail_lowest_point = Point(move_27.Geometry)
move_28 = Move(Geometry=rail_lowest_point, Motion=Z_11)  # -> Geometry, Transform
move_29 = Move(Geometry=move_28.Geometry, Motion=Y_10)  # -> Geometry, Transform
ln_21 = Line(StartPoint=move_25.Geometry, EndPoint=move_24.Geometry)
ln_22 = Line(StartPoint=rail_lowest_point, EndPoint=move_29.Geometry)
ln_23 = Line(StartPoint=move_27.Geometry, EndPoint=move_26.Geometry)
ln_24 = Line(StartPoint=move_24.Geometry, EndPoint=move_26.Geometry)
v_rail_upper_line = Curve(ln_21)
bird_bit_lower_line_2 = Line(bird_bit_lower_line)
bird_bit_center_point_2 = Point(bird_bit_center_point)
bird_bit_center_point_3 = Point(bird_bit_center_point)
bird_beak_model_2 = Brep(bird_beak_model)
bird_bit_upper_line_2 = Line(bird_bit_upper_line)
v_rail_lower_line = Curve(ln_23)
v_rail_mid_section = Curve(ln_24)
bird_beak_model_3 = Brep(bird_beak_model)
v_rail_rest_line = Curve(ln_22)
len_6 = Length(Curve=bird_bit_lower_line_2)
eval_6 = EvaluateLength(Curve=bird_bit_lower_line_2, Length="0.5", Normalized=True)  # -> Point, Tangent, Parameter
eval_7 = EvaluateLength(Curve=v_rail_upper_line, Length="0.5", Normalized=True)  # -> Point, Tangent, Parameter
len_7 = Length(Curve=v_rail_upper_line)
eval_8 = EvaluateLength(Curve=v_rail_lower_line, Length="0", Normalized=True)  # -> Point, Tangent, Parameter
len_8 = Length(Curve=v_rail_lower_line)
eval_9 = EvaluateLength(Curve=bird_bit_upper_line_2, Length="0", Normalized=True)  # -> Point, Tangent, Parameter
len_9 = Length(Curve=bird_bit_upper_line_2)
yz_2 = YZPlane(Origin=eval_6.Point)
yz_3 = YZPlane(Origin=eval_7.Point)
v_rail_upper_line_2 = Curve(v_rail_upper_line)
v_rail_mid_section_2 = Curve(v_rail_mid_section)
v_rail_rest_line_2 = Curve(v_rail_rest_line)
v_rail_lower_line_2 = Curve(v_rail_lower_line)
yz_4 = YZPlane(Origin=eval_8.Point)
yz_5 = YZPlane(Origin=eval_9.Point)
merge_11 = Merge(Data1=v_rail_upper_line_2, Data2=v_rail_mid_section_2, Data3=v_rail_lower_line_2, Data4=v_rail_rest_line_2)
orient_5 = Orient(Geometry=bird_bit_center_point_2, Source=yz_2, Target=yz_3)  # -> Geometry, Transform
orient_6 = Orient(Geometry=bird_bit_center_point_3, Source=yz_5, Target=yz_4)  # -> Geometry, Transform
orient_7 = Orient(Geometry=bird_beak_model_2, Source=yz_2, Target=yz_3)  # -> Geometry, Transform
orient_8 = Orient(Geometry=bird_beak_model_3, Source=yz_5, Target=yz_4)  # -> Geometry, Transform
join_8 = JoinCurves(Curves=merge_11, Preserve=False)
v_rail_edge_cleanup_depth = Panel(addition_27)
end_point_upper_rail_path = Point(orient_5.Geometry)
end_point_lower_rail_path = Point(orient_6.Geometry)
rail_lowest_point_2 = Point(move_29.Geometry)
rail_profile = Curve(join_8)

# ---- group: Make V bearing profile
rail_rack_and_pinion_material_thickness_5 = Panel(thickness_2)
rail_to_carriage_safety_distance_4 = Panel(rail_to_carriage_safety_distance)
rail_flat_mid_section_heigth_3 = Panel(rail_flat_mid_section_heigth)
v_rail_upper_line_3 = Curve(v_rail_upper_line)
v_rail_lower_line_3 = Curve(v_rail_lower_line)
end_11 = EndPoints(Curve=v_rail_lower_line_3)  # -> Start, End
end_12 = EndPoints(Curve=v_rail_upper_line_3)  # -> Start, End
end_13 = EndPoints(Curve=v_rail_lower_line_3)  # -> Start, End
end_14 = EndPoints(Curve=v_rail_upper_line_3)  # -> Start, End
multiplication_45 = Multiplication(A=rail_to_carriage_safety_distance_4, B="0.5")
multiplication_46 = Multiplication(A=rail_flat_mid_section_heigth_3, B="0.5")
neg_15 = Negative(Value=multiplication_45)
neg_16 = Negative(Value=multiplication_46)
neg_17 = Negative(Value=multiplication_45)
Z_15 = UnitZ(Factor=multiplication_45)
Z_16 = UnitZ(Factor=neg_15)
neg_18 = Negative(Value=multiplication_46)
Z_17 = UnitZ(Factor=multiplication_46)
Z_18 = UnitZ(Factor=neg_16)
move_30 = Move(Geometry=end_11.Start, Motion=Z_15)  # -> Geometry, Transform
move_31 = Move(Geometry=end_12.Start, Motion=Z_16)  # -> Geometry, Transform
Y_11 = UnitY(Factor=neg_17)
move_32 = Move(Geometry=end_13.End, Motion=Z_17)  # -> Geometry, Transform
move_33 = Move(Geometry=end_14.End, Motion=Z_18)  # -> Geometry, Transform
Y_12 = UnitY(Factor=neg_18)
move_34 = Move(Geometry=move_30.Geometry, Motion=Y_11)  # -> Geometry, Transform
move_35 = Move(Geometry=move_31.Geometry, Motion=Y_11)  # -> Geometry, Transform
move_36 = Move(Geometry=move_32.Geometry, Motion=Y_12)  # -> Geometry, Transform
move_37 = Move(Geometry=move_33.Geometry, Motion=Y_12)  # -> Geometry, Transform
rail_rack_and_pinion_material_thickness_6 = Panel(rail_rack_and_pinion_material_thickness_5)
ln_25 = Line(StartPoint=move_34.Geometry, EndPoint=move_36.Geometry)
ln_26 = Line(StartPoint=move_35.Geometry, EndPoint=move_37.Geometry)
pdecon_7 = Deconstruct(Point=move_37.Geometry)  # -> XComponent, YComponent, ZComponent
pdecon_8 = Deconstruct(Point=move_35.Geometry)  # -> XComponent, YComponent, ZComponent
v_bearing_lower_line = Curve(ln_25)
v_bearing_lower_line_2 = Curve(v_bearing_lower_line)
end_15 = EndPoints(Curve=v_bearing_lower_line_2)  # -> Start, End
pt_15 = Point(end_15.Start)
v_bearing_upper_line = Curve(ln_26)
v_bearing_upper_line_2 = Curve(v_bearing_upper_line)
end_16 = EndPoints(Curve=v_bearing_upper_line_2)  # -> Start, End
pt_16 = Point(end_16.Start)
pt_17 = ConstructPoint(XCoordinate=0, YCoordinate=pdecon_8.YComponent, ZCoordinate=0)
pt_18 = ConstructPoint(XCoordinate=0, YCoordinate=pdecon_7.YComponent, ZCoordinate=0)
dist_4 = Distance(PointA=pt_16, PointB=pt_15)
dist_5 = Distance(PointA=pt_17, PointB=pt_18)
subtraction_26 = Subtraction(A=rail_rack_and_pinion_material_thickness_6, B=dist_4)
grove_depth_bearing = Panel(dist_5)
Z_19 = UnitZ(Factor=subtraction_26)
move_38 = Move(Geometry=pt_16, Motion=Z_19)  # -> Geometry, Transform
multiplication_47 = Multiplication(A=rail_to_carriage_safety_distance_4, B="0.5")
ln_27 = Line(StartPoint=move_38.Geometry, EndPoint=pt_16)
Z_20 = UnitZ(Factor=multiplication_47)
move_39 = Move(Geometry=move_37.Geometry, Motion=Z_20)  # -> Geometry, Transform
join_9 = JoinCurves(Curves=[v_bearing_upper_line, v_bearing_lower_line], Preserve=False)
move_40 = Move(Geometry=move_39.Geometry, Motion=X_8)  # -> Geometry, Transform
move_41 = Move(Geometry=move_35.Geometry, Motion=X_8)  # -> Geometry, Transform
move_42 = Move(Geometry=join_9, Motion=X_8)  # -> Geometry, Transform
v_bearing_inside_corner_point = Point(move_40.Geometry)
v_bearing_outer_point = Point(move_41.Geometry)
v_bearing_straight_top_line = Curve(ln_27)
v_bearing_profile = Curve(move_42.Geometry)

# ---- group: Adjust input axis lenght
actual_axis_lenght_first_axis_4 = Panel(actual_axis_lenght_first_axis)
actual_axis_lenght_second_axis = Panel(actual_axis_lenght_lower_gantry_axis)
bolt_placement_axis_4 = Curve(ext_6)
axis_edge_3 = Curve(ext_7)
larger_5 = LargerThan(FirstNumber=actual_axis_lenght_second_axis, SecondNumber=actual_axis_lenght_first_axis_4)  # -> LargerThan, OrEqualTo
subtraction_27 = Subtraction(A=actual_axis_lenght_second_axis, B=actual_axis_lenght_first_axis_4)
ext_8 = ExtendCurve(Curve=axis_edge_3, Type=0, Start="0", End=subtraction_27)
ext_9 = ExtendCurve(Curve=bolt_placement_axis_4, Type=0, Start="0", End=subtraction_27)
total_axis_extension_2 = Panel(total_axis_extension)
extended_bolt_placement_axis = Curve(ext_9)
extended_axis_edge = Curve(ext_8)
bolt_placement_axis_5 = Curve(ext_6)
axis_edge_4 = Curve(axis_edge_3)
addition_28 = Addition(A=actual_axis_lenght_second_axis, B=total_axis_extension_2)
filter_48 = StreamFilter(Gate=larger_5.LargerThan, Stream0=axis_edge_4, Stream1=extended_axis_edge)
filter_49 = StreamFilter(Gate=larger_5.LargerThan, Stream0=bolt_placement_axis_5, Stream1=extended_bolt_placement_axis)
actual_extended_axis_lenght_second_axis = Panel(addition_28)
bolt_placement_axis_6 = Curve(filter_49)
axis_edge_5 = Curve(filter_48)

# ---- group: Make joinery hole planes
wedge_or_bolt_spacing_4 = Panel(wedge_or_bolt_spacing)
wedge_width_to_material_thickness_ratio_4 = Panel(wedge_width_to_material_thickness_ratio)
spacer_diamter_3 = Panel(spacer_diameter_inc_margin)
join_rails_with_dowels_instead_of_bolts_4 = Panel(join_rails_with_dowels_instead_of_bolts_2)
main_material_thickness_6 = Panel(thickness)
bolt_placement_axis_7 = Curve(bolt_placement_axis_6)
multiplication_48 = Multiplication(A=wedge_width_to_material_thickness_ratio_4, B=main_material_thickness_6)
top_wedge_hole_width_3 = Panel(multiplication_48)
bolt_placement_axis_8 = Curve(bolt_placement_axis_7)
filter_50 = StreamFilter(Gate=join_rails_with_dowels_instead_of_bolts_4, Stream0=spacer_diamter_3, Stream1=top_wedge_hole_width_3)
hole_width_2 = Panel(filter_50)
len_10 = Length(Curve=bolt_placement_axis_8)
subtraction_28 = Subtraction(A=len_10, B=hole_width_2)
merge_12 = Merge(Data1=hole_width_2, Data2=subtraction_28)
eval_10 = EvaluateLength(Curve=bolt_placement_axis_8, Length=merge_12, Normalized=Toggle(False))  # -> Point, Tangent, Parameter
shatter_5 = Shatter(Curve=bolt_placement_axis_8, Parameters=eval_10.Parameter)
wedge_or_bolt_spacing_5 = Panel(wedge_or_bolt_spacing_4)
item_24 = ListItem(List=shatter_5, Index="1", Wrap=True)
divide_curve_even_lenght_2 = DivideCurveEvenLenght(crv=item_24, B=wedge_or_bolt_spacing_5)
xy_14 = XYPlane(Origin=divide_curve_even_lenght_2)
xz_8 = XZPlane(Origin=Point(0, 0, 0))
mirror_4 = Mirror(Geometry=xy_14, Plane=xz_8)  # -> Geometry, Transform
hole_planes_top_gantry_layer = Plane(mirror_4.Geometry)

# ---- group: Make wedge holes
wedge_width_to_material_thickness_ratio_5 = Panel(wedge_width_to_material_thickness_ratio_3)
dogbone_corner_reduction_factor = Panel(".66")
join_rails_with_dowels_instead_of_bolts_5 = Panel(join_rails_with_dowels_instead_of_bolts_3)
wedge_hole_margin = Panel("0")
dogbone_margin = Panel("0.05")
main_material_thickness_7 = Panel(main_material_thickness_5)
main_material_bit_4 = Panel(diameter_2)
filter_51 = StreamFilter(Gate=join_rails_with_dowels_instead_of_bolts_5, Stream1=main_material_thickness_7)
main_material_thickness_8 = Panel(filter_51)
multiplication_49 = Multiplication(A=main_material_bit_4, B="0.5")
xy_15 = XYPlane(Origin=Point(0, 0, 0))
dom_4 = ConstructDomain(DomainStart="0.01", DomainEnd="0.99")
addition_29 = Addition(A=multiplication_49, B=dogbone_margin)
constrain_4 = Constrain(Number=dogbone_corner_reduction_factor, Domain=dom_4)
multiplication_50 = Multiplication(A=main_material_thickness_8, B="0.5")
cir_8 = Circle(Plane=xy_15, Radius=addition_29)
addition_30 = Addition(A=multiplication_50, B=wedge_hole_margin)
wedge_width_to_material_thickness_ratio_6 = Panel(wedge_width_to_material_thickness_ratio_5)
multiplication_51 = Multiplication(A=addition_29, B=constrain_4)
main_material_thickness_9 = Panel(main_material_thickness_8)
multiplication_52 = Multiplication(A=main_material_thickness_9, B=wedge_width_to_material_thickness_ratio_6)
multiplication_53 = Multiplication(A=multiplication_52, B="0.5")
multiplication_54 = Multiplication(A=multiplication_51, B="0.5")
multiplication_55 = Multiplication(A=multiplication_51, B="0.5")
addition_31 = Addition(A=addition_30, B=multiplication_54)
addition_32 = Addition(A=addition_30, B=multiplication_55)
neg_19 = Negative(Value=addition_30)
neg_20 = Negative(Value=multiplication_53)
neg_21 = Negative(Value=addition_30)
neg_22 = Negative(Value=addition_32)
subtraction_29 = Subtraction(A=addition_30, B=multiplication_51)
subtraction_30 = Subtraction(A=multiplication_53, B=addition_29)
subtraction_31 = Subtraction(A=addition_30, B=multiplication_51)
subtraction_32 = Subtraction(A=addition_32, B=addition_29)
subtraction_33 = Subtraction(A=addition_30, B=addition_29)
subtraction_34 = Subtraction(A=addition_30, B=multiplication_51)
dom_5 = ConstructDomain(DomainStart=neg_19, DomainEnd=addition_30)
dom_6 = ConstructDomain(DomainStart=neg_20, DomainEnd=multiplication_53)
dom_7 = ConstructDomain(DomainStart=neg_21, DomainEnd=addition_30)
dom_8 = ConstructDomain(DomainStart=neg_22, DomainEnd=addition_32)
X_10 = UnitX(Factor=subtraction_30)
X_11 = UnitX(Factor=subtraction_32)
X_12 = UnitX(Factor=subtraction_33)
neg_23 = Negative(Value=addition_30)
move_43 = Move(Geometry=cir_8, Motion=X_10)  # -> Geometry, Transform
Y_13 = UnitY(Factor=subtraction_29)
move_44 = Move(Geometry=cir_8, Motion=X_11)  # -> Geometry, Transform
Y_14 = UnitY(Factor=subtraction_31)
move_45 = Move(Geometry=cir_8, Motion=X_12)  # -> Geometry, Transform
Y_15 = UnitY(Factor=subtraction_34)
dom_9 = ConstructDomain(DomainStart=neg_23, DomainEnd=addition_30)
rectangle_2 = Rectangle(Plane=xy_15, XSize=dom_6, YSize=dom_5, Radius=0)  # -> Rectangle, Length
rectangle_3 = Rectangle(Plane=xy_15, XSize=dom_8, YSize=dom_7, Radius=0)  # -> Rectangle, Length
move_46 = Move(Geometry=move_43.Geometry, Motion=Y_13)  # -> Geometry, Transform
move_47 = Move(Geometry=move_44.Geometry, Motion=Y_14)  # -> Geometry, Transform
rectangle_4 = Rectangle(Plane=xy_15, XSize=dom_9, YSize=dom_9, Radius=0)  # -> Rectangle, Length
move_48 = Move(Geometry=move_45.Geometry, Motion=Y_15)  # -> Geometry, Transform
ccx_5 = CurveCurve(CurveA=rectangle_2.Rectangle, CurveB=move_46.Geometry)  # -> Points, ParamsA, ParamsB
ccx_6 = CurveCurve(CurveA=rectangle_3.Rectangle, CurveB=move_47.Geometry)  # -> Points, ParamsA, ParamsB
ccx_7 = CurveCurve(CurveA=rectangle_4.Rectangle, CurveB=move_48.Geometry)  # -> Points, ParamsA, ParamsB
shatter_6 = Shatter(Curve=move_46.Geometry, Parameters=ccx_5.ParamsB)
shatter_7 = Shatter(Curve=move_47.Geometry, Parameters=ccx_6.ParamsB)
shatter_8 = Shatter(Curve=move_48.Geometry, Parameters=ccx_7.ParamsB)
item_25 = ListItem(List=shatter_6, Index=0, Wrap=True)  # -> Item, Item1
item_26 = ListItem(List=shatter_7, Index=0, Wrap=True)  # -> Item, Item1
item_27 = ListItem(List=shatter_8, Index=0, Wrap=True)  # -> Item, Item1
join_10 = JoinCurves(Curves=[item_25.Item, item_25.Item1], Preserve=False)
join_11 = JoinCurves(Curves=[item_26.Item, item_26.Item1], Preserve=False)
join_12 = JoinCurves(Curves=[item_27.Item, item_27.Item1], Preserve=False)
corner_curve = Curve(join_10)
corner_curve_2 = Curve(join_11)
corner_curve_3 = Curve(join_12)
yz_6 = YZPlane(Origin=Point(0, 0, 0))
xz_9 = XZPlane(Origin=Point(0, 0, 0))
yz_7 = YZPlane(Origin=Point(0, 0, 0))
xz_10 = XZPlane(Origin=Point(0, 0, 0))
yz_8 = YZPlane(Origin=Point(0, 0, 0))
xz_11 = XZPlane(Origin=Point(0, 0, 0))
mirror_5 = Mirror(Geometry=corner_curve, Plane=xz_9)  # -> Geometry, Transform
mirror_6 = Mirror(Geometry=corner_curve, Plane=yz_6)  # -> Geometry, Transform
mirror_7 = Mirror(Geometry=mirror_5.Geometry, Plane=yz_6)  # -> Geometry, Transform
mirror_8 = Mirror(Geometry=corner_curve_2, Plane=xz_10)  # -> Geometry, Transform
mirror_9 = Mirror(Geometry=corner_curve_2, Plane=yz_7)  # -> Geometry, Transform
mirror_10 = Mirror(Geometry=mirror_8.Geometry, Plane=yz_7)  # -> Geometry, Transform
mirror_11 = Mirror(Geometry=corner_curve_3, Plane=xz_11)  # -> Geometry, Transform
mirror_12 = Mirror(Geometry=corner_curve_3, Plane=yz_8)  # -> Geometry, Transform
mirror_13 = Mirror(Geometry=mirror_11.Geometry, Plane=yz_8)  # -> Geometry, Transform
end_17 = EndPoints(Curve=corner_curve)  # -> Start, End
end_18 = EndPoints(Curve=mirror_5.Geometry)  # -> Start, End
end_19 = EndPoints(Curve=corner_curve)  # -> Start, End
end_20 = EndPoints(Curve=mirror_6.Geometry)  # -> Start, End
end_21 = EndPoints(Curve=corner_curve_2)  # -> Start, End
end_22 = EndPoints(Curve=mirror_8.Geometry)  # -> Start, End
end_23 = EndPoints(Curve=corner_curve_2)  # -> Start, End
end_24 = EndPoints(Curve=mirror_9.Geometry)  # -> Start, End
end_25 = EndPoints(Curve=corner_curve_3)  # -> Start, End
end_26 = EndPoints(Curve=mirror_11.Geometry)  # -> Start, End
end_27 = EndPoints(Curve=corner_curve_3)  # -> Start, End
end_28 = EndPoints(Curve=mirror_12.Geometry)  # -> Start, End
yz_9 = YZPlane(Origin=Point(0, 0, 0))
xz_12 = XZPlane(Origin=Point(0, 0, 0))
ln_28 = Line(StartPoint=end_17.Start, EndPoint=end_18.Start)
ln_29 = Line(StartPoint=end_19.End, EndPoint=end_20.End)
yz_10 = YZPlane(Origin=Point(0, 0, 0))
xz_13 = XZPlane(Origin=Point(0, 0, 0))
ln_30 = Line(StartPoint=end_21.Start, EndPoint=end_22.Start)
ln_31 = Line(StartPoint=end_23.End, EndPoint=end_24.End)
yz_11 = YZPlane(Origin=Point(0, 0, 0))
xz_14 = XZPlane(Origin=Point(0, 0, 0))
ln_32 = Line(StartPoint=end_25.Start, EndPoint=end_26.Start)
ln_33 = Line(StartPoint=end_27.End, EndPoint=end_28.End)
mirror_14 = Mirror(Geometry=ln_28, Plane=yz_9)  # -> Geometry, Transform
mirror_15 = Mirror(Geometry=ln_29, Plane=xz_12)  # -> Geometry, Transform
mirror_16 = Mirror(Geometry=ln_30, Plane=yz_10)  # -> Geometry, Transform
mirror_17 = Mirror(Geometry=ln_31, Plane=xz_13)  # -> Geometry, Transform
mirror_18 = Mirror(Geometry=ln_32, Plane=yz_11)  # -> Geometry, Transform
mirror_19 = Mirror(Geometry=ln_33, Plane=xz_14)  # -> Geometry, Transform
merge_13 = Merge(
    Data1=corner_curve,
    Data2=mirror_5.Geometry,
    Data3=mirror_6.Geometry,
    Data4=mirror_7.Geometry,
    Data5=ln_28,
    Data6=mirror_14.Geometry,
    Data7=ln_29,
    Data8=mirror_15.Geometry)
merge_14 = Merge(
    Data1=corner_curve_2,
    Data2=mirror_8.Geometry,
    Data3=mirror_9.Geometry,
    Data4=mirror_10.Geometry,
    Data5=ln_30,
    Data6=mirror_16.Geometry,
    Data7=ln_31,
    Data8=mirror_17.Geometry)
merge_15 = Merge(
    Data1=corner_curve_3,
    Data2=mirror_11.Geometry,
    Data3=mirror_12.Geometry,
    Data4=mirror_13.Geometry,
    Data5=ln_32,
    Data6=mirror_18.Geometry,
    Data7=ln_33,
    Data8=mirror_19.Geometry)
join_13 = JoinCurves(Curves=merge_13, Preserve=False)
join_14 = JoinCurves(Curves=merge_14, Preserve=False)
join_15 = JoinCurves(Curves=merge_15, Preserve=False)
wedge_hole_top_layer = Curve(join_13)
wedge_hole_mid_layers = Curve(join_14)
wedge_hole_lowest_layer = Curve(join_15)

# ---- group: Make top layer outline
corner_radius_2 = Panel(corner_radius)
extra_precut_with_offset_top_layer_3 = Panel(extra_precut_with_offset_top_layer)
axis_edge_6 = Curve(axis_edge)
Y_16 = UnitY(Factor=extra_precut_with_offset_top_layer_3)
move_49 = Move(Geometry=axis_edge_6, Motion=Y_16)  # -> Geometry, Transform
offset_axis_edge = Curve(move_49.Geometry)
xz_15 = XZPlane(Origin=Point(0, 0, 0))
mirror_20 = Mirror(Geometry=offset_axis_edge, Plane=xz_15)  # -> Geometry, Transform
end_29 = EndPoints(Curve=offset_axis_edge)  # -> Start, End
end_30 = EndPoints(Curve=mirror_20.Geometry)  # -> Start, End
rec_2pt = Rectangle2Pt(Plane=PlaneXY(0, 0, 0), PointA=end_29.Start, PointB=end_30.End, Radius=corner_radius_2)  # -> Rectangle, Length
axis_top_layer_outline = Curve(rec_2pt.Rectangle)

# ----
axis_edge_7 = Curve(axis_edge)
v_rail_edge_cleanup_depth_2 = Panel(v_rail_edge_cleanup_depth)
extra_cutout_depth_2 = Panel(extra_cutout_depth)
addition_33 = Addition(A=v_rail_edge_cleanup_depth_2, B=extra_cutout_depth_2)
neg_24 = Negative(Value=addition_33)
Z_21 = UnitZ(Factor=neg_24)
move_50 = Move(Geometry=axis_edge_7, Motion=Z_21)  # -> Geometry, Transform
Y_17 = UnitY(Factor=multiplication_30)
move_51 = Move(Geometry=move_50.Geometry, Motion=Y_17)  # -> Geometry, Transform
ext_10 = ExtendCurve(Curve=move_51.Geometry, Type=0, Start=rack_teeth_bit_diameter_2, End=rack_teeth_bit_diameter_2)
redpline = Reduce(Polyline=ext_10, Tolerance=1)  # -> Polyline, Reduction
xz_16 = XZPlane(Origin=Point(0, 0, 0))
mirror_21 = Mirror(Geometry=redpline.Polyline, Plane=xz_16)  # -> Geometry, Transform
flip_6 = FlipCurve(Curve=mirror_21.Geometry)  # -> Curve, Flag
merge_16 = Merge(Data1=flip_6.Curve, Data2=redpline.Polyline)
v_reail_edge_cleanup_toolpath = Curve(merge_16)

filter_52 = StreamFilter(Gate=cut_8, Stream1=v_reail_edge_cleanup_toolpath)

# ---- group: Make delta simulation
highest_movement_point_3 = Point(highest_movement_point_2)
arm_lenght_3 = Panel(arm_lenght)
lowest_movement_point_3 = Point(lowest_movement_point_2)
arm_spacing_2 = Panel(arm_spacing)
wrist_point_6 = Point(wrist_point_4)
bottom_point_2 = Point(bottom_point)
shoulder_point_4 = Point(shoulder_point_2)
current_position_point_4 = Point(current_position_point_2)
preview_center_plane_4 = Plane(preview_center_plane)
work_area_outline_2 = Curve(work_area_outline)
center_plate_curve_2 = Curve(center_plate_curve)
xy_16 = XYPlane(Origin=Point(0, 0, 0))
xy_17 = XYPlane(Origin=current_position_point_4)
ln_34 = Line(StartPoint=lowest_movement_point_3, EndPoint=highest_movement_point_3)
orient_9 = Orient(Geometry=ln_34, Source=xy_16, Target=preview_center_plane_4)  # -> Geometry, Transform
rotate_9 = Rotate(Geometry=wrist_point_6, Angle=degrees("120"), Plane=xy_16)  # -> Geometry, Transform
rotate_10 = Rotate(Geometry=wrist_point_6, Angle=degrees("240"), Plane=xy_16)  # -> Geometry, Transform
wrist_point1 = Point(wrist_point_6)
wrist_point2 = Point(rotate_9.Geometry)
wrist_point3 = Point(rotate_10.Geometry)
sph = Sphere(Base=wrist_point3, Radius=arm_lenght_3)
rotate_11 = Rotate(Geometry=orient_9.Geometry, Angle=degrees("120"), Plane=preview_center_plane_4)  # -> Geometry, Transform
sph_2 = Sphere(Base=wrist_point1, Radius=arm_lenght_3)
sph_3 = Sphere(Base=wrist_point2, Radius=arm_lenght_3)
rotate_12 = Rotate(Geometry=orient_9.Geometry, Angle=degrees("240"), Plane=preview_center_plane_4)  # -> Geometry, Transform
orient_10 = Orient(Geometry=wrist_point1, Source=xy_16, Target=xy_17)  # -> Geometry, Transform
orient_11 = Orient(Geometry=wrist_point2, Source=xy_16, Target=xy_17)  # -> Geometry, Transform
orient_12 = Orient(Geometry=wrist_point3, Source=xy_16, Target=xy_17)  # -> Geometry, Transform
orient_13 = Orient(Geometry=sph_2, Source=xy_16, Target=xy_17)  # -> Geometry, Transform
orient_14 = Orient(Geometry=sph_3, Source=xy_16, Target=xy_17)  # -> Geometry, Transform
orient_15 = Orient(Geometry=sph, Source=xy_16, Target=xy_17)  # -> Geometry, Transform
axis3 = Line(rotate_12.Geometry)
axis2 = Line(rotate_11.Geometry)
axis_1 = Line(orient_9.Geometry)
sphere1 = Surface(orient_13.Geometry)
sphere1_2 = Surface(orient_14.Geometry)
sphere1_3 = Surface(orient_15.Geometry)
slx = SurfaceLine(Surface=sphere1_2, Line=axis2, LimitToFirst=False)  # -> Curves, Points, UVPoints, Normal
slx_2 = SurfaceLine(Surface=sphere1_3, Line=axis3, LimitToFirst=False)  # -> Curves, Points, UVPoints, Normal
slx_3 = SurfaceLine(Surface=sphere1, Line=axis_1, LimitToFirst=False)  # -> Curves, Points, UVPoints, Normal
pdecon_9 = Deconstruct(Point=slx.Points)  # -> XComponent, YComponent, ZComponent
pdecon_10 = Deconstruct(Point=slx_2.Points)  # -> XComponent, YComponent, ZComponent
pdecon_11 = Deconstruct(Point=slx_3.Points)  # -> XComponent, YComponent, ZComponent
sort_3 = SortList(Keys=pdecon_9.ZComponent, ValuesA=slx.Points)  # -> Keys, ValuesA
sort_4 = SortList(Keys=pdecon_10.ZComponent, ValuesA=slx_2.Points)  # -> Keys, ValuesA
sort_5 = SortList(Keys=pdecon_11.ZComponent, ValuesA=slx_3.Points)  # -> Keys, ValuesA
rev_4 = ReverseList(List=sort_3.ValuesA)
rev_5 = ReverseList(List=sort_4.ValuesA)
rev_6 = ReverseList(List=sort_5.ValuesA)
item_28 = ListItem(List=rev_4, Index=0, Wrap=True)
item_29 = ListItem(List=rev_5, Index=0, Wrap=True)
item_30 = ListItem(List=rev_6, Index=0, Wrap=True)
lowest_movement_point_4 = Point(lowest_movement_point_3)
highest_movement_point_4 = Point(highest_movement_point_3)
arm_spacing_3 = Panel(arm_spacing_2)
xy_18 = XYPlane(Origin=lowest_movement_point_4)
shoulder_point_axis1 = Point(item_30)
shoulder_point_axis2 = Point(item_28)
shoulder_point_axis3 = Point(item_29)
eval_11 = EvaluateLength(Curve=orient_9.Geometry, Length="0.5", Normalized=True)  # -> Point, Tangent, Parameter
wrist_point1_2 = Point(orient_10.Geometry)
wrist_point2_2 = Point(orient_11.Geometry)
wrist_point3_2 = Point(orient_12.Geometry)
multiplication_56 = Multiplication(A=arm_spacing_3, B="0.5")
shoulder_point_axis1_2 = Point(shoulder_point_axis1)
shoulder_point_axis3_2 = Point(shoulder_point_axis3)
shoulder_point_axis2_2 = Point(shoulder_point_axis2)
Y_18 = UnitY(Factor=multiplication_56)
ln_35 = Line(StartPoint=shoulder_point_axis3, EndPoint=wrist_point3_2)
ln_36 = Line(StartPoint=shoulder_point_axis1, EndPoint=wrist_point1_2)
ln_37 = Line(StartPoint=shoulder_point_axis2, EndPoint=wrist_point2_2)
X_13 = UnitX(Factor=Slider(57, range=0..100))
move_52 = Move(Geometry=eval_11.Point, Motion=Y_18)  # -> Geometry, Transform
project_2 = Project(Geometry=shoulder_point_axis3_2, Plane=xy_18)  # -> Geometry, Transform
project_3 = Project(Geometry=shoulder_point_axis1_2, Plane=xy_18)  # -> Geometry, Transform
project_4 = Project(Geometry=shoulder_point_axis2_2, Plane=xy_18)  # -> Geometry, Transform
Z_22 = UnitZ(Factor=Slider(50, range=0..100))
arm_spacing_4 = Panel(arm_spacing_2)
dist_6 = Distance(PointA=project_2.Geometry, PointB=shoulder_point_axis3_2)
dist_7 = Distance(PointA=project_3.Geometry, PointB=shoulder_point_axis1_2)
dist_8 = Distance(PointA=project_4.Geometry, PointB=shoulder_point_axis2_2)
merge_17 = Merge(Data1=dist_7, Data2=dist_8, Data3=dist_6)
Y_19 = UnitY(Factor=arm_spacing_4)
rotate_13 = Rotate(Geometry=Y_19, Angle=degrees("120"), Plane=PlaneXY(0, 0, 0))  # -> Geometry, Transform
rotate_14 = Rotate(Geometry=Y_19, Angle=degrees("240"), Plane=PlaneXY(0, 0, 0))  # -> Geometry, Transform
orient_16 = Orient(Geometry=work_area_outline_2, Source=xy_16, Target=preview_center_plane_4)  # -> Geometry, Transform
orient_17 = Orient(Geometry=center_plate_curve_2, Source=xy_16, Target=xy_17)  # -> Geometry, Transform
move_53 = Move(Geometry=ln_35, Motion=rotate_14.Geometry)  # -> Geometry, Transform
move_54 = Move(Geometry=ln_37, Motion=rotate_13.Geometry)  # -> Geometry, Transform
move_55 = Move(Geometry=ln_36, Motion=Y_19)  # -> Geometry, Transform
axis_simulation_distances = Panel(merge_17)
center_plate_curve_3 = Curve(orient_17.Geometry)
work_area_outline_3 = Curve(orient_16.Geometry)
crv = Curve([move_55.Geometry, ln_36])
crv_2 = Curve([move_54.Geometry, ln_37])
crv_3 = Curve([move_53.Geometry, ln_35])

# ----
move_56 = Move(Geometry=move_52.Geometry, Motion=Z_22)  # -> Geometry, Transform

# ---- group: Make delta simulation (continued)
move_57 = Move(Geometry=move_56.Geometry, Motion=X_13)  # -> Geometry, Transform
yz_12 = YZPlane(Origin=move_57.Geometry)
xz_17 = XZPlane(Origin=move_57.Geometry)
mirror_22 = Mirror(Geometry=yz_12, Plane=xz_17)  # -> Geometry, Transform
rotate_15 = Rotate(Geometry=mirror_22.Geometry, Angle=degrees("240"), Plane=preview_center_plane_4)  # -> Geometry, Transform
rotate_16 = Rotate(Geometry=mirror_22.Geometry, Angle=degrees("120"), Plane=preview_center_plane_4)  # -> Geometry, Transform
axis_planes = Plane([mirror_22.Geometry, rotate_16.Geometry, rotate_15.Geometry])

# ---- group: Make V bearing geometry
grove_depth_bearing_2 = Panel(grove_depth_bearing)
bearing_bolt_placement_margin_2 = Panel(bearing_bolt_placement_margin)
main_material_thickness_10 = Panel(thickness)
safety_reduction = Panel("1.5")
make_at_least_one_z_axis = Panel(or)
v_contact_length_factor = Panel("1.2")
make_z_axis_side2_3 = Panel(make_z_axis_side2_2)
make_z_axis_side1_3 = Panel(make_z_axis_side1_2)
v_bearing_outer_point_2 = Point(v_bearing_outer_point)
subtraction_35 = Subtraction(A=main_material_thickness_10, B=safety_reduction)
multiplication_57 = Multiplication(A=bearing_bolt_placement_margin_2, B="0.5")
v_bearing_outer_point_3 = Point(v_bearing_outer_point_2)
make_at_least_one_z_axis_2 = Panel(make_at_least_one_z_axis)
indent_depth = Panel(subtraction_35)
grove_depth_bearing_3 = Panel(grove_depth_bearing_2)
xy_19 = XYPlane(Origin=Point(0, 0, 0))
xz_18 = XZPlane(Origin=Point(0, 0, 0))
project_5 = Project(Geometry=v_bearing_outer_point_3, Plane=xy_19)  # -> Geometry, Transform
xy_20 = XYPlane(Origin=Point(0, 0, 0))
addition_34 = Addition(A=grove_depth_bearing_3, B=safety_reduction)
addition_35 = Addition(A=indent_depth, B=multiplication_57)
indent_depth_2 = Panel(addition_34)
indent_depth_3 = Panel(addition_35)
indent_depth_4 = Panel(indent_depth)
neg_25 = Negative(Value=indent_depth_2)
Y_20 = UnitY(Factor=indent_depth_4)
Y_21 = UnitY(Factor=indent_depth_3)
Y_22 = UnitY(Factor=neg_25)
X_14 = UnitX(Factor=neg_25)
yz_13 = YZPlane(Origin=Point(0, 0, 0))
yz_14 = YZPlane(Origin=Point(0, 0, 0))
xy_21 = XYPlane(Origin=Point(0, 0, 0))
xy_22 = XYPlane(Origin=Point(0, 0, 0))
yz_15 = YZPlane(Origin=Point(0, 0, 0))
make_z_axis_side1_4 = Panel(make_z_axis_side1_3)
make_z_axis_side2_4 = Panel(make_z_axis_side2_3)
xz_19 = XZPlane(Origin=Point(0, 0, 0))
make_at_least_one_z_axis_3 = Panel(make_at_least_one_z_axis)
main_material_bit_5 = Panel(diameter_2)

# ---- group: Make Z support wall
main_material_thickness_11 = Panel(thickness)
make_z_axis_side2_5 = Panel(make_z_axis_side2_2)
corner_radius_3 = Panel(corner_radius)
make_z_axis_side1_5 = Panel(make_z_axis_side1_2)
z_support_wall_margin = Panel("1")
assembly_easy_fillet_radius = Panel("1")
bearing_nut_height_inc_spacer_and_margin = Panel(bolt_head_height_inc_spacer_and_margin)
and_20 = GateAnd(A=make_z_axis_side1_5, B=make_z_axis_side2_5)
yz_16 = YZPlane(Origin=Point(0, 0, 0))
filter_53 = StreamFilter(Gate=make_z_axis_side1_5)
filter_54 = StreamFilter(Gate=make_z_axis_side2_5)
make_dual_z_axis = Panel(and_20)
triangle_thickness_ratio = Panel("0.8")
main_material_thickness_12 = Panel(main_material_thickness_11)
assembly_easy_fillet_radius_2 = Panel(assembly_easy_fillet_radius)
multiplication_58 = Multiplication(A=main_material_thickness_12, B=triangle_thickness_ratio)
triangle_offset_distance = Panel(multiplication_58)
multiplication_59 = Multiplication(A=triangle_offset_distance, B="0.5")
main_material_thickness_13 = Panel(main_material_thickness_11)
bridge_ratio = Panel("0.6")
bearing_nut_height_inc_spacer_and_margin_2 = Panel(bearing_nut_height_inc_spacer_and_margin)
main_material_thickness_14 = Panel(main_material_thickness_11)
contact_ratio = Panel("1")
xz_20 = XZPlane(Origin=Point(0, 0, 0))
Y_23 = UnitY(Factor=multiplication_59)
neg_26 = Negative(Value=z_support_wall_margin)
multiplication_60 = Multiplication(A=main_material_thickness_13, B=bridge_ratio)
multiplication_61 = Multiplication(A=main_material_thickness_14, B=contact_ratio)
X_15 = UnitX(Factor=neg_26)
multiplication_62 = Multiplication(A=triangle_offset_distance, B="0.5")
xy_23 = XYPlane(Origin=Point(0, 0, 0))
xy_24 = XYPlane(Origin=Point(0, 0, 0))
corner_radius_4 = Panel(corner_radius_3)
multiplication_63 = Multiplication(A=multiplication_60, B="0.5")
corner_radius_5 = Panel(corner_radius_3)
neg_27 = Negative(Value=multiplication_63)
xz_21 = XZPlane(Origin=Point(0, 0, 0))
make_dual_z_axis_2 = Panel(make_dual_z_axis)
xz_22 = XZPlane(Origin=Point(0, 0, 0))
main_material_bit_6 = Panel(diameter_2)
main_material_bit_7 = Panel(diameter_2)
multiplication_64 = Multiplication(A=main_material_bit_7, B="0.5")
neg_28 = Negative(Value=multiplication_64)

# ---- group: Make Z wall
rail_rack_and_pinion_material_thickness_7 = Panel(thickness_2)
make_at_least_one_z_axis_4 = Panel(or)
main_material_thickness_15 = Panel(thickness)
margin = Panel("3")
carriage_lenght_7 = Panel(carriage_lenght_6)
bearing_nut_height_inc_spacer_and_margin_3 = Panel(bolt_head_height_inc_spacer_and_margin)
number_of_layers_beneath_rack_and_rail_l_4 = Panel(number_of_layers_beneath_rack_and_rail_l_3)  # "Number of layers beneath rack and rail layer"
corner_radius_6 = Panel(corner_radius)
number_of_layers_beneath_rack_and_rail_l_5 = Panel(number_of_layers_beneath_rack_and_rail_l_3)  # "Number of layers beneath rack and rail layer"
margin_2 = Panel("0.7")
motor_width_2 = Panel(motor_width)
motor_pocket_margin = Panel("1")
thickness_underneath_motor_pocket_on_z_w_2 = Panel(thickness_underneath_motor_pocket_on_z_w)  # "Thickness underneath motor pocket on Z wall"
multiplication_65 = Multiplication(A=main_material_thickness_15, B=margin_2)
addition_36 = Addition(A=rail_rack_and_pinion_material_thickness_7, B=margin)
addition_37 = Addition(A=number_of_layers_beneath_rack_and_rail_l_4, B="1")
multiplication_66 = Multiplication(A=carriage_lenght_7, B="0.5")
multiplication_67 = Multiplication(A=motor_width_2, B="0.5")
z_wall_narrow_part_extension = Panel(addition_36)
multiplication_68 = Multiplication(A=main_material_thickness_15, B=addition_37)
addition_38 = Addition(A=multiplication_67, B=motor_pocket_margin)
subtraction_36 = Subtraction(A=main_material_thickness_15, B=thickness_underneath_motor_pocket_on_z_w_2)
larger_6 = LargerThan(FirstNumber=main_material_thickness_15, SecondNumber=thickness_underneath_motor_pocket_on_z_w_2)  # -> LargerThan, OrEqualTo
addition_39 = Addition(A=multiplication_67, B=addition_38)
addition_40 = Addition(A=multiplication_68, B=rail_rack_and_pinion_material_thickness_7)
filter_55 = StreamFilter(Gate=larger_6.LargerThan, Stream0="0", Stream1=thickness_underneath_motor_pocket_on_z_w_2)
filter_56 = StreamFilter(Gate=larger_6.LargerThan, Stream0="0", Stream1=subtraction_36)
addition_41 = Addition(A=addition_39, B=motor_pocket_margin)
addition_42 = Addition(A=addition_38, B=motor_pocket_margin)
neg_29 = Negative(Value=z_wall_narrow_part_extension)
distance_from_top_of_carraige_plate_to_b = Panel(addition_40)  # "Distance from top of carraige plate to bott of Z wall"
motor_top_height = Panel(addition_41)
motor_mid_height = Panel(addition_42)
Y_24 = UnitY(Factor=neg_29)
Z_23 = UnitZ(Factor=filter_55)
X_16 = UnitX(Factor=multiplication_65)
motor_top_height_2 = Panel(motor_top_height)
Y_25 = UnitY(Factor=bearing_nut_height_inc_spacer_and_margin_3)
motor_mid_height_2 = Panel(motor_mid_height)
corner_radius_7 = Panel(corner_radius_6)
xy_25 = XYPlane(Origin=Point(0, 0, 0))
yz_17 = YZPlane(Origin=Point(0, 0, 0))
main_material_bit_8 = Panel(diameter_2)
yz_18 = YZPlane(Origin=Point(0, 0, 0))
z_wall_motor_pocket_depth = Panel(filter_56)

# ----
make_at_least_one_z_axis_5 = Panel(make_at_least_one_z_axis_4)
filter_57 = StreamFilter(Gate=make_at_least_one_z_axis_5, Stream1=xy_25)

# ---- group: Make carriage plate geometry
axis_width_3 = Panel(actual_axis_width_2)
rail_flat_mid_section_heigth_4 = Panel(rail_flat_mid_section_heigth)
carriage_lenght_8 = Panel(carriage_lenght_6)
motor_mount_hole_spacing_2 = Panel(motor_mount_hole_spacing)
motor_mount_hole_diameter_2 = Panel(motor_mount_hole_diameter)
make_motor_mount_holes_millable_with_mai_2 = Panel(make_motor_mount_holes_millable_with_mai)  # "Make motor mount holes millable with main milling bit"
main_material_bit_9 = Panel(diameter_2)
shaft_opening_diameter_2 = Panel(shaft_opening_diameter)
motor_mount_placement_margin_2 = Panel(motor_mount_placement_margin)
bearing_bolt_hole_diameter_2 = Panel(bearing_bolt_hole_diameter)
bearing_bolt_placement_margin_3 = Panel(bearing_bolt_placement_margin)
inner_v_rail_edge_to_bolt_center_distanc_2 = Panel(inner_v_rail_edge_to_bolt_center_distanc)  # "Inner v rail edge to bolt center distance"
v_slide_backside_width_ratio = Panel("1.3")
v_slide_short_side_edge_to_bolt_ratio = Panel("1.8")
corner_radius_8 = Panel(corner_radius)
main_material_thickness_16 = Panel(thickness)
motor_width_3 = Panel(motor_width)
motor_pocket_margin_2 = Panel("5")
main_material_thickness_17 = Panel(thickness)
thickness_underneath_motor_pocket_on_car_2 = Panel(thickness_underneath_motor_pocket_on_car)  # "Thickness underneath motor pocket on carriage"
smaller_5 = SmallerThan(FirstNumber=motor_mount_hole_diameter_2, SecondNumber=main_material_bit_9)  # -> SmallerThan, OrEqualTo
multiplication_69 = Multiplication(A=inner_v_rail_edge_to_bolt_center_distanc_2, B=v_slide_backside_width_ratio)
multiplication_70 = Multiplication(A=inner_v_rail_edge_to_bolt_center_distanc_2, B=v_slide_short_side_edge_to_bolt_ratio)
division_7 = Division(A=motor_width_3, B="8")
multiplication_71 = Multiplication(A=carriage_lenght_8, B="0.5")
addition_43 = Addition(A=axis_width_3, B=rail_flat_mid_section_heigth_4)
multiplication_72 = Multiplication(A=main_material_bit_9, B="1.02")
addition_44 = Addition(A=inner_v_rail_edge_to_bolt_center_distanc_2, B=multiplication_69)
and_21 = GateAnd(A=make_motor_mount_holes_millable_with_mai_2, B=smaller_5.SmallerThan)
addition_45 = Addition(A=motor_width_3, B=motor_pocket_margin_2)
multiplication_73 = Multiplication(A=addition_43, B="0.5")
distance_from_rail_edge_to_slide_edge = Panel(addition_44)
subtraction_37 = Subtraction(A=main_material_thickness_17, B=thickness_underneath_motor_pocket_on_car_2)
larger_7 = LargerThan(FirstNumber=main_material_thickness_17, SecondNumber=thickness_underneath_motor_pocket_on_car_2)  # -> LargerThan, OrEqualTo
addition_46 = Addition(A=addition_45, B=motor_mount_placement_margin_2)
multiplication_74 = Multiplication(A=addition_45, B="0.5")
distance_from_rail_edge_to_slide_edge_2 = Panel(distance_from_rail_edge_to_slide_edge)
distance_to_rail_edge = Panel(multiplication_73)
multiplication_75 = Multiplication(A=addition_46, B="0.5")
multiplication_76 = Multiplication(A=motor_width_3, B="0.5")
filter_58 = StreamFilter(Gate=larger_7.LargerThan, Stream0="0", Stream1=subtraction_37)
neg_30 = Negative(Value=multiplication_74)
neg_31 = Negative(Value=multiplication_76)
neg_32 = Negative(Value=multiplication_75)
neg_33 = Negative(Value=multiplication_76)
inner_v_rail_edge_to_bolt_center_distanc_3 = Panel(inner_v_rail_edge_to_bolt_center_distanc)  # "Inner v rail edge to bolt center distance"
multiplication_77 = Multiplication(A=main_material_thickness_16, B="0.5")
distance_to_rail_edge_2 = Panel(multiplication_73)
addition_47 = Addition(A=distance_to_rail_edge, B=distance_from_rail_edge_to_slide_edge_2)
xy_26 = XYPlane(Origin=Point(0, 0, 0))
pt_19 = ConstructPoint(XCoordinate=multiplication_74, YCoordinate=multiplication_75, ZCoordinate=0)
pt_20 = ConstructPoint(XCoordinate=neg_30, YCoordinate=neg_32, ZCoordinate=0)
pt_21 = ConstructPoint(XCoordinate=neg_31, YCoordinate=neg_33, ZCoordinate=0)
pt_22 = ConstructPoint(XCoordinate=multiplication_76, YCoordinate=multiplication_76, ZCoordinate=0)
addition_48 = Addition(A=inner_v_rail_edge_to_bolt_center_distanc_2, B=multiplication_70)
motor_mount_hole_spacing_3 = Panel(motor_mount_hole_spacing_2)
neg_34 = Negative(Value=addition_47)
neg_35 = Negative(Value=multiplication_71)
filter_59 = StreamFilter(Gate=and_21, Stream0=motor_mount_hole_diameter_2, Stream1=multiplication_72)
addition_49 = Addition(A=multiplication_77, B=main_material_thickness_16)
subtraction_38 = Subtraction(A=multiplication_71, B=multiplication_77)
multiplication_78 = Multiplication(A=addition_48, B="0.5")
rec_2pt_2 = Rectangle2Pt(Plane=xy_26, PointA=pt_19, PointB=pt_20, Radius=0)  # -> Rectangle, Length
multiplication_79 = Multiplication(A=carriage_lenght_8, B="0.5")
pt_23 = ConstructPoint(XCoordinate=multiplication_71, YCoordinate=addition_47, ZCoordinate=0)
pt_24 = ConstructPoint(XCoordinate=neg_35, YCoordinate=neg_34, ZCoordinate=0)
rec_2pt_3 = Rectangle2Pt(Plane=xy_26, PointA=pt_22, PointB=pt_21, Radius=0)  # -> Rectangle, Length
edge_off_support_wall = Panel(subtraction_38)
subtraction_39 = Subtraction(A=distance_to_rail_edge, B=addition_49)
addition_50 = Addition(A=distance_to_rail_edge_2, B=inner_v_rail_edge_to_bolt_center_distanc_3)
subtraction_40 = Subtraction(A=multiplication_79, B=multiplication_78)
multiplication_80 = Multiplication(A=motor_mount_hole_spacing_3, B="0.5")
shaft_opening_diameter_3 = Panel(shaft_opening_diameter_2)
xy_27 = XYPlane(Origin=Point(0, 0, 0))
filter_60 = StreamFilter(Gate=larger_7.LargerThan, Stream1=rec_2pt_2.Rectangle)
motor_mount_hole_diameter_3 = Panel(filter_59)
motor_mount_placement_margin_3 = Panel(motor_mount_placement_margin_2)
cp = ControlPoints(Curve=rec_2pt_3.Rectangle)  # -> Points, Weights, Knots
bolt_placement_margin = Panel(bearing_bolt_placement_margin_3)
bearing_bolt_hole_diameter_3 = Panel(bearing_bolt_hole_diameter_2)
pt_25 = ConstructPoint(XCoordinate=subtraction_40, YCoordinate=addition_50, ZCoordinate=0)
neg_36 = Negative(Value=subtraction_39)
pt_26 = ConstructPoint(XCoordinate=multiplication_80, YCoordinate=multiplication_80, ZCoordinate=0)
neg_37 = Negative(Value=edge_off_support_wall)
rec_2pt_4 = Rectangle2Pt(Plane=xy_27, PointA=pt_23, PointB=pt_24, Radius=corner_radius_8)  # -> Rectangle, Length
make_at_least_one_z_axis_6 = Panel(make_at_least_one_z_axis)
xy_28 = XYPlane(Origin=cp.Points)
xy_29 = XYPlane(Origin=pt_25)
xz_23 = XZPlane(Origin=pt_25)
xy_30 = XYPlane(Origin=pt_26)
xz_24 = XZPlane(Origin=pt_26)
cir_9 = Circle(Plane=xy_28, Radius=division_7)
pt_27 = ConstructPoint(XCoordinate=neg_37, YCoordinate=neg_36, ZCoordinate=0)
multiplication_81 = Multiplication(A=shaft_opening_diameter_3, B="0.5")
xy_31 = XYPlane(Origin=Point(0, 0, 0))
multiplication_82 = Multiplication(A=bolt_placement_margin, B="0.5")
multiplication_83 = Multiplication(A=bearing_bolt_hole_diameter_3, B="0.5")
multiplication_84 = Multiplication(A=motor_mount_placement_margin_3, B="0.5")
multiplication_85 = Multiplication(A=motor_mount_hole_diameter_3, B="0.5")
main_material_bit_10 = Panel(diameter_2)
trim = TrimWithRegions(Curve=rec_2pt_3.Rectangle, Regions=cir_9)  # -> Inside, Outside
filter_61 = StreamFilter(Gate=make_at_least_one_z_axis_6, Stream1=pt_27)
arc = Arc(Plane=xy_29, Radius=multiplication_83, Angle=Domain(0, 3.141592654))  # -> Arc, Length
arc_2 = Arc(Plane=xy_31, Radius=multiplication_81, Angle=Domain(0, 3.141592654))  # -> Arc, Length
arc_3 = Arc(Plane=xy_30, Radius=multiplication_85, Angle=Domain(0, 3.141592654))  # -> Arc, Length
Y_26 = UnitY(Factor=multiplication_82)
Y_27 = UnitY(Factor=multiplication_84)
xy_32 = XYPlane(Origin=filter_61)
end_31 = EndPoints(Curve=trim.Outside)  # -> Start, End
move_58 = Move(Geometry=arc.Arc, Motion=Y_26)  # -> Geometry, Transform
move_59 = Move(Geometry=arc_2.Arc, Motion=Y_27)  # -> Geometry, Transform
carriage_outline = Curve(rec_2pt_4.Rectangle)
move_60 = Move(Geometry=arc_3.Arc, Motion=Y_27)  # -> Geometry, Transform
xz_25 = XZPlane(Origin=Point(0, 0, 0))
rectangle_5 = Rectangle(Plane=xy_32, XSize=main_material_thickness_16, YSize=main_material_thickness_16, Radius=0)  # -> Rectangle, Length
dogbone_maker = DogboneMaker(
    curves_to_dogbone=rectangle_5.Rectangle,
    milling_bit_diameter=main_material_bit_10,
    corner_angle_threshold=120,
    flip_cornes_boolean=Toggle(True))
weave_2 = Weave(Pattern=[0, 1], Stream0=end_31.Start, Stream1=end_31.End, NullGaps=False)
mirror_23 = Mirror(Geometry=move_58.Geometry, Plane=xz_23)  # -> Geometry, Transform
mirror_24 = Mirror(Geometry=move_59.Geometry, Plane=xz_25)  # -> Geometry, Transform
mirror_25 = Mirror(Geometry=move_60.Geometry, Plane=xz_24)  # -> Geometry, Transform
pline_2 = PolyLine(Vertices=weave_2, Closed=True)
end_32 = EndPoints(Curve=mirror_23.Geometry)  # -> Start, End
end_33 = EndPoints(Curve=move_58.Geometry)  # -> Start, End
end_34 = EndPoints(Curve=mirror_24.Geometry)  # -> Start, End
end_35 = EndPoints(Curve=mirror_25.Geometry)  # -> Start, End
end_36 = EndPoints(Curve=move_59.Geometry)  # -> Start, End
end_37 = EndPoints(Curve=move_60.Geometry)  # -> Start, End
main_material_bit_11 = Panel(diameter_2)
ln_38 = Line(StartPoint=end_32.Start, EndPoint=end_33.Start)
ln_39 = Line(StartPoint=end_32.End, EndPoint=end_33.End)
yz_19 = YZPlane(Origin=Point(0, 0, 0))
ln_40 = Line(StartPoint=end_34.Start, EndPoint=end_36.Start)
ln_41 = Line(StartPoint=end_34.End, EndPoint=end_36.End)
ln_42 = Line(StartPoint=end_35.Start, EndPoint=end_37.Start)
ln_43 = Line(StartPoint=end_35.End, EndPoint=end_37.End)
make_z_axis_side1_6 = Panel(make_z_axis_side1_3)
make_z_axis_side2_6 = Panel(make_z_axis_side2_3)
mirror_26 = Mirror(Geometry=dogbone_maker, Plane=yz_19)  # -> Geometry, Transform
merge_18 = Merge(Data1=ln_38, Data2=ln_39, Data3=mirror_23.Geometry, Data4=move_58.Geometry)
merge_19 = Merge(Data1=ln_40, Data2=ln_41, Data3=mirror_24.Geometry, Data4=move_59.Geometry)
merge_20 = Merge(Data1=ln_42, Data2=ln_43, Data3=mirror_25.Geometry, Data4=move_60.Geometry)
xz_26 = XZPlane(Origin=Point(0, 0, 0))
join_16 = JoinCurves(Curves=merge_18, Preserve=False)
yz_20 = YZPlane(Origin=Point(0, 0, 0))
join_17 = JoinCurves(Curves=merge_19, Preserve=False)
join_18 = JoinCurves(Curves=merge_20, Preserve=False)
yz_21 = YZPlane(Origin=Point(0, 0, 0))
mirror_27 = Mirror(Geometry=[mirror_26.Geometry, dogbone_maker], Plane=xz_26)  # -> Geometry, Transform
make_at_least_one_z_axis_7 = Panel(make_at_least_one_z_axis)
mirror_28 = Mirror(Geometry=join_16, Plane=yz_20)  # -> Geometry, Transform
mirror_29 = Mirror(Geometry=join_18, Plane=yz_21)  # -> Geometry, Transform
xz_27 = XZPlane(Origin=Point(0, 0, 0))
filter_62 = StreamFilter(Gate=make_z_axis_side1_6, Stream1=[dogbone_maker, mirror_26.Geometry])
filter_63 = StreamFilter(Gate=make_z_axis_side2_6, Stream1=mirror_27.Geometry)
xz_28 = XZPlane(Origin=Point(0, 0, 0))
mirror_30 = Mirror(Geometry=[mirror_29.Geometry, join_18], Plane=xz_28)  # -> Geometry, Transform
mirror_31 = Mirror(Geometry=[mirror_28.Geometry, join_16], Plane=xz_27)  # -> Geometry, Transform
merge_21 = Merge(Data1=filter_62, Data2=filter_63)
carriage_motor_pocket_depth = Panel(filter_58)
motor_shaft_hole = Curve(join_17)
z_support_wall_holes = Curve(merge_21)
motor_mount_holes = Curve([mirror_30.Geometry, mirror_29.Geometry, join_18])
bolt_holes = Curve([mirror_31.Geometry, mirror_28.Geometry, join_16])
motor_pocket = Curve(filter_60)
motor_outline = Curve(pline_2)

# ---- group: Make V bearing geometry (continued)
inner_v_rail_edge_to_bolt_center_distanc_4 = Panel(inner_v_rail_edge_to_bolt_center_distanc_2)  # "Inner v rail edge to bolt center distance"
pt_28 = Point(pt_23)
panel_8 = Panel(multiplication_78)
mirror_32 = Mirror(Geometry=pt_28, Plane=xz_18)  # -> Geometry, Transform
corner_radius_9 = Panel(corner_radius_8)
panel_9 = Panel(panel_8)
multiplication_86 = Multiplication(A=inner_v_rail_edge_to_bolt_center_distanc_4, B="2")
rec_2pt_5 = Rectangle2Pt(Plane=xy_20, PointA=project_5.Geometry, PointB=mirror_32.Geometry, Radius=0)  # -> Rectangle, Length
rec_2pt_6 = Rectangle2Pt(Plane=xy_20, PointA=project_5.Geometry, PointB=mirror_32.Geometry, Radius=corner_radius_9)  # -> Rectangle, Length
slide_outline = Curve(rec_2pt_5.Rectangle)
filter_64 = StreamFilter(Gate=make_at_least_one_z_axis_2, Stream1=rec_2pt_5.Rectangle)
addition_51 = Addition(A=panel_9, B=multiplication_86)
multiplication_87 = Multiplication(A=panel_9, B=v_contact_length_factor)
explode = Explode(Curve=filter_64, Recursive=True)  # -> Segments, Vertices
explode_2 = Explode(Curve=slide_outline, Recursive=True)  # -> Segments, Vertices
subtraction_41 = Subtraction(A=addition_51, B=safety_reduction)
distance_from_edge_to_rail_indent_start = Panel(multiplication_87)
distance_from_edge_to_indent_start = Panel(addition_51)
item_31 = ListItem(List=explode_2.Segments, Index="2", Wrap=True)
distance_from_edge_to_indent_start_2 = Panel(subtraction_41)
item_32 = ListItem(List=explode.Segments, Index=0, Wrap=True)
eval_12 = EvaluateLength(Curve=item_31, Length=distance_from_edge_to_rail_indent_start, Normalized=Toggle(False))  # -> Point, Tangent, Parameter
eval_13 = EvaluateLength(Curve=item_32, Length=distance_from_edge_to_indent_start, Normalized=Toggle(False))  # -> Point, Tangent, Parameter
eval_14 = EvaluateLength(Curve=item_32, Length=distance_from_edge_to_indent_start_2, Normalized=Toggle(False))  # -> Point, Tangent, Parameter
move_61 = Move(Geometry=eval_12.Point, Motion=Y_22)  # -> Geometry, Transform
move_62 = Move(Geometry=eval_13.Point, Motion=Y_20)  # -> Geometry, Transform
move_63 = Move(Geometry=eval_14.Point, Motion=Y_21)  # -> Geometry, Transform
move_64 = Move(Geometry=move_61.Geometry, Motion=X_14)  # -> Geometry, Transform
mirror_33 = Mirror(Geometry=move_62.Geometry, Plane=yz_13)  # -> Geometry, Transform
mirror_34 = Mirror(Geometry=move_63.Geometry, Plane=yz_14)  # -> Geometry, Transform
merge_22 = Merge(Data1=eval_12.Point, Data2=move_64.Geometry)
rec_2pt_7 = Rectangle2Pt(Plane=xy_21, PointA=eval_13.Point, PointB=mirror_33.Geometry, Radius=0)  # -> Rectangle, Length
rec_2pt_8 = Rectangle2Pt(Plane=xy_22, PointA=eval_14.Point, PointB=mirror_34.Geometry, Radius=0)  # -> Rectangle, Length
mirror_35 = Mirror(Geometry=merge_22, Plane=yz_15)  # -> Geometry, Transform
rev_7 = ReverseList(List=merge_22)
mirror_36 = Mirror(Geometry=rec_2pt_7.Rectangle, Plane=xz_19)  # -> Geometry, Transform
pline_3 = PolyLine(Vertices=[rev_7, mirror_35.Geometry], Closed=True)
slide_outline_with_radius = Curve(rec_2pt_6.Rectangle)
filter_65 = StreamFilter(Gate=make_z_axis_side1_4, Stream1=rec_2pt_7.Rectangle)
filter_66 = StreamFilter(Gate=make_z_axis_side2_4, Stream1=mirror_36.Geometry)
slide_indent = Curve(pline_3)
merge_23 = Merge(Data1=filter_65, Data2=filter_66)
rdiff = RegionDifference(CurvesA=slide_outline_with_radius, CurvesB=slide_indent)
axis_cutouts = Curve(merge_23)
rdiff_2 = RegionDifference(CurvesA=rdiff, CurvesB=rec_2pt_8.Rectangle)
dogbone_maker_2 = DogboneMaker(
    curves_to_dogbone=rdiff_2,
    milling_bit_diameter=main_material_bit_5,
    corner_angle_threshold=120,
    flip_cornes_boolean=Toggle(False))
filter_67 = StreamFilter(Gate=make_at_least_one_z_axis_3, Stream0=rdiff, Stream1=dogbone_maker_2)
slide_outline_with_radius_2 = Curve(filter_67)
bolt_holes_slide = Curve(mirror_31.Geometry)

# ---- group: Make Z wall (continued)
mid_cutout = Curve(rec_2pt_7.Rectangle)
filter_68 = StreamFilter(Gate=make_at_least_one_z_axis_4, Stream1=mid_cutout)
explode_3 = Explode(Curve=filter_68, Recursive=True)  # -> Segments, Vertices
item_33 = ListItem(List=explode_3.Vertices, Index="1", Wrap=True)
item_34 = ListItem(List=explode_3.Vertices, Index="2", Wrap=True)
move_65 = Move(Geometry=item_33, Motion=Y_24)  # -> Geometry, Transform
move_66 = Move(Geometry=item_34, Motion=X_16)  # -> Geometry, Transform
pdecon_12 = Deconstruct(Point=item_34)  # -> XComponent, YComponent, ZComponent
pdecon_13 = Deconstruct(Point=item_34)  # -> XComponent, YComponent, ZComponent
move_67 = Move(Geometry=move_66.Geometry, Motion=Y_25)  # -> Geometry, Transform
pdecon_14 = Deconstruct(Point=move_65.Geometry)  # -> XComponent, YComponent, ZComponent
pdecon_15 = Deconstruct(Point=move_65.Geometry)  # -> XComponent, YComponent, ZComponent
subtraction_42 = Subtraction(A=pdecon_13.YComponent, B=distance_from_top_of_carraige_plate_to_b)
addition_52 = Addition(A=motor_top_height_2, B=pdecon_12.YComponent)
pdecon_16 = Deconstruct(Point=move_67.Geometry)  # -> XComponent, YComponent, ZComponent
pt_29 = ConstructPoint(XCoordinate=0, YCoordinate=subtraction_42, ZCoordinate=0)
pt_30 = ConstructPoint(XCoordinate=multiplication_66, YCoordinate=subtraction_42, ZCoordinate=0)
pt_31 = ConstructPoint(XCoordinate=pdecon_15.XComponent, YCoordinate=subtraction_42, ZCoordinate=0)
pt_32 = ConstructPoint(XCoordinate=multiplication_66, YCoordinate=pdecon_14.YComponent, ZCoordinate=0)
pt_33 = ConstructPoint(XCoordinate=multiplication_66, YCoordinate=pdecon_16.YComponent, ZCoordinate=0)
pt_34 = ConstructPoint(XCoordinate=multiplication_66, YCoordinate=addition_52, ZCoordinate=0)
pt_35 = ConstructPoint(XCoordinate=0, YCoordinate=addition_52, ZCoordinate=0)
pt_36 = Point(pt_31)
z_support_wall_hole = Curve(mirror_26.Geometry)
addition_53 = Addition(A=motor_mid_height_2, B=pdecon_13.YComponent)
pt_37 = Point(move_65.Geometry)
pt_38 = Point(pt_32)
pt_39 = Point(pt_34)
pt_40 = Point(move_66.Geometry)
pt_41 = Point(item_34)
pt_42 = Point(pt_30)
pt_43 = Point(pt_33)
pt_44 = Point(move_67.Geometry)
pt_45 = Point(pt_35)
pt_46 = Point(pt_29)
pt_47 = ConstructPoint(XCoordinate=0, YCoordinate=addition_53, ZCoordinate=0)
area_3 = Area(Geometry=z_support_wall_hole)  # -> Area, Centroid
xy_33 = XYPlane(Origin=pt_47)
merge_24 = Merge(Data1=pt_45, Data2=pt_39, Data3=pt_43, Data4=pt_44, Data5=pt_40, Data6=pt_41, Data8=pt_36, Data10=pt_46)
pt_48 = Point(item_34)
pdecon_17 = Deconstruct(Point=area_3.Centroid)  # -> XComponent, YComponent, ZComponent
rotate_17 = Rotate(Geometry=xy_33, Angle=1.570796327, Plane=xy_33)  # -> Geometry, Transform
pt_49 = ConstructPoint(XCoordinate=pdecon_17.XComponent, YCoordinate=addition_53, ZCoordinate=0)
pdecon_18 = Deconstruct(Point=pt_48)  # -> XComponent, YComponent, ZComponent
pline_4 = PolyLine(Vertices=merge_24, Closed=False)
motor_shaft_hole_2 = Curve(motor_shaft_hole)
motor_mount_holes_2 = Curve(motor_mount_holes)
pt_50 = ConstructPoint(XCoordinate=0, YCoordinate=pdecon_18.YComponent, ZCoordinate=0)
z_wall_outline = Curve(pline_4)
crv_cp = CurveClosestPoint(Point=pt_39, Curve=z_wall_outline)  # -> Point, Parameter, Distance
fillet = Fillet(Curve=z_wall_outline, Parameter=crv_cp.Parameter, Radius=corner_radius_7)  # -> Curve, Parameter
vec2pt = Vector2Pt(PointA=area_3.Centroid, PointB=pt_49, Unitize=False)  # -> Vector, Length
move_68 = Move(Geometry=rotate_17.Geometry, Motion=Z_23)  # -> Geometry, Transform
crv_cp_2 = CurveClosestPoint(Point=pt_43, Curve=fillet.Curve)  # -> Point, Parameter, Distance
xy_34 = XYPlane(Origin=pt_50)
motor_pocket_2 = Curve(filter_60)
move_69 = Move(Geometry=z_support_wall_hole, Motion=vec2pt.Vector)  # -> Geometry, Transform
fillet_2 = Fillet(Curve=fillet.Curve, Parameter=crv_cp_2.Parameter, Radius=corner_radius_7)  # -> Curve, Parameter
mirror_37 = Mirror(Geometry=move_69.Geometry, Plane=yz_17)  # -> Geometry, Transform
orient_18 = Orient(Geometry=motor_pocket_2, Source=filter_57, Target=rotate_17.Geometry)  # -> Geometry, Transform
orient_19 = Orient(Geometry=[motor_shaft_hole_2, motor_mount_holes_2], Source=filter_57, Target=rotate_17.Geometry)  # -> Geometry, Transform
crv_cp_3 = CurveClosestPoint(Point=pt_38, Curve=fillet_2.Curve)  # -> Point, Parameter, Distance
fillet_3 = Fillet(Curve=fillet_2.Curve, Parameter=crv_cp_3.Parameter, Radius=corner_radius_7)  # -> Curve, Parameter
crv_cp_4 = CurveClosestPoint(Point=pt_42, Curve=fillet_3.Curve)  # -> Point, Parameter, Distance
clean = CleanTree(RemoveNulls=True, RemoveInvalid=True, RemoveEmpty=False, Tree=[mirror_37.Geometry, move_69.Geometry])
fillet_4 = Fillet(Curve=fillet_3.Curve, Parameter=crv_cp_4.Parameter, Radius=corner_radius_7)  # -> Curve, Parameter
mirror_38 = Mirror(Geometry=fillet_4.Curve, Plane=yz_18)  # -> Geometry, Transform
join_19 = JoinCurves(Curves=[fillet_4.Curve, mirror_38.Geometry], Preserve=False)
dogbone_maker_3 = DogboneMaker(
    curves_to_dogbone=join_19,
    milling_bit_diameter=main_material_bit_8,
    corner_angle_threshold=120,
    flip_cornes_boolean=Toggle(False))
z_wall_outline_with_filets = Curve(dogbone_maker_3)
z_wall_motor_pocket = Curve(orient_18.Geometry)
z_support_wall_holes_2 = Curve(clean)
z_wall_motor_holes = Curve(orient_19.Geometry)
motor_plane = Plane(move_68.Geometry)
origin_plane = Plane(xy_34)

# ---- group: Make Z support wall (continued)
z_support_wall_hole_2 = Curve(rectangle_5.Rectangle)
mirror_39 = Mirror(Geometry=z_support_wall_hole_2, Plane=yz_16)  # -> Geometry, Transform
z_support_wall_hole_3 = Curve(mirror_39.Geometry)
explode_4 = Explode(Curve=mirror_39.Geometry, Recursive=True)  # -> Segments, Vertices
motor_top_height_3 = Panel(motor_top_height)
pt_51 = Point(item_34)
item_35 = ListItem(List=explode_4.Vertices, Index="1", Wrap=True)
explode_5 = Explode(Curve=z_support_wall_hole_3, Recursive=True)  # -> Segments, Vertices
pdecon_19 = Deconstruct(Point=pt_51)  # -> XComponent, YComponent, ZComponent
addition_54 = Addition(A=pdecon_19.YComponent, B=main_material_thickness_11)
pdecon_20 = Deconstruct(Point=item_35)  # -> XComponent, YComponent, ZComponent
subtraction_43 = Subtraction(A=pdecon_20.XComponent, B=motor_top_height_3)
subtraction_44 = Subtraction(A=pdecon_20.XComponent, B=main_material_thickness_11)
item_36 = ListItem(List=explode_5.Vertices, Index="0", Wrap=True)
item_37 = ListItem(List=explode_5.Vertices, Index="3", Wrap=True)
crv_cp_5 = CurveClosestPoint(Point=item_36, Curve=z_support_wall_hole_3)  # -> Point, Parameter, Distance
pt_52 = ConstructPoint(XCoordinate=subtraction_43, YCoordinate=addition_54, ZCoordinate=0)
pt_53 = ConstructPoint(XCoordinate=subtraction_43, YCoordinate=pdecon_19.YComponent, ZCoordinate=0)
pt_54 = ConstructPoint(XCoordinate=pdecon_20.XComponent, YCoordinate=pdecon_19.YComponent, ZCoordinate=0)
pt_55 = ConstructPoint(XCoordinate=pdecon_20.XComponent, YCoordinate=0, ZCoordinate=0)
pt_56 = ConstructPoint(XCoordinate=subtraction_44, YCoordinate=0, ZCoordinate=0)
item_38 = ListItem(List=explode_5.Vertices, Index="1", Wrap=True)
fillet_5 = Fillet(Curve=z_support_wall_hole_3, Parameter=crv_cp_5.Parameter, Radius=assembly_easy_fillet_radius_2)  # -> Curve, Parameter
mid_top_point = Point(pt_56)
top_inner_point = Point(pt_52)
hole_corner = Point(item_38)
top_point = Point(pt_53)
top_point_2 = Point(top_point)
mirror_40 = Mirror(Geometry=top_point_2, Plane=xz_20)  # -> Geometry, Transform
mid_point = Point(pt_55)
corner_point_2 = Point(pt_54)
move_70 = Move(Geometry=mid_point, Motion=Y_23)  # -> Geometry, Transform
motor_mid_height_3 = Panel(motor_mid_height)
crv_cp_6 = CurveClosestPoint(Point=item_37, Curve=fillet_5.Curve)  # -> Point, Parameter, Distance
pdecon_21 = Deconstruct(Point=hole_corner)  # -> XComponent, YComponent, ZComponent
corner_point_3 = Point(corner_point_2)
other_top_point = Point(mirror_40.Geometry)
top_point_3 = Point(top_point_2)
mid_point_2 = Point(move_70.Geometry)
fillet_6 = Fillet(Curve=fillet_5.Curve, Parameter=crv_cp_6.Parameter, Radius=assembly_easy_fillet_radius_2)  # -> Curve, Parameter
merge_25 = Merge(Data1=flatten(mid_point), Data2=flatten(corner_point_2), Data3=flatten(top_point))
subtraction_45 = Subtraction(A=pdecon_21.YComponent, B=multiplication_61)
merge_26 = Merge(Data1=flatten(mid_point), Data2=flatten(mid_top_point), Data3=flatten(top_inner_point), Data4=flatten(top_point))
ln_44 = Line(StartPoint=mid_point, EndPoint=corner_point_2)
ln_45 = Line(StartPoint=corner_point_2, EndPoint=top_point)
ln_46 = Line(StartPoint=top_inner_point, EndPoint=mid_top_point)
subtraction_46 = Subtraction(A=pdecon_21.XComponent, B=bearing_nut_height_inc_spacer_and_margin_2)
ln_47 = Line(StartPoint=top_point_3, EndPoint=mid_point_2)
subtraction_47 = Subtraction(A=pdecon_20.XComponent, B=motor_mid_height_3)
move_71 = Move(Geometry=fillet_6.Curve, Motion=X_15)  # -> Geometry, Transform
item_39 = ListItem(List=explode_5.Segments, Index="1", Wrap=True)
corner_point_4 = Point(corner_point_2)
pt_57 = ConstructPoint(XCoordinate=subtraction_46, YCoordinate=subtraction_45, ZCoordinate=0)
ext_11 = ExtendCurve(Curve=ln_46, Type=0, Start=triangle_offset_distance, End=triangle_offset_distance)
ext_12 = ExtendCurve(Curve=ln_44, Type=0, Start=triangle_offset_distance, End=triangle_offset_distance)
ext_13 = ExtendCurve(Curve=ln_45, Type=0, Start=triangle_offset_distance, End=triangle_offset_distance)
pline_5 = PolyLine(Vertices=merge_26, Closed=False)
ext_14 = ExtendCurve(Curve=ln_47, Type=0, Start=triangle_offset_distance, End=triangle_offset_distance)
ext_15 = ExtendCurve(Curve=ln_45, Type=0, Start=triangle_offset_distance, End=triangle_offset_distance)
pt_58 = ConstructPoint(XCoordinate=subtraction_47, YCoordinate=pdecon_19.YComponent, ZCoordinate=0)
ext_16 = ExtendCurve(Curve=ln_44, Type=0, Start=triangle_offset_distance, End=triangle_offset_distance)
pline_6 = PolyLine(Vertices=merge_25, Closed=False)
eval_15 = EvaluateLength(Curve=item_39, Length="0.5", Normalized=True)  # -> Point, Tangent, Parameter
offset_5 = Offset(Curve=ext_16, Distance=triangle_offset_distance, Plane=PlaneXY(0, 0, 0), Corners=1)
rec_2pt_9 = Rectangle2Pt(Plane=xy_24, PointA=other_top_point, PointB=corner_point_3, Radius=0)  # -> Rectangle, Length
offset_6 = Offset(Curve=ext_15, Distance=triangle_offset_distance, Plane=PlaneXY(0, 0, 0), Corners=1)
offset_7 = Offset(Curve=ext_14, Distance=multiplication_62, Plane=PlaneXY(0, 0, 0), Corners=1)
offset_8 = Offset(Curve=ext_12, Distance=triangle_offset_distance, Plane=PlaneXY(0, 0, 0), Corners=1)
offset_9 = Offset(Curve=ext_13, Distance=triangle_offset_distance, Plane=PlaneXY(0, 0, 0), Corners=1)
midway_point = Point(pt_58)
offset_10 = Offset(Curve=ext_11, Distance=triangle_offset_distance, Plane=PlaneXY(0, 0, 0), Corners=1)
rec_2pt_10 = Rectangle2Pt(Plane=xy_23, PointA=corner_point_4, PointB=pt_57, Radius=0)  # -> Rectangle, Length
xy_35 = XYPlane(Origin=eval_15.Point)
fillet_7 = Fillet(Curve=pline_5, Radius=corner_radius_4)
xy_36 = XYPlane(Origin=midway_point)
crv_cp_7 = CurveClosestPoint(Point=pt_57, Curve=rec_2pt_10.Rectangle)  # -> Point, Parameter, Distance
mcx = MultipleCurves(Curves=[offset_8, offset_9, offset_10])  # -> Points, IndexA, IndexB, ParamA, ParamB
mcx_2 = MultipleCurves(Curves=[offset_5, offset_6, offset_7])  # -> Points, IndexA, IndexB, ParamA, ParamB
eval_16 = EvaluateCurve(Curve=ln_47, Parameter="0.5")  # -> Point, Tangent, Angle
pt_59 = Point(eval_16.Point)
ln_48 = Line(StartPoint=pt_57, EndPoint=pt_59)
rotate_18 = Rotate(Geometry=xy_36, Angle=4.71238898, Plane=xy_36)  # -> Geometry, Transform
join_20 = JoinCurves(Curves=[fillet_7, pline_6], Preserve=False)
offset_11 = Offset(Curve=rec_2pt_10.Rectangle, Distance=multiplication_60, Plane=PlaneXY(0, 0, 0), Corners=1)
offset_12 = Offset(Curve=ln_48, Distance=multiplication_63, Plane=PlaneXY(0, 0, 0), Corners=1)
pline_7 = PolyLine(Vertices=mcx_2.Points, Closed=True)
offset_13 = Offset(Curve=ln_48, Distance=neg_27, Plane=PlaneXY(0, 0, 0), Corners=1)
pline_8 = PolyLine(Vertices=mcx.Points, Closed=True)
fillet_8 = Fillet(Curve=rec_2pt_10.Rectangle, Parameter=crv_cp_7.Parameter, Radius=corner_radius_5)  # -> Curve, Parameter
xy_37 = XYPlane(Origin=eval_16.Point)
end_38 = EndPoints(Curve=offset_12)  # -> Start, End
end_39 = EndPoints(Curve=offset_13)  # -> Start, End
orient_20 = Orient(Geometry=move_71.Geometry, Source=xy_35, Target=rotate_18.Geometry)  # -> Geometry, Transform
rotate_19 = Rotate(Geometry=pline_7, Angle=3.141592654, Plane=xy_37)  # -> Geometry, Transform
merge_27 = Merge(Data1=end_38.Start, Data2=end_38.End, Data3=end_39.End, Data4=end_39.Start)
joint_fingers = Curve(flatten([orient_20.Geometry, move_71.Geometry]))
mirror_41 = Mirror(Geometry=[rotate_19.Geometry, pline_7], Plane=xz_21)  # -> Geometry, Transform
pline_9 = PolyLine(Vertices=merge_27, Closed=True)
flip_7 = FlipCurve(Curve=mirror_41.Geometry)  # -> Curve, Flag
runion = RegionUnion(Curves=[pline_9, offset_11])
filter_69 = StreamFilter(Gate=make_dual_z_axis, Stream1=top_point_2)
outer_bolt_nut_pocket = Curve(runion)
rectangle_inside_curves = Curve([pline_7, rotate_19.Geometry, flip_7.Curve])
inner_bolt_nut_pocket = Curve(fillet_8.Curve)
rectangle_inside_curves_2 = Curve(rectangle_inside_curves)
joint_fingers_2 = Curve(joint_fingers)
triangle_inside_curves = Curve(pline_8)
triangle_outline = Curve(join_20)
rectangle_curve = Curve(rec_2pt_9.Rectangle)
gate_3 = StreamGate(Stream=joint_fingers_2, Gate=make_dual_z_axis_2)  # -> Target0, Target1
mirror_42 = Mirror(Geometry=gate_3.Target1, Plane=xz_22)  # -> Geometry, Transform
mirror_43 = Mirror(Geometry=outer_bolt_nut_pocket, Plane=xz_22)  # -> Geometry, Transform
mirror_44 = Mirror(Geometry=inner_bolt_nut_pocket, Plane=xz_22)  # -> Geometry, Transform
runion_2 = RegionUnion(Curves=flatten([gate_3.Target1, mirror_42.Geometry, rectangle_curve]))
runion_3 = RegionUnion(Curves=flatten([gate_3.Target0, triangle_outline]))
rdiff_3 = RegionDifference(CurvesA=triangle_inside_curves, CurvesB=outer_bolt_nut_pocket)
rdiff_4 = RegionDifference(CurvesA=rectangle_inside_curves_2, CurvesB=[mirror_43.Geometry, outer_bolt_nut_pocket])
rdiff_5 = RegionDifference(CurvesA=runion_3, CurvesB=inner_bolt_nut_pocket)
rdiff_6 = RegionDifference(CurvesA=runion_2, CurvesB=[inner_bolt_nut_pocket, mirror_44.Geometry])
filter_70 = StreamFilter(Gate=make_dual_z_axis_2, Stream0=rdiff_5, Stream1=rdiff_6)
filter_71 = StreamFilter(Gate=make_dual_z_axis_2, Stream0=rdiff_3, Stream1=rdiff_4)
clean_2 = CleanTree(RemoveNulls=True, RemoveInvalid=True, RemoveEmpty=False, Tree=filter_71)
dogbone_maker_4 = DogboneMaker(
    curves_to_dogbone=filter_70,
    milling_bit_diameter=main_material_bit_6,
    corner_angle_threshold=120,
    flip_cornes_boolean=Toggle(False))
z_support_wall_inside = Curve(clean_2)
fillet_9 = Fillet(Curve=z_support_wall_inside, Radius=multiplication_64)
offset_14 = Offset(Curve=fillet_9, Distance=neg_28, Plane=PlaneXY(0, 0, 0), Corners=1)
mid_point_3 = Point(mid_point)
offset_15 = Offset(Curve=flatten(offset_14), Distance=multiplication_64, Plane=PlaneXY(0, 0, 0), Corners=2)
xy_38 = XYPlane(Origin=mid_point_3)
flatten_2 = FlattenTree(Tree=offset_15, Path="{0}")
cls = Closed(Curve=flatten_2)  # -> Closed, Periodic
dispatch = Dispatch(List=flatten_2, DispatchPattern=cls.Closed)  # -> ListA, ListB
z_support_wall_inside_2 = Curve(dispatch.ListA)
z_support_wall_cutout = Curve(dogbone_maker_4)
origin_plane_2 = Plane(xy_38)

# ---- group: Make gantry bridge geometry
bearing_bolt_hole_diameter_4 = Panel(bearing_bolt_hole_diameter)
bearing_bolt_spacer_diameter_2 = Panel(bearing_bolt_spacer_diameter)
motor_mount_holes_3 = Curve(motor_mount_holes)
motor_shaft_hole_3 = Curve(motor_shaft_hole)
motor_pocket_3 = Curve(motor_pocket)
rail_lowest_point_3 = Point(rail_lowest_point_2)
slide_outline_2 = Curve(slide_outline_with_radius_2)
current_machine_to_make_9 = Panel(list)
bearing_bolt_diameter_2 = Panel(bearing_bolt_diameter)
bolt_head_multiplier = Panel("0.5")
gantry_axis_end_distance_inside_motor_po = Panel("1")  # "Gantry axis end distance inside motor pocket"
actual_extended_bridge_axis_length = Panel(actual_axis_length)
actual_bridge_axis_lenght = Panel(actual_axis_lenght_first_axis)
number_of_layers_beneath_rack_and_rail_l_6 = Panel(number_of_layers_beneath_rack_and_rail_l_3)  # "Number of layers beneath rack and rail layer"
bolt_holes_2 = Curve(mirror_31.Geometry)
motor_pocket_source = Curve(rec_2pt_2.Rectangle)
gantry_config_identifier_4 = Panel(gantry_config_identifier)
corner_radius_10 = Panel(corner_radius)
bearing_bolt_placement_margin_4 = Panel(bearing_bolt_placement_margin)
multiplication_88 = Multiplication(A=bearing_bolt_diameter_2, B=bolt_head_multiplier)
equals_49 = Equality(FirstNumber=current_machine_to_make_9, SecondNumber=gantry_config_identifier_4)  # -> Equality, Inequality
subtraction_48 = Subtraction(A=bearing_bolt_spacer_diameter_2, B=bearing_bolt_hole_diameter_4)
multiplication_89 = Multiplication(A=actual_bridge_axis_lenght, B="0.5")
distance_from_end_of_bolt_holes_to_start = Panel(multiplication_88)  # "Distance from end of bolt holes to start of upper gantry axis"
larger_8 = LargerThan(FirstNumber=number_of_layers_beneath_rack_and_rail_l_6, SecondNumber="1")  # -> LargerThan, OrEqualTo
multiplication_90 = Multiplication(A=subtraction_48, B="0.5")
pt_60 = ConstructPoint(XCoordinate=multiplication_89, YCoordinate=0, ZCoordinate=0)
multiplication_91 = Multiplication(A=bearing_bolt_placement_margin_4, B="0.5")
filter_72 = StreamFilter(Gate=equals_49.Equality, Stream1=motor_shaft_hole_3)
filter_73 = StreamFilter(Gate=equals_49.Equality, Stream1=motor_pocket_3)
filter_74 = StreamFilter(Gate=equals_49.Equality, Stream1=motor_mount_holes_3)
filter_75 = StreamFilter(Gate=equals_49.Equality, Stream1=bolt_holes_2)
motor_pocket_4 = Curve(filter_73)
filter_76 = StreamFilter(Gate=equals_49.Equality, Stream1=actual_extended_bridge_axis_length)
bolt_holes_3 = Curve(filter_75)
make_bridge_lower_layer = Panel(larger_8.LargerThan)
xy_39 = XYPlane(Origin=pt_60)
bbox_9 = BoundingBox(Content=slide_outline_2, Plane=PlaneXY(0, 0, 0))  # -> Box, Box_2
bbox_10 = BoundingBox(Content=motor_pocket_4, Plane=PlaneXY(0, 0, 0), UnionBox=True)  # -> Box, Box_2
bbox_11 = BoundingBox(Content=motor_pocket_source, Plane=PlaneXY(0, 0, 0), UnionBox=True)  # -> Box, Box_2
debrep_2 = DeconstructBrep(Brep=bbox_9.Box)  # -> Faces, Edges, Vertices
distance_from_end_of_bolt_holes_to_start_2 = Panel(distance_from_end_of_bolt_holes_to_start)  # "Distance from end of bolt holes to start of upper gantry axis"
debrep_3 = DeconstructBrep(Brep=bbox_10.Box)  # -> Faces, Edges, Vertices
item_40 = ListItem(List=debrep_2.Vertices, Index=0, Wrap=True)
debrep_4 = DeconstructBrep(Brep=bbox_11.Box)  # -> Faces, Edges, Vertices
item_41 = ListItem(List=debrep_3.Vertices, Index=0, Wrap=True)
actual_axis_lenght_first_axis_5 = Panel(filter_76)
pdecon_22 = Deconstruct(Point=item_40)  # -> XComponent, YComponent, ZComponent
item_42 = ListItem(List=debrep_4.Vertices, Index="3", Wrap=True)
subtraction_49 = Subtraction(A=pdecon_22.YComponent, B=multiplication_91)
pdecon_23 = Deconstruct(Point=item_41)  # -> XComponent, YComponent, ZComponent
rail_lowest_point_4 = Point(rail_lowest_point_3)
pdecon_24 = Deconstruct(Point=item_42)  # -> XComponent, YComponent, ZComponent
subtraction_50 = Subtraction(A=pdecon_23.YComponent, B=distance_from_end_of_bolt_holes_to_start_2)
multiplication_92 = Multiplication(A=actual_axis_lenght_first_axis_5, B="0.5")
pdecon_25 = Deconstruct(Point=rail_lowest_point_4)  # -> XComponent, YComponent, ZComponent
subtraction_51 = Subtraction(A=pdecon_24.YComponent, B=gantry_axis_end_distance_inside_motor_po)
filter_77 = StreamFilter(Gate=make_bridge_lower_layer, Stream1=subtraction_49)
subtraction_52 = Subtraction(A=subtraction_50, B=multiplication_92)
pt_61 = ConstructPoint(XCoordinate=pdecon_25.YComponent, YCoordinate=subtraction_51, ZCoordinate=0)
pt_62 = ConstructPoint(XCoordinate=0, YCoordinate=subtraction_52, ZCoordinate=0)
upper_axis_carriage_plate_corner_point = Point(pt_61)
center_point_upper_axis = Point(pt_62)
pt_63 = ConstructPoint(XCoordinate=pdecon_25.YComponent, YCoordinate=filter_77, ZCoordinate=0)
upper_axis_carriage_plate_corner_point_2 = Point(pt_63)
center_point_upper_axis_2 = Point(center_point_upper_axis)
center_point_upper_axis_3 = Point(center_point_upper_axis)
xz_29 = XZPlane(Origin=center_point_upper_axis_2)
yz_22 = YZPlane(Origin=center_point_upper_axis_2)
xz_30 = XZPlane(Origin=center_point_upper_axis_3)
yz_23 = YZPlane(Origin=center_point_upper_axis_3)
mirror_45 = Mirror(Geometry=upper_axis_carriage_plate_corner_point_2, Plane=xz_29)  # -> Geometry, Transform
xy_40 = XYPlane(Origin=center_point_upper_axis_2)
mirror_46 = Mirror(Geometry=upper_axis_carriage_plate_corner_point, Plane=xz_30)  # -> Geometry, Transform
mirror_47 = Mirror(Geometry=filter_73, Plane=xz_30)  # -> Geometry, Transform
mirror_48 = Mirror(Geometry=filter_74, Plane=xz_30)  # -> Geometry, Transform
mirror_49 = Mirror(Geometry=filter_75, Plane=xz_30)  # -> Geometry, Transform
mirror_50 = Mirror(Geometry=filter_72, Plane=xz_30)  # -> Geometry, Transform
xy_41 = XYPlane(Origin=pt_60)
mirror_51 = Mirror(Geometry=mirror_45.Geometry, Plane=yz_22)  # -> Geometry, Transform
rotate_20 = Rotate(Geometry=xy_40, Angle=4.71238898, Plane=xy_40)  # -> Geometry, Transform
mirror_52 = Mirror(Geometry=mirror_46.Geometry, Plane=yz_23)  # -> Geometry, Transform
gantry_bridge_motor_mount_holes = Curve(flatten([mirror_48.Geometry, filter_74]))
rail_rack_and_pinion_material_thickness_8 = Panel(thickness_2)
gantry_bridge_motor_shaft_hole = Curve(flatten([mirror_50.Geometry, filter_72]))
gantry_bridge_bolt_holes = Curve(flatten([mirror_49.Geometry, filter_75]))
rail_to_carriage_safety_distance_5 = Panel(rail_to_carriage_safety_distance)
main_material_thickness_18 = Panel(thickness)
construction_plane_upper_axis = Plane(xy_41)
location_plane_upper_axis = Plane(rotate_20.Geometry)
rec_2pt_11 = Rectangle2Pt(
    Plane=PlaneXY(0, 0, 0),
    PointA=upper_axis_carriage_plate_corner_point_2,
    PointB=mirror_51.Geometry,
    Radius=corner_radius_10)  # -> Rectangle, Length
rec_2pt_12 = Rectangle2Pt(
    Plane=PlaneXY(0, 0, 0),
    PointA=upper_axis_carriage_plate_corner_point,
    PointB=mirror_52.Geometry,
    Radius=corner_radius_10)  # -> Rectangle, Length
neg_38 = Negative(Value=multiplication_90)
offset_16 = Offset(Curve=gantry_bridge_bolt_holes, Distance=multiplication_90, Plane=PlaneXY(0, 0, 0), Corners=1)
offset_17 = Offset(Curve=gantry_bridge_bolt_holes, Distance=neg_38, Plane=PlaneXY(0, 0, 0), Corners=1)
addition_55 = Addition(A=rail_rack_and_pinion_material_thickness_8, B=main_material_thickness_18)
addition_56 = Addition(A=rail_to_carriage_safety_distance_5, B=addition_55)
p_n_c = PickNChoose(Pattern=[0, 1, 1, 0], Stream0=flatten(offset_16), Stream1=flatten(offset_17))
orient_21 = Orient(
    Geometry=flatten([mirror_47.Geometry, filter_73]),
    Source=location_plane_upper_axis,
    Target=construction_plane_upper_axis)  # -> Geometry, Transform
orient_22 = Orient(Geometry=rec_2pt_12.Rectangle, Source=location_plane_upper_axis, Target=construction_plane_upper_axis)  # -> Geometry, Transform
orient_23 = Orient(Geometry=rec_2pt_11.Rectangle, Source=location_plane_upper_axis, Target=construction_plane_upper_axis)  # -> Geometry, Transform
orient_24 = Orient(
    Geometry=[gantry_bridge_bolt_holes, gantry_bridge_motor_mount_holes, gantry_bridge_motor_shaft_hole],
    Source=location_plane_upper_axis,
    Target=construction_plane_upper_axis)  # -> Geometry, Transform
orient_25 = Orient(Geometry=gantry_bridge_bolt_holes, Source=location_plane_upper_axis, Target=construction_plane_upper_axis)  # -> Geometry, Transform
orient_26 = Orient(Geometry=p_n_c, Source=location_plane_upper_axis, Target=construction_plane_upper_axis)  # -> Geometry, Transform
Z_24 = UnitZ(Factor=addition_56)
move_72 = Move(Geometry=location_plane_upper_axis, Motion=Z_24)  # -> Geometry, Transform
gantry_bridge_carriage_plate_outline = Curve(orient_22.Geometry)
gantry_bridge_lower_layer_outline = Curve(orient_23.Geometry)
gantry_bridge_bolt_pockets = Curve(orient_26.Geometry)
gantry_bridge_bolt_holes_2 = Curve(orient_25.Geometry)
gantry_bridge_motor_pockets = Curve(orient_21.Geometry)
gantry_bridge_motor_holes = Curve(orient_24.Geometry)
location_plane_upper_axis_2 = Plane(move_72.Geometry)

# ---- group: Make carriage plate geometry (continued)
axis_cutouts_2 = Curve(axis_cutouts)
rdiff_7 = RegionDifference(CurvesA=carriage_outline, CurvesB=axis_cutouts_2)
dogbone_maker_5 = DogboneMaker(
    curves_to_dogbone=rdiff_7,
    milling_bit_diameter=main_material_bit_11,
    corner_angle_threshold=120,
    flip_cornes_boolean=Toggle(False))
filter_78 = StreamFilter(Gate=make_at_least_one_z_axis_7, Stream0=carriage_outline, Stream1=dogbone_maker_5)
# Make nut pocket?
# Or pocket on underside of y axis?
carriage_outline_2 = Curve(filter_78)

# ---- group: ake lower rail toolpaths
safe_x_y_bird_bit = Panel("10")
end_point_upper_rail_path_2 = Point(end_point_upper_rail_path)
end_point_lower_rail_path_2 = Point(end_point_lower_rail_path)
actual_extended_axis_lenght_second_axis_2 = Panel(actual_extended_axis_lenght_second_axis)
bird_bit_diameter_2 = Panel(bird_bit_diameter)
X_17 = UnitX(Factor=actual_extended_axis_lenght_second_axis_2)
multiplication_93 = Multiplication(A=bird_bit_diameter_2, B=".5")
move_73 = Move(Geometry=end_point_upper_rail_path_2, Motion=X_17)  # -> Geometry, Transform
move_74 = Move(Geometry=end_point_lower_rail_path_2, Motion=X_17)  # -> Geometry, Transform
addition_57 = Addition(A=multiplication_93, B=safe_x_y_bird_bit)
ln_49 = Line(StartPoint=move_74.Geometry, EndPoint=end_point_lower_rail_path_2)
ln_50 = Line(StartPoint=move_73.Geometry, EndPoint=end_point_upper_rail_path_2)
ext_17 = ExtendCurve(Curve=ln_50, Type=0, Start=addition_57, End=addition_57)
ext_18 = ExtendCurve(Curve=ln_49, Type=0, Start=addition_57, End=addition_57)
center_point_upper_axis_4 = Point(center_point_upper_axis)
redpline_2 = Reduce(Polyline=ext_17, Tolerance=1)  # -> Polyline, Reduction
redpline_3 = Reduce(Polyline=ext_18, Tolerance=1)  # -> Polyline, Reduction
merge_28 = Merge(Data1=redpline_2.Polyline, Data2=redpline_3.Polyline)
xz_31 = XZPlane(Origin=center_point_upper_axis_4)
mirror_53 = Mirror(Geometry=merge_28, Plane=xz_31)  # -> Geometry, Transform
flip_8 = FlipCurve(Curve=mirror_53.Geometry)  # -> Curve, Flag
merge_29 = Merge(Data1=flatten(merge_28), Data2=flatten(flip_8.Curve))
gantry_base_v_rail_bird_beak_toolpaths = Curve(merge_29)

# ---- group: Make lower layer outline
actual_axis_length_2 = Panel(actual_axis_length)
corner_radius_11 = Panel(corner_radius)
gantry_config_identifier_5 = Panel(gantry_config_identifier)
number_of_layers_beneath_rack_and_rail_l_7 = Panel(number_of_layers_beneath_rack_and_rail_l_3)  # "Number of layers beneath rack and rail layer"
rail_lowest_point_5 = Point(rail_lowest_point_2)
current_machine_to_make_10 = Panel(list)
equals_50 = Equality(FirstNumber=current_machine_to_make_10, SecondNumber=gantry_config_identifier_5)  # -> Equality, Inequality
larger_9 = LargerThan(FirstNumber=number_of_layers_beneath_rack_and_rail_l_7, SecondNumber="1")  # -> LargerThan, OrEqualTo
pdecon_26 = Deconstruct(Point=rail_lowest_point_5)  # -> XComponent, YComponent, ZComponent
make_gantry_bridge = Panel(equals_50.Equality)
make_bridge_lower_layer_2 = Panel(larger_9.LargerThan)
pt_64 = ConstructPoint(XCoordinate=pdecon_26.XComponent, YCoordinate=pdecon_26.YComponent, ZCoordinate=0)
xz_32 = XZPlane(Origin=Point(0, 0, 0))
mirror_54 = Mirror(Geometry=pt_64, Plane=xz_32)  # -> Geometry, Transform
X_18 = UnitX(Factor=actual_axis_length_2)
gantry_bridge_motor_pockets_2 = Curve(gantry_bridge_motor_pockets)
gantry_bridge_carriage_plate_outline_2 = Curve(gantry_bridge_carriage_plate_outline)
gantry_bridge_motor_holes_2 = Curve(gantry_bridge_motor_holes)
gantry_bridge_lower_layer_outline_2 = Curve(gantry_bridge_lower_layer_outline)
move_75 = Move(Geometry=mirror_54.Geometry, Motion=X_18)  # -> Geometry, Transform
rec_2pt_13 = Rectangle2Pt(Plane=PlaneXY(0, 0, 0), PointA=pt_64, PointB=move_75.Geometry, Radius=corner_radius_11)  # -> Rectangle, Length
axis_lower_layers_outline = Curve(rec_2pt_13.Rectangle)
filter_79 = StreamFilter(
    Gate=make_bridge_lower_layer_2,
    Stream0=gantry_bridge_carriage_plate_outline_2,
    Stream1=gantry_bridge_lower_layer_outline_2)
filter_80 = StreamFilter(
    Gate=make_bridge_lower_layer_2,
    Stream0=gantry_bridge_lower_layer_outline_2,
    Stream1=gantry_bridge_carriage_plate_outline_2)
make_gantry_bridge_2 = Panel(make_gantry_bridge)
outline_for_lower_layer = Curve(filter_79)
outline_for_mid_layer = Curve(filter_80)
filter_81 = StreamFilter(Gate=make_gantry_bridge_2, Stream1=gantry_bridge_motor_holes_2)
filter_82 = StreamFilter(Gate=make_gantry_bridge_2, Stream1=gantry_bridge_motor_pockets_2)
filter_83 = StreamFilter(Gate=make_gantry_bridge_2, Stream0=axis_lower_layers_outline, Stream1=outline_for_mid_layer)
filter_84 = StreamFilter(Gate=make_gantry_bridge_2, Stream0=axis_lower_layers_outline, Stream1=outline_for_lower_layer)
and_22 = GateAnd(A=make_gantry_bridge, B=make_bridge_lower_layer_2)
make_bridge_lower_layer_3 = Panel(make_bridge_lower_layer_2)
lowest_layer_is_beneath_motor_plate = Panel(and_22)
axis_first_lower_layer_outline = Curve(filter_84)
no_gantry_lower_layers_outline = Curve(axis_lower_layers_outline)
axis_mid_layer_outline = Curve(filter_83)
gate_4 = StreamGate(Stream=filter_82, Gate=make_bridge_lower_layer_3)  # -> Target0, Target1
gate_5 = StreamGate(Stream=filter_81, Gate=make_bridge_lower_layer_3)  # -> Target0, Target1

# ---- group: Organize Z wall cutting
z_wall_motor_pocket_depth_2 = Panel(z_wall_motor_pocket_depth)
make_z_axis_side2_7 = Panel(make_z_axis_side2_2)
make_z_axis_side1_7 = Panel(make_z_axis_side1_2)
space_between_parts_3 = Panel(space_between_parts)
z_wall_motor_holes_2 = Curve(z_wall_motor_holes)
z_wall_outline_2 = Curve(z_wall_outline_with_filets)
z_wall_motor_pocket_2 = Curve(z_wall_motor_pocket)
z_wall_inside_precut = Curve(z_support_wall_holes_2)
merge_30 = Merge(Data1=flatten(z_wall_motor_holes_2), Data2=flatten(z_wall_outline_2))
addition_58 = Addition(A=make_z_axis_side1_7, B=make_z_axis_side2_7)
z_wall_cutout = Curve(merge_30)
numner_of_z_walls_to_cut = Panel(addition_58)
bbox_12 = BoundingBox(Content=z_wall_cutout, Plane=PlaneXY(0, 0, 0), UnionBox=True)  # -> Box, Box_2
dim_6 = Dimensions(Surface=bbox_12.Box)  # -> UDimension, VDimension
addition_59 = Addition(A=dim_6.UDimension, B=space_between_parts_3)
series_2 = Series(Start=0, Step=addition_59, Count=numner_of_z_walls_to_cut)
X_19 = UnitX(Factor=series_2)
move_76 = Move(Geometry=graft(z_wall_cutout), Motion=X_19)  # -> Geometry, Transform
move_77 = Move(Geometry=graft(z_wall_inside_precut), Motion=X_19)  # -> Geometry, Transform
move_78 = Move(Geometry=graft(z_wall_motor_pocket_2), Motion=X_19)  # -> Geometry, Transform
z_wall_inside_precut_2 = Curve(flatten(move_77.Geometry))
z_wall_motor_pocket_3 = Curve(flatten(move_78.Geometry))
z_wall_cutout_2 = Curve(flatten(move_76.Geometry))

# ---- group: Organize Z support wall cutting
z_support_wall_inside_pocket_precut = Curve(z_support_wall_inside_2)
make_at_least_one_z_axis_8 = Panel(or)
space_between_parts_4 = Panel(space_between_parts)
z_support_wall_cutout_2 = Curve(z_support_wall_cutout)
multiplication_94 = Multiplication(A=make_at_least_one_z_axis_8, B="2")
numner_of_z_support_walls_to_cut = Panel(multiplication_94)
bbox_13 = BoundingBox(Content=z_support_wall_cutout_2, Plane=PlaneXY(0, 0, 0), UnionBox=True)  # -> Box, Box_2
dim_7 = Dimensions(Surface=bbox_13.Box)  # -> UDimension, VDimension
addition_60 = Addition(A=dim_7.UDimension, B=space_between_parts_4)
series_3 = Series(Start=0, Step=addition_60, Count=numner_of_z_support_walls_to_cut)
X_20 = UnitX(Factor=series_3)
move_79 = Move(Geometry=graft(z_support_wall_inside_pocket_precut), Motion=X_20)  # -> Geometry, Transform
move_80 = Move(Geometry=graft(z_support_wall_cutout_2), Motion=X_20)  # -> Geometry, Transform
z_support_wall_inside_pocket_precut_2 = Curve(flatten(move_79.Geometry))
z_support_wall_cutout_3 = Curve(flatten(move_80.Geometry))

# ---- group: Organize carriage cutting
motor_mount_holes_4 = Curve(motor_mount_holes)
z_support_wall_holes_3 = Curve(z_support_wall_holes)
carriage_outline_3 = Curve(carriage_outline_2)
bolt_holes_4 = Curve(bolt_holes)
motor_shaft_hole_4 = Curve(motor_shaft_hole)
merge_31 = Merge(
    Data1=flatten(motor_mount_holes_4),
    Data2=flatten(motor_shaft_hole_4),
    Data3=flatten(z_support_wall_holes_3),
    Data4=flatten(carriage_outline_3))
carriage_motor_pocket_depth_2 = Panel(carriage_motor_pocket_depth)
carriage_inside_precut = Curve(bolt_holes_4)
carriage_cutout = Curve(merge_31)
motor_pocket_5 = Curve(motor_pocket)

# ----
filter_85 = StreamFilter(Gate=make_gantry_bridge_2, Stream1=gantry_bridge_motor_holes_2)

# ---- group: Make Z support wall breps
z_support_wall_cutout_4 = Curve(z_support_wall_cutout)
z_support_wall_inside_3 = Curve(z_support_wall_inside_2)
rail_to_carriage_safety_distance_6 = Panel(rail_to_carriage_safety_distance)
main_material_thickness_19 = Panel(thickness)
origin_plane_3 = Plane(origin_plane_2)
xz_33 = XZPlane(Origin=origin_plane_3)
addition_61 = Addition(A=main_material_thickness_19, B=rail_to_carriage_safety_distance_6)
rotate_21 = Rotate(Geometry=origin_plane_3, Angle=4.71238898, Plane=xz_33)  # -> Geometry, Transform
merge_32 = Merge(Data1=flatten(z_support_wall_inside_3), Data2=flatten(z_support_wall_cutout_4))
Z_25 = UnitZ(Factor=main_material_thickness_19)
Z_26 = UnitZ(Factor=addition_61)
move_81 = Move(Geometry=rotate_21.Geometry, Motion=Z_26)  # -> Geometry, Transform
z_wall_support_curves = Curve(merge_32)
extr = Extrude(Base=flatten(z_wall_support_curves), Direction=Z_25)
boundary = BoundarySurfaces(Edges=z_wall_support_curves)
move_82 = Move(Geometry=boundary, Motion=Z_25)  # -> Geometry, Transform
join_21 = BrepJoin(Breps=[move_82.Geometry, boundary, extr])  # -> Breps, Closed
orient_27 = Orient(Geometry=join_21.Breps, Source=origin_plane_3, Target=move_81.Geometry)  # -> Geometry, Transform
yz_24 = YZPlane(Origin=Point(0, 0, 0))
mirror_55 = Mirror(Geometry=orient_27.Geometry, Plane=yz_24)  # -> Geometry, Transform
z_support_wall_breps = Brep([orient_27.Geometry, mirror_55.Geometry])

# ---- group: Make V bearing preview brep
bolt_holes_slide_2 = Curve(bolt_holes_slide)
slide_outline_with_radius_3 = Curve(slide_outline_with_radius_2)
v_bearing_profile_2 = Curve(v_bearing_profile)
axis_width_4 = Panel(actual_axis_width_2)
rail_to_carriage_safety_distance_7 = Panel(rail_to_carriage_safety_distance)
rail_rack_and_pinion_material_thickness_9 = Panel(thickness_2)
merge_33 = Merge(Data1=flatten(bolt_holes_slide_2), Data2=flatten(slide_outline_with_radius_3))
end_40 = EndPoints(Curve=v_bearing_profile_2)  # -> Start, End
addition_62 = Addition(A=axis_width_4, B="2")
neg_39 = Negative(Value=rail_rack_and_pinion_material_thickness_9)
Z_27 = UnitZ(Factor=rail_to_carriage_safety_distance_7)
xz_34 = XZPlane(Origin=end_40.Start)
slide_curves = Curve(merge_33)
X_21 = UnitX(Factor=addition_62)
mirror_56 = Mirror(Geometry=v_bearing_profile_2, Plane=xz_34)  # -> Geometry, Transform
Z_28 = UnitZ(Factor=neg_39)
extr_2 = Extrude(Base=flatten(slide_curves), Direction=Z_28)
boundary_2 = BoundarySurfaces(Edges=slide_curves)
join_22 = JoinCurves(Curves=[v_bearing_profile_2, mirror_56.Geometry], Preserve=False)
extr_3 = Extrude(Base=join_22, Direction=X_21)
move_83 = Move(Geometry=boundary_2, Motion=Z_28)  # -> Geometry, Transform
neg_40 = Negative(Value="1")
cap = CapHoles(Brep=extr_3)
X_22 = UnitX(Factor=neg_40)
join_23 = BrepJoin(Breps=[move_83.Geometry, boundary_2, extr_2])  # -> Breps, Closed
move_84 = Move(Geometry=cap, Motion=X_22)  # -> Geometry, Transform
move_85 = Move(Geometry=join_23.Breps, Motion=Z_27)  # -> Geometry, Transform
sdiff = SolidDifference(BrepsA=move_85.Geometry, BrepsB=move_84.Geometry)
xz_35 = XZPlane(Origin=Point(0, 0, 0))
mirror_57 = Mirror(Geometry=sdiff, Plane=xz_35)  # -> Geometry, Transform
v_bearing_brep = Brep([sdiff, mirror_57.Geometry])

# ----
slide_preview_brep = Brep(sdiff)

# ---- group: Make carriage plate preview brep
preview_level_of_detail = Panel(list_3)
carriage_outline_4 = Curve(carriage_outline_2)
bolt_holes_5 = Curve(bolt_holes)
motor_mount_holes_5 = Curve(motor_mount_holes)
motor_mount_holes_6 = Curve(motor_shaft_hole)
z_support_wall_holes_4 = Curve(z_support_wall_holes)
main_material_thickness_20 = Panel(thickness)
rail_to_carriage_safety_distance_8 = Panel(rail_to_carriage_safety_distance)
motor_pocket_6 = Curve(motor_pocket)
carriage_motor_pocket_depth_3 = Panel(carriage_motor_pocket_depth)
merge_34 = Merge(
    Data2=flatten(bolt_holes_5),
    Data3=flatten(motor_mount_holes_5),
    Data4=flatten(motor_mount_holes_6),
    Data5=flatten(z_support_wall_holes_4))
neg_41 = Negative(Value=carriage_motor_pocket_depth_3)
carriage_holes = Curve(merge_34)
Z_29 = UnitZ(Factor=main_material_thickness_20)
Z_30 = UnitZ(Factor=neg_41)
Z_31 = UnitZ(Factor=rail_to_carriage_safety_distance_8)
gate_6 = StreamGate(Stream=carriage_holes, Gate=preview_level_of_detail)  # -> Target0, Target1
extr_4 = Extrude(Base=motor_pocket_6, Direction=Z_30)
extr_5 = Extrude(Base=carriage_outline_4, Direction=Z_29)
extr_6 = Extrude(Base=gate_6.Target1, Direction=Z_29)
cap_2 = CapHoles(Brep=extr_4)
cap_3 = CapHoles(Brep=extr_5)
cap_4 = CapHoles(Brep=extr_6)
sdiff_2 = SolidDifference(BrepsA=cap_3, BrepsB=cap_4)
move_86 = Move(Geometry=cap_2, Motion=Z_29)  # -> Geometry, Transform
filter_86 = StreamFilter(Gate=preview_level_of_detail, Stream0=cap_3, Stream1=sdiff_2)
sdiff_3 = SolidDifference(BrepsA=filter_86, BrepsB=move_86.Geometry)
null_2 = NullItem(Item=sdiff_3)  # -> NullFlags, InvalidFlags, Description
filter_87 = StreamFilter(Gate=null_2.NullFlags, Stream0=sdiff_3, Stream1=filter_86)
move_87 = Move(Geometry=filter_87, Motion=Z_31)  # -> Geometry, Transform
carriage_plate_brep = Brep(move_87.Geometry)

# ---- group: Make carriage motor brep
carriage_motor_pocket_depth_4 = Panel(carriage_motor_pocket_depth)
motor_height_3 = Panel(motor_height_2)
motor_outline_2 = Curve(motor_outline)
Z_32 = UnitZ(Factor=motor_height_3)
extr_7 = Extrude(Base=motor_outline_2, Direction=Z_32)
subtraction_53 = Subtraction(A=main_material_thickness_20, B=carriage_motor_pocket_depth_4)
cap_5 = CapHoles(Brep=extr_7)
addition_63 = Addition(A=rail_to_carriage_safety_distance_8, B=subtraction_53)
motor_brep = Brep(cap_5)
Z_33 = UnitZ(Factor=addition_63)
move_88 = Move(Geometry=motor_brep, Motion=Z_33)  # -> Geometry, Transform
carriage_motor_brep = Brep(move_88.Geometry)

# ---- group: Make z wall motor brep
origin_plane_4 = Plane(origin_plane)
yz_25 = YZPlane(Origin=origin_plane_4)
xy_42 = XYPlane(Origin=origin_plane_4)
rotate_22 = Rotate(Geometry=origin_plane_4, Angle=1.570796327, Plane=yz_25)  # -> Geometry, Transform
rotate_23 = Rotate(Geometry=rotate_22.Geometry, Angle=3.141592654, Plane=xy_42)  # -> Geometry, Transform
neg_42 = Negative(Value=main_material_thickness_20)
Y_28 = UnitY(Factor=neg_42)
move_89 = Move(Geometry=rotate_23.Geometry, Motion=Y_28)  # -> Geometry, Transform
addition_64 = Addition(A=main_material_thickness_20, B=rail_to_carriage_safety_distance_8)
Z_34 = UnitZ(Factor=addition_64)
move_90 = Move(Geometry=move_89.Geometry, Motion=Z_34)  # -> Geometry, Transform
assembly_plane = Plane(move_90.Geometry)
origin_plane_5 = Plane(origin_plane)
xy_43 = XYPlane(Origin=Point(0, 0, 0))
move_91 = Move(Geometry=xy_43, Motion=Z_33)  # -> Geometry, Transform
carriage_motor_plane = Plane(move_91.Geometry)
z_wall_motor_plane = Plane(motor_plane)
assembly_plane_2 = Plane(assembly_plane)
origin_plane_6 = Plane(origin_plane_5)
orient_28 = Orient(Geometry=move_88.Geometry, Source=carriage_motor_plane, Target=z_wall_motor_plane)  # -> Geometry, Transform
orient_29 = Orient(Geometry=orient_28.Geometry, Source=origin_plane_6, Target=assembly_plane_2)  # -> Geometry, Transform
z_wall_motor_brep = Brep(orient_29.Geometry)

# ---- group: Make Z wall preview brep
z_wall_motor_pocket_depth_3 = Panel(z_wall_motor_pocket_depth)
z_support_wall_inside_precut = Curve(z_support_wall_holes_2)
main_material_thickness_21 = Panel(thickness)
preview_level_of_detail_2 = Panel(list_3)
z_wall_motor_holes_3 = Curve(z_wall_motor_holes)
z_wall_outline_3 = Curve(z_wall_outline_with_filets)
z_wall_motor_pocket_4 = Curve(z_wall_motor_pocket)
gate_7 = StreamGate(Stream=z_wall_motor_pocket_4, Gate=preview_level_of_detail_2)  # -> Target0, Target1
neg_43 = Negative(Value=z_wall_motor_pocket_depth_3)
merge_35 = Merge(Data1=flatten(z_wall_motor_holes_3), Data2=flatten(z_support_wall_inside_precut), Data3=flatten(z_wall_outline_3))
Z_35 = UnitZ(Factor=neg_43)
z_wall_curves = Curve(merge_35)
Z_36 = UnitZ(Factor=main_material_thickness_21)
extr_8 = Extrude(Base=gate_7.Target1, Direction=Z_35)
extr_9 = Extrude(Base=flatten(z_wall_curves), Direction=Z_36)
boundary_3 = BoundarySurfaces(Edges=z_wall_curves)
cap_6 = CapHoles(Brep=extr_8)
move_92 = Move(Geometry=boundary_3, Motion=Z_36)  # -> Geometry, Transform
join_24 = BrepJoin(Breps=[move_92.Geometry, boundary_3, extr_9])  # -> Breps, Closed
move_93 = Move(Geometry=cap_6, Motion=Z_36)  # -> Geometry, Transform
sdiff_4 = SolidDifference(BrepsA=join_24.Breps, BrepsB=move_93.Geometry)
null_3 = NullItem(Item=sdiff_4)  # -> NullFlags, InvalidFlags, Description
filter_88 = StreamFilter(Gate=null_3.NullFlags, Stream0=sdiff_4, Stream1=join_24.Breps)
assembly_plane_3 = Plane(assembly_plane)
origin_plane_7 = Plane(origin_plane_5)
orient_30 = Orient(Geometry=filter_88, Source=origin_plane_7, Target=assembly_plane_3)  # -> Geometry, Transform
z_wall_brep = Brep(orient_30.Geometry)

# ---- group: Make gantry motors
center_point_upper_axis_5 = Point(center_point_upper_axis)
carriage_motor_brep_2 = Brep(move_88.Geometry)
v_bearing_brep_2 = Brep(sdiff)
xz_36 = XZPlane(Origin=center_point_upper_axis_5)
xz_37 = XZPlane(Origin=center_point_upper_axis_5)
mirror_58 = Mirror(Geometry=v_bearing_brep_2, Plane=xz_36)  # -> Geometry, Transform
mirror_59 = Mirror(Geometry=carriage_motor_brep_2, Plane=xz_37)  # -> Geometry, Transform
gantry_bridge_v_bearings = Brep([v_bearing_brep_2, mirror_58.Geometry])
gantry_bridge_motors = Brep([mirror_59.Geometry, carriage_motor_brep_2])

# ---- group: Organize Z wall 1 and 2
z_wall_motor_brep_2 = Brep(z_wall_motor_brep)
make_z_axis_side1_8 = Panel(make_z_axis_side1_2)
make_z_axis_side2_8 = Panel(make_z_axis_side2_2)
z_wall_brep_2 = Brep(z_wall_brep)
filter_89 = StreamFilter(Gate=make_z_axis_side2_8, Stream1=z_wall_brep_2)
filter_90 = StreamFilter(Gate=make_z_axis_side1_8, Stream1=z_wall_motor_brep_2)
filter_91 = StreamFilter(Gate=make_z_axis_side2_8, Stream1=z_wall_motor_brep_2)
filter_92 = StreamFilter(Gate=make_z_axis_side1_8, Stream1=z_wall_brep_2)
xz_38 = XZPlane(Origin=Point(0, 0, 0))
mirror_60 = Mirror(Geometry=filter_91, Plane=xz_38)  # -> Geometry, Transform
mirror_61 = Mirror(Geometry=filter_89, Plane=xz_38)  # -> Geometry, Transform
z_wall1_motor_brep = Brep(filter_90)
z_wall2_motor_brep = Brep(mirror_60.Geometry)
z_wal12_brep = Brep(mirror_61.Geometry)
z_wal1l_brep = Brep(filter_92)

# ---- group: Make inside holes for axis top layer
gantry_bridge_bolt_holes_3 = Curve(gantry_bridge_bolt_holes_2)
join_rails_with_dowels_instead_of_bolts_6 = Panel(join_rails_with_dowels_instead_of_bolts_3)
attachment_bolt_diameter_3 = Panel(attachment_bolt_diameter)
spacer_diameter_inc_margin_2 = Panel(spacer_diameter_inc_margin)
spacer_pocket_depth_2 = Panel(spacer_pocket_depth)
wedge_hole_top_layer_2 = Curve(wedge_hole_top_layer)
hole_planes_top_layer_2 = Plane(hole_planes_top_layer)
nut_holes_for_top_layer_2 = Curve(nut_holes_for_top_layer)
axis_top_layer_outline_2 = Curve(axis_top_layer_outline)
extra_cutout_depth_3 = Panel(extra_cutout_depth)
rail_rack_and_pinion_material_thickness_10 = Panel(thickness_2)
gantry_bridge_bolt_pockets_2 = Curve(gantry_bridge_bolt_pockets)
bolt_head_height_inc_spacer_and_margin_2 = Panel(bolt_head_height_inc_spacer_and_margin)
addition_65 = Addition(A=extra_cutout_depth_3, B=rail_rack_and_pinion_material_thickness_10)
xy_44 = XYPlane(Origin=Point(0, 0, 0))
multiplication_95 = Multiplication(A=attachment_bolt_diameter_3, B="0.5")
filter_93 = StreamFilter(Gate=join_rails_with_dowels_instead_of_bolts_6, Stream0=spacer_diameter_inc_margin_2)
cir_10 = Circle(Plane=xy_44, Radius=multiplication_95)
xy_45 = XYPlane(Origin=Point(0, 0, 0))
xy_46 = XYPlane(Origin=Point(0, 0, 0))
multiplication_96 = Multiplication(A=filter_93, B="0.5")
rotate_24 = Rotate(Geometry=xy_45, Angle=1.570796327, Plane=xy_45)  # -> Geometry, Transform
cir_11 = Circle(Plane=xy_46, Radius=multiplication_96)
filter_94 = StreamFilter(Gate=join_rails_with_dowels_instead_of_bolts_6, Stream0=cir_10, Stream1=wedge_hole_top_layer_2)
merge_36 = Merge(
    Data1=flatten(nut_holes_for_top_layer_2),
    Data2=flatten(axis_top_layer_outline_2),
    Data3=flatten(gantry_bridge_bolt_holes_3))
orient_31 = Orient(Geometry=cir_11, Source=rotate_24.Geometry, Target=hole_planes_top_layer_2)  # -> Geometry, Transform
orient_32 = Orient(Geometry=filter_94, Source=rotate_24.Geometry, Target=hole_planes_top_layer_2)  # -> Geometry, Transform
clean_3 = CleanTree(RemoveNulls=True, RemoveInvalid=True, RemoveEmpty=False, Tree=gantry_bridge_bolt_pockets_2)
clean_4 = CleanTree(RemoveNulls=True, RemoveInvalid=True, RemoveEmpty=False, Tree=orient_31.Geometry)
axis_top_layer_bearing_bolt_pocket = Curve(clean_3)
spacer_pocket_depth_3 = Panel(spacer_pocket_depth_2)
bearing_bolt_pocket_depth = Panel(bolt_head_height_inc_spacer_and_margin_2)
axis_top_layer_spacer_pocket = Curve(clean_4)
cut_depth_top_layer = Panel(addition_65)
axis_top_layer_inside_holes = Curve(orient_32.Geometry)
axis_top_layer_cutout = Curve(merge_36)

# ---- group: Make top layer preview brep
rack_teeth_15 = Curve(rack_teeth_6)
preview_level_of_detail_3 = Panel(list_3)
rail_profile_2 = Curve(rail_profile)
actual_axis_length_3 = Panel(actual_axis_length)
pinion_pocket_2 = Curve(pinion_pocket)
pinion_pocket_depth_3 = Panel(pinion_pocket_depth_2)
rack_pocket_3 = Curve(rack_pocket)
rack_pocket_depth_6 = Panel(rack_pocket_depth_3)
spacer_pockets = Curve(axis_top_layer_spacer_pocket)
spacer_pocket_depth_4 = Panel(spacer_pocket_depth_3)
axis_top_layer_inside_precut = Curve(axis_top_layer_inside_holes)
gantry_bridge_bolt_holes_4 = Curve(gantry_bridge_bolt_holes_3)
rail_rack_and_pinion_material_thickness_11 = Panel(thickness_2)
bearing_bolt_pocket_depth_2 = Panel(bearing_bolt_pocket_depth)
axis_top_layer_bearing_bolt_pocket_2 = Curve(axis_top_layer_bearing_bolt_pocket)
nut_holes_for_top_layer_3 = Curve(nut_holes_for_top_layer)
merge_37 = Merge(
    Data1=flatten(axis_top_layer_inside_precut),
    Data2=flatten(nut_holes_for_top_layer_3),
    Data3=flatten(gantry_bridge_bolt_holes_4))
xz_39 = XZPlane(Origin=Point(0, 0, 0))
gate_8 = StreamGate(Stream=spacer_pockets, Gate=preview_level_of_detail_3)  # -> Target0, Target1
gate_9 = StreamGate(Stream=axis_top_layer_bearing_bolt_pocket_2, Gate=preview_level_of_detail_3)  # -> Target0, Target1
mirror_62 = Mirror(Geometry=rail_profile_2, Plane=xz_39)  # -> Geometry, Transform
gate_10 = StreamGate(Stream=merge_37, Gate=preview_level_of_detail_3)  # -> Target0, Target1
end_41 = EndPoints(Curve=rail_profile_2)  # -> Start, End
end_42 = EndPoints(Curve=mirror_62.Geometry)  # -> Start, End
neg_44 = Negative(Value=rail_rack_and_pinion_material_thickness_11)
neg_45 = Negative(Value=bearing_bolt_pocket_depth_2)
neg_46 = Negative(Value=spacer_pocket_depth_4)
neg_47 = Negative(Value=pinion_pocket_depth_3)
neg_48 = Negative(Value=rack_pocket_depth_6)
Z_37 = UnitZ(Factor=neg_44)
Z_38 = UnitZ(Factor=neg_45)
Z_39 = UnitZ(Factor=neg_46)
Z_40 = UnitZ(Factor=neg_47)
Z_41 = UnitZ(Factor=neg_48)
ln_51 = Line(StartPoint=end_41.End, EndPoint=end_42.End)
ln_52 = Line(StartPoint=end_41.Start, EndPoint=end_42.Start)
extr_10 = Extrude(Base=gate_10.Target1, Direction=Z_37)
extr_11 = Extrude(Base=gate_9.Target1, Direction=Z_38)
extr_12 = Extrude(Base=gate_8.Target1, Direction=Z_39)
extr_13 = Extrude(Base=pinion_pocket_2, Direction=Z_40)
extr_14 = Extrude(Base=rack_pocket_3, Direction=Z_41)
join_25 = JoinCurves(Curves=[ln_52, ln_51, mirror_62.Geometry, rail_profile_2], Preserve=False)
X_23 = UnitX(Factor=actual_axis_length_3)
move_94 = Move(Geometry=rack_teeth_15, Motion=Z_41)  # -> Geometry, Transform
cap_7 = CapHoles(Brep=extr_10)
cap_8 = CapHoles(Brep=extr_11)
cap_9 = CapHoles(Brep=extr_12)
cap_10 = CapHoles(Brep=extr_13)
cap_11 = CapHoles(Brep=extr_14)
extr_15 = Extrude(Base=join_25, Direction=X_23)
cap_12 = CapHoles(Brep=extr_15)
sdiff_5 = SolidDifference(BrepsA=cap_12, BrepsB=cap_10)
sdiff_6 = SolidDifference(BrepsA=sdiff_5, BrepsB=cap_11)
merge_38 = Merge(Data1=flatten(sdiff_6), Data2=flatten(gate_8.Target0), Data3=flatten(gate_9.Target0), Data4=flatten(gate_10.Target0))
sdiff_7 = SolidDifference(BrepsA=sdiff_6, BrepsB=cap_9)
geo = Geometry(merge_38)
item_43 = ListItem(List=sdiff_7, Index=0, Wrap=True)
null_4 = NullItem(Item=item_43)  # -> NullFlags, InvalidFlags, Description
filter_95 = StreamFilter(Gate=null_4.NullFlags, Stream0=sdiff_7, Stream1=sdiff_6)
sdiff_8 = SolidDifference(BrepsA=filter_95, BrepsB=cap_8)
item_44 = ListItem(List=sdiff_8, Index=0, Wrap=True)
null_5 = NullItem(Item=item_44)  # -> NullFlags, InvalidFlags, Description
filter_96 = StreamFilter(Gate=null_5.NullFlags, Stream0=sdiff_8, Stream1=filter_95)
sdiff_9 = SolidDifference(BrepsA=filter_96, BrepsB=cap_7)
filter_97 = StreamFilter(Gate=preview_level_of_detail_3, Stream0=geo, Stream1=sdiff_9)
axis_top_layer = Geometry(flatten([filter_97, move_94.Geometry]))

# ----
filter_98 = StreamFilter(Gate=precut_3, Stream1=carriage_inside_precut)
filter_99 = StreamFilter(Gate=precut_3, Stream1=motor_pocket_5)
filter_100 = StreamFilter(Gate=precut_3, Stream1=carriage_cutout)
filter_101 = StreamFilter(Gate=precut_5, Stream1=z_wall_inside_precut_2)
filter_102 = StreamFilter(Gate=precut_5, Stream1=z_wall_motor_pocket_3)
filter_103 = StreamFilter(Gate=precut_5, Stream1=z_wall_cutout_2)
filter_104 = StreamFilter(Gate=precut_6, Stream1=z_support_wall_inside_pocket_precut_2)
filter_105 = StreamFilter(Gate=precut_6, Stream1=z_support_wall_cutout_3)
filter_106 = StreamFilter(Gate=precut_top_axis_layer, Stream1=axis_top_layer_cutout)
filter_107 = StreamFilter(Gate=precut_top_axis_layer, Stream1=axis_top_layer_inside_holes)
filter_108 = StreamFilter(Gate=precut_top_axis_layer, Stream1=axis_top_layer_spacer_pocket)
filter_109 = StreamFilter(Gate=precut_top_axis_layer, Stream1=axis_top_layer_bearing_bolt_pocket)

# ---- group: Find geometry corner
cutout_curves = Curve(filter_100)
bbox_14 = BoundingBox(Content=flatten(cutout_curves), Plane=PlaneXY(0, 0, 0), UnionBox=True)  # -> Box, Box_2
debrep_5 = DeconstructBrep(Brep=bbox_14.Box)  # -> Faces, Edges, Vertices
item_45 = ListItem(List=debrep_5.Vertices, Index=0, Wrap=True)
xy_47 = XYPlane(Origin=item_45)
cut_geomtery_plane = Plane(xy_47)
cut_position_plane_2 = Plane(cut_position_plane)

cutout_curves_2 = Curve(filter_103)
bbox_15 = BoundingBox(Content=flatten(cutout_curves_2), Plane=PlaneXY(0, 0, 0), UnionBox=True)  # -> Box, Box_2
debrep_6 = DeconstructBrep(Brep=bbox_15.Box)  # -> Faces, Edges, Vertices
item_46 = ListItem(List=debrep_6.Vertices, Index=0, Wrap=True)
xy_48 = XYPlane(Origin=item_46)
cut_geomtery_plane_2 = Plane(xy_48)
cut_position_plane_3 = Plane(cut_position_plane)

cutout_curves_3 = Curve(filter_105)
bbox_16 = BoundingBox(Content=flatten(cutout_curves_3), Plane=PlaneXY(0, 0, 0), UnionBox=True)  # -> Box, Box_2
debrep_7 = DeconstructBrep(Brep=bbox_16.Box)  # -> Faces, Edges, Vertices
item_47 = ListItem(List=debrep_7.Vertices, Index=0, Wrap=True)
xy_49 = XYPlane(Origin=item_47)
cut_geomtery_plane_3 = Plane(xy_49)
cut_position_plane_4 = Plane(cut_position_plane)

cutout_curves_4 = Curve(filter_106)
bbox_17 = BoundingBox(Content=flatten(cutout_curves_4), Plane=PlaneXY(0, 0, 0), UnionBox=True)  # -> Box, Box_2
debrep_8 = DeconstructBrep(Brep=bbox_17.Box)  # -> Faces, Edges, Vertices
item_48 = ListItem(List=debrep_8.Vertices, Index=0, Wrap=True)
xy_50 = XYPlane(Origin=item_48)
cut_position_plane_5 = Plane(cut_position_plane)
cut_geomtery_plane_4 = Plane(xy_50)

# ----
filter_110 = StreamFilter(Gate=cut_2, Stream1=gantry_base_v_rail_bird_beak_toolpaths)
orient_33 = Orient(Geometry=filter_98, Source=cut_geomtery_plane, Target=cut_position_plane_2)  # -> Geometry, Transform
orient_34 = Orient(Geometry=filter_99, Source=cut_geomtery_plane, Target=cut_position_plane_2)  # -> Geometry, Transform
orient_35 = Orient(Geometry=filter_100, Source=cut_geomtery_plane, Target=cut_position_plane_2)  # -> Geometry, Transform
orient_36 = Orient(Geometry=filter_101, Source=cut_geomtery_plane_2, Target=cut_position_plane_3)  # -> Geometry, Transform
orient_37 = Orient(Geometry=filter_102, Source=cut_geomtery_plane_2, Target=cut_position_plane_3)  # -> Geometry, Transform
orient_38 = Orient(Geometry=filter_103, Source=cut_geomtery_plane_2, Target=cut_position_plane_3)  # -> Geometry, Transform
orient_39 = Orient(Geometry=filter_104, Source=cut_geomtery_plane_3, Target=cut_position_plane_4)  # -> Geometry, Transform
orient_40 = Orient(Geometry=filter_105, Source=cut_geomtery_plane_3, Target=cut_position_plane_4)  # -> Geometry, Transform
orient_41 = Orient(Geometry=filter_107, Source=cut_geomtery_plane_4, Target=cut_position_plane_5)  # -> Geometry, Transform
orient_42 = Orient(Geometry=filter_108, Source=cut_geomtery_plane_4, Target=cut_position_plane_5)  # -> Geometry, Transform
orient_43 = Orient(Geometry=filter_37, Source=cut_geomtery_plane_4, Target=cut_position_plane_5)  # -> Geometry, Transform
orient_44 = Orient(Geometry=filter_38, Source=cut_geomtery_plane_4, Target=cut_position_plane_5)  # -> Geometry, Transform
orient_45 = Orient(Geometry=filter_109, Source=cut_geomtery_plane_4, Target=cut_position_plane_5)  # -> Geometry, Transform
orient_46 = Orient(Geometry=filter_106, Source=cut_geomtery_plane_4, Target=cut_position_plane_5)  # -> Geometry, Transform

# ---- group: Precut top axis layer
axis_top_layer_bearing_bolt_pocket_3 = Curve(orient_45.Geometry)
spacer_pocket_depth_5 = Panel(spacer_pocket_depth_3)
bearing_bolt_pocket_depth_3 = Panel(bearing_bolt_pocket_depth)
axis_top_layer_inside_precut_2 = Curve(orient_41.Geometry)
rack_pocket_depth_7 = Panel(rack_pocket_depth_3)
pinion_pocket_depth_4 = Panel(pinion_pocket_depth_2)
axis_top_layer_cutout_2 = Curve(orient_46.Geometry)
spacer_pockets_2 = Curve(orient_42.Geometry)
pinion_pocket_3 = Curve(orient_43.Geometry)
rack_pocket_4 = Curve(orient_44.Geometry)

# ---- group: Z support wall cutting
numner_of_z_support_walls_to_cut_2 = Panel(numner_of_z_support_walls_to_cut)
z_support_wall_inside_pocket_precut_3 = Curve(orient_39.Geometry)
z_support_wall_cutout_5 = Curve(orient_40.Geometry)

# ---- group: Carriage cutting
carriage_motor_pocket_depth_5 = Panel(carriage_motor_pocket_depth_2)
carriage_inside_precut_2 = Curve(orient_33.Geometry)
carriage_cutout_2 = Curve(orient_35.Geometry)
motor_pocket_7 = Curve(orient_34.Geometry)

# ---- group: Z wall cutting
z_wall_motor_pocket_depth_4 = Panel(z_wall_motor_pocket_depth_2)
numner_of_z_walls_to_cut_2 = Panel(numner_of_z_walls_to_cut)
z_wall_motor_pocket_5 = Curve(orient_37.Geometry)
z_wall_inside_precut_3 = Curve(orient_36.Geometry)
z_wall_cutout_3 = Curve(orient_38.Geometry)

# ----
cut_depth_top_layer_2 = Panel(cut_depth_top_layer)

# ---- group: Pre cut
cutout = Cutout(
    curves_for_cutout=axis_top_layer_inside_precut_2,
    cut_depth=cut_depth_top_layer_2,
    pass_depth=pass_depth_from_easy_interface,
    tool_diameter=main_material_and_rack_diameter,
    use_climb_direction=Toggle(False),
    use_inside_cutting=Toggle(True))
pocket = Pocket(
    curves_for_raster_pocket=spacer_pockets_2,
    cut_depth_pocket=spacer_pocket_depth_5,
    pass_depth=pass_depth_from_easy_interface,
    tool_diameter=main_material_and_rack_diameter,
    stepover_0_1=pocket_stepover,
    raster_along_y_0_1=Toggle(False))  # -> pocket_toolpaths_2, feed_rate_multiplier_4

# ---- group: Main cut
pocket_2 = Pocket(
    curves_for_raster_pocket=pinion_pocket_3,
    cut_depth_pocket=pinion_pocket_depth_4,
    pass_depth=pass_depth_from_easy_interface,
    tool_diameter=main_material_and_rack_diameter,
    stepover_0_1=pocket_stepover,
    raster_along_y_0_1=Toggle(False))  # -> pocket_toolpaths_2, feed_rate_multiplier_4
pocket_3 = Pocket(
    curves_for_raster_pocket=rack_pocket_4,
    cut_depth_pocket=rack_pocket_depth_7,
    pass_depth=pass_depth_from_easy_interface,
    tool_diameter=main_material_and_rack_diameter,
    stepover_0_1=pocket_stepover,
    raster_along_y_0_1=Toggle(False))  # -> pocket_toolpaths_2, feed_rate_multiplier_4
pocket_4 = Pocket(
    curves_for_raster_pocket=axis_top_layer_bearing_bolt_pocket_3,
    cut_depth_pocket=bearing_bolt_pocket_depth_3,
    pass_depth=pass_depth_from_easy_interface,
    tool_diameter=main_material_and_rack_diameter,
    stepover_0_1=pocket_stepover,
    raster_along_y_0_1=Toggle(False))  # -> pocket_toolpaths_2, feed_rate_multiplier_4
cutout_2 = Cutout(
    curves_for_cutout=axis_top_layer_cutout_2,
    cut_depth=cut_depth_top_layer_2,
    pass_depth=pass_depth_from_easy_interface,
    tool_diameter=main_material_and_rack_diameter,
    use_climb_direction=Toggle(False),
    use_inside_cutting=Toggle(False))

# ----
merge_39 = Merge(Data1=pocket.pocket_toolpaths_2, Data2=cutout)
merge_40 = Merge(Data1=pocket_2.pocket_toolpaths_2, Data2=pocket_3.pocket_toolpaths_2, Data3=pocket_4.pocket_toolpaths_2, Data4=cutout_2)
main_cut_toolpaths = Curve(merge_40)
pre_cut_toolpaths = Curve(merge_39)
axis_top_layer_2 = Geometry(axis_top_layer)
axis_top_layer_3 = Geometry(axis_top_layer)

# ---- group: Make machine bed outlines
corner_radius_12 = Panel(corner_radius)
actual_z_axis_lenght_2 = Panel(actual_z_axis_lenght)
main_material_thickness_22 = Panel(thickness)
make_vacuum_bed_3 = Panel(make_vacuum_bed)
vacuum_tube_diameter_2 = Panel(vacuum_tube_diameter)
make_electronics_section_outside_rack_2 = Panel(make_electronics_section_outside_rack)
section_width_2 = Panel(section_width)
number_of_layers_beneath_lower_gantry_ra_2 = Panel(number_of_layers_beneath_lower_gantry_ra)  # "Number of layers beneath lower gantry rack and rail layer"
actual_extended_axis_lenght_second_axis_3 = Panel(actual_extended_axis_lenght_second_axis)
rail_rack_and_pinion_material_thickness_13 = Panel(thickness_2)
main_material_thickness_23 = Panel(thickness)
number_of_layers_beneath_lower_gantry_ra_3 = Panel(number_of_layers_beneath_lower_gantry_ra)  # "Number of layers beneath lower gantry rack and rail layer"
hold_down_hole_diameter_2 = Panel(hold_down_and_registration_hole_diameter)
hold_down_minimum_spacing_2 = Panel(hold_down_minimum_spacing)
upper_axis_carriage_plate_corner_point_3 = Point(upper_axis_carriage_plate_corner_point)
center_point_upper_axis_6 = Point(center_point_upper_axis)
or_3 = GateOr(A=make_vacuum_bed_3, B=make_electronics_section_outside_rack_2)
pdecon_27 = Deconstruct(Point=upper_axis_carriage_plate_corner_point_3)  # -> XComponent, YComponent, ZComponent
make_section_outside_rack = Panel(or_3)
actual_extended_axis_lenght_second_axis_4 = Panel(actual_extended_axis_lenght_second_axis_3)
section_width_3 = Panel(section_width_2)
main_material_thickness_24 = Panel(main_material_thickness_22)
vacuum_tube_diameter_3 = Panel(vacuum_tube_diameter_2)
abs = Absolute(Value=flatten(pdecon_27.YComponent))
side_section_width = Panel(abs)
center_point_upper_axis_7 = Point(center_point_upper_axis_6)
addition_66 = Addition(A=main_material_thickness_24, B=main_material_thickness_24, C=vacuum_tube_diameter_3)
multiplication_97 = Multiplication(A=main_material_thickness_23, B=number_of_layers_beneath_lower_gantry_ra_3)
multiplication_98 = Multiplication(A=actual_extended_axis_lenght_second_axis_4, B="0.5")
sort_6 = SortList(Keys=[addition_66, section_width_3])  # -> Keys, ValuesA
addition_67 = Addition(A=rail_rack_and_pinion_material_thickness_13, B=multiplication_97)
rev_8 = ReverseList(List=sort_6.Keys)
hold_down_hole_diameter_3 = Panel(hold_down_hole_diameter_2)
X_24 = UnitX(Factor=actual_extended_axis_lenght_second_axis_3)
X_25 = UnitX(Factor=actual_extended_axis_lenght_second_axis_3)
item_49 = ListItem(List=rev_8, Index=0, Wrap=True)
Z_42 = UnitZ(Factor=addition_67)
X_26 = UnitX(Factor=multiplication_98)
neg_49 = Negative(Value=Z_42)
move_95 = Move(Geometry=center_point_upper_axis_7, Motion=X_26)  # -> Geometry, Transform
xz_40 = XZPlane(Origin=center_point_upper_axis_6)
xz_41 = XZPlane(Origin=center_point_upper_axis_6)
Y_29 = UnitY(Factor=item_49)
multiplication_99 = Multiplication(A=hold_down_hole_diameter_3, B="1.5")
move_96 = Move(Geometry=move_95.Geometry, Motion=neg_49)  # -> Geometry, Transform
make_section_outside_rack_2 = Panel(make_section_outside_rack)
neg_50 = Negative(Value=multiplication_99)
Y_30 = UnitY(Factor=neg_50)
hold_down_minimum_spacing_3 = Panel(hold_down_minimum_spacing_2)
xz_42 = XZPlane(Origin=center_point_upper_axis_6)
hold_down_hole_diameter_4 = Panel(hold_down_hole_diameter_2)
multiplication_100 = Multiplication(A=hold_down_hole_diameter_2, B="0.5")

# ---- group: Make top gantry rail preview brep
rack_teeth_lower_gantry_axis_2 = Curve(rack_teeth_lower_gantry_axis)
preview_level_of_detail_4 = Panel(list_3)
rail_rack_and_pinion_material_thickness_14 = Panel(thickness_2)
rack_tooth_edge_5 = Curve(rack_tooth_edge_4)
rack_pocket_5 = Curve(rack_pocket_2)
rack_pocket_depth_8 = Panel(rack_pocket_depth_4)
rail_profile_3 = Curve(rail_profile)
actual_extended_axis_lenght_second_axis_5 = Panel(actual_extended_axis_lenght_second_axis)
end_43 = EndPoints(Curve=rack_tooth_edge_5)  # -> Start, End
end_44 = EndPoints(Curve=rail_profile_3)  # -> Start, End
neg_51 = Negative(Value=rail_rack_and_pinion_material_thickness_14)
pdecon_28 = Deconstruct(Point=end_44.Start)  # -> XComponent, YComponent, ZComponent
pdecon_29 = Deconstruct(Point=end_43.Start)  # -> XComponent, YComponent, ZComponent
pdecon_30 = Deconstruct(Point=end_44.End)  # -> XComponent, YComponent, ZComponent
neg_52 = Negative(Value=rack_pocket_depth_8)
Z_43 = UnitZ(Factor=neg_51)
Z_44 = UnitZ(Factor=neg_52)
pt_65 = ConstructPoint(XCoordinate=pdecon_30.XComponent, YCoordinate=pdecon_29.YComponent, ZCoordinate=pdecon_30.ZComponent)
pt_66 = ConstructPoint(XCoordinate=pdecon_28.XComponent, YCoordinate=pdecon_29.YComponent, ZCoordinate=pdecon_28.ZComponent)
extr_16 = Extrude(Base=rack_pocket_5, Direction=Z_44)
cap_13 = CapHoles(Brep=extr_16)
ln_53 = Line(StartPoint=pt_66, EndPoint=end_44.Start)
ln_54 = Line(StartPoint=pt_66, EndPoint=pt_65)
ln_55 = Line(StartPoint=end_44.End, EndPoint=pt_65)
join_26 = JoinCurves(Curves=flatten([ln_54, rail_profile_3, ln_55, ln_53]), Preserve=False)
X_27 = UnitX(Factor=actual_extended_axis_lenght_second_axis_5)
center_point_upper_axis_8 = Point(center_point_upper_axis)
extr_17 = Extrude(Base=join_26, Direction=X_27)
cap_14 = CapHoles(Brep=extr_17)
xz_43 = XZPlane(Origin=center_point_upper_axis_8)
sdiff_10 = SolidDifference(BrepsA=cap_14, BrepsB=cap_13)
mirror_63 = Mirror(Geometry=sdiff_10, Plane=xz_43)  # -> Geometry, Transform
move_97 = Move(Geometry=rack_teeth_lower_gantry_axis_2, Motion=Z_44)  # -> Geometry, Transform
gantry_lower_axis_outer_corner = Point(pt_66)

# ---- group: Make machine bed outlines (continued)
gantry_lower_axis_outer_corner_2 = Point(gantry_lower_axis_outer_corner)
pdecon_31 = Deconstruct(Point=gantry_lower_axis_outer_corner_2)  # -> XComponent, YComponent, ZComponent
gantry_lower_axis_outer_corner_3 = Point(gantry_lower_axis_outer_corner_2)
pt_67 = ConstructPoint(XCoordinate=pdecon_31.XComponent, YCoordinate=side_section_width, ZCoordinate=0)
move_98 = Move(Geometry=pt_67, Motion=X_24)  # -> Geometry, Transform
move_99 = Move(Geometry=gantry_lower_axis_outer_corner_3, Motion=X_25)  # -> Geometry, Transform
move_100 = Move(Geometry=pt_67, Motion=Y_29)  # -> Geometry, Transform
mirror_64 = Mirror(Geometry=move_98.Geometry, Plane=xz_40)  # -> Geometry, Transform
mirror_65 = Mirror(Geometry=move_99.Geometry, Plane=xz_41)  # -> Geometry, Transform
ln_56 = Line(StartPoint=pt_67, EndPoint=move_98.Geometry)
move_101 = Move(Geometry=flatten(ln_56), Motion=Y_30)  # -> Geometry, Transform
filter_111 = StreamFilter(Gate=make_section_outside_rack_2, Stream0=pt_67, Stream1=move_100.Geometry)
gantry_lower_axis_bottom_right_corner = Point(mirror_65.Geometry)
gantrybed_hold_down_axis = Curve(move_101.Geometry)
gantry_lower_axis_outer_corner_4 = Point(gantry_lower_axis_outer_corner_3)
machine_bottom_right_corner = Point(mirror_64.Geometry)
machine_bed_top_left_corner = Point(filter_111)
ln_57 = Line(StartPoint=machine_bed_top_left_corner, EndPoint=machine_bottom_right_corner)
eval_17 = EvaluateLength(Curve=ln_57, Length="0.5", Normalized=True)  # -> Point, Tangent, Parameter
yz_26 = YZPlane(Origin=eval_17.Point)
mirror_66 = Mirror(Geometry=move_96.Geometry, Plane=yz_26)  # -> Geometry, Transform
len_11 = Length(Curve=gantrybed_hold_down_axis)
rec_2pt_14 = Rectangle2Pt(Plane=PlaneXY(0, 0, 0), PointA=machine_bed_top_left_corner, PointB=machine_bottom_right_corner, Radius=corner_radius_12)  # -> Rectangle, Length
rec_2pt_15 = Rectangle2Pt(
    Plane=PlaneXY(0, 0, 0),
    PointA=gantry_lower_axis_outer_corner_4,
    PointB=gantry_lower_axis_bottom_right_corner,
    Radius=corner_radius_12)  # -> Rectangle, Length
subtraction_54 = Subtraction(A=len_11, B=multiplication_99)
xy_51 = XYPlane(Origin=mirror_66.Geometry)
merge_41 = Merge(Data1=multiplication_99, Data2=subtraction_54)
rotate_25 = Rotate(Geometry=xy_51, Angle=4.71238898, Plane=xy_51)  # -> Geometry, Transform
eval_18 = EvaluateLength(Curve=gantrybed_hold_down_axis, Length=merge_41, Normalized=Toggle(False))  # -> Point, Tangent, Parameter
gantry_work_area_center_plane = Plane(rotate_25.Geometry)
shatter_9 = Shatter(Curve=gantrybed_hold_down_axis, Parameters=eval_18.Parameter)
item_50 = ListItem(List=shatter_9, Index="1", Wrap=True)
len_12 = Length(Curve=item_50)
division_8 = Division(A=len_12, B=hold_down_minimum_spacing_3)
division_9 = Division(A=division_8, B="2")
round_3 = Round(Number=division_9)  # -> Nearest, Floor, Ceiling
multiplication_101 = Multiplication(A=round_3.Nearest, B="2")
addition_68 = Addition(A=multiplication_101, B="1")
divide_2 = DivideCurve(Curve=item_50, Count=addition_68, Kinks=False)  # -> Points, Tangents, Parameters
mirror_67 = Mirror(Geometry=divide_2.Points, Plane=xz_42)  # -> Geometry, Transform
merge_42 = Merge(Data1=divide_2.Points, Data2=mirror_67.Geometry)
xy_52 = XYPlane(Origin=merge_42)
cir_12 = Circle(Plane=xy_52, Radius=multiplication_100)
machine_bed_hold_down_holes = Curve(cir_12)
gantry_work_area_center_plane_2 = Plane(gantry_work_area_center_plane)
machine_bed_lower_layer_outline = Curve(rec_2pt_15.Rectangle)
machine_bed_lower_layer_outline_2 = Curve(rec_2pt_14.Rectangle)

# ---- group: Make lower gantry rail preview outline
extra_precut_with_offset_top_layer_4 = Panel(extra_precut_with_offset_top_layer)
axis_edge_8 = Curve(axis_edge_5)
corner_radius_13 = Panel(corner_radius)
Y_31 = UnitY(Factor=extra_precut_with_offset_top_layer_4)
move_102 = Move(Geometry=axis_edge_8, Motion=Y_31)  # -> Geometry, Transform
offset_axis_edge_2 = Curve(move_102.Geometry)
xz_44 = XZPlane(Origin=Point(0, 0, 0))
mirror_68 = Mirror(Geometry=offset_axis_edge_2, Plane=xz_44)  # -> Geometry, Transform
addition_69 = Addition(A=extra_precut_with_offset_top_layer_4, B=pdecon_29.YComponent)
end_45 = EndPoints(Curve=mirror_68.Geometry)  # -> Start, End
pt_68 = ConstructPoint(XCoordinate=pdecon_28.XComponent, YCoordinate=addition_69, ZCoordinate=pdecon_28.ZComponent)
rec_2pt_16 = Rectangle2Pt(Plane=PlaneXY(0, 0, 0), PointA=end_45.End, PointB=pt_68, Radius=corner_radius_13)  # -> Rectangle, Length
axis_top_layer_outline_3 = Curve(rec_2pt_16.Rectangle)

# ---- group: Make lower gantry rail outline
corner_radius_14 = Panel(corner_radius)
rail_lowest_point_6 = Point(rail_lowest_point_2)
gantry_lower_axis_corner_point = Point(pt_66)
actual_axis_length_4 = Panel(actual_extended_axis_lenght_second_axis)
pdecon_32 = Deconstruct(Point=rail_lowest_point_6)  # -> XComponent, YComponent, ZComponent
X_28 = UnitX(Factor=actual_axis_length_4)
pt_69 = ConstructPoint(XCoordinate=pdecon_32.XComponent, YCoordinate=pdecon_32.YComponent, ZCoordinate=0)
move_103 = Move(Geometry=gantry_lower_axis_corner_point, Motion=X_28)  # -> Geometry, Transform
xy_53 = XYPlane(Origin=Point(0, 0, 0))
rec_2pt_17 = Rectangle2Pt(Plane=xy_53, PointA=pt_69, PointB=move_103.Geometry, Radius=corner_radius_14)  # -> Rectangle, Length
axis_lower_layer_outline = Curve(rec_2pt_17.Rectangle)

# ---- group: Make inside holes for axis top layer
wedge_hole_top_layer_3 = Curve(wedge_hole_top_layer)
rail_rack_and_pinion_material_thickness_15 = Panel(thickness_2)
join_rails_with_dowels_instead_of_bolts_7 = Panel(join_rails_with_dowels_instead_of_bolts_4)
attachment_bolt_diameter_4 = Panel(attachment_bolt_diameter)
spacer_diameter_inc_margin_3 = Panel(spacer_diameter_inc_margin)
spacer_pocket_depth_6 = Panel(spacer_pocket_depth)
hole_planes_top_layer_3 = Plane(hole_planes_top_gantry_layer)
extra_cutout_depth_4 = Panel(extra_cutout_depth)
axis_top_layer_outline_4 = Curve(axis_top_layer_outline_3)
addition_70 = Addition(A=extra_cutout_depth_4, B=rail_rack_and_pinion_material_thickness_15)
xy_54 = XYPlane(Origin=Point(0, 0, 0))
multiplication_102 = Multiplication(A=attachment_bolt_diameter_4, B="0.5")
filter_112 = StreamFilter(Gate=join_rails_with_dowels_instead_of_bolts_7, Stream0=spacer_diameter_inc_margin_3)
cir_13 = Circle(Plane=xy_54, Radius=multiplication_102)
xy_55 = XYPlane(Origin=Point(0, 0, 0))
xy_56 = XYPlane(Origin=Point(0, 0, 0))
multiplication_103 = Multiplication(A=filter_112, B="0.5")
rotate_26 = Rotate(Geometry=xy_55, Angle=1.570796327, Plane=xy_55)  # -> Geometry, Transform
cir_14 = Circle(Plane=xy_56, Radius=multiplication_103)
filter_113 = StreamFilter(Gate=join_rails_with_dowels_instead_of_bolts_7, Stream0=cir_13, Stream1=wedge_hole_top_layer_3)
orient_47 = Orient(Geometry=cir_14, Source=rotate_26.Geometry, Target=hole_planes_top_layer_3)  # -> Geometry, Transform
orient_48 = Orient(Geometry=filter_113, Source=rotate_26.Geometry, Target=hole_planes_top_layer_3)  # -> Geometry, Transform
clean_5 = CleanTree(RemoveNulls=True, RemoveInvalid=True, RemoveEmpty=False, Tree=orient_47.Geometry)
spacer_pocket_depth_7 = Panel(spacer_pocket_depth_6)
axis_top_layer_spacer_pocket_2 = Curve(clean_5)
cut_depth_top_layer_3 = Panel(addition_70)
axis_top_layer_inside_holes_2 = Curve(orient_48.Geometry)
axis_top_layer_cutout_3 = Curve(axis_top_layer_outline_4)

# ---- group: Make top gantry rail preview brep (continued)
spacer_pockets_3 = Curve(axis_top_layer_spacer_pocket_2)
spacer_pocket_depth_8 = Panel(spacer_pocket_depth_7)
lower_left_rail_inside_precut = Curve(axis_top_layer_inside_holes_2)
gate_11 = StreamGate(Stream=spacer_pockets_3, Gate=preview_level_of_detail_4)  # -> Target0, Target1
gate_12 = StreamGate(Stream=lower_left_rail_inside_precut, Gate=preview_level_of_detail_4)  # -> Target0, Target1
neg_53 = Negative(Value=spacer_pocket_depth_8)
Z_45 = UnitZ(Factor=neg_53)
extr_18 = Extrude(Base=gate_12.Target1, Direction=Z_43)
extr_19 = Extrude(Base=gate_11.Target1, Direction=Z_45)
cap_15 = CapHoles(Brep=extr_18)
cap_16 = CapHoles(Brep=extr_19)
sdiff_11 = SolidDifference(BrepsA=sdiff_10, BrepsB=cap_16)
mirror_69 = Mirror(Geometry=[gate_11.Target0, gate_12.Target0], Plane=xz_43)  # -> Geometry, Transform
item_51 = ListItem(List=sdiff_11, Index=0, Wrap=True)
null_6 = NullItem(Item=item_51)  # -> NullFlags, InvalidFlags, Description
merge_43 = Merge(
    Data1=flatten([sdiff_10, mirror_63.Geometry]),
    Data2=flatten([gate_11.Target0, gate_12.Target0]),
    Data3=flatten(mirror_69.Geometry))
filter_114 = StreamFilter(Gate=null_6.NullFlags, Stream0=sdiff_11, Stream1=sdiff_10)
mirror_70 = Mirror(Geometry=[move_97.Geometry, gate_11.Target0, gate_12.Target0], Plane=xz_43)  # -> Geometry, Transform
sdiff_12 = SolidDifference(BrepsA=filter_114, BrepsB=cap_15)
mirror_71 = Mirror(Geometry=sdiff_12, Plane=xz_43)  # -> Geometry, Transform
filter_115 = StreamFilter(Gate=preview_level_of_detail_4, Stream0=merge_43, Stream1=[mirror_71.Geometry, sdiff_12])
gantry_rail_top_layer = Geometry(flatten([filter_115, move_97.Geometry, mirror_70.Geometry]))

# ---- group: Prep rail lower layer cutting
wedge_hole_mid_layers_2 = Curve(wedge_hole_mid_layers)
number_of_layers_beneath_lower_gantry_ra_4 = Panel(number_of_layers_beneath_lower_gantry_ra)  # "Number of layers beneath lower gantry rack and rail layer"
axis_lower_layer_outline_2 = Curve(axis_lower_layer_outline)
main_material_and_rack_bit_diameter = Panel(diameter_2)
tight_nesting_margin = Panel("0.5")
addition_71 = Addition(A=main_material_and_rack_bit_diameter, B=tight_nesting_margin)
smaller_6 = SmallerThan(FirstNumber=number_of_layers_beneath_lower_gantry_ra_4, SecondNumber="1")  # -> SmallerThan, OrEqualTo
xy_57 = XYPlane(Origin=Point(0, 0, 0))
filter_116 = StreamFilter(Gate=join_rails_with_dowels_instead_of_bolts_7, Stream0=cir_13, Stream1=wedge_hole_mid_layers_2)
rotate_27 = Rotate(Geometry=xy_57, Angle=1.570796327, Plane=xy_57)  # -> Geometry, Transform
orient_49 = Orient(Geometry=filter_116, Source=rotate_27.Geometry, Target=hole_planes_top_layer_3)  # -> Geometry, Transform
merge_44 = Merge(Data1=flatten(orient_49.Geometry))
multiplication_104 = Multiplication(A=number_of_layers_beneath_lower_gantry_ra_4, B="2")
filter_117 = StreamFilter(Gate=smaller_6.SmallerThan, Stream0=axis_lower_layer_outline_2)
filter_118 = StreamFilter(Gate=smaller_6.SmallerThan, Stream0=merge_44)
axis_mid_layer_outline_2 = Curve(filter_117)
number_of_lower_layer_rails = Panel(multiplication_104)
bbox_18 = BoundingBox(Content=axis_mid_layer_outline_2, Plane=PlaneXY(0, 0, 0), UnionBox=True)  # -> Box, Box_2
dim_8 = Dimensions(Surface=bbox_18.Box)  # -> UDimension, VDimension
addition_72 = Addition(A=dim_8.VDimension, B=addition_71)
axis_mid_layers_inside_holes = Curve(filter_118)
series_4 = Series(Start=0, Step=addition_72, Count=number_of_lower_layer_rails)
Y_32 = UnitY(Factor=series_4)
move_104 = Move(Geometry=graft(axis_mid_layer_outline_2), Motion=Y_32)  # -> Geometry, Transform
move_105 = Move(Geometry=graft(axis_mid_layers_inside_holes), Motion=Y_32)  # -> Geometry, Transform
axis_mid_layers_inside_holes_2 = Curve(flatten(move_105.Geometry))
axis_mid_layer_outline_3 = Curve(flatten(move_104.Geometry))

# ---- group: Make lower gantry rail preview brep
number_of_layers_beneath_lower_gantry_ra_5 = Panel(number_of_layers_beneath_lower_gantry_ra)  # "Number of layers beneath lower gantry rack and rail layer"
rail_rack_and_pinion_material_thickness_16 = Panel(thickness_2)
preview_level_of_detail_5 = Panel(list_3)
main_material_thickness_25 = Panel(thickness)
axis_mid_layers_inside_holes_3 = Curve(axis_mid_layers_inside_holes)
axis_lower_layer_outline_3 = Curve(axis_lower_layer_outline)
gate_13 = StreamGate(Stream=axis_mid_layers_inside_holes_3, Gate=preview_level_of_detail_5)  # -> Target0, Target1
neg_54 = Negative(Value=main_material_thickness_25)
series_5 = Series(
    Start=rail_rack_and_pinion_material_thickness_16,
    Step=main_material_thickness_25,
    Count=number_of_layers_beneath_lower_gantry_ra_5)
Z_46 = UnitZ(Factor=neg_54)
neg_55 = Negative(Value=series_5)
extr_20 = Extrude(Base=gate_13.Target1, Direction=Z_46)
Z_47 = UnitZ(Factor=neg_55)
neg_56 = Negative(Value=main_material_thickness_25)
cap_17 = CapHoles(Brep=extr_20)
Z_48 = UnitZ(Factor=neg_56)
extr_21 = Extrude(Base=axis_lower_layer_outline_3, Direction=Z_48)
center_point_upper_axis_9 = Point(center_point_upper_axis)
cap_18 = CapHoles(Brep=extr_21)
sdiff_13 = SolidDifference(BrepsA=cap_18, BrepsB=cap_17)
filter_119 = StreamFilter(Gate=preview_level_of_detail_5, Stream0=cap_18, Stream1=sdiff_13)
xz_45 = XZPlane(Origin=center_point_upper_axis_9)
move_106 = Move(Geometry=filter_119, Motion=Z_47)  # -> Geometry, Transform
mirror_72 = Mirror(Geometry=move_106.Geometry, Plane=xz_45)  # -> Geometry, Transform
gantry_rail_lower_layers_brep = Brep(flatten([mirror_72.Geometry, move_106.Geometry]))

# ---- group: Prep upper bed layer cutting
wedge_hole_mid_layers_3 = Curve(wedge_hole_mid_layers)
machine_bed_lower_layer_outline_3 = Curve(machine_bed_lower_layer_outline)
center_point_upper_axis_10 = Point(center_point_upper_axis)
number_of_layers_in_gantry_bed_4 = Panel(number_of_layers_in_gantry_bed_3)
xz_46 = XZPlane(Origin=center_point_upper_axis_10)
larger_10 = LargerThan(FirstNumber=number_of_layers_in_gantry_bed_4, SecondNumber="1")  # -> LargerThan, OrEqualTo
xy_58 = XYPlane(Origin=Point(0, 0, 0))
filter_120 = StreamFilter(Gate=join_rails_with_dowels_instead_of_bolts_7, Stream0=cir_13, Stream1=wedge_hole_mid_layers_3)
rotate_28 = Rotate(Geometry=xy_58, Angle=1.570796327, Plane=xy_58)  # -> Geometry, Transform
orient_50 = Orient(Geometry=filter_120, Source=rotate_28.Geometry, Target=hole_planes_top_layer_3)  # -> Geometry, Transform
merge_45 = Merge(Data1=flatten(orient_50.Geometry))
filter_121 = StreamFilter(Gate=larger_10.LargerThan, Stream1=machine_bed_lower_layer_outline_3)
filter_122 = StreamFilter(Gate=larger_10.LargerThan, Stream1=merge_45)
mirror_73 = Mirror(Geometry=filter_122, Plane=xz_46)  # -> Geometry, Transform
clean_6 = CleanTree(RemoveNulls=True, RemoveInvalid=True, RemoveEmpty=True, Tree=flatten([filter_122, mirror_73.Geometry]))
make_upper_bed_layer = Panel(larger_10.LargerThan)
bed_top_layer_outline = Curve(flatten(filter_121))
bed_top_layer_inside_holes = Curve(flatten(clean_6))

# ---- group: Prep lower bed layer cutting
machine_bed_hold_down_holes_2 = Curve(machine_bed_hold_down_holes)
wedge_hole_lowest_layer_2 = Curve(wedge_hole_lowest_layer)
center_point_upper_axis_11 = Point(center_point_upper_axis)
machine_bed_lower_layer_outline_4 = Curve(machine_bed_lower_layer_outline_2)
nut_pocket_2 = Curve(nut_pocket)
nut_pocket_depth_5 = Panel(nut_pocket_depth_3)
nut_width_flat_side_to_flat_side_4 = Panel(nut_width_flat_side_to_flat_side)
multiplication_105 = Multiplication(A=nut_width_flat_side_to_flat_side_4, B="0.02")
offset_18 = Offset(Curve=cir_13, Distance=multiplication_105, Plane=PlaneXY(0, 0, 0), Corners=1)
xz_47 = XZPlane(Origin=center_point_upper_axis_11)
xy_59 = XYPlane(Origin=Point(0, 0, 0))
flatten_3 = FlattenTree(Tree=offset_18, Path="{0}")
filter_123 = StreamFilter(Gate=join_rails_with_dowels_instead_of_bolts_7, Stream0=flatten_3, Stream1=wedge_hole_lowest_layer_2)
rotate_29 = Rotate(Geometry=xy_59, Angle=1.570796327, Plane=xy_59)  # -> Geometry, Transform
orient_51 = Orient(Geometry=filter_123, Source=rotate_29.Geometry, Target=hole_planes_top_layer_3)  # -> Geometry, Transform
filter_124 = StreamFilter(Gate=join_rails_with_dowels_instead_of_bolts_7, Stream0=nut_pocket_2)
orient_52 = Orient(Geometry=filter_124, Source=rotate_29.Geometry, Target=hole_planes_top_layer_3)  # -> Geometry, Transform
mirror_74 = Mirror(Geometry=orient_51.Geometry, Plane=xz_47)  # -> Geometry, Transform
mirror_75 = Mirror(Geometry=orient_52.Geometry, Plane=xz_47)  # -> Geometry, Transform
clean_7 = CleanTree(RemoveNulls=True, RemoveInvalid=True, RemoveEmpty=False, Tree=[orient_52.Geometry, mirror_75.Geometry])
merge_46 = Merge(Data1=flatten([orient_51.Geometry, mirror_74.Geometry]), Data2=flatten(machine_bed_lower_layer_outline_4))
bed_lower_layer_inside_holes = Curve(flatten(machine_bed_hold_down_holes_2))
bed_lower_layer_cutout = Curve(flatten(merge_46))
nut_pocket_depth_6 = Panel(nut_pocket_depth_5)
nut_pockets = Curve(flatten(clean_7))

# ----
y_corner_bed_2 = Panel(y_corner_bed)
x_corner_bed_2 = Panel(x_corner_bed)
bed_lower_layer_cutout_2 = Curve(flatten(bed_lower_layer_cutout))
bed_lower_layer_cutout_3 = Curve(bed_lower_layer_cutout)
pt_70 = ConstructPoint(XCoordinate=x_corner_bed_2, YCoordinate=y_corner_bed_2, ZCoordinate=0)
bbox_19 = BoundingBox(Content=bed_lower_layer_cutout_3, Plane=PlaneXY(0, 0, 0), UnionBox=True)  # -> Box, Box_2
xy_60 = XYPlane(Origin=pt_70)
debrep_9 = DeconstructBrep(Brep=bbox_19.Box)  # -> Faces, Edges, Vertices
item_52 = ListItem(List=debrep_9.Vertices, Index=0, Wrap=True)
bed_plane = Plane(xy_60)
xy_61 = XYPlane(Origin=item_52)
bed_finish_plane = Plane(bed_plane)
bed_ref_plane = Plane(xy_61)
orient_53 = Orient(Geometry=bed_lower_layer_cutout_2, Source=bed_ref_plane, Target=bed_finish_plane)  # -> Geometry, Transform
bed_ref = Curve(orient_53.Geometry)

# ---- group: Select bed registration holes
bed_lower_layer_inside_holes_2 = Curve(bed_lower_layer_inside_holes)
lng = ListLength(List=bed_lower_layer_inside_holes_2)
subtraction_55 = Subtraction(A=lng, B="1")
merge_47 = Merge(Data1="0", Data2=subtraction_55)
item_53 = ListItem(List=bed_lower_layer_inside_holes_2, Index=merge_47, Wrap=False)
bed_assembly_registration_holes = Curve(item_53)

# ----
rack_teeth_16 = Curve(rack_teeth_12)
cut_rack_geometry_identifer_2 = Panel("7")
current_action_2 = Panel(list_4)
rack_mill_margin_5 = Panel(rack_mill_margin)
first_premill_stepover_2 = Panel("0.025")
rack_pocket_depth_9 = Panel(rack_pocket_depth)
rack_and_pinion_tooth_height_4 = Panel(rack_and_pinion_tooth_height_2)
rack_teeth_bit_diameter_3 = Panel(diameter_5)
neg_57 = Negative(Value=rack_pocket_depth_9)
equals_51 = Equality(FirstNumber=cut_rack_geometry_identifer_2, SecondNumber=current_action_2)  # -> Equality, Inequality
multiplication_106 = Multiplication(A=rack_mill_margin_5, B="0.5")
multiplication_107 = Multiplication(A=rack_teeth_bit_diameter_3, B="0.5")
multiplication_108 = Multiplication(A=rack_teeth_bit_diameter_3, B=first_premill_stepover_2)
Z_49 = UnitZ(Factor=neg_57)
filter_125 = StreamFilter(Gate=equals_51.Equality, Stream1=rack_teeth_16)
addition_73 = Addition(A=multiplication_107, B=multiplication_106)
flip_9 = FlipCurve(Curve=filter_125)  # -> Curve, Flag
addition_74 = Addition(A=addition_73, B=multiplication_108)
move_107 = Move(Geometry=flip_9.Curve, Motion=Z_49)  # -> Geometry, Transform
gantry_work_area_center_plane_3 = Plane(gantry_work_area_center_plane_2)
cut1_2 = Panel(addition_74)
cut2_2 = Panel(addition_73)
cut3_2 = Panel(multiplication_107)
rack_teeth_17 = Curve(move_107.Geometry)
rack_cut_depth_2 = Panel(rack_and_pinion_tooth_height_4)
offset_19 = Offset(Curve=rack_teeth_17, Distance=cut1_2, Plane=PlaneXY(0, 0, 0), Corners=1)
offset_20 = Offset(Curve=rack_teeth_17, Distance=cut2_2, Plane=PlaneXY(0, 0, 0), Corners=1)  # disabled
offset_21 = Offset(Curve=rack_teeth_17, Distance=cut3_2, Plane=PlaneXY(0, 0, 0), Corners=1)
flip_10 = FlipCurve(Curve=offset_20)  # -> Curve, Flag
flip_11 = FlipCurve(Curve=offset_19)  # -> Curve, Flag
xz_48 = XZPlane(Origin=gantry_work_area_center_plane_3)
multiplication_109 = Multiplication(A=rack_teeth_bit_diameter_3, B="2")
mirror_76 = Mirror(Geometry=flip_11.Curve, Plane=xz_48)  # -> Geometry, Transform
end_46 = EndPoints(Curve=flip_11.Curve)  # -> Start, End
Y_33 = UnitY(Factor=multiplication_109)
neg_58 = Negative(Value=multiplication_109)
flip_12 = FlipCurve(Curve=mirror_76.Geometry)  # -> Curve, Flag
xz_49 = XZPlane(Origin=gantry_work_area_center_plane_3)
xz_50 = XZPlane(Origin=gantry_work_area_center_plane_3)
move_108 = Move(Geometry=end_46.Start, Motion=Y_33)  # -> Geometry, Transform
Y_34 = UnitY(Factor=neg_58)
end_47 = EndPoints(Curve=flip_12.Curve)  # -> Start, End
mirror_77 = Mirror(Geometry=offset_21, Plane=xz_49)  # -> Geometry, Transform
mirror_78 = Mirror(Geometry=flip_10.Curve, Plane=xz_50)  # -> Geometry, Transform
ln_58 = Line(StartPoint=move_108.Geometry, EndPoint=end_46.Start)
move_109 = Move(Geometry=end_47.Start, Motion=Y_34)  # -> Geometry, Transform
flip_13 = FlipCurve(Curve=mirror_77.Geometry)  # -> Curve, Flag
flip_14 = FlipCurve(Curve=mirror_78.Geometry)  # -> Curve, Flag
join_27 = JoinCurves(Curves=[ln_58, flip_11.Curve], Preserve=False)
ln_59 = Line(StartPoint=move_109.Geometry, EndPoint=end_47.Start)
join_28 = JoinCurves(Curves=[ln_59, flip_12.Curve], Preserve=False)
merge_48 = Merge(Data1=flip_10.Curve, Data2=flip_14.Curve)
merge_49 = Merge(Data1=offset_21, Data2=flip_13.Curve)
merge_50 = Merge(Data1=join_27, Data2=join_28)
rack_finish_mill_2 = Curve(merge_49)
rack_premill2_2 = Curve(merge_48)
rack_premill1_2 = Curve(merge_50)

axis_edge_9 = Curve(axis_edge_5)
v_rail_edge_cleanup_depth_3 = Panel(v_rail_edge_cleanup_depth)
extra_cutout_depth_5 = Panel(extra_cutout_depth)
addition_75 = Addition(A=v_rail_edge_cleanup_depth_3, B=extra_cutout_depth_5)
neg_59 = Negative(Value=addition_75)
Z_50 = UnitZ(Factor=neg_59)
move_110 = Move(Geometry=axis_edge_9, Motion=Z_50)  # -> Geometry, Transform
Y_35 = UnitY(Factor=multiplication_107)
move_111 = Move(Geometry=move_110.Geometry, Motion=Y_35)  # -> Geometry, Transform
ext_19 = ExtendCurve(Curve=move_111.Geometry, Type=0, Start=rack_teeth_bit_diameter_3, End=rack_teeth_bit_diameter_3)
redpline_4 = Reduce(Polyline=ext_19, Tolerance=1)  # -> Polyline, Reduction
xz_51 = XZPlane(Origin=Point(0, 0, 0))
mirror_79 = Mirror(Geometry=redpline_4.Polyline, Plane=xz_51)  # -> Geometry, Transform
flip_15 = FlipCurve(Curve=mirror_79.Geometry)  # -> Curve, Flag
merge_51 = Merge(Data1=flip_15.Curve)
xz_52 = XZPlane(Origin=gantry_work_area_center_plane_3)
mirror_80 = Mirror(Geometry=merge_51, Plane=xz_52)  # -> Geometry, Transform
flip_16 = FlipCurve(Curve=mirror_80.Geometry)  # -> Curve, Flag
merge_52 = Merge(Data1=flatten(merge_51), Data2=flatten(flip_16.Curve))
rev_9 = ReverseList(List=merge_52)
v_reail_edge_cleanup_toolpath_2 = Curve(rev_9)

# ---- group: Mirror axis
lower_left_rail_inside_precut_2 = Curve(axis_top_layer_inside_holes_2)
lower_left_rail_cutout = Curve(axis_top_layer_cutout_3)
spacer_pockets_4 = Curve(axis_top_layer_spacer_pocket_2)
rack_pocket_6 = Curve(rack_pocket_2)
xz_53 = XZPlane(Origin=Point(0, 0, 0))
mirror_81 = Mirror(Geometry=lower_left_rail_inside_precut_2, Plane=xz_53)  # -> Geometry, Transform
mirror_82 = Mirror(Geometry=rack_pocket_6, Plane=xz_53)  # -> Geometry, Transform
mirror_83 = Mirror(Geometry=spacer_pockets_4, Plane=xz_53)  # -> Geometry, Transform
mirror_84 = Mirror(Geometry=lower_left_rail_cutout, Plane=xz_53)  # -> Geometry, Transform

# ----
filter_126 = StreamFilter(Gate=precut_4, Stream1=nut_pockets)
filter_127 = StreamFilter(Gate=precut_4, Stream1=bed_lower_layer_cutout)
filter_128 = StreamFilter(Gate=precut_4, Stream1=bed_lower_layer_inside_holes)
filter_129 = StreamFilter(Gate=precut_lower_right_axis, Stream1=mirror_81.Geometry)
filter_130 = StreamFilter(Gate=precut_lower_right_axis, Stream1=mirror_83.Geometry)
filter_131 = StreamFilter(Gate=precut_lower_right_axis, Stream1=mirror_82.Geometry)
filter_132 = StreamFilter(Gate=precut_lower_right_axis, Stream1=mirror_84.Geometry)
filter_133 = StreamFilter(Gate=precut_lower_left_axis, Stream1=axis_top_layer_inside_holes_2)
filter_134 = StreamFilter(Gate=precut_lower_left_axis, Stream1=axis_top_layer_spacer_pocket_2)
filter_135 = StreamFilter(Gate=precut_lower_left_axis, Stream1=axis_top_layer_cutout_3)
filter_136 = StreamFilter(Gate=precut_7, Stream1=axis_mid_layers_inside_holes_2)
filter_137 = StreamFilter(Gate=precut_7, Stream1=axis_mid_layer_outline_3)
bed_assembly_registration_holes_2 = Curve(bed_assembly_registration_holes)

# ---- group: Find geometry corner
cutout_curves_5 = Curve(filter_127)
bbox_20 = BoundingBox(Content=flatten(cutout_curves_5), Plane=PlaneXY(0, 0, 0), UnionBox=True)  # -> Box, Box_2
debrep_10 = DeconstructBrep(Brep=bbox_20.Box)  # -> Faces, Edges, Vertices
item_54 = ListItem(List=debrep_10.Vertices, Index=0, Wrap=True)
xy_62 = XYPlane(Origin=item_54)
cut_geomtery_plane_5 = Plane(xy_62)
cut_position_plane_6 = Plane(cut_position_plane)

cutout_curves_6 = Curve(filter_132)
bbox_21 = BoundingBox(Content=flatten(cutout_curves_6), Plane=PlaneXY(0, 0, 0), UnionBox=True)  # -> Box, Box_2
debrep_11 = DeconstructBrep(Brep=bbox_21.Box)  # -> Faces, Edges, Vertices
item_55 = ListItem(List=debrep_11.Vertices, Index=0, Wrap=True)
xy_63 = XYPlane(Origin=item_55)
cut_geomtery_plane_6 = Plane(xy_63)
cut_position_plane_7 = Plane(cut_position_plane)

cutout_curves_7 = Curve(filter_135)
bbox_22 = BoundingBox(Content=flatten(cutout_curves_7), Plane=PlaneXY(0, 0, 0), UnionBox=True)  # -> Box, Box_2
debrep_12 = DeconstructBrep(Brep=bbox_22.Box)  # -> Faces, Edges, Vertices
item_56 = ListItem(List=debrep_12.Vertices, Index=0, Wrap=True)
xy_64 = XYPlane(Origin=item_56)
cut_geomtery_plane_7 = Plane(xy_64)
cut_position_plane_8 = Plane(cut_position_plane)

cutout_curves_8 = Curve(filter_137)
bbox_23 = BoundingBox(Content=flatten(cutout_curves_8), Plane=PlaneXY(0, 0, 0), UnionBox=True)  # -> Box, Box_2
debrep_13 = DeconstructBrep(Brep=bbox_23.Box)  # -> Faces, Edges, Vertices
item_57 = ListItem(List=debrep_13.Vertices, Index=0, Wrap=True)
xy_65 = XYPlane(Origin=item_57)
cut_geomtery_plane_8 = Plane(xy_65)
cut_position_plane_9 = Plane(cut_position_plane)

# ----
filter_138 = StreamFilter(Gate=cut_5, Stream1=bed_assembly_registration_holes_2)
bed_finish_plane_2 = Plane(bed_plane)
bed_finish_plane_3 = Plane(bed_plane)
bed_finish_plane_4 = Plane(bed_plane)
bed_ref_plane_2 = Plane(xy_61)
bed_ref_plane_3 = Plane(xy_61)
bed_ref_plane_4 = Plane(xy_61)
filter_139 = StreamFilter(Gate=cut_7, Stream1=v_reail_edge_cleanup_toolpath_2)
filter_140 = StreamFilter(Gate=cut_7, Stream1=rack_finish_mill_2)
filter_141 = StreamFilter(Gate=cut_7, Stream1=rack_premill2_2)
filter_142 = StreamFilter(Gate=cut_7, Stream1=rack_premill1_2)
orient_54 = Orient(Geometry=filter_110, Source=bed_ref_plane_2, Target=bed_finish_plane_2)  # -> Geometry, Transform
orient_55 = Orient(Geometry=filter_138, Source=bed_ref_plane_4, Target=bed_finish_plane_4)  # -> Geometry, Transform
bed_finish_plane_5 = Plane(bed_plane)
bed_finish_plane_6 = Plane(bed_plane)
bed_ref_plane_5 = Plane(xy_61)
bed_ref_plane_6 = Plane(xy_61)
bed_finish_plane_7 = Plane(bed_plane)
bed_finish_plane_8 = Plane(bed_plane)
bed_finish_plane_9 = Plane(bed_plane)
bed_ref_plane_7 = Plane(xy_61)
bed_ref_plane_8 = Plane(xy_61)
bed_ref_plane_9 = Plane(xy_61)
orient_56 = Orient(Geometry=filter_126, Source=cut_geomtery_plane_5, Target=cut_position_plane_6)  # -> Geometry, Transform
orient_57 = Orient(Geometry=filter_127, Source=cut_geomtery_plane_5, Target=cut_position_plane_6)  # -> Geometry, Transform
orient_58 = Orient(Geometry=filter_128, Source=cut_geomtery_plane_5, Target=cut_position_plane_6)  # -> Geometry, Transform
orient_59 = Orient(Geometry=filter_129, Source=cut_geomtery_plane_6, Target=cut_position_plane_7)  # -> Geometry, Transform
orient_60 = Orient(Geometry=filter_130, Source=cut_geomtery_plane_6, Target=cut_position_plane_7)  # -> Geometry, Transform
orient_61 = Orient(Geometry=filter_131, Source=cut_geomtery_plane_6, Target=cut_position_plane_7)  # -> Geometry, Transform
orient_62 = Orient(Geometry=filter_132, Source=cut_geomtery_plane_6, Target=cut_position_plane_7)  # -> Geometry, Transform
orient_63 = Orient(Geometry=filter_133, Source=cut_geomtery_plane_7, Target=cut_position_plane_8)  # -> Geometry, Transform
orient_64 = Orient(Geometry=filter_134, Source=cut_geomtery_plane_7, Target=cut_position_plane_8)  # -> Geometry, Transform
orient_65 = Orient(Geometry=filter_36, Source=cut_geomtery_plane_7, Target=cut_position_plane_8)  # -> Geometry, Transform
orient_66 = Orient(Geometry=filter_135, Source=cut_geomtery_plane_7, Target=cut_position_plane_8)  # -> Geometry, Transform
orient_67 = Orient(Geometry=filter_136, Source=cut_geomtery_plane_8, Target=cut_position_plane_9)  # -> Geometry, Transform
orient_68 = Orient(Geometry=filter_137, Source=cut_geomtery_plane_8, Target=cut_position_plane_9)  # -> Geometry, Transform

# ---- group: Assembly registration holes - inside cut
registration_hole_depth_2 = Panel(registration_hole_depth)
bed_assembly_registration_holes_3 = Curve(orient_55.Geometry)

# ----
orient_69 = Orient(Geometry=filter_139, Source=bed_ref_plane_6, Target=bed_finish_plane_6)  # -> Geometry, Transform
orient_70 = Orient(Geometry=filter_140, Source=bed_ref_plane_7, Target=bed_finish_plane_7)  # -> Geometry, Transform

# ---- group: Pre cut lower bed layer
bed_lower_layer_inside_holes_precut = Curve(orient_58.Geometry)
nut_pocket_depth_7 = Panel(nut_pocket_depth_6)
bed_lower_layer_cutout_4 = Curve(orient_57.Geometry)
nut_pockets_2 = Curve(orient_56.Geometry)

# ----
orient_71 = Orient(Geometry=filter_141, Source=bed_ref_plane_8, Target=bed_finish_plane_8)  # -> Geometry, Transform
orient_72 = Orient(Geometry=filter_142, Source=bed_ref_plane_9, Target=bed_finish_plane_9)  # -> Geometry, Transform

# ---- group: Precut lower left axis rail
spacer_pocket_depth_9 = Panel(spacer_pocket_depth_7)
lower_left_rail_inside_precut_3 = Curve(orient_63.Geometry)
rack_pocket_depth_10 = Panel(rack_pocket_depth_4)
lower_left_rail_cutout_2 = Curve(orient_66.Geometry)
spacer_pockets_5 = Curve(orient_64.Geometry)
rack_pocket_7 = Curve(orient_65.Geometry)

# ---- group: Precut lower right axis rail
lower_right_rail_inside_precut = Curve(orient_59.Geometry)
spacer_pocket_depth_10 = Panel(spacer_pocket_depth_7)
lower_right_rail_cutout = Curve(orient_62.Geometry)
spacer_pockets_6 = Curve(orient_60.Geometry)
rack_pocket_8 = Curve(orient_61.Geometry)

# ----
bed_assembly_v_rail_bird_beak_toolpaths = Curve(orient_54.Geometry)

# ---- group: Pre cut upper bed layer
bed_top_layer_inside_holes_precut = Curve(bed_top_layer_inside_holes)
make_upper_bed_layer_2 = Panel(make_upper_bed_layer)
bed_top_layer_cutout = Curve(bed_top_layer_outline)

# ---- group: Pre cut lower gantry rail layers
axis_mid_layers_inside_precut = Curve(orient_67.Geometry)
number_of_mid_layers = Panel(number_of_lower_layer_rails)
axis_mid_layer_cutout = Curve(orient_68.Geometry)

# ---- group: Bed rack cut and edge cleanup
v_reail_edge_cleanup_toolpath_3 = Curve(orient_69.Geometry)
rack_cut_depth_3 = Panel(rack_cut_depth)
rack_finish_mill_3 = Curve(orient_70.Geometry)
rack_premill1_3 = Curve(orient_72.Geometry)
rack_premill2_3 = Curve(orient_71.Geometry)

# ----
cutout_3 = Cutout(
    curves_for_cutout=bed_assembly_registration_holes_3,
    cut_depth=registration_hole_depth_2,
    pass_depth=pass_depth_from_easy_interface,
    tool_diameter=main_material_and_rack_diameter,
    use_climb_direction=Toggle(False),
    use_inside_cutting=Toggle(True))

engrave = Engrave(engrave_curves=bed_assembly_v_rail_bird_beak_toolpaths)
engrave_2 = Engrave(engrave_curves=rack_finish_mill_3, cut_depth=rack_cut_depth_3, pass_depth=rack_cut_depth_3)
engrave_3 = Engrave(engrave_curves=rack_premill1_3, cut_depth=rack_cut_depth_3, pass_depth=rack_cut_depth_3)
engrave_4 = Engrave(engrave_curves=rack_premill2_3, cut_depth=rack_cut_depth_3, pass_depth=rack_cut_depth_3)
engrave_5 = Engrave(engrave_curves=v_reail_edge_cleanup_toolpath_3)

cutout_4 = Cutout(
    curves_for_cutout=lower_left_rail_inside_precut_3,
    cut_depth=cut_depth_top_layer_2,
    pass_depth=pass_depth_from_easy_interface,
    tool_diameter=main_material_and_rack_diameter,
    use_climb_direction=Toggle(False),
    use_inside_cutting=Toggle(True))
pocket_5 = Pocket(
    curves_for_raster_pocket=spacer_pockets_5,
    cut_depth_pocket=spacer_pocket_depth_9,
    pass_depth=pass_depth_from_easy_interface,
    tool_diameter=main_material_and_rack_diameter,
    stepover_0_1=pocket_stepover,
    raster_along_y_0_1=Toggle(False))  # -> pocket_toolpaths_2, feed_rate_multiplier_4

pocket_6 = Pocket(
    curves_for_raster_pocket=rack_pocket_7,
    cut_depth_pocket=rack_pocket_depth_10,
    pass_depth=pass_depth_from_easy_interface,
    tool_diameter=main_material_and_rack_diameter,
    stepover_0_1=pocket_stepover,
    raster_along_y_0_1=Toggle(False))  # -> pocket_toolpaths_2, feed_rate_multiplier_4
cutout_5 = Cutout(
    curves_for_cutout=lower_left_rail_cutout_2,
    cut_depth=cut_depth_top_layer_2,
    pass_depth=pass_depth_from_easy_interface,
    tool_diameter=main_material_and_rack_diameter,
    use_climb_direction=Toggle(False),
    use_inside_cutting=Toggle(False))

cutout_6 = Cutout(
    curves_for_cutout=lower_right_rail_inside_precut,
    cut_depth=cut_depth_top_layer_2,
    pass_depth=pass_depth_from_easy_interface,
    tool_diameter=main_material_and_rack_diameter,
    use_climb_direction=Toggle(False),
    use_inside_cutting=Toggle(True))
pocket_7 = Pocket(
    curves_for_raster_pocket=spacer_pockets_6,
    cut_depth_pocket=spacer_pocket_depth_9,
    pass_depth=pass_depth_from_easy_interface,
    tool_diameter=main_material_and_rack_diameter,
    stepover_0_1=pocket_stepover,
    raster_along_y_0_1=Toggle(False))  # -> pocket_toolpaths_2, feed_rate_multiplier_4

pocket_8 = Pocket(
    curves_for_raster_pocket=rack_pocket_8,
    cut_depth_pocket=rack_pocket_depth_10,
    pass_depth=pass_depth_from_easy_interface,
    tool_diameter=main_material_and_rack_diameter,
    stepover_0_1=pocket_stepover,
    raster_along_y_0_1=Toggle(False))  # -> pocket_toolpaths_2, feed_rate_multiplier_4
cutout_7 = Cutout(
    curves_for_cutout=lower_right_rail_cutout,
    cut_depth=cut_depth_top_layer_2,
    pass_depth=pass_depth_from_easy_interface,
    tool_diameter=main_material_and_rack_diameter,
    use_climb_direction=Toggle(False),
    use_inside_cutting=Toggle(False))

main_cut_toolpaths_2 = Curve(engrave)
main_cut_toolpaths_3 = Curve(cutout_3)
merge_53 = Merge(Data1=engrave_3, Data2=engrave_4, Data3=engrave_2, Data4=engrave_5)
main_cut_toolpaths_4 = Curve(merge_53)
merge_54 = Merge(Data1=cutout_4, Data2=pocket_5.pocket_toolpaths_2)
merge_55 = Merge(Data1=pocket_6.pocket_toolpaths_2, Data2=cutout_5)
merge_56 = Merge(Data1=cutout_6, Data2=pocket_7.pocket_toolpaths_2)
merge_57 = Merge(Data1=pocket_8.pocket_toolpaths_2, Data2=cutout_7)
main_cut_toolpaths_5 = Curve(merge_55)
main_cut_toolpaths_6 = Curve(merge_57)
pre_cut_toolpaths_2 = Curve(merge_54)
pre_cut_toolpaths_3 = Curve(merge_56)

space_between_parts_5 = Panel(space_between_parts)
hold_down_hole_for_cutsheet_layout_2 = Curve(hold_down_hole_for_cutsheet_layout)
main_material_bit_12 = Panel(diameter_2)
pocket_edge_offset = Panel("2")
slide_inside_precut = Curve(bolt_holes_slide)
slide_cutout = Curve(slide_outline_with_radius_2)
slide_registration_pocket_depth = Panel("2")
bird_bit_diameter_3 = Panel(bird_bit_diameter)
bird_bit_center_point_4 = Point(bird_bit_center_point)
bird_bit_upper_line_3 = Line(bird_bit_upper_line)
v_bearing_inside_corner_point_2 = Point(v_bearing_inside_corner_point)
bird_beak_model_4 = Brep(bird_beak_model)
yz_27 = YZPlane(Origin=v_bearing_inside_corner_point_2)
bbox_24 = BoundingBox(Content=slide_cutout, Plane=PlaneXY(0, 0, 0), UnionBox=True)  # -> Box, Box_2
xy_66 = XYPlane(Origin=yz_27)
edges_5 = BrepEdges(Brep=bbox_24.Box)  # -> Naked, Interior, NonManifold
dim_9 = Dimensions(Surface=bbox_24.Box)  # -> UDimension, VDimension
eval_19 = EvaluateLength(Curve=bird_bit_upper_line_3, Length="0", Normalized=True)  # -> Point, Tangent, Parameter
len_13 = Length(Curve=bird_bit_upper_line_3)
rotate_30 = Rotate(Geometry=yz_27, Angle=3.141592654, Plane=xy_66)  # -> Geometry, Transform
addition_76 = Addition(A=dim_9.UDimension, B=space_between_parts_5)
yz_28 = YZPlane(Origin=eval_19.Point)
join_29 = JoinCurves(Curves=edges_5.Naked, Preserve=False)
item_58 = ListItem(List=edges_5.Naked, Index="3", Wrap=True)
orient_73 = Orient(Geometry=bird_bit_center_point_4, Source=yz_28, Target=rotate_30.Geometry)  # -> Geometry, Transform
orient_74 = Orient(Geometry=bird_beak_model_4, Source=yz_28, Target=rotate_30.Geometry)  # -> Geometry, Transform
dogbone_maker_6 = DogboneMaker(
    curves_to_dogbone=join_29,
    milling_bit_diameter=main_material_bit_12,
    corner_angle_threshold=120,
    flip_cornes_boolean=Toggle(True))
multiplication_110 = Multiplication(A=space_between_parts_5, B="0.5")
eval_20 = EvaluateLength(Curve=item_58, Length="0.5", Normalized=True)  # -> Point, Tangent, Parameter
end_point_v_bearing_path = Point(orient_73.Geometry)
neg_60 = Negative(Value=multiplication_110)
X_29 = UnitX(Factor=neg_60)
slide_registration_pocket = Curve(dogbone_maker_6)
multiplication_111 = Multiplication(A=bird_bit_diameter_3, B=".5")
slide_inside_precut_2 = Curve(slide_inside_precut)
move_112 = Move(Geometry=eval_20.Point, Motion=X_29)  # -> Geometry, Transform
xy_67 = XYPlane(Origin=Point(0, 0, 0))
neg_61 = Negative(Value=pocket_edge_offset)
Y_36 = UnitY(Factor=neg_61)
registration_jig_size_y = Panel(dim_9.VDimension)
multiplication_112 = Multiplication(A=registration_jig_size_y, B="0.5")
neg_62 = Negative(Value=multiplication_112)
dom_10 = ConstructDomain(DomainStart=neg_62, DomainEnd=multiplication_112)
slide_registration_pocket_depth_2 = Panel(slide_registration_pocket_depth)

actual_axis_length_5 = Panel(actual_axis_length)
safe_x_y_bird_bit_2 = Panel("10")
end_point_upper_rail_path_3 = Point(end_point_upper_rail_path)
end_point_lower_rail_path_3 = Point(end_point_lower_rail_path)
bird_bit_diameter_4 = Panel(bird_bit_diameter)
X_30 = UnitX(Factor=actual_axis_length_5)
multiplication_113 = Multiplication(A=bird_bit_diameter_4, B=".5")
move_113 = Move(Geometry=end_point_upper_rail_path_3, Motion=X_30)  # -> Geometry, Transform
addition_77 = Addition(A=multiplication_113, B=safe_x_y_bird_bit_2)
ln_60 = Line(StartPoint=move_113.Geometry, EndPoint=end_point_upper_rail_path_3)
ext_20 = ExtendCurve(Curve=ln_60, Type=0, Start=addition_77, End=addition_77)
redpline_5 = Reduce(Polyline=ext_20, Tolerance=1)  # -> Polyline, Reduction
xz_54 = XZPlane(Origin=Point(0, 0, 0))
mirror_85 = Mirror(Geometry=redpline_5.Polyline, Plane=xz_54)  # -> Geometry, Transform
flip_17 = FlipCurve(Curve=mirror_85.Geometry)  # -> Curve, Flag
merge_58 = Merge(Data1=redpline_5.Polyline, Data2=flip_17.Curve)

move_114 = Move(Geometry=end_point_lower_rail_path_3, Motion=X_30)  # -> Geometry, Transform
ln_61 = Line(StartPoint=move_114.Geometry, EndPoint=end_point_lower_rail_path_3)
ext_21 = ExtendCurve(Curve=ln_61, Type=0, Start=addition_77, End=addition_77)
redpline_6 = Reduce(Polyline=ext_21, Tolerance=1)  # -> Polyline, Reduction
mirror_86 = Mirror(Geometry=redpline_6.Polyline, Plane=xz_54)  # -> Geometry, Transform
flip_18 = FlipCurve(Curve=mirror_86.Geometry)  # -> Curve, Flag
merge_59 = Merge(Data1=redpline_6.Polyline, Data2=flip_18.Curve)
merge_60 = Merge(Data1=merge_58, Data2=merge_59)

v_rail_bird_beak_toolpaths = Curve(merge_60)

filter_143 = StreamFilter(Gate=cut_3, Stream1=v_rail_bird_beak_toolpaths)

safe_x_y_bird_bit_3 = Panel(safe_x_y_bird_bit_2)
addition_78 = Addition(A=multiplication_111, B=safe_x_y_bird_bit_3)

# ---- group: Organize slide cutting
current_machine_to_make_11 = Panel(list)
amount_of_slide_per_machine_type = Panel("""2
4
6""")
extra_amount_of_slides_to_cut_2 = Panel(extra_amount_of_slides_to_cut)
slide_inside_precut_3 = Curve(bolt_holes_slide)
slide_cutout_2 = Curve(slide_outline_with_radius_2)
item_59 = ListItem(List=amount_of_slide_per_machine_type, Index=current_machine_to_make_11, Wrap=True)
addition_79 = Addition(A=item_59, B=extra_amount_of_slides_to_cut_2)
number_of_slides_to_cut = Panel(addition_79)

# ----
number_of_slides_to_cut_2 = Panel(number_of_slides_to_cut)
subtraction_56 = Subtraction(A=number_of_slides_to_cut_2, B="1")
multiplication_114 = Multiplication(A=dim_9.UDimension, B=number_of_slides_to_cut_2)
multiplication_115 = Multiplication(A=space_between_parts_5, B=subtraction_56)
addition_80 = Addition(A=multiplication_114, B=multiplication_115)
addition_81 = Addition(A=number_of_slides_to_cut_2, B="1")
series_6 = Series(Start=0, Step=addition_76, Count=number_of_slides_to_cut_2)
series_7 = Series(Start=0, Step=addition_76, Count=addition_81)
X_31 = UnitX(Factor=addition_80)
X_32 = UnitX(Factor=series_6)
X_33 = UnitX(Factor=series_7)
move_115 = Move(Geometry=end_point_v_bearing_path, Motion=X_31)  # -> Geometry, Transform
ln_62 = Line(StartPoint=end_point_v_bearing_path, EndPoint=move_115.Geometry)
move_116 = Move(Geometry=graft(slide_inside_precut_2), Motion=X_32)  # -> Geometry, Transform
move_117 = Move(Geometry=move_112.Geometry, Motion=X_33)  # -> Geometry, Transform
addition_82 = Addition(A=number_of_slides_to_cut_2, B="1")
ext_22 = ExtendCurve(Curve=ln_62, Type=0, Start=addition_78, End=addition_78)
move_118 = Move(Geometry=slide_registration_pocket, Motion=X_32)  # -> Geometry, Transform
multiplication_116 = Multiplication(A=space_between_parts_5, B=addition_82)
xy_68 = XYPlane(Origin=move_117.Geometry)
multiplication_117 = Multiplication(A=dim_9.UDimension, B=number_of_slides_to_cut_2)
pshift_2 = ShiftPaths(Data=move_116.Geometry, Offset=-1)
redpline_7 = Reduce(Polyline=ext_22, Tolerance=1)  # -> Polyline, Reduction
addition_83 = Addition(A=multiplication_117, B=multiplication_116)
orient_75 = Orient(Geometry=hold_down_hole_for_cutsheet_layout_2, Source=xy_67, Target=xy_68)  # -> Geometry, Transform
registration_jig_size_x = Panel(addition_83)
bbox_25 = BoundingBox(Content=orient_75.Geometry, Plane=PlaneXY(0, 0, 0), UnionBox=True)  # -> Box, Box_2
area_4 = Area(Geometry=bbox_25.Box)  # -> Area, Centroid
move_119 = Move(Geometry=area_4.Centroid, Motion=Y_36)  # -> Geometry, Transform
registration_jig_size_x_2 = Panel(registration_jig_size_x)
xy_69 = XYPlane(Origin=move_119.Geometry)
multiplication_118 = Multiplication(A=registration_jig_size_x_2, B="0.5")
neg_63 = Negative(Value=multiplication_118)
dom_11 = ConstructDomain(DomainStart=neg_63, DomainEnd=multiplication_118)
slide_hold_down_holes = Curve(pshift_2)
rectangle_6 = Rectangle(Plane=xy_69, XSize=dom_11, YSize=dom_10, Radius=0)  # -> Rectangle, Length
bearing_slide_v_rail_bird_beak_toolpaths = Curve(redpline_7.Polyline)
registration_jig_cutout = Curve(flatten([rectangle_6.Rectangle, slide_hold_down_holes]))
slide_registration_pockets = Curve(move_118.Geometry)
hold_down_inside_pre_cut = Curve(orient_75.Geometry)

# ---- group: Organize slide cutting (continued)
move_120 = Move(Geometry=graft(slide_inside_precut_3), Motion=X_32)  # -> Geometry, Transform
move_121 = Move(Geometry=slide_cutout_2, Motion=X_32)  # -> Geometry, Transform
flatten_4 = FlattenTree(Tree=move_120.Geometry, Path="{0}")
flatten_5 = FlattenTree(Tree=move_121.Geometry, Path="{0}")
rev_10 = ReverseList(List=flatten_5)
slide_inside_precut_4 = Curve(flatten_4)
slide_cutout_3 = Curve(rev_10)

# ----
move_122 = Move(Geometry=slide_preview_brep, Motion=X_32)  # -> Geometry, Transform
slide_preview_breps = Brep(move_122.Geometry)

slide_registration_pockets_2 = Curve(slide_registration_pockets)
hold_down_inside_pre_cut_2 = Curve(hold_down_inside_pre_cut)
registration_jig_cutout_2 = Curve(registration_jig_cutout)
y_corner_slide_jig_2 = Panel(y_corner_slide_jig)
x_corner_slide_jig_2 = Panel(x_corner_slide_jig)
merge_61 = Merge(
    Data1=flatten(hold_down_inside_pre_cut_2),
    Data2=flatten(slide_registration_pockets_2),
    Data3=flatten(registration_jig_cutout_2))
pt_71 = ConstructPoint(XCoordinate=x_corner_slide_jig_2, YCoordinate=y_corner_slide_jig_2, ZCoordinate=0)
bbox_26 = BoundingBox(Content=flatten(merge_61), Plane=PlaneXY(0, 0, 0), UnionBox=True)  # -> Box, Box_2
xy_70 = XYPlane(Origin=pt_71)
debrep_14 = DeconstructBrep(Brep=bbox_26.Box)  # -> Faces, Edges, Vertices
item_60 = ListItem(List=debrep_14.Vertices, Index=0, Wrap=True)
slide_plane = Plane(xy_70)
xy_71 = XYPlane(Origin=item_60)

filter_144 = StreamFilter(Gate=precut_slides, Stream1=slide_inside_precut_4)
filter_145 = StreamFilter(Gate=precut_slides, Stream1=slide_cutout_3)

# ---- group: Find geometry corner
cutout_curves_9 = Curve(filter_145)
bbox_27 = BoundingBox(Content=flatten(cutout_curves_9), Plane=PlaneXY(0, 0, 0), UnionBox=True)  # -> Box, Box_2
debrep_15 = DeconstructBrep(Brep=bbox_27.Box)  # -> Faces, Edges, Vertices
item_61 = ListItem(List=debrep_15.Vertices, Index=0, Wrap=True)
xy_72 = XYPlane(Origin=item_61)
cut_geomtery_plane_9 = Plane(xy_72)
cut_position_plane_10 = Plane(cut_position_plane)

# ----
filter_146 = StreamFilter(Gate=cut, Stream1=slide_registration_pockets)
filter_147 = StreamFilter(Gate=cut, Stream1=registration_jig_cutout)
filter_148 = StreamFilter(Gate=cut, Stream1=hold_down_inside_pre_cut)
filter_149 = StreamFilter(Gate=cut_4, Stream1=slide_preview_breps)
filter_150 = StreamFilter(Gate=cut_4, Stream1=bearing_slide_v_rail_bird_beak_toolpaths)
slide_finish_plane = Plane(slide_plane)
slide_finish_plane_2 = Plane(slide_plane)
slide_finish_plane_3 = Plane(slide_plane)
slide_ref_plane = Plane(xy_71)
slide_ref_plane_2 = Plane(xy_71)
slide_ref_plane_3 = Plane(xy_71)
slide_finish_plane_4 = Plane(slide_plane)
slide_finish_plane_5 = Plane(slide_plane)
slide_ref_plane_4 = Plane(xy_71)
slide_ref_plane_5 = Plane(xy_71)
orient_76 = Orient(Geometry=filter_146, Source=slide_ref_plane, Target=slide_finish_plane)  # -> Geometry, Transform
orient_77 = Orient(Geometry=filter_147, Source=slide_ref_plane_2, Target=slide_finish_plane_2)  # -> Geometry, Transform
orient_78 = Orient(Geometry=filter_148, Source=slide_ref_plane_3, Target=slide_finish_plane_3)  # -> Geometry, Transform
orient_79 = Orient(Geometry=filter_149, Source=slide_ref_plane_4, Target=slide_finish_plane_4)  # -> Geometry, Transform
orient_80 = Orient(Geometry=filter_150, Source=slide_ref_plane_5, Target=slide_finish_plane_5)  # -> Geometry, Transform
orient_81 = Orient(Geometry=filter_144, Source=cut_geomtery_plane_9, Target=cut_position_plane_10)  # -> Geometry, Transform
# Make pinion cutting
orient_82 = Orient(Geometry=filter_145, Source=cut_geomtery_plane_9, Target=cut_position_plane_10)  # -> Geometry, Transform
bearing_slide_v_rail_bird_beak_toolpaths_2 = Curve(orient_80.Geometry)
slide_preview_breps_2 = Brep(orient_79.Geometry)

# ---- group: Bearing slide jig precut
slide_registration_pocket_depth_3 = Panel(slide_registration_pocket_depth_2)
slide_registration_pockets_3 = Curve(orient_76.Geometry)
hold_down_inside_pre_cut_3 = Curve(orient_78.Geometry)
registration_jig_cutout_3 = Curve(orient_77.Geometry)

# ---- group: Precut slides
slide_inside_precut_5 = Curve(orient_81.Geometry)
slide_cutout_4 = Curve(orient_82.Geometry)

# ----
preview_4 = CustomPreview(Geometry=slide_preview_breps_2, Shader=part_ghost_material)
engrave_6 = Engrave(engrave_curves=bearing_slide_v_rail_bird_beak_toolpaths_2)

cutout_8 = Cutout(
    curves_for_cutout=slide_inside_precut_5,
    cut_depth=cut_depth_top_layer_2,
    pass_depth=pass_depth_from_easy_interface,
    tool_diameter=main_material_and_rack_diameter,
    use_climb_direction=Toggle(False),
    use_inside_cutting=Toggle(True))

cutout_9 = Cutout(
    curves_for_cutout=slide_cutout_4,
    cut_depth=cut_depth_top_layer_2,
    pass_depth=pass_depth_from_easy_interface,
    tool_diameter=main_material_and_rack_diameter,
    use_climb_direction=Toggle(False),
    use_inside_cutting=Toggle(False))

main_cut_toolpaths_7 = Curve(engrave_6)
main_cut_toolpaths_8 = Curve(cutout_9)
pre_cut_toolpaths_4 = Curve(cutout_8)

# ---- group: Make lower layer preview brep
preview_level_of_detail_6 = Panel(list_3)
axis_lower_layer_outline_4 = Curve(axis_first_lower_layer_outline)
main_material_thickness_26 = Panel(thickness)
rail_rack_and_pinion_material_thickness_17 = Panel(thickness_2)
neg_64 = Negative(Value=main_material_thickness_26)
neg_65 = Negative(Value=main_material_thickness_26)
Z_51 = UnitZ(Factor=neg_64)
Z_52 = UnitZ(Factor=neg_65)
extr_22 = Extrude(Base=axis_lower_layer_outline_4, Direction=Z_51)
cap_19 = CapHoles(Brep=extr_22)
neg_66 = Negative(Value=rail_rack_and_pinion_material_thickness_17)
Z_53 = UnitZ(Factor=neg_66)

# ---- group: Make mid layer preview brep
preview_level_of_detail_7 = Panel(list_3)
main_material_thickness_27 = Panel(thickness)
rail_rack_and_pinion_material_thickness_18 = Panel(thickness_2)
neg_67 = Negative(Value=main_material_thickness_27)
Z_54 = UnitZ(Factor=neg_67)
neg_68 = Negative(Value=rail_rack_and_pinion_material_thickness_18)
Z_55 = UnitZ(Factor=neg_68)

# ----
number_of_layers_beneath_lower_gantry_ra_6 = Panel(number_of_layers_beneath_lower_gantry_ra)  # "Number of layers beneath lower gantry rack and rail layer"
preview_level_of_detail_8 = Panel(list_3)
number_of_layers_in_gantry_bed_5 = Panel(number_of_layers_in_gantry_bed_3)
rail_rack_and_pinion_material_thickness_19 = Panel(thickness_2)
bed_lower_layer_inside_holes_precut_2 = Curve(flatten([bed_lower_layer_inside_holes, orient_51.Geometry, mirror_74.Geometry]))
bed_top_layer_inside_holes_precut_2 = Curve(bed_top_layer_inside_holes)
main_material_thickness_28 = Panel(thickness)
bed_lower_layer_cutout_5 = Curve(flatten(machine_bed_lower_layer_outline_4))
bed_top_layer_cutout_2 = Curve(bed_top_layer_outline)
neg_69 = Negative(Value=main_material_thickness_28)
multiplication_119 = Multiplication(A=main_material_thickness_28, B=number_of_layers_beneath_lower_gantry_ra_6)
Z_56 = UnitZ(Factor=neg_69)
addition_84 = Addition(A=rail_rack_and_pinion_material_thickness_19, B=multiplication_119)
gate_14 = StreamGate(Stream=bed_top_layer_inside_holes_precut_2, Gate=preview_level_of_detail_8)  # -> Target0, Target1
gate_15 = StreamGate(Stream=bed_lower_layer_inside_holes_precut_2, Gate=preview_level_of_detail_8)  # -> Target0, Target1
start_depth = Panel(addition_84)
extr_23 = Extrude(Base=bed_lower_layer_cutout_5, Direction=Z_56)
extr_24 = Extrude(Base=gate_15.Target1, Direction=Z_56)
extr_25 = Extrude(Base=bed_top_layer_cutout_2, Direction=Z_56)
extr_26 = Extrude(Base=gate_14.Target1, Direction=Z_56)
cap_20 = CapHoles(Brep=extr_23)
cap_21 = CapHoles(Brep=extr_24)
cap_22 = CapHoles(Brep=extr_25)
cap_23 = CapHoles(Brep=extr_26)
subtraction_57 = Subtraction(A=number_of_layers_in_gantry_bed_5, B="1")
sdiff_14 = SolidDifference(BrepsA=cap_22, BrepsB=cap_23)
sdiff_15 = SolidDifference(BrepsA=cap_20, BrepsB=cap_21)
multiplication_120 = Multiplication(A=main_material_thickness_28, B=subtraction_57)
addition_85 = Addition(A=start_depth, B=multiplication_120)
addition_86 = Addition(A=start_depth, B=main_material_thickness_28)
neg_70 = Negative(Value=addition_86)
neg_71 = Negative(Value=addition_85)
neg_72 = Negative(Value=start_depth)
Z_57 = UnitZ(Factor=neg_70)
Z_58 = UnitZ(Factor=neg_71)
Z_59 = UnitZ(Factor=neg_72)
filter_151 = StreamFilter(Gate=preview_level_of_detail_8, Stream0=cap_20, Stream1=sdiff_15)
filter_152 = StreamFilter(Gate=preview_level_of_detail_8, Stream0=cap_22, Stream1=sdiff_14)
move_123 = Move(Geometry=filter_151, Motion=Z_58)  # -> Geometry, Transform
move_124 = Move(Geometry=filter_152, Motion=Z_59)  # -> Geometry, Transform

# ---- group: Organize Z support wall
make_dual_z_axis_3 = Panel(and_20)
make_z_axis_side2_9 = Panel(make_z_axis_side2_2)
z_support_wall_breps_2 = Brep(z_support_wall_breps)
xz_55 = XZPlane(Origin=Point(0, 0, 0))

# ----
gate_16 = StreamGate(Stream=z_support_wall_breps_2, Gate=make_z_axis_side2_9)  # -> Target0, Target1

# ---- group: Organize Z support wall (continued)
mirror_87 = Mirror(Geometry=gate_16.Target1, Plane=xz_55)  # -> Geometry, Transform

# ----
filter_153 = StreamFilter(Gate=make_z_axis_side2_9, Stream0=gate_16.Target0, Stream1=mirror_87.Geometry)

# ---- group: Organize Z support wall (continued)
filter_154 = StreamFilter(Gate=make_dual_z_axis_3, Stream0=filter_153, Stream1=z_support_wall_breps_2)
z_support_wall_breps_3 = Brep(filter_154)

# ---- group: Prep lowest layer cutting
# make outside tab box and hold down wider than axis in case of gantry?
# Make warning in case of only 1 bridge layer and motor pocket and nut+bolt joining?
nut_width_flat_side_to_flat_side_5 = Panel(nut_width_flat_side_to_flat_side)
wedge_hole_lowest_layer_3 = Curve(wedge_hole_lowest_layer)
gantry_bridge_motor_pockets_for_lower_la = Curve(gate_4.Target0)  # "Gantry bridge motor pockets for lower layer"
hold_down_area_width = Panel("20")
bolt_holes_for_mounting_2 = Curve(bolt_holes_for_mounting)
axis_lower_layer_outline_5 = Curve(axis_first_lower_layer_outline)
main_material_bit_13 = Panel(diameter_2)
carriage_motor_pocket_depth_6 = Panel(carriage_motor_pocket_depth_2)
hold_down_hole_2 = Curve(hold_down_hole)
gantry_bridge_motor_holes_for_mid_layer = Curve(gate_5.Target1)
nut_pocket_depth_8 = Panel(nut_pocket_depth_3)
gantry_bridge_motor_holes_for_lower_laye = Curve(gate_5.Target0)  # "Gantry bridge motor holes for lower layer"
lowest_layer_is_beneath_motor_plate_2 = Panel(lowest_layer_is_beneath_motor_plate)
tab_box_2 = Brep(tab_box)
nut_pocket_3 = Curve(nut_pocket)
multiplication_121 = Multiplication(A=nut_width_flat_side_to_flat_side_5, B="0.02")
item_62 = ListItem(List=gantry_bridge_motor_holes_for_mid_layer, Index=0, Wrap=True)
bolt_hole_offset_ease = Panel(multiplication_121)
xz_56 = XZPlane(Origin=Point(0, 0, 0))
area_5 = Area(Geometry=item_62)  # -> Area, Centroid
multiplication_122 = Multiplication(A=hold_down_area_width, B="0.5")
make_bridge_lower_layer_4 = Panel(make_bridge_lower_layer_2)
addition_87 = Addition(A=main_material_bit_13, B=hold_down_area_width)
offset_22 = Offset(Curve=cir_10, Distance=bolt_hole_offset_ease, Plane=PlaneXY(0, 0, 0), Corners=1)
bbox_28 = BoundingBox(Content=axis_lower_layer_outline_5, Plane=PlaneXY(0, 0, 0), UnionBox=True)  # -> Box, Box_2
addition_88 = Addition(A=main_material_bit_13, B=multiplication_122)
xy_73 = XYPlane(Origin=Point(0, 0, 0))
neg_73 = Negative(Value=addition_88)
flatten_6 = FlattenTree(Tree=offset_22, Path="{0}")
edges_6 = BrepEdges(Brep=bbox_28.Box)  # -> Naked, Interior, NonManifold
item_63 = ListItem(List=edges_6.Naked, Index=0, Wrap=True)  # -> Item, Item1, Item2, Item3
filter_155 = StreamFilter(Gate=join_rails_with_dowels_instead_of_bolts_6, Stream0=nut_pocket_3)
rotate_31 = Rotate(Geometry=xy_73, Angle=1.570796327, Plane=xy_73)  # -> Geometry, Transform
X_34 = UnitX(Factor=addition_88)
X_35 = UnitX(Factor=neg_73)
neg_74 = Negative(Value=addition_87)
filter_156 = StreamFilter(Gate=join_rails_with_dowels_instead_of_bolts_6, Stream0=flatten_6, Stream1=wedge_hole_lowest_layer_3)
item_64 = ListItem(List=edges_6.Naked, Index="2", Wrap=True)
item_65 = ListItem(List=edges_6.Naked, Index=0, Wrap=True)
X_36 = UnitX(Factor=addition_87)
X_37 = UnitX(Factor=neg_74)
toggle = BooleanToggle(False)
move_125 = Move(Geometry=item_63.Item3, Motion=X_35)  # -> Geometry, Transform
move_126 = Move(Geometry=item_63.Item1, Motion=X_34)  # -> Geometry, Transform
end_48 = EndPoints(Curve=item_65)  # -> Start, End
end_49 = EndPoints(Curve=item_64)  # -> Start, End
orient_83 = Orient(Geometry=filter_156, Source=rotate_31.Geometry, Target=hole_planes_top_layer_2)  # -> Geometry, Transform
eval_21 = EvaluateLength(Curve=[move_125.Geometry, move_126.Geometry], Length=multiplication_122, Normalized=toggle)  # -> Point, Tangent, Parameter
eval_22 = EvaluateLength(Curve=[item_63.Item1, item_63.Item3], Length=multiplication_122, Normalized=toggle)  # -> Point, Tangent, Parameter
orient_84 = Orient(Geometry=filter_155, Source=rotate_31.Geometry, Target=hole_planes_top_layer_2)  # -> Geometry, Transform
xz_57 = XZPlane(Origin=Point(0, 0, 0))
move_127 = Move(Geometry=end_49.Start, Motion=X_36)  # -> Geometry, Transform
xy_74 = XYPlane(Origin=Point(0, 0, 0))
move_128 = Move(Geometry=end_48.Start, Motion=X_37)  # -> Geometry, Transform
clean_8 = CleanTree(RemoveNulls=True, RemoveInvalid=True, RemoveEmpty=False, Tree=orient_84.Geometry)
mirror_88 = Mirror(Geometry=eval_21.Point, Plane=xz_57)  # -> Geometry, Transform
rec_2pt_18 = Rectangle2Pt(Plane=xy_74, PointA=move_128.Geometry, PointB=move_127.Geometry, Radius=0)  # -> Rectangle, Length
area_6 = Area(Geometry=rec_2pt_18.Rectangle)  # -> Area, Centroid
yz_29 = YZPlane(Origin=area_6.Centroid)
mirror_89 = Mirror(Geometry=area_5.Centroid, Plane=yz_29)  # -> Geometry, Transform
mirror_90 = Mirror(Geometry=[mirror_89.Geometry, area_5.Centroid], Plane=xz_56)  # -> Geometry, Transform
points_inside_bolt_holes = Point(flatten([mirror_90.Geometry, mirror_89.Geometry, area_5.Centroid]))
gantry_bridge_motor_holes_for_lower_laye_2 = Curve(gantry_bridge_motor_holes_for_lower_laye)  # "Gantry bridge motor holes for lower layer"
weave_3 = Weave(Pattern=[0, 1], Stream0=eval_21.Point, Stream1=mirror_88.Geometry, NullGaps=False)
mirror_91 = Mirror(Geometry=eval_22.Point, Plane=xz_57)  # -> Geometry, Transform
filter_157 = StreamFilter(Gate=lowest_layer_is_beneath_motor_plate_2, Stream0=weave_3, Stream1=points_inside_bolt_holes)
weave_4 = Weave(Pattern=[0, 1], Stream0=eval_22.Point, Stream1=mirror_91.Geometry, NullGaps=False)
xy_75 = XYPlane(Origin=filter_157)
xy_76 = XYPlane(Origin=weave_4)
outer_hold_down_planes = Plane(xy_75)
hold_down_hole_3 = Curve(hold_down_hole_2)
tab_planes = Plane(xy_76)
xy_77 = XYPlane(Origin=Point(0, 0, 0))
merge_62 = Merge(
    Data1=flatten(orient_83.Geometry),
    Data2=flatten(axis_lower_layer_outline_5),
    Data3=flatten(gantry_bridge_motor_holes_for_lower_laye_2))
tab_box_3 = Brep(tab_box_2)
orient_85 = Orient(Geometry=hold_down_hole_3, Source=xy_77, Target=outer_hold_down_planes)  # -> Geometry, Transform
lower_layer_outside_hold_down_holes = Curve(orient_85.Geometry)
merge_63 = Merge(Data2=flatten(lower_layer_outside_hold_down_holes))
gantry_bridge_motor_pockets_for_lower_la_2 = Curve(gantry_bridge_motor_pockets_for_lower_la)  # "Gantry bridge motor pockets for lower layer"
lower_layer_outside_hold_down_holes_2 = Curve(lower_layer_outside_hold_down_holes)
axis_lower_layer_outside_tabs_outline = Curve(rec_2pt_18.Rectangle)
carriage_motor_pocket_depth_7 = Panel(carriage_motor_pocket_depth_6)
axis_mid_layers_inside_holes_4 = Curve(merge_63)
bolt_holes_for_mounting_3 = Curve(bolt_holes_for_mounting_2)
nut_pocket_depth_9 = Panel(nut_pocket_depth_8)
axis_lower_layer_cutout = Curve(merge_62)
nut_pockets_3 = Curve(clean_8)

# ----
axis_lower_layer_outside_tabs_outline_2 = Curve(axis_lower_layer_outside_tabs_outline)
axis_lower_layer_cutout_2 = Curve(axis_lower_layer_cutout)
y_corner_bridge_assembly_2 = Panel(y_corner_bridge_assembly)
x_corner_bridge_assembly_2 = Panel(x_corner_bridge_assembly)
merge_64 = Merge(Data1=flatten(axis_lower_layer_cutout_2), Data2=flatten(axis_lower_layer_outside_tabs_outline_2))
pt_72 = ConstructPoint(XCoordinate=x_corner_bridge_assembly_2, YCoordinate=y_corner_bridge_assembly_2, ZCoordinate=0)
bbox_29 = BoundingBox(Content=merge_64, Plane=PlaneXY(0, 0, 0), UnionBox=True)  # -> Box, Box_2
xy_78 = XYPlane(Origin=pt_72)
debrep_16 = DeconstructBrep(Brep=bbox_29.Box)  # -> Faces, Edges, Vertices
item_66 = ListItem(List=debrep_16.Vertices, Index=0, Wrap=True)
bridge_assembly_finnsih_plane = Plane(xy_78)
xy_79 = XYPlane(Origin=item_66)
bridge_assembly_finnsih_plane_2 = Plane(bridge_assembly_finnsih_plane)
bridge_assembly_ref_plane = Plane(xy_79)
orient_86 = Orient(Geometry=merge_64, Source=bridge_assembly_ref_plane, Target=bridge_assembly_finnsih_plane_2)  # -> Geometry, Transform
bridge_ref = Curve(orient_86.Geometry)

# ---- group: Select bridge registration holes
lower_layer_outside_hold_down_holes_3 = Curve(lower_layer_outside_hold_down_holes_2)
lng_2 = ListLength(List=lower_layer_outside_hold_down_holes_3)
subtraction_58 = Subtraction(A=lng_2, B="1")
merge_65 = Merge(Data1="0", Data2=subtraction_58)
item_67 = ListItem(List=lower_layer_outside_hold_down_holes_3, Index=merge_65, Wrap=False)
axis_assembly_registration_holes = Curve(item_67)

# ----
filter_158 = StreamFilter(Gate=precut, Stream1=gantry_bridge_motor_pockets_for_lower_la_2)
filter_159 = StreamFilter(Gate=precut, Stream1=axis_mid_layers_inside_holes_4)
filter_160 = StreamFilter(Gate=precut, Stream1=nut_pockets_3)
filter_161 = StreamFilter(Gate=precut, Stream1=bolt_holes_for_mounting_3)
filter_162 = StreamFilter(Gate=precut, Stream1=axis_lower_layer_cutout)
filter_163 = StreamFilter(Gate=precut, Stream1=axis_lower_layer_outside_tabs_outline)

# ---- group: Find geometry corner
cutout_curves_10 = Curve(filter_163)
bbox_30 = BoundingBox(Content=flatten(cutout_curves_10), Plane=PlaneXY(0, 0, 0), UnionBox=True)  # -> Box, Box_2
debrep_17 = DeconstructBrep(Brep=bbox_30.Box)  # -> Faces, Edges, Vertices
item_68 = ListItem(List=debrep_17.Vertices, Index=0, Wrap=True)
xy_80 = XYPlane(Origin=item_68)
cut_geomtery_plane_10 = Plane(xy_80)
cut_position_plane_11 = Plane(cut_position_plane)

# ----
filter_164 = StreamFilter(Gate=cut_6, Stream1=axis_assembly_registration_holes)
bridge_assembly_finnsih_plane_3 = Plane(bridge_assembly_finnsih_plane)
bridge_assembly_finnsih_plane_4 = Plane(bridge_assembly_finnsih_plane)
bridge_assembly_ref_plane_2 = Plane(xy_79)
bridge_assembly_ref_plane_3 = Plane(xy_79)
bridge_assembly_finnsih_plane_5 = Plane(bridge_assembly_finnsih_plane)
bridge_assembly_ref_plane_4 = Plane(xy_79)
bridge_assembly_finnsih_plane_6 = Plane(bridge_assembly_finnsih_plane)
bridge_assembly_ref_plane_5 = Plane(xy_79)
bridge_assembly_finnsih_plane_7 = Plane(bridge_assembly_finnsih_plane)
bridge_assembly_finnsih_plane_8 = Plane(bridge_assembly_finnsih_plane)
bridge_assembly_finnsih_plane_9 = Plane(bridge_assembly_finnsih_plane)
bridge_assembly_ref_plane_6 = Plane(xy_79)
bridge_assembly_ref_plane_7 = Plane(xy_79)
bridge_assembly_ref_plane_8 = Plane(xy_79)
orient_87 = Orient(Geometry=filter_143, Source=bridge_assembly_ref_plane_2, Target=bridge_assembly_finnsih_plane_4)  # -> Geometry, Transform
orient_88 = Orient(Geometry=filter_164, Source=bridge_assembly_ref_plane_4, Target=bridge_assembly_finnsih_plane_5)  # -> Geometry, Transform
orient_89 = Orient(Geometry=filter_158, Source=cut_geomtery_plane_10, Target=cut_position_plane_11)  # -> Geometry, Transform
orient_90 = Orient(Geometry=filter_159, Source=cut_geomtery_plane_10, Target=cut_position_plane_11)  # -> Geometry, Transform
orient_91 = Orient(Geometry=filter_160, Source=cut_geomtery_plane_10, Target=cut_position_plane_11)  # -> Geometry, Transform
orient_92 = Orient(Geometry=filter_161, Source=cut_geomtery_plane_10, Target=cut_position_plane_11)  # -> Geometry, Transform
orient_93 = Orient(Geometry=filter_162, Source=cut_geomtery_plane_10, Target=cut_position_plane_11)  # -> Geometry, Transform
orient_94 = Orient(Geometry=filter_163, Source=cut_geomtery_plane_10, Target=cut_position_plane_11)  # -> Geometry, Transform
bridge_assembly_v_rail_bird_beak_toolpat = Curve(orient_87.Geometry)  # "Bridge assembly V rail bird beak toolpaths"
orient_95 = Orient(Geometry=filter_52, Source=bridge_assembly_ref_plane_5, Target=bridge_assembly_finnsih_plane_6)  # -> Geometry, Transform

# ---- group: Assembly registration holes - inside cut
registration_hole_depth_3 = Panel(registration_hole_depth)
bridge_assembly_registration_holes = Curve(orient_88.Geometry)

# ----
orient_96 = Orient(Geometry=filter_39, Source=bridge_assembly_ref_plane_6, Target=bridge_assembly_finnsih_plane_7)  # -> Geometry, Transform
orient_97 = Orient(Geometry=filter_40, Source=bridge_assembly_ref_plane_7, Target=bridge_assembly_finnsih_plane_8)  # -> Geometry, Transform
orient_98 = Orient(Geometry=filter_41, Source=bridge_assembly_ref_plane_8, Target=bridge_assembly_finnsih_plane_9)  # -> Geometry, Transform

# ---- group: Bridge rack cut and edge cleanup
v_reail_edge_cleanup_toolpath_4 = Curve(orient_95.Geometry)
rack_cut_depth_4 = Panel(rack_cut_depth)
rack_finish_mill_4 = Curve(orient_96.Geometry)
rack_premill1_4 = Curve(orient_98.Geometry)
rack_premill2_4 = Curve(orient_97.Geometry)

# ----
cutout_10 = Cutout(
    curves_for_cutout=bridge_assembly_registration_holes,
    cut_depth=registration_hole_depth_3,
    pass_depth=pass_depth_from_easy_interface,
    tool_diameter=main_material_and_rack_diameter,
    use_climb_direction=Toggle(False),
    use_inside_cutting=Toggle(True))

engrave_7 = Engrave(engrave_curves=bridge_assembly_v_rail_bird_beak_toolpat)
engrave_8 = Engrave(engrave_curves=v_reail_edge_cleanup_toolpath_4)
engrave_9 = Engrave(engrave_curves=rack_finish_mill_4, cut_depth=rack_cut_depth_4, pass_depth=rack_cut_depth_4)
engrave_10 = Engrave(engrave_curves=rack_premill1_4, cut_depth=rack_cut_depth_4, pass_depth=rack_cut_depth_4)
engrave_11 = Engrave(engrave_curves=rack_premill2_4, cut_depth=rack_cut_depth_4, pass_depth=rack_cut_depth_4)
main_cut_toolpaths_9 = Curve(engrave_7)
main_cut_toolpaths_10 = Curve(cutout_10)
merge_66 = Merge(Data1=engrave_10, Data2=engrave_11, Data3=engrave_9, Data4=engrave_8)
main_cut_toolpaths_11 = Curve(merge_66)

# ---- group: Make lower layer preview brep (continued)
axis_mid_layers_inside_holes_5 = Curve(flatten([bolt_holes_for_mounting_2, gantry_bridge_motor_holes_for_lower_laye_2, orient_83.Geometry]))
gantry_bridge_motor_pockets_for_lower_la_3 = Curve(gantry_bridge_motor_pockets_for_lower_la_2)  # "Gantry bridge motor pockets for lower layer"
carriage_motor_pocket_depth_8 = Panel(carriage_motor_pocket_depth_7)
gate_17 = StreamGate(Stream=gantry_bridge_motor_pockets_for_lower_la_3, Gate=preview_level_of_detail_6)  # -> Target0, Target1
gate_18 = StreamGate(Stream=axis_mid_layers_inside_holes_5, Gate=preview_level_of_detail_6)  # -> Target0, Target1
neg_75 = Negative(Value=carriage_motor_pocket_depth_8)
Z_60 = UnitZ(Factor=neg_75)
extr_27 = Extrude(Base=gate_18.Target1, Direction=Z_52)
extr_28 = Extrude(Base=gate_17.Target1, Direction=Z_60)
cap_24 = CapHoles(Brep=extr_27)
cap_25 = CapHoles(Brep=extr_28)
sdiff_16 = SolidDifference(BrepsA=cap_19, BrepsB=cap_24)
sdiff_17 = SolidDifference(BrepsA=sdiff_16, BrepsB=cap_25)
item_69 = ListItem(List=sdiff_17, Index=0, Wrap=True)
null_7 = NullItem(Item=item_69)  # -> NullFlags, InvalidFlags, Description
filter_165 = StreamFilter(Gate=null_7.NullFlags, Stream0=sdiff_17, Stream1=sdiff_16)
filter_166 = StreamFilter(Gate=preview_level_of_detail_6, Stream0=cap_19, Stream1=filter_165)

# ---- group: Prep mid layer cutting
gantry_bridge_motor_holes_for_mid_layer_2 = Curve(gate_5.Target1)
gantry_bridge_motor_pockets_for_mid_laye = Curve(gate_4.Target1)  # "Gantry bridge motor pockets for mid layer"
bolt_holes_for_mounting_4 = Curve(bolt_holes_for_mounting)
axis_lower_layer_outline_6 = Curve(axis_mid_layer_outline)
number_of_layers_beneath_rack_and_rail_l_8 = Panel(number_of_layers_beneath_rack_and_rail_l_3)  # "Number of layers beneath rack and rail layer"
wedge_hole_mid_layers_4 = Curve(wedge_hole_mid_layers)
carriage_motor_pocket_depth_9 = Panel(carriage_motor_pocket_depth_2)
extra_cutout_depth_6 = Panel(extra_cutout_depth)
main_material_thickness_29 = Panel(thickness)
xy_81 = XYPlane(Origin=Point(0, 0, 0))
addition_89 = Addition(A=extra_cutout_depth_6, B=main_material_thickness_29)
filter_167 = StreamFilter(Gate=join_rails_with_dowels_instead_of_bolts_6, Stream0=cir_10, Stream1=wedge_hole_mid_layers_4)
smaller_7 = SmallerThan(FirstNumber=number_of_layers_beneath_rack_and_rail_l_8, SecondNumber="2")  # -> SmallerThan, OrEqualTo
rotate_32 = Rotate(Geometry=xy_81, Angle=1.570796327, Plane=xy_81)  # -> Geometry, Transform
cut_depth_main_layers = Panel(addition_89)
subtraction_59 = Subtraction(A=number_of_layers_beneath_rack_and_rail_l_8, B="1")
orient_99 = Orient(Geometry=filter_167, Source=rotate_32.Geometry, Target=hole_planes_top_layer_2)  # -> Geometry, Transform
merge_67 = Merge(Data1=flatten(orient_99.Geometry), Data2=flatten(bolt_holes_for_mounting_4))
filter_168 = StreamFilter(Gate=smaller_7.SmallerThan, Stream0=axis_lower_layer_outline_6)
filter_169 = StreamFilter(Gate=smaller_7.SmallerThan, Stream0=merge_67)
gantry_bridge_motor_pockets_for_mid_laye_2 = Curve(gantry_bridge_motor_pockets_for_mid_laye)  # "Gantry bridge motor pockets for mid layer"
carriage_motor_pocket_depth_10 = Panel(carriage_motor_pocket_depth_9)
number_of_mid_layers_2 = Panel(subtraction_59)
axis_mid_layers_inside_holes_6 = Curve(filter_169)
cut_depth_main_layers_2 = Panel(cut_depth_main_layers)

# ---- group: Make lower layer preview brep (continued)
number_of_mid_layers_3 = Panel(number_of_mid_layers_2)
multiplication_123 = Multiplication(A=number_of_mid_layers_3, B=main_material_thickness_26)
neg_76 = Negative(Value=multiplication_123)
Z_61 = UnitZ(Factor=neg_76)
move_129 = Move(Geometry=filter_166, Motion=Z_61)  # -> Geometry, Transform
move_130 = Move(Geometry=move_129.Geometry, Motion=Z_53)  # -> Geometry, Transform
axis_lower_layers_brep = Brep(flatten(move_130.Geometry))

# ---- group: Make mid layer preview brep (continued)
axis_mid_layer_outline_4 = Curve(filter_168)
axis_mid_layers_inside_precut_2 = Curve(axis_mid_layers_inside_holes_6)
axis_mid_layer_inside_holes = Curve(gantry_bridge_motor_holes_for_mid_layer_2)
gantry_bridge_motor_pockets_for_mid_laye_3 = Curve(gantry_bridge_motor_pockets_for_mid_laye_2)  # "Gantry bridge motor pockets for mid layer"
carriage_motor_pocket_depth_11 = Panel(carriage_motor_pocket_depth_10)
number_of_mid_layers_4 = Panel(number_of_mid_layers_2)
merge_68 = Merge(Data1=flatten(axis_mid_layers_inside_precut_2), Data2=flatten(axis_mid_layer_inside_holes))
neg_77 = Negative(Value=carriage_motor_pocket_depth_11)
gate_19 = StreamGate(Stream=merge_68, Gate=preview_level_of_detail_7)  # -> Target0, Target1
gate_20 = StreamGate(Stream=gantry_bridge_motor_pockets_for_mid_laye_3, Gate=preview_level_of_detail_7)  # -> Target0, Target1
Z_62 = UnitZ(Factor=neg_77)
extr_29 = Extrude(Base=gate_19.Target1, Direction=Z_54)
extr_30 = Extrude(Base=axis_mid_layer_outline_4, Direction=Z_54)
extr_31 = Extrude(Base=gate_20.Target1, Direction=Z_62)
cap_26 = CapHoles(Brep=extr_30)
cap_27 = CapHoles(Brep=extr_29)
cap_28 = CapHoles(Brep=extr_31)
sdiff_18 = SolidDifference(BrepsA=cap_26, BrepsB=cap_27)
filter_170 = StreamFilter(Gate=preview_level_of_detail_7, Stream0=cap_26, Stream1=sdiff_18)
sdiff_19 = SolidDifference(BrepsA=filter_170, BrepsB=cap_28)
series_8 = Series(Start=0, Step=main_material_thickness_27, Count=number_of_mid_layers_4)
item_70 = ListItem(List=sdiff_19, Index=0, Wrap=True)
neg_78 = Negative(Value=series_8)
null_8 = NullItem(Item=item_70)  # -> NullFlags, InvalidFlags, Description
Z_63 = UnitZ(Factor=neg_78)
filter_171 = StreamFilter(Gate=null_8.NullFlags, Stream0=sdiff_19, Stream1=filter_170)
move_131 = Move(Geometry=filter_171, Motion=Z_63)  # -> Geometry, Transform
move_132 = Move(Geometry=move_131.Geometry, Motion=Z_55)  # -> Geometry, Transform
axis_mid_layers_brep = Brep(flatten(move_132.Geometry))

# ---- group: Prep lowest layer cutting (continued)
cut_depth_mid_layer = Panel(cut_depth_main_layers)
pt_73 = ConstructPoint(XCoordinate=0, YCoordinate=0, ZCoordinate=cut_depth_mid_layer)
xy_82 = XYPlane(Origin=pt_73)
orient_100 = Orient(Geometry=tab_box_3, Source=xy_82, Target=tab_planes)  # -> Geometry, Transform
axis_lower_layer_tabs = Brep(orient_100.Geometry)

# ----
merge_69 = Merge(Data1=flatten(filter_168), Data2=flatten(gantry_bridge_motor_holes_for_mid_layer_2))

# ---- group: Prep mid layer cutting (continued)
axis_mid_layer_cutout_2 = Curve(merge_69)

# ----
filter_172 = StreamFilter(Gate=precut, Stream1=axis_lower_layer_tabs)
filter_173 = StreamFilter(Gate=precut_2, Stream1=gantry_bridge_motor_pockets_for_mid_laye_2)
filter_174 = StreamFilter(Gate=precut_2, Stream1=axis_mid_layer_cutout_2)
filter_175 = StreamFilter(Gate=precut_2, Stream1=axis_mid_layers_inside_holes_6)

# ---- group: Find geometry corner
cutout_curves_11 = Curve(filter_174)
bbox_31 = BoundingBox(Content=flatten(cutout_curves_11), Plane=PlaneXY(0, 0, 0), UnionBox=True)  # -> Box, Box_2
debrep_18 = DeconstructBrep(Brep=bbox_31.Box)  # -> Faces, Edges, Vertices
item_71 = ListItem(List=debrep_18.Vertices, Index=0, Wrap=True)
xy_83 = XYPlane(Origin=item_71)
cut_geomtery_plane_11 = Plane(xy_83)
cut_position_plane_12 = Plane(cut_position_plane)

# ---- group: Make 3D ghost preview
axis_gantry_bridge = Merge(Data1=axis_top_layer, Data2=axis_mid_layers_brep, Data3=axis_lower_layers_brep)
filter_176 = StreamFilter(Gate=cut_8, Stream1=axis_gantry_bridge)
bridge_assembly_finnsih_plane_10 = Plane(bridge_assembly_finnsih_plane)
bridge_assembly_ref_plane_9 = Plane(xy_79)
orient_101 = Orient(Geometry=filter_176, Source=bridge_assembly_ref_plane_9, Target=bridge_assembly_finnsih_plane_10)  # -> Geometry, Transform
preview_5 = CustomPreview(Geometry=orient_101.Geometry, Shader=part_ghost_material)

# ----
filter_177 = StreamFilter(Gate=cut_3, Stream1=axis_gantry_bridge)
orient_102 = Orient(Geometry=filter_177, Source=bridge_assembly_ref_plane_3, Target=bridge_assembly_finnsih_plane_3)  # -> Geometry, Transform
orient_103 = Orient(Geometry=filter_172, Source=cut_geomtery_plane_10, Target=cut_position_plane_11)  # -> Geometry, Transform
orient_104 = Orient(Geometry=filter_35, Source=cut_geomtery_plane_11, Target=cut_position_plane_12)  # -> Geometry, Transform
orient_105 = Orient(Geometry=filter_173, Source=cut_geomtery_plane_11, Target=cut_position_plane_12)  # -> Geometry, Transform
orient_106 = Orient(Geometry=filter_174, Source=cut_geomtery_plane_11, Target=cut_position_plane_12)  # -> Geometry, Transform
orient_107 = Orient(Geometry=filter_175, Source=cut_geomtery_plane_11, Target=cut_position_plane_12)  # -> Geometry, Transform

# ---- group: Pre cut lower layer
gantry_bridge_motor_pockets_for_lower_la_4 = Curve(orient_89.Geometry)  # "Gantry bridge motor pockets for lower layer"
axis_mid_layer_outside_hold_down_cutout = Curve(orient_94.Geometry)
carriage_motor_pocket_depth_12 = Panel(carriage_motor_pocket_depth_7)
axis_lower_layers_inside_precut = Curve(orient_90.Geometry)
axis_lower_layer_inside_cut = Curve(orient_92.Geometry)
nut_pocket_depth_10 = Panel(nut_pocket_depth_9)
axis_lower_layer_cutout_3 = Curve(orient_93.Geometry)
axis_lower_layer_tabs_2 = Brep(orient_103.Geometry)
nut_pockets_4 = Curve(orient_91.Geometry)

# ---- group: Pre cut mid layers
gantry_bridge_motor_pockets_for_mid_laye_4 = Curve(orient_105.Geometry)  # "Gantry bridge motor pockets for mid layer"
carriage_motor_pocket_depth_13 = Panel(carriage_motor_pocket_depth_10)
number_of_mid_layers_5 = Panel(number_of_mid_layers_2)
axis_mid_layers_inside_precut_3 = Curve(orient_107.Geometry)
axis_mid_layer_cutout_3 = Curve(orient_106.Geometry)

# ----
nut_pockets_for_mid_layer_4 = Curve(orient_104.Geometry)
cut_depth_main_layers_3 = Panel(cut_depth_main_layers_2)
preview_6 = CustomPreview(Geometry=orient_102.Geometry, Shader=part_ghost_material)

pocket_9 = Pocket(
    curves_for_raster_pocket=slide_registration_pockets_3,
    cut_depth_pocket=slide_registration_pocket_depth_3,
    pass_depth=pass_depth_from_easy_interface,
    tool_diameter=main_material_and_rack_diameter,
    stepover_0_1=pocket_stepover,
    raster_along_y_0_1=Toggle(False))  # -> pocket_toolpaths_2, feed_rate_multiplier_4
cutout_11 = Cutout(
    curves_for_cutout=registration_jig_cutout_3,
    cut_depth=cut_depth_main_layers_3,
    pass_depth=pass_depth_from_easy_interface,
    tool_diameter=main_material_and_rack_diameter,
    use_climb_direction=Toggle(False),
    use_inside_cutting=Toggle(False))

pocket_10 = Pocket(
    curves_for_raster_pocket=nut_pockets_2,
    cut_depth_pocket=nut_pocket_depth_7,
    pass_depth=pass_depth_from_easy_interface,
    tool_diameter=main_material_and_rack_diameter,
    stepover_0_1=pocket_stepover,
    raster_along_y_0_1=Toggle(False))  # -> pocket_toolpaths_2, feed_rate_multiplier_4
cutout_12 = Cutout(
    curves_for_cutout=bed_lower_layer_cutout_4,
    cut_depth=cut_depth_main_layers_3,
    pass_depth=pass_depth_from_easy_interface,
    tool_diameter=main_material_and_rack_diameter,
    use_climb_direction=Toggle(False),
    use_inside_cutting=Toggle(False))

cutout_13 = Cutout(
    curves_for_cutout=hold_down_inside_pre_cut_3,
    cut_depth=cut_depth_main_layers_3,
    pass_depth=pass_depth_from_easy_interface,
    tool_diameter=main_material_and_rack_diameter,
    use_climb_direction=Toggle(False),
    use_inside_cutting=Toggle(True))

# ----
# Make dowels
cutout_14 = Cutout(
    curves_for_cutout=bed_lower_layer_inside_holes_precut,
    cut_depth=cut_depth_main_layers_3,
    pass_depth=pass_depth_from_easy_interface,
    tool_diameter=main_material_and_rack_diameter,
    use_climb_direction=Toggle(False),
    use_inside_cutting=Toggle(True))

cutout_15 = Cutout(
    curves_for_cutout=axis_mid_layers_inside_precut,
    cut_depth=cut_depth_main_layers_3,
    pass_depth=pass_depth_from_easy_interface,
    tool_diameter=main_material_and_rack_diameter,
    use_climb_direction=Toggle(False),
    use_inside_cutting=Toggle(True))

cutout_16 = Cutout(
    curves_for_cutout=axis_mid_layer_cutout,
    cut_depth=cut_depth_main_layers_3,
    pass_depth=pass_depth_from_easy_interface,
    tool_diameter=main_material_and_rack_diameter,
    use_climb_direction=Toggle(False),
    use_inside_cutting=Toggle(False))

pocket_11 = Pocket(
    curves_for_raster_pocket=z_support_wall_inside_pocket_precut_3,
    cut_depth_pocket=cut_depth_main_layers_3,
    pass_depth=pass_depth_from_easy_interface,
    tool_diameter=main_material_and_rack_diameter,
    stepover_0_1=pocket_stepover,
    raster_along_y_0_1=Toggle(False))  # -> pocket_toolpaths_2, feed_rate_multiplier_4

cutout_17 = Cutout(
    curves_for_cutout=z_support_wall_cutout_5,
    cut_depth=cut_depth_main_layers_3,
    pass_depth=pass_depth_from_easy_interface,
    tool_diameter=main_material_and_rack_diameter,
    use_climb_direction=Toggle(False),
    use_inside_cutting=Toggle(False))

pocket_12 = Pocket(
    curves_for_raster_pocket=motor_pocket_7,
    cut_depth_pocket=carriage_motor_pocket_depth_5,
    pass_depth=pass_depth_from_easy_interface,
    tool_diameter=main_material_and_rack_diameter,
    stepover_0_1=pocket_stepover,
    raster_along_y_0_1=Toggle(False))  # -> pocket_toolpaths_2, feed_rate_multiplier_4
cutout_18 = Cutout(
    curves_for_cutout=carriage_cutout_2,
    cut_depth=cut_depth_main_layers_3,
    pass_depth=pass_depth_from_easy_interface,
    tool_diameter=main_material_and_rack_diameter,
    use_climb_direction=Toggle(False),
    use_inside_cutting=Toggle(False))

cutout_19 = Cutout(
    curves_for_cutout=carriage_inside_precut_2,
    cut_depth=cut_depth_main_layers_3,
    pass_depth=pass_depth_from_easy_interface,
    tool_diameter=main_material_and_rack_diameter,
    use_climb_direction=Toggle(False),
    use_inside_cutting=Toggle(True))

pocket_13 = Pocket(
    curves_for_raster_pocket=gantry_bridge_motor_pockets_for_lower_la_4,
    cut_depth_pocket=carriage_motor_pocket_depth_12,
    pass_depth=pass_depth_from_easy_interface,
    tool_diameter=main_material_and_rack_diameter,
    stepover_0_1=pocket_stepover,
    raster_along_y_0_1=Toggle(False))  # -> pocket_toolpaths_2, feed_rate_multiplier_4
pocket_14 = Pocket(
    curves_for_raster_pocket=nut_pockets_4,
    cut_depth_pocket=nut_pocket_depth_10,
    pass_depth=pass_depth_from_easy_interface,
    tool_diameter=main_material_and_rack_diameter,
    stepover_0_1=pocket_stepover,
    raster_along_y_0_1=Toggle(False))  # -> pocket_toolpaths_2, feed_rate_multiplier_4
cutout_20 = Cutout(
    curves_for_cutout=axis_lower_layer_inside_cut,
    cut_depth=cut_depth_main_layers_3,
    pass_depth=pass_depth_from_easy_interface,
    tool_diameter=main_material_and_rack_diameter,
    use_climb_direction=Toggle(False),
    use_inside_cutting=Toggle(True))
cutout_21 = Cutout(
    curves_for_cutout=axis_lower_layer_cutout_3,
    cut_depth=cut_depth_main_layers_3,
    pass_depth=pass_depth_from_easy_interface,
    tool_diameter=main_material_and_rack_diameter,
    use_climb_direction=Toggle(False),
    use_inside_cutting=Toggle(False))
cutout_22 = Cutout(
    curves_for_cutout=axis_mid_layer_outside_hold_down_cutout,
    cut_depth=cut_depth_main_layers_3,
    pass_depth=pass_depth_from_easy_interface,
    tool_diameter=main_material_and_rack_diameter,
    use_climb_direction=Toggle(False),
    use_inside_cutting=Toggle(False))
pocket_15 = Pocket(
    curves_for_raster_pocket=z_wall_motor_pocket_5,
    cut_depth_pocket=z_wall_motor_pocket_depth_4,
    pass_depth=pass_depth_from_easy_interface,
    tool_diameter=main_material_and_rack_diameter,
    stepover_0_1=pocket_stepover,
    raster_along_y_0_1=Toggle(False))  # -> pocket_toolpaths_2, feed_rate_multiplier_4
cutout_23 = Cutout(
    curves_for_cutout=z_wall_cutout_3,
    cut_depth=cut_depth_main_layers_3,
    pass_depth=pass_depth_from_easy_interface,
    tool_diameter=main_material_and_rack_diameter,
    use_climb_direction=Toggle(False),
    use_inside_cutting=Toggle(False))

cutout_24 = Cutout(
    curves_for_cutout=axis_lower_layers_inside_precut,
    cut_depth=cut_depth_main_layers_3,
    pass_depth=pass_depth_from_easy_interface,
    tool_diameter=main_material_and_rack_diameter,
    use_climb_direction=Toggle(False),
    use_inside_cutting=Toggle(True))

cutout_25 = Cutout(
    curves_for_cutout=z_wall_inside_precut_3,
    cut_depth=cut_depth_main_layers_3,
    pass_depth=pass_depth_from_easy_interface,
    tool_diameter=main_material_and_rack_diameter,
    use_climb_direction=Toggle(False),
    use_inside_cutting=Toggle(True))

cutout_26 = Cutout(
    curves_for_cutout=axis_mid_layer_cutout_3,
    cut_depth=cut_depth_main_layers_3,
    pass_depth=pass_depth_from_easy_interface,
    tool_diameter=main_material_and_rack_diameter,
    use_climb_direction=Toggle(False),
    use_inside_cutting=Toggle(False))
pocket_16 = Pocket(
    curves_for_raster_pocket=gantry_bridge_motor_pockets_for_mid_laye_4,
    cut_depth_pocket=carriage_motor_pocket_depth_13,
    pass_depth=pass_depth_from_easy_interface,
    tool_diameter=main_material_and_rack_diameter,
    stepover_0_1=pocket_stepover,
    raster_along_y_0_1=Toggle(False))  # -> pocket_toolpaths_2, feed_rate_multiplier_4

pocket_17 = Pocket(
    curves_for_raster_pocket=nut_pockets_for_mid_layer_4,
    cut_depth_pocket=nut_pocket_depth_4,
    pass_depth=pass_depth_from_easy_interface,
    tool_diameter=main_material_and_rack_diameter,
    stepover_0_1=pocket_stepover,
    raster_along_y_0_1=Toggle(False))  # -> pocket_toolpaths_2, feed_rate_multiplier_4
cutout_27 = Cutout(
    curves_for_cutout=axis_mid_layers_inside_precut_3,
    cut_depth=cut_depth_main_layers_3,
    pass_depth=pass_depth_from_easy_interface,
    tool_diameter=main_material_and_rack_diameter,
    use_climb_direction=Toggle(False),
    use_inside_cutting=Toggle(True))

merge_70 = Merge(Data1=pocket_9.pocket_toolpaths_2, Data2=cutout_11)
merge_71 = Merge(Data1=pocket_10.pocket_toolpaths_2, Data2=cutout_12)
main_cut_toolpaths_12 = Curve(cutout_16)
pre_cut_toolpaths_5 = Curve(cutout_15)
merge_72 = Merge(Data1=cutout_27, Data2=pocket_17.pocket_toolpaths_2)
merge_73 = Merge(Data1=pocket_16.pocket_toolpaths_2, Data2=cutout_26)
merge_74 = Merge(Data1=pocket_12.pocket_toolpaths_2, Data2=cutout_18)
merge_75 = Merge(Data1=pocket_15.pocket_toolpaths_2, Data2=cutout_23)
pre_cut_toolpaths_6 = Curve(cutout_13)
pre_cut_toolpaths_7 = Curve(pocket_11.pocket_toolpaths_2)
pre_cut_toolpaths_8 = Curve(cutout_14)
main_cut_toolpaths_13 = Curve(merge_70)
main_cut_toolpaths_14 = Curve(cutout_17)
main_cut_toolpaths_15 = Curve(merge_71)
merge_76 = Merge(
    Data1=pocket_13.pocket_toolpaths_2,
    Data2=pocket_14.pocket_toolpaths_2,
    Data3=cutout_20,
    Data4=cutout_21,
    Data5=cutout_22)
pre_cut_toolpaths_9 = Curve(merge_72)
main_cut_toolpaths_16 = Curve(merge_73)
pre_cut_toolpaths_10 = Curve(cutout_19)
main_cut_toolpaths_17 = Curve(merge_74)
pre_cut_toolpaths_11 = Curve(cutout_25)
main_cut_toolpaths_18 = Curve(merge_75)
main_cut_toolpaths_19 = Curve(merge_76)
pre_cut_toolpaths_12 = Curve(cutout_24)
merge_77 = Merge(
    Data1=main_cut_toolpaths,
    Data2=main_cut_toolpaths_5,
    Data3=main_cut_toolpaths_6,
    Data4=main_cut_toolpaths_8,
    Data5=main_cut_toolpaths_16,
    Data6=main_cut_toolpaths_19,
    Data7=main_cut_toolpaths_17,
    Data8=main_cut_toolpaths_18,
    Data9=main_cut_toolpaths_14,
    Data10=main_cut_toolpaths_12,
    Data13=main_cut_toolpaths_15,
    Data14=main_cut_toolpaths_13,
    Data15=main_cut_toolpaths_10,
    Data17=main_cut_toolpaths_7,
    Data18=main_cut_toolpaths_3,
    Data19=main_cut_toolpaths_9,
    Data20=main_cut_toolpaths_2,
    Data21=main_cut_toolpaths_11,
    Data22=main_cut_toolpaths_4)
merge_78 = Merge(
    Data1=pre_cut_toolpaths,
    Data2=pre_cut_toolpaths_2,
    Data3=pre_cut_toolpaths_3,
    Data4=pre_cut_toolpaths_4,
    Data5=pre_cut_toolpaths_9,
    Data6=pre_cut_toolpaths_12,
    Data7=pre_cut_toolpaths_10,
    Data8=pre_cut_toolpaths_11,
    Data9=pre_cut_toolpaths_7,
    Data10=pre_cut_toolpaths_5,
    Data13=pre_cut_toolpaths_8,
    Data14=pre_cut_toolpaths_6)
pre_cut_toolpaths_13 = Curve(merge_78)
main_cut_toolpaths_20 = Curve(merge_77)
filter_178 = StreamFilter(Gate=current_cutting_to_do, Stream0=hold_down_toolpaths, Stream1=pre_cut_toolpaths_13, Stream2=main_cut_toolpaths_20)
current_toolpaths_to_cut = Curve(filter_178)
shopbot_code_postprocessor = ShopBotCodePostProcessor(
    toolpath_curves=current_toolpaths_to_cut,
    tab_breps=axis_lower_layer_tabs_2,
    feed_rate=feed_rate_2,
    plunge_rate=plunge_rate_2,
    safe_z_height=safe_z_height,
    use_spindle=use_spindle_2,
    spindle_speed=filter_20,
    ramp_plunges=ramp_plunges_2,
    ramp_angle=ramp_angle_2,
    use_custom_jog_home=use_custom_jog_home_2,
    custom_home_x=custom_jog_home_x_2,
    custom_home_y=custom_jog_home_y_2,
    deviation_tolerance=deviation_tolerance_2,
    milling_bit_diameter=milling_bit_diameter,
    job_name=job_name)  # -> toolpath_preview_curves_2, tab_cleanup_preview_curves_2, cut_transition_preview_lines_2, cut_entry_preview_lines_2, cut_exit_preview_lines_2, shopbot_code_connect_panel_stream_and_sa, tab_cleanup_code_connect_panel_stream_an

# ---- group: ShopBot code current job
stream_and_save_as_sbp = Panel(shopbot_code_postprocessor.shopbot_code_connect_panel_stream_and_sa)

# ---- group: Make single axis simulation
single_axis_config_identifier_4 = Panel(single_axis_config_identifier)
single_axis_simulation_x_2 = Panel(single_axis_simulation_x)
main_material_thickness_30 = Panel(thickness)
rail_rack_and_pinion_material_thickness_20 = Panel(thickness_2)
current_machine_to_make_12 = Panel(list)
actual_axis_lenght_first_axis_6 = Panel(actual_axis_lenght_first_axis)
number_of_layers_beneath_rack_and_rail_l_9 = Panel(number_of_layers_beneath_rack_and_rail_l_3)  # "Number of layers beneath rack and rail layer"
z_wal1l_brep_2 = Brep(z_wal1l_brep)
v_bearing_brep_3 = Brep(v_bearing_brep)
carriage_motor_brep_3 = Brep(carriage_motor_brep)
z_wall1_motor_brep_2 = Brep(z_wall1_motor_brep)
carriage_plate_brep_2 = Brep(carriage_plate_brep)
z_wal12_brep_2 = Brep(z_wal12_brep)
z_support_wall_breps_4 = Brep(z_support_wall_breps_3)
z_wall2_motor_brep_2 = Brep(z_wall2_motor_brep)
axis_lower_layers_brep_2 = Brep([axis_lower_layers_brep, axis_mid_layers_brep])
preview_center_plane_5 = Plane(preview_center_plane)
merge_79 = Merge(
    Data1=flatten(carriage_plate_brep_2),
    Data2=flatten(z_wal1l_brep_2),
    Data3=flatten(z_wal12_brep_2),
    Data4=flatten(z_support_wall_breps_4))
merge_80 = Merge(Data1=flatten(carriage_motor_brep_3), Data2=flatten(z_wall1_motor_brep_2), Data3=flatten(z_wall2_motor_brep_2))
equals_52 = Equality(FirstNumber=current_machine_to_make_12, SecondNumber=single_axis_config_identifier_4)  # -> Equality, Inequality
Y_37 = UnitY(Factor=single_axis_simulation_x_2)
multiplication_124 = Multiplication(A=number_of_layers_beneath_rack_and_rail_l_9, B=main_material_thickness_30)
filter_179 = StreamFilter(Gate=equals_52.Equality, Stream1=v_bearing_brep_3)
filter_180 = StreamFilter(Gate=equals_52.Equality, Stream1=merge_80)
filter_181 = StreamFilter(Gate=equals_52.Equality, Stream1=merge_79)
filter_182 = StreamFilter(Gate=equals_52.Equality, Stream1=axis_top_layer_2)
filter_183 = StreamFilter(Gate=equals_52.Equality, Stream1=axis_lower_layers_brep_2)
addition_90 = Addition(A=multiplication_124, B=rail_rack_and_pinion_material_thickness_20)
multiplication_125 = Multiplication(A=actual_axis_lenght_first_axis_6, B="0.5")
neg_79 = Negative(Value=addition_90)
pt_74 = ConstructPoint(XCoordinate=multiplication_125, YCoordinate=0, ZCoordinate=neg_79)
xy_84 = XYPlane(Origin=pt_74)
rotate_33 = Rotate(Geometry=xy_84, Angle=4.71238898, Plane=xy_84)  # -> Geometry, Transform
gantry_work_area_center_plane_4 = Plane(rotate_33.Geometry)
orient_108 = Orient(Geometry=filter_181, Source=gantry_work_area_center_plane_4, Target=preview_center_plane_5)  # -> Geometry, Transform
orient_109 = Orient(Geometry=filter_179, Source=gantry_work_area_center_plane_4, Target=preview_center_plane_5)  # -> Geometry, Transform
orient_110 = Orient(Geometry=filter_180, Source=gantry_work_area_center_plane_4, Target=preview_center_plane_5)  # -> Geometry, Transform
orient_111 = Orient(Geometry=filter_183, Source=gantry_work_area_center_plane_4, Target=preview_center_plane_5)  # -> Geometry, Transform
orient_112 = Orient(Geometry=filter_182, Source=gantry_work_area_center_plane_4, Target=preview_center_plane_5)  # -> Geometry, Transform
carriage_rack_and_rail_material = Brep(orient_109.Geometry)
carriage_motor_material = Brep(orient_110.Geometry)
carriage_main_material = Brep(orient_108.Geometry)
bridge_main_material = Brep(orient_111.Geometry)
gate_21 = StreamGate(Stream=orient_112.Geometry, Gate=equals_43.Equality)  # -> Target0, Target1
gate_22 = StreamGate(Stream=carriage_main_material, Gate=equals_43.Equality)  # -> Target0, Target1
gate_23 = StreamGate(Stream=carriage_rack_and_rail_material, Gate=equals_43.Equality)  # -> Target0, Target1
gate_24 = StreamGate(Stream=carriage_motor_material, Gate=equals_43.Equality)  # -> Target0, Target1
gate_25 = StreamGate(Stream=bridge_main_material, Gate=equals_43.Equality)  # -> Target0, Target1
item_72 = ListItem(List=gate_21.Target0, Index=0, Wrap=True)
wires = BrepWireframe(Brep=carriage_main_material, Density=-1)
wires_2 = BrepWireframe(Brep=carriage_rack_and_rail_material, Density=-1)
wires_3 = BrepWireframe(Brep=carriage_motor_material, Density=-1)
wires_4 = BrepWireframe(Brep=bridge_main_material, Density=-1)
wires_5 = BrepWireframe(Brep=orient_112.Geometry, Density=-1)
mesh = MeshBrep(Brep=gate_22.Target0, Settings=smooth)
mesh_2 = MeshBrep(Brep=gate_23.Target0, Settings=smooth)
mesh_3 = MeshBrep(Brep=gate_24.Target0, Settings=smooth)
mesh_4 = MeshBrep(Brep=gate_25.Target0, Settings=smooth)
mesh_5 = MeshBrep(Brep=item_72, Settings=smooth)
crv_4 = Curve(orient_112.Geometry)
move_133 = Move(Geometry=mesh, Motion=Y_37)  # -> Geometry, Transform
move_134 = Move(Geometry=wires, Motion=Y_37)  # -> Geometry, Transform
move_135 = Move(Geometry=mesh_2, Motion=Y_37)  # -> Geometry, Transform
move_136 = Move(Geometry=wires_2, Motion=Y_37)  # -> Geometry, Transform
move_137 = Move(Geometry=mesh_3, Motion=Y_37)  # -> Geometry, Transform
move_138 = Move(Geometry=wires_3, Motion=Y_37)  # -> Geometry, Transform
carriage_rack_and_rail_material_2 = Geometry(move_135.Geometry)
carriage_rack_and_rail_material_3 = Geometry(move_136.Geometry)
bridge_rack_and_rail_material = Geometry(mesh_5)
bridge_rack_and_rail_material_2 = Geometry([wires_5, crv_4])
carriage_motor_material_2 = Geometry(move_137.Geometry)
carriage_motor_material_3 = Geometry(move_138.Geometry)
carriage_main_material_2 = Geometry(move_133.Geometry)
carriage_main_material_3 = Geometry(move_134.Geometry)
bridge_main_material_2 = Geometry(mesh_4)
bridge_main_material_3 = Geometry(wires_4)
rack_and_rail_material_2 = Shader(filter_23)
rack_and_rail_material_3 = Shader(filter_23)
motor_material_2 = Shader(filter_24)
main_material_2 = Shader(filter_22)
main_material_3 = Shader(filter_22)
wire_material_2 = Shader(filter_25)
wire_material_3 = Shader(filter_25)
wire_material_4 = Shader(filter_25)
wire_material_5 = Shader(filter_25)
wire_material_6 = Shader(filter_25)
preview_7 = CustomPreview(Geometry=carriage_main_material_2, Shader=main_material_2)
preview_8 = CustomPreview(Geometry=carriage_main_material_3, Shader=wire_material_2)
preview_9 = CustomPreview(Geometry=carriage_rack_and_rail_material_2, Shader=rack_and_rail_material_2)
preview_10 = CustomPreview(Geometry=carriage_rack_and_rail_material_3, Shader=wire_material_3)
preview_11 = CustomPreview(Geometry=carriage_motor_material_2, Shader=motor_material_2)
preview_12 = CustomPreview(Geometry=carriage_motor_material_3, Shader=wire_material_4)
preview_13 = CustomPreview(Geometry=bridge_main_material_2, Shader=main_material_3)
preview_14 = CustomPreview(Geometry=bridge_main_material_3, Shader=wire_material_5)
preview_15 = CustomPreview(Geometry=bridge_rack_and_rail_material, Shader=rack_and_rail_material_3)
preview_16 = CustomPreview(Geometry=bridge_rack_and_rail_material_2, Shader=wire_material_6)

# ---- group: Make delta simulation
axis_planes_2 = Plane(graft(axis_planes))
preview_center_plane_6 = Plane(preview_center_plane)
current_machine_to_make_13 = Panel(list)
actual_axis_lenght_first_axis_7 = Panel(actual_axis_lenght_first_axis)
number_of_layers_beneath_rack_and_rail_l_10 = Panel(number_of_layers_beneath_rack_and_rail_l_3)  # "Number of layers beneath rack and rail layer"
delta_axis_config_identifier = Panel(single_axis_config_identifier_2)
axis_simulation_distances_2 = Panel(axis_simulation_distances)
main_material_thickness_31 = Panel(thickness)
rail_rack_and_pinion_material_thickness_21 = Panel(thickness_2)
carriage_plate_brep_3 = Brep(carriage_plate_brep)
z_wal1l_brep_3 = Brep(z_wal1l_brep)
z_support_wall_breps_5 = Brep(z_support_wall_breps_3)
v_bearing_brep_4 = Brep(v_bearing_brep)
carriage_motor_brep_4 = Brep(carriage_motor_brep)
z_wall1_motor_brep_3 = Brep(z_wall1_motor_brep)
z_wall2_motor_brep_3 = Brep(z_wall2_motor_brep)
z_wal12_brep_3 = Brep(z_wal12_brep)
axis_lower_layers_brep_3 = Brep([axis_lower_layers_brep, axis_mid_layers_brep])
merge_81 = Merge(
    Data1=flatten(carriage_plate_brep_3),
    Data2=flatten(z_wal1l_brep_3),
    Data3=flatten(z_wal12_brep_3),
    Data4=flatten(z_support_wall_breps_5))
merge_82 = Merge(Data1=flatten(carriage_motor_brep_4), Data2=flatten(z_wall1_motor_brep_3), Data3=flatten(z_wall2_motor_brep_3))
equals_53 = Equality(FirstNumber=current_machine_to_make_13, SecondNumber=delta_axis_config_identifier)  # -> Equality, Inequality
graft = GraftTree(Tree=axis_simulation_distances_2, IncludeEmptyLists=True, IncludeNullItems=True)
multiplication_126 = Multiplication(A=number_of_layers_beneath_rack_and_rail_l_10, B=main_material_thickness_31)
filter_184 = StreamFilter(Gate=equals_53.Equality, Stream1=v_bearing_brep_4)
filter_185 = StreamFilter(Gate=equals_53.Equality, Stream1=merge_82)
filter_186 = StreamFilter(Gate=equals_53.Equality, Stream1=merge_81)
filter_187 = StreamFilter(Gate=equals_53.Equality, Stream1=axis_top_layer_3)
filter_188 = StreamFilter(Gate=equals_53.Equality, Stream1=axis_lower_layers_brep_3)
Z_64 = UnitZ(Factor=graft)
addition_91 = Addition(A=multiplication_126, B=rail_rack_and_pinion_material_thickness_21)
multiplication_127 = Multiplication(A=actual_axis_lenght_first_axis_7, B="0.5")
neg_80 = Negative(Value=addition_91)
pt_75 = ConstructPoint(XCoordinate=multiplication_127, YCoordinate=0, ZCoordinate=neg_80)
xy_85 = XYPlane(Origin=pt_75)
rotate_34 = Rotate(Geometry=xy_85, Angle=4.71238898, Plane=xy_85)  # -> Geometry, Transform
gantry_work_area_center_plane_5 = Plane(rotate_34.Geometry)
orient_113 = Orient(Geometry=filter_186, Source=gantry_work_area_center_plane_5, Target=axis_planes_2)  # -> Geometry, Transform
orient_114 = Orient(Geometry=filter_184, Source=gantry_work_area_center_plane_5, Target=axis_planes_2)  # -> Geometry, Transform
orient_115 = Orient(Geometry=filter_185, Source=gantry_work_area_center_plane_5, Target=axis_planes_2)  # -> Geometry, Transform
orient_116 = Orient(Geometry=filter_188, Source=gantry_work_area_center_plane_5, Target=axis_planes_2)  # -> Geometry, Transform
orient_117 = Orient(Geometry=filter_187, Source=gantry_work_area_center_plane_5, Target=axis_planes_2)  # -> Geometry, Transform
carriage_rack_and_rail_material_4 = Brep(orient_114.Geometry)
carriage_motor_material_4 = Brep(orient_115.Geometry)
carriage_main_material_4 = Brep(orient_113.Geometry)
bridge_main_material_4 = Brep(orient_116.Geometry)
gate_26 = StreamGate(Stream=carriage_main_material_4, Gate=equals_43.Equality)  # -> Target0, Target1
gate_27 = StreamGate(Stream=carriage_rack_and_rail_material_4, Gate=equals_43.Equality)  # -> Target0, Target1
gate_28 = StreamGate(Stream=carriage_motor_material_4, Gate=equals_43.Equality)  # -> Target0, Target1
gate_29 = StreamGate(Stream=bridge_main_material_4, Gate=equals_43.Equality)  # -> Target0, Target1
gate_30 = StreamGate(Stream=orient_117.Geometry, Gate=equals_43.Equality)  # -> Target0, Target1
wires_6 = BrepWireframe(Brep=carriage_main_material_4, Density=-1)
wires_7 = BrepWireframe(Brep=carriage_rack_and_rail_material_4, Density=-1)
wires_8 = BrepWireframe(Brep=carriage_motor_material_4, Density=-1)
wires_9 = BrepWireframe(Brep=bridge_main_material_4, Density=-1)
wires_10 = BrepWireframe(Brep=orient_117.Geometry, Density=-1)
mesh_6 = MeshBrep(Brep=gate_26.Target0, Settings=smooth)
mesh_7 = MeshBrep(Brep=gate_27.Target0, Settings=smooth)
mesh_8 = MeshBrep(Brep=gate_28.Target0, Settings=smooth)
mesh_9 = MeshBrep(Brep=gate_29.Target0, Settings=smooth)
mesh_10 = MeshBrep(Brep=gate_30.Target0, Settings=smooth)
pshift_3 = ShiftPaths(Data=wires_7, Offset=-1)
pshift_4 = ShiftPaths(Data=wires_8, Offset=-1)
pshift_5 = ShiftPaths(Data=wires_6, Offset=-1)
move_139 = Move(Geometry=mesh_6, Motion=Z_64)  # -> Geometry, Transform
move_140 = Move(Geometry=pshift_5, Motion=Z_64)  # -> Geometry, Transform
move_141 = Move(Geometry=mesh_7, Motion=Z_64)  # -> Geometry, Transform
move_142 = Move(Geometry=pshift_3, Motion=Z_64)  # -> Geometry, Transform
move_143 = Move(Geometry=mesh_8, Motion=Z_64)  # -> Geometry, Transform
move_144 = Move(Geometry=pshift_4, Motion=Z_64)  # -> Geometry, Transform
carriage_rack_and_rail_material_5 = Geometry(move_141.Geometry)
carriage_rack_and_rail_material_6 = Geometry(move_142.Geometry)
bridge_rack_and_rail_material_3 = Geometry(mesh_10)
bridge_rack_and_rail_material_4 = Geometry(wires_10)
carriage_motor_material_5 = Geometry(move_143.Geometry)
carriage_motor_material_6 = Geometry(move_144.Geometry)
carriage_main_material_5 = Geometry(move_139.Geometry)
carriage_main_material_6 = Geometry(move_140.Geometry)
bridge_main_material_5 = Geometry(wires_9)
bridge_main_material_6 = Geometry(mesh_9)
rack_and_rail_material_4 = Shader(filter_23)
rack_and_rail_material_5 = Shader(filter_23)
motor_material_3 = Shader(filter_24)
main_material_4 = Shader(filter_22)
main_material_5 = Shader(filter_22)
wire_material_7 = Shader(filter_25)
wire_material_8 = Shader(filter_25)
wire_material_9 = Shader(filter_25)
wire_material_10 = Shader(filter_25)
wire_material_11 = Shader(filter_25)
preview_17 = CustomPreview(Geometry=carriage_main_material_5, Shader=main_material_4)
preview_18 = CustomPreview(Geometry=carriage_main_material_6, Shader=wire_material_9)
preview_19 = CustomPreview(Geometry=carriage_rack_and_rail_material_5, Shader=rack_and_rail_material_4)
preview_20 = CustomPreview(Geometry=carriage_rack_and_rail_material_6, Shader=wire_material_7)
preview_21 = CustomPreview(Geometry=carriage_motor_material_5, Shader=motor_material_3)
preview_22 = CustomPreview(Geometry=carriage_motor_material_6, Shader=wire_material_10)
preview_23 = CustomPreview(Geometry=bridge_main_material_6, Shader=main_material_5)
preview_24 = CustomPreview(Geometry=bridge_main_material_5, Shader=wire_material_8)
preview_25 = CustomPreview(Geometry=bridge_rack_and_rail_material_3, Shader=rack_and_rail_material_5)
preview_26 = CustomPreview(Geometry=bridge_rack_and_rail_material_4, Shader=wire_material_11)

# ----
toolpath_preview_curves = Curve(shopbot_code_postprocessor.toolpath_preview_curves_2)
find_deepest_z = FindDeepestZ(toolpaths=toolpath_preview_curves)
compile_settings = CompileSettings(
    feed_rate=feed_rate_2,
    plunge_rate=plunge_rate_2,
    spindle_rpm=filter_20,
    pass_depth=feed_rate_calculator.pass_depth_4,
    ramp_plunges=ramp_plunges_2,
    ramp_angle=ramp_angle_2,
    deepest_z=find_deepest_z)  # -> complete_settings, crucial_settings
mill_settings_current_job = Panel(compile_settings.complete_settings)
tab_cleanup_preview_lines = Curve(shopbot_code_postprocessor.tab_cleanup_preview_curves_2)
preview_27 = CustomPreview(Geometry=tab_cleanup_preview_lines, Shader=tab_cleanup)

# ---- group: Prep mid bed layer cutting
wedge_hole_mid_layers_5 = Curve(wedge_hole_mid_layers)
machine_bed_lower_layer_outline_5 = Curve(machine_bed_lower_layer_outline)
center_point_upper_axis_12 = Point(center_point_upper_axis)
number_of_layers_in_gantry_bed_6 = Panel(number_of_layers_in_gantry_bed_3)
xz_58 = XZPlane(Origin=center_point_upper_axis_12)
larger_11 = LargerThan(FirstNumber=number_of_layers_in_gantry_bed_6, SecondNumber="2")  # -> LargerThan, OrEqualTo
xy_86 = XYPlane(Origin=Point(0, 0, 0))
filter_189 = StreamFilter(Gate=join_rails_with_dowels_instead_of_bolts_7, Stream0=cir_13, Stream1=wedge_hole_mid_layers_5)
rotate_35 = Rotate(Geometry=xy_86, Angle=1.570796327, Plane=xy_86)  # -> Geometry, Transform
orient_118 = Orient(Geometry=filter_189, Source=rotate_35.Geometry, Target=hole_planes_top_layer_3)  # -> Geometry, Transform
merge_83 = Merge(Data1=flatten(orient_118.Geometry))
filter_190 = StreamFilter(Gate=larger_11.LargerThan, Stream1=machine_bed_lower_layer_outline_5)
filter_191 = StreamFilter(Gate=larger_11.LargerThan, Stream1=merge_83)
mirror_92 = Mirror(Geometry=filter_191, Plane=xz_58)  # -> Geometry, Transform
make_mid_bed_layer = Panel(larger_11.LargerThan)
bed_mid_layer_outline = Curve(flatten(filter_190))

# ----
clean_9 = CleanTree(RemoveNulls=True, RemoveInvalid=True, RemoveEmpty=True, Tree=flatten([filter_191, mirror_92.Geometry]))

# ---- group: Prep mid bed layer cutting (continued)
bed_mid_layer_inside_holes = Curve(flatten(clean_9))

# ----
bed_mid_layer_inside_holes_precut = Curve(bed_mid_layer_inside_holes)
bed_mid_layer_cutout = Curve(bed_mid_layer_outline)
gate_31 = StreamGate(Stream=bed_mid_layer_inside_holes_precut, Gate=preview_level_of_detail_8)  # -> Target0, Target1
extr_32 = Extrude(Base=bed_mid_layer_cutout, Direction=Z_56)
extr_33 = Extrude(Base=gate_31.Target1, Direction=Z_56)
cap_29 = CapHoles(Brep=extr_32)
cap_30 = CapHoles(Brep=extr_33)
sdiff_20 = SolidDifference(BrepsA=cap_29, BrepsB=cap_30)
filter_192 = StreamFilter(Gate=preview_level_of_detail_8, Stream0=cap_29, Stream1=sdiff_20)
move_145 = Move(Geometry=filter_192, Motion=Z_57)  # -> Geometry, Transform
merge_84 = Merge(Data1=move_124.Geometry, Data2=move_145.Geometry, Data3=move_123.Geometry)
gantry_bed_layers_brep = Brep(merge_84)

merge_85 = Merge(Data1=gantry_rail_top_layer, Data2=gantry_rail_lower_layers_brep, Data3=gantry_bed_layers_brep)
filter_193 = StreamFilter(Gate=cut_2, Stream1=merge_85)
filter_194 = StreamFilter(Gate=cut_7, Stream1=merge_85)
orient_119 = Orient(Geometry=filter_193, Source=bed_ref_plane_3, Target=bed_finish_plane_3)  # -> Geometry, Transform
orient_120 = Orient(Geometry=filter_194, Source=bed_ref_plane_5, Target=bed_finish_plane_5)  # -> Geometry, Transform

# ---- group: Pre cut mid bed layer
bed_mid_layer_inside_holes_precut_2 = Curve(bed_mid_layer_inside_holes)
make_mid_bed_layer_2 = Panel(make_mid_bed_layer)
# CONNECT!
bed_mid_layer_cutout_2 = Curve(bed_mid_layer_outline)

# ----
preview_28 = CustomPreview(Geometry=orient_119.Geometry, Shader=part_ghost_material)
preview_29 = CustomPreview(Geometry=orient_120.Geometry, Shader=part_ghost_material)
flatten_7 = FlattenTree(
    Tree=[axis_top_layer_inside_precut_2, spacer_pockets_2, pinion_pocket_3, rack_pocket_4, axis_top_layer_bearing_bolt_pocket_3, axis_top_layer_cutout_2, lower_left_rail_inside_precut_3, spacer_pockets_5, rack_pocket_7, lower_left_rail_cutout_2, lower_right_rail_inside_precut, spacer_pockets_6, rack_pocket_8, lower_right_rail_cutout, slide_inside_precut_5, slide_cutout_4, axis_mid_layers_inside_precut_3, gantry_bridge_motor_pockets_for_mid_laye_4, axis_mid_layer_cutout_3, axis_lower_layers_inside_precut, gantry_bridge_motor_pockets_for_lower_la_4, nut_pockets_4, axis_lower_layer_inside_cut, axis_lower_layer_cutout_3, axis_lower_layer_tabs_2, axis_mid_layer_outside_hold_down_cutout, carriage_inside_precut_2, motor_pocket_7, carriage_cutout_2, z_wall_inside_precut_3, z_wall_motor_pocket_5, z_wall_cutout_3, z_support_wall_inside_pocket_precut_3, z_support_wall_cutout_5, axis_mid_layers_inside_precut, axis_mid_layer_cutout, bed_top_layer_inside_holes_precut, bed_top_layer_cutout, bed_mid_layer_inside_holes_precut_2, bed_mid_layer_cutout_2, bed_lower_layer_inside_holes_precut, nut_pockets_2, bed_lower_layer_cutout_4, hold_down_inside_pre_cut_3, slide_registration_pockets_3, registration_jig_cutout_3, bridge_assembly_registration_holes, bed_assembly_registration_holes_3],
    Path="{0}")
clean_10 = CleanTree(RemoveNulls=True, RemoveInvalid=True, RemoveEmpty=False, Tree=flatten_7)
current_2d_geometry = Curve(clean_10)

# ---- group: Make gantry config simulation
gantry_simulation_z_2 = Panel(gantry_simulation_z)
carriage_plate_brep_4 = Brep(carriage_plate_brep)
z_wal12_brep_4 = Brep(z_wal12_brep)
z_support_wall_breps_6 = Brep(z_support_wall_breps_3)
v_bearing_brep_5 = Brep(v_bearing_brep)
carriage_motor_brep_5 = Brep(carriage_motor_brep)
axis_lower_layers_brep_4 = Brep([axis_lower_layers_brep, axis_mid_layers_brep])
gantry_bridge_v_bearing_breps = Brep(gantry_bridge_v_bearings)
gantry_bridge_motor_breps = Brep(gantry_bridge_motors)
gantry_rail_lower_layers_brep_2 = Brep(gantry_rail_lower_layers_brep)
gantry_bed_layers_brep_2 = Brep(gantry_bed_layers_brep)
construction_plane_upper_axis_2 = Plane(construction_plane_upper_axis)
location_plane_upper_axis_3 = Plane(location_plane_upper_axis_2)
current_machine_to_make_14 = Panel(list)
gantry_simulation_x_2 = Panel(gantry_simulation_x)
distance_from_rail_edge_to_slide_edge_3 = Panel(distance_from_rail_edge_to_slide_edge)
z_wal1l_brep_4 = Brep(z_wal1l_brep)
z_wall1_motor_brep_4 = Brep(z_wall1_motor_brep)
z_wall2_motor_brep_4 = Brep(z_wall2_motor_brep)
gantry_config_identifier_6 = Panel(gantry_config_identifier)
gantry_simulation_y_2 = Panel(gantry_simulation_y)
gantry_rail_top_layer_2 = Geometry(gantry_rail_top_layer)
axis_top_layer_4 = Geometry(axis_top_layer)
merge_86 = Merge(
    Data1=flatten(carriage_plate_brep_4),
    Data2=flatten(z_wal1l_brep_4),
    Data3=flatten(z_wal12_brep_4),
    Data4=flatten(z_support_wall_breps_6))
merge_87 = Merge(Data1=flatten(carriage_motor_brep_5), Data2=flatten(z_wall1_motor_brep_4), Data3=flatten(z_wall2_motor_brep_4))
merge_88 = Merge(Data1=flatten(gantry_rail_lower_layers_brep_2), Data2=flatten(gantry_bed_layers_brep_2))
equals_54 = Equality(FirstNumber=current_machine_to_make_14, SecondNumber=gantry_config_identifier_6)  # -> Equality, Inequality
X_38 = UnitX(Factor=gantry_simulation_y_2)
addition_92 = Addition(A=gantry_simulation_x_2, B=distance_from_rail_edge_to_slide_edge_3)
filter_195 = StreamFilter(Gate=equals_54.Equality, Stream1=merge_88)
filter_196 = StreamFilter(Gate=equals_54.Equality, Stream1=gantry_rail_top_layer_2)
filter_197 = StreamFilter(Gate=equals_54.Equality, Stream1=v_bearing_brep_5)
filter_198 = StreamFilter(Gate=equals_54.Equality, Stream1=merge_87)
filter_199 = StreamFilter(Gate=equals_54.Equality, Stream1=merge_86)
filter_200 = StreamFilter(Gate=equals_54.Equality, Stream1=gantry_bridge_motor_breps)
filter_201 = StreamFilter(Gate=equals_54.Equality, Stream1=axis_lower_layers_brep_4)
filter_202 = StreamFilter(Gate=equals_54.Equality, Stream1=axis_top_layer_4)
filter_203 = StreamFilter(Gate=equals_54.Equality, Stream1=gantry_bridge_v_bearing_breps)
Y_38 = UnitY(Factor=addition_92)
orient_121 = Orient(Geometry=filter_199, Source=construction_plane_upper_axis_2, Target=location_plane_upper_axis_3)  # -> Geometry, Transform
orient_122 = Orient(Geometry=filter_197, Source=construction_plane_upper_axis_2, Target=location_plane_upper_axis_3)  # -> Geometry, Transform
orient_123 = Orient(Geometry=filter_198, Source=construction_plane_upper_axis_2, Target=location_plane_upper_axis_3)  # -> Geometry, Transform
orient_124 = Orient(Geometry=filter_201, Source=construction_plane_upper_axis_2, Target=location_plane_upper_axis_3)  # -> Geometry, Transform
orient_125 = Orient(Geometry=filter_202, Source=construction_plane_upper_axis_2, Target=location_plane_upper_axis_3)  # -> Geometry, Transform
gantry_work_area_center_plane_6 = Plane(gantry_work_area_center_plane_2)
preview_center_plane_7 = Plane(preview_center_plane)
orient_126 = Orient(Geometry=filter_203, Source=gantry_work_area_center_plane_6, Target=preview_center_plane_7)  # -> Geometry, Transform
orient_127 = Orient(Geometry=orient_121.Geometry, Source=gantry_work_area_center_plane_6, Target=preview_center_plane_7)  # -> Geometry, Transform
orient_128 = Orient(Geometry=orient_122.Geometry, Source=gantry_work_area_center_plane_6, Target=preview_center_plane_7)  # -> Geometry, Transform
orient_129 = Orient(Geometry=orient_123.Geometry, Source=gantry_work_area_center_plane_6, Target=preview_center_plane_7)  # -> Geometry, Transform
orient_130 = Orient(Geometry=orient_124.Geometry, Source=gantry_work_area_center_plane_6, Target=preview_center_plane_7)  # -> Geometry, Transform
orient_131 = Orient(Geometry=orient_125.Geometry, Source=gantry_work_area_center_plane_6, Target=preview_center_plane_7)  # -> Geometry, Transform
orient_132 = Orient(Geometry=filter_200, Source=gantry_work_area_center_plane_6, Target=preview_center_plane_7)  # -> Geometry, Transform
orient_133 = Orient(Geometry=filter_195, Source=gantry_work_area_center_plane_6, Target=preview_center_plane_7)  # -> Geometry, Transform
orient_134 = Orient(Geometry=filter_196, Source=gantry_work_area_center_plane_6, Target=preview_center_plane_7)  # -> Geometry, Transform
carriage_rack_and_rail_material_7 = Brep(orient_128.Geometry)
carriage_motor_material_7 = Brep(orient_129.Geometry)
carriage_main_material_7 = Brep(orient_127.Geometry)
bridge_motor_material = Brep(orient_132.Geometry)
bridge_main_material_7 = Brep(orient_130.Geometry)
bed_main_material = Brep(orient_133.Geometry)
gate_32 = StreamGate(Stream=orient_126.Geometry, Gate=equals_43.Equality)  # -> Target0, Target1
gate_33 = StreamGate(Stream=orient_131.Geometry, Gate=equals_43.Equality)  # -> Target0, Target1
gate_34 = StreamGate(Stream=orient_134.Geometry, Gate=equals_43.Equality)  # -> Target0, Target1
gate_35 = StreamGate(Stream=carriage_main_material_7, Gate=equals_43.Equality)  # -> Target0, Target1
gate_36 = StreamGate(Stream=carriage_rack_and_rail_material_7, Gate=equals_43.Equality)  # -> Target0, Target1
gate_37 = StreamGate(Stream=carriage_motor_material_7, Gate=equals_43.Equality)  # -> Target0, Target1
gate_38 = StreamGate(Stream=bridge_main_material_7, Gate=equals_43.Equality)  # -> Target0, Target1
gate_39 = StreamGate(Stream=bridge_motor_material, Gate=equals_43.Equality)  # -> Target0, Target1
gate_40 = StreamGate(Stream=bed_main_material, Gate=equals_43.Equality)  # -> Target0, Target1
item_73 = ListItem(List=gate_33.Target0, Index=0, Wrap=True)
item_74 = ListItem(List=gate_34.Target0, Index=[0, 1], Wrap=True)
wires_11 = BrepWireframe(Brep=[orient_131.Geometry, orient_126.Geometry], Density=-1)
wires_12 = BrepWireframe(Brep=carriage_main_material_7, Density=-1)
wires_13 = BrepWireframe(Brep=carriage_rack_and_rail_material_7, Density=-1)
wires_14 = BrepWireframe(Brep=carriage_motor_material_7, Density=-1)
wires_15 = BrepWireframe(Brep=bridge_main_material_7, Density=-1)
wires_16 = BrepWireframe(Brep=bridge_motor_material, Density=-1)
wires_17 = BrepWireframe(Brep=bed_main_material, Density=-1)
wires_18 = BrepWireframe(Brep=orient_134.Geometry, Density=-1)
mesh_11 = MeshBrep(Brep=gate_35.Target0, Settings=smooth)
mesh_12 = MeshBrep(Brep=gate_36.Target0, Settings=smooth)
mesh_13 = MeshBrep(Brep=gate_37.Target0, Settings=smooth)
mesh_14 = MeshBrep(Brep=gate_38.Target0, Settings=smooth)
mesh_15 = MeshBrep(Brep=[item_73, gate_32.Target0], Settings=smooth)
mesh_16 = MeshBrep(Brep=gate_39.Target0, Settings=smooth)
mesh_17 = MeshBrep(Brep=gate_40.Target0, Settings=smooth)
mesh_18 = MeshBrep(Brep=item_74, Settings=smooth)
crv_5 = Curve(orient_131.Geometry)
crv_6 = Curve(orient_134.Geometry)
move_146 = Move(Geometry=mesh_11, Motion=Y_38)  # -> Geometry, Transform
move_147 = Move(Geometry=wires_12, Motion=Y_38)  # -> Geometry, Transform
move_148 = Move(Geometry=mesh_12, Motion=Y_38)  # -> Geometry, Transform
move_149 = Move(Geometry=wires_13, Motion=Y_38)  # -> Geometry, Transform
move_150 = Move(Geometry=mesh_13, Motion=Y_38)  # -> Geometry, Transform
move_151 = Move(Geometry=wires_14, Motion=Y_38)  # -> Geometry, Transform
move_152 = Move(Geometry=mesh_14, Motion=Y_38)  # -> Geometry, Transform
move_153 = Move(Geometry=wires_15, Motion=Y_38)  # -> Geometry, Transform
move_154 = Move(Geometry=mesh_15, Motion=Y_38)  # -> Geometry, Transform
move_155 = Move(Geometry=mesh_16, Motion=Y_38)  # -> Geometry, Transform
move_156 = Move(Geometry=wires_16, Motion=Y_38)  # -> Geometry, Transform
move_157 = Move(Geometry=[wires_11, crv_5], Motion=Y_38)  # -> Geometry, Transform
move_158 = Move(Geometry=move_146.Geometry, Motion=X_38)  # -> Geometry, Transform
move_159 = Move(Geometry=move_147.Geometry, Motion=X_38)  # -> Geometry, Transform
move_160 = Move(Geometry=move_148.Geometry, Motion=X_38)  # -> Geometry, Transform
move_161 = Move(Geometry=move_149.Geometry, Motion=X_38)  # -> Geometry, Transform
move_162 = Move(Geometry=move_150.Geometry, Motion=X_38)  # -> Geometry, Transform
move_163 = Move(Geometry=move_151.Geometry, Motion=X_38)  # -> Geometry, Transform
carriage_rack_and_rail_material_8 = Geometry(move_160.Geometry)
carriage_rack_and_rail_material_9 = Geometry(move_161.Geometry)
bridge_rack_and_rail_material_5 = Geometry(move_154.Geometry)
bridge_rack_and_rail_material_6 = Geometry(move_157.Geometry)
bed_rack_and_rail_material = Geometry(mesh_18)
bed_rack_and_rail_material_2 = Geometry([wires_18, crv_6])
carriage_motor_material_8 = Geometry(move_162.Geometry)
carriage_motor_material_9 = Geometry(move_163.Geometry)
carriage_main_material_8 = Geometry(move_158.Geometry)
carriage_main_material_9 = Geometry(move_159.Geometry)
bridge_motor_material_2 = Geometry(move_155.Geometry)
bridge_motor_material_3 = Geometry(move_156.Geometry)
bridge_main_material_8 = Geometry(move_152.Geometry)
bridge_main_material_9 = Geometry(move_153.Geometry)
bed_main_material_2 = Geometry(mesh_17)
bed_main_material_3 = Geometry(wires_17)
rack_and_rail_material_6 = Shader(filter_23)
rack_and_rail_material_7 = Shader(filter_23)
rack_and_rail_material_8 = Shader(filter_23)
motor_material_4 = Shader(filter_24)
motor_material_5 = Shader(filter_24)
main_material_6 = Shader(filter_22)
main_material_7 = Shader(filter_22)
main_material_8 = Shader(filter_22)
wire_material_12 = Shader(filter_25)
wire_material_13 = Shader(filter_25)
wire_material_14 = Shader(filter_25)
wire_material_15 = Shader(filter_25)
wire_material_16 = Shader(filter_25)
wire_material_17 = Shader(filter_25)
wire_material_18 = Shader(filter_25)
wire_material_19 = Shader(filter_25)
preview_30 = CustomPreview(Geometry=carriage_main_material_8, Shader=main_material_6)
preview_31 = CustomPreview(Geometry=carriage_main_material_9, Shader=wire_material_12)
preview_32 = CustomPreview(Geometry=carriage_rack_and_rail_material_8, Shader=rack_and_rail_material_6)
preview_33 = CustomPreview(Geometry=carriage_rack_and_rail_material_9, Shader=wire_material_13)
preview_34 = CustomPreview(Geometry=carriage_motor_material_8, Shader=motor_material_4)
preview_35 = CustomPreview(Geometry=carriage_motor_material_9, Shader=wire_material_17)
preview_36 = CustomPreview(Geometry=bridge_main_material_8, Shader=main_material_7)
preview_37 = CustomPreview(Geometry=bridge_main_material_9, Shader=wire_material_14)
preview_38 = CustomPreview(Geometry=bridge_rack_and_rail_material_5, Shader=rack_and_rail_material_7)
preview_39 = CustomPreview(Geometry=bridge_rack_and_rail_material_6, Shader=wire_material_15)
preview_40 = CustomPreview(Geometry=bridge_motor_material_2, Shader=motor_material_5)
preview_41 = CustomPreview(Geometry=bridge_motor_material_3, Shader=wire_material_16)
preview_42 = CustomPreview(Geometry=bed_main_material_2, Shader=main_material_8)
preview_43 = CustomPreview(Geometry=bed_main_material_3, Shader=wire_material_18)
preview_44 = CustomPreview(Geometry=bed_rack_and_rail_material, Shader=rack_and_rail_material_8)
preview_45 = CustomPreview(Geometry=bed_rack_and_rail_material_2, Shader=wire_material_19)

# ----
merge_89 = Merge(
    Data1=carriage_main_material,
    Data2=carriage_rack_and_rail_material,
    Data3=carriage_motor_material,
    Data4=bridge_main_material,
    Data5=orient_112.Geometry,
    Data6=carriage_main_material_7,
    Data7=carriage_rack_and_rail_material_7,
    Data8=carriage_motor_material_7,
    Data9=bridge_main_material_7,
    Data10=orient_131.Geometry,
    Data11=orient_126.Geometry,
    Data12=bridge_motor_material,
    Data13=bed_main_material,
    Data14=orient_134.Geometry)
machine_geometry = Geometry(merge_89)

# ---- group: Right clik and choose "Bake"
complete_machine_3d_geometry = Geometry(machine_geometry)
# I want to make this the manual way,
# give me the geometry:
current_job_2d_curves = Curve(current_2d_geometry)

# ---- group: Toolpath preview
toolpath_preview_curves_2 = Curve(toolpath_preview_curves)
use_inside_cutting = Panel("0")
cut_transition_preview_lines = Curve(shopbot_code_postprocessor.cut_transition_preview_lines_2)
cut_entry_preview_lines = Curve(shopbot_code_postprocessor.cut_entry_preview_lines_2)
cut_exit_preview_lines = Curve(shopbot_code_postprocessor.cut_exit_preview_lines_2)
drill_preview_geometry_2 = Curve()
jog_transitions = ColourSwatch(SwatchColor=RGB(71, 61, 38))
hold_down = ColourSwatch(SwatchColor=RGB(255, 191, 0))
cut_entries = ColourSwatch(SwatchColor=RGB(145, 193, 194))
cut_exits = ColourSwatch(SwatchColor=RGB(61, 88, 89))
preview_46 = CustomPreview(Geometry=cut_transition_preview_lines, Shader=jog_transitions)
preview_47 = CustomPreview(Geometry=cut_entry_preview_lines, Shader=cut_entries)
preview_48 = CustomPreview(Geometry=cut_exit_preview_lines, Shader=cut_exits)
preview_49 = CustomPreview(Geometry=drill_preview_geometry_2, Shader=hold_down)

# ----
filter_204 = StreamFilter(
    Gate=use_inside_cutting,
    Stream0=ColourSwatch(SwatchColor=RGB(181, 253, 255)),
    Stream1=ColourSwatch(SwatchColor=RGB(255, 61, 155)))

# ---- group: Toolpath preview (continued)
preview_50 = CustomPreview(Geometry=toolpath_preview_curves_2, Shader=filter_204)

# ----
len_14 = Length(Curve=cut_transition_preview_lines)
jog_rate = Panel("150")
ma_3 = MassAddition(Input=len_14)  # -> Result, PartialResults
panel_12 = Panel(ma_3.Result)
division_10 = Division(A=panel_12, B=jog_rate)
division_11 = Division(A=division_10, B="60")
estimated_time = Panel(division_11)

len_15 = Length(Curve=toolpath_preview_curves_2)
feed_rate_3 = Panel(feed_rate_2)
ma_4 = MassAddition(Input=len_15)  # -> Result, PartialResults
panel_13 = Panel(ma_4.Result)
division_12 = Division(A=panel_13, B=feed_rate_3)
division_13 = Division(A=division_12, B="60")
estimated_time_2 = Panel(division_13)

len_16 = Length(Curve=[cut_entry_preview_lines, cut_exit_preview_lines])
feed_rate_4 = Panel(feed_rate_2)
ma_5 = MassAddition(Input=len_16)  # -> Result, PartialResults
panel_14 = Panel(ma_5.Result)
division_14 = Division(A=panel_14, B=feed_rate_4)
division_15 = Division(A=division_14, B="60")
estimated_time_3 = Panel(division_15)

ma_6 = MassAddition(Input=[estimated_time_2, estimated_time, estimated_time_3])  # -> Result, PartialResults
estimated_job_minutes = Integer(ma_6.Result)
estimated_time_4 = Panel(estimated_job_minutes)
estimated_time_current_job = Panel(estimated_time_4)

# ==== cluster RollerRackAndPinionMaker: Makes rack and pinion gemetry suitable for 3 axis CNC milling. Has low backlash, but is vulnerable to contamination. More options inside component.
number_of_pinion_teeth = ClusterInput()
milling_bit_diameter = ClusterInput()
motor_shaft_diameter = ClusterInput()
rack_length = ClusterInput()

# ---- group: Smaller amount of teeth gives higher resolution and more torque
number_of_pinion_teeth_2 = Panel("10")
number_of_pinion_teeth_3 = Number(number_of_pinion_teeth)
null = NullItem(Item=number_of_pinion_teeth_3)  # -> NullFlags, InvalidFlags, Description
filter = StreamFilter(Gate=null.NullFlags, Stream0=number_of_pinion_teeth_3, Stream1=number_of_pinion_teeth_2)
number_of_pinion_teeth_4 = Panel(filter)

# ---- group: Determines the tooth sppacing, some margin recommended
milling_bit_diameter_2 = Panel("3.1")
milling_bit_diameter_3 = Number(milling_bit_diameter)
null_2 = NullItem(Item=milling_bit_diameter_3)  # -> NullFlags, InvalidFlags, Description
filter_2 = StreamFilter(Gate=null_2.NullFlags, Stream0=milling_bit_diameter_3, Stream1=milling_bit_diameter_2)
milling_bit_diameter_4 = Panel(filter_2)

# ---- group: Determines the travel distance of pinion
rack_length_2 = Panel("200")
rack_length_3 = Number(rack_length)
# default config for 2mm pinion milling and 3mm rack milling: bit diamter: 3.1
# margin factor: -0.14
# number of pinion teeth: 10
# fillet ratio: 0.15
null_3 = NullItem(Item=rack_length_3)  # -> NullFlags, InvalidFlags, Description
filter_3 = StreamFilter(Gate=null_3.NullFlags, Stream0=rack_length_3, Stream1=rack_length_2)
rack_length_4 = Panel(filter_3)

# ---- group: The shaft diameter of the motor driving the pinion
motor_shaft_diameter_2 = Panel("5")
motor_shaft_diameter_3 = Number(motor_shaft_diameter)
null_4 = NullItem(Item=motor_shaft_diameter_3)  # -> NullFlags, InvalidFlags, Description
filter_4 = StreamFilter(Gate=null_4.NullFlags, Stream0=motor_shaft_diameter_3, Stream1=motor_shaft_diameter_2)
motor_shaft_diameter_4 = Panel(filter_4)

# ----
preview_position_0_1 = ClusterInput()
preview_position = Slider(0.25, range=0..1)

# ---- group: Low fillet ratio gives smoother motion, but makes a less robust pinion
tooth_fillet_ratio = Slider(0.15, range=0..1)
tooth_fillet_ratio_2 = Panel(tooth_fillet_ratio)

# ---- group: Controlls pinion tooth blending
rounding_factor_pinion_outside = Slider(20, range=0..100)
rounding_factor_pinion_inside = Slider(70, range=0..100)

# ---- group: Start numbers to help calculte pinion tooth path through rack
number_of_curve_sample_points = Slider(20, range=0..1000)
sample_tooth_position = Panel("0.26")

# ---- group: Lower number gives more clearene between rack tooth and pinion valley
pinion_corner_tolerance_factor = Panel("15")

# ---- group: Fill in for correct step statistics
number_of_stepper_motor_steps = Panel("200")
microstep_level = Panel("4")

# ----
preview_position_0_1_2 = Number(preview_position_0_1)

# ---- group: Can be used to reduce or increase the pinion tooth spacing
pinion_tooth_spacing_factor = Panel("-0.14")

# ---- group: Prepare properties
multiplication = Multiplication(A=milling_bit_diameter_4, B=pinion_tooth_spacing_factor)
multiplication_2 = Multiplication(A=number_of_pinion_teeth_4, B=sample_tooth_position)
division = Division(A=milling_bit_diameter_4, B=pinion_corner_tolerance_factor)
addition = Addition(A=milling_bit_diameter_4, B=multiplication)
multiplication_3 = Multiplication(A=milling_bit_diameter_4, B="0.5")
multiplication_4 = Multiplication(A=motor_shaft_diameter_4, B="0.5")
round = Round(Number=multiplication_2)  # -> Nearest, Floor, Ceiling
multiplication_5 = Multiplication(A=number_of_pinion_teeth_4, B="2")
neg = Negative(Value=division)
multiplication_6 = Multiplication(A=milling_bit_diameter_4, B=tooth_fillet_ratio_2)
milling_bit_radius = Panel(multiplication_3)
xy = XYPlane(Origin=Point(0, 0, 0))
sample_tooth_number = Panel(round.Ceiling)
multiplication_7 = Multiplication(A=addition, B=multiplication_5)
tooth_fillet_radius = Panel(multiplication_6)
pinion_circumference = Panel(multiplication_7)
cir = Circle(Plane=xy, Radius=milling_bit_radius)
pi = Pi(Factor=1)
division_2 = Division(A=pinion_circumference, B=pi)
number_of_pinion_teeth_5 = Panel(number_of_pinion_teeth_4)
pinion_diameter = Panel(division_2)
sample_tooth_number_2 = Panel(sample_tooth_number)
number_of_curve_sample_points_2 = Panel(number_of_curve_sample_points)
multiplication_8 = Multiplication(A=pinion_diameter, B="0.5")
division_3 = Division(A=sample_tooth_number_2, B=number_of_pinion_teeth_5)
pinion_radius = Panel(multiplication_8)
pinion_circumference_2 = Panel(pinion_circumference)
multiplication_9 = Multiplication(A="360", B=division_3)
Y = UnitY(Factor=pinion_radius)
division_4 = Division(A="360", B=number_of_pinion_teeth_5)
multiplication_10 = Multiplication(A=pinion_circumference_2, B=division_3)
division_5 = Division(A=multiplication_9, B=number_of_curve_sample_points_2)
division_6 = Division(A=pinion_circumference, B=number_of_pinion_teeth_4)
move = Move(Geometry=xy, Motion=Y)  # -> Geometry, Transform
series = Series(Start=0, Step=division_4, Count=number_of_pinion_teeth_5)
division_7 = Division(A=multiplication_10, B=number_of_curve_sample_points_2)
series_2 = Series(Start=0, Step=division_5, Count=number_of_curve_sample_points_2)
tooth_spacing = Panel(division_6)
rad = Radians(Degrees=series)
circle = Circle(cir)
series_3 = Series(Start=0, Step=division_7, Count=number_of_curve_sample_points_2)
neg_2 = Negative(Value=series_2)
rotate = Rotate(Geometry=circle, Angle=rad, Plane=move.Geometry)  # -> Geometry, Transform
rad_2 = Radians(Degrees=neg_2)

# ---- group: Make step resolution statisitics
number_of_stepper_motor_steps_2 = Panel(number_of_stepper_motor_steps)
microstep_level_2 = Panel(microstep_level)
division_8 = Division(A=pinion_circumference, B=number_of_stepper_motor_steps_2)
distance_covered_per_step = Panel(division_8)
division_9 = Division(A=distance_covered_per_step, B=microstep_level_2)
distance_covered_per_micro_step = Panel(division_9)

# ---- group: Step statsistics
distance_covered_per_step_2 = Panel(distance_covered_per_step)
distance_covered_per_micro_step_2 = Panel(distance_covered_per_micro_step)

# ---- group: Create rack tooth geometry
sample_tooth_number_3 = Panel(sample_tooth_number_2)
tooth_spacing_2 = Panel(tooth_spacing)
item = ListItem(List=rotate.Geometry, Index=sample_tooth_number_3, Wrap=True)
rotate_2 = Rotate(Geometry=graft(item), Angle=rad_2, Plane=move.Geometry)  # -> Geometry, Transform
tooth_spacing_3 = Panel(tooth_spacing)
X = UnitX(Factor=series_3)
sample_tooth_number_4 = Panel(sample_tooth_number_3)
milling_it_radius = Panel(multiplication_3)
subtraction = Subtraction(A=sample_tooth_number_3, B="0.5")
move_2 = Move(Geometry=rotate_2.Geometry, Motion=X)  # -> Geometry, Transform
multiplication_11 = Multiplication(A=sample_tooth_number_4, B=tooth_spacing_3)
area = Area(Geometry=move_2.Geometry)  # -> Area, Centroid
pt = ConstructPoint(XCoordinate=multiplication_11, YCoordinate=0, ZCoordinate=0)
multiplication_12 = Multiplication(A=subtraction, B=tooth_spacing_2)
multiplication_13 = Multiplication(A=sample_tooth_number_3, B=tooth_spacing_2)
deplane = DeconstructPlane(Plane=xy)  # -> Origin, XAxis, YAxis, ZAxis
merge = Merge(Data1=flatten(area.Centroid), Data2=flatten(pt))
amp = Amplitude(Vector=deplane.YAxis, Amplitude=milling_it_radius)
amp_2 = Amplitude(Vector=deplane.XAxis, Amplitude=multiplication_12)
amp_3 = Amplitude(Vector=deplane.XAxis, Amplitude=multiplication_13)
intcrv = Interpolate(Vertices=merge, Degree=3, Periodic=False, KnotStyle=1)  # -> Curve, Length, Domain
rev = Reverse(Vector=amp)
move_3 = Move(Geometry=deplane.Origin, Motion=amp_2)  # -> Geometry, Transform
move_4 = Move(Geometry=deplane.Origin, Motion=amp_3)  # -> Geometry, Transform
move_5 = Move(Geometry=move_3.Geometry, Motion=rev)  # -> Geometry, Transform
yz = YZPlane(Origin=move_5.Geometry)
crv = Curve(intcrv.Curve)
mirror = Mirror(Geometry=crv, Plane=yz)  # -> Geometry, Transform
ccx = CurveCurve(CurveA=crv, CurveB=mirror.Geometry)  # -> Points, ParamsA, ParamsB
shatter = Shatter(Curve=crv, Parameters=ccx.ParamsA)
rev_2 = ReverseList(List=shatter)
milling_it_radius_2 = Panel(milling_it_radius)
tooth_fillet_radius_2 = Panel(tooth_fillet_radius)
item_2 = ListItem(List=rev_2, Index=0, Wrap=True)
mirror_2 = Mirror(Geometry=item_2, Plane=yz)  # -> Geometry, Transform
pt_2 = Point(move_4.Geometry)
pt_3 = Point(deplane.Origin)
addition_2 = Addition(A=tooth_fillet_radius_2, B=milling_it_radius_2)
join = JoinCurves(Curves=[item_2, mirror_2.Geometry], Preserve=False)
vec2pt = Vector2Pt(PointA=pt_2, PointB=pt_3, Unitize=False)  # -> Vector, Length
fillet = Fillet(Curve=join, Radius=addition_2)
move_6 = Move(Geometry=fillet, Motion=vec2pt.Vector)  # -> Geometry, Transform

# ---- group: Offset tooth profile to prepare for copying
tooth_spacing_4 = Panel(tooth_spacing)
milling_it_radius_3 = Panel(milling_it_radius)
tooth_profile_for_offset = Curve(move_6.Geometry)
xy_2 = XYPlane(Origin=Point(0, 0, 0))
neg_3 = Negative(Value=tooth_spacing_4)
X_2 = UnitX(Factor=tooth_spacing_4)
X_3 = UnitX(Factor=neg_3)
move_7 = Move(Geometry=tooth_profile_for_offset, Motion=X_2)  # -> Geometry, Transform
move_8 = Move(Geometry=tooth_profile_for_offset, Motion=X_3)  # -> Geometry, Transform
end = EndPoints(Curve=tooth_profile_for_offset)  # -> Start, End
join_2 = JoinCurves(Curves=flatten([move_8.Geometry, tooth_profile_for_offset, move_7.Geometry]), Preserve=False)
yz_2 = YZPlane(Origin=[end.Start, end.End])
offset = Offset(Curve=join_2, Distance=milling_it_radius_3, Plane=xy_2, Corners=2)
pcx = CurvePlane(Curve=offset, Plane=yz_2)  # -> Points, ParamsC, ParamsP
shatter_2 = Shatter(Curve=offset, Parameters=flatten(pcx.ParamsC))
item_3 = ListItem(List=shatter_2, Index="1", Wrap=True)
offset_tooth_for_copy_and_join = Curve(item_3)

# ---- group: Create rack by copying and offsetting rack tooth
tooth_spacing_5 = Panel(tooth_spacing)
rack_length_5 = Panel(rack_length_4)
milling_bit_radius_2 = Panel(multiplication_3)
tooth_profile_for_copy_and_join = Curve(offset_tooth_for_copy_and_join)
pinion_radius_2 = Panel(pinion_radius)
addition_3 = Addition(A=pinion_radius_2, B=milling_bit_radius_2)
multiplication_14 = Multiplication(A=addition_3, B="2")
addition_4 = Addition(A=rack_length_5, B=multiplication_14)
division_10 = Division(A=addition_3, B=tooth_spacing_5)
actual_rack_length = Panel(addition_4)
round_2 = Round(Number=division_10)  # -> Nearest, Floor, Ceiling
multiplication_15 = Multiplication(A=round_2.Ceiling, B=tooth_spacing_5)
division_11 = Division(A=actual_rack_length, B=tooth_spacing_5)
neg_4 = Negative(Value=addition_3)
neg_5 = Negative(Value=multiplication_15)
round_3 = Round(Number=division_11)  # -> Nearest, Floor, Ceiling
rack_start_distance = Panel(neg_5)
rack_cut_start_distance = Panel(neg_4)
addition_5 = Addition(A=round_3.Ceiling, B="1")
series_4 = Series(Start=0, Step=tooth_spacing_5, Count=addition_5)
X_4 = UnitX(Factor=rack_start_distance)
move_9 = Move(Geometry=tooth_profile_for_copy_and_join, Motion=X_4)  # -> Geometry, Transform
X_5 = UnitX(Factor=series_4)
move_10 = Move(Geometry=move_9.Geometry, Motion=X_5)  # -> Geometry, Transform
pinion_radius_3 = Panel(pinion_radius)
join_3 = JoinCurves(Curves=move_10.Geometry, Preserve=False)
neg_6 = Negative(Value=pinion_radius_3)
Y_2 = UnitY(Factor=neg_6)
move_11 = Move(Geometry=join_3, Motion=Y_2)  # -> Geometry, Transform
rack_teeth = Curve(move_11.Geometry)

# ---- group: Trim rack to specified length
rack_cut_start_distance_2 = Panel(rack_cut_start_distance)
actual_rack_length_2 = Panel(actual_rack_length)
pinion_diameter_2 = Panel(pinion_diameter)
rack_teeth_2 = Curve(rack_teeth)
pt_4 = ConstructPoint(XCoordinate=rack_cut_start_distance_2, YCoordinate=0, ZCoordinate=0)
xy_3 = XYPlane(Origin=pt_4)
neg_7 = Negative(Value=pinion_diameter_2)
rectangle = Rectangle(Plane=xy_3, XSize=actual_rack_length_2, YSize=neg_7, Radius=0)  # -> Rectangle, Length
trim = TrimWithRegion(Curve=rack_teeth_2, Region=rectangle.Rectangle)  # -> Inside, Outside
bbox = BoundingBox(Content=trim.Inside, Plane=PlaneXY(0, 0, 0))  # -> Box, Box_2
edges = BrepEdges(Brep=bbox.Box)  # -> Naked, Interior, NonManifold
item_4 = ListItem(List=edges.Naked, Index="2", Wrap=True)
flip = FlipCurve(Curve=item_4)  # -> Curve, Flag
rack_tooth_edge = Curve(flip.Curve)
trimmed_rack_teeth = Curve(trim.Inside)

# ----
distance_covered_per_step_3 = Panel(distance_covered_per_step)
distance_covered_per_step_4 = Number(distance_covered_per_step_3)
rack_teeth_3 = Curve(trimmed_rack_teeth)
rack_edge = Curve(rack_tooth_edge)
rack_teeth_4 = ClusterOutput(rack_teeth_3)
rack_edge_2 = ClusterOutput(rack_edge)
distance_covered_per_step_5 = ClusterOutput(distance_covered_per_step_4)

# ---- group: Create and blend pinion teeth
eval = EvaluateLength(Curve=fillet, Length="0.5", Normalized=True)  # -> Point, Tangent, Parameter
pdecon = Deconstruct(Point=eval.Point)  # -> XComponent, YComponent, ZComponent
milling_it_radius_4 = Panel(milling_bit_radius)
pinion_corner_tolerance = Panel(neg)
subtraction_2 = Subtraction(A=pdecon.YComponent, B=milling_it_radius_4)
subtraction_3 = Subtraction(A=subtraction_2, B=milling_it_radius_4)
subtraction_4 = Subtraction(A=subtraction_3, B=pinion_corner_tolerance)
pt_5 = ConstructPoint(XCoordinate=0, YCoordinate=subtraction_4, ZCoordinate=0)
rounding_factor_pinion_outside_2 = Panel(rounding_factor_pinion_outside)
xy_4 = XYPlane(Origin=pt_5)
division_12 = Division(A="360", B=multiplication_5)
rounding_factor_pinion_inside_2 = Panel(rounding_factor_pinion_inside)
subtraction_5 = Subtraction(A="0", B=rounding_factor_pinion_outside_2)
addition_6 = Addition(A="180", B=rounding_factor_pinion_outside_2)
rad_3 = Radians(Degrees=addition_6)
rad_4 = Radians(Degrees=subtraction_5)
subtraction_6 = Subtraction(A="180", B=rounding_factor_pinion_inside_2)
addition_7 = Addition(A="0", B=rounding_factor_pinion_inside_2)
milling_it_radius_5 = Panel(milling_it_radius_4)
dom = ConstructDomain(DomainStart=rad_4, DomainEnd=rad_3)
xy_5 = XYPlane(Origin=Point(0, 0, 0))
rad_5 = Radians(Degrees=subtraction_6)
rad_6 = Radians(Degrees=addition_7)
dom_2 = ConstructDomain(DomainStart=rad_6, DomainEnd=rad_5)
pi_2 = Pi(Factor=1)
arc = Arc(Plane=xy_5, Radius=milling_it_radius_5, Angle=dom)  # -> Arc, Length
arc_2 = Arc(Plane=xy_4, Radius=milling_it_radius_5, Angle=dom_2)  # -> Arc, Length
rad_7 = Radians(Degrees=division_12)
rotate_3 = Rotate(Geometry=arc.Arc, Angle=pi_2, Plane=xy_5)  # -> Geometry, Transform
addition_8 = Addition(A=rad, B=rad_7)
number_slider = Slider(0.5, range=0..1)
rotate_4 = Rotate(Geometry=rotate_3.Geometry, Angle=rad, Plane=move.Geometry)  # -> Geometry, Transform
rotate_5 = Rotate(Geometry=arc_2.Arc, Angle=addition_8, Plane=move.Geometry)  # -> Geometry, Transform
flip_2 = FlipCurve(Curve=rotate_4.Geometry)  # -> Curve, Flag
flip_3 = FlipCurve(Curve=rotate_5.Geometry)  # -> Curve, Flag
pinion_radius_4 = Panel(pinion_radius)
shift = ShiftList(List=flip_2.Curve, Shift=1, Wrap=True)
blendc = BlendCurve(CurveA=rotate_4.Geometry, CurveB=flip_3.Curve, BulgeA=number_slider, BulgeB=number_slider, Continuity=2)
blendc_2 = BlendCurve(CurveA=shift, CurveB=rotate_5.Geometry, BulgeA=number_slider, BulgeB=number_slider, Continuity=2)
neg_8 = Negative(Value=pinion_radius_4)
Y_3 = UnitY(Factor=neg_8)
cir_2 = Circle(Plane=move.Geometry, Radius=multiplication_4)
join_4 = JoinCurves(Curves=flatten([rotate_4.Geometry, rotate_5.Geometry, blendc, blendc_2]), Preserve=False)
move_12 = Move(Geometry=join_4, Motion=Y_3)  # -> Geometry, Transform
pinion_teeth = Curve(move_12.Geometry)

# ----
move_13 = Move(Geometry=cir_2, Motion=Y_3)  # -> Geometry, Transform

# ---- group: Create and blend pinion teeth (continued)
pinion_center_hole = Curve(move_13.Geometry)

# ---- group: Create pinion movement preview
preview_position_0_1_3 = Number(preview_position_0_1_2)
pinion_radius_5 = Panel(pinion_radius)
pinion_circumference_3 = Panel(pinion_circumference)
multiplication_16 = Multiplication(A="360", B=preview_position_0_1_3)
multiplication_17 = Multiplication(A=pinion_circumference_3, B=preview_position_0_1_3)
neg_9 = Negative(Value=multiplication_16)
X_6 = UnitX(Factor=multiplication_17)
rad_8 = Radians(Degrees=neg_9)
rotate_6 = Rotate(Geometry=flatten([join_4, cir_2]), Angle=rad_8, Plane=move.Geometry)  # -> Geometry, Transform
move_14 = Move(Geometry=rotate_6.Geometry, Motion=X_6)  # -> Geometry, Transform
neg_10 = Negative(Value=pinion_radius_5)
Y_4 = UnitY(Factor=neg_10)
move_15 = Move(Geometry=move_14.Geometry, Motion=Y_4)  # -> Geometry, Transform
pinion_movement_preview = Curve(move_15.Geometry)

# ---- group: Make pinion bit statisitics
pinion_radius_6 = Panel(pinion_radius)
rotate_7 = Rotate(Geometry=move.Geometry, Angle=4.71238898, Plane=move.Geometry)  # -> Geometry, Transform
pinion_teeth_2 = Curve(join_4)
cir_3 = Circle(Plane=rotate_7.Geometry, Radius=pinion_radius_6)
trim_2 = TrimWithRegion(Curve=cir_3, Region=pinion_teeth_2)  # -> Inside, Outside
item_5 = ListItem(List=trim_2.Outside, Index=0, Wrap=True)
len = Length(Curve=flatten(item_5))
maxium_pinion_milling_bit_diamter = Panel(len)

# ----
maxium_pinion_milling_bit_diamter_2 = Panel(maxium_pinion_milling_bit_diamter)
maxium_pinion_milling_bit_diamter_3 = Number(maxium_pinion_milling_bit_diamter_2)
pinion_movement_preview_2 = Curve(pinion_movement_preview)
pinion_center_hole_2 = Curve(pinion_center_hole)
pinion_teeth_3 = Curve(pinion_teeth)
pinion_teeth_4 = ClusterOutput(pinion_teeth_3)
pinion_center_hole_3 = ClusterOutput(pinion_center_hole_2)
pinion_movement_preview_3 = ClusterOutput(pinion_movement_preview_2)
maxium_pinion_milling_bit_diamter_4 = ClusterOutput(maxium_pinion_milling_bit_diamter_3)

pinion_radius_7 = Panel(pinion_radius)
milling_bit_radius_3 = Panel(multiplication_3)
addition_9 = Addition(A=pinion_radius_7, B=milling_bit_radius_3)
cir_4 = Circle(Plane=move.Geometry, Radius=addition_9)

move_16 = Move(Geometry=cir_4, Motion=Y_3)  # -> Geometry, Transform

pinion_edge = Curve(move_16.Geometry)

pinion_edge_2 = Curve(pinion_edge)
pinion_edge_3 = ClusterOutput(pinion_edge_2)

# ==== cluster DivideCurveEvenLenght: Calculates approximate curve length for even division
crv = ClusterInput()
crv_2 = Curve(crv)
B = ClusterInput()
len = Length(Curve=crv_2)
division = Division(A=len, B=B)
round = Round(Number=division)  # -> Nearest, Floor, Ceiling
divide = DivideCurve(Curve=crv_2, Count=round.Ceiling, Kinks=False)  # -> Points, Tangents, Parameters
P = ClusterOutput(divide.Points)

# ==== cluster DogboneMaker
corner_angle_threshold = ClusterInput()
milling_bit_diameter = ClusterInput()
flip_cornes_boolean = ClusterInput()
curves_to_dogbone = ClusterInput()
flip_cornes_boolean_2 = Integer(flip_cornes_boolean)
radius_margin = Panel("0.1")

milling_bit_diameter_2 = Number(milling_bit_diameter)
multiplication = Multiplication(A=milling_bit_diameter_2, B="0.5")
addition = Addition(A=multiplication, B=radius_margin)
dogbone_radius = Panel(addition)

corner_angle_threshold_2 = Number(corner_angle_threshold)
dom = ConstructDomain(DomainStart="1", DomainEnd="179")
constrain = Constrain(Number=corner_angle_threshold_2, Domain=dom)
subtraction = Subtraction(A="360", B=constrain)
division = Division(A=subtraction, B="360")
dogbone_minium_angle = Panel(division)

curves_to_dogbone_2 = Curve(curves_to_dogbone)
flatten = FlattenTree(Tree=curves_to_dogbone_2, Path="{0}")

# ---- group: Merge overlapping curves //removed to alow neighbouring pockets
mcx = MultipleCurves(Curves=flatten)  # -> Points, IndexA, IndexB, ParamA, ParamB; disabled
dcon = DeleteConsecutive(Set=[mcx.IndexA, mcx.IndexB], Wrap=False)  # -> Set, Count
item = ListItem(List=flatten, Index=dcon.Set, Wrap=True)
cull_i = CullIndex(List=flatten, Indices=dcon.Set, Wrap=True)
runion = RegionUnion(Curves=item)
merged_overlapping_curves = Curve([runion, cull_i])

# ---- group: Detect curves inside curves
aligned_curves = Curve(flatten)
graft = GraftTree(Tree=aligned_curves, IncludeEmptyLists=True, IncludeNullItems=True)
end = EndPoints(Curve=aligned_curves)  # -> Start, End
incurve = PointInCurve(Point=end.Start, Curve=graft)  # -> Relationship, Point
multiplication_2 = Multiplication(A=incurve.Relationship, B="0.5")
round = Round(Number=multiplication_2)  # -> Nearest, Floor, Ceiling
int = Integer(round.Floor)
flip = FlipMatrix(Data=int)
ma = MassAddition(Input=flip)  # -> Result, PartialResults
pshift = ShiftPaths(Data=ma.Result, Offset=-1)
dispatch = Dispatch(List=aligned_curves, DispatchPattern=pshift)  # -> ListA, ListB
curves_outside = Curve(dispatch.ListB)
curves_inside = Curve(dispatch.ListA)

# ----
xy = XYPlane(Origin=Point(0, 0, 0))
cir = Circle(Plane=xy, Radius="0.01")
dogbone_minium_angle_2 = Panel(dogbone_minium_angle)
len = Length(Curve=cir)
multiplication_3 = Multiplication(A=len, B=dogbone_minium_angle_2)

xy_2 = XYPlane(Origin=Point(0, 0, 0))
cir_2 = Circle(Plane=xy_2, Radius="0.01")
dogbone_minium_angle_3 = Panel(dogbone_minium_angle)
len_2 = Length(Curve=cir_2)
multiplication_4 = Multiplication(A=len_2, B=dogbone_minium_angle_3)

flip_cornes_boolean_3 = Panel(flip_cornes_boolean_2)
flip_cornes_boolean_4 = Panel(flip_cornes_boolean_2)
curves_to_dogbone_3 = Curve(flatten)
lng = ListLength(List=curves_to_dogbone_3)

curves_for_dogbone = Curve(curves_inside)
cp = ControlPoints(Curve=curves_for_dogbone)  # -> Points, Weights, Knots

disc = Discontinuity(Curve=curves_for_dogbone, Level=1)  # -> Points, Parameters

curves_for_dogbone_2 = Curve(curves_outside)
cp_2 = ControlPoints(Curve=curves_for_dogbone_2)  # -> Points, Weights, Knots

disc_2 = Discontinuity(Curve=curves_for_dogbone_2, Level=1)  # -> Points, Parameters

xy_3 = XYPlane(Origin=disc.Points)
cir_3 = Circle(Plane=xy_3, Radius="0.01")
trim = TrimWithRegion(Curve=cir_3, Region=graft(curves_for_dogbone), Plane=xy_3)  # -> Inside, Outside

filter = StreamFilter(Gate=flip_cornes_boolean_4, Stream0=trim.Outside, Stream1=trim.Inside)

pshift_2 = ShiftPaths(Data=filter, Offset=-1)
len_3 = Length(Curve=pshift_2)

xy_4 = XYPlane(Origin=disc_2.Points)
cir_4 = Circle(Plane=xy_4, Radius="0.01")
trim_2 = TrimWithRegion(Curve=cir_4, Region=graft(curves_for_dogbone_2), Plane=xy_4)  # -> Inside, Outside

filter_2 = StreamFilter(Gate=flip_cornes_boolean_3, Stream0=trim_2.Inside, Stream1=trim_2.Outside)

pshift_3 = ShiftPaths(Data=filter_2, Offset=-1)
len_4 = Length(Curve=pshift_3)

larger = LargerThan(FirstNumber=len_3, SecondNumber=multiplication_3)  # -> LargerThan, OrEqualTo
dogbone_radius_2 = Panel(dogbone_radius)
dispatch_2 = Dispatch(List=disc.Points, DispatchPattern=larger.LargerThan)  # -> ListA, ListB
dispatch_3 = Dispatch(List=pshift_2, DispatchPattern=larger.LargerThan)  # -> ListA, ListB
eval = EvaluateLength(Curve=dispatch_3.ListA, Length="0.5", Normalized=True)  # -> Point, Tangent, Parameter
pt = Point(dispatch_2.ListA)
pln = Plane(dispatch_2.ListA)
pt_2 = Point(eval.Point)
vec2pt = Vector2Pt(PointA=pt_2, PointB=pt, Unitize=False)  # -> Vector, Length

amp = Amplitude(Vector=vec2pt.Vector, Amplitude=dogbone_radius_2)

move = Move(Geometry=pln, Motion=amp)  # -> Geometry, Transform
cir_5 = Circle(Plane=move.Geometry, Radius=dogbone_radius_2)

lng_2 = ListLength(List=cir_5)
larger_2 = LargerThan(FirstNumber=lng_2, SecondNumber="0.01")  # -> LargerThan, OrEqualTo
pshift_4 = ShiftPaths(Data=larger_2.LargerThan, Offset=-1)
ma_2 = MassAddition(Input=pshift_4)  # -> Result, PartialResults
dispatch_4 = Dispatch(List=curves_for_dogbone, DispatchPattern=pshift_4)  # -> ListA, ListB
crv = Curve(dispatch_4.ListB)
smaller = SmallerThan(FirstNumber=ma_2.Result, SecondNumber="0.5")  # -> SmallerThan, OrEqualTo
clean = CleanTree(RemoveNulls=True, RemoveInvalid=True, RemoveEmpty=False, Tree=crv)

crv_2 = Curve(curves_for_dogbone)
graft_2 = GraftTree(Tree=crv_2, IncludeEmptyLists=True, IncludeNullItems=True)
runion_2 = RegionUnion(Curves=[cir_5, graft_2])
pshift_5 = ShiftPaths(Data=runion_2, Offset=-1)
pshift_6 = ShiftPaths(Data=pshift_5, Offset=-1)

filter_3 = StreamFilter(Gate=smaller.SmallerThan, Stream0=pshift_6)
merge = Merge(Data1=filter_3, Data2=clean)
dogboned_inside_curves = Curve(merge)

larger_3 = LargerThan(FirstNumber=len_4, SecondNumber=multiplication_4)  # -> LargerThan, OrEqualTo
dogbone_radius_3 = Panel(dogbone_radius)
dispatch_5 = Dispatch(List=disc_2.Points, DispatchPattern=larger_3.LargerThan)  # -> ListA, ListB
dispatch_6 = Dispatch(List=pshift_3, DispatchPattern=larger_3.LargerThan)  # -> ListA, ListB
eval_2 = EvaluateLength(Curve=dispatch_6.ListA, Length="0.5", Normalized=True)  # -> Point, Tangent, Parameter
pln_2 = Plane(dispatch_5.ListA)
pt_3 = Point(dispatch_5.ListA)
pt_4 = Point(eval_2.Point)
vec2pt_2 = Vector2Pt(PointA=pt_4, PointB=pt_3, Unitize=False)  # -> Vector, Length

amp_2 = Amplitude(Vector=vec2pt_2.Vector, Amplitude=dogbone_radius_3)

move_2 = Move(Geometry=pln_2, Motion=amp_2)  # -> Geometry, Transform
cir_6 = Circle(Plane=move_2.Geometry, Radius=dogbone_radius_3)

crv_3 = Curve(curves_for_dogbone_2)
flip_cornes_boolean_5 = Panel(flip_cornes_boolean_2)
graft_3 = GraftTree(Tree=crv_3, IncludeEmptyLists=True, IncludeNullItems=True)
gate = StreamGate(Stream=[graft_3, cir_6], Gate=flip_cornes_boolean_5)  # -> Target0, Target1
gate_2 = StreamGate(Stream=graft_3, Gate=flip_cornes_boolean_5)  # -> Target0, Target1
gate_3 = StreamGate(Stream=cir_6, Gate=flip_cornes_boolean_5)  # -> Target0, Target1
runion_3 = RegionUnion(Curves=gate.Target1)
rdiff = RegionDifference(CurvesA=gate_2.Target0, CurvesB=gate_3.Target0)
filter_4 = StreamFilter(Gate=flip_cornes_boolean_5, Stream0=rdiff, Stream1=runion_3)
pshift_7 = ShiftPaths(Data=filter_4, Offset=-1)
pshift_8 = ShiftPaths(Data=pshift_7, Offset=-1)

lng_3 = ListLength(List=cir_6)
larger_4 = LargerThan(FirstNumber=lng_3, SecondNumber="0.01")  # -> LargerThan, OrEqualTo
pshift_9 = ShiftPaths(Data=larger_4.LargerThan, Offset=-1)
ma_3 = MassAddition(Input=pshift_9)  # -> Result, PartialResults
dispatch_7 = Dispatch(List=curves_for_dogbone_2, DispatchPattern=pshift_9)  # -> ListA, ListB
crv_4 = Curve(dispatch_7.ListB)
smaller_2 = SmallerThan(FirstNumber=ma_3.Result, SecondNumber="0.5")  # -> SmallerThan, OrEqualTo
clean_2 = CleanTree(RemoveNulls=True, RemoveInvalid=True, RemoveEmpty=False, Tree=crv_4)

filter_5 = StreamFilter(Gate=smaller_2.SmallerThan, Stream0=pshift_8)
merge_2 = Merge(Data1=filter_5, Data2=clean_2)
dogboned_outside_curves = Curve(merge_2)
merge_3 = Merge(Data1=dogboned_inside_curves, Data2=dogboned_outside_curves)
flatten_2 = FlattenTree(Tree=merge_3, Path="{0}")
end_2 = EndPoints(Curve=flatten_2)  # -> Start, End
dup = DuplicateData(Data=graft(flatten_2), Number=lng, Order=True)
flip_2 = FlipMatrix(Data=dup)
crv_cp = CurveClosestPoint(Point=end_2.Start, Curve=graft(curves_to_dogbone_3))  # -> Point, Parameter, Distance
pshift_10 = ShiftPaths(Data=flip_2, Offset=-1)
sort = SortList(Keys=crv_cp.Distance, ValuesA=pshift_10)  # -> Keys, ValuesA
item_2 = ListItem(List=sort.ValuesA, Index=0, Wrap=True)
flatten_3 = FlattenTree(Tree=item_2, Path="{0}")
dogboned_curves = Curve(flatten_3)
dogboned_curves_2 = ClusterOutput(dogboned_curves)

# ==== cluster Drill
I = ClusterInput()
I_2 = ClusterInput()
default_tool_diameter = Panel("6")
default_drill_depth = Panel("10")
null = NullItem(Item=I_2)  # -> NullFlags, InvalidFlags, Description
null_2 = NullItem(Item=I)  # -> NullFlags, InvalidFlags, Description
drill_curves = ClusterInput()
filter = StreamFilter(Gate=null.NullFlags, Stream0=I_2, Stream1=default_tool_diameter)
filter_2 = StreamFilter(Gate=null_2.NullFlags, Stream0=I, Stream1=default_drill_depth)

# ---- group: Creat hold down drill lines
drill_curves_2 = Curve(drill_curves)
drill_depth = Number(filter_2)
area = Area(Geometry=drill_curves_2)  # -> Area, Centroid
drill_depth_2 = Panel(drill_depth)
pdecon = Deconstruct(Point=area.Centroid)  # -> XComponent, YComponent, ZComponent
pt = ConstructPoint(XCoordinate=pdecon.XComponent, YCoordinate=pdecon.YComponent, ZCoordinate=0)
neg = Negative(Value=drill_depth_2)
Z = UnitZ(Factor=neg)
move = Move(Geometry=pt, Motion=Z)  # -> Geometry, Transform
ln = Line(StartPoint=pt, EndPoint=move.Geometry)

# ----
tool_diameter_for_preview = Number(filter)

# ---- group: Create hold down preview circles
drill_toolpaths = Curve(ln)
tool_diameter = Panel(tool_diameter_for_preview)
end = EndPoints(Curve=drill_toolpaths)  # -> Start, End
multiplication = Multiplication(A=tool_diameter, B="0.5")
pt_2 = Point(end.Start)
neg_2 = Negative(Value=multiplication)
neg_3 = Negative(Value=multiplication)
X = UnitX(Factor=multiplication)
X_2 = UnitX(Factor=neg_3)
Y = UnitY(Factor=neg_2)
Y_2 = UnitY(Factor=multiplication)
move_2 = Move(Geometry=pt_2, Motion=Y)  # -> Geometry, Transform
xy = XYPlane(Origin=pt_2)
move_3 = Move(Geometry=pt_2, Motion=X_2)  # -> Geometry, Transform
move_4 = Move(Geometry=pt_2, Motion=Y_2)  # -> Geometry, Transform
move_5 = Move(Geometry=pt_2, Motion=X)  # -> Geometry, Transform
cir = Circle(Plane=xy, Radius=multiplication)
ln_2 = Line(StartPoint=move_4.Geometry, EndPoint=move_2.Geometry)
ln_3 = Line(StartPoint=move_5.Geometry, EndPoint=move_3.Geometry)
drill_preview_geometry = Curve([ln_3, ln_2, cir])

# ----
drill_preview_geometry_2 = Curve(drill_preview_geometry)
drill_toolpaths_2 = Curve(ln)
drill_preview_geometry_3 = ClusterOutput(drill_preview_geometry_2)
drill_toolpaths_3 = ClusterOutput(drill_toolpaths_2)

# ==== cluster PreviewGraphicFor11ProjectionOnMachine
measured_projected_size = ClusterInput()
expected_projected_size = ClusterInput()
position_correction_x = ClusterInput()
position_correction_y = ClusterInput()
drill_preview_curves = ClusterInput()
rotation_correction = ClusterInput()
toolpath_curves = ClusterInput()
cutting_curves = ClusterInput()
svg_px_heigth = ClusterInput()
pocket_curves = ClusterInput()
svg_px_width = ClusterInput()
toolpath_curves_2 = Curve(flatten(toolpath_curves))
cutting_curves_2 = Curve(cutting_curves)
drill_preview_curves_2 = Curve(drill_preview_curves)
measured_projected_size_2 = Number(measured_projected_size)
position_correction_x_2 = Number(position_correction_x)
position_correction_y_2 = Number(position_correction_y)
svg_px_width_2 = Number(svg_px_width)
pocket_curves_2 = Curve(pocket_curves)
expected_projected_size_2 = Number(expected_projected_size)
rotation_correction_2 = Number(rotation_correction)
svg_px_heigth_2 = Number(svg_px_heigth)
background_color = ColourSwatch(SwatchColor=RGB(0, 0, 0))
explode = Explode(Curve=toolpath_curves_2, Recursive=True)  # -> Segments, Vertices
pt = ConstructPoint(XCoordinate=position_correction_x_2, YCoordinate=position_correction_y_2, ZCoordinate=0)
division = Division(A=expected_projected_size_2, B=measured_projected_size_2)
pt_2 = ConstructPoint(XCoordinate="0", YCoordinate="0", ZCoordinate=0)
vec2pt = Vector2Pt(PointA=pt_2, PointB=pt, Unitize=False)  # -> Vector, Length
xy = XYPlane(Origin=pt_2)
pocket_curves_3 = Curve(flatten(pocket_curves_2))
x_y_and_z_axis_indicators = Curve([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])
cutting_curves_3 = Curve(flatten(cutting_curves_2))
toolpath_curves_3 = Curve(flatten(explode.Segments))
drill_preview_curves_3 = Curve(drill_preview_curves_2)
scale = Scale(Geometry=flatten(x_y_and_z_axis_indicators), Center=pt_2, Factor=division)  # -> Geometry, Transform
scale_2 = Scale(Geometry=cutting_curves_3, Center=pt_2, Factor=division)  # -> Geometry, Transform
scale_3 = Scale(Geometry=pocket_curves_3, Center=pt_2, Factor=division)  # -> Geometry, Transform
scale_4 = Scale(Geometry=drill_preview_curves_3, Center=pt_2, Factor=division)  # -> Geometry, Transform
move = Move(Geometry=scale_3.Geometry, Motion=vec2pt.Vector)  # -> Geometry, Transform
move_2 = Move(Geometry=scale_2.Geometry, Motion=vec2pt.Vector)  # -> Geometry, Transform
scale_5 = Scale(Geometry=toolpath_curves_3, Center=pt_2, Factor=division)  # -> Geometry, Transform
move_3 = Move(Geometry=scale.Geometry, Motion=vec2pt.Vector)  # -> Geometry, Transform
move_4 = Move(Geometry=scale_4.Geometry, Motion=vec2pt.Vector)  # -> Geometry, Transform
move_5 = Move(Geometry=scale_5.Geometry, Motion=vec2pt.Vector)  # -> Geometry, Transform
rotate = Rotate(Geometry=move_2.Geometry, Angle=rotation_correction_2, Plane=xy)  # -> Geometry, Transform
rotate_2 = Rotate(Geometry=move.Geometry, Angle=rotation_correction_2, Plane=xy)  # -> Geometry, Transform
rotate_3 = Rotate(Geometry=move_4.Geometry, Angle=rotation_correction_2, Plane=xy)  # -> Geometry, Transform
rotate_4 = Rotate(Geometry=move_3.Geometry, Angle=rotation_correction_2, Plane=xy)  # -> Geometry, Transform
rotate_5 = Rotate(Geometry=move_5.Geometry, Angle=rotation_correction_2, Plane=xy)  # -> Geometry, Transform
topoly = CurveToPolyline(Curve=rotate_3.Geometry, ToleranceDistance=Slider(0.25, range=0..1), ToleranceAngle=0)  # -> Polyline, Segments
topoly_2 = CurveToPolyline(Curve=rotate_2.Geometry, ToleranceDistance=Slider(0.25, range=0..1), ToleranceAngle=0)  # -> Polyline, Segments
topoly_3 = CurveToPolyline(Curve=rotate.Geometry, ToleranceDistance=Slider(0.25, range=0..1), ToleranceAngle=0)  # -> Polyline, Segments
topoly_4 = CurveToPolyline(Curve=rotate_4.Geometry, ToleranceDistance=Slider(0.25, range=0..1), ToleranceAngle=0)  # -> Polyline, Segments
topoly_5 = CurveToPolyline(Curve=rotate_5.Geometry, ToleranceDistance=Slider(0.25, range=0..1), ToleranceAngle=0)  # -> Polyline, Segments
explode_2 = Explode(Curve=topoly_4.Polyline, Recursive=True)  # -> Segments, Vertices
crv = Curve(topoly.Polyline)
int = Integer(svg_px_heigth_2)
int_2 = Integer(svg_px_heigth_2)
crv_2 = Curve(topoly_2.Polyline)
crv_3 = Curve(flatten(explode_2.Segments))
int_3 = Integer(svg_px_heigth_2)
crv_4 = Curve(topoly_3.Polyline)
int_4 = Integer(svg_px_heigth_2)
crv_5 = Curve(topoly_5.Polyline)
int_5 = Integer(svg_px_heigth_2)
cluster = Cluster_2(
    background_height=int,
    polyline=crv,
    stroke_color=ColourSwatch(SwatchColor=RGB(255, 191, 0)),
    stroke_width=Slider(0.8, range=0..5))
cluster_2 = Cluster_2(
    background_height=int_2,
    polyline=crv_2,
    stroke_color=ColourSwatch(SwatchColor=RGB(251, 0, 255)),
    stroke_width=Slider(0.8, range=0..5))
cluster_3 = Cluster_2(
    background_height=int_3,
    polyline=crv_4,
    stroke_color=ColourSwatch(SwatchColor=RGB(0, 140, 255)),
    stroke_width=Slider(0.8, range=0..5))
cluster_4 = Cluster_2(
    background_height=int_4,
    polyline=crv_3,
    stroke_color=ColourSwatch(SwatchColor=RGB(106, 150, 158)),
    stroke_width=Slider(0.8, range=0..5))
cluster_5 = Cluster_2(
    background_height=int_5,
    polyline=crv_5,
    stroke_color=ColourSwatch(SwatchColor=RGB(184, 251, 255)),
    stroke_width=Slider(0.8, range=0..5))
flatten = FlattenTree(Tree=cluster, Path="{0}")
flatten_2 = FlattenTree(Tree=cluster_2, Path="{0}")
flatten_3 = FlattenTree(Tree=cluster_3, Path="{0}")
flatten_4 = FlattenTree(Tree=cluster_4, Path="{0}")
flatten_5 = FlattenTree(Tree=cluster_5, Path="{0}")
flatten_6 = FlattenTree(Tree=[flatten_5, flatten_3, flatten, flatten_2, flatten_4], Path="{0}")
cluster_6 = Cluster(background_width=svg_px_width_2, background_height=svg_px_heigth_2, background_color=background_color, data=flatten_6)
stream_save_as_svg = Panel(cluster_6)
composed_svg_stream_save_as_svg = ClusterOutput(cluster_6)

# ==== cluster ShopBotCodePostProcessor
use_custom_jog_home = ClusterInput()
milling_bit_diameter = ClusterInput()
deviation_tolerance = ClusterInput()
custom_home_x = ClusterInput()
toolpath_curves = ClusterInput()
custom_home_y = ClusterInput()
ramp_plunges = ClusterInput()
spindle_speed = ClusterInput()
safe_z_height = ClusterInput()
ramp_angle = ClusterInput()
use_spindle = ClusterInput()
plunge_rate = ClusterInput()
tab_breps = ClusterInput()
job_name = ClusterInput()
feed_rate = ClusterInput()

convert_to_inches = BooleanToggle(False)
toolpath_curves_2 = Curve(toolpath_curves)
tab_breps_2 = Brep(tab_breps)
feed_rate_2 = Number(feed_rate)
plunge_rate_2 = Number(plunge_rate)
safe_z_height_2 = Number(safe_z_height)
use_spindle_2 = Integer(use_spindle)
spindle_speed_2 = Number(spindle_speed)
ramp_plunges_2 = Integer(ramp_plunges)
ramp_angle_2 = Number(ramp_angle)
use_custom_jog_home_2 = Integer(use_custom_jog_home)
custom_home_x_2 = Number(custom_home_x)
custom_home_y_2 = Number(custom_home_y)
deviation_tolerance_2 = Number(deviation_tolerance)
milling_bit_diameter_2 = Number(milling_bit_diameter)
job_name_2 = Text(job_name)
use_inches_boolean = Panel(convert_to_inches)
flatten = FlattenTree(Tree=toolpath_curves_2, Path="{0}")
flatten_2 = FlattenTree(Tree=tab_breps_2, Path="{0}")
clean = CleanTree(RemoveNulls=True, RemoveInvalid=True, RemoveEmpty=False, Tree=flatten)
filter = StreamFilter(Gate=use_inches_boolean, Stream0="1", Stream1="25.4")
division = Division(A=custom_home_x_2, B=filter)
division_2 = Division(A=custom_home_y_2, B=filter)
join = TextJoin(Text=flatten(["'", job_name_2]))
topoly = CurveToPolyline(Curve=clean, ToleranceDistance=deviation_tolerance_2, ToleranceAngle=0)  # -> Polyline, Segments
division_3 = Division(A=feed_rate_2, B=filter)
division_4 = Division(A=plunge_rate_2, B=filter)
division_5 = Division(A=safe_z_height_2, B=filter)
polyline_toolpaths = Curve(topoly.Polyline)

# ---- group: Eliminate unecessary jog Z
connect_overlapping_toolpaths = ConnectOverlappingToolpaths(polyline_toolpaths=polyline_toolpaths)

# ----
ramp_plunges_3 = Integer(ramp_plunges_2)
filter_2 = StreamFilter(Gate=ramp_plunges_3, Stream0=connect_overlapping_toolpaths, Stream1=polyline_toolpaths)

# ---- group: Adds tabs to toolpaths
tab_toolpaths = TabToolpaths(polyline_toolpaths=filter_2, tab_breps=flatten_2, milling_bit_diamter=milling_bit_diameter_2)  # -> tabbed_toolpaths_3, tab_cleanup_toolpaths_4

# ----
tab_cleanup_toolpaths = Curve(tab_toolpaths.tab_cleanup_toolpaths_4)

# ---- group: Add ramps to toolpaths
ramp_toolpath_plunges = RampToolpathPlunges(toolpaths_to_ramp=tab_toolpaths.tabbed_toolpaths_3, ramp_angle=ramp_angle_2)
ramp_plunges_4 = Integer(ramp_plunges_2)
filter_3 = StreamFilter(Gate=flatten(ramp_plunges_4), Stream0=flatten(tab_toolpaths.tabbed_toolpaths_3), Stream1=flatten(ramp_toolpath_plunges))

# ---- group: Add ramps to cleanup toolpaths
ramp_toolpath_plunges_2 = RampToolpathPlunges(toolpaths_to_ramp=tab_cleanup_toolpaths, ramp_angle=ramp_angle_2)
ramp_plunges_5 = Integer(ramp_plunges_2)
filter_4 = StreamFilter(Gate=ramp_plunges_5, Stream0=tab_cleanup_toolpaths, Stream1=ramp_toolpath_plunges_2)

# ----
connect_overlapping_toolpaths_2 = ConnectOverlappingToolpaths(polyline_toolpaths=filter_3)
connect_overlapping_toolpaths_3 = ConnectOverlappingToolpaths(polyline_toolpaths=filter_4)

# ---- group: Create safe Z transtions
cp = ControlPoints(Curve=connect_overlapping_toolpaths_2)  # -> Points, Weights, Knots
rev = ReverseList(List=cp.Points)
safe_z_height_3 = Number(division_5)
item = ListItem(List=cp.Points, Index=0, Wrap=True)
item_2 = ListItem(List=rev, Index=0, Wrap=True)
pdecon = Deconstruct(Point=item)  # -> XComponent, YComponent, ZComponent
pdecon_2 = Deconstruct(Point=item_2)  # -> XComponent, YComponent, ZComponent
pt = ConstructPoint(XCoordinate=pdecon.XComponent, YCoordinate=pdecon.YComponent, ZCoordinate=safe_z_height_3)
pt_2 = ConstructPoint(XCoordinate=pdecon_2.XComponent, YCoordinate=pdecon_2.YComponent, ZCoordinate=safe_z_height_3)
safe_z_end_point = Point(pt_2)
safe_z_start_point = Point(pt)

# ----
flatten_3 = FlattenTree(Tree=cp.Points, Path="{0}")  # disabled

safe_z_height_4 = Number(division_5)
cp_2 = ControlPoints(Curve=connect_overlapping_toolpaths_3)  # -> Points, Weights, Knots

lng = ListLength(List=flatten_3)
multiplication = Multiplication(A=lng, B=Slider(0.048775, range=0..1))
item_3 = ListItem(List=flatten_3, Index=multiplication, Wrap=True)
toolpath_points = Point(cp.Points)
toolpath_points_2 = Point(cp_2.Points)
pdecon_3 = Deconstruct(Point=toolpath_points)  # -> XComponent, YComponent, ZComponent

# ---- group: Optional MM to inch conversion
convert_to_inches_boolean = Panel(convert_to_inches)
filter_5 = StreamFilter(Gate=convert_to_inches_boolean, Stream0="1", Stream1="25.4")
division_6 = Division(A=pdecon_3.XComponent, B=filter_5)
division_7 = Division(A=pdecon_3.YComponent, B=filter_5)
division_8 = Division(A=pdecon_3.ZComponent, B=filter_5)

# ----
lng_2 = ListLength(List=toolpath_points)
pdecon_4 = Deconstruct(Point=toolpath_points_2)  # -> XComponent, YComponent, ZComponent

# ---- group: Optional MM to inch conversion
convert_to_inches_boolean_2 = Panel(convert_to_inches)
filter_6 = StreamFilter(Gate=convert_to_inches_boolean_2, Stream0="1", Stream1="25.4")
division_9 = Division(A=pdecon_4.XComponent, B=filter_6)
division_10 = Division(A=pdecon_4.YComponent, B=filter_6)
division_11 = Division(A=pdecon_4.ZComponent, B=filter_6)

# ----
lng_3 = ListLength(List=toolpath_points_2)
flatten_4 = FlattenTree(Tree=lng_2, Path="{0}")
flatten_5 = FlattenTree(Tree=lng_3, Path="{0}")
merge = Merge(Data1=Slider(0, range=0..100), Data2=flatten_4)
panel = Panel(division_6)
panel_2 = Panel(division_7)
panel_3 = Panel(division_8)
merge_2 = Merge(Data1=Slider(0, range=0..100), Data2=flatten_5)
panel_4 = Panel(division_9)
panel_5 = Panel(division_10)
panel_6 = Panel(division_11)

# ---- group: Jog to safe Z
safe_z_height_5 = Number(flatten(safe_z_height_3))
text = Text("JZ,")
graft = GraftTree(Tree=safe_z_height_5, IncludeEmptyLists=True, IncludeNullItems=True)
graft_2 = GraftTree(Tree=text, IncludeEmptyLists=True, IncludeNullItems=True)
lng_4 = ListLength(List=flatten(merge))
join_2 = TextJoin(Text=[graft_2, graft])
dup = DuplicateData(Data=join_2, Number=lng_4, Order=True)

# ---- group: Name
panel_7 = Panel(join)

# ---- group: Set spindle speed
spindle_speed_3 = Number(spindle_speed_2)
int = Integer(spindle_speed_3)
join_3 = TextJoin(Text=["TR,", int, ",1"])

# ---- group: Turn off spindle
filter_7 = StreamFilter(Gate=use_spindle_2, Stream1="SO,1,0")

# ---- group: Toolpath coordinates
text_2 = Text("M3,")
text_3 = Text(",")
text_4 = Text(",")
dup_2 = DuplicateData(Data=text_4, Number=lng_2, Order=True)
dup_3 = DuplicateData(Data=text_3, Number=lng_2, Order=True)
dup_4 = DuplicateData(Data=text_2, Number=lng_2, Order=True)
simplify = SimplifyTree(Tree=flatten(dup_4), Front=False)
simplify_2 = SimplifyTree(Tree=flatten(panel), Front=False)
simplify_3 = SimplifyTree(Tree=flatten(dup_3), Front=False)
simplify_4 = SimplifyTree(Tree=flatten(panel_2), Front=False)
simplify_5 = SimplifyTree(Tree=flatten(dup_2), Front=False)
simplify_6 = SimplifyTree(Tree=flatten(panel_3), Front=False)
graft_3 = GraftTree(Tree=simplify, IncludeEmptyLists=True, IncludeNullItems=True)
graft_4 = GraftTree(Tree=simplify_2, IncludeEmptyLists=True, IncludeNullItems=True)
graft_5 = GraftTree(Tree=simplify_3, IncludeEmptyLists=True, IncludeNullItems=True)
graft_6 = GraftTree(Tree=simplify_4, IncludeEmptyLists=True, IncludeNullItems=True)
graft_7 = GraftTree(Tree=simplify_5, IncludeEmptyLists=True, IncludeNullItems=True)
graft_8 = GraftTree(Tree=simplify_6, IncludeEmptyLists=True, IncludeNullItems=True)
join_4 = TextJoin(Text=[graft_3, graft_4, graft_5, graft_6, graft_7, graft_8])
flatten_6 = FlattenTree(Tree=join_4, Path="{0}")

# ---- group: Start spindle
panel_8 = Panel("PAUSE 1")
filter_8 = StreamFilter(Gate=use_spindle_2, Stream1="SO,1,1")

# ---- group: Set Feed rate (X Y speed) and plunge rate (Z speed)
feed_rate_3 = Number(division_3)
plunge_rate_3 = Number(division_4)
plunge_rate_4 = Number(plunge_rate_3)
feed_rate_4 = Number(feed_rate_3)
text_5 = Text("MS,")
text_6 = Text(",")
join_5 = TextJoin(Text=flatten([text_5, feed_rate_4, text_6, plunge_rate_4]))

# ---- group: Jog to safe Z
safe_z_height_6 = Number(flatten(safe_z_height_4))
text_7 = Text("JZ,")
graft_9 = GraftTree(Tree=safe_z_height_6, IncludeEmptyLists=True, IncludeNullItems=True)
graft_10 = GraftTree(Tree=text_7, IncludeEmptyLists=True, IncludeNullItems=True)
lng_5 = ListLength(List=flatten(merge_2))
join_6 = TextJoin(Text=[graft_10, graft_9])
dup_5 = DuplicateData(Data=join_6, Number=lng_5, Order=True)

# ---- group: Name
panel_9 = Panel(join)

# ---- group: Set spindle speed
spindle_speed_4 = Number(spindle_speed_2)
int_2 = Integer(spindle_speed_4)
join_7 = TextJoin(Text=["TR,", int_2, ",1"])

# ---- group: Turn off spindle
filter_9 = StreamFilter(Gate=use_spindle_2, Stream1="SO,1,0")

# ---- group: Toolpath coordinates
text_8 = Text("M3,")
text_9 = Text(",")
text_10 = Text(",")
dup_6 = DuplicateData(Data=text_10, Number=lng_3, Order=True)
dup_7 = DuplicateData(Data=text_9, Number=lng_3, Order=True)
dup_8 = DuplicateData(Data=text_8, Number=lng_3, Order=True)
simplify_7 = SimplifyTree(Tree=flatten(dup_8), Front=False)
simplify_8 = SimplifyTree(Tree=flatten(panel_4), Front=False)
simplify_9 = SimplifyTree(Tree=flatten(dup_7), Front=False)
simplify_10 = SimplifyTree(Tree=flatten(panel_5), Front=False)
simplify_11 = SimplifyTree(Tree=flatten(dup_6), Front=False)
simplify_12 = SimplifyTree(Tree=flatten(panel_6), Front=False)
graft_11 = GraftTree(Tree=simplify_7, IncludeEmptyLists=True, IncludeNullItems=True)
graft_12 = GraftTree(Tree=simplify_8, IncludeEmptyLists=True, IncludeNullItems=True)
graft_13 = GraftTree(Tree=simplify_9, IncludeEmptyLists=True, IncludeNullItems=True)
graft_14 = GraftTree(Tree=simplify_10, IncludeEmptyLists=True, IncludeNullItems=True)
graft_15 = GraftTree(Tree=simplify_11, IncludeEmptyLists=True, IncludeNullItems=True)
graft_16 = GraftTree(Tree=simplify_12, IncludeEmptyLists=True, IncludeNullItems=True)
join_8 = TextJoin(Text=[graft_11, graft_12, graft_13, graft_14, graft_15, graft_16])
flatten_7 = FlattenTree(Tree=join_8, Path="{0}")

# ---- group: Start spindle
panel_10 = Panel("PAUSE 1")
filter_10 = StreamFilter(Gate=use_spindle_2, Stream1="SO,1,1")

# ---- group: Set Feed rate (X Y speed) and plunge rate (Z speed)
feed_rate_5 = Number(division_3)
plunge_rate_5 = Number(division_4)
plunge_rate_6 = Number(plunge_rate_5)
feed_rate_6 = Number(feed_rate_5)
text_11 = Text("MS,")
text_12 = Text(",")
join_9 = TextJoin(Text=flatten([text_11, feed_rate_6, text_12, plunge_rate_6]))

# ----
filter_11 = StreamFilter(Gate=use_spindle_2, Stream1=join_3)
filter_12 = StreamFilter(Gate=use_spindle_2, Stream1=join_7)
text_13 = Text("J2,")
text_14 = Text(",")
text_15 = Text("J2,")
text_16 = Text(",")
join_10 = TextJoin(Text=[text_13, division, text_14, division_2])
join_11 = TextJoin(Text=[text_15, division, text_16, division_2])

# ---- group: Insert JZ commands
ma = MassAddition(Input=merge)  # -> Result, PartialResults
ins = InsertItems(List=flatten_6, Item=dup, Indices=ma.PartialResults, Wrap=True)

ma_2 = MassAddition(Input=merge_2)  # -> Result, PartialResults
ins_2 = InsertItems(List=flatten_7, Item=dup_5, Indices=ma_2.PartialResults, Wrap=True)

# ---- group: Create toolpath preview
rev_2 = ReverseList(List=flatten(safe_z_end_point))
cull_i = CullIndex(List=flatten(safe_z_start_point), Indices=0, Wrap=True)
cull_i_2 = CullIndex(List=rev_2, Indices=0, Wrap=True)
rev_3 = ReverseList(List=flatten(cull_i_2))
ln = Line(StartPoint=rev_3, EndPoint=cull_i)
ln_2 = Line(StartPoint=safe_z_start_point, EndPoint=item)
ln_3 = Line(StartPoint=item_2, EndPoint=safe_z_end_point)
tab_cleanup_preview_curves = Curve(connect_overlapping_toolpaths_3)
cut_transition_preview_lines = Curve(flatten(ln))
cut_entry_preview_lines = Curve(flatten(ln_2))
cut_exit_preview_lines = Curve(flatten(ln_3))
toolpath_preview_curves = Curve(connect_overlapping_toolpaths_2)

# ----
tab_cleanup_preview_curves_2 = ClusterOutput(tab_cleanup_preview_curves)
cut_transition_preview_lines_2 = ClusterOutput(cut_transition_preview_lines)
cut_exit_preview_lines_2 = ClusterOutput(cut_exit_preview_lines)
toolpath_preview_curves_2 = ClusterOutput(toolpath_preview_curves)
cut_entry_preview_lines_2 = ClusterOutput(cut_entry_preview_lines)

# ---- group: Jog to startpoints
item_4 = ListItem(List=division_6, Index=0, Wrap=True)
item_5 = ListItem(List=division_7, Index=0, Wrap=True)
lng_6 = ListLength(List=flatten(item_4))
text_17 = Text(",")
text_18 = Text("J2,")
dup_9 = DuplicateData(Data=text_18, Number=lng_6, Order=True)
dup_10 = DuplicateData(Data=text_17, Number=lng_6, Order=True)
simplify_13 = SimplifyTree(Tree=flatten(dup_9), Front=False)
simplify_14 = SimplifyTree(Tree=flatten(item_4), Front=False)
simplify_15 = SimplifyTree(Tree=flatten(dup_10), Front=False)
simplify_16 = SimplifyTree(Tree=flatten(item_5), Front=False)
graft_17 = GraftTree(Tree=simplify_13, IncludeEmptyLists=True, IncludeNullItems=True)
graft_18 = GraftTree(Tree=simplify_14, IncludeEmptyLists=True, IncludeNullItems=True)
graft_19 = GraftTree(Tree=simplify_15, IncludeEmptyLists=True, IncludeNullItems=True)
graft_20 = GraftTree(Tree=simplify_16, IncludeEmptyLists=True, IncludeNullItems=True)
join_12 = TextJoin(Text=[graft_17, graft_18, graft_19, graft_20])
jh = Text("JH")
flatten_8 = FlattenTree(Tree=join_12, Path="{0}")

# ----
filter_13 = StreamFilter(Gate=use_custom_jog_home_2, Stream0=jh, Stream1=flatten(join_10))

# ---- group: Jog to startpoints (continued)
merge_3 = Merge(Data1=flatten_8, Data2=filter_13)

# ---- group: Insert J2 commands
lng_7 = ListLength(List=merge_3)
dup_11 = DuplicateData(Data=Slider(1, range=0..1), Number=lng_7, Order=True)
addition = Addition(A=dup_11, B=merge)
ma_3 = MassAddition(Input=addition)  # -> Result, PartialResults
ins_3 = InsertItems(List=ins, Item=merge_3, Indices=ma_3.PartialResults, Wrap=True)

# ----
flatten_9 = FlattenTree(Tree=ins_3, Path="{0}")
merge_4 = Merge(Data1=panel_7, Data3=filter_11, Data4=filter_8, Data5=panel_8, Data6=join_5, Data7=flatten_9, Data8=filter_7)
shopbot_code_connect_panel_stream_and_sa = ClusterOutput(merge_4)  # "ShopBot code - Connect panel, stream and save as .sbp"
stream_and_save_as_sbp = Panel(merge_4)

# ---- group: Jog to startpoints
item_6 = ListItem(List=division_9, Index=0, Wrap=True)
item_7 = ListItem(List=division_10, Index=0, Wrap=True)
lng_8 = ListLength(List=flatten(item_6))
text_19 = Text(",")
text_20 = Text("J2,")
dup_12 = DuplicateData(Data=text_20, Number=lng_8, Order=True)
dup_13 = DuplicateData(Data=text_19, Number=lng_8, Order=True)
simplify_17 = SimplifyTree(Tree=flatten(dup_12), Front=False)
simplify_18 = SimplifyTree(Tree=flatten(item_6), Front=False)
simplify_19 = SimplifyTree(Tree=flatten(dup_13), Front=False)
simplify_20 = SimplifyTree(Tree=flatten(item_7), Front=False)
graft_21 = GraftTree(Tree=simplify_17, IncludeEmptyLists=True, IncludeNullItems=True)
graft_22 = GraftTree(Tree=simplify_18, IncludeEmptyLists=True, IncludeNullItems=True)
graft_23 = GraftTree(Tree=simplify_19, IncludeEmptyLists=True, IncludeNullItems=True)
graft_24 = GraftTree(Tree=simplify_20, IncludeEmptyLists=True, IncludeNullItems=True)
join_13 = TextJoin(Text=[graft_21, graft_22, graft_23, graft_24])
jh_2 = Text("JH")
flatten_10 = FlattenTree(Tree=join_13, Path="{0}")

# ----
filter_14 = StreamFilter(Gate=use_custom_jog_home_2, Stream0=jh_2, Stream1=flatten(join_11))

# ---- group: Jog to startpoints (continued)
merge_5 = Merge(Data1=flatten_10, Data2=filter_14)

# ---- group: Insert J2 commands
lng_9 = ListLength(List=merge_5)
dup_14 = DuplicateData(Data=Slider(1, range=0..1), Number=lng_9, Order=True)
addition_2 = Addition(A=dup_14, B=merge_2)
ma_4 = MassAddition(Input=addition_2)  # -> Result, PartialResults
ins_4 = InsertItems(List=ins_2, Item=merge_5, Indices=ma_4.PartialResults, Wrap=True)

# ----
flatten_11 = FlattenTree(Tree=ins_4, Path="{0}")
merge_6 = Merge(Data1=panel_9, Data3=filter_12, Data4=filter_10, Data5=panel_10, Data6=join_9, Data7=flatten_11, Data8=filter_9)
tab_cleanup_code_connect_panel_stream_an = ClusterOutput(merge_6)  # "Tab cleanup code - Connect panel, stream and save as .sbp"
stream_and_save_as_sbp_2 = Panel(merge_6)

# ==== cluster FindDeepestZ
toolpaths = ClusterInput()
toolpaths_2 = Geometry(toolpaths)
bbox = BoundingBox(Content=flatten(toolpaths_2), Plane=PlaneXY(0, 0, 0), UnionBox=True)  # -> Box, Box_2
box_corners = BoxCorners(Box=bbox.Box)  # -> CornerA, CornerB, CornerC, CornerD, CornerE, CornerF, CornerG, CornerH
pt = Point(box_corners.CornerA)
pdecon = Deconstruct(Point=pt)  # -> XComponent, YComponent, ZComponent
deepest_z = Number(pdecon.ZComponent)
deepest_z_2 = ClusterOutput(deepest_z)

# ==== cluster FeedRateCalculator
bit_diameter_id = ClusterInput()
bit_type_id = ClusterInput()
material_id = ClusterInput()
speed_factor = ClusterInput()
number_of_material_types = Panel("5")
plunge_rate_reduction_factor_up_cut = Panel("0.5")
material_min_speed_at_pass_depth = Panel("""60
32
22
22
8""")
material_max_speed_close_to_surface = Panel("""150
80
50
50
20""")
bit_reduction_factor_material_type = Panel("""0.7
0.8
0.9
1
1""")
plunge_rate_reduction_factor_up_cut_2 = Panel("0.9")
bit_type_id_2 = Number(bit_type_id)
bit_diameter_id_2 = Number(bit_diameter_id)
material_ramp_angles = Panel("""40
30
25
18
12""")
speed_factor_2 = Number(speed_factor)
material_id_2 = Integer(material_id)
bit_diameter_id_3 = Panel(bit_diameter_id_2)
bit_type_id_3 = Panel(bit_type_id_2)
material_type_id = Panel(material_id_2)
larger = LargerThan(FirstNumber=bit_type_id_3, SecondNumber="0")  # -> LargerThan, OrEqualTo
int = Integer(larger.LargerThan)

# ---- group: Calculate feed rate
number_of_material_types_2 = Panel(number_of_material_types)
number_of_material_types_3 = Panel(number_of_material_types)
dup = DuplicateData(Data=graft(material_max_speed_close_to_surface), Number=number_of_material_types_2, Order=True)
dup_2 = DuplicateData(Data=graft(material_min_speed_at_pass_depth), Number=number_of_material_types_3, Order=True)
flip = FlipMatrix(Data=dup)
flip_2 = FlipMatrix(Data=dup_2)
simplify = SimplifyTree(Tree=flip, Front=False)
simplify_2 = SimplifyTree(Tree=flip_2, Front=False)
multiplication = Multiplication(A=simplify, B=graft(bit_reduction_factor_material_type))
multiplication_2 = Multiplication(A=simplify_2, B=graft(bit_reduction_factor_material_type))
feed_rates_max = Panel(multiplication)
feed_rates_min = Panel(multiplication_2)

# ----
bit_type_simple = Panel(int)

# ---- group: Calculate pass depth
bit_type_id_4 = Panel(bit_type_id_3)
pass_depth_6mm_downcut_ball_straight = Panel("""15
13
8
4
2""")
bit_type_simple_2 = Panel(bit_type_simple)
pass_depth_6mm_upcut = Panel("""20
20
12
8.6
4""")
bit_reduction_factor_pass_depths = Panel("""0.28
0.5
0.66
1
1""")
v_bit_reduction_factor = Panel("0.5")
v_bit_identifier = Panel("3")
number_of_bit_diameters = Panel("5")
number_of_bit_diameters_2 = Panel(number_of_bit_diameters)
number_of_bit_diameters_3 = Panel(number_of_bit_diameters)
dup_3 = DuplicateData(Data=graft(pass_depth_6mm_upcut), Number=number_of_bit_diameters_3, Order=True)
dup_4 = DuplicateData(Data=graft(pass_depth_6mm_downcut_ball_straight), Number=number_of_bit_diameters_2, Order=True)
flip_3 = FlipMatrix(Data=dup_3)
flip_4 = FlipMatrix(Data=dup_4)
simplify_3 = SimplifyTree(Tree=flip_3, Front=False)
simplify_4 = SimplifyTree(Tree=flip_4, Front=False)
multiplication_3 = Multiplication(A=simplify_3, B=graft(bit_reduction_factor_pass_depths))
multiplication_4 = Multiplication(A=simplify_4, B=graft(bit_reduction_factor_pass_depths))
pass_depths_up_cut = Panel(multiplication_3)
pass_depths_down_cut_ball_nose_straight = Panel(multiplication_4)
bit_type_simple_3 = Panel(bit_type_simple_2)
bit_diameter = Panel(bit_diameter_id_3)
filter = StreamFilter(Gate=bit_type_simple_3, Stream0=pass_depths_up_cut, Stream1=pass_depths_down_cut_ball_nose_straight)
flip_5 = FlipMatrix(Data=filter)
item = ListItem(List=flip_5, Index=bit_diameter, Wrap=True)
material_type = Panel(material_type_id)
panel = Panel(item)
flatten = FlattenTree(Tree=panel, Path="{0}")
item_2 = ListItem(List=flatten, Index=material_type, Wrap=True)
v_bit_reduction_factor_2 = Panel(v_bit_reduction_factor)
bit_type_id_5 = Panel(bit_type_id_4)
v_bit_identifier_2 = Panel(v_bit_identifier)
multiplication_5 = Multiplication(A=item_2, B="10")
int_2 = Integer(multiplication_5)
v_bit_reduction_factor_3 = Panel(v_bit_reduction_factor_2)
division = Division(A=int_2, B="10")
equals = Equality(FirstNumber=bit_type_id_5, SecondNumber=v_bit_identifier_2)  # -> Equality, Inequality
multiplication_6 = Multiplication(A=division, B=v_bit_reduction_factor_3)
filter_2 = StreamFilter(Gate=equals.Equality, Stream0=division, Stream1=multiplication_6)
pass_depth = Panel(filter_2)

# ---- group: Make feed rate domain
int_3 = Integer(feed_rates_max)
int_4 = Integer(feed_rates_min)
dom = ConstructDomain(DomainStart=int_4, DomainEnd=int_3)
feed_rates_domains = Panel(dom)
bit_diameter_2 = Panel(bit_diameter_id_3)
flip_6 = FlipMatrix(Data=feed_rates_domains)
item_3 = ListItem(List=flip_6, Index=bit_diameter_2, Wrap=True)
panel_2 = Panel(item_3)
material_type_2 = Panel(material_type_id)
flatten_2 = FlattenTree(Tree=panel_2, Path="{0}")
item_4 = ListItem(List=flatten_2, Index=material_type_2, Wrap=True)
feed_rate_domain = Panel(item_4)

# ---- group: Select feedrate
bit_diameter_3 = Panel(bit_diameter_id_3)
flip_7 = FlipMatrix(Data=feed_rates_min)
item_5 = ListItem(List=flip_7, Index=bit_diameter_3, Wrap=True)
panel_3 = Panel(item_5)
material_type_3 = Panel(material_type_id)
flatten_3 = FlattenTree(Tree=panel_3, Path="{0}")
item_6 = ListItem(List=flatten_3, Index=material_type_3, Wrap=True)
feed_rate = Panel(item_6)

# ---- group: Map ramp and ramp angles
material_type_4 = Panel(material_type_id)
bit_type_simple_4 = Panel(int)
material_ramp_angles_2 = Panel(material_ramp_angles)
material_type_5 = Panel(material_type_id)
larger_2 = LargerThan(FirstNumber=material_type_4, SecondNumber="1")  # -> LargerThan, OrEqualTo
bool = Boolean(bit_type_simple_4)
larger_3 = LargerThan(FirstNumber=material_type_5, SecondNumber="2")  # -> LargerThan, OrEqualTo
item_7 = ListItem(List=material_ramp_angles_2, Index=material_type_5, Wrap=True)
ramp_because_of_special_bit_in_material = Panel(larger_2.LargerThan)
ramp_because_of_bit_type = Panel(bool)
ramp_because_of_material = Panel(larger_3.LargerThan)
and = GateAnd(A=ramp_because_of_bit_type, B=ramp_because_of_special_bit_in_material)
or = GateOr(A=ramp_because_of_material, B=and)
ramp_angle = Panel(item_7)
ramp_plunges = Panel(or)

# ---- group: Calculate plunge rate
plunge_rate_reduction_factor_up_cut_3 = Panel(plunge_rate_reduction_factor_up_cut)
bit_type = Panel(bit_type_simple)
plunge_rate_reduction_factor_up_cut_4 = Panel(plunge_rate_reduction_factor_up_cut_2)
filter_3 = StreamFilter(Gate=bit_type, Stream0=plunge_rate_reduction_factor_up_cut_4, Stream1=plunge_rate_reduction_factor_up_cut_3)
multiplication_7 = Multiplication(A=feed_rate, B=filter_3)
int_5 = Integer(multiplication_7)
num = Number(int_5)
plunge_rate = Panel(num)

# ----
pass_depth_2 = Panel(pass_depth)
feed_rate_domain_2 = Panel(feed_rate_domain)
plunge_rate_2 = Panel(plunge_rate)
feed_rate_2 = Panel(feed_rate)
ramp_angle_2 = Panel(ramp_angle)
ramp_plunges_2 = Panel(ramp_plunges)
ramp_plunges_3 = Boolean(ramp_plunges_2)
ramp_angle_3 = Integer(ramp_angle_2)
ramp_angle_4 = ClusterOutput(ramp_angle_3)
ramp_plunges_4 = ClusterOutput(ramp_plunges_3)

# ---- group: Speed mod
speed_factor_3 = Number(speed_factor_2)
subtraction = Subtraction(A=speed_factor_3, B="100")
division_2 = Division(A=subtraction, B="100")
dedomain = DeconstructDomain(Domain=feed_rate_domain_2)  # -> Start, End
division_3 = Division(A=subtraction, B="100")
division_4 = Division(A=subtraction, B="100")
larger_4 = LargerThan(FirstNumber=division_2, SecondNumber="0")  # -> LargerThan, OrEqualTo
multiplication_8 = Multiplication(A=pass_depth_2, B=division_2)
multiplication_9 = Multiplication(A=plunge_rate_2, B=division_4)
multiplication_10 = Multiplication(A=division_3, B=dedomain.Start)
multiplication_11 = Multiplication(A=division_3, B=dedomain.End)
filter_4 = StreamFilter(Gate=larger_4.LargerThan, Stream0=multiplication_8, Stream1="0")
addition = Addition(A=multiplication_9, B=plunge_rate_2)
addition_2 = Addition(A=multiplication_11, B=dedomain.End)
addition_3 = Addition(A=multiplication_10, B=dedomain.Start)
addition_4 = Addition(A=filter_4, B=pass_depth_2)
int_6 = Integer(addition)
int_7 = Integer(addition_3)
int_8 = Integer(addition_2)
dom_2 = ConstructDomain(DomainStart=int_7, DomainEnd=int_8)
num_2 = Number(addition_4)
speed_mod_pass_depth = Panel(num_2)

# ----
multiplication_12 = Multiplication(A=division_3, B=feed_rate_2)
addition_5 = Addition(A=multiplication_12, B=feed_rate_2)
int_9 = Integer(addition_5)
num_3 = Number(int_6)
speed_mod_feed_rate = Panel(dom_2)

# ---- group: Speed mod (continued)
speed_mod_plunge_rate = Panel(num_3)
speed_mod_feed_rate_2 = Panel(int_9)

# ----
feed_rate_domain_3 = Domain(speed_mod_feed_rate)
plunge_rate_3 = Number(speed_mod_plunge_rate)
pass_depth_3 = Number(speed_mod_pass_depth)
feed_rate_3 = Integer(speed_mod_feed_rate_2)
plunge_rate_4 = ClusterOutput(plunge_rate_3)
feed_rate_4 = ClusterOutput(feed_rate_3)
pass_depth_4 = ClusterOutput(pass_depth_3)

# ==== cluster CompileSettings
spindle_rpm = ClusterInput()
deepest_z = ClusterInput()
ramp_angle = ClusterInput()
ramp_plunges = ClusterInput()
pass_depth = ClusterInput()
plunge_rate = ClusterInput()
feed_rate = ClusterInput()
ramp_plunges_2 = Boolean(ramp_plunges)
pass_depth_2 = Number(pass_depth)
spindle_rpm_2 = Number(spindle_rpm)
plunge_rate_2 = Number(plunge_rate)
ramp_angle_2 = Integer(ramp_angle)
deepest_z_2 = Number(deepest_z)
feed_rate_2 = Number(feed_rate)
int = Integer(plunge_rate_2)
int_2 = Integer(spindle_rpm_2)
int_3 = Integer(feed_rate_2)
spindle_rpm_3 = Panel(int_2)
join = TextJoin(Text=["Spindle RPM: ", spindle_rpm_3])

# ---- group: Format for settings display
feed_rate_3 = Panel(int_3)
plunge_rate_3 = Panel(int)
pass_depth_3 = Panel(pass_depth_2)
ramp_plunges_3 = Panel(ramp_plunges_2)
ramp_angle_3 = Panel(ramp_angle_2)
deepest_point = Panel(deepest_z_2)
join_2 = TextJoin(Text=["Feed rate: ", feed_rate_3])
join_3 = TextJoin(Text=["Plunge rate: ", plunge_rate_3])
join_4 = TextJoin(Text=["Pass depth: ", pass_depth_3])
join_5 = TextJoin(Text=["Ramp plunges: ", ramp_plunges_3])
join_6 = TextJoin(Text=["Ramp angle:", ramp_angle_3])
join_7 = TextJoin(Text=["Deepest Z: ", deepest_point])
merge = Merge(
    Data1=join_2,
    Data2=" ",
    Data3=join_3,
    Data4=" ",
    Data5=join,
    Data6=" ",
    Data7=join_4,
    Data8=" ",
    Data9=join_5,
    Data10=" ",
    Data11=join_6,
    Data12=" ",
    Data13=join_7)
merge_2 = Merge(Data1=join_2, Data2=" ", Data3=join_3, Data4=" ", Data5=join_4, Data6=" ", Data7=join_7, Data8=" ")

# ----
crucial_settings = ClusterOutput(merge_2)
complete_settings = ClusterOutput(merge)

# ==== cluster Pocket
curves_for_raster_pocket = ClusterInput()
cut_depth_pocket = ClusterInput()
raster_along_y_0_1 = ClusterInput()
tool_diameter = ClusterInput()
stepover_0_1 = ClusterInput()
pass_depth = ClusterInput()
cut_depth_pocket_2 = Number(flatten(cut_depth_pocket))

# ---- group: Filter out open curves
curves_for_raster_pocket_2 = Curve(flatten(curves_for_raster_pocket))
cls = Closed(Curve=curves_for_raster_pocket_2)  # -> Closed, Periodic
dispatch = Dispatch(List=curves_for_raster_pocket_2, DispatchPattern=cls.Closed)  # -> ListA, ListB
dispatch_2 = Dispatch(List=cut_depth_pocket_2, DispatchPattern=cls.Closed)  # -> ListA, ListB

# ----
raster_trim_safety_distance = Panel("0.09")
raster_along_y_0_1_2 = Integer(raster_along_y_0_1)
tool_diameter_2 = Number(tool_diameter)
stepover_0_1_2 = Number(stepover_0_1)
pass_depth_2 = Number(pass_depth)
xy = XYPlane(Origin=Point(0, 0, 0))
multiplication = Multiplication(A=tool_diameter_2, B="0.5")
multiplication_2 = Multiplication(A=tool_diameter_2, B=stepover_0_1_2)
operation_plane = Plane(xy)
tool_radius = Panel(multiplication)
stepover_distance = Panel(multiplication_2)
tool_radius_2 = Panel(tool_radius)

# ---- group: Merge overlapping curves //removed for alowing multiple side by side pocket depths
curves_for_merging_overlap = Curve()
mcx = MultipleCurves(Curves=curves_for_merging_overlap)  # -> Points, IndexA, IndexB, ParamA, ParamB
dcon = DeleteConsecutive(Set=[mcx.IndexA, mcx.IndexB], Wrap=False)  # -> Set, Count
item = ListItem(List=curves_for_merging_overlap, Index=dcon.Set, Wrap=True)
cull_i = CullIndex(List=curves_for_merging_overlap, Indices=dcon.Set, Wrap=True)
runion = RegionUnion(Curves=item, Plane=operation_plane)
merged_overlapping_curves = Curve([runion, cull_i])

# ---- group: Align curve directions
curves_for_aligned_direction = Curve(dispatch.ListA)
graft = GraftTree(Tree=curves_for_aligned_direction, IncludeEmptyLists=True, IncludeNullItems=True)
offset = Offset(Curve=graft, Distance="0.01", Plane=PlaneXY(0, 0, 0), Corners=2)
end = EndPoints(Curve=offset)  # -> Start, End
pshift = ShiftPaths(Data=end.Start, Offset=-1)
incurve = PointInCurve(Point=pshift, Curve=graft)  # -> Relationship, Point
multiplication_3 = Multiplication(A=incurve.Relationship, B="0.5")
round = Round(Number=multiplication_3)  # -> Nearest, Floor, Ceiling
crv = Curve(graft)
int = Integer(round.Nearest)
flip = FlipCurve(Curve=crv)  # -> Curve, Flag
weave = Weave(Pattern=int, Stream0=flip.Curve, Stream1=crv, NullGaps=False)
pshift_2 = ShiftPaths(Data=weave, Offset=-1)
aligned_curves = Curve(pshift_2)

# ---- group: Detect curves inside curves
aligned_curves_2 = Curve(aligned_curves)
area = Area(Geometry=aligned_curves_2)  # -> Area, Centroid
graft_2 = GraftTree(Tree=aligned_curves_2, IncludeEmptyLists=True, IncludeNullItems=True)
end_2 = EndPoints(Curve=aligned_curves_2)  # -> Start, End
crv_cp = CurveClosestPoint(Point=area.Centroid, Curve=aligned_curves_2)  # -> Point, Parameter, Distance
incurve_2 = PointInCurve(Point=crv_cp.Point, Curve=graft_2)  # -> Relationship, Point
multiplication_4 = Multiplication(A=incurve_2.Relationship, B="0.5")
round_2 = Round(Number=multiplication_4)  # -> Nearest, Floor, Ceiling
int_2 = Integer(round_2.Floor)
flip_2 = FlipMatrix(Data=int_2)
cut_depth_pocket_3 = Number(dispatch_2.ListA)
ma = MassAddition(Input=flip_2)  # -> Result, PartialResults
pshift_3 = ShiftPaths(Data=ma.Result, Offset=-1)
dispatch_3 = Dispatch(List=cut_depth_pocket_3, DispatchPattern=pshift_3)  # -> ListA, ListB
dispatch_4 = Dispatch(List=aligned_curves_2, DispatchPattern=pshift_3)  # -> ListA, ListB
cut_depths_outer_pocket = Number(cut_depth_pocket_3)
curves_outside = Curve(dispatch_4.ListB)
curves_inside = Curve(dispatch_4.ListA)

# ----
curves_for_offset_outwards = Curve(curves_inside)
curves_for_offset_inwards = Curve(curves_outside)
operation_plane_2 = Plane(operation_plane)
neg = Negative(Value=tool_radius_2)
offset_2 = Offset(Curve=curves_for_offset_inwards, Distance=tool_radius_2, Plane=operation_plane_2, Corners=2)
offset_3 = Offset(Curve=curves_for_offset_outwards, Distance=neg, Plane=operation_plane_2, Corners=2)
pshift_4 = ShiftPaths(Data=offset_3, Offset=-1)
pshift_5 = ShiftPaths(Data=offset_2, Offset=-1)

# ---- group: Merge overlapping inside curves
curves_for_merging_overlap_2 = Curve(pshift_4)
mcx_2 = MultipleCurves(Curves=curves_for_merging_overlap_2)  # -> Points, IndexA, IndexB, ParamA, ParamB
dcon_2 = DeleteConsecutive(Set=[mcx_2.IndexA, mcx_2.IndexB], Wrap=False)  # -> Set, Count
item_2 = ListItem(List=curves_for_merging_overlap_2, Index=dcon_2.Set, Wrap=True)
runion_2 = RegionUnion(Curves=item_2, Plane=operation_plane_2)
cull_i_2 = CullIndex(List=curves_for_merging_overlap_2, Indices=dcon_2.Set, Wrap=True)
merged_overlapping_curves_2 = Curve([runion_2, cull_i_2])

# ----
operation_plane_3 = Plane(operation_plane_2)

# ---- group: Detect narrow gaps
graft_3 = GraftTree(Tree=merged_overlapping_curves_2, IncludeEmptyLists=True, IncludeNullItems=True)
ccx = CurveCurve(CurveA=flatten(pshift_5), CurveB=graft_3)  # -> Points, ParamsA, ParamsB
lng = ListLength(List=ccx.ParamsB)
larger = LargerThan(FirstNumber=lng, SecondNumber="0")  # -> LargerThan, OrEqualTo
pshift_6 = ShiftPaths(Data=larger.LargerThan, Offset=-1)
ma_2 = MassAddition(Input=pshift_6)  # -> Result, PartialResults
pshift_7 = ShiftPaths(Data=ma_2.Result, Offset=-1)
dispatch_5 = Dispatch(List=merged_overlapping_curves_2, DispatchPattern=pshift_7)  # -> ListA, ListB
rdiff = RegionDifference(CurvesA=pshift_5, CurvesB=dispatch_5.ListA, Plane=operation_plane_3)
inside_outline_curves = Curve(dispatch_5.ListB)
fixed_outline_curves = Curve(rdiff)

# ----
curves_for_raster_generation = Curve(fixed_outline_curves)
raster_direction_bollean = Integer(raster_along_y_0_1_2)

oultine_curve = Curve(curves_for_raster_generation)
X = UnitX(Factor=1)
Y = UnitY(Factor=1)
bbox = BoundingBox(Content=oultine_curve, Plane=PlaneXY(0, 0, 0))  # -> Box, Box_2
rev = Reverse(Vector=Y)
edges = BrepEdges(Brep=bbox.Box)  # -> Naked, Interior, NonManifold
filter = StreamFilter(Gate=raster_direction_bollean, Stream0="2", Stream1="3")
filter_2 = StreamFilter(Gate=raster_direction_bollean, Stream0="3", Stream1="2")
filter_3 = StreamFilter(Gate=raster_direction_bollean, Stream0=rev, Stream1=X)
item_3 = ListItem(List=edges.Naked, Index=filter_2, Wrap=True)
item_4 = ListItem(List=edges.Naked, Index=filter, Wrap=True)
len = Length(Curve=item_3)
stepover_distance_2 = Panel(stepover_distance)
division = Division(A=len, B=stepover_distance_2)
round_3 = Round(Number=division)  # -> Nearest, Floor, Ceiling
series = Series(Start=stepover_distance_2, Step=stepover_distance_2, Count=round_3.Floor)
amp = Amplitude(Vector=filter_3, Amplitude=series)
move = Move(Geometry=item_4, Motion=amp)  # -> Geometry, Transform
raster_curves = Curve(move.Geometry)

raster_cutoff_safety_factor = Panel("0.05")
raster_trim_safety_distance_2 = Panel(raster_trim_safety_distance)

# ---- group: Trim raster curves
dispatch_6 = Dispatch(List=flatten(raster_curves), DispatchPattern=[True, False])  # -> ListA, ListB
operation_plane_4 = Plane(operation_plane)
oultine_curve_2 = Curve(curves_for_raster_generation)
flip_3 = FlipCurve(Curve=dispatch_6.ListA)  # -> Curve, Flag
weave_2 = Weave(Pattern=[0, 1], Stream0=flip_3.Curve, Stream1=dispatch_6.ListB, NullGaps=False)
raster_curves_2 = Curve(weave_2)
offset_4 = Offset(Curve=oultine_curve_2, Distance=raster_trim_safety_distance_2, Plane=operation_plane_4, Corners=1)
trim = TrimWithRegion(Curve=raster_curves_2, Region=offset_4, Plane=operation_plane_4)  # -> Inside, Outside
simplify = SimplifyTree(Tree=trim.Inside, Front=False)
trimmed_raster_curves = Curve(simplify)

# ----
multiplication_5 = Multiplication(A=tool_radius_2, B=raster_cutoff_safety_factor)

# ---- group: Filter short curves
stepover_distance_3 = Panel(stepover_distance_2)
len_2 = Length(Curve=trimmed_raster_curves)
multiplication_6 = Multiplication(A=stepover_distance_3, B="0.8")
smaller = SmallerThan(FirstNumber=len_2, SecondNumber=multiplication_6)  # -> SmallerThan, OrEqualTo
dispatch_7 = Dispatch(List=trimmed_raster_curves, DispatchPattern=smaller.SmallerThan)  # -> ListA, ListB
trimmed_and_filtered_raster_curves = Curve(dispatch_7.ListB)

# ---- group: Create line connections
oultine_curve_3 = Curve(oultine_curve_2)
lng_2 = ListLength(List=flatten(oultine_curve_3))
smaller_2 = SmallerThan(FirstNumber=lng_2, SecondNumber="2")  # -> SmallerThan, OrEqualTo
flatten = FlattenTree(Tree=trimmed_and_filtered_raster_curves, Path="{0}")
pshift_8 = ShiftPaths(Data=trimmed_and_filtered_raster_curves, Offset=-1)
filter_4 = StreamFilter(Gate=smaller_2.SmallerThan, Stream0=pshift_8, Stream1=flatten)
crv_2 = Curve(filter_4)
shift = ShiftList(List=crv_2, Shift="-1", Wrap=False)
shift_2 = ShiftList(List=crv_2, Shift="1", Wrap=False)
end_3 = EndPoints(Curve=shift)  # -> Start, End
end_4 = EndPoints(Curve=shift_2)  # -> Start, End
ln = Line(StartPoint=end_3.End, EndPoint=end_4.Start)

# ---- group: Collsion detect innside outline curves
curves_for_offset_inwards_2 = Curve(curves_for_offset_inwards)
inside_outline_curves_2 = Curve(inside_outline_curves)
colom = CollisionOneMany(Collider=graft(inside_outline_curves_2), Obstacles=curves_for_offset_inwards_2)  # -> Collision, Index
dispatch_8 = Dispatch(List=graft(inside_outline_curves_2), DispatchPattern=colom.Collision)  # -> ListA, ListB
pshift_9 = ShiftPaths(Data=dispatch_8.ListB, Offset=-1)
collsion_detected_inside_outline_curves = Curve(pshift_9)

# ----
cut_depths_outer_pocket_2 = Number(flatten(cut_depths_outer_pocket))

# ---- group: Filter intersecting curves
line_connections = Curve(ln)
inside_outline_curves_3 = Curve(inside_outline_curves)
oultine_curve_4 = Curve(oultine_curve_2)
colom_2 = CollisionOneMany(Collider=line_connections, Obstacles=oultine_curve_4)  # -> Collision, Index
dispatch_9 = Dispatch(List=line_connections, DispatchPattern=colom_2.Collision)  # -> ListA, ListB
colom_3 = CollisionOneMany(Collider=dispatch_9.ListB, Obstacles=inside_outline_curves_3)  # -> Collision, Index
dispatch_10 = Dispatch(List=line_connections, DispatchPattern=colom_3.Collision)  # -> ListA, ListB

# ----
eval = EvaluateLength(Curve=dispatch_10.ListB, Length="0.5", Normalized=True)  # -> Point, Tangent, Parameter
incurve_3 = PointInCurve(Point=eval.Point, Curve=oultine_curve_4)  # -> Relationship, Point
multiplication_7 = Multiplication(A=incurve_3.Relationship, B="0.5")
bool = Boolean(multiplication_7)
dispatch_11 = Dispatch(List=dispatch_10.ListB, DispatchPattern=bool)  # -> ListA, ListB

# ---- group: Filter intersecting curves (continued)
connection_lines = Curve(dispatch_11.ListA)

# ---- group: Trim with inside outline curves
connection_lines_2 = Curve(connection_lines)
trimmed_and_filtered_raster_curves_2 = Curve(trimmed_and_filtered_raster_curves)
inside_outline_curves_4 = Curve(inside_outline_curves)
operation_plane_5 = Plane(operation_plane)
neg_2 = Negative(Value=raster_trim_safety_distance_2)
offset_5 = Offset(Curve=inside_outline_curves_4, Distance=neg_2, Plane=operation_plane_5, Corners=1)
oultine_curve_5 = Curve(oultine_curve_2)
lng_3 = ListLength(List=flatten(oultine_curve_5))
smaller_3 = SmallerThan(FirstNumber=lng_3, SecondNumber="2")  # -> SmallerThan, OrEqualTo
pshift_10 = ShiftPaths(Data=trimmed_and_filtered_raster_curves_2, Offset=-1)
flatten_2 = FlattenTree(Tree=trimmed_and_filtered_raster_curves_2, Path="{0}")
filter_5 = StreamFilter(Gate=smaller_3.SmallerThan, Stream0=pshift_10, Stream1=flatten_2)
pshift_11 = ShiftPaths(Data=offset_5, Offset=-1)
lng_4 = ListLength(List=flatten(inside_outline_curves_4))
smaller_4 = SmallerThan(FirstNumber=lng_4, SecondNumber="1")  # -> SmallerThan, OrEqualTo
trim_2 = TrimWithRegions(Curve=filter_5, Regions=pshift_11, Plane=operation_plane_4)  # -> Inside, Outside

# ----
filter_6 = StreamFilter(Gate=smaller_4.SmallerThan, Stream0=trim_2.Outside, Stream1=filter_5)

# ---- group: Trim with inside outline curves (continued)
crv_3 = Curve(filter_6)
join = JoinCurves(Curves=flatten([connection_lines_2, crv_3]), Preserve=True)
raster_curves_3 = Curve(join)

# ----
end_5 = EndPoints(Curve=raster_curves_3)  # -> Start, End
cps = ClosestPoints(Point=end_5.End, Cloud=end_5.Start, Count=2)  # -> ClosestPoint, CPIndex, Distance
dist = Distance(PointA=graft(end_5.Start), PointB=cps.ClosestPoint)
equals = Equality(FirstNumber=dist, SecondNumber="0")  # -> Equality, Inequality
dispatch_12 = Dispatch(List=cps.ClosestPoint, DispatchPattern=equals.Equality)  # -> ListA, ListB
item_5 = ListItem(List=dispatch_12.ListB, Index=0, Wrap=True)
ln_2 = Line(StartPoint=item_5, EndPoint=graft(end_5.End))

merge = Merge(Data1=inside_outline_curves_4, Data2=oultine_curve_4)
insied_and_outside_outline_curves = Curve(flatten(merge))
line_connections_2 = Curve(ln_2)
colom_4 = CollisionOneMany(Collider=line_connections_2, Obstacles=insied_and_outside_outline_curves)  # -> Collision, Index
dispatch_13 = Dispatch(List=line_connections_2, DispatchPattern=colom_4.Collision)  # -> ListA, ListB
stepover_distance_4 = Panel(stepover_distance_2)
len_3 = Length(Curve=dispatch_13.ListB)
multiplication_8 = Multiplication(A=stepover_distance_4, B="3")
larger_2 = LargerThan(FirstNumber=len_3, SecondNumber=multiplication_8)  # -> LargerThan, OrEqualTo
dispatch_14 = Dispatch(List=dispatch_13.ListB, DispatchPattern=larger_2.LargerThan)  # -> ListA, ListB
extra_connection_lines = Curve(dispatch_14.ListB)

extra_connection_lines_2 = Curve(extra_connection_lines)
raster_curves_4 = Curve(join)
join_2 = JoinCurves(Curves=flatten([raster_curves_4, extra_connection_lines_2]), Preserve=False)
raster_curves_5 = Curve(join_2)

inside_outline_curves_5 = Curve(collsion_detected_inside_outline_curves)
oultine_curve_6 = Curve(curves_for_raster_generation)
raster_curves_6 = Curve(raster_curves_5)
flatten_3 = FlattenTree(Tree=oultine_curve_6, Path="{0}")
end_6 = EndPoints(Curve=inside_outline_curves_5)  # -> Start, End
incurves = PointInCurves(Point=end_6.Start, Curves=flatten_3)  # -> Relationship, Index, Point
addition = Addition(A=incurves.Index, B="1")
# fix curve order fail when no raster lines
# fix offset from when 1 line becomes more ? (narrow channels)
ins = InsertItems(List=flatten_3, Item=inside_outline_curves_5, Indices=addition, Wrap=True)
end_7 = EndPoints(Curve=raster_curves_6)  # -> Start, End
incurves_2 = PointInCurves(Point=end_7.Start, Curves=ins)  # -> Relationship, Index, Point
ins_2 = InsertItems(List=ins, Item=raster_curves_6, Indices=incurves_2.Index, Wrap=True)
flatten_4 = FlattenTree(Tree=ins_2, Path="{0}")
item_6 = ListItem(List=flatten_4, Index=0, Wrap=True)
null = NullItem(Item=item_6)  # -> NullFlags, InvalidFlags, Description
filter_7 = StreamFilter(Gate=null.NullFlags, Stream0=ins_2, Stream1=flatten_3)
sorted_raster_and_outline_routes = Curve(flatten(filter_7))

# ---- group: Sort curves
aligned_curves_3 = Curve(sorted_raster_and_outline_routes)
curves_outside_2 = Curve(flatten(dispatch_4.ListB))
graft_4 = GraftTree(Tree=curves_outside_2, IncludeEmptyLists=True, IncludeNullItems=True)
end_8 = EndPoints(Curve=aligned_curves_3)  # -> Start, End
lng_5 = ListLength(List=curves_outside_2)
incurve_4 = PointInCurve(Point=end_8.Start, Curve=graft_4)  # -> Relationship, Point
dup = DuplicateData(Data=graft(aligned_curves_3), Number=lng_5, Order=True)
multiplication_9 = Multiplication(A=incurve_4.Relationship, B="0.5")
pshift_12 = ShiftPaths(Data=dup, Offset=-1)
round_4 = Round(Number=multiplication_9)  # -> Nearest, Floor, Ceiling
flip_4 = FlipMatrix(Data=pshift_12)
int_3 = Integer(round_4.Floor)
cull = CullPattern(List=flip_4, CullPattern=int_3)
sorted_curves = Curve(cull)

# ---- group: Move pocket toolpaths to cut depths
pass_depth_3 = Panel(pass_depth_2)
cut_depth_pocket_4 = Panel(cut_depths_outer_pocket_2)
sorted_raster_and_outline_routes_2 = Curve(sorted_curves)
division_2 = Division(A=cut_depth_pocket_4, B=pass_depth_3)
round_5 = Round(Number=division_2)  # -> Nearest, Floor, Ceiling
division_3 = Division(A=cut_depth_pocket_4, B=round_5.Ceiling)
actual_pass_depth = Panel(division_3)
series_2 = Series(Start=actual_pass_depth, Step=actual_pass_depth, Count=round_5.Ceiling)
neg_3 = Negative(Value=series_2)
item_7 = ListItem(List=neg_3, Index=0, Wrap=True)
null_2 = NullItem(Item=item_7)  # -> NullFlags, InvalidFlags, Description
filter_8 = StreamFilter(Gate=null_2.NullFlags, Stream0=neg_3, Stream1="0")
Z = UnitZ(Factor=filter_8)

# ----
group = Group(Objects=sorted_raster_and_outline_routes_2)

# ---- group: Fix curve order
rev_2 = ReverseList(List=sorted_raster_and_outline_routes_2)  # disabled
item_8 = ListItem(List=rev_2, Index=0, Wrap=True)
pshift_13 = ShiftPaths(Data=item_8, Offset=-1)
curves_for_raster_pocket_3 = Curve(dispatch.ListA)  # disabled
end_9 = EndPoints(Curve=pshift_13)  # -> Start, End
incurves_3 = PointInCurves(Point=end_9.Start, Curves=curves_for_raster_pocket_3)  # -> Relationship, Index, Point
pshift_14 = ShiftPaths(Data=group, Offset=-1)
item_9 = ListItem(List=pshift_14, Index=incurves_3.Index, Wrap=True)
item_10 = ListItem(List=item_9, Index=0, Wrap=True)

# ---- group: Calculate cut load
actual_pass_depth_2 = Panel(actual_pass_depth)
pass_depth_4 = Panel(pass_depth_2)
division_4 = Division(A=pass_depth_4, B=actual_pass_depth_2)
feed_rate_multiplier = Panel(division_4)

# ---- group: Move pocket toolpaths to cut depths (continued)
move_2 = Move(Geometry=group, Motion=Z)  # -> Geometry, Transform
ungroup = Ungroup(Group=move_2.Geometry)
flatten_5 = FlattenTree(Tree=ungroup, Path="{0}")

# ----
feed_rate_multiplier_2 = Panel(feed_rate_multiplier)
feed_rate_multiplier_3 = Number(feed_rate_multiplier_2)
pocket_toolpaths = Curve(flatten_5)
feed_rate_multiplier_4 = ClusterOutput(feed_rate_multiplier_3)
pocket_toolpaths_2 = ClusterOutput(pocket_toolpaths)

# ==== cluster Cutout
use_climb_direction = ClusterInput()
use_inside_cutting = ClusterInput()
curves_for_cutout = ClusterInput()
cutout_tolerance = ClusterInput()
tool_diameter = ClusterInput()
pass_depth = ClusterInput()
cut_depth = ClusterInput()
use_climb_direction_2 = Integer(use_climb_direction)
use_inside_cutting_2 = Integer(use_inside_cutting)
curves_for_cutout_2 = Curve(curves_for_cutout)
cutout_tolerance_2 = Number(cutout_tolerance)
tool_diameter_2 = Number(tool_diameter)
pass_depth_2 = Number(pass_depth)
cut_depth_2 = Number(cut_depth)
tool_diameter_3 = Panel(tool_diameter_2)
use_climb_direction_3 = Panel(use_climb_direction_2)
use_inside_cutting_3 = Panel(use_inside_cutting_2)

# ---- group: Filter out open curves
curves_for_cutout_3 = Curve(curves_for_cutout_2)
cls = Closed(Curve=curves_for_cutout_3)  # -> Closed, Periodic
dispatch = Dispatch(List=curves_for_cutout_3, DispatchPattern=cls.Closed)  # -> ListA, ListB

# ----
xy = XYPlane(Origin=Point(0, 0, 0))
operation_plane = Plane(xy)
multiplication = Multiplication(A=tool_diameter_3, B="0.5")
cutout_tolerance_3 = Panel(cutout_tolerance_2)
tool_radius = Panel(multiplication)

# ---- group: Re-join to assist in offsetting
explode = Explode(Curve=dispatch.ListA, Recursive=True)  # -> Segments, Vertices
join = JoinCurves(Curves=explode.Segments, Preserve=False)
cls_2 = Closed(Curve=join)  # -> Closed, Periodic
crv = Curve(graft(dispatch.ListA))
p_n_c = PickNChoose(Pattern=cls_2.Closed, Stream0=crv, Stream1=join)
flatten = FlattenTree(Tree=p_n_c, Path="{0}")

# ----
addition = Addition(A=tool_radius, B=cutout_tolerance_3)
compensated_tool_radius = Panel(addition)

# ---- group: Merge overlapping curves
curves_for_merging_overlap = Curve(flatten)
mcx = MultipleCurves(Curves=curves_for_merging_overlap)  # -> Points, IndexA, IndexB, ParamA, ParamB
dcon = DeleteConsecutive(Set=[mcx.IndexA, mcx.IndexB], Wrap=False)  # -> Set, Count
item = ListItem(List=curves_for_merging_overlap, Index=dcon.Set, Wrap=True)
cull_i = CullIndex(List=curves_for_merging_overlap, Indices=dcon.Set, Wrap=True)
runion = RegionUnion(Curves=item, Plane=operation_plane)
merged_overlapping_curves = Curve([runion, cull_i])

# ----
use_inside_cutting_4 = Panel(use_inside_cutting_3)
operation_plane_2 = Plane(operation_plane)
neg = Negative(Value=compensated_tool_radius)
pass_depth_3 = Number(pass_depth_2)
cut_depth_3 = Number(cut_depth_2)

# ---- group: Align curve directions
curves_for_aligned_direction = Curve(merged_overlapping_curves)
graft = GraftTree(Tree=curves_for_aligned_direction, IncludeEmptyLists=True, IncludeNullItems=True)
offset = Offset(Curve=graft, Distance="0.01", Plane=PlaneXY(0, 0, 0), Corners=2)
end = EndPoints(Curve=offset)  # -> Start, End
pshift = ShiftPaths(Data=end.Start, Offset=-1)
incurve = PointInCurve(Point=pshift, Curve=graft)  # -> Relationship, Point
multiplication_2 = Multiplication(A=incurve.Relationship, B="0.5")
round = Round(Number=multiplication_2)  # -> Nearest, Floor, Ceiling
crv_2 = Curve(graft)
int = Integer(round.Nearest)
flip = FlipCurve(Curve=crv_2)  # -> Curve, Flag
weave = Weave(Pattern=int, Stream0=flip.Curve, Stream1=crv_2, NullGaps=False)
pshift_2 = ShiftPaths(Data=weave, Offset=-1)

# ----
flip_2 = FlipCurve(Curve=pshift_2)  # -> Curve, Flag
filter = StreamFilter(Gate=use_inside_cutting_4, Stream0=pshift_2, Stream1=flip_2.Curve)

# ---- group: Align curve directions (continued)
aligned_curves = Curve(filter)

# ---- group: Detect curves inside curves
aligned_curves_2 = Curve(aligned_curves)
graft_2 = GraftTree(Tree=aligned_curves_2, IncludeEmptyLists=True, IncludeNullItems=True)
end_2 = EndPoints(Curve=aligned_curves_2)  # -> Start, End
incurve_2 = PointInCurve(Point=end_2.Start, Curve=graft_2)  # -> Relationship, Point
multiplication_3 = Multiplication(A=incurve_2.Relationship, B="0.5")
round_2 = Round(Number=multiplication_3)  # -> Nearest, Floor, Ceiling
int_2 = Integer(round_2.Floor)
flip_3 = FlipMatrix(Data=int_2)
ma = MassAddition(Input=flip_3)  # -> Result, PartialResults
pshift_3 = ShiftPaths(Data=ma.Result, Offset=-1)
dispatch_2 = Dispatch(List=aligned_curves_2, DispatchPattern=pshift_3)  # -> ListA, ListB
curves_outside = Curve(dispatch_2.ListB)
curves_inside = Curve(dispatch_2.ListA)

# ----
curves_for_offset_outwards = Curve(curves_outside)
curves_for_offset_inwards = Curve(curves_inside)
offset_2 = Offset(Curve=curves_for_offset_outwards, Distance=neg, Plane=operation_plane_2, Corners=2)
offset_3 = Offset(Curve=curves_for_offset_inwards, Distance=compensated_tool_radius, Plane=operation_plane_2, Corners=2)
pshift_4 = ShiftPaths(Data=offset_3, Offset=-1)
pshift_5 = ShiftPaths(Data=offset_2, Offset=-1)
flip_4 = FlipCurve(Curve=pshift_4)  # -> Curve, Flag
outside_cutout_curves = Curve(pshift_5)
inside_cutout_curves = Curve(flip_4.Curve)

outside_cutout_curves_2 = Curve(outside_cutout_curves)
inside_cutout_curves_2 = Curve(inside_cutout_curves)
inside_outline_curves = Curve(inside_cutout_curves_2)
flatten_2 = FlattenTree(Tree=outside_cutout_curves_2, Path="{0}")
end_3 = EndPoints(Curve=inside_outline_curves)  # -> Start, End
incurves = PointInCurves(Point=end_3.Start, Curves=flatten_2)  # -> Relationship, Index, Point
addition_2 = Addition(A=incurves.Index, B="1")
ins = InsertItems(List=flatten_2, Item=inside_outline_curves, Indices=incurves.Index, Wrap=True)

# ---- group: Flip curves for climb direction
sorted_inside_and_outside_curves = Curve(ins)
use_climb_direction_4 = Panel(use_climb_direction_3)
flip_5 = FlipCurve(Curve=sorted_inside_and_outside_curves)  # -> Curve, Flag
filter_2 = StreamFilter(Gate=use_climb_direction_4, Stream0=flip_5.Curve, Stream1=sorted_inside_and_outside_curves)
sorted_inside_and_outside_curves_2 = Curve(filter_2)

# ---- group: Move cutout toolpaths to cut depths
sorted_inside_and_outside_curves_3 = Curve(sorted_inside_and_outside_curves_2)
pass_depth_4 = Panel(pass_depth_3)
cut_depth_cutout = Panel(cut_depth_3)
division = Division(A=cut_depth_cutout, B=pass_depth_4)
graft_3 = GraftTree(Tree=sorted_inside_and_outside_curves_3, IncludeEmptyLists=True, IncludeNullItems=True)
round_3 = Round(Number=division)  # -> Nearest, Floor, Ceiling
division_2 = Division(A=cut_depth_cutout, B=round_3.Ceiling)
actual_pass_depth = Panel(division_2)
series = Series(Start=actual_pass_depth, Step=actual_pass_depth, Count=round_3.Ceiling)
neg_2 = Negative(Value=series)
Z = UnitZ(Factor=neg_2)
simplify = SimplifyTree(Tree=graft_3, Front=False)
simplify_2 = SimplifyTree(Tree=Z, Front=False)
move = Move(Geometry=simplify, Motion=simplify_2)  # -> Geometry, Transform
flatten_3 = FlattenTree(Tree=move.Geometry, Path="{0}")

# ----
cutout_toolpaths = Curve(flatten_3)
cutout_toolpaths_2 = ClusterOutput(cutout_toolpaths)

# ==== cluster Engrave
engrave_curves = ClusterInput()
pass_depth = ClusterInput()
cut_depth = ClusterInput()
engrave_curves_2 = Curve(engrave_curves)
pass_depth_2 = Number(pass_depth)
cut_depth_2 = Number(cut_depth)
pass_depth_3 = Panel(pass_depth_2)
cut_depth_line_engrave = Panel(cut_depth_2)
division = Division(A=cut_depth_line_engrave, B=pass_depth_3)
round = Round(Number=division)  # -> Nearest, Floor, Ceiling
division_2 = Division(A=cut_depth_line_engrave, B=round.Ceiling)
actual_pass_depth = Panel(division_2)
series = Series(Start=actual_pass_depth, Step=actual_pass_depth, Count=round.Ceiling)
neg = Negative(Value=series)
null = NullItem(Item=division_2)  # -> NullFlags, InvalidFlags, Description
filter = StreamFilter(Gate=null.NullFlags, Stream0=neg, Stream1="0")
Z = UnitZ(Factor=filter)
move = Move(Geometry=graft(engrave_curves_2), Motion=Z)  # -> Geometry, Transform
flatten = FlattenTree(Tree=move.Geometry, Path="{0}")
clean = CleanTree(RemoveNulls=True, RemoveInvalid=True, RemoveEmpty=False, Tree=flatten)
engrave_toolpaths = Curve(clean)
engrave_toolpaths_2 = ClusterOutput(engrave_toolpaths)

# ==== cluster GCodePreviewer
F = ClusterInput()
file = ReadFile(File=F, PerLineParse=True)
panel = Panel(file)
split = TextSplit(Text=panel, Separators=";")
item = ListItem(List=split, Index=0, Wrap=False)
flatten = FlattenTree(Tree=item, Path="{0}")
split_2 = TextSplit(Text=flatten, Separators=" ")
simplify = SimplifyTree(Tree=split_2, Front=False)
mindex = MemberIndex(Set=simplify, Member="G0")  # -> Index, Count
mindex_2 = MemberIndex(Set=simplify, Member="G1")  # -> Index, Count
simplify_2 = SimplifyTree(Tree=mindex.Count, Front=False)
simplify_3 = SimplifyTree(Tree=mindex_2.Count, Front=False)
larger = LargerThan(FirstNumber=simplify_2, SecondNumber="0")  # -> LargerThan, OrEqualTo
larger_2 = LargerThan(FirstNumber=simplify_3, SecondNumber="0")  # -> LargerThan, OrEqualTo
or = GateOr(A=larger_2.LargerThan, B=larger.LargerThan)
dispatch = Dispatch(List=simplify, DispatchPattern=or)  # -> ListA, ListB
clean = CleanTree(RemoveNulls=True, RemoveInvalid=True, RemoveEmpty=True, Tree=dispatch.ListA)
split_3 = TextSplit(Text=clean, Separators="Z")
split_4 = TextSplit(Text=clean, Separators="Y")
split_5 = TextSplit(Text=clean, Separators="X")
item_2 = ListItem(List=split_3, Index="1", Wrap=False)
item_3 = ListItem(List=split_4, Index="1", Wrap=False)
item_4 = ListItem(List=split_5, Index="1", Wrap=False)
pshift = ShiftPaths(Data=item_3, Offset=-1)
pshift_2 = ShiftPaths(Data=item_2, Offset=-1)
pshift_3 = ShiftPaths(Data=item_4, Offset=-1)
clean_2 = CleanTree(RemoveNulls=True, RemoveInvalid=True, RemoveEmpty=False, Tree=pshift_2)
clean_3 = CleanTree(RemoveNulls=True, RemoveInvalid=True, RemoveEmpty=False, Tree=pshift)
clean_4 = CleanTree(RemoveNulls=True, RemoveInvalid=True, RemoveEmpty=False, Tree=pshift_3)
null = NullItem(Item=clean_2)  # -> NullFlags, InvalidFlags, Description
flatten_2 = FlattenTree(Tree=null.NullFlags, Path="{0}")
flatten_3 = FlattenTree(Tree=clean_2, Path="{0}")
mindex_3 = MemberIndex(Set=flatten_2, Member=Toggle(False))  # -> Index, Count
shift = ShiftList(List=mindex_3.Index, Shift=1, Wrap=True)
subtraction = Subtraction(A=shift, B=mindex_3.Index)
rev = ReverseList(List=subtraction)
replace = ReplaceItems(List=rev, Item="0", Indices="0", Wrap=False)
rev_2 = ReverseList(List=replace)
dup = DuplicateData(Data=graft(flatten_3), Number=graft(rev_2), Order=True)
flatten_4 = FlattenTree(Tree=dup, Path="{0}")
graft = GraftTree(Tree=flatten_4, IncludeEmptyLists=True, IncludeNullItems=True)
simplify_4 = SimplifyTree(Tree=graft, Front=False)
simplify_5 = SimplifyTree(Tree=clean_4, Front=False)
simplify_6 = SimplifyTree(Tree=clean_3, Front=False)
pt = ConstructPoint(XCoordinate=simplify_5, YCoordinate=simplify_6, ZCoordinate=simplify_4)
pline = PolyLine(Vertices=flatten(pt), Closed=False)
g_code_toolpath = Curve(pline)
g_code_toolpath_2 = ClusterOutput(g_code_toolpath)

# ==== cluster Cluster
background_details = Panel("<svg xmlns=\"http://www.w3.org/2000/svg\" version=\"1.1\" width=\"W\" height=\"H\" style=\"background-color:rgb(C)\">")
background_width = ClusterInput()
rep = ReplaceText(Text=background_details, Find="W", BackgroundWidth=background_width, RecursiveReplace=False)
background_height = ClusterInput()
rep_2 = ReplaceText(Text=rep, Find="H", BackgroundHeight=background_height, RecursiveReplace=False)
background_color = ClusterInput()
rep_3 = ReplaceText(Text=rep_2, Find="C", BackgroundColor=background_color, RecursiveReplace=False)
data = ClusterInput()
data_2 = Data(data)
merge = Merge(Data1=rep_3, Data2=data_2, Data3="</svg>")
svg_composer = ClusterOutput(merge)

# ==== cluster Cluster_2
polyline = ClusterInput()
disc = Discontinuity(Polyline=polyline, Level=1)  # -> Points, Parameters
pdecon = Deconstruct(Point=disc.Points)  # -> XComponent, YComponent, ZComponent
background_height = ClusterInput()
polyline_string = Panel("<polyline points=\"C\" stroke=\"rgb(S)\" stroke-width=\"W\" stroke-dasharray=\"A\" fill=\"none\" />")
subtraction = Subtraction(BackgroundHeight=background_height, B=pdecon.YComponent)
concat = Concatenate(FragmentA=pdecon.XComponent, FragmentB=",", FragmentC=subtraction, FragmentD=" ")
join = TextJoin(Text=concat)
stroke_color = ClusterInput()
rep = ReplaceText(Text=polyline_string, Find="C", Replace=join, RecursiveReplace=False)
stroke_width = ClusterInput()
rep_2 = ReplaceText(Text=rep, Find="S", StrokeColor=stroke_color, RecursiveReplace=False)
rep_3 = ReplaceText(Text=rep_2, Find="W", StrokeWidth=stroke_width, RecursiveReplace=False)
stroke_dasharray = ClusterInput()
rep_4 = ReplaceText(Text=rep_3, Find="A", StrokeDasharray=stroke_dasharray, RecursiveReplace=False)
polyline_svg = ClusterOutput(rep_4)

# ==== cluster ConnectOverlappingToolpaths
polyline_toolpaths = ClusterInput()
polyline_toolpaths_2 = Curve(polyline_toolpaths)
clean = CleanTree(RemoveNulls=True, RemoveInvalid=True, RemoveEmpty=False, Tree=polyline_toolpaths_2)
crv = Curve(clean)
cp = ControlPoints(Curve=crv)  # -> Points, Weights, Knots
cp_2 = ControlPoints(Curve=crv)  # -> Points, Weights, Knots
end = EndPoints(Curve=crv)  # -> Start, End
lng = ListLength(List=cp.Points)
pshift = ShiftPaths(Data=cp_2.Points, Offset=-1)
shift = ShiftList(List=end.Start, Shift=1, Wrap=False)
shift_2 = ShiftList(List=end.End, Shift=-1, Wrap=False)
pshift_2 = ShiftPaths(Data=lng, Offset=-1)
pline = PolyLine(Vertices=pshift, Closed=False)
pdecon = Deconstruct(Point=shift)  # -> XComponent, YComponent, ZComponent
pdecon_2 = Deconstruct(Point=shift_2)  # -> XComponent, YComponent, ZComponent
ma = MassAddition(Input=pshift_2)  # -> Result, PartialResults
cp_3 = ControlPoints(Curve=pline)  # -> Points, Weights, Knots
pshift_3 = ShiftPaths(Data=cp_2.Points, Offset=-1)
flatten = FlattenTree(Tree=ma.PartialResults, Path="{0}")
multiplication = Multiplication(A=pdecon.YComponent, B="100")
multiplication_2 = Multiplication(A=pdecon.XComponent, B="100")
multiplication_3 = Multiplication(A=pdecon_2.XComponent, B="100")
multiplication_4 = Multiplication(A=pdecon_2.YComponent, B="100")
lng_2 = ListLength(List=pshift_3)
lng_3 = ListLength(List=cp_3.Points)
int = Integer(multiplication)
int_2 = Integer(multiplication_2)
int_3 = Integer(multiplication_3)
int_4 = Integer(multiplication_4)
smaller = SmallerThan(FirstNumber=lng_3, SecondNumber=lng_2)  # -> SmallerThan, OrEqualTo
division = Division(A=int, B="100")
division_2 = Division(A=int_2, B="100")
division_3 = Division(A=int_3, B="100")
division_4 = Division(A=int_4, B="100")
unreialiable_result_boolean = Panel(smaller.SmallerThan)
equals = Equality(FirstNumber=division_2, SecondNumber=division_3)  # -> Equality, Inequality
equals_2 = Equality(FirstNumber=division, SecondNumber=division_4)  # -> Equality, Inequality
and = GateAnd(A=equals.Equality, B=equals_2.Equality)

# ---- group: Line connection viz for troubleshooting
dispatch = Dispatch(List=shift_2, DispatchPattern=and)  # -> ListA, ListB
dispatch_2 = Dispatch(List=shift, DispatchPattern=and)  # -> ListA, ListB
ln = Line(StartPoint=dispatch_2.ListA, EndPoint=dispatch.ListA)  # disabled

# ----
rev = ReverseList(List=flatten)
rev_2 = ReverseList(List=flatten)
cull_i = CullIndex(List=rev, Indices="0", Wrap=True)
item = ListItem(List=rev, Index="0", Wrap=True)
cull_i_2 = CullIndex(List=rev_2, Indices="0", Wrap=True)
pshift_4 = ShiftPaths(Data=and, Offset=-1)
pshift_5 = ShiftPaths(Data=cull_i, Offset=-1)
pshift_6 = ShiftPaths(Data=cull_i_2, Offset=-1)
lng_4 = ListLength(List=pshift_4)
rev_3 = ReverseList(List=pshift_5)
rev_4 = ReverseList(List=pshift_6)
ins = InsertItems(List=pshift_4, Item=Toggle(False), Indices="0", Wrap=True)
ins_2 = InsertItems(List=pshift_4, Item=Toggle(False), Indices=lng_4, Wrap=True)
subtraction = Subtraction(A=rev_3, B="1")
cp_4 = ControlPoints(Curve=pline)  # -> Points, Weights, Knots
flatten_2 = FlattenTree(Tree=pshift, Path="{0}")
pshift_7 = ShiftPaths(Data=ins, Offset=-1)
merge = Merge(Data1=subtraction, Data2=item)
merge_2 = Merge(Data1="0", Data2=rev_4)
pshift_8 = ShiftPaths(Data=ins_2, Offset=-1)
dispatch_3 = Dispatch(List=merge_2, DispatchPattern=pshift_7)  # -> ListA, ListB
dispatch_4 = Dispatch(List=merge, DispatchPattern=pshift_8)  # -> ListA, ListB
dom = ConstructDomain(DomainStart=dispatch_3.ListB, DomainEnd=dispatch_4.ListB)
subset = SubList(List=flatten_2, Domain=dom, Wrap=False)  # -> List, Index
pline_2 = PolyLine(Vertices=subset.List, Closed=False)
unreialiable_result_boolean_2 = Panel(unreialiable_result_boolean)
flatten_3 = FlattenTree(Tree=pline_2, Path="{0}")
pshift_9 = ShiftPaths(Data=pline_2, Offset=-2)
filter = StreamFilter(Gate=unreialiable_result_boolean_2, Stream0=pshift_9)
item_2 = ListItem(List=flatten_3, Index=0, Wrap=True)
polyline_toolpaths_3 = Curve(polyline_toolpaths_2)
null = NullItem(Item=item_2)  # -> NullFlags, InvalidFlags, Description
filter_2 = StreamFilter(Gate=null.NullFlags, Stream0=flatten_3, Stream1=polyline_toolpaths_3)
z_connected_polyline_toolpaths = Curve(filter_2)
z_connected_polyline_toolpaths_2 = ClusterOutput(z_connected_polyline_toolpaths)

# ==== cluster TabToolpaths
polyline_toolpaths = ClusterInput()
milling_bit_diamter = ClusterInput()
tab_breps = ClusterInput()
tab_cleanup_overshoot_lenght = Panel("1")
tab_breps_2 = Brep(tab_breps)
polyline_toolpaths_2 = Curve(polyline_toolpaths)
milling_bit_diamter_2 = Number(milling_bit_diamter)
flatten = FlattenTree(Tree=tab_breps_2, Path="{0}")
clean = CleanTree(RemoveNulls=True, RemoveInvalid=True, RemoveEmpty=False, Tree=polyline_toolpaths_2)
bbox = BoundingBox(Content=clean, Plane=PlaneXY(0, 0, 0), UnionBox=True)  # -> Box, Box_2

# ---- group: Check if any tab volumes break material surface
bbox_2 = BoundingBox(Content=flatten, Plane=PlaneXY(0, 0, 0))  # -> Box, Box_2
debrep = DeconstructBrep(Brep=bbox_2.Box)  # -> Faces, Edges, Vertices
item = ListItem(List=debrep.Vertices, Index="4", Wrap=True)
pdecon = Deconstruct(Point=item)  # -> XComponent, YComponent, ZComponent
sort = SortList(Keys=flatten(pdecon.ZComponent))  # -> Keys, ValuesA
rev = ReverseList(List=sort.Keys)
item_2 = ListItem(List=rev, Index=0, Wrap=True)
larger = LargerThan(FirstNumber=item_2, SecondNumber="0")  # -> LargerThan, OrEqualTo
make_severed_toolapths = Panel(larger.LargerThan)

# ---- group: Check for input tab breps
item_3 = ListItem(List=flatten, Index=0, Wrap=True)
null = NullItem(Item=item_3)  # -> NullFlags, InvalidFlags, Description
no_tab_brep_input_boolean = Panel(null.NullFlags)

# ----
debrep_2 = DeconstructBrep(Brep=bbox.Box)  # -> Faces, Edges, Vertices
item_4 = ListItem(List=debrep_2.Vertices, Index="0", Wrap=True)
pdecon_2 = Deconstruct(Point=flatten(item_4))  # -> XComponent, YComponent, ZComponent
subtraction = Subtraction(A=pdecon_2.ZComponent, B="0.1")
lowes_toolpath_point = Panel(subtraction)
polyline_toolpaths_3 = Curve(clean)
tab_breps_3 = Brep(flatten)

# ---- group: Bit diameter compensate tab breps (for tab cleanup)
tab_cleanup_overshoot_lenght_2 = Panel(tab_cleanup_overshoot_lenght)
milling_bit_diamter_3 = Number(milling_bit_diamter_2)
tab_breps_4 = Brep(tab_breps_3)
multiplication = Multiplication(A=milling_bit_diamter_3, B="0.5")
debrep_3 = DeconstructBrep(Brep=tab_breps_4)  # -> Faces, Edges, Vertices
bbox_3 = BoundingBox(Content=tab_breps_4, Plane=PlaneXY(0, 0, 0))  # -> Box, Box_2
addition = Addition(A=multiplication, B=tab_cleanup_overshoot_lenght_2)
debrep_4 = DeconstructBrep(Brep=bbox_3.Box)  # -> Faces, Edges, Vertices
planar = IsPlanar(Surface=debrep_3.Faces, Interior=True)  # -> Planar, Plane
deplane = DeconstructPlane(Plane=planar.Plane)  # -> Origin, XAxis, YAxis, ZAxis
lowes_toolpath_point_2 = Panel(lowes_toolpath_point)
pdecon_3 = Deconstruct(Point=deplane.Origin)  # -> XComponent, YComponent, ZComponent
item_5 = ListItem(List=debrep_4.Vertices, Index=4, Wrap=True)
sort_2 = SortList(Keys=pdecon_3.ZComponent, ValuesA=debrep_3.Faces)  # -> Keys, ValuesA
pt = ConstructPoint(XCoordinate=0, YCoordinate=0, ZCoordinate=lowes_toolpath_point_2)
item_6 = ListItem(List=sort_2.ValuesA, Index=0, Wrap=True)
xy = XYPlane(Origin=pt)
edges = BrepEdges(Brep=item_6)  # -> Naked, Interior, NonManifold
cp = PlaneClosestPoint(Point=item_5, Plane=xy)  # -> Point, UVPoint, Distance
pshift = ShiftPaths(Data=edges.Naked, Offset=-1)
join = JoinCurves(Curves=pshift, Preserve=False)
Z = UnitZ(Factor=cp.Distance)
simplify = SimplifyTree(Tree=join, Front=False)
simplify_2 = SimplifyTree(Tree=Z, Front=False)
milling_bit_radius = Panel(addition)
project = Project(Geometry=simplify, Plane=xy)  # -> Geometry, Transform
neg = Negative(Value=milling_bit_radius)
offset = Offset(Curve=project.Geometry, Distance=milling_bit_radius, Plane=PlaneXY(0, 0, 0), Corners=1)
offset_2 = Offset(Curve=project.Geometry, Distance=neg, Plane=PlaneXY(0, 0, 0), Corners=1)
len = Length(Curve=offset)
len_2 = Length(Curve=offset_2)
smaller = SmallerThan(FirstNumber=len, SecondNumber=len_2)  # -> SmallerThan, OrEqualTo
weave = Weave(Pattern=smaller.SmallerThan, Stream0=offset, Stream1=offset_2, NullGaps=False)
extr = Extrude(Base=weave, Direction=simplify_2)
cap = CapHoles(Brep=extr)
bit_diameter_compensated_tab_breps = Brep(flatten(cap))

# ---- group: Bit diameter compensate tab breps
milling_bit_diamter_4 = Number(milling_bit_diamter_2)
tab_breps_5 = Brep(tab_breps_3)
multiplication_2 = Multiplication(A=milling_bit_diamter_4, B="0.5")
debrep_5 = DeconstructBrep(Brep=tab_breps_5)  # -> Faces, Edges, Vertices
bbox_4 = BoundingBox(Content=tab_breps_5, Plane=PlaneXY(0, 0, 0))  # -> Box, Box_2
milling_bit_radius_2 = Panel(multiplication_2)
debrep_6 = DeconstructBrep(Brep=bbox_4.Box)  # -> Faces, Edges, Vertices
planar_2 = IsPlanar(Surface=debrep_5.Faces, Interior=True)  # -> Planar, Plane
deplane_2 = DeconstructPlane(Plane=planar_2.Plane)  # -> Origin, XAxis, YAxis, ZAxis
lowes_toolpath_point_3 = Panel(lowes_toolpath_point)
item_7 = ListItem(List=debrep_6.Vertices, Index=4, Wrap=True)
pdecon_4 = Deconstruct(Point=deplane_2.Origin)  # -> XComponent, YComponent, ZComponent
sort_3 = SortList(Keys=pdecon_4.ZComponent, ValuesA=debrep_5.Faces)  # -> Keys, ValuesA
pt_2 = ConstructPoint(XCoordinate=0, YCoordinate=0, ZCoordinate=lowes_toolpath_point_3)
item_8 = ListItem(List=sort_3.ValuesA, Index=0, Wrap=True)
xy_2 = XYPlane(Origin=pt_2)
edges_2 = BrepEdges(Brep=item_8)  # -> Naked, Interior, NonManifold
cp_2 = PlaneClosestPoint(Point=item_7, Plane=xy_2)  # -> Point, UVPoint, Distance
pshift_2 = ShiftPaths(Data=edges_2.Naked, Offset=-1)
join_2 = JoinCurves(Curves=pshift_2, Preserve=False)
Z_2 = UnitZ(Factor=cp_2.Distance)
simplify_3 = SimplifyTree(Tree=join_2, Front=False)
# FIX BUG: Tabs equal to bit diamter makes offset and select error
simplify_4 = SimplifyTree(Tree=Z_2, Front=False)
milling_bit_radius_3 = Panel(milling_bit_radius_2)
project_2 = Project(Geometry=simplify_3, Plane=xy_2)  # -> Geometry, Transform
neg_2 = Negative(Value=milling_bit_radius_3)
offset_3 = Offset(Curve=project_2.Geometry, Distance=milling_bit_radius_3, Plane=PlaneXY(0, 0, 0), Corners=1)
offset_4 = Offset(Curve=project_2.Geometry, Distance=neg_2, Plane=PlaneXY(0, 0, 0), Corners=1)
len_3 = Length(Curve=offset_3)
len_4 = Length(Curve=offset_4)
smaller_2 = SmallerThan(FirstNumber=len_3, SecondNumber=len_4)  # -> SmallerThan, OrEqualTo
weave_2 = Weave(Pattern=smaller_2.SmallerThan, Stream0=offset_3, Stream1=offset_4, NullGaps=False)
extr_2 = Extrude(Base=weave_2, Direction=simplify_4)
cap_2 = CapHoles(Brep=extr_2)
bit_diameter_compensated_tab_breps_2 = Brep(flatten(cap_2))

# ---- group: Check for invalid boxes
flatten_2 = FlattenTree(Tree=bit_diameter_compensated_tab_breps_2, Path="{0}")
item_9 = ListItem(List=flatten_2, Index=0, Wrap=True)
null_2 = NullItem(Item=item_9)  # -> NullFlags, InvalidFlags, Description
filter = StreamFilter(Gate=null_2.NullFlags, Stream0=bit_diameter_compensated_tab_breps_2, Stream1=tab_breps_3)

flatten_3 = FlattenTree(Tree=bit_diameter_compensated_tab_breps, Path="{0}")
item_10 = ListItem(List=flatten_3, Index=0, Wrap=True)
null_3 = NullItem(Item=item_10)  # -> NullFlags, InvalidFlags, Description
filter_2 = StreamFilter(Gate=null_3.NullFlags, Stream0=bit_diameter_compensated_tab_breps, Stream1=tab_breps_3)

# ----
mesh = MeshBrep(
    Brep=filter_2,
    Settings={GridMaxCount=0, GridMinCount=16, JaggedSeams=False, MaxEdgeLength=0, MinEdgeLength=0.0001, MinTolerance=0, Refine=True, RefineAngle=0, RelativeTolerance=0.65, SimplePlanes=True, Tolerance=0})
mjoin = MeshJoin(Meshes=mesh)
tab_cleanup_volume_mesh = Mesh(mjoin)

make_severed_toolapths_2 = Panel(make_severed_toolapths)
no_tab_brep_input_boolean_2 = Panel(no_tab_brep_input_boolean)
polyline_toolpaths_4 = Curve(clean)

mesh_2 = MeshBrep(
    Brep=filter,
    Settings={GridMaxCount=0, GridMinCount=16, JaggedSeams=False, MaxEdgeLength=0, MinEdgeLength=0.0001, MinTolerance=0, Refine=True, RefineAngle=0, RelativeTolerance=0.65, SimplePlanes=True, Tolerance=0})
mjoin_2 = MeshJoin(Meshes=mesh_2)
tab_volume_mesh = Mesh(mjoin_2)
colom = CollisionOneMany(Collider=tab_volume_mesh, Obstacles=graft(polyline_toolpaths_3))  # -> Collision, Index
pshift_3 = ShiftPaths(Data=colom.Collision, Offset=-1)

tab_or_no_tab_booleans = Integer(pshift_3)

dispatch = Dispatch(List=polyline_toolpaths_3, DispatchPattern=tab_or_no_tab_booleans)  # -> ListA, ListB
toolpaths_without_tabs = Curve(dispatch.ListB)
toolpaths_for_tabbing = Curve(dispatch.ListA)

bbox_5 = BoundingBox(Content=mesh_2, Plane=PlaneXY(0, 0, 0))  # -> Box, Box_2
volume = Volume(Geometry=bbox_5.Box)  # -> Volume, Centroid
xy_3 = XYPlane(Origin=volume.Centroid)
scale_nu = ScaleNU(Geometry=bbox_5.Box, Plane=xy_3, ScaleX="1.01", ScaleY="1.01", ScaleZ=1)  # -> Geometry, Transform
mjoin_3 = MeshJoin(Meshes=scale_nu.Geometry)
tab_control_point_intersect_mesh = Mesh(mjoin_3)

# ---- group: Filter toolpaths entirely inside tabs
toolpaths_without_tabs_2 = Curve(dispatch.ListB)
tab_breps_6 = Brep(filter)
shapein = ShapeInBrep(Brep=tab_breps_6, Shape=toolpaths_without_tabs_2)
lng = ListLength(List=toolpaths_without_tabs_2)
bool = Boolean(shapein)
series = Series(Start=0, Step=1, Count=lng)
dispatch_2 = Dispatch(List=series, DispatchPattern=bool)  # -> ListA, ListB
replace = ReplaceItems(List=toolpaths_without_tabs_2, Indices=dispatch_2.ListB, Wrap=False)
toolpaths_without_tabs_3 = Curve(replace)

# ---- group: Test closing
cls = Closed(Curve=toolpaths_for_tabbing)  # -> Closed, Periodic
graft = GraftTree(Tree=cls.Closed, IncludeEmptyLists=True, IncludeNullItems=True)

# ----
tab_or_no_tab_booleans_2 = Integer(tab_or_no_tab_booleans)
toolpaths_without_tabs_4 = Curve(replace)

# ---- group: Cut toolpaths with extended tab volumes for tab cleanup
tab_cleanup_volume_mesh_2 = Mesh(tab_cleanup_volume_mesh)
mcx = MeshCurve(Mesh=tab_cleanup_volume_mesh_2, Curve=toolpaths_for_tabbing)  # -> Points, Faces

# ----
cullpt = CullDuplicates(Points=mcx.Points, Tolerance="0.01", CullMode=3)  # -> Points, Indices, Valence
pshift_4 = ShiftPaths(Data=cullpt.Points, Offset=-1)

# ---- group: Cut toolpaths with extended tab volumes for tab cleanup (continued)
crv_cp = CurveClosestPoint(Point=pshift_4, Curve=graft(toolpaths_for_tabbing))  # -> Point, Parameter, Distance
shatter = Shatter(Curve=graft(toolpaths_for_tabbing), Parameters=crv_cp.Parameter)
curvepoint = PointOnCurve(shatter, parameter=0.5)
minc = MeshInclusion(Mesh=tab_cleanup_volume_mesh_2, Point=curvepoint, Strict=False)
dispatch_3 = Dispatch(List=shatter, DispatchPattern=minc)  # -> ListA, ListB
tab_cleanup_toolpaths = Curve(dispatch_3.ListA)
toolpath_outside_tabs = Curve(dispatch_3.ListB)

# ----
tab_cleanup_toolpaths_2 = Curve(tab_cleanup_toolpaths)
flatten_4 = FlattenTree(Tree=tab_cleanup_toolpaths_2, Path="{0}")
tab_cleanup_toolpaths_3 = Curve(flatten_4)
tab_cleanup_toolpaths_4 = ClusterOutput(tab_cleanup_toolpaths_3)

# ---- group: Cut toolpaths with tab volumes
tab_volume_mesh_2 = Mesh(tab_volume_mesh)
mcx_2 = MeshCurve(Mesh=tab_volume_mesh_2, Curve=toolpaths_for_tabbing)  # -> Points, Faces

# ----
cullpt_2 = CullDuplicates(Points=mcx_2.Points, Tolerance="0.01", CullMode=3)  # -> Points, Indices, Valence
pshift_5 = ShiftPaths(Data=cullpt_2.Points, Offset=-1)

# ---- group: Cut toolpaths with tab volumes (continued)
crv_cp_2 = CurveClosestPoint(Point=pshift_5, Curve=graft(toolpaths_for_tabbing))  # -> Point, Parameter, Distance
shatter_2 = Shatter(Curve=graft(toolpaths_for_tabbing), Parameters=crv_cp_2.Parameter)
curvepoint_2 = PointOnCurve(shatter_2, parameter=0.5)
minc_2 = MeshInclusion(Mesh=tab_volume_mesh_2, Point=curvepoint_2, Strict=False)
dispatch_4 = Dispatch(List=shatter_2, DispatchPattern=minc_2)  # -> ListA, ListB
toolpath_outside_tabs_2 = Curve(dispatch_4.ListB)
toolpaths_inside_tabs = Curve(dispatch_4.ListA)

# ----
cp_3 = ControlPoints(Curve=toolpaths_inside_tabs)  # -> Points, Weights, Knots
Z_3 = UnitZ(Factor=1)
meshray = MeshRay(Mesh=tab_control_point_intersect_mesh, Point=cp_3.Points, Direction=Z_3)  # -> Point, Hit
pline = PolyLine(Vertices=meshray.Point, Closed=False)
pshift_6 = ShiftPaths(Data=pline, Offset=-1)

weave_3 = Weave(Pattern=minc_2, Stream0=toolpath_outside_tabs_2, Stream1=pshift_6, NullGaps=False)
cp_4 = ControlPoints(Curve=weave_3)  # -> Points, Weights, Knots
pshift_7 = ShiftPaths(Data=cp_4.Points, Offset=-1)
pline_2 = PolyLine(Vertices=pshift_7, Closed=graft)
pshift_8 = ShiftPaths(Data=pline_2, Offset="-2")
toolpath_outside_tabs_3 = Curve(toolpath_outside_tabs_2)
group = Group(Objects=toolpath_outside_tabs_3)

# ---- group: Check
flatten_5 = FlattenTree(Tree=pline_2, Path="{0}")
flatten_6 = FlattenTree(Tree=group, Path="{0}")

# ----
toolpaths_with_tabs = Curve(flatten_5)
pshift_9 = ShiftPaths(Data=group, Offset="-2")
filter_3 = StreamFilter(Gate=make_severed_toolapths_2, Stream0=toolpaths_with_tabs, Stream1=flatten_6)
tabbed_toolpaths = Geometry(filter_3)
weave_4 = Weave(Pattern=tab_or_no_tab_booleans_2, Stream0=toolpaths_without_tabs_4, Stream1=tabbed_toolpaths, NullGaps=False)
ungroup = Ungroup(Group=weave_4)
pshift_10 = ShiftPaths(Data=ungroup, Offset=-1)

polyline_toolpaths_5 = Curve(clean)
end = EndPoints(Curve=pshift_10)  # -> Start, End

end_2 = EndPoints(Curve=polyline_toolpaths_5)  # -> Start, End
crv_cp_3 = CurveClosestPoint(Point=end_2.End, Curve=pshift_10)  # -> Point, Parameter, Distance
pt_3 = Point(end_2.End)

dist = Distance(PointA=end.End, PointB=pt_3)
smaller_3 = SmallerThan(FirstNumber=dist, SecondNumber="0.01")  # -> SmallerThan, OrEqualTo
dispatch_5 = Dispatch(List=crv_cp_3.Parameter, DispatchPattern=smaller_3.SmallerThan)  # -> ListA, ListB
dispatch_6 = Dispatch(List=pshift_10, DispatchPattern=smaller_3.SmallerThan)  # -> ListA, ListB
seam = Seam(Curve=dispatch_6.ListB, Seam=dispatch_5.ListB)
weave_5 = Weave(Pattern=smaller_3.SmallerThan, Stream0=seam, Stream1=dispatch_6.ListA, NullGaps=False)

filter_4 = StreamFilter(Gate=no_tab_brep_input_boolean_2, Stream0=weave_5, Stream1=polyline_toolpaths_4)
clean_2 = CleanTree(RemoveNulls=True, RemoveInvalid=False, RemoveEmpty=False, Tree=filter_4)
flatten_7 = FlattenTree(Tree=clean_2, Path="{0}")
tabbed_toolpaths_2 = Curve(flatten_7)
tabbed_toolpaths_3 = ClusterOutput(tabbed_toolpaths_2)

# ==== cluster RampToolpathPlunges
toolpaths_to_ramp = ClusterInput()
ramp_angle = ClusterInput()
toolpaths_to_ramp_2 = Curve(toolpaths_to_ramp)
ramp_angle_2 = Number(ramp_angle)
end = EndPoints(Curve=toolpaths_to_ramp_2)  # -> Start, End
pdecon = Deconstruct(Point=end.Start)  # -> XComponent, YComponent, ZComponent
abs = Absolute(Value=pdecon.ZComponent)
dom = ConstructDomain(DomainStart="1", DomainEnd="89")
constrain = Constrain(Number=ramp_angle_2, Domain=dom)
rad = Radians(Degrees=constrain)
rtrig = RightTrigonometry(Beta=rad, QLength=abs)  # -> Alpha, Beta, PLength, QLength, RLength
len = Length(Curve=toolpaths_to_ramp_2)
smaller = SmallerThan(FirstNumber=len, SecondNumber=rtrig.PLength)  # -> SmallerThan, OrEqualTo
dispatch = Dispatch(List=len, DispatchPattern=smaller.OrEqualTo)  # -> ListA, ListB
dispatch_2 = Dispatch(List=rtrig.PLength, DispatchPattern=smaller.OrEqualTo)  # -> ListA, ListB
division = Division(A=dispatch_2.ListA, B=dispatch.ListA)
weave = Weave(Pattern=smaller.OrEqualTo, Stream0=dispatch_2.ListB, Stream1=dispatch.ListA, NullGaps=False)

cls = Closed(Curve=toolpaths_to_ramp_2)  # -> Closed, Periodic
dispatch_3 = Dispatch(List=toolpaths_to_ramp_2, DispatchPattern=cls.Closed)  # -> ListA, ListB
flip = FlipCurve(Curve=dispatch_3.ListA)  # -> Curve, Flag
weave_2 = Weave(Pattern=cls.Closed, Stream0=dispatch_3.ListB, Stream1=flip.Curve, NullGaps=False)

round = Round(Number=division)  # -> Nearest, Floor, Ceiling
division_2 = Division(A=weave, B="0.1")
dispatch_4 = Dispatch(List=abs, DispatchPattern=smaller.OrEqualTo)  # -> ListA, ListB
int = Integer(division_2)
division_3 = Division(A=dispatch_4.ListA, B=round.Ceiling)
int_2 = Integer(division_2)
division_4 = Division(A=weave, B=int)
weave_3 = Weave(Pattern=smaller.OrEqualTo, Stream0=dispatch_4.ListB, Stream1=division_3, NullGaps=False)
addition = Addition(A=int, B="1")
division_5 = Division(A=weave_3, B=int_2)
series = Series(Start=0, Step=division_4, Count=addition)
series_2 = Series(Start=0, Step=division_5, Count=addition)
eval = EvaluateLength(Curve=graft(weave_2), Length=series, Normalized=False)  # -> Point, Tangent, Parameter
Z = UnitZ(Factor=series_2)
move = Move(Geometry=eval.Point, Motion=Z)  # -> Geometry, Transform
pline = PolyLine(Vertices=move.Geometry, Closed=False)
pshift = ShiftPaths(Data=pline, Offset=-1)
redpline = Reduce(Polyline=pshift, Tolerance="0.02")  # -> Polyline, Reduction
flip_2 = FlipCurve(Curve=redpline.Polyline)  # -> Curve, Flag

dispatch_5 = Dispatch(List=flip_2.Curve, DispatchPattern=smaller.OrEqualTo)  # -> ListA, ListB
end_2 = EndPoints(Curve=dispatch_5.ListA)  # -> Start, End
pdecon_2 = Deconstruct(Point=end_2.End)  # -> XComponent, YComponent, ZComponent
pdecon_3 = Deconstruct(Point=end_2.Start)  # -> XComponent, YComponent, ZComponent
pt = ConstructPoint(XCoordinate=0, YCoordinate=0, ZCoordinate=pdecon_2.ZComponent)
pt_2 = ConstructPoint(XCoordinate=0, YCoordinate=0, ZCoordinate=pdecon_3.ZComponent)
dist = Distance(PointA=pt_2, PointB=pt)
series_3 = Series(Start=0, Step=dist, Count=round.Ceiling)
Z_2 = UnitZ(Factor=series_3)
move_2 = Move(Geometry=graft(dispatch_5.ListA), Motion=Z_2)  # -> Geometry, Transform

clean = CleanTree(RemoveNulls=True, RemoveInvalid=True, RemoveEmpty=False, Tree=move_2.Geometry)
join = JoinCurves(Curves=move_2.Geometry, Preserve=False)
flip_3 = FlipMatrix(Data=clean)
lng = ListLength(List=join)
dispatch_6 = Dispatch(List=flip_3, DispatchPattern=cls.Closed)  # -> ListA, ListB
larger = LargerThan(FirstNumber=lng, SecondNumber="1")  # -> LargerThan, OrEqualTo
flip_4 = FlipMatrix(Data=dispatch_6.ListB)
dispatch_7 = Dispatch(List=join, DispatchPattern=larger.LargerThan)  # -> ListA, ListB
simplify = SimplifyTree(Tree=dispatch_7.ListA, Front=False)
dispatch_8 = Dispatch(List=flip_4, DispatchPattern=[True, False])  # -> ListA, ListB
flatten = FlattenTree(Tree=dispatch_7.ListB, Path="{0}")
dispatch_9 = Dispatch(List=simplify, DispatchPattern=[True, False])  # -> ListA, ListB
crv = Curve(dispatch_9.ListB)
bbox = BoundingBox(Content=dispatch_9.ListB, Plane=PlaneXY(0, 0, 0))  # -> Box, Box_2
xy = XYPlane(Origin=Point(0, 0, 0))
cp = ControlPoints(Curve=dispatch_8.ListB)  # -> Points, Weights, Knots
x_tremez = Extremes(Curve=crv, Plane=xy)  # -> Highest, Lowest
cp_2 = ControlPoints(Curve=dispatch_9.ListB)  # -> Points, Weights, Knots; disabled
pshift_2 = ShiftPaths(Data=bbox.Box, Offset=-1)
pdecon_4 = Deconstruct(Point=cp.Points)  # -> XComponent, YComponent, ZComponent
ln = Line(StartPoint=x_tremez.Highest, EndPoint=x_tremez.Lowest)
debrep = DeconstructBrep(Brep=pshift_2)  # -> Faces, Edges, Vertices
rev = ReverseList(List=pdecon_4.ZComponent)
pdecon_5 = Deconstruct(Point=cp_2.Points)  # -> XComponent, YComponent, ZComponent
pt_3 = ConstructPoint(XCoordinate=pdecon_4.XComponent, YCoordinate=pdecon_4.YComponent, ZCoordinate=rev)
item = ListItem(List=debrep.Edges, Index="8", Wrap=True)
rev_2 = ReverseList(List=pdecon_5.ZComponent)
eval_2 = EvaluateLength(Curve=ln, Length="0.5", Normalized=True)  # -> Point, Tangent, Parameter
pline_2 = PolyLine(Vertices=pt_3, Closed=False)
pt_4 = ConstructPoint(XCoordinate=pdecon_5.XComponent, YCoordinate=pdecon_5.YComponent, ZCoordinate=rev_2)
pshift_3 = ShiftPaths(Data=eval_2.Point, Offset=-1)  # disabled
pshift_4 = ShiftPaths(Data=pline_2, Offset=-1)
pline_3 = PolyLine(Vertices=pt_4, Closed=False)
xy_2 = XYPlane(Origin=eval_2.Point)
flip_5 = FlipCurve(Curve=pshift_4)  # -> Curve, Flag
pshift_5 = ShiftPaths(Data=pline_3, Offset=-1)
mirror = Mirror(Geometry=crv, Plane=xy_2)  # -> Geometry, Transform
weave_4 = Weave(Pattern=[0, 1], Stream0=dispatch_8.ListA, Stream1=flip_5.Curve, NullGaps=False)
flip_6 = FlipCurve(Curve=pshift_5)  # -> Curve, Flag
flip_7 = FlipMatrix(Data=weave_4)
flip_8 = FlipCurve(Curve=mirror.Geometry)  # -> Curve, Flag
weave_5 = Weave(Pattern=[0, 1], Stream0=dispatch_9.ListA, Stream1=flip_8.Curve, NullGaps=False)
weave_6 = Weave(Pattern=cls.Closed, Stream0=flip_7, Stream1=dispatch_6.ListA, NullGaps=False)
join_2 = JoinCurves(Curves=weave_5, Preserve=False)
flip_9 = FlipMatrix(Data=weave_6)
simplify_2 = SimplifyTree(Tree=join_2, Front=False)
join_3 = JoinCurves(Curves=flip_9, Preserve=False)
number_slider = Slider(4, range=0..10)
weave_7 = Weave(Pattern=flatten(larger.LargerThan), Stream0=flatten(flatten), Stream1=flatten(simplify_2), NullGaps=False)
pshift_6 = ShiftPaths(Data=join_3, Offset=-1)
pshift_7 = ShiftPaths(Data=pshift_6, Offset=-1)
weave_8 = Weave(Pattern=smaller.OrEqualTo, Stream0=dispatch_5.ListB, Stream1=weave_7, NullGaps=False)
item_2 = ListItem(List=toolpaths_to_ramp_2, Index=number_slider, Wrap=True)
item_3 = ListItem(List=weave_8, Index=number_slider, Wrap=True)
weave_9 = Weave(Pattern=[0, 1], Stream0=weave_8, Stream1=toolpaths_to_ramp_2, NullGaps=False)
join_4 = JoinCurves(Curves=weave_9, Preserve=Toggle(True))  # disabled
ramped_toolpaths = Curve(weave_9)
ramped_toolpaths_2 = ClusterOutput(ramped_toolpaths)
