# Grasshopper definition rack and pinion animator.gh (Grasshopper 0.9.76)
# Copyright: Creative commons attribution share-a-like
# plug-ins: setFlounderCamera

master_animation_position = Slider(1, range=0..1)
start_number_of_pinion_teeth = Panel("42")
# Fix preview on by default
# Fix convert tooth count to int
end_number_of_pinion_teeth = Panel("10")
graph = GraphMapper(
    master_animation_position,
    x0=0,
    x1=1,
    y0=0,
    y1=1,
    container_name="Bezier",
    cpx=[0, 0.2020522356, 0.2433843166, 1],
    cpy=[0, 0.8268043399, 1, 1])
master_animation_position_2 = Panel(master_animation_position)
number_of_rotations = Panel("0.5")
multiplication = Multiplication(A=master_animation_position_2, B=number_of_rotations)
master_animation_position_3 = Panel(graph)
subtraction = Subtraction(A=start_number_of_pinion_teeth, B=end_number_of_pinion_teeth)
subtraction_2 = Subtraction(A="1", B=master_animation_position_3)
multiplication_2 = Multiplication(A=subtraction_2, B=subtraction)
number_slider = Slider(2, range=0..10)
addition = Addition(A=multiplication_2, B=end_number_of_pinion_teeth)
division = Division(A=addition, B=number_slider)
int = Integer(division)
multiplication_3 = Multiplication(A=int, B=number_slider)
current_number_of_teeth = Panel(multiplication_3)
roller_rack_and_pinion_maker = RollerRackAndPinionMaker(
    rack_length=Slider(1000, range=0..1000),
    milling_bit_diameter=Slider(3, range=0..10),
    number_of_pinion_teeth=current_number_of_teeth,
    preview_position_0_1=multiplication)  # -> rack_teeth_4, rack_edge_2, pinion_teeth_4, pinion_center_hole_3, pinion_edge_3, pinion_movement_preview_3, distance_covered_per_step_5, maxium_pinion_milling_bit_diamter_4
swatch = ColourSwatch(SwatchColor=RGB(130, 240, 255))
item = ListItem(List=roller_rack_and_pinion_maker.pinion_movement_preview_3, Index=0, Wrap=True)
preview = CustomPreview(Geometry=roller_rack_and_pinion_maker.rack_teeth_4, Shader=swatch)
preview_2 = CustomPreview(Geometry=roller_rack_and_pinion_maker.pinion_movement_preview_3, Shader=swatch)
area = Area(Geometry=item)  # -> Area, Centroid
pinion_center = Point(area.Centroid)
Z = UnitZ(Factor=Slider(60, range=0..200))
Y = UnitY(Factor=1)
move = Move(Geometry=pinion_center, Motion=Z)  # -> Geometry, Transform
syncfloundercamera = SyncFlounderCamera(Activate=Toggle(True), ViewportName="Perspective", Location=move.Geometry, Target=pinion_center, Lens="50", Up=Y)

# ==== cluster RollerRackAndPinionMaker: Makes rack and pinion gemetry suitable for 3 axis CNC milling. Has low backlash, but is vulnerable to contamination. More options inside component.
number_of_pinion_teeth = ClusterInput()
milling_bit_diameter = ClusterInput()
motor_shaft_diameter = ClusterInput()
rack_length = ClusterInput()

# ---- group: Smaller amount of teeth gives higher resolution and more torque
number_of_pinion_teeth_2 = Panel("10")
number_of_pinion_teeth_3 = Number(number_of_pinion_teeth)
null = NullItem(Item=number_of_pinion_teeth_3)  # -> NullFlags, InvalidFlags, Description
filter = StreamFilter(Gate=null.NullFlags, Stream0=number_of_pinion_teeth_3, Stream1=number_of_pinion_teeth_2)
number_of_pinion_teeth_4 = Panel(filter)

# ---- group: Determines the tooth sppacing, some margin recommended
milling_bit_diameter_2 = Panel("3.1")
milling_bit_diameter_3 = Number(milling_bit_diameter)
null_2 = NullItem(Item=milling_bit_diameter_3)  # -> NullFlags, InvalidFlags, Description
filter_2 = StreamFilter(Gate=null_2.NullFlags, Stream0=milling_bit_diameter_3, Stream1=milling_bit_diameter_2)
milling_bit_diameter_4 = Panel(filter_2)

# ---- group: Determines the travel distance of pinion
rack_length_2 = Panel("200")
rack_length_3 = Number(rack_length)
# default config for 2mm pinion milling and 3mm rack milling: bit diamter: 3.1
# margin factor: -0.14
# number of pinion teeth: 10
# fillet ratio: 0.15
null_3 = NullItem(Item=rack_length_3)  # -> NullFlags, InvalidFlags, Description
filter_3 = StreamFilter(Gate=null_3.NullFlags, Stream0=rack_length_3, Stream1=rack_length_2)
rack_length_4 = Panel(filter_3)

# ---- group: The shaft diameter of the motor driving the pinion
motor_shaft_diameter_2 = Panel("5")
motor_shaft_diameter_3 = Number(motor_shaft_diameter)
null_4 = NullItem(Item=motor_shaft_diameter_3)  # -> NullFlags, InvalidFlags, Description
filter_4 = StreamFilter(Gate=null_4.NullFlags, Stream0=motor_shaft_diameter_3, Stream1=motor_shaft_diameter_2)
motor_shaft_diameter_4 = Panel(filter_4)

# ----
preview_position_0_1 = ClusterInput()
preview_position = Slider(0.25, range=0..1)

# ---- group: Low fillet ratio gives smoother motion, but makes a less robust pinion
tooth_fillet_ratio = Slider(0.15, range=0..1)
tooth_fillet_ratio_2 = Panel(tooth_fillet_ratio)

# ---- group: Controlls pinion tooth blending
rounding_factor_pinion_outside = Slider(20, range=0..100)
rounding_factor_pinion_inside = Slider(70, range=0..100)

# ---- group: Start numbers to help calculte pinion tooth path through rack
number_of_curve_sample_points = Slider(20, range=0..1000)
sample_tooth_position = Panel("0.26")

# ---- group: Lower number gives more clearene between rack tooth and pinion valley
pinion_corner_tolerance_factor = Panel("15")

# ---- group: Fill in for correct step statistics
number_of_stepper_motor_steps = Panel("200")
microstep_level = Panel("4")

# ----
preview_position_0_1_2 = Number(preview_position_0_1)

# ---- group: Can be used to reduce or increase the pinion tooth spacing
pinion_tooth_spacing_factor = Panel("-0.14")

# ---- group: Prepare properties
multiplication = Multiplication(A=milling_bit_diameter_4, B=pinion_tooth_spacing_factor)
multiplication_2 = Multiplication(A=number_of_pinion_teeth_4, B=sample_tooth_position)
division = Division(A=milling_bit_diameter_4, B=pinion_corner_tolerance_factor)
addition = Addition(A=milling_bit_diameter_4, B=multiplication)
multiplication_3 = Multiplication(A=milling_bit_diameter_4, B="0.5")
multiplication_4 = Multiplication(A=motor_shaft_diameter_4, B="0.5")
round = Round(Number=multiplication_2)  # -> Nearest, Floor, Ceiling
multiplication_5 = Multiplication(A=number_of_pinion_teeth_4, B="2")
neg = Negative(Value=division)
multiplication_6 = Multiplication(A=milling_bit_diameter_4, B=tooth_fillet_ratio_2)
milling_bit_radius = Panel(multiplication_3)
xy = XYPlane(Origin=Point(0, 0, 0))
sample_tooth_number = Panel(round.Ceiling)
multiplication_7 = Multiplication(A=addition, B=multiplication_5)
tooth_fillet_radius = Panel(multiplication_6)
pinion_circumference = Panel(multiplication_7)
cir = Circle(Plane=xy, Radius=milling_bit_radius)
pi = Pi(Factor=1)
division_2 = Division(A=pinion_circumference, B=pi)
number_of_pinion_teeth_5 = Panel(number_of_pinion_teeth_4)
pinion_diameter = Panel(division_2)
sample_tooth_number_2 = Panel(sample_tooth_number)
number_of_curve_sample_points_2 = Panel(number_of_curve_sample_points)
multiplication_8 = Multiplication(A=pinion_diameter, B="0.5")
division_3 = Division(A=sample_tooth_number_2, B=number_of_pinion_teeth_5)
pinion_radius = Panel(multiplication_8)
pinion_circumference_2 = Panel(pinion_circumference)
multiplication_9 = Multiplication(A="360", B=division_3)
Y = UnitY(Factor=pinion_radius)
division_4 = Division(A="360", B=number_of_pinion_teeth_5)
multiplication_10 = Multiplication(A=pinion_circumference_2, B=division_3)
division_5 = Division(A=multiplication_9, B=number_of_curve_sample_points_2)
division_6 = Division(A=pinion_circumference, B=number_of_pinion_teeth_4)
move = Move(Geometry=xy, Motion=Y)  # -> Geometry, Transform
series = Series(Start=0, Step=division_4, Count=number_of_pinion_teeth_5)
division_7 = Division(A=multiplication_10, B=number_of_curve_sample_points_2)
series_2 = Series(Start=0, Step=division_5, Count=number_of_curve_sample_points_2)
tooth_spacing = Panel(division_6)
rad = Radians(Degrees=series)
circle = Circle(cir)
series_3 = Series(Start=0, Step=division_7, Count=number_of_curve_sample_points_2)
neg_2 = Negative(Value=series_2)
rotate = Rotate(Geometry=circle, Angle=rad, Plane=move.Geometry)  # -> Geometry, Transform
rad_2 = Radians(Degrees=neg_2)

# ---- group: Make step resolution statisitics
number_of_stepper_motor_steps_2 = Panel(number_of_stepper_motor_steps)
microstep_level_2 = Panel(microstep_level)
division_8 = Division(A=pinion_circumference, B=number_of_stepper_motor_steps_2)
distance_covered_per_step = Panel(division_8)
division_9 = Division(A=distance_covered_per_step, B=microstep_level_2)
distance_covered_per_micro_step = Panel(division_9)

# ---- group: Step statsistics
distance_covered_per_step_2 = Panel(distance_covered_per_step)
distance_covered_per_micro_step_2 = Panel(distance_covered_per_micro_step)

# ---- group: Create rack tooth geometry
sample_tooth_number_3 = Panel(sample_tooth_number_2)
tooth_spacing_2 = Panel(tooth_spacing)
item = ListItem(List=rotate.Geometry, Index=sample_tooth_number_3, Wrap=True)
rotate_2 = Rotate(Geometry=graft(item), Angle=rad_2, Plane=move.Geometry)  # -> Geometry, Transform
tooth_spacing_3 = Panel(tooth_spacing)
X = UnitX(Factor=series_3)
sample_tooth_number_4 = Panel(sample_tooth_number_3)
milling_it_radius = Panel(multiplication_3)
subtraction = Subtraction(A=sample_tooth_number_3, B="0.5")
move_2 = Move(Geometry=rotate_2.Geometry, Motion=X)  # -> Geometry, Transform
multiplication_11 = Multiplication(A=sample_tooth_number_4, B=tooth_spacing_3)
area = Area(Geometry=move_2.Geometry)  # -> Area, Centroid
pt = ConstructPoint(XCoordinate=multiplication_11, YCoordinate=0, ZCoordinate=0)
multiplication_12 = Multiplication(A=subtraction, B=tooth_spacing_2)
multiplication_13 = Multiplication(A=sample_tooth_number_3, B=tooth_spacing_2)
deplane = DeconstructPlane(Plane=xy)  # -> Origin, XAxis, YAxis, ZAxis
merge = Merge(Data1=flatten(area.Centroid), Data2=flatten(pt))
amp = Amplitude(Vector=deplane.YAxis, Amplitude=milling_it_radius)
amp_2 = Amplitude(Vector=deplane.XAxis, Amplitude=multiplication_12)
amp_3 = Amplitude(Vector=deplane.XAxis, Amplitude=multiplication_13)
intcrv = Interpolate(Vertices=merge, Degree=3, Periodic=False, KnotStyle=1)  # -> Curve, Length, Domain
rev = Reverse(Vector=amp)
move_3 = Move(Geometry=deplane.Origin, Motion=amp_2)  # -> Geometry, Transform
move_4 = Move(Geometry=deplane.Origin, Motion=amp_3)  # -> Geometry, Transform
move_5 = Move(Geometry=move_3.Geometry, Motion=rev)  # -> Geometry, Transform
yz = YZPlane(Origin=move_5.Geometry)
crv = Curve(intcrv.Curve)
mirror = Mirror(Geometry=crv, Plane=yz)  # -> Geometry, Transform
ccx = CurveCurve(CurveA=crv, CurveB=mirror.Geometry)  # -> Points, ParamsA, ParamsB
shatter = Shatter(Curve=crv, Parameters=ccx.ParamsA)
rev_2 = ReverseList(List=shatter)
milling_it_radius_2 = Panel(milling_it_radius)
tooth_fillet_radius_2 = Panel(tooth_fillet_radius)
item_2 = ListItem(List=rev_2, Index=0, Wrap=True)
mirror_2 = Mirror(Geometry=item_2, Plane=yz)  # -> Geometry, Transform
pt_2 = Point(move_4.Geometry)
pt_3 = Point(deplane.Origin)
addition_2 = Addition(A=tooth_fillet_radius_2, B=milling_it_radius_2)
join = JoinCurves(Curves=[item_2, mirror_2.Geometry], Preserve=False)
vec2pt = Vector2Pt(PointA=pt_2, PointB=pt_3, Unitize=False)  # -> Vector, Length
fillet = Fillet(Curve=join, Radius=addition_2)
move_6 = Move(Geometry=fillet, Motion=vec2pt.Vector)  # -> Geometry, Transform

# ---- group: Offset tooth profile to prepare for copying
tooth_spacing_4 = Panel(tooth_spacing)
milling_it_radius_3 = Panel(milling_it_radius)
tooth_profile_for_offset = Curve(move_6.Geometry)
xy_2 = XYPlane(Origin=Point(0, 0, 0))
neg_3 = Negative(Value=tooth_spacing_4)
X_2 = UnitX(Factor=tooth_spacing_4)
X_3 = UnitX(Factor=neg_3)
move_7 = Move(Geometry=tooth_profile_for_offset, Motion=X_2)  # -> Geometry, Transform
move_8 = Move(Geometry=tooth_profile_for_offset, Motion=X_3)  # -> Geometry, Transform
end = EndPoints(Curve=tooth_profile_for_offset)  # -> Start, End
join_2 = JoinCurves(Curves=flatten([move_8.Geometry, tooth_profile_for_offset, move_7.Geometry]), Preserve=False)
yz_2 = YZPlane(Origin=[end.Start, end.End])
offset = Offset(Curve=join_2, Distance=milling_it_radius_3, Plane=xy_2, Corners=2)
pcx = CurvePlane(Curve=offset, Plane=yz_2)  # -> Points, ParamsC, ParamsP
shatter_2 = Shatter(Curve=offset, Parameters=flatten(pcx.ParamsC))
item_3 = ListItem(List=shatter_2, Index="1", Wrap=True)
offset_tooth_for_copy_and_join = Curve(item_3)

# ---- group: Create rack by copying and offsetting rack tooth
tooth_spacing_5 = Panel(tooth_spacing)
rack_length_5 = Panel(rack_length_4)
milling_bit_radius_2 = Panel(multiplication_3)
tooth_profile_for_copy_and_join = Curve(offset_tooth_for_copy_and_join)
pinion_radius_2 = Panel(pinion_radius)
addition_3 = Addition(A=pinion_radius_2, B=milling_bit_radius_2)
multiplication_14 = Multiplication(A=addition_3, B="2")
addition_4 = Addition(A=rack_length_5, B=multiplication_14)
division_10 = Division(A=addition_3, B=tooth_spacing_5)
actual_rack_length = Panel(addition_4)
round_2 = Round(Number=division_10)  # -> Nearest, Floor, Ceiling
multiplication_15 = Multiplication(A=round_2.Ceiling, B=tooth_spacing_5)
division_11 = Division(A=actual_rack_length, B=tooth_spacing_5)
neg_4 = Negative(Value=addition_3)
neg_5 = Negative(Value=multiplication_15)
round_3 = Round(Number=division_11)  # -> Nearest, Floor, Ceiling
rack_start_distance = Panel(neg_5)
rack_cut_start_distance = Panel(neg_4)
addition_5 = Addition(A=round_3.Ceiling, B="1")
series_4 = Series(Start=0, Step=tooth_spacing_5, Count=addition_5)
X_4 = UnitX(Factor=rack_start_distance)
move_9 = Move(Geometry=tooth_profile_for_copy_and_join, Motion=X_4)  # -> Geometry, Transform
X_5 = UnitX(Factor=series_4)
move_10 = Move(Geometry=move_9.Geometry, Motion=X_5)  # -> Geometry, Transform
pinion_radius_3 = Panel(pinion_radius)
join_3 = JoinCurves(Curves=move_10.Geometry, Preserve=False)
neg_6 = Negative(Value=pinion_radius_3)
Y_2 = UnitY(Factor=neg_6)
move_11 = Move(Geometry=join_3, Motion=Y_2)  # -> Geometry, Transform
rack_teeth = Curve(move_11.Geometry)

# ---- group: Trim rack to specified length
rack_cut_start_distance_2 = Panel(rack_cut_start_distance)
actual_rack_length_2 = Panel(actual_rack_length)
pinion_diameter_2 = Panel(pinion_diameter)
rack_teeth_2 = Curve(rack_teeth)
pt_4 = ConstructPoint(XCoordinate=rack_cut_start_distance_2, YCoordinate=0, ZCoordinate=0)
xy_3 = XYPlane(Origin=pt_4)
neg_7 = Negative(Value=pinion_diameter_2)
rectangle = Rectangle(Plane=xy_3, XSize=actual_rack_length_2, YSize=neg_7, Radius=0)  # -> Rectangle, Length
trim = TrimWithRegion(Curve=rack_teeth_2, Region=rectangle.Rectangle)  # -> Inside, Outside
bbox = BoundingBox(Content=trim.Inside, Plane=PlaneXY(0, 0, 0))  # -> Box, Box_2
edges = BrepEdges(Brep=bbox.Box)  # -> Naked, Interior, NonManifold
item_4 = ListItem(List=edges.Naked, Index="2", Wrap=True)
flip = FlipCurve(Curve=item_4)  # -> Curve, Flag
rack_tooth_edge = Curve(flip.Curve)
trimmed_rack_teeth = Curve(trim.Inside)

# ----
distance_covered_per_step_3 = Panel(distance_covered_per_step)
distance_covered_per_step_4 = Number(distance_covered_per_step_3)
rack_teeth_3 = Curve(trimmed_rack_teeth)
rack_edge = Curve(rack_tooth_edge)
rack_teeth_4 = ClusterOutput(rack_teeth_3)
rack_edge_2 = ClusterOutput(rack_edge)
distance_covered_per_step_5 = ClusterOutput(distance_covered_per_step_4)

# ---- group: Create and blend pinion teeth
eval = EvaluateLength(Curve=fillet, Length="0.5", Normalized=True)  # -> Point, Tangent, Parameter
pdecon = Deconstruct(Point=eval.Point)  # -> XComponent, YComponent, ZComponent
milling_it_radius_4 = Panel(milling_bit_radius)
pinion_corner_tolerance = Panel(neg)
subtraction_2 = Subtraction(A=pdecon.YComponent, B=milling_it_radius_4)
subtraction_3 = Subtraction(A=subtraction_2, B=milling_it_radius_4)
subtraction_4 = Subtraction(A=subtraction_3, B=pinion_corner_tolerance)
pt_5 = ConstructPoint(XCoordinate=0, YCoordinate=subtraction_4, ZCoordinate=0)
rounding_factor_pinion_outside_2 = Panel(rounding_factor_pinion_outside)
xy_4 = XYPlane(Origin=pt_5)
division_12 = Division(A="360", B=multiplication_5)
rounding_factor_pinion_inside_2 = Panel(rounding_factor_pinion_inside)
subtraction_5 = Subtraction(A="0", B=rounding_factor_pinion_outside_2)
addition_6 = Addition(A="180", B=rounding_factor_pinion_outside_2)
rad_3 = Radians(Degrees=addition_6)
rad_4 = Radians(Degrees=subtraction_5)
subtraction_6 = Subtraction(A="180", B=rounding_factor_pinion_inside_2)
addition_7 = Addition(A="0", B=rounding_factor_pinion_inside_2)
milling_it_radius_5 = Panel(milling_it_radius_4)
dom = ConstructDomain(DomainStart=rad_4, DomainEnd=rad_3)
xy_5 = XYPlane(Origin=Point(0, 0, 0))
rad_5 = Radians(Degrees=subtraction_6)
rad_6 = Radians(Degrees=addition_7)
dom_2 = ConstructDomain(DomainStart=rad_6, DomainEnd=rad_5)
pi_2 = Pi(Factor=1)
arc = Arc(Plane=xy_5, Radius=milling_it_radius_5, Angle=dom)  # -> Arc, Length
arc_2 = Arc(Plane=xy_4, Radius=milling_it_radius_5, Angle=dom_2)  # -> Arc, Length
rad_7 = Radians(Degrees=division_12)
rotate_3 = Rotate(Geometry=arc.Arc, Angle=pi_2, Plane=xy_5)  # -> Geometry, Transform
addition_8 = Addition(A=rad, B=rad_7)
number_slider = Slider(0.5, range=0..1)
rotate_4 = Rotate(Geometry=rotate_3.Geometry, Angle=rad, Plane=move.Geometry)  # -> Geometry, Transform
rotate_5 = Rotate(Geometry=arc_2.Arc, Angle=addition_8, Plane=move.Geometry)  # -> Geometry, Transform
flip_2 = FlipCurve(Curve=rotate_4.Geometry)  # -> Curve, Flag
flip_3 = FlipCurve(Curve=rotate_5.Geometry)  # -> Curve, Flag
pinion_radius_4 = Panel(pinion_radius)
shift = ShiftList(List=flip_2.Curve, Shift=1, Wrap=True)
blendc = BlendCurve(CurveA=rotate_4.Geometry, CurveB=flip_3.Curve, BulgeA=number_slider, BulgeB=number_slider, Continuity=2)
blendc_2 = BlendCurve(CurveA=shift, CurveB=rotate_5.Geometry, BulgeA=number_slider, BulgeB=number_slider, Continuity=2)
neg_8 = Negative(Value=pinion_radius_4)
Y_3 = UnitY(Factor=neg_8)
cir_2 = Circle(Plane=move.Geometry, Radius=multiplication_4)
join_4 = JoinCurves(Curves=flatten([rotate_4.Geometry, rotate_5.Geometry, blendc, blendc_2]), Preserve=False)
move_12 = Move(Geometry=join_4, Motion=Y_3)  # -> Geometry, Transform
pinion_teeth = Curve(move_12.Geometry)

# ----
move_13 = Move(Geometry=cir_2, Motion=Y_3)  # -> Geometry, Transform

# ---- group: Create and blend pinion teeth (continued)
pinion_center_hole = Curve(move_13.Geometry)

# ---- group: Create pinion movement preview
preview_position_0_1_3 = Number(preview_position_0_1_2)
pinion_radius_5 = Panel(pinion_radius)
pinion_circumference_3 = Panel(pinion_circumference)
multiplication_16 = Multiplication(A="360", B=preview_position_0_1_3)
multiplication_17 = Multiplication(A=pinion_circumference_3, B=preview_position_0_1_3)
neg_9 = Negative(Value=multiplication_16)
X_6 = UnitX(Factor=multiplication_17)
rad_8 = Radians(Degrees=neg_9)
rotate_6 = Rotate(Geometry=flatten([join_4, cir_2]), Angle=rad_8, Plane=move.Geometry)  # -> Geometry, Transform
move_14 = Move(Geometry=rotate_6.Geometry, Motion=X_6)  # -> Geometry, Transform
neg_10 = Negative(Value=pinion_radius_5)
Y_4 = UnitY(Factor=neg_10)
move_15 = Move(Geometry=move_14.Geometry, Motion=Y_4)  # -> Geometry, Transform
pinion_movement_preview = Curve(move_15.Geometry)

# ---- group: Make pinion bit statisitics
pinion_radius_6 = Panel(pinion_radius)
rotate_7 = Rotate(Geometry=move.Geometry, Angle=4.71238898, Plane=move.Geometry)  # -> Geometry, Transform
pinion_teeth_2 = Curve(join_4)
cir_3 = Circle(Plane=rotate_7.Geometry, Radius=pinion_radius_6)
trim_2 = TrimWithRegion(Curve=cir_3, Region=pinion_teeth_2)  # -> Inside, Outside
item_5 = ListItem(List=trim_2.Outside, Index=0, Wrap=True)
len = Length(Curve=flatten(item_5))
maxium_pinion_milling_bit_diamter = Panel(len)

# ----
maxium_pinion_milling_bit_diamter_2 = Panel(maxium_pinion_milling_bit_diamter)
maxium_pinion_milling_bit_diamter_3 = Number(maxium_pinion_milling_bit_diamter_2)
pinion_movement_preview_2 = Curve(pinion_movement_preview)
pinion_center_hole_2 = Curve(pinion_center_hole)
pinion_teeth_3 = Curve(pinion_teeth)
pinion_teeth_4 = ClusterOutput(pinion_teeth_3)
pinion_center_hole_3 = ClusterOutput(pinion_center_hole_2)
pinion_movement_preview_3 = ClusterOutput(pinion_movement_preview_2)
maxium_pinion_milling_bit_diamter_4 = ClusterOutput(maxium_pinion_milling_bit_diamter_3)

pinion_radius_7 = Panel(pinion_radius)
milling_bit_radius_3 = Panel(multiplication_3)
addition_9 = Addition(A=pinion_radius_7, B=milling_bit_radius_3)
cir_4 = Circle(Plane=move.Geometry, Radius=addition_9)

move_16 = Move(Geometry=cir_4, Motion=Y_3)  # -> Geometry, Transform

pinion_edge = Curve(move_16.Geometry)

pinion_edge_2 = Curve(pinion_edge)
pinion_edge_3 = ClusterOutput(pinion_edge_2)
